# Dynamo graph 01-SWITCH JOIN-FRAMING SLAB COLUMN.dyn (Dynamo 0.9.1.4062)

string = StringInput("""import clr
clr.AddReference('ProtoGeometry')
from Autodesk.DesignScript.Geometry import *
clr.AddReference('RevitAPI')
from Autodesk.Revit.DB import *
clr.AddReference('RevitAPIUI')
from Autodesk.Revit.UI import TaskDialog
clr.AddReference("RevitNodes")
import Revit
clr.ImportExtensions(Revit.Elements)
clr.AddReference("RevitServices")
import RevitServices
from RevitServices.Persistence import DocumentManager
from RevitServices.Transactions import TransactionManager
from System.Collections.Generic import *
clr.ImportExtensions(Revit.GeometryConversion)
 
doc = DocumentManager.Instance.CurrentDBDocument
uiapp = DocumentManager.Instance.CurrentUIApplication
app = uiapp.Application
 
import sys
import System

import Autodesk.Revit.DB.JoinGeometryUtils as JGU
#The inputs to this node will be stored as a list in the IN variables.
dataEnteringNode = IN

elems = UnwrapElement(IN[0])
res = []

finRes = []

if not len(elems) == 0:
 for e in elems:
  je = JGU.GetJoinedElements(doc,e)
  ees = []
  for id in je:
   ee = doc.GetElement(id)
   ees.append(ee)   
  res.append(ees)
 finRes.append(elems)
 finRes.append(res)
else:
 finRes = 0

#Assign your output to the OUT variable.
OUT = finRes""")
# note: [0] Chọn toàn bộ các Cấu kiện KC theo Tầng
# note: Thứ tự ưu tiên JOIN;
# 1. Móng
# 2. DẦM
# 3. SÀN
# 4. CỘT
# 5. TƯỜNG
select_model_elements = DSModelElementsSelection()  # 1983 picked in the model

# group: Lọc theo category
code_block = CodeBlock { "Structural Foundations"; "Structural Columns"; "Walls"; "Structural Framing"; "Floors"; }
python_script = Python(IN[0]=select_model_elements, IN[1]=code_block.out0, IN[2]=code_block.out1, IN[3]=code_block.out2, IN[4]=code_block.out3, IN[5]=code_block.out4)
# ---------- python_script.python (60 lines) ----------
import clr
clr.AddReference('ProtoGeometry')
from Autodesk.DesignScript.Geometry import *
clr.AddReference('RevitAPI')
from Autodesk.Revit.DB import *
clr.AddReference('RevitAPIUI')
from Autodesk.Revit.UI import TaskDialog
clr.AddReference("RevitNodes")
import Revit
clr.ImportExtensions(Revit.Elements)
clr.AddReference("RevitServices")
import RevitServices
from RevitServices.Persistence import DocumentManager
from RevitServices.Transactions import TransactionManager
from System.Collections.Generic import *
clr.ImportExtensions(Revit.GeometryConversion)
 
doc = DocumentManager.Instance.CurrentDBDocument
uiapp = DocumentManager.Instance.CurrentUIApplication
app = uiapp.Application
 
import sys
import System
import Autodesk.Revit.DB.JoinGeometryUtils as JGU # de Join

#The inputs to this node will be stored as a list in the IN variables.
dataEnteringNode = IN

elems = UnwrapElement(IN[0])
f=IN[1]
c=IN[2]
w=IN[3]
fr=IN[4]
fl=IN[5]


FD=[]
SC=[]
SW=[]
SFR=[]
SFL=[]

res = []

for e in elems:
	if e.Category.Name == f:
		FD.append(e)
	elif e.Category.Name == c:
		SC.append(e)
	elif e.Category.Name == w:
		SW.append(e)
	elif e.Category.Name == fr:
		SFR.append(e)
	elif e.Category.Name == fl:
		SFL.append(e)
	else:
		res.append(e)

#Assign your output to the OUT variable.
OUT = FD,SC,SW,SFR,SFL,res
# ----------------------------------------
code_block_2 = CodeBlock(elemList=python_script)
# ---------- code_block_2.designscript (6 lines) ----------
elemList;
foundations = elemList[0];
columns = elemList[1];
walls = elemList[2];
framings = elemList[3];
floors = elemList[4];
# ----------------------------------------

# note: Tìm các cá thể join với đối tượng lọc
python_script_from_string = PythonStringNode(script=string, IN[0]=code_block_2.foundations)
python_script_from_string_2 = PythonStringNode(script=string, IN[0]=code_block_2.walls)
python_script_from_string_3 = PythonStringNode(script=string, IN[0]=code_block_2.framings)
nếu_cut_thì_switch_join = StringInput("""import clr
clr.AddReference('ProtoGeometry')
from Autodesk.DesignScript.Geometry import *
clr.AddReference('RevitAPI')
from Autodesk.Revit.DB import *
clr.AddReference('RevitAPIUI')
from Autodesk.Revit.UI import TaskDialog
clr.AddReference("RevitNodes")
import Revit
clr.ImportExtensions(Revit.Elements)
clr.AddReference("RevitServices")
import RevitServices
from RevitServices.Persistence import DocumentManager
from RevitServices.Transactions import TransactionManager
from System.Collections.Generic import *
clr.ImportExtensions(Revit.GeometryConversion)
 
doc = DocumentManager.Instance.CurrentDBDocument
uiapp = DocumentManager.Instance.CurrentUIApplication
app = uiapp.Application
 
import sys
import System
import Autodesk.Revit.DB.JoinGeometryUtils as JGU # de Join 

#The inputs to this node will be stored as a list in the IN variables.
dataEnteringNode = IN

list = IN[0]

res = []

# Start Transaction
TransactionManager.Instance.EnsureInTransaction(doc)
try:
 for l in list:
  A = UnwrapElement(l[0])
  jes = l[1]
  
  for j in jes:
   B = UnwrapElement(j)
   boolCut = JGU.IsCuttingElementInJoin(doc,A,B)
   if boolCut == True:
    JGU.SwitchJoinOrder(doc,B,A)
except:
    pass
 
# End Transaction
TransactionManager.Instance.TransactionTaskDone()
doc.Regenerate()

#Assign your output to the OUT variable.
OUT = list""")
nếu_empty_thì_loại_bỏ = StringInput("""import clr
clr.AddReference('ProtoGeometry')
from Autodesk.DesignScript.Geometry import *
#The inputs to this node will be stored as a list in the IN variables.
dataEnteringNode = IN
list = IN[0]
res = []
for l in list:
 e = l[0]
 je = l[1] 
 if len(je) == 0:
  res.append(l)
  list.remove(l)
#Assign your output to the OUT variable.
OUT = list#,res""")
python_script_from_string_4 = PythonStringNode(script=string, IN[0]=code_block_2.columns)

# group: Switch Join process for Floors
transpose = List.Transpose(python_script_from_string_4)
python_script_from_string_5 = PythonStringNode(script=nếu_empty_thì_loại_bỏ, IN[0]=transpose)
python_script_from_string_6 = PythonStringNode(script=nếu_cut_thì_switch_join, IN[0]=python_script_from_string_5)

python_script_from_string_7 = PythonStringNode(script=string, IN[0]=code_block_2.floors)

# group: Switch Join process for Floors
transpose_2 = List.Transpose(python_script_from_string_7)
python_script_from_string_8 = PythonStringNode(script=nếu_empty_thì_loại_bỏ, IN[0]=transpose_2)
python_script_from_string_9 = PythonStringNode(script=nếu_cut_thì_switch_join, IN[0]=python_script_from_string_8)
