# Dynamo graph 02-FLOOR BY ROOM.dyn (Dynamo 0.9.1.4062)

select_model_elements = DSModelElementsSelection()  # 10 picked in the model
solids = Element.Solids(select_model_elements)
flatten = Flatten(solids)
explode = Geometry.Explode(flatten)
code_block = CodeBlock { 0.5; }
normalAtParameter = Surface.NormalAtParameter(surface=explode, u=code_block, v=code_block)
python_script_tim_chi_so_mp_nam = Python(IN[0]=normalAtParameter)  # "Python Script-Tim chi so MP nam duoi"
# ---------- python_script_tim_chi_so_mp_nam.python (17 lines) ----------
import clr
clr.AddReference('ProtoGeometry')
from Autodesk.DesignScript.Geometry import *
#The inputs to this node will be stored as a list in the IN variables.
dataEnteringNode = IN

listlistVec = IN[0]
res = []
for list in listlistVec:
	newlist = []
	for i in range(len(list)):
		if list[i].Z == -1:
			newlist.append(i)
	res.append(newlist)
		
#Assign your output to the OUT variable.
OUT = res
# ----------------------------------------
python_script_lay_mp = Python(IN[0]=python_script_tim_chi_so_mp_nam, IN[1]=explode)
# ---------- python_script_lay_mp.python (17 lines) ----------
import clr
clr.AddReference('ProtoGeometry')
from Autodesk.DesignScript.Geometry import *
#The inputs to this node will be stored as a list in the IN variables.
dataEnteringNode = IN

dsChiSo = IN[0]
dsMP = IN[1]


res = []
for i in range(len(dsChiSo)):
	res.append(dsMP[i][dsChiSo[i][0]])
		
#Assign your output to the OUT variable.
OUT = res
	
# ----------------------------------------
perimeterCurves = Surface.PerimeterCurves(python_script_lay_mp)
loai_san = StringInput("Basic Finish Floor 50mm")
byName = FloorType.ByName(loai_san)
levels = Levels("Level 1")
byOutlineTypeAndLevel = Floor.ByOutlineTypeAndLevel(outlineCurves=perimeterCurves, floorType=byName, level=levels)
thong_tin_input_cho_san = CodeBlock { "RoomName"; }
code_block_2 = CodeBlock { "Name"; }
getParameterValueByName = Element.GetParameterValueByName(element=select_model_elements, parameterName=code_block_2)
setParameterByName = Element.SetParameterByName(element=byOutlineTypeAndLevel, parameterName=thong_tin_input_cho_san, value=getParameterValueByName)
code_block_3 = CodeBlock(elem=select_model_elements) { elem[0]; }
parameters = Element.Parameters(code_block_3)
