# Dynamo graph 02-FW BY FACE.dyn (Dynamo 0.9.1.4062)

# note: View--> show all part and origin ---->
select_merged_part = DSModelElementSelection()  # frozen
python_script = Python()
# ---------- python_script.python (24 lines) ----------
# Importing Reference Modules
import clr
clr.AddReference('ProtoGeometry')
import Autodesk
from Autodesk.DesignScript.Geometry import *

# create empty lists to store values
subDir = []

# give geometry a nickname for easy reference
geo = Autodesk.DesignScript.Geometry

# dir returns a list of module/class/object attributes
# for each item in topDir
for i in dir(geo) :
	# create a string equivalent to geo.i
	# eg 'Autodesk.DesignScript.Geometry.Application'
	dir_str = getattr(geo, i)
	# to find nested dir
	# append to subDir the dir of dir(geo)
	subDir.append(dir(dir_str))

# output dir(geo) and sub dir
OUT = dir(geo), subDir
# ----------------------------------------
string = StringInput("""# Importing Reference Modules
import clr
clr.AddReference('ProtoGeometry')
import Autodesk
from Autodesk.DesignScript.Geometry import *

# create empty lists to store values
subDir = []

# give geometry a nickname for easy reference
geo = Autodesk.DesignScript.Geometry

# dir returns a list of module/class/object attributes
# for each item in topDir
for i in dir(geo) :
 # create a string equivalent to geo.i
 # eg 'Autodesk.DesignScript.Geometry.Application'
 dir_str = getattr(geo, i)
 # to find nested dir
 # append to subDir the dir of dir(geo)
 subDir.append(dir(dir_str))

# output dir(geo) and sub dir
OUT = dir(geo), subDir""")
select_original_elements = DSModelElementsSelection()  # 55 picked in the model
solids = Element.Solids(select_original_elements)
flatten = Flatten(solids)
byUnion = Solid.ByUnion(flatten)
explode = Geometry.Explode(byUnion)
flatten_2 = Flatten(explode)
code_block = CodeBlock(listSurface=flatten_2) { listSurface; }
code_block_2 = CodeBlock { 0.5; }
normalAtParameter = Surface.NormalAtParameter(surface=code_block, u=code_block_2, v=code_block_2)
Z = Vector.Z(normalAtParameter)
code_block_3 = CodeBlock { 1; -1; }
eq = Z == code_block_3.out0
filterByBoolMask = List.FilterByBoolMask(list=code_block, mask=eq)
pointAtParameter = Surface.PointAtParameter(surface=filterByBoolMask.out, u=code_block_2, v=code_block_2)
Z_2 = Point.Z(pointAtParameter)
boolean = BoolSelector(true)
sortIndexByValue = SortIndexByValue(Z_2, boolean)
getItemAtIndex = List.GetItemAtIndex(list=filterByBoolMask.out, index=sortIndexByValue)
deconstruct = List.Deconstruct(list=getItemAtIndex)
code_block_4 = CodeBlock(surface=deconstruct.rest) { surface; }
code_block_5 = CodeBlock { 20; }
boolean_2 = BoolSelector(false)
thicken = Surface.Thicken(surface=code_block_4, thickness=code_block_5, both_sides=boolean_2)
deconstruct_2 = List.Deconstruct(list=thicken)
unionAll = Solid.UnionAll(deconstruct_2.first, deconstruct_2.rest)
select_box_of_lowest_beam_bottom = DSModelElementsSelection()  # "Select Box of lowest Beam bottom face"; 1 picked in the model
solids_2 = Element.Solids(select_box_of_lowest_beam_bottom)
difference = Solid.Difference(solid=unionAll, other=solids_2)
file_path = Filename("C:\Users\USER\Documents\MARUBENI COFFEE\BIM QTO\frame part")
exportToSAT = ExportWithUnits(difference, file_path, exportedUnit=Millimeters)
boundingBox = Element.BoundingBox(select_box_of_lowest_beam_bottom)
select_box_of_the_rest_of_column = DSModelElementsSelection()  # "Select Box of the rest of Column and Wall"; 1 picked in the model
solids_3 = Element.Solids(select_box_of_the_rest_of_column)
difference_2 = Solid.Difference(solid=unionAll, other=solids_3)
file_path_2 = Filename("C:\Users\USER\Documents\MARUBENI COFFEE\BIM QTO\column part")
exportToSAT_2 = ExportWithUnits(difference_2, file_path_2, exportedUnit=Millimeters)
difference_3 = Solid.Difference()
