# Dynamo graph 04-MATCHING PARAM VALUE btw INTERSECTED ELEMS.dyn (Dynamo 0.9.1.4062)

string = StringInput("Category")
chọn_các_đối_tượng_móng_cột = DSModelElementsSelection()  # 10 picked in the model
getParameterValueByName = Element.GetParameterValueByName(element=chọn_các_đối_tượng_móng_cột)
string_from_object = FromObject(getParameterValueByName)
string_2 = StringInput("OST_StructuralFoundation")
byName = Category.ByName(string_2)
string_from_object_2 = FromObject(byName)
eq = string_from_object == string_from_object_2
filterByBoolMask = List.FilterByBoolMask(list=chọn_các_đối_tượng_móng_cột, mask=eq)
string_3 = StringInput("OST_StructuralColumns")
byName_2 = Category.ByName(string_3)
string_from_object_3 = FromObject(byName_2)
eq_2 = string_from_object == string_from_object_3
filterByBoolMask_2 = List.FilterByBoolMask(list=chọn_các_đối_tượng_móng_cột, mask=eq_2)
code_block = CodeBlock(foundations=filterByBoolMask.in, columns=filterByBoolMask_2.in) { foundations; columns; }
python_script_get_join_elements = Python(IN[0]=code_block.columns)
# ---------- python_script_get_join_elements.python (42 lines) ----------
import clr
clr.AddReference('ProtoGeometry')
from Autodesk.DesignScript.Geometry import *
clr.AddReference('RevitAPI')
from Autodesk.Revit.DB import *
clr.AddReference('RevitAPIUI')
from Autodesk.Revit.UI import TaskDialog
clr.AddReference("RevitNodes")
import Revit
clr.ImportExtensions(Revit.Elements)
clr.AddReference("RevitServices")
import RevitServices
from RevitServices.Persistence import DocumentManager
from RevitServices.Transactions import TransactionManager
from System.Collections.Generic import *
clr.ImportExtensions(Revit.GeometryConversion)
 
doc = DocumentManager.Instance.CurrentDBDocument
uiapp = DocumentManager.Instance.CurrentUIApplication
app = uiapp.Application
 
import sys
import System
import Autodesk.Revit.DB.JoinGeometryUtils as JGU # de Join 

#The inputs to this node will be stored as a list in the IN variables.
dataEnteringNode = IN

list = IN[0]

res = []

for l in list:
	joinElems = []
	elem = doc.GetElement(UnwrapElement(l).Id)
	joinElems.Add(JGU.GetJoinedElements(doc,elem))
	
	res.append(joinElems)


#Assign your output to the OUT variable.
OUT = res
# ----------------------------------------
solids = Element.Solids(code_block.foundations)
python_script_unionall = Python(IN[0]=solids)
# ---------- python_script_unionall.python (16 lines) ----------
import clr
clr.AddReference('ProtoGeometry')
from Autodesk.DesignScript.Geometry import *
#The inputs to this node will be stored as a list in the IN variables.
dataEnteringNode = IN
listSol = IN[0]

newlist = []
for list in listSol:
	
	sol = list[0]
	union = sol.UnionAll(list)
	newlist.append(union)
		
#Assign your output to the OUT variable.
OUT = newlist
# ----------------------------------------
solids_2 = Element.Solids(code_block.columns)
python_script_unionall_2 = Python(IN[0]=solids_2)  # same code as python_script_unionall
python_script = Python(IN[0]=python_script_unionall, IN[1]=python_script_unionall_2, IN[2]=code_block.foundations, IN[3]=code_block.columns)
# ---------- python_script.python (26 lines) ----------
import clr
clr.AddReference('ProtoGeometry')
from Autodesk.DesignScript.Geometry import *
#The inputs to this node will be stored as a list in the IN variables.
dataEnteringNode = IN

sol1 = IN[0]
sol2 = IN[1]

elem1 = IN[2]
elem2 = IN[3]

res = []

for i in range(len(sol1)):
	list = []
	list.append(elem1[i])
	for j in range(len(sol2)):	
		if sol1[i].	DoesIntersect(sol2[j]):			
			list.append(elem2[j])
	if len(list) > 1:
		res.append(list)

	
#Assign your output to the OUT variable.
OUT = res
# ----------------------------------------
parameter_a_name = StringInput("Comments")
parameter_b_name = StringInput("Comments")
python_script_2 = Python(IN[0]=python_script, IN[1]=parameter_a_name, IN[2]=parameter_b_name)
# ---------- python_script_2.python (45 lines) ----------
import clr
clr.AddReference('ProtoGeometry')
from Autodesk.DesignScript.Geometry import *
clr.AddReference('RevitAPI')
from Autodesk.Revit.DB import *
clr.AddReference('RevitAPIUI')
from Autodesk.Revit.UI import TaskDialog
clr.AddReference("RevitNodes")
import Revit
clr.ImportExtensions(Revit.Elements)
clr.AddReference("RevitServices")
import RevitServices
from RevitServices.Persistence import DocumentManager
from RevitServices.Transactions import TransactionManager
from System.Collections.Generic import *
clr.ImportExtensions(Revit.GeometryConversion)
 
doc = DocumentManager.Instance.CurrentDBDocument
uiapp = DocumentManager.Instance.CurrentUIApplication
app = uiapp.Application
#The inputs to this node will be stored as a list in the IN variables.
dataEnteringNode = IN

LL = IN[0]

paramA = IN[1]
paramB = IN[2]


# Start Transaction
TransactionManager.Instance.EnsureInTransaction(doc)
try:
	for list in LL:
		B = list[0].GetParameterValueByName(paramA)
		for i in range(1,len(list)):		
			list[i].SetParameterByName(paramB,B)
except:
    pass
 
# End Transaction
TransactionManager.Instance.TransactionTaskDone()
doc.Regenerate()

#Assign your output to the OUT variable.
OUT = 0
# ----------------------------------------
