# Dynamo graph 07-READ SHARE PARAM.dyn (Dynamo 0.9.1.4062)

file_path = Filename("C:\Users\USER\Documents\MARUBENI COFFEE\QTO SHARE PARAM.txt")
fromPath = FileObject(file_path)  # "File.FromPath"
string_from_object = FromObject(file_path)
length = String.Length(string_from_object)
string = StringInput(".txt")
length_2 = String.Length(string)
string_2 = StringInput("\")
lastIndexOf = String.LastIndexOf(string_from_object, string_2)
code_block = CodeBlock(l0=length, l1=length_2, l2=lastIndexOf, i=lastIndexOf) { l = l0 - l1-l2-1; si  = i+1; }
substring = String.Substring(str=string_from_object, startIndex=code_block.si, length=code_block.l)
readFromFile = Excel.ReadFromFile(file=fromPath, sheetName=substring)
code_block_2 = CodeBlock { 8; }
dropItems = List.DropItems(list=readFromFile, amount=code_block_2)
transpose = List.Transpose(dropItems)
code_block_3 = CodeBlock(param=transpose)
# ---------- code_block_3.designscript (4 lines) ----------
param[2];
//parameter name;
param[3];
//unit TYPE;
# ----------------------------------------
watch = Watch(code_block_3.out0)
readText = File.ReadText(fromPath)
watch_2 = Watch(readText)
code_block_4 = CodeBlock { "Foundation"; "Column"; "Framing"; "Slab"; "Wall"; "Floor"; }
contains = String.Contains(str=code_block_3.out0, searchFor=code_block_4.out0)
filterByBoolMask = List.FilterByBoolMask(list=code_block_3.out0, mask=contains)
filterByBoolMask_2 = List.FilterByBoolMask(list=code_block_3.out1, mask=contains)
code_block_5 = CodeBlock { "VOLUME"; "AREA"; }
contains_2 = String.Contains(str=filterByBoolMask_2.in, searchFor=code_block_5.out0)
contains_3 = String.Contains(str=filterByBoolMask_2.in, searchFor=code_block_5.out1)
