# Dynamo graph 09-ISOLATED FOUNDATION EXCAVATION.dyn (Dynamo 0.9.1.4062)

string = StringInput("OST_StructuralFoundation")  # frozen
byName = Category.ByName(string)
all_elements_of_category = ElementsOfCategory(byName)
select_model_elements = DSModelElementsSelection()  # 97 picked in the model
category_name = StringInput("Structural Foundations")
filter_foundations = Python(IN[0]=select_model_elements, IN[1]=category_name)
# ---------- filter_foundations.python (17 lines) ----------
import clr
clr.AddReference('ProtoGeometry')
from Autodesk.DesignScript.Geometry import *
#The inputs to this node will be stored as a list in the IN variables.
dataEnteringNode = IN
elems = IN[0]
cateName = IN[1]

res = []

for e in elems:
	ee = UnwrapElement(e)
	if ee.Category.Name == cateName:
		res.append(e)

#Assign your output to the OUT variable.
OUT = res
# ----------------------------------------
code_block = CodeBlock(elems=filter_foundations) { elems; }
code_block_2 = CodeBlock { "Elevation at Top"; "Elevation at Bottom"; "Width"; "Length"; }
facingOrientation = FamilyInstance.FacingOrientation(code_block)  # frozen
XAxis = Vector.XAxis()
angleBetween = Vector.AngleBetween(facingOrientation, XAxis)

# group: Radian to Degree
number = DoubleInput(57.296)
mul = angleBetween * number

watch = Watch(mul)
excavate_hole_family_type_name = StringInput("Excavate Hole-Taluy")
byName_2 = FamilyType.ByName(excavate_hole_family_type_name)
location = FamilyInstance.Location(code_block)
X = Point.X(location)
Y = Point.Y(location)
level_of_nature_ground_soil = Levels("Exc LV")  # "Level of Nature Ground Soil Surface"
elevation = Level.Elevation(level_of_nature_ground_soil)

# group: foundation parameter value
getParameterValueByName = Element.GetParameterValueByName(element=code_block, parameterName=code_block_2.out0)
getParameterValueByName_2 = Element.GetParameterValueByName(element=code_block, parameterName=code_block_2.out1)
sub = elevation - getParameterValueByName_2
getParameterValueByName_3 = Element.GetParameterValueByName(element=code_block, parameterName=code_block_2.out2)
getParameterValueByName_4 = Element.GetParameterValueByName(element=code_block, parameterName=code_block_2.out3)
id = Element.Id(code_block)

byCoordinates = Point.ByCoordinates(x=X, y=Y, z=elevation)
byPoint = FamilyInstance.ByPoint(familyType=byName_2, point=byCoordinates)
code_block_3 = CodeBlock(elems=byPoint) { elems; }
code_block_4 = CodeBlock()
# ---------- code_block_4.designscript (14 lines) ----------
"Height";
"Width";
"Length";
"Comments";
"HostID1";
"TrackingHostID1";
"ExcavationTaluyAngleToX";
"VolumeExcavatedSoilPrimitive";
"VolumeExcavatedSoilMerged";
"VolumeBackfillSoil";
"AreaBOFImpactmentPrimitive";
"AreaBOFImpactmentMerged";
"AreaTOESImpactmentPrimitive";
"AreaTOESImpactmentMerged";
# ----------------------------------------
setParameterByName = Element.SetParameterByName(element=code_block_3, parameterName=code_block_4.out0, value=sub)
setParameterByName_2 = Element.SetParameterByName(element=setParameterByName, parameterName=code_block_4.out1, value=getParameterValueByName_3)
setParameterByName_3 = Element.SetParameterByName(element=setParameterByName_2, parameterName=code_block_4.out2, value=getParameterValueByName_4)
python_script_rotation = Python(IN[0]=code_block)
# ---------- python_script_rotation.python (19 lines) ----------
import clr
clr.AddReference('ProtoGeometry')
from Autodesk.DesignScript.Geometry import *
clr.AddReference('RevitAPI')
from Autodesk.Revit.DB import *
#The inputs to this node will be stored as a list in the IN variables.
dataEnteringNode = IN

elems = UnwrapElement(IN[0])
results = []
#if listcount = 1

#if listcount > 1
for i in range(len(elems)):
	rot = round(elems[i].Location.Rotation * 57.2957795,0)
	results.append(rot)

#Assign your output to the OUT variable.
OUT = results
# ----------------------------------------
code_block_5 = CodeBlock(a=python_script_rotation) { 0-a; }
setRotation = FamilyInstance.SetRotation(familyInstance=code_block_3, degree=code_block_5)
code_block_6 = CodeBlock(list=setParameterByName) { list[0]; }
parameters = Element.Parameters(code_block_6)
watch_2 = Watch(parameters)
code_block_7 = CodeBlock(list=code_block) { list[0]; }
parameters_2 = Element.Parameters(code_block_7)
watch_3 = Watch(parameters_2)
file_path = Filename("C:\Users\USER\Documents\MARUBENI COFFEE\BIM QTO\Dynamo Data-Foundation.xlsx")  # frozen
fromPath = FileObject(file_path)  # "File.FromPath"
sheet_name = StringInput("Excavation")
code_block_8 = CodeBlock()
# ---------- code_block_8.designscript (2 lines) ----------
3;
//start row #
# ----------------------------------------
code_block_9 = CodeBlock()
# ---------- code_block_9.designscript (24 lines) ----------
0;
//ids;
1;
//hostIds1;
2;
//trackingHostIds1;
3;
//gfElevations;
4;
//taluyAngles;
5;
//volumePrims;
6;
//volumeJoined;
7;
//impBFPrimi;
8;
//impBFMerged;
9;
//impTF;
10;
//impMerged;
11;
//volumeBF;
# ----------------------------------------
overwrite = BoolSelector(false)
code_block_10 = CodeBlock { elemFinishModified; }  # frozen

# group: Excavation Hole Param value
code_block_11 = CodeBlock(elems=code_block_10) { elems; }
id_2 = Element.Id(code_block_11)
code_block_12 = CodeBlock()
# ---------- code_block_12.designscript (10 lines) ----------
"HostID1";
"TrackingHostID1";
"ExcavationTaluyAngleToX";
"VolumeExcavatedSoilPrimitive";
"VolumeExcavatedSoilMerged";
"VolumeBackfillSoil";
"AreaBOFImpactmentPrimitive";
"AreaBOFImpactmentMerged";
"AreaTOESImpactmentPrimitive";
"AreaTOESImpactmentMerged";
# ----------------------------------------
code_block_13 = CodeBlock(elem=code_block_11, paramName=code_block_12.out0) { value = elem.GetParameterValueByName(paramName); }
code_block_14 = CodeBlock(elem=code_block_11, paramName=code_block_12.out1) { value = elem.GetParameterValueByName(paramName); }
code_block_15 = CodeBlock { "Offset"; }
code_block_16 = CodeBlock(elem=code_block_11, paramName=code_block_12.out2) { value = elem.GetParameterValueByName(paramName); }

code_block_17 = CodeBlock(elem=code_block_11, paramName=code_block_15) { value = elem.GetParameterValueByName(paramName); }
code_block_18 = CodeBlock(elem=code_block_11, paramName=code_block_12.out3) { value = elem.GetParameterValueByName(paramName); }
code_block_19 = CodeBlock(elem=code_block_11, paramName=code_block_12.out4) { value = elem.GetParameterValueByName(paramName); }
code_block_20 = CodeBlock(elem=code_block_11, paramName=code_block_12.out6) { value = elem.GetParameterValueByName(paramName); }
code_block_21 = CodeBlock(elem=code_block_11, paramName=code_block_12.out7) { value = elem.GetParameterValueByName(paramName); }
code_block_22 = CodeBlock(elem=code_block_11, paramName=code_block_12.out8) { value = elem.GetParameterValueByName(paramName); }
code_block_23 = CodeBlock(elem=code_block_11, paramName=code_block_12.out9) { value = elem.GetParameterValueByName(paramName); }
code_block_24 = CodeBlock(elem=code_block_11, paramName=code_block_12.out5) { value = elem.GetParameterValueByName(paramName); }
data = CodeBlock(ids=id_2, hostIds1=code_block_13, trackingHostIds1=code_block_14, gfElevations=code_block_17, taluyAngles=code_block_16, volumePrims=code_block_18, volumemerged=code_block_19, impBFprimi=code_block_20, impBFmerged=code_block_21, impTFprimi=code_block_22, impTFmerged=code_block_23, volumeBF=code_block_24)
# ---------- data.designscript (12 lines) ----------
ids;
hostIds1;
trackingHostIds1;
gfElevations;
taluyAngles;
volumePrims;
volumemerged;
impBFprimi;
impBFmerged;
impTFprimi;
impTFmerged;
volumeBF;
# ----------------------------------------
code_block_25 = CodeBlock(sheetname=sheet_name, row=code_block_8, col=code_block_9.out0, override=overwrite, file=file_path, data=data.ids) { sheetname; row; col; override; t6 = Excel.WriteToFile(file, sheetname, row, col, data, override); }
code_block_26 = CodeBlock()
# ---------- code_block_26.designscript (4 lines) ----------
3;
//start row #
0;
//start column #
# ----------------------------------------
boolean = BoolSelector(false)
writeToFile = Excel.WriteToFile(filePath=fromPath, sheetName=code_block_25.row, startRow=code_block_26.out0, startCol=code_block_26.out1, overWrite=boolean)  # frozen
getParameterValueByName_5 = Element.GetParameterValueByName(element=code_block_10, parameterName=code_block_12.out2)
watch_4 = Watch(data.ids)
code_block_27 = CodeBlock(sheetname=sheet_name, row=code_block_8, col=code_block_9.out1, override=overwrite, file=file_path, data=data.hostIds1) { sheetname; row; col; override; t6 = Excel.WriteToFile(file, sheetname, row, col, data, override); }
code_block_28 = CodeBlock(sheetname=sheet_name, row=code_block_8, col=code_block_9.out3, override=overwrite, file=file_path, data=data.gfElevations) { sheetname; row; col; override; t6 = Excel.WriteToFile(file, sheetname, row, col, data, override); }
code_block_29 = CodeBlock(sheetname=sheet_name, row=code_block_8, col=code_block_9.out2, override=overwrite, file=file_path, data=data.trackingHostIds1) { sheetname; row; col; override; t6 = Excel.WriteToFile(file, sheetname, row, col, data, override); }
code_block_30 = CodeBlock(sheetname=sheet_name, row=code_block_8, col=code_block_9.out7, override=overwrite, file=file_path, data=data.impBFprimi) { sheetname; row; col; override; t6 = Excel.WriteToFile(file, sheetname, row, col, data, override); }
code_block_31 = CodeBlock(sheetname=sheet_name, row=code_block_8, col=code_block_9.out6, override=overwrite, file=file_path, data=data.volumemerged) { sheetname; row; col; override; t6 = Excel.WriteToFile(file, sheetname, row, col, data, override); }
code_block_32 = CodeBlock(sheetname=sheet_name, row=code_block_8, col=code_block_9.out5, override=overwrite, file=file_path, data=data.volumePrims) { sheetname; row; col; override; t6 = Excel.WriteToFile(file, sheetname, row, col, data, override); }
code_block_33 = CodeBlock(sheetname=sheet_name, row=code_block_8, col=code_block_9.out4, override=overwrite, file=file_path, data=data.taluyAngles) { sheetname; row; col; override; t6 = Excel.WriteToFile(file, sheetname, row, col, data, override); }
code_block_34 = CodeBlock(sheetname=sheet_name, row=code_block_8, col=code_block_9.out9, override=overwrite, file=file_path, data=data.impTFprimi) { sheetname; row; col; override; t6 = Excel.WriteToFile(file, sheetname, row, col, data, override); }
code_block_35 = CodeBlock(sheetname=sheet_name, row=code_block_8, col=code_block_9.out8, override=overwrite, file=file_path, data=data.impBFmerged) { sheetname; row; col; override; t6 = Excel.WriteToFile(file, sheetname, row, col, data, override); }
code_block_36 = CodeBlock(sheetname=sheet_name, row=code_block_8, col=code_block_9.out11, override=overwrite, file=file_path, data=data.volumeBF) { sheetname; row; col; override; t6 = Excel.WriteToFile(file, sheetname, row, col, data, override); }
code_block_37 = CodeBlock(sheetname=sheet_name, row=code_block_8, col=code_block_9.out10, override=overwrite, file=file_path, data=data.impTFmerged) { sheetname; row; col; override; t6 = Excel.WriteToFile(file, sheetname, row, col, data, override); }
string_2 = StringInput("Foundation Excavation")
setParameterByName_4 = Element.SetParameterByName(element=setParameterByName_2, parameterName=code_block_4.out3, value=string_2)
setParameterByName_5 = Element.SetParameterByName(element=setParameterByName_4, parameterName=code_block_4.out4, value=id)
setParameterByName_6 = Element.SetParameterByName(element=setParameterByName_5, parameterName=code_block_4.out5, value=id)

# group: Calulate Volume
code_block_38 = CodeBlock(elemCalVolume=setParameterByName_6) { elemCalVolume; }
solids = Element.Solids(code_block_38)
python_script_unionall = Python(IN[0]=solids)
# ---------- python_script_unionall.python (16 lines) ----------
import clr
clr.AddReference('ProtoGeometry')
from Autodesk.DesignScript.Geometry import *
#The inputs to this node will be stored as a list in the IN variables.
dataEnteringNode = IN
listSol = IN[0]

newlist = []
for list in listSol:
	
	sol = list[0]
	union = sol.UnionAll(list)
	newlist.append(union)
		
#Assign your output to the OUT variable.
OUT = newlist
# ----------------------------------------
volume = Solid.Volume(python_script_unionall)
code_block_39 = CodeBlock { 1000000000; }
div = volume / code_block_39
element_setparameterbyname = Element.SetParameterByName(element=code_block_38, parameterName=code_block_4.out7, value=div)  # "Element.SetParameterByName-v3ExcSoilPrimi"
output = CodeBlock(excMergedSolids=python_script_unionall) { excMergedSolids; }

solids_2 = Element.Solids(code_block)
python_script_unionall_2 = Python(IN[0]=solids_2)  # same code as python_script_unionall
