# Dynamo graph 10-ARCHIVE EXCAVATION DATA.dyn (Dynamo 0.9.1.4062)

file_path = Filename("C:\Users\USER\Documents\MARUBENI COFFEE\BIM QTO\Dynamo Data-Foundation.xlsx")
fromPath = FileObject(file_path)  # "File.FromPath"
sheet_name = StringInput("Excavation")
code_block = CodeBlock()
# ---------- code_block.designscript (2 lines) ----------
0;
//start row #
# ----------------------------------------
code_block_2 = CodeBlock()
# ---------- code_block_2.designscript (24 lines) ----------
0;
//ids;
1;
//hostIds1;
2;
//trackingHostIds1;
3;
//gfElevations;
4;
//taluyAngles;
5;
//volumePrims;
6;
//volumeJoined;
7;
//impBFPrimi;
8;
//impBFMerged;
9;
//impTF;
10;
//impMerged;
11;
//volumeBF;
# ----------------------------------------
overwrite = BoolSelector(false)
select_model_elements = DSModelElementsSelection()  # 156 picked in the model
check_comments = StringInput("Comments")
getParameterValueByName = Element.GetParameterValueByName(element=select_model_elements, parameterName=check_comments)
contain = StringInput("Excavation")
contains = String.Contains(str=getParameterValueByName, searchFor=contain)
filterByBoolMask = List.FilterByBoolMask(list=select_model_elements, mask=contains)
code_block_3 = CodeBlock(elemFinishModified=filterByBoolMask.in) { elemFinishModified; }
code_block_4 = CodeBlock()
# ---------- code_block_4.designscript (10 lines) ----------
"HostID1";
"TrackingHostID1";
"ExcavationTaluyAngleToX";
"VolumeExcavatedSoilPrimitive";
"VolumeExcavatedSoilMerged";
"VolumeBackfillSoil";
"AreaBOFImpactmentPrimitive";
"AreaBOFImpactmentMerged";
"AreaTOESImpactmentPrimitive";
"AreaTOESImpactmentMerged";
# ----------------------------------------
code_block_5 = CodeBlock { "Offset"; }

# group: Excavation Hole Param value
code_block_6 = CodeBlock(elems=code_block_3) { elems; }
id = Element.Id(code_block_6)
code_block_7 = CodeBlock(elem=code_block_6, paramName=code_block_4.out0) { value = elem.GetParameterValueByName(paramName); }
code_block_8 = CodeBlock(elem=code_block_6, paramName=code_block_4.out1) { value = elem.GetParameterValueByName(paramName); }
code_block_9 = CodeBlock(elem=code_block_6, paramName=code_block_5) { value = elem.GetParameterValueByName(paramName); }
code_block_10 = CodeBlock(elem=code_block_6, paramName=code_block_4.out2) { value = elem.GetParameterValueByName(paramName); }
code_block_11 = CodeBlock(elem=code_block_6, paramName=code_block_4.out3) { value = elem.GetParameterValueByName(paramName); }
code_block_12 = CodeBlock(elem=code_block_6, paramName=code_block_4.out4) { value = elem.GetParameterValueByName(paramName); }
code_block_13 = CodeBlock(elem=code_block_6, paramName=code_block_4.out6) { value = elem.GetParameterValueByName(paramName); }
code_block_14 = CodeBlock(elem=code_block_6, paramName=code_block_4.out7) { value = elem.GetParameterValueByName(paramName); }
code_block_15 = CodeBlock(elem=code_block_6, paramName=code_block_4.out8) { value = elem.GetParameterValueByName(paramName); }
code_block_16 = CodeBlock(elem=code_block_6, paramName=code_block_4.out9) { value = elem.GetParameterValueByName(paramName); }
code_block_17 = CodeBlock(elem=code_block_6, paramName=code_block_4.out5) { value = elem.GetParameterValueByName(paramName); }

data = CodeBlock(ids=id, hostIds1=code_block_7, trackingHostIds1=code_block_8, gfElevations=code_block_9, taluyAngles=code_block_10, volumePrims=code_block_11, volumemerged=code_block_12, impBFprimi=code_block_13, impBFmerged=code_block_14, impTFprimi=code_block_15, impTFmerged=code_block_16, volumeBF=code_block_17)
# ---------- data.designscript (12 lines) ----------
ids;
hostIds1;
trackingHostIds1;
gfElevations;
taluyAngles;
volumePrims;
volumemerged;
impBFprimi;
impBFmerged;
impTFprimi;
impTFmerged;
volumeBF;
# ----------------------------------------
code_block_18 = CodeBlock(sheetname=sheet_name, row=code_block, col=code_block_2.out0, override=overwrite, file=file_path, data=data.ids) { sheetname; row; col; override; t6 = Excel.WriteToFile(file, sheetname, row, col, data, override); }
code_block_19 = CodeBlock()
# ---------- code_block_19.designscript (4 lines) ----------
3;
//start row #
0;
//start column #
# ----------------------------------------
boolean = BoolSelector(false)
writeToFile = Excel.WriteToFile(filePath=fromPath, sheetName=code_block_18.row, startRow=code_block_19.out0, startCol=code_block_19.out1, overWrite=boolean)  # frozen
code_block_20 = CodeBlock(sheetname=sheet_name, row=code_block, col=code_block_2.out1, override=overwrite, file=file_path, data=data.hostIds1) { sheetname; row; col; override; t6 = Excel.WriteToFile(file, sheetname, row, col, data, override); }
code_block_21 = CodeBlock(sheetname=sheet_name, row=code_block, col=code_block_2.out3, override=overwrite, file=file_path, data=data.gfElevations) { sheetname; row; col; override; t6 = Excel.WriteToFile(file, sheetname, row, col, data, override); }
code_block_22 = CodeBlock(sheetname=sheet_name, row=code_block, col=code_block_2.out2, override=overwrite, file=file_path, data=data.trackingHostIds1) { sheetname; row; col; override; t6 = Excel.WriteToFile(file, sheetname, row, col, data, override); }
code_block_23 = CodeBlock(sheetname=sheet_name, row=code_block, col=code_block_2.out7, override=overwrite, file=file_path, data=data.impBFprimi) { sheetname; row; col; override; t6 = Excel.WriteToFile(file, sheetname, row, col, data, override); }
code_block_24 = CodeBlock(sheetname=sheet_name, row=code_block, col=code_block_2.out6, override=overwrite, file=file_path, data=data.volumemerged) { sheetname; row; col; override; t6 = Excel.WriteToFile(file, sheetname, row, col, data, override); }
code_block_25 = CodeBlock(sheetname=sheet_name, row=code_block, col=code_block_2.out5, override=overwrite, file=file_path, data=data.volumePrims) { sheetname; row; col; override; t6 = Excel.WriteToFile(file, sheetname, row, col, data, override); }
code_block_26 = CodeBlock(sheetname=sheet_name, row=code_block, col=code_block_2.out4, override=overwrite, file=file_path, data=data.taluyAngles) { sheetname; row; col; override; t6 = Excel.WriteToFile(file, sheetname, row, col, data, override); }
code_block_27 = CodeBlock(sheetname=sheet_name, row=code_block, col=code_block_2.out9, override=overwrite, file=file_path, data=data.impTFprimi) { sheetname; row; col; override; t6 = Excel.WriteToFile(file, sheetname, row, col, data, override); }
code_block_28 = CodeBlock(sheetname=sheet_name, row=code_block, col=code_block_2.out8, override=overwrite, file=file_path, data=data.impBFmerged) { sheetname; row; col; override; t6 = Excel.WriteToFile(file, sheetname, row, col, data, override); }
code_block_29 = CodeBlock(sheetname=sheet_name, row=code_block, col=code_block_2.out11, override=overwrite, file=file_path, data=data.volumeBF) { sheetname; row; col; override; t6 = Excel.WriteToFile(file, sheetname, row, col, data, override); }
code_block_30 = CodeBlock(sheetname=sheet_name, row=code_block, col=code_block_2.out10, override=overwrite, file=file_path, data=data.impTFmerged) { sheetname; row; col; override; t6 = Excel.WriteToFile(file, sheetname, row, col, data, override); }
