# Dynamo graph 11-MERGE EXCAVATION.dyn (Dynamo 0.9.1.4062)

select_model_elements = DSModelElementsSelection()  # 156 picked in the model
check_comments = StringInput("Comments")
getParameterValueByName = Element.GetParameterValueByName(element=select_model_elements, parameterName=check_comments)
contain = StringInput("Excavation")
contains = String.Contains(str=getParameterValueByName, searchFor=contain)
filterByBoolMask = List.FilterByBoolMask(list=select_model_elements, mask=contains)
code_block = CodeBlock(holes=filterByBoolMask.in) { holes; }
solids = Element.Solids(code_block)
flatten = Flatten(solids)
deconstruct = List.Deconstruct(list=flatten)
unionAll = Solid.UnionAll(deconstruct.first, deconstruct.rest)
directory_path = Directory("C:\Users\USER\Documents\MARUBENI COFFEE\BIM QTO")
string = StringInput("\")
file_name = StringInput("Excavation Merged")
volume = Solid.Volume(unionAll)
number = DoubleInput(1000000000)
div = volume / number
number_2 = DoubleInput(0)
round = Math.Round(number=div, digits=number_2)
string_from_object = FromObject(round)
code_block_2 = CodeBlock { 0; }
code_block_3 = CodeBlock { "."; }
indexOf = String.IndexOf(string=string_from_object, searchFor=code_block_3)
substring = String.Substring(str=string_from_object, startIndex=code_block_2, length=indexOf)
code_block_4 = CodeBlock(dir=directory_path, plash=string, filename=file_name, Info=substring) { filepath = dir+plash+filename+"-"+Info+" m3"+".sat"; }
exportToSAT = ExportWithUnits(unionAll, code_block_4, exportedUnit=Millimeters)
string_from_object_2 = FromObject(directory_path)
