# Dynamo graph 13-DIFFENT SATs.dyn (Dynamo 0.9.1.4062)

sat_concrete = DSModelElementSelection()  # 1 picked in the model
solids = Element.Solids(sat_concrete)
flatten = Flatten(solids)
count = Count(flatten)
code_block = CodeBlock { 1; }
gt = count > code_block
deconstruct = List.Deconstruct(list=flatten)
unionAll = Solid.UnionAll(deconstruct.first, deconstruct.rest)
if_ = If(test=gt, true=unionAll, false=flatten)
sat_concrete_2 = DSModelElementSelection()  # 1 picked in the model
solids_2 = Element.Solids(sat_concrete_2)
flatten_2 = Flatten(solids_2)
count_2 = Count(flatten_2)
code_block_2 = CodeBlock { 1; }
gt_2 = count_2 > code_block_2
deconstruct_2 = List.Deconstruct(list=flatten_2)
unionAll_2 = Solid.UnionAll(deconstruct_2.first, deconstruct_2.rest)
if_2 = If(test=gt_2, true=unionAll_2, false=flatten_2)
difference = Solid.Difference(solid=if_, other=if_2)
directory_path = Directory("C:\Users\USER\Documents\MARUBENI COFFEE\BIM QTO")
string = StringInput("\")
file_name = StringInput("Backfill")
volume = Solid.Volume(difference)
number = DoubleInput(1000000000)
div = volume / number
number_2 = DoubleInput(0)
round = Math.Round(number=div, digits=number_2)
string_from_object = FromObject(round)
code_block_3 = CodeBlock { 0; }
code_block_4 = CodeBlock { "."; }
indexOf = String.IndexOf(string=string_from_object, searchFor=code_block_4)
substring = String.Substring(str=string_from_object, startIndex=code_block_3, length=indexOf)
code_block_5 = CodeBlock(dir=directory_path, plash=string, filename=file_name, Info=substring) { filepath = dir+plash+filename+"-"+Info+" m3"+".sat"; }
exportToSAT = ExportWithUnits(difference, code_block_5, exportedUnit=Millimeters)
watch = Watch(exportToSAT)
