# Dynamo graph 14-COLUMN FORMWORK.dyn (Dynamo 0.9.1.4062)

string = StringInput("OST_StructuralColumns")  # frozen
byName = Category.ByName(string)
all_elements_of_category = ElementsOfCategory(byName)
excavate_hole_family_type_name = StringInput("FW-PLY-Column")
byName_2 = FamilyType.ByName(excavate_hole_family_type_name)
select_model_elements = DSModelElementsSelection()  # 48 picked in the model
category_name = StringInput("Structural Columns")
filter = Python(IN[0]=select_model_elements, IN[1]=category_name)
# ---------- filter.python (17 lines) ----------
import clr
clr.AddReference('ProtoGeometry')
from Autodesk.DesignScript.Geometry import *
#The inputs to this node will be stored as a list in the IN variables.
dataEnteringNode = IN
elems = IN[0]
cateName = IN[1]

res = []

for e in elems:
	ee = UnwrapElement(e)
	if ee.Category.Name == cateName:
		res.append(e)

#Assign your output to the OUT variable.
OUT = res
# ----------------------------------------
code_block = CodeBlock(elems=filter) { elems; }
python_script = Python(IN[0]=code_block)
# ---------- python_script.python (18 lines) ----------
import clr
clr.AddReference('ProtoGeometry')
from Autodesk.DesignScript.Geometry import *
#The inputs to this node will be stored as a list in the IN variables.
dataEnteringNode = IN

columns = UnwrapElement(IN[0])
res = []
for c in columns:
	xyz = []
	xyz.append(c.Location.Point.X*304.8)
	xyz.append(c.Location.Point.Y*304.8)
	xyz.append(c.Location.Point.Z*304.8)
	
	res.append(xyz)

#Assign your output to the OUT variable.
OUT = res
# ----------------------------------------
transpose = List.Transpose(python_script)
code_block_2 = CodeBlock(list=transpose) { x = list[0]; y = list [1]; z = list[2]; }
level_of_nature_ground_soil = Levels("Level 1")  # "Level of Nature Ground Soil Surface"
elevation = Level.Elevation(level_of_nature_ground_soil)
code_block_3 = CodeBlock { "Elevation at Top"; "Elevation at Bottom"; "Width"; "Length1"; "Height"; "Comments"; "Base Offset"; }
getParameterValueByName = Element.GetParameterValueByName(element=code_block, parameterName=code_block_3.out6)
code_block_4 = CodeBlock(z=elevation, o=getParameterValueByName) { z+o; }
byCoordinates = Point.ByCoordinates(x=code_block_2.x, y=code_block_2.y, z=code_block_4)
byPoint = FamilyInstance.ByPoint(familyType=byName_2, point=byCoordinates)
code_block_5 = CodeBlock(elems=byPoint) { elems; }
python_script_rotation = Python(IN[0]=code_block)
# ---------- python_script_rotation.python (19 lines) ----------
import clr
clr.AddReference('ProtoGeometry')
from Autodesk.DesignScript.Geometry import *
clr.AddReference('RevitAPI')
from Autodesk.Revit.DB import *
#The inputs to this node will be stored as a list in the IN variables.
dataEnteringNode = IN

elems = UnwrapElement(IN[0])
results = []
#if listcount = 1

#if listcount > 1
for i in range(len(elems)):
	rot = round(elems[i].Location.Rotation * 57.2957795,0)
	results.append(rot)

#Assign your output to the OUT variable.
OUT = results
# ----------------------------------------
code_block_6 = CodeBlock(a=python_script_rotation) { 0-a; }
setRotation = FamilyInstance.SetRotation(familyInstance=code_block_5, degree=code_block_6)
code_block_7 = CodeBlock(list=filter) { list[0]; }
parameters = Element.Parameters(code_block_7)
watch = Watch(parameters)

# group: foundation parameter value
id = Element.Id(code_block)
getParameterValueByName_2 = Element.GetParameterValueByName(element=code_block, parameterName=code_block_3.out4)
getParameterValueByName_3 = Element.GetParameterValueByName(element=code_block, parameterName=code_block_3.out2)
getParameterValueByName_4 = Element.GetParameterValueByName(element=code_block, parameterName=code_block_3.out3)

code_block_8 = CodeBlock()
# ---------- code_block_8.designscript (14 lines) ----------
"Height";
"Width";
"Length";
"Comments";
"HostID1";
"TrackingHostID1";
"ExcavationTaluyAngleToX";
"VolumeExcavatedSoilPrimitive";
"VolumeExcavatedSoilMerged";
"VolumeBackfillSoil";
"AreaBOFImpactmentPrimitive";
"AreaBOFImpactmentMerged";
"AreaTOESImpactmentPrimitive";
"AreaTOESImpactmentMerged";
# ----------------------------------------

# group: Calulate Volume
code_block_9 = CodeBlock { elemCalVolume; }  # frozen
element_setparameterbyname = Element.SetParameterByName(element=code_block_9, parameterName=code_block_8.out7)  # "Element.SetParameterByName-v3ExcSoilPrimi"
solids = Element.Solids(code_block_9)
python_script_unionall = Python(IN[0]=solids)
# ---------- python_script_unionall.python (16 lines) ----------
import clr
clr.AddReference('ProtoGeometry')
from Autodesk.DesignScript.Geometry import *
#The inputs to this node will be stored as a list in the IN variables.
dataEnteringNode = IN
listSol = IN[0]

newlist = []
for list in listSol:
	
	sol = list[0]
	union = sol.UnionAll(list)
	newlist.append(union)
		
#Assign your output to the OUT variable.
OUT = newlist
# ----------------------------------------
volume = Solid.Volume(python_script_unionall)
code_block_10 = CodeBlock { 1000000000; }
div = volume / code_block_10
output = CodeBlock(excMergedSolids=python_script_unionall) { excMergedSolids; }

solids_2 = Element.Solids(code_block)
python_script_unionall_2 = Python(IN[0]=solids_2)  # same code as python_script_unionall
columnInfo = StringInput("Stum Column")
formwork_info = StringInput("Stum Column Formwork")
formwork_info_2 = StringInput("Stifferner Formwork")
columnInfo_2 = StringInput("Stifferner")
getParameterValueByName_5 = Element.GetParameterValueByName(element=code_block, parameterName=code_block_3.out5)
columnInfo_3 = StringInput("Super Structure Column")
code_block_11 = CodeBlock(ColumnInfo=columnInfo_3) { ColumnInfo; }
code_block_12 = CodeBlock { " "; ", "; }
python_script_2 = Python(IN[0]=getParameterValueByName_5, IN[1]=code_block_11, IN[2]=code_block_12.out1)
# ---------- python_script_2.python (30 lines) ----------
import clr
clr.AddReference('ProtoGeometry')
from Autodesk.DesignScript.Geometry import *
#The inputs to this node will be stored as a list in the IN variables.
dataEnteringNode = IN

listSavedInfo = IN[0]

strContain = IN[1]

brkS = IN[2]

listStrCont = strContain.split(" ")

res = []

for si in listSavedInfo:
	if len(si) == 0 or not si:
		res.append(strContain)
	if not strContain in si:
		res.append(si+brkS+strContain)
	else:
		st = ""
		for sc in listStrCont:
			if not sc in si:
				st = st + brkS + sc
		res.append(si + st)

#Assign your output to the OUT variable.
OUT = res
# ----------------------------------------
setParameterByName = Element.SetParameterByName(element=code_block, parameterName=code_block_3.out5, value=python_script_2)
setParameterByName_2 = Element.SetParameterByName(element=code_block_5, parameterName=code_block_8.out0, value=getParameterValueByName_2)
setParameterByName_3 = Element.SetParameterByName(element=setParameterByName_2, parameterName=code_block_8.out1, value=getParameterValueByName_3)
setParameterByName_4 = Element.SetParameterByName(element=setParameterByName_3, parameterName=code_block_8.out2, value=getParameterValueByName_4)
getParameterValueByName_6 = Element.GetParameterValueByName(element=setParameterByName_4, parameterName=code_block_3.out5)
formwork_info_3 = StringInput("Column Formwork")
code_block_13 = CodeBlock(FWInfo=formwork_info_3) { FWInfo; }
python_script_3 = Python(IN[0]=getParameterValueByName_6, IN[1]=code_block_13, IN[2]=code_block_12.out1)
# ---------- python_script_3.python (30 lines) ----------
import clr
clr.AddReference('ProtoGeometry')
from Autodesk.DesignScript.Geometry import *
#The inputs to this node will be stored as a list in the IN variables.
dataEnteringNode = IN

listSavedInfo = IN[0]

strContain = IN[1]

brkS = ", "

listStrCont = strContain.split(" ")

res = []

for si in listSavedInfo:
	if len(si) == 0 or not si:
		res.append(strContain)
	if not strContain in si:
		res.append(si+brkS+strContain)
	else:
		st = ""
		for sc in listStrCont:
			if not sc in si:
				st = st + brkS + sc
		res.append(si + st)

#Assign your output to the OUT variable.
OUT = res
# ----------------------------------------
setParameterByName_5 = Element.SetParameterByName(element=setParameterByName_4, parameterName=code_block_3.out5, value=python_script_3)
facingOrientation = FamilyInstance.FacingOrientation(code_block)  # frozen
XAxis = Vector.XAxis()
angleBetween = Vector.AngleBetween(facingOrientation, XAxis)
number = DoubleInput(57.296)
mul = angleBetween * number
watch_2 = Watch(mul)
