# Dynamo graph 14-FOUNDATION FORMWORK.dyn (Dynamo 0.9.1.4062)

string = StringInput("OST_StructuralFoundation")  # frozen
byName = Category.ByName(string)
all_elements_of_category = ElementsOfCategory(byName)
excavate_hole_family_type_name = StringInput("FW-PLY-Foundation Cap-Type 1")
byName_2 = FamilyType.ByName(excavate_hole_family_type_name)
select_model_elements = DSModelElementsSelection()  # 743 picked in the model
category_name = StringInput("Structural Foundations")
filter_foundations = Python(IN[0]=select_model_elements, IN[1]=category_name)
# ---------- filter_foundations.python (17 lines) ----------
import clr
clr.AddReference('ProtoGeometry')
from Autodesk.DesignScript.Geometry import *
#The inputs to this node will be stored as a list in the IN variables.
dataEnteringNode = IN
elems = IN[0]
cateName = IN[1]

res = []

for e in elems:
	ee = UnwrapElement(e)
	if ee.Category.Name == cateName:
		res.append(e)

#Assign your output to the OUT variable.
OUT = res
# ----------------------------------------
code_block = CodeBlock(elems=filter_foundations) { elems; }
location = FamilyInstance.Location(code_block)
X = Point.X(location)
Y = Point.Y(location)
level_of_nature_ground_soil = Levels("Level 1")  # "Level of Nature Ground Soil Surface"
elevation = Level.Elevation(level_of_nature_ground_soil)
byCoordinates = Point.ByCoordinates(x=X, y=Y, z=elevation)
byPoint = FamilyInstance.ByPoint(familyType=byName_2, point=byCoordinates)
code_block_2 = CodeBlock(elems=byPoint) { elems; }
code_block_3 = CodeBlock()
# ---------- code_block_3.designscript (15 lines) ----------
"Height";
"Width";
"Length";
"Comments";
"HostID1";
"TrackingHostID1";
"ExcavationTaluyAngleToX";
"VolumeExcavatedSoilPrimitive";
"VolumeExcavatedSoilMerged";
"VolumeBackfillSoil";
"AreaBOFImpactmentPrimitive";
"AreaBOFImpactmentMerged";
"AreaTOESImpactmentPrimitive";
"AreaTOESImpactmentMerged";
"Offset";
# ----------------------------------------
code_block_4 = CodeBlock { "Elevation at Top"; "Elevation at Bottom"; "Width"; "Length"; "Height Offset From Level"; }

# group: foundation parameter value
getParameterValueByName = Element.GetParameterValueByName(element=code_block, parameterName=code_block_4.out0)
getParameterValueByName_2 = Element.GetParameterValueByName(element=code_block, parameterName=code_block_4.out1)
sub = getParameterValueByName - getParameterValueByName_2
getParameterValueByName_3 = Element.GetParameterValueByName(element=code_block, parameterName=code_block_4.out2)
getParameterValueByName_4 = Element.GetParameterValueByName(element=code_block, parameterName=code_block_4.out3)
id = Element.Id(code_block)

code_block_5 = CodeBlock { 50; }
sub_2 = sub - code_block_5
setParameterByName = Element.SetParameterByName(element=code_block_2, parameterName=code_block_3.out0, value=sub_2)
facingOrientation = FamilyInstance.FacingOrientation(code_block)  # frozen
XAxis = Vector.XAxis()
angleBetween = Vector.AngleBetween(facingOrientation, XAxis)

# group: Radian to Degree
number = DoubleInput(57.296)
mul = angleBetween * number

watch = Watch(mul)
setParameterByName_2 = Element.SetParameterByName(element=code_block_2, parameterName=code_block_3.out1, value=getParameterValueByName_3)
setParameterByName_3 = Element.SetParameterByName(element=code_block_2, parameterName=code_block_3.out2, value=getParameterValueByName_4)
python_script_rotation = Python(IN[0]=code_block)
# ---------- python_script_rotation.python (19 lines) ----------
import clr
clr.AddReference('ProtoGeometry')
from Autodesk.DesignScript.Geometry import *
clr.AddReference('RevitAPI')
from Autodesk.Revit.DB import *
#The inputs to this node will be stored as a list in the IN variables.
dataEnteringNode = IN

elems = UnwrapElement(IN[0])
results = []
#if listcount = 1

#if listcount > 1
for i in range(len(elems)):
	rot = round(elems[i].Location.Rotation * 57.2957795,0)
	results.append(rot)

#Assign your output to the OUT variable.
OUT = results
# ----------------------------------------
code_block_6 = CodeBlock(a=python_script_rotation) { 0-a; }
setRotation = FamilyInstance.SetRotation(familyInstance=code_block_2, degree=code_block_6)
code_block_7 = CodeBlock(list=code_block) { list[0]; }
parameters = Element.Parameters(code_block_7)
watch_2 = Watch(parameters)
string_2 = StringInput("Foundation Formwork")
setParameterByName_4 = Element.SetParameterByName(element=code_block_2, parameterName=code_block_3.out3, value=string_2)
setParameterByName_5 = Element.SetParameterByName(element=setParameterByName_4, parameterName=code_block_3.out4, value=id)
setParameterByName_6 = Element.SetParameterByName(element=setParameterByName_5, parameterName=code_block_3.out5, value=id)
solids = Element.Solids(code_block)
python_script_unionall = Python(IN[0]=solids)
# ---------- python_script_unionall.python (16 lines) ----------
import clr
clr.AddReference('ProtoGeometry')
from Autodesk.DesignScript.Geometry import *
#The inputs to this node will be stored as a list in the IN variables.
dataEnteringNode = IN
listSol = IN[0]

newlist = []
for list in listSol:
	
	sol = list[0]
	union = sol.UnionAll(list)
	newlist.append(union)
		
#Assign your output to the OUT variable.
OUT = newlist
# ----------------------------------------
setParameterByName_7 = Element.SetParameterByName(element=code_block_2, parameterName=code_block_3.out14, value=getParameterValueByName)
