# Dynamo graph 15-Clear Comments to Len 0.dyn (Dynamo 0.9.1.4062)

select_model_elements = DSModelElementsSelection()  # 211 picked in the model
code_block = CodeBlock { "Comments"; ""; }
getParameterValueByName = Element.GetParameterValueByName(element=select_model_elements, parameterName=code_block.out0)
setParameterByName = Element.SetParameterByName(element=select_model_elements, parameterName=code_block.out0, value=code_block.out1)
