# Dynamo graph AdaptiveFWforStructuralPartMerged-171116-02.dyn (Dynamo 0.9.1.4062)

# group: INPUTS
true_horizontal_faces = BoolSelector(true)
true_select_1_element_false = BoolSelector(true)  # "True = Select 1 Element | False = Select multi Elements"
select_model_element = DSModelElementSelection()
select_model_elements = DSModelElementsSelection()

# group: Switch SIngle / Multi Elements
boolean = BoolSelector(true)
eq = true_select_1_element_false == boolean
if_ = If(test=eq, true=select_model_element, false=select_model_elements)

# group: Faces
faces = Element.Faces(if_)
flatten = Flatten(faces)

# group: Testung Z VECTOR??
code_block = CodeBlock { 0; }
normalAtParameter = Surface.NormalAtParameter(surface=flatten, u=code_block, v=code_block)
ZAxis = Vector.ZAxis()
isParallel = Vector.IsParallel(normalAtParameter, ZAxis)
boolean_2 = BoolSelector(false)
allIndicesOf = List.AllIndicesOf(list=isParallel, item=boolean_2)
getItemAtIndex = List.GetItemAtIndex(list=flatten, index=allIndicesOf)

# group: Switch Vertical / Horizontal Faces
boolean_3 = BoolSelector(true)
eq_2 = true_horizontal_faces == boolean_3
if_2 = If(test=eq_2, true=getItemAtIndex, false=flatten)

perimeterCurves = Surface.PerimeterCurves(if_2)
startPoint = Curve.StartPoint(perimeterCurves)
count_longest = Count(startPoint, lacing=Longest)
code_block_2 = CodeBlock(int1=count_longest) { int1; }  # frozen
code_block_3 = CodeBlock { 4; }
gt = code_block_2 > code_block_3
boolean_4 = BoolSelector(true)
allIndicesOf_2 = List.AllIndicesOf(list=gt, item=boolean_4)
getItemAtIndex_2 = List.GetItemAtIndex(list=code_block_2, index=allIndicesOf_2)
code_block_4 = CodeBlock(a=code_block_2) { a; 1; b=Math.Floor(a/4); chop=a-b*a; 4; }
gt_2 = code_block_4.b > code_block_4.out1
boolean_5 = BoolSelector(true)
allIndicesOf_3 = List.AllIndicesOf(list=gt_2, item=boolean_5)
getItemAtIndex_3 = List.GetItemAtIndex(list=startPoint, index=allIndicesOf_3)
count = Count(getItemAtIndex_3)
code_block_5 = CodeBlock(n=count) { 0..n-1..1; }
getItemAtIndex_4 = List.GetItemAtIndex(list=getItemAtIndex_3, index=code_block_5)
chop = List.Chop(list=getItemAtIndex_4, lengths=code_block_4.out4)
count_2 = Count(getItemAtIndex_3, lacing=Longest)
flatten_2 = Flatten(getItemAtIndex_3)
getItemAtIndex_5 = List.GetItemAtIndex(list=code_block_4.a, index=allIndicesOf_3)
takeItems = List.TakeItems(list=flatten_2, amount=getItemAtIndex_5)
number = DoubleInput(4)
eq_3 = count_longest == number
byJoinedCurves = PolyCurve.ByJoinedCurves(perimeterCurves)  # frozen
isNull = Object.IsNull(byJoinedCurves)
boolean_6 = BoolSelector(true)
allIndicesOf_4 = List.AllIndicesOf(list=isNull, item=boolean_6)
getItemAtIndex_6 = List.GetItemAtIndex(list=if_2, index=allIndicesOf_4)
code_block_6 = CodeBlock { 0; }
pointAtParameter = Surface.PointAtParameter(surface=getItemAtIndex_6, u=code_block_6, v=code_block_6)
code_block_7 = CodeBlock { 1; }
pointAtParameter_2 = Surface.PointAtParameter(surface=getItemAtIndex_6, u=code_block_6, v=code_block_7)
pointAtParameter_3 = Surface.PointAtParameter(surface=getItemAtIndex_6, u=code_block_7, v=code_block_7)
pointAtParameter_4 = Surface.PointAtParameter(surface=getItemAtIndex_6, u=code_block_7, v=code_block_6)
create = List.Create(pointAtParameter, pointAtParameter_2, pointAtParameter_3, pointAtParameter_4)
transpose = List.Transpose(create)
code_block_8 = CodeBlock(n=number) { a="ADT-FW "; b=" points"; n; c=a+n+b; }
byName = FamilyType.ByName(code_block_8.c)
byPoints = AdaptiveComponent.ByPoints(points=transpose, familyType=byName)
maximumItem = List.MaximumItem()
filterByBoolMask = List.FilterByBoolMask()
doesIntersect = Geometry.DoesIntersect(lacing=Longest)
countTrue = CountTrue(doesIntersect, lacing=Longest)
countFalse = CountFalse(doesIntersect, lacing=Longest)
code_block_9 = CodeBlock { n=20; 0..1..#n; 0; }
pointAtParameter_5 = Surface.PointAtParameter(surface=getItemAtIndex_6, u=code_block_9.out2, v=code_block_9.out1, lacing=CrossProduct)
code_block_10 = CodeBlock { 0; 1; }
pointAtParameter_6 = Surface.PointAtParameter(surface=getItemAtIndex_6, u=code_block_10.out0, v=code_block_10.out0, lacing=CrossProduct)
ofRepeatedItem = List.OfRepeatedItem(item=pointAtParameter_6, amount=code_block_9.n)
pointAtParameter_7 = Surface.PointAtParameter(surface=getItemAtIndex_6, u=code_block_10.out1, v=code_block_10.out1, lacing=CrossProduct)
ofRepeatedItem_2 = List.OfRepeatedItem(item=pointAtParameter_7, amount=code_block_9.n)
byTwoPoints = Vector.ByTwoPoints(start=ofRepeatedItem, end=ofRepeatedItem_2)
byOriginNormal = Plane.ByOriginNormal(origin=pointAtParameter_5, normal=byTwoPoints, lacing=CrossProduct)
getItemAtIndex_7 = List.GetItemAtIndex(list=perimeterCurves, index=allIndicesOf_4)
intersect = Geometry.Intersect(geometry=byOriginNormal, other=getItemAtIndex_7, lacing=Longest)

# group: Place AC
number_2 = DoubleInput(3)
eq_4 = count_longest == number_2
boolean_7 = BoolSelector(true)
allIndicesOf_5 = List.AllIndicesOf(list=eq_4, item=boolean_7)
getItemAtIndex_8 = List.GetItemAtIndex(list=startPoint, index=allIndicesOf_5)
code_block_11 = CodeBlock(n=number_2) { a="ADT-FW "; b=" points"; n; c=a+n+b; }
byName_2 = FamilyType.ByName(code_block_11.c)
byPoints_2 = AdaptiveComponent.ByPoints(points=getItemAtIndex_8, familyType=byName_2)

# group: Place AC
number_3 = DoubleInput(4)
eq_5 = count_longest == number_3
boolean_8 = BoolSelector(true)
allIndicesOf_6 = List.AllIndicesOf(list=eq_5, item=boolean_8)
getItemAtIndex_9 = List.GetItemAtIndex(list=startPoint, index=allIndicesOf_6)
code_block_12 = CodeBlock(n=number_3) { a="ADT-FW "; b=" points"; n; c=a+n+b; }
byName_3 = FamilyType.ByName(code_block_12.c)
byPoints_3 = AdaptiveComponent.ByPoints(points=getItemAtIndex_9, familyType=byName_3)

# group: Place AC
number_4 = DoubleInput(5)
eq_6 = count_longest == number_4
boolean_9 = BoolSelector(true)
allIndicesOf_7 = List.AllIndicesOf(list=eq_6, item=boolean_9)
getItemAtIndex_10 = List.GetItemAtIndex(list=startPoint, index=allIndicesOf_7)
code_block_13 = CodeBlock(n=number_4) { a="ADT-FW "; b=" points"; n; c=a+n+b; }
byName_4 = FamilyType.ByName(code_block_13.c)
byPoints_4 = AdaptiveComponent.ByPoints(points=getItemAtIndex_10, familyType=byName_4)

# group: Place AC
number_5 = DoubleInput(6)
eq_7 = count_longest == number_5
boolean_10 = BoolSelector(true)
allIndicesOf_8 = List.AllIndicesOf(list=eq_7, item=boolean_10)
getItemAtIndex_11 = List.GetItemAtIndex(list=startPoint, index=allIndicesOf_8)
code_block_14 = CodeBlock(n=number_5) { a="ADT-FW "; b=" points"; n; c=a+n+b; }
byName_5 = FamilyType.ByName(code_block_14.c)
byPoints_5 = AdaptiveComponent.ByPoints(points=getItemAtIndex_11, familyType=byName_5)

# group: Place AC
number_6 = DoubleInput(7)
eq_8 = count_longest == number_6
boolean_11 = BoolSelector(true)
allIndicesOf_9 = List.AllIndicesOf(list=eq_8, item=boolean_11)
getItemAtIndex_12 = List.GetItemAtIndex(list=startPoint, index=allIndicesOf_9)
code_block_15 = CodeBlock(n=number_6) { a="ADT-FW "; b=" points"; n; c=a+n+b; }
byName_6 = FamilyType.ByName(code_block_15.c)
byPoints_6 = AdaptiveComponent.ByPoints(points=getItemAtIndex_12, familyType=byName_6)

# group: Place AC
number_7 = DoubleInput(8)
eq_9 = count_longest == number_7
boolean_12 = BoolSelector(true)
allIndicesOf_10 = List.AllIndicesOf(list=eq_9, item=boolean_12)
getItemAtIndex_13 = List.GetItemAtIndex(list=startPoint, index=allIndicesOf_10)
code_block_16 = CodeBlock(n=number_7) { a="ADT-FW "; b=" points"; n; c=a+n+b; }
byName_7 = FamilyType.ByName(code_block_16.c)
byPoints_7 = AdaptiveComponent.ByPoints(points=getItemAtIndex_13, familyType=byName_7)

# group: Place AC
number_8 = DoubleInput(9)
eq_10 = count_longest == number_8
boolean_13 = BoolSelector(true)
allIndicesOf_11 = List.AllIndicesOf(list=eq_10, item=boolean_13)
getItemAtIndex_14 = List.GetItemAtIndex(list=startPoint, index=allIndicesOf_11)
code_block_17 = CodeBlock(n=number_8) { a="ADT-FW "; b=" points"; n; c=a+n+b; }
byName_8 = FamilyType.ByName(code_block_17.c)
byPoints_8 = AdaptiveComponent.ByPoints(points=getItemAtIndex_14, familyType=byName_8)

# group: Place AC
number_9 = DoubleInput(10)
eq_11 = count_longest == number_9
boolean_14 = BoolSelector(true)
allIndicesOf_12 = List.AllIndicesOf(list=eq_11, item=boolean_14)
getItemAtIndex_15 = List.GetItemAtIndex(list=startPoint, index=allIndicesOf_12)
code_block_18 = CodeBlock(n=number_9) { a="ADT-FW "; b=" points"; n; c=a+n+b; }
byName_9 = FamilyType.ByName(code_block_18.c)
byPoints_9 = AdaptiveComponent.ByPoints(points=getItemAtIndex_15, familyType=byName_9)

# group: Place AC
number_10 = DoubleInput(11)
eq_12 = count_longest == number_10
boolean_15 = BoolSelector(true)
allIndicesOf_13 = List.AllIndicesOf(list=eq_12, item=boolean_15)
getItemAtIndex_16 = List.GetItemAtIndex(list=startPoint, index=allIndicesOf_13)
code_block_19 = CodeBlock(n=number_10) { a="ADT-FW "; b=" points"; n; c=a+n+b; }
byName_10 = FamilyType.ByName(code_block_19.c)
byPoints_10 = AdaptiveComponent.ByPoints(points=getItemAtIndex_16, familyType=byName_10)

# group: Place AC
number_11 = DoubleInput(12)
eq_13 = count_longest == number_11
boolean_16 = BoolSelector(true)
allIndicesOf_14 = List.AllIndicesOf(list=eq_13, item=boolean_16)
getItemAtIndex_17 = List.GetItemAtIndex(list=startPoint, index=allIndicesOf_14)
code_block_20 = CodeBlock(n=number_11) { a="ADT-FW "; b=" points"; n; c=a+n+b; }
byName_11 = FamilyType.ByName(code_block_20.c)
byPoints_11 = AdaptiveComponent.ByPoints(points=getItemAtIndex_17, familyType=byName_11)

# group: Place AC
number_12 = DoubleInput(13)
eq_14 = count_longest == number_12
boolean_17 = BoolSelector(true)
allIndicesOf_15 = List.AllIndicesOf(list=eq_14, item=boolean_17)
getItemAtIndex_18 = List.GetItemAtIndex(list=startPoint, index=allIndicesOf_15)
code_block_21 = CodeBlock(n=number_12) { a="ADT-FW "; b=" points"; n; c=a+n+b; }
byName_12 = FamilyType.ByName(code_block_21.c)
byPoints_12 = AdaptiveComponent.ByPoints(points=getItemAtIndex_18, familyType=byName_12)

# group: Place AC
number_13 = DoubleInput(14)
eq_15 = count_longest == number_13
boolean_18 = BoolSelector(true)
allIndicesOf_16 = List.AllIndicesOf(list=eq_15, item=boolean_18)
getItemAtIndex_19 = List.GetItemAtIndex(list=startPoint, index=allIndicesOf_16)
code_block_22 = CodeBlock(n=number_13) { a="ADT-FW "; b=" points"; n; c=a+n+b; }
byName_13 = FamilyType.ByName(code_block_22.c)
byPoints_13 = AdaptiveComponent.ByPoints(points=getItemAtIndex_19, familyType=byName_13)

# group: Place AC
number_14 = DoubleInput(15)
eq_16 = count_longest == number_14
boolean_19 = BoolSelector(true)
allIndicesOf_17 = List.AllIndicesOf(list=eq_16, item=boolean_19)
getItemAtIndex_20 = List.GetItemAtIndex(list=startPoint, index=allIndicesOf_17)
code_block_23 = CodeBlock(n=number_14) { a="ADT-FW "; b=" points"; n; c=a+n+b; }
byName_14 = FamilyType.ByName(code_block_23.c)
byPoints_14 = AdaptiveComponent.ByPoints(points=getItemAtIndex_20, familyType=byName_14)

# group: Place AC
number_15 = DoubleInput(16)
eq_17 = count_longest == number_15
boolean_20 = BoolSelector(true)
allIndicesOf_18 = List.AllIndicesOf(list=eq_17, item=boolean_20)
getItemAtIndex_21 = List.GetItemAtIndex(list=startPoint, index=allIndicesOf_18)
code_block_24 = CodeBlock(n=number_15) { a="ADT-FW "; b=" points"; n; c=a+n+b; }
byName_15 = FamilyType.ByName(code_block_24.c)
byPoints_15 = AdaptiveComponent.ByPoints(points=getItemAtIndex_21, familyType=byName_15)

# group: Place AC
number_16 = DoubleInput(17)
eq_18 = count_longest == number_16
boolean_21 = BoolSelector(true)
allIndicesOf_19 = List.AllIndicesOf(list=eq_18, item=boolean_21)
getItemAtIndex_22 = List.GetItemAtIndex(list=startPoint, index=allIndicesOf_19)
code_block_25 = CodeBlock(n=number_16) { a="ADT-FW "; b=" points"; n; c=a+n+b; }
byName_16 = FamilyType.ByName(code_block_25.c)
byPoints_16 = AdaptiveComponent.ByPoints(points=getItemAtIndex_22, familyType=byName_16)

# group: Place AC
number_17 = DoubleInput(18)
eq_19 = count_longest == number_17
boolean_22 = BoolSelector(true)
allIndicesOf_20 = List.AllIndicesOf(list=eq_19, item=boolean_22)
getItemAtIndex_23 = List.GetItemAtIndex(list=startPoint, index=allIndicesOf_20)
code_block_26 = CodeBlock(n=number_17) { a="ADT-FW "; b=" points"; n; c=a+n+b; }
byName_17 = FamilyType.ByName(code_block_26.c)
byPoints_17 = AdaptiveComponent.ByPoints(points=getItemAtIndex_23, familyType=byName_17)

# group: Place AC
number_18 = DoubleInput(19)
eq_20 = count_longest == number_18
boolean_23 = BoolSelector(true)
allIndicesOf_21 = List.AllIndicesOf(list=eq_20, item=boolean_23)
getItemAtIndex_24 = List.GetItemAtIndex(list=startPoint, index=allIndicesOf_21)
code_block_27 = CodeBlock(n=number_18) { a="ADT-FW "; b=" points"; n; c=a+n+b; }
byName_18 = FamilyType.ByName(code_block_27.c)
byPoints_18 = AdaptiveComponent.ByPoints(points=getItemAtIndex_24, familyType=byName_18)

# group: Place AC
number_19 = DoubleInput(20)
eq_21 = count_longest == number_19
boolean_24 = BoolSelector(true)
allIndicesOf_22 = List.AllIndicesOf(list=eq_21, item=boolean_24)
getItemAtIndex_25 = List.GetItemAtIndex(list=startPoint, index=allIndicesOf_22)
code_block_28 = CodeBlock(n=number_19) { a="ADT-FW "; b=" points"; n; c=a+n+b; }
byName_19 = FamilyType.ByName(code_block_28.c)
byPoints_19 = AdaptiveComponent.ByPoints(points=getItemAtIndex_25, familyType=byName_19)

create_2 = List.Create(byPoints_2, byPoints_3, byPoints_4, byPoints_5, byPoints_6, byPoints_7, byPoints_8, byPoints_9, byPoints_10, byPoints_11, byPoints_12, byPoints_13, byPoints_14, byPoints_15, byPoints_16, byPoints_17, byPoints_18, byPoints_19)
flatten_3 = Flatten(create_2)
faces_2 = Element.Faces(select_model_element)
