# Dynamo graph Adaptive2PointsByLines-0901-OK-180130.dyn (Dynamo 0.9.1.4062)

# group: USE LINES
select_lines = DSModelElementsSelection()  # 12 picked in the model
curves = Element.Curves(select_lines)

flatten = Flatten(curves)
startPoint = Curve.StartPoint(flatten)
endPoint = Curve.EndPoint(flatten)
create = List.Create(startPoint, endPoint)
transpose = List.Transpose(create)

# group: SELECT TYPE OF ADAPTIVE COMPONENT
family_types = FamilyTypes("Gen-AD-FenceRail_full_2xPoints:Gen-AD-FenceRail_full_2xPoints")

byPoints = AdaptiveComponent.ByPoints(points=transpose, familyType=family_types)
