# Dynamo graph CadData-PlaceComponentFollowPoints-OK (1).dyn (Dynamo 0.9.1.4062)

# group: Inputs
cad_data_file_path = Filename("D:\DYNAMO\Dynamo 2017-20171103T153953Z-001\Dynamo 2017\CadData.xls")
choose_family_types = FamilyTypes("M_Desk:1830 x 915mm")
block_name = CodeBlock { "BLOCK 1"; }
levels = Levels("Level 1")
false_not_rotate_true_rotate_use = BoolSelector(false)  # "False = not Rotate; True = Rotate; Use False at first"

fromPath = FileObject(cad_data_file_path)  # "File.FromPath"
code_block = CodeBlock { "Summary"; }
boolean = BoolSelector(true)
readFromFile = Excel.ReadFromFile(file=fromPath, sheetName=code_block, readAsStrings=boolean)
transpose = List.Transpose(readFromFile)
count = List.Count(transpose)
code_block_2 = CodeBlock { 1; }
getItemAtIndex = List.GetItemAtIndex(list=transpose, index=code_block_2)
eq = getItemAtIndex == block_name
boolean_2 = BoolSelector(true)
allIndicesOf = List.AllIndicesOf(list=eq, item=boolean_2)
getItemAtIndex_2 = List.GetItemAtIndex(list=readFromFile, index=allIndicesOf)
flatten = Flatten(getItemAtIndex_2)
count_2 = List.Count(flatten)

# group: Get position Z
code_block_3 = CodeBlock { 0; }
getItemAtIndex_3 = List.GetItemAtIndex(list=readFromFile, index=code_block_3)
code_block_4 = CodeBlock { "Position Z"; }
eq_2 = getItemAtIndex_3 == code_block_4
boolean_3 = BoolSelector(true)
indexOf = IndexOf(eq_2, boolean_3)

count_3 = List.Count(getItemAtIndex_3)

# group: get position X
code_block_5 = CodeBlock { 0; }
getItemAtIndex_4 = List.GetItemAtIndex(list=readFromFile, index=code_block_5)
code_block_6 = CodeBlock { "Position X"; }
eq_3 = getItemAtIndex_4 == code_block_6
boolean_4 = BoolSelector(true)
indexOf_2 = IndexOf(eq_3, boolean_4)
code_block_7 = CodeBlock(a=indexOf_2, n=count_2, b=count_3) { a..n..b; }

# group: get position Y
code_block_8 = CodeBlock { 0; }
getItemAtIndex_5 = List.GetItemAtIndex(list=readFromFile, index=code_block_8)
code_block_9 = CodeBlock { "Position Y"; }
eq_4 = getItemAtIndex_5 == code_block_9
boolean_5 = BoolSelector(true)
indexOf_3 = IndexOf(eq_4, boolean_5)
code_block_10 = CodeBlock(a=indexOf_3, n=count_2, b=count_3) { a..n..b; }

# group (continued): Get position Z
code_block_11 = CodeBlock(a=indexOf, n=count_2, b=count_3) { a..n..b; }

# group: create Points
getItemAtIndex_6 = List.GetItemAtIndex(list=flatten, index=code_block_7)
toNumber = String.ToNumber(getItemAtIndex_6)
getItemAtIndex_7 = List.GetItemAtIndex(list=flatten, index=code_block_10)
toNumber_2 = String.ToNumber(getItemAtIndex_7)
getItemAtIndex_8 = List.GetItemAtIndex(list=flatten, index=code_block_11)
toNumber_3 = String.ToNumber(getItemAtIndex_8)
byCoordinates = Point.ByCoordinates(x=toNumber, y=toNumber_2, z=toNumber_3)

byPointAndLevel = FamilyInstance.ByPointAndLevel(familyType=choose_family_types, point=byCoordinates, level=levels)

# group: get rotation degree
code_block_12 = CodeBlock { 0; }
getItemAtIndex_9 = List.GetItemAtIndex(list=readFromFile, index=code_block_12)
code_block_13 = CodeBlock { "Rotation"; }
eq_5 = getItemAtIndex_9 == code_block_13
boolean_6 = BoolSelector(true)
indexOf_4 = IndexOf(eq_5, boolean_6)
code_block_14 = CodeBlock(a=indexOf_4, n=count_2, b=count_3) { a..n..b; }
getItemAtIndex_10 = List.GetItemAtIndex(list=flatten, index=code_block_14)

# group: switch to Rotate by Y/N
boolean_7 = BoolSelector(true)
eq_6 = false_not_rotate_true_rotate_use == boolean_7
toNumber_4 = String.ToNumber(getItemAtIndex_10)
code_block_15 = CodeBlock { 0; }
if_ = If(test=eq_6, true=toNumber_4, false=code_block_15)

setRotation = FamilyInstance.SetRotation(familyInstance=byPointAndLevel, degree=if_)
type = FamilyInstance.Type(byPointAndLevel)
location = FamilyInstance.Location(byPointAndLevel)
