# Dynamo graph CreatePartsFromLink-OK.dyn (Dynamo 0.9.1.4062)

select_model_element = DSModelElementSelection()  # 1 picked in the model
categories = Categories("StructuralColumns")
python_script = Python(IN[0]=select_model_element, IN[1]=categories)
# ---------- python_script.python (40 lines) ----------
import clr

clr.AddReference('RevitAPI')
from Autodesk.Revit.DB import *

clr.AddReference('System')
from System.Collections.Generic import List

clr.AddReference('RevitNodes')
import Revit
clr.ImportExtensions(Revit.GeometryConversion)
clr.ImportExtensions(Revit.Elements)

clr.AddReference('RevitServices')
import RevitServices
from RevitServices.Persistence import DocumentManager
from RevitServices.Transactions import TransactionManager

doc = DocumentManager.Instance.CurrentDBDocument

#Preparing input from dynamo to revit
link = UnwrapElement(IN[0])
category = UnwrapElement(IN[1])
linkDoc = link.GetLinkDocument()

elements = FilteredElementCollector(linkDoc).OfCategoryId(category.Id).WhereElementIsNotElementType()

#Create a genereic list for the elements
eList = List[LinkElementId]()
for e in elements:
	eList.Add(LinkElementId(link.Id,e.Id))

#All actions that makes changes to the Revit database needs to be inside a Transaction
TransactionManager.Instance.EnsureInTransaction(doc)

createparts = PartUtils.CreateParts(doc, eList)

TransactionManager.Instance.TransactionTaskDone()

OUT = elements
# ----------------------------------------
categories_2 = Categories("StructuralFraming")
python_script_2 = Python(IN[0]=select_model_element, IN[1]=categories_2)  # same code as python_script
categories_3 = Categories("Floors")
python_script_3 = Python(IN[0]=select_model_element, IN[1]=categories_3)  # same code as python_script
categories_4 = Categories("StructuralFoundation")
python_script_4 = Python(IN[0]=select_model_element, IN[1]=categories_4)  # same code as python_script
