# Dynamo graph Delete Not Placed Rooms-0901-OK.dyn (Dynamo 0.9.1.4062)

# group: Input Level
levels = Levels("Level 1")

# group: All Rooms on Level
false_all_room = BoolSelector(false)
python_script = Python(IN[0]=levels, IN[1]=false_all_room)
# ---------- python_script.python (60 lines) ----------
# Default imports
import clr
clr.AddReference('ProtoGeometry')
clr.AddReference('RevitAPI')
clr.AddReference('RevitAPIUI')
from Autodesk.Revit.DB import *
import Autodesk
import sys
import clr
clr.AddReference('RevitServices')
import RevitServices
from RevitServices.Persistence import DocumentManager
from RevitServices.Transactions import TransactionManager

path = r'C:\Autodesk\Dynamo\Core'
exec_path = r'C:\Autodesk\Dynamo\Core\dll'
sys.path.append(path)
sys.path.append(exec_path)
#clr.AddReference('LibGNet')
#from Autodesk.LibG import *


#The input to this node will be stored in the IN variable.
dataEnteringNode = IN[0]
level_input = IN[0]
filterToggle = IN[1]
roomNames = []
validRooms = []
invalidRooms = []

#levelID=level_input.Id

doc = DocumentManager.Instance.CurrentDBDocument

level_filter = ElementLevelFilter(Autodesk.Revit.DB.ElementId(level_input.Id))
collector = FilteredElementCollector(doc)

#roomFilter = RoomFilter()


if filterToggle == 0:
	all_rooms_on_level = collector.OfClass(Autodesk.Revit.DB.SpatialElement).WherePasses(level_filter).ToElements()
	#all_rooms_on_level = collector.WherePasses(roomFilter).WherePasses(level_filter).ToElements()
	
	#for i in all_rooms_on_level:

		#roomNames.append(i.get_Parameter("Name").AsString())
	#OUT = all_rooms_on_level, roomNames
	OUT = all_rooms_on_level
else:
	all_rooms_on_level = collector.OfClass(Autodesk.Revit.DB.SpatialElement).WherePasses(level_filter).ToElements()
	for i in all_rooms_on_level:
		if i.Area !=0:
			validRooms.append(i)
	#for i in validRooms:
		#roomNames.append(i.get_Parameter("Name").AsString())
	#OUT = validRooms, roomNames
		if i.Area ==0:
			invalidRooms.append(i)
	OUT = invalidRooms
# ----------------------------------------
parameters = Element.Parameters(python_script)
code_block = CodeBlock { "Name"; }
getParameterValueByName = Element.GetParameterValueByName(element=python_script, parameterName=code_block)

true_alow_to_delete = BoolSelector(true)

# group: Placed Rooms on Level
true_not_placed_rooms = BoolSelector(true)
python_script_2 = Python(IN[0]=levels, IN[1]=true_not_placed_rooms)  # same code as python_script

# group: Delete Unplaced Rooms
boolean = BoolSelector(true)
eq = true_alow_to_delete == boolean
code_block_2 = CodeBlock { "null"; }
if_ = If(test=eq, true=python_script_2, false=code_block_2)
python_script_3 = Python(IN[0]=if_)
# ---------- python_script_3.python (44 lines) ----------
import clr
clr.AddReference('ProtoGeometry')
from Autodesk.DesignScript.Geometry import *
# Import ToDSType(bool) extension method
clr.AddReference("RevitNodes")
import Revit
clr.ImportExtensions(Revit.Elements)
# Import geometry conversion extension methods
clr.ImportExtensions(Revit.GeometryConversion)
# Import DocumentManager and TransactionManager
clr.AddReference("RevitServices")
import RevitServices
from RevitServices.Persistence import DocumentManager
from RevitServices.Transactions import TransactionManager
from System.Collections.Generic import *
# Import RevitAPI
clr.AddReference("RevitAPI")
import Autodesk
from Autodesk.Revit.DB import *

doc = DocumentManager.Instance.CurrentDBDocument
uiapp = DocumentManager.Instance.CurrentUIApplication
app = uiapp.Application

elt = []
for i in IN[0]:
	elt.append(UnwrapElement(i).Id)

# Start Transaction
TransactionManager.Instance.EnsureInTransaction(doc)


cantdelete=[]
for item in elt:
	try:
		doc.Delete(item)
	except:
		cantdelete.append(item)
		

# End Transaction
TransactionManager.Instance.TransactionTaskDone()
doc.Regenerate()
OUT=cantdelete
# ----------------------------------------
