# Dynamo graph DeleteLinkInstances-0901-171219-OK.dyn (Dynamo 0.9.1.4062)

get_link_instances = Python()
# ---------- get_link_instances.python (28 lines) ----------
import clr
clr.AddReference('ProtoGeometry')
clr.AddReference('RevitAPI')
clr.AddReference('RevitAPIUI')
from Autodesk.Revit.DB import *
import Autodesk
import sys
import clr
clr.AddReference('RevitServices')
import RevitServices
from RevitServices.Persistence import DocumentManager
from RevitServices.Transactions import TransactionManager


rvt = IN[0]
link=[]
name=[]
linkinst=[]

doc = DocumentManager.Instance.CurrentDBDocument

			
#looks for links in the active project, add instances to a list
collector = FilteredElementCollector(doc)
filter = ElementCategoryFilter(BuiltInCategory.OST_RvtLinks)
linkinst.append(collector.WherePasses(filter).WhereElementIsNotElementType().ToElements())
	
OUT = (linkinst)
# ----------------------------------------
code_block = CodeBlock(linkInstances=get_link_instances) { linkInstances; }
flatten = Flatten(code_block)
boolean = BoolSelector(true)
deleteRevitInstances = Custom[DeleteRevitInstances](Instances=flatten, TrueOrFalse=boolean)  # Delete Revit Instances
