# Dynamo graph DisallowJoinSelectedWalls-180106-OK.dyn (Dynamo 0.9.1.4062)

select_model_elements_walls = DSModelElementsSelection()  # 5 picked in the model
code_block = CodeBlock(e=select_model_elements_walls) { e; }
start = Revit.Transaction.Transaction.Start(code_block)
firstItem = List.FirstItem(start)
addItemToFront = List.AddItemToFront(item=firstItem, list=start)
python_script = Python(IN[0]=addItemToFront)
# ---------- python_script.python (21 lines) ----------
import clr

clr.AddReference("RevitServices")
import RevitServices
from RevitServices.Persistence import DocumentManager
from RevitServices.Transactions import TransactionManager
doc = DocumentManager.Instance.CurrentDBDocument

clr.AddReference("RevitAPI")
from Autodesk.Revit.DB import WallUtils

walls = UnwrapElement(IN[0])

TransactionManager.Instance.EnsureInTransaction(doc)

for i in range(0,len(walls)):
	WallUtils.DisallowWallJoinAtEnd(walls[i],0)
	WallUtils.DisallowWallJoinAtEnd(walls[i],1)
	
TransactionManager.Instance.TransactionTaskDone()
OUT = "Successfull"
# ----------------------------------------
end = Revit.Transaction.Transaction.End(python_script)
