# Dynamo graph DuplicateWithDetailingByAllPhases-0901-OK.dyn (Dynamo 0.9.1.4062)

# group: Get all Phases
get_phases = Python()
# ---------- get_phases.python (45 lines) ----------
#import libraries and reference
import clr
clr.AddReference('ProtoGeometry')
from Autodesk.DesignScript.Geometry import *
clr.AddReference('RevitAPI')
from Autodesk.Revit.DB import *
clr.AddReference('RevitAPIUI')
from Autodesk.Revit.UI import TaskDialog
clr.AddReference("RevitNodes")
import Revit
clr.ImportExtensions(Revit.Elements)
# Import geometry conversion extension methods
clr.ImportExtensions(Revit.GeometryConversion)
# Import DocumentManager and TransactionManager
clr.AddReference("RevitServices")
import RevitServices
from RevitServices.Persistence import DocumentManager
from RevitServices.Transactions import TransactionManager
from System.Collections.Generic import *


doc = DocumentManager.Instance.CurrentDBDocument
uiapp = DocumentManager.Instance.CurrentUIApplication
app = uiapp.Application
#The inputs to this node will be stored as a list in the IN variables.
dataEnteringNode = IN

elems = list()
elemName = list()
elemDes = list()

for phase in doc.Phases:
	elems.append(phase)
	elemName.append(phase.Name)


# Start Transaction
TransactionManager.Instance.EnsureInTransaction(doc)

# End Transaction
TransactionManager.Instance.TransactionTaskDone()
doc.Regenerate()

#Assign your output to the OUT variable.
OUT = elems
# ----------------------------------------
parameters = Element.Parameters(get_phases)
code_block = CodeBlock { "Sequence Number"; "Name"; }
getParameterValueByName = Element.GetParameterValueByName(element=get_phases, parameterName=code_block.out0)
boolean = BoolSelector(true)
sortIndexByValue = SortIndexByValue(getParameterValueByName, boolean)
getItemAtIndex = List.GetItemAtIndex(list=get_phases, index=sortIndexByValue)
getParameterValueByName_2 = Element.GetParameterValueByName(element=get_phases, parameterName=code_block.out1)

current = Document.Current()
activeView = Document.ActiveView(current)
count = Count(getItemAtIndex)
duplicate_views_w_detailing = Python(IN[0]=activeView, IN[1]=count)
# ---------- duplicate_views_w_detailing.python (45 lines) ----------
import clr
clr.AddReference('ProtoGeometry')
from Autodesk.DesignScript.Geometry import *
clr.AddReference('RevitAPI')
from Autodesk.Revit.DB import *
clr.AddReference('RevitAPIUI')
from Autodesk.Revit.UI import TaskDialog
clr.AddReference("RevitNodes")
import Revit
clr.ImportExtensions(Revit.Elements)
clr.AddReference("RevitServices")
import RevitServices
from RevitServices.Persistence import DocumentManager
from RevitServices.Transactions import TransactionManager
from System.Collections.Generic import *
#The inputs to this node will be stored as a list in the IN variables.
dataEnteringNode = IN

doc = DocumentManager.Instance.CurrentDBDocument
uiapp = DocumentManager.Instance.CurrentUIApplication
app = uiapp.Application


cView = UnwrapElement(IN[0])
aV = IN[1]
newViews = []
nvId=[]
dOp = ViewDuplicateOption.WithDetailing

# Start Transaction
TransactionManager.Instance.EnsureInTransaction(doc)

for i in range(0,aV):
	idV=cView.Duplicate(dOp)
	nvId.append(idV)
	
for j in range(0,len(nvId)):
	nV = cView.Document.GetElement(nvId[j])
	newViews.append(nV)

# End Transaction
TransactionManager.Instance.TransactionTaskDone()
doc.Regenerate()
#Assign your output to the OUT variable.
OUT = newViews
# ----------------------------------------
code_block_2 = CodeBlock { "View Name"; "Phase"; }

# group: START ----- by Inputting
suffix_name = StringInput("55")

code_block_3 = CodeBlock(sf=suffix_name, mf=sortIndexByValue, pf=getParameterValueByName_2) { sf+"_"+mf+"_"+pf; }
setParameterByName = Element.SetParameterByName(element=duplicate_views_w_detailing, parameterName=code_block_2.out0, value=code_block_3)
setParameterByName_2 = Element.SetParameterByName(element=setParameterByName, parameterName=code_block_2.out1, value=getItemAtIndex)
