# Dynamo graph ExportSchedules-180104-OK.dyn (Dynamo 0.9.1.4062)

views = Views("Project View")
directory_path = Directory("C:\Users\tvpduy\Desktop\RevitSchedule")
name = Element.Name(views)
code_block = CodeBlock(name=name) { name + ".txt"; }
python_script = Python(IN[0]=views, IN[1]=directory_path, IN[2]=code_block)
# ---------- python_script.python (17 lines) ----------
import clr
clr.AddReference('ProtoGeometry')
from Autodesk.DesignScript.Geometry import *
clr.AddReference('RevitAPI')
from Autodesk.Revit.DB import *
#The inputs to this node will be stored as a list in the IN variables.
dataEnteringNode = IN
schedule = UnwrapElement(IN[0])
path = IN[1]
name = IN[2]
try:
	exp_opt = ViewScheduleExportOptions()
	schedule.Export(path, name, exp_opt)
	OUT = "Done"

except: OUT = "Nope"
#Assign your output to the OUT variable.
# ----------------------------------------
fromPath = DirectoryObject(directory_path)  # "Directory.FromPath"
views_2 = Views("Project View")
name_2 = Element.Name(views_2)
code_block_2 = CodeBlock(name=name_2) { name + ".txt"; }
python_script_2 = Python(IN[0]=views_2, IN[1]=directory_path, IN[2]=code_block_2)  # same code as python_script
fromPath_2 = DirectoryObject(directory_path)  # "Directory.FromPath"
views_3 = Views("Project View")
name_3 = Element.Name(views_3)
code_block_3 = CodeBlock(name=name_3) { name + ".txt"; }
python_script_3 = Python(IN[0]=views_3, IN[1]=directory_path, IN[2]=code_block_3)  # same code as python_script
fromPath_3 = DirectoryObject(directory_path)  # "Directory.FromPath"
views_4 = Views("Project View")
name_4 = Element.Name(views_4)
code_block_4 = CodeBlock(name=name_4) { name + ".txt"; }
python_script_4 = Python(IN[0]=views_4, IN[1]=directory_path, IN[2]=code_block_4)  # same code as python_script
fromPath_4 = DirectoryObject(directory_path)  # "Directory.FromPath"
views_5 = Views("Project View")
name_5 = Element.Name(views_5)
code_block_5 = CodeBlock(name=name_5) { name + ".txt"; }
python_script_5 = Python(IN[0]=views_5, IN[1]=directory_path, IN[2]=code_block_5)  # same code as python_script
fromPath_5 = DirectoryObject(directory_path)  # "Directory.FromPath"
views_6 = Views("Project View")
name_6 = Element.Name(views_6)
code_block_6 = CodeBlock(name=name_6) { name + ".txt"; }
python_script_6 = Python(IN[0]=views_6, IN[1]=directory_path, IN[2]=code_block_6)  # same code as python_script
fromPath_6 = DirectoryObject(directory_path)  # "Directory.FromPath"
