# Dynamo graph ExternalWork-FrameSystem-180312.dyn (Dynamo 0.9.1.4062)

code_block = CodeBlock()
# ---------- code_block.designscript (6 lines) ----------
mode1;
// vẽ 2D, kiểm tra offset;
mode2;
//vẽ mass 3D;
mode3;
//vẽ cấu kiện;
# ----------------------------------------
integer_slider = IntegerSlider(1, range=1..3 step 1)
line_name = CodeBlock { "ES_SpanLength_1830"; "ES_SpanLength_1225"; }
code_block_2 = CodeBlock(linename=line_name.out0) { linename; }
offsetFromBoundary = CodeBlock()
# ---------- offsetFromBoundary.designscript (2 lines) ----------
300;
//default;
# ----------------------------------------
# note: Nếu Length < 1225 + 100 +100--> Tách ra list mới
flip = BoolSelector(false)
if_ = If(test=flip)
reverse_start_end = BoolSelector(true)
select_model_elements = DSModelElementsSelection()  # frozen
count = Count(select_model_elements)
code_block_3 = CodeBlock { 1; }
eq = count == code_block_3
test_length_of_line = CodeBlock { "Length"; testLength = 1225+100+100; true; false; }
# note: List > 1225+100+100
getParameterValueByName = Element.GetParameterValueByName(element=select_model_elements, parameterName=test_length_of_line.out0)
gt = getParameterValueByName > test_length_of_line.testLength
allIndicesOf = List.AllIndicesOf(list=gt, item=test_length_of_line.out2)
getItemAtIndex = List.GetItemAtIndex(list=select_model_elements, index=allIndicesOf)
if_2 = If(test=eq, true=select_model_elements, false=getItemAtIndex)
geometry = Element.Geometry(if_2)
flatten = Flatten(geometry)
endPoint = Curve.EndPoint(flatten)
startPoint = Curve.StartPoint(flatten)
create = List.Create(endPoint, startPoint)
create_2 = List.Create(startPoint, endPoint)
if_3 = If(test=reverse_start_end, true=create, false=create_2)
transpose = List.Transpose(if_3)
family_type_name = CodeBlock { "Scaffold-FrameSystem"; }
byName = FamilyType.ByName(family_type_name)
byPoints = AdaptiveComponent.ByPoints(points=transpose, familyType=byName)
code_block_4 = CodeBlock { "StartSpace"; 300; }
setParameterByName = Element.SetParameterByName(element=byPoints, parameterName=code_block_4.out0, value=code_block_4.out1)
family_type_name_2 = CodeBlock { "Scaffold-FrameSystem"; }
byName_2 = FamilyType.ByName(family_type_name_2)
startPoint_2 = Curve.StartPoint()
endPoint_2 = Curve.EndPoint()
create_3 = List.Create(startPoint_2, endPoint_2)
transpose_2 = List.Transpose(create_3)
byIsoCurveOnSurface = Curve.ByIsoCurveOnSurface()
reverse_start_end_2 = BoolSelector(false)
select_a_line = DSModelElementsSelection()  # 1 picked in the model
start = Revit.Transaction.Transaction.Start(select_a_line)
code_block_5 = CodeBlock(line=start) { line; }
geometry_2 = Element.Geometry(code_block_5)
endPoint_3 = Curve.EndPoint(geometry_2)
startPoint_3 = Curve.StartPoint(geometry_2)
byStartPointEndPoint = Line.ByStartPointEndPoint(startPoint=endPoint_3, endPoint=startPoint_3)
byStartPointEndPoint_2 = Line.ByStartPointEndPoint(startPoint=startPoint_3, endPoint=endPoint_3)
if_4 = If(test=reverse_start_end_2, true=byStartPointEndPoint, false=byStartPointEndPoint_2)
flip_2 = BoolSelector(true)
offset_from_boundary = CodeBlock { 300; }
spanLengthSpecial = CodeBlock { 1225; }
code_block_6 = CodeBlock(offset=offset_from_boundary, frameWidth=spanLengthSpecial) { offset; -offset; frameWidth; -frameWidth; }
if_5 = If(test=flip_2, true=code_block_6.out1, false=code_block_6.offset)
offset = Curve.Offset(curve=if_4, distance=if_5)
spanLengthCommon = CodeBlock { 1830; }
decreasing_module = CodeBlock { 1; }

# group: Analyse LENGTH
length = Curve.Length(offset)
code_block_7 = CodeBlock { 1830; 1225; }
code_block_8 = CodeBlock(length=length, d=decreasing_module, spanLength=code_block_7.out0)
# ---------- code_block_8.designscript (2 lines) ----------
trueLength = length -
Math.Abs(d)*spanLength;
# ----------------------------------------
mod = code_block_8 % code_block_7.out0
sub = code_block_8 - mod
div = sub / code_block_7.out0
ofRepeatedItem = List.OfRepeatedItem(item=spanLengthCommon, amount=div)
flatten_2 = Flatten(ofRepeatedItem)

point_by_divided_distance = Python(IN[0]=offset, IN[1]=flatten_2)
# ---------- point_by_divided_distance.python (16 lines) ----------
import clr
clr.AddReference('ProtoGeometry')
from Autodesk.DesignScript.Geometry import *
#The inputs to this node will be stored as a list in the IN variables.
dataEnteringNode = IN
curve = IN[0]
listDist = IN[1]

pointsAtDistance = []

for c in curve:
	for i in range(len(listDist)+1):
		point = c.PointAtDistance(i*listDist[0])
		pointsAtDistance.append(point)
#Assign your output to the OUT variable.
OUT = pointsAtDistance
# ----------------------------------------
if_6 = If(test=flip_2, true=code_block_6.out3, false=code_block_6.frameWidth)
offset_2 = Curve.Offset(curve=offset, distance=if_6)
point_by_divided_distance_2 = Python(IN[0]=offset_2, IN[1]=flatten_2)  # same code as point_by_divided_distance

# group: List of Frame Points
create_4 = List.Create(point_by_divided_distance, point_by_divided_distance_2)
transpose_3 = List.Transpose(create_4)

# group: List of Frame Points
create_5 = List.Create(point_by_divided_distance, point_by_divided_distance_2)
transpose_4 = List.Transpose(create_5)

# group: List of Brace points inside
list_of_brace_points = Python(IN[0]=point_by_divided_distance)
# ---------- list_of_brace_points.python (21 lines) ----------
import clr
clr.AddReference('ProtoGeometry')
from Autodesk.DesignScript.Geometry import *
#The inputs to this node will be stored as a list in the IN variables.
dataEnteringNode = IN
points = IN[0]


bracePoints = []

for i in range(len(points)-1):
	newpoint1 = points[i]
	newpoint2 = points[i+1]
	newPointCouple = []
	newPointCouple.append(newpoint1)
	newPointCouple.append(newpoint2)
	
	bracePoints.append(newPointCouple)
	
#Assign your output to the OUT variable.
OUT = bracePoints
# ----------------------------------------

# group: List of Brace points Outside
list_of_brace_points_2 = Python(IN[0]=point_by_divided_distance_2)  # same code as list_of_brace_points

lastItem = List.LastItem(point_by_divided_distance)
endPoint_4 = Curve.EndPoint(offset)
byStartPointEndPoint_3 = Line.ByStartPointEndPoint(startPoint=lastItem, endPoint=endPoint_4)
the_rest_length_of_curve = CodeBlock(spanLength1=spanLengthCommon, spanLength2=spanLengthSpecial, length=length, n=div)
# ---------- the_rest_length_of_curve.designscript (6 lines) ----------
spanLength1;
spanLength2;
restLength = Math.Round(length -
n*spanLength1);
modulo = restLength % spanLength2;
divNumber = Math.Round((restLength-modulo)/spanLength2);
# ----------------------------------------
ofRepeatedItem_2 = List.OfRepeatedItem(item=the_rest_length_of_curve.spanLength2, amount=the_rest_length_of_curve.divNumber)
flatten_3 = Flatten(ofRepeatedItem_2)
point_by_divided_distance_3 = Python(IN[0]=byStartPointEndPoint_3, IN[1]=flatten_3)  # same code as point_by_divided_distance
lastItem_2 = List.LastItem(point_by_divided_distance_2)
endPoint_5 = Curve.EndPoint(offset_2)
byStartPointEndPoint_4 = Line.ByStartPointEndPoint(startPoint=lastItem_2, endPoint=endPoint_5)
point_by_divided_distance_4 = Python(IN[0]=byStartPointEndPoint_4, IN[1]=flatten_3)  # same code as point_by_divided_distance

# group: List of Frame Points
create_6 = List.Create(point_by_divided_distance_3, point_by_divided_distance_4)
transpose_5 = List.Transpose(create_6)
deconstruct = List.Deconstruct(list=transpose_5)

# group: List of Brace points Outside
list_of_brace_points_3 = Python(IN[0]=point_by_divided_distance_3)  # same code as list_of_brace_points

# group: List of Brace points Outside
list_of_brace_points_4 = Python(IN[0]=point_by_divided_distance_4)  # same code as list_of_brace_points

line_categories = CodeBlock { "ES_SpanLength_1225"; "ES_SpanLength_1830"; }

# group: Create lines
firstItem = List.FirstItem(point_by_divided_distance)
lastItem_3 = List.LastItem(point_by_divided_distance)
byStartPointEndPoint_5 = Line.ByStartPointEndPoint(startPoint=firstItem, endPoint=lastItem_3)
byCurve = ModelCurve.ByCurve(byStartPointEndPoint_5)
get_line_category_by_id = Python(IN[0]=line_categories.out1)
# ---------- get_line_category_by_id.python (36 lines) ----------
import clr
clr.AddReference('ProtoGeometry')
from Autodesk.DesignScript.Geometry import *
clr.AddReference('RevitAPI')
from Autodesk.Revit.DB import *
from Autodesk.Revit.DB import ElementId
clr.AddReference('RevitAPIUI')
from Autodesk.Revit.UI import TaskDialog
clr.AddReference("RevitNodes")
import Revit
clr.ImportExtensions(Revit.Elements)
clr.ImportExtensions(Revit.GeometryConversion)
clr.AddReference("RevitServices")
import RevitServices
from RevitServices.Persistence import DocumentManager
from RevitServices.Transactions import TransactionManager
from System.Collections.Generic import *

doc = DocumentManager.Instance.CurrentDBDocument
uiapp = DocumentManager.Instance.CurrentUIApplication
app = uiapp.Application

dataEnteringNode = IN
catName = IN[0]

graphStyles = FilteredElementCollector(doc).OfClass(GraphicsStyle)
graphId = []

for style in graphStyles:
	name = style.Name
	if name == catName:
		graphId.append(style.Id)
id = graphId[0]

#Assign your output to the OUT variable.
OUT = doc.GetElement(id)
# ----------------------------------------
code_block_9 = CodeBlock(value=get_line_category_by_id) { "Line Style"; value; }
setParameterByName_2 = Element.SetParameterByName(element=byCurve, parameterName=code_block_9.out0, value=code_block_9.value)
firstItem_2 = List.FirstItem(point_by_divided_distance_2)
lastItem_4 = List.LastItem(point_by_divided_distance_2)
byStartPointEndPoint_6 = Line.ByStartPointEndPoint(startPoint=firstItem_2, endPoint=lastItem_4)
byCurve_2 = ModelCurve.ByCurve(byStartPointEndPoint_6)
setParameterByName_3 = Element.SetParameterByName(element=byCurve_2, parameterName=code_block_9.out0, value=code_block_9.value)

firstItem_3 = List.FirstItem(point_by_divided_distance_3)
lastItem_5 = List.LastItem(point_by_divided_distance_3)
byStartPointEndPoint_7 = Line.ByStartPointEndPoint(startPoint=firstItem_3, endPoint=lastItem_5)
firstItem_4 = List.FirstItem(point_by_divided_distance_4)
lastItem_6 = List.LastItem(point_by_divided_distance_4)
byStartPointEndPoint_8 = Line.ByStartPointEndPoint(startPoint=firstItem_4, endPoint=lastItem_6)

# group: Create Line
byCurve_3 = ModelCurve.ByCurve(byStartPointEndPoint_7)
get_line_category_by_id_2 = Python(IN[0]=line_categories.out0)  # same code as get_line_category_by_id
code_block_10 = CodeBlock(value=get_line_category_by_id_2) { "Line Style"; value; }
setParameterByName_4 = Element.SetParameterByName(element=byCurve_3, parameterName=code_block_10.out0, value=code_block_10.value)
byCurve_4 = ModelCurve.ByCurve(byStartPointEndPoint_8)
setParameterByName_5 = Element.SetParameterByName(element=byCurve_4, parameterName=code_block_10.out0, value=code_block_10.value)

create_7 = List.Create(transpose_3, transpose_4, list_of_brace_points, list_of_brace_points_2, deconstruct.rest, list_of_brace_points_3, list_of_brace_points_4, setParameterByName_2, setParameterByName_3, setParameterByName_4, setParameterByName_5)
