# Dynamo graph Slab Fromwork old.dyn (Dynamo 0.8.2.2392)

select_model_elements = DSModelElementsSelection()  # 23 picked in the model
categories = Categories("StructuralFraming")
isOfCategory = Custom[Element.IsOfCategory](element=select_model_elements, category=categories)  # Checks whether an element is of a specified category
filterByBoolMask = List.FilterByBoolMask(list=select_model_elements, mask=isOfCategory)
boolean = BoolSelector(true)
categories_2 = Categories("Floors")
isOfCategory_2 = Custom[Element.IsOfCategory](element=select_model_elements, category=categories_2)
filterByBoolMask_2 = List.FilterByBoolMask(list=select_model_elements, mask=isOfCategory_2)
map_to_1d_list = Python(IN[0]=filterByBoolMask_2.in)
# ---------- map_to_1d_list.python (16 lines) ----------
import clr
clr.AddReference('ProtoGeometry')
from Autodesk.DesignScript.Geometry import *
#The inputs to this node will be stored as a list in the IN variables.
dataEnteringNode = IN
_input = IN[0]
_output = []

if not isinstance(_input,list):
	_output.append(_input)
else:
	for i in range(0, len(_input)):
		_output.append(_input[i])

#Assign your output to the OUT variable.
OUT = _output
# ----------------------------------------
doan_floor_element_collector = Python(IN[0]=boolean, IN[1]=map_to_1d_list)
# ---------- doan_floor_element_collector.python (91 lines) ----------
#Copyright(c) 2014, Nathan Miller
# The Proving Ground, http://theprovingground.org
import clr

# Import RevitAPI
clr.AddReference("RevitAPI")
import Autodesk
from Autodesk.Revit.DB import *

# Import DocumentManager and TransactionManager
clr.AddReference("RevitServices")
import RevitServices
from RevitServices.Persistence import DocumentManager
from RevitServices.Transactions import TransactionManager

# Import ToDSType(bool) extension method
clr.AddReference("RevitNodes")
import Revit
clr.ImportExtensions(Revit.Elements)

#The input to this node will be stored in the IN[0] variable.

doc =  DocumentManager.Instance.CurrentDBDocument
app =  DocumentManager.Instance.CurrentUIApplication.Application

toggle = IN[0]
floors = UnwrapElement(IN[1])

output = []
#floors = []
levels = []
areas = []
boundaries = []
locations = []
elementids = []
uniqueids = []

if toggle == True:
	#collector = FilteredElementCollector(doc)
	#collector.OfClass(Floor)
 
	#famtypeitr = collector.GetElementIdIterator()
	#famtypeitr.Reset()

	for floor in floors:
		#famtypeID = floor.Id
		#faminst = doc.GetElement(famtypeID)
		#if floortype == '*':
		#floor = faminst
		for p in floor.Parameters:
			if p.Definition.Name == 'Level':		
				level = p.AsValueString()
			if p.Definition.Name == 'Area':		
				area = p.AsDouble

		elementid = floor.Id.ToString()
		uniqueid = floor.UniqueId
    	
		boptions = app.Create.NewGeometryOptions()
		floorgeo = floor.get_Geometry(boptions)
		faces = []
		for geo in floorgeo:
			instance = geo		
			solidface = instance.Faces
			for face in solidface:
				faces.append(face)
    
		edgeloops = faces[1].EdgeLoops
		edges = []
		for loop in edgeloops:
			edgs = []
			for edge in loop:
				edgs.append(Revit.GeometryConversion.RevitToProtoCurve.ToProtoType( edge.AsCurve(), True ))
			edges.append(edgs)
    	
		#floors.append(floor)
		boundaries.append(edges)
		levels.append(level)
		areas.append(area)
		elementids.append(elementid)
		uniqueids.append(uniqueid)    
        
	output.append(floors)
	output.append(boundaries)
	output.append(levels)
	output.append(areas)
	output.append(elementids)
	output.append(uniqueids)
        
#Assign your output to the OUT variable
OUT = output
# ----------------------------------------
code_block = CodeBlock(out=doan_floor_element_collector) { floors = out[0]; floorboundary = out[1]; level = out[2]; area = out[3]; elementID = out[4]; uniqueID = out[5]; }
watch = Watch(code_block.floorboundary)
flatten = Flatten()
map = List.Map(list=watch, f_x=flatten)
flatten_2 = Flatten(map)
code_block_2 = CodeBlock { "Thickness"; }
getParameterValueByName = Element.GetParameterValueByName(element=code_block.floors, parameterName=code_block_2)
map_thong_so_dau_vao = Python(IN[0]=getParameterValueByName, IN[1]=map)
# ---------- map_thong_so_dau_vao.python (16 lines) ----------
import clr
clr.AddReference('ProtoGeometry')
from Autodesk.DesignScript.Geometry import *
#The inputs to this node will be stored as a list in the IN variables.
dataEnteringNode = IN
listA = IN[0]
listB = IN[1]
listC = []

for i in range(0, len(listB)):
	for j in range(0, len(listB[i])):
		listC.append(listA[i])
	

#Assign your output to the OUT variable.
OUT = listC
# ----------------------------------------
code_block_3 = CodeBlock { "Level"; }
getParameterValueByName_2 = Element.GetParameterValueByName(element=code_block.floors, parameterName=code_block_3)
map_thong_so_dau_vao_2 = Python(IN[0]=getParameterValueByName_2, IN[1]=map)  # same code as map_thong_so_dau_vao
wall_types = WallTypes("Coffa")
byCurveAndHeight = Wall.ByCurveAndHeight(curve=flatten_2, height=map_thong_so_dau_vao, level=map_thong_so_dau_vao_2, wallType=wall_types, lacing=Longest)
code_block_4 = CodeBlock { "Base Offset"; }
code_block_5 = CodeBlock(x=map_thong_so_dau_vao) { -x; }
setParameterByName = Element.SetParameterByName(element=byCurveAndHeight, parameterName=code_block_4, value=code_block_5)
byJoinedCurves = PolyCurve.ByJoinedCurves(watch)
lay_item_tu_1_n = Python(IN[0]=byJoinedCurves)
# ---------- lay_item_tu_1_n.python (11 lines) ----------
import clr
clr.AddReference('ProtoGeometry')
from Autodesk.DesignScript.Geometry import *
#The inputs to this node will be stored as a list in the IN variables.
dataEnteringNode = IN
lsA = IN[0]

for i in range(0, len(lsA)):
	del lsA[i][0]
#Assign your output to the OUT variable.
OUT = lsA
# ----------------------------------------
length = Curve.Length(byJoinedCurves)
remove_max_length_item = Python(IN[0]=length, IN[1]=byJoinedCurves)
# ---------- remove_max_length_item.python (19 lines) ----------
import clr
clr.AddReference('ProtoGeometry')
from Autodesk.DesignScript.Geometry import *
#The inputs to this node will be stored as a list in the IN variables.
dataEnteringNode = IN
lsA = IN[0]
lsB = IN[1]
lsMax = []
inMax = []

#Tim maximum
_indexMax = 0
for i in range(0, len(lsA)):
	lsMax.append(lsB[i][lsA[i].index(max(lsA[i]))])
	_indexMax = lsA[i].index(max(lsA[i]))
	inMax.append(_indexMax)
	del lsB[i][lsA[i].index(max(lsA[i]))]
#Assign your output to the OUT variable.
OUT = lsB, lsMax, inMax
# ----------------------------------------
code_block_6 = CodeBlock(out=remove_max_length_item) { nsideCurves = Flatten(out[0]); boundaries = out[1]; insideCurvesIndex = out[2]; }
floor_types = FloorTypes("Coffa Floor")
byOutlineTypeAndLevel = Floor.ByOutlineTypeAndLevel(outline=code_block_6.boundaries, floorType=floor_types, level=getParameterValueByName_2)
end = Revit.Transaction.Transaction.End(byOutlineTypeAndLevel)
flatten_3 = Flatten(end)
code_block_7 = CodeBlock { "Height Offset From Level"; }
code_block_8 = CodeBlock { "Height Offset From Level"; }
getParameterValueByName_3 = Element.GetParameterValueByName(element=code_block.floors, parameterName=code_block_8)
code_block_9 = CodeBlock(A=getParameterValueByName_3, B=getParameterValueByName) { -A-B; }
setParameterByName_2 = Element.SetParameterByName(element=flatten_3, parameterName=code_block_7, value=code_block_9)
map_floor_with_opening = Python(IN[0]=setParameterByName_2, IN[1]=byJoinedCurves)
# ---------- map_floor_with_opening.python (18 lines) ----------
import clr
clr.AddReference('ProtoGeometry')
from Autodesk.DesignScript.Geometry import *
#The inputs to this node will be stored as a list in the IN variables.
dataEnteringNode = IN
lsA = IN[0]
lsB = IN[1]
lsC = []
for i in range(0, len(lsA)):
	try:
		for j in range(0, len(lsB[i])-1):
			lsC.append(lsA[i])
	
	except:
		pass

#Assign your output to the OUT variable.
OUT = lsC
# ----------------------------------------
watch_2 = Watch(code_block_6.nsideCurves)
curves = PolyCurve.Curves(watch_2)
python_script = Python(IN[0]=map_floor_with_opening, IN[1]=curves)
# ---------- python_script.python (45 lines) ----------
import clr

# Import RevitAPI
clr.AddReference("RevitAPI")
import Autodesk
from Autodesk.Revit.DB import *

# Import DocumentManager and TransactionManager
clr.AddReference("RevitServices")
import RevitServices
from RevitServices.Persistence import DocumentManager
from RevitServices.Transactions import TransactionManager

# Import ToDSType(bool) extension method
clr.AddReference("RevitNodes")
import Revit
clr.ImportExtensions(Revit.Elements)
clr.ImportExtensions(Revit.GeometryConversion)

#The input to this node will be stored in the IN[0] variable.

doc =  DocumentManager.Instance.CurrentDBDocument

flr = IN[0]
hole = IN[1]
ind = 0
newfl = []
newhl = []

TransactionManager.Instance.EnsureInTransaction(doc)

for h in range(len(hole)):
	z = CurveArray()
	for j in range(len(hole[h])):
		z.Append(hole[h][j].ToRevitType())
	newhl.append(z)

for f in range(0,len(flr)):
	x = doc.Create.NewOpening(UnwrapElement(flr)[f],newhl[f],False)
	newfl.append(x.ToDSType(False))
	ind = ind + 1

TransactionManager.Instance.TransactionTaskDone()

OUT = newfl
# ----------------------------------------
end_2 = Revit.Transaction.Transaction.End(python_script)
watch_3 = Watch(code_block_6.boundaries)
code_block_10 = CodeBlock { "Width"; }
getParameterValueByName_4 = Element.GetParameterValueByName(element=wall_types, parameterName=code_block_10)
code_block_11 = CodeBlock(width=getParameterValueByName_4) { width/2; -width/2; }
offset = Curve.Offset(curve=watch_2, distance=code_block_11.out0)
length_2 = Curve.Length(offset)
offset_2 = Curve.Offset(curve=watch_2, distance=code_block_11.out1)
length_3 = Curve.Length(offset_2)
lay_duong_bao_ben_trong = Python(IN[0]=length_2, IN[1]=length_3, IN[2]=offset, IN[3]=offset_2)
# ---------- lay_duong_bao_ben_trong.python (20 lines) ----------
import clr
clr.AddReference('ProtoGeometry')
from Autodesk.DesignScript.Geometry import *
#The inputs to this node will be stored as a list in the IN variables.
dataEnteringNode = IN
curlen1 = IN[0]
curlen2 = IN[1]
cur1 = IN[2]
cur2 = IN[3]

output1 = []

for i in range(0, len(cur1)):
	if curlen1[i] < curlen2[i]:
		output1.append(cur1[i])
	else:
		output1.append(cur2[i])

#Assign your output to the OUT variable.
OUT = output1
# ----------------------------------------
explode = Geometry.Explode(lay_duong_bao_ben_trong)
flatten_4 = Flatten(explode)
code_block_12 = CodeBlock { 500; }
levels = Levels("Level 2")
byCurveAndHeight_2 = Wall.ByCurveAndHeight(curve=flatten_4, height=code_block_12, level=levels, wallType=wall_types, lacing=Longest)
watch_4 = Watch(code_block_6.boundaries)
offset_3 = Curve.Offset(curve=watch_4, distance=code_block_11.out0)
length_4 = Curve.Length(offset_3)
offset_4 = Curve.Offset(curve=watch_4, distance=code_block_11.out1)
length_5 = Curve.Length(offset_4)
lay_duong_bao_ben_ngoai = Python(IN[0]=length_4, IN[1]=length_5, IN[2]=offset_3, IN[3]=offset_4)
# ---------- lay_duong_bao_ben_ngoai.python (20 lines) ----------
import clr
clr.AddReference('ProtoGeometry')
from Autodesk.DesignScript.Geometry import *
#The inputs to this node will be stored as a list in the IN variables.
dataEnteringNode = IN
curlen1 = IN[0]
curlen2 = IN[1]
cur1 = IN[2]
cur2 = IN[3]

output1 = []

for i in range(0, len(cur1)):
	if curlen1[i] > curlen2[i]:
		output1.append(cur1[i])
	else:
		output1.append(cur2[i])

#Assign your output to the OUT variable.
OUT = output1
# ----------------------------------------
explode_2 = Geometry.Explode(lay_duong_bao_ben_ngoai)
flatten_5 = Flatten(explode_2)
code_block_13 = CodeBlock { 500; }
levels_2 = Levels("Level 2")
byCurveAndHeight_3 = Wall.ByCurveAndHeight(curve=flatten_5, height=code_block_13, level=levels_2, wallType=wall_types, lacing=Longest)
map_orginal_floor_with_opening = Python(IN[0]=code_block.floors, IN[1]=byJoinedCurves)  # same code as map_floor_with_opening
python_script_2 = Python(IN[0]=map_orginal_floor_with_opening, IN[1]=explode)  # starter script, not edited (OUT = 0)
