# Dynamo graph Slab Fromwork.dyn (Dynamo 0.8.2.2392)

select_model_elements = DSModelElementsSelection()  # 27 picked in the model
categories = Categories("StructuralFraming")
isOfCategory = Custom[Element.IsOfCategory](element=select_model_elements, category=categories)  # Checks whether an element is of a specified category
filterByBoolMask = List.FilterByBoolMask(list=select_model_elements, mask=isOfCategory)
boolean = BoolSelector(false)
elementSketch = Custom[Collector.ElementSketch](element_s=filterByBoolMask.out, refresh=boolean)  # Get the actual sketch lines of a sketch based element (floor, ceiling, modified wall, etc.) . You can optionally fetch the matching model curves, however this might prove comptationally heavy on larger data sets.
flatten = Flatten(elementSketch.curves)
python_script = Python(IN[0]=filterByBoolMask.in)
# ---------- python_script.python (33 lines) ----------
import clr
import math

clr.AddReference("RevitServices")
import RevitServices
from RevitServices.Persistence import DocumentManager
from RevitServices.Transactions import TransactionManager
doc = DocumentManager.Instance.CurrentDBDocument

clr.AddReference("RevitNodes")
import Revit
clr.ImportExtensions(Revit.Elements)
clr.ImportExtensions(Revit.GeometryConversion)

clr.AddReference("RevitAPI")

from Autodesk.Revit.DB import *


#The inputs to this node will be stored as a list in the IN variables.
dataEnteringNode = IN
ls = UnwrapElement(IN[0])
Solids = []
for faminst in ls:
	Solid = []
	geo = faminst.GetOriginalGeometry(Options()).GetTransformed(faminst.GetTransform())
	for g in geo:
		s1 = g.Convert()
		if s1 != None: Solid.append(s1)
	Solids.append(Solid)

#Assign your output to the OUT variable.
OUT = Solids
# ----------------------------------------
byUnion = Solid.ByUnion(python_script)
byUnion_2 = Solid.ByUnion(byUnion)
intersect = Geometry.Intersect(geometry=byUnion_2, other=flatten)
length = Curve.Length(intersect)
python_script_2 = Python(IN[0]=length)
# ---------- python_script_2.python (17 lines) ----------
import clr
clr.AddReference('ProtoGeometry')
from Autodesk.DesignScript.Geometry import *
#The inputs to this node will be stored as a list in the IN variables.
dataEnteringNode = IN
ls =IN[0]
kq = []
for i in range(0, len(ls)):
	sum = 0
	if len(ls[i]) != 0:
		for j in range(len(ls[i])):
			sum = sum + ls[i][j]	
	kq.append(sum)	
			

#Assign your output to the OUT variable.
OUT = kq
# ----------------------------------------
length_2 = Curve.Length(flatten)
code_block = CodeBlock(a=python_script_2, b=length_2) { a/b*100; }
code_block_2 = CodeBlock { 50; }
lt = code_block < code_block_2
filterByBoolMask_2 = List.FilterByBoolMask(list=flatten, mask=lt)
code_block_3 = CodeBlock { 100; }
levels = Levels("Level 1")
wall_types = WallTypes("Generic - 200mm")
byCurveAndHeight = Wall.ByCurveAndHeight(curve=filterByBoolMask_2.in, height=code_block_3, level=levels, wallType=wall_types)
