# Dynamo graph Update Floor Thickness To Beam.dyn (Dynamo 0.8.2.2392)

select_floor_and_beam = DSModelElementsSelection()  # 41 picked in the model
categories = Categories("StructuralFraming")
isOfCategory = Custom[Element.IsOfCategory](element_s=select_floor_and_beam, Category=categories)  # Checks whether an element is of a specified category
filterByBoolMask = List.FilterByBoolMask(list=select_floor_and_beam, mask=isOfCategory)
code_block = CodeBlock { "Hs"; }
code_block_2 = CodeBlock(t2=filterByBoolMask.in) { t1 = {t2}; t3 = Flatten(t1); }
python_script = Python(IN[0]=code_block_2.t3)
# ---------- python_script.python (33 lines) ----------
import clr
import math

clr.AddReference("RevitServices")
import RevitServices
from RevitServices.Persistence import DocumentManager
from RevitServices.Transactions import TransactionManager
doc = DocumentManager.Instance.CurrentDBDocument

clr.AddReference("RevitNodes")
import Revit
clr.ImportExtensions(Revit.Elements)
clr.ImportExtensions(Revit.GeometryConversion)

clr.AddReference("RevitAPI")

from Autodesk.Revit.DB import *


#The inputs to this node will be stored as a list in the IN variables.
dataEnteringNode = IN
ls = UnwrapElement(IN[0])
Solids = []
for faminst in ls:
	Solid = []
	geo = faminst.GetOriginalGeometry(Options()).GetTransformed(faminst.GetTransform())
	for g in geo:
		s1 = g.Convert()
		if s1 != None: Solid.append(s1)
	Solids.append(Solid)

#Assign your output to the OUT variable.
OUT = Solids
# ----------------------------------------
byUnion = Solid.ByUnion(python_script)
categories_2 = Categories("Floors")
isOfCategory_2 = Custom[Element.IsOfCategory](element_s=select_floor_and_beam, Category=categories_2)
filterByBoolMask_2 = List.FilterByBoolMask(list=select_floor_and_beam, mask=isOfCategory_2)
floor_original_geometry = Custom[Floor Original Geometry](Floors=filterByBoolMask_2.in)  # Get Original Geometry Of Floor
byUnion_2 = Solid.ByUnion(floor_original_geometry.Solid)
byUnion_3 = Solid.ByUnion(byUnion_2)
differenceAll = Solid.DifferenceAll(byUnion, byUnion_3)
volume = Solid.Volume(differenceAll)
volume_2 = Solid.Volume(byUnion)
type = Custom[Element.Type](Element_s=filterByBoolMask.in)  # Gets the family type of a given element (if applicable).
code_block_3 = CodeBlock { "h"; }
getParameterValueByName = Element.GetParameterValueByName(element=type, parameterName=code_block_3)
code_block_4 = CodeBlock(Vcut=volume, Vorgi=volume_2, horgi=getParameterValueByName) { hcut = Vcut/Vorgi*horgi; hs = horgi - hcut; }
setParameterByName = Element.SetParameterByName(element=filterByBoolMask.in, parameterName=code_block, value=code_block_4.hs)
code_block_5 = CodeBlock { "Hcut"; }
code_block_6 = CodeBlock { 0; }
code_block_7 = CodeBlock { "Thickness"; }
getParameterValueByName_2 = Element.GetParameterValueByName(element=filterByBoolMask_2.in, parameterName=code_block_7)
uniqueItems = List.UniqueItems(getParameterValueByName_2)
addItemToEnd = List.AddItemToEnd(code_block_6, uniqueItems)
chuan_hoa_hs = Python(IN[0]=code_block_4.hs, IN[1]=addItemToEnd)
# ---------- chuan_hoa_hs.python (19 lines) ----------
import clr
clr.AddReference('ProtoGeometry')
from Autodesk.DesignScript.Geometry import *
#The inputs to this node will be stored as a list in the IN variables.
dataEnteringNode = IN
hsdam = IN[0]
hsproject = IN[1]

Output = []

for i in range(0, len(hsdam)):
	offsets = [hsdam[i] - el for el in hsproject]
	absofs = [abs(of) for of in offsets]
	index = absofs.index(min(absofs))
	
	Output.append(hsproject[index])
	
#Assign your output to the OUT variable.
OUT = Output
# ----------------------------------------
code_block_8 = CodeBlock(a=chuan_hoa_hs, b=code_block_4.hs) { a-b; }
setParameterByName_2 = Element.SetParameterByName(element=setParameterByName, parameterName=code_block_5, value=code_block_8)
code_block_9 = CodeBlock { "HsA"; }
setParameterByName_3 = Element.SetParameterByName(element=setParameterByName_2, parameterName=code_block_9, value=chuan_hoa_hs)
