# Dynamo graph FW Scaffolding placement By 2D Adaptive 0901 180521.dyn (Dynamo 0.9.1.4062)

code_block = CodeBlock { "Adt-WL-2D-Hoz Brace 1200-2 points"; }
byName = FamilyType.ByName(code_block)
byFamilyType = FamilyInstance.ByFamilyType(byName)
curves = Element.Curves(byFamilyType)
flatten = Flatten(curves)
startPoint = Curve.StartPoint(flatten)
endPoint = Curve.EndPoint(flatten)
create = List.Create(startPoint, endPoint)
transpose = List.Transpose(create)
# note: 1. LOAD CÁC FAMILY CẦN THIẾT VÀO REVIT
# note: 2. CHỌN CÁC INSTANCE ADAPTIVE 2D "Adt-WL-2D-FW SCFD-2 points"
# note: 1
family_type_name = CodeBlock { "Adt-Wedgelock-Sys of Hoz Brace 1200-2 points"; "Adt-Wedgelock-Sys of Post w Head U non Moduled-1 points"; }
byName_2 = FamilyType.ByName(family_type_name.out0)
byPoints = AdaptiveComponent.ByPoints(points=transpose, familyType=byName_2)
code_block_2 = CodeBlock { "Chieu_Cao_Tong"; }
chieu_cao_tong = DoubleInput(3300)
setParameterByName = Element.SetParameterByName(element=byPoints, parameterName=code_block_2, value=chieu_cao_tong)
# note: 2
select_model_elements = DSModelElementsSelection()  # 18 picked in the model
geometry = Element.Geometry(select_model_elements)
flatten_2 = Flatten(geometry)
python_script = Python(IN[0]=flatten_2)
# ---------- python_script.python (13 lines) ----------
import clr
clr.AddReference('ProtoGeometry')
from Autodesk.DesignScript.Geometry import *
#The inputs to this node will be stored as a list in the IN variables.
dataEnteringNode = IN
list = UnwrapElement(IN[0])
res = []
for e in list:
	if e.GetType().ToString() == 'Autodesk.DesignScript.Geometry.Point':
		res.append(e)

#Assign your output to the OUT variable.
OUT = res
# ----------------------------------------
byName_3 = FamilyType.ByName(family_type_name.out1)
byPoints_2 = AdaptiveComponent.ByPoints(points=python_script, familyType=byName_3)
setParameterByName_2 = Element.SetParameterByName(element=byPoints_2, parameterName=code_block_2, value=chieu_cao_tong)
code_block_3 = CodeBlock { 0; 1; }
sublists = List.Sublists(list=python_script, ranges=code_block_3.out0, offset=code_block_3.out1)
