# Dynamo graph Formwork-Wedgelock-180420-1.dyn (Dynamo 0.9.1.4062)

giằng_ngang_1200 = CodeBlock { "Line_WedgeLock_Brace_1200"; "Adt-Wedgelock-Sys of Hoz Brace 1200-2 points"; }
select_all_lines = DSModelElementsSelection()  # 21 picked in the model
python_script = Python(IN[0]=giằng_ngang_1200.out0, IN[1]=select_all_lines)
# ---------- python_script.python (46 lines) ----------
import clr
clr.AddReference('ProtoGeometry')
from Autodesk.DesignScript.Geometry import *
clr.AddReference('RevitAPI')
from Autodesk.Revit.DB import *
from Autodesk.Revit.DB import ElementId
clr.AddReference('RevitAPIUI')
from Autodesk.Revit.UI import TaskDialog
clr.AddReference("RevitNodes")
import Revit
clr.ImportExtensions(Revit.Elements)
clr.ImportExtensions(Revit.GeometryConversion)
clr.AddReference("RevitServices")
import RevitServices
from RevitServices.Persistence import DocumentManager
from RevitServices.Transactions import TransactionManager
from System.Collections.Generic import *

doc = DocumentManager.Instance.CurrentDBDocument
uiapp = DocumentManager.Instance.CurrentUIApplication
app = uiapp.Application

dataEnteringNode = IN
catName = IN[0]
#selectElems = IN[1]
selectElems = UnwrapElement(IN[1])

graphStyles = FilteredElementCollector(doc).OfClass(GraphicsStyle)
graphId = []
result = []

for style in graphStyles:
	name = style.Name
	if name == catName:
		graphId.append(style.Id)
id = graphId[0]

elemID = doc.GetElement(id)

for elem in selectElems:	 
	if elem.LineStyle.Id == elemID.Id:
	#if elem.GetParameterValueByName("Line Style").Id == elemID:
		result.append(elem)

#Assign your output to the OUT variable.
OUT = result
# ----------------------------------------
geometry = Element.Geometry(python_script)
flatten = Flatten(geometry)
startPoint = Curve.StartPoint(flatten)
endPoint = Curve.EndPoint(flatten)
create = List.Create(startPoint, endPoint)
transpose = List.Transpose(create)
byName = FamilyType.ByName(giằng_ngang_1200.out1)
byPoints = AdaptiveComponent.ByPoints(points=transpose, familyType=byName)
code_block = CodeBlock(p=startPoint) { p; }
flatten_2 = Flatten(code_block)
select_multi_faces = SelectFaces()  # 3 picked in the model
code_block_2 = CodeBlock(faces=select_multi_faces) { faces; }
byJoinedSurfaces = PolySurface.ByJoinedSurfaces(code_block_2)
flatten_3 = Flatten(byJoinedSurfaces)
deconstruct = List.Deconstruct(list=flatten_3)
join = Surface.Join(deconstruct.first, deconstruct.rest)
code_block_3 = CodeBlock(geo=join) { geo; }
ZAxis = Vector.ZAxis()
project = Point.Project(flatten_2, code_block_3, ZAxis, lacing=Longest)
flatten_4 = Flatten(project)
byStartPointEndPoint = Line.ByStartPointEndPoint(startPoint=flatten_2, endPoint=flatten_4)
length = Curve.Length(byStartPointEndPoint)
round = Math.Round(length)
code_block_4 = CodeBlock(p=endPoint) { p; }
flatten_5 = Flatten(code_block_4)
ZAxis_2 = Vector.ZAxis()
project_2 = Point.Project(flatten_5, code_block_3, ZAxis_2, lacing=Longest)
flatten_6 = Flatten(project_2)
byStartPointEndPoint_2 = Line.ByStartPointEndPoint(startPoint=flatten_5, endPoint=flatten_6)
length_2 = Curve.Length(byStartPointEndPoint_2)
round_2 = Math.Round(length_2)
create_2 = List.Create(round, round_2)
transpose_2 = List.Transpose(create_2)
python_script_2 = Python(IN[0]=transpose_2)
# ---------- python_script_2.python (15 lines) ----------
import clr
clr.AddReference('ProtoGeometry')
from Autodesk.DesignScript.Geometry import *
#The inputs to this node will be stored as a list in the IN variables.
dataEnteringNode = IN
list = IN[0]
res=[]
for l in list:
	if l[0]<l[1]:
		res.append(l[0])
	else:
		res.append(l[1])

#Assign your output to the OUT variable.
OUT = res
# ----------------------------------------
chiều_cao_chân = CodeBlock { 300; }
code_block_5 = CodeBlock(adaptivecomponent1=byPoints, num2=python_script_2, num1=chiều_cao_chân)
# ---------- code_block_5.designscript (4 lines) ----------
str1 = "Chieu_Cao_Chan";
str2 = "Chieu_Cao_Tong";
element2 = adaptivecomponent1.SetParameterByName(str2, num2);
element1 = adaptivecomponent1.SetParameterByName(str1, num1);
# ----------------------------------------
giằng_ngang_900 = CodeBlock { "Line_WedgeLock_Brace_900"; "Adt-Wedgelock-Sys of Hoz Brace 900-2 points"; }
python_script_3 = Python(IN[0]=giằng_ngang_900.out0, IN[1]=select_all_lines)  # same code as python_script
geometry_2 = Element.Geometry(python_script_3)
flatten_7 = Flatten(geometry_2)
startPoint_2 = Curve.StartPoint(flatten_7)
endPoint_2 = Curve.EndPoint(flatten_7)
create_3 = List.Create(startPoint_2, endPoint_2)
transpose_3 = List.Transpose(create_3)
byName_2 = FamilyType.ByName(giằng_ngang_900.out1)
byPoints_2 = AdaptiveComponent.ByPoints(points=transpose_3, familyType=byName_2)
code_block_6 = CodeBlock(p=startPoint_2) { p; }
flatten_8 = Flatten(code_block_6)
ZAxis_3 = Vector.ZAxis()
project_3 = Point.Project(flatten_8, code_block_3, ZAxis_3, lacing=Longest)
flatten_9 = Flatten(project_3)
byStartPointEndPoint_3 = Line.ByStartPointEndPoint(startPoint=flatten_8, endPoint=flatten_9)
length_3 = Curve.Length(byStartPointEndPoint_3)
round_3 = Math.Round(length_3)
code_block_7 = CodeBlock(p=endPoint_2) { p; }
flatten_10 = Flatten(code_block_7)
ZAxis_4 = Vector.ZAxis()
project_4 = Point.Project(flatten_10, code_block_3, ZAxis_4, lacing=Longest)
flatten_11 = Flatten(project_4)
byStartPointEndPoint_4 = Line.ByStartPointEndPoint(startPoint=flatten_10, endPoint=flatten_11)
length_4 = Curve.Length(byStartPointEndPoint_4)
round_4 = Math.Round(length_4)
create_4 = List.Create(round_3, round_4)
transpose_4 = List.Transpose(create_4)
python_script_4 = Python(IN[0]=transpose_4)  # same code as python_script_2
code_block_8 = CodeBlock(adaptivecomponent1=byPoints_2, num2=python_script_4, num1=chiều_cao_chân)  # same code as code_block_5
giằng_ngang_600 = CodeBlock { "Line_WedgeLock_Brace_600"; "Adt-Wedgelock-Sys of Hoz Brace 600-2 points"; }
python_script_5 = Python(IN[0]=giằng_ngang_600.out0, IN[1]=select_all_lines)  # same code as python_script
geometry_3 = Element.Geometry(python_script_5)
flatten_12 = Flatten(geometry_3)
startPoint_3 = Curve.StartPoint(flatten_12)
endPoint_3 = Curve.EndPoint(flatten_12)
create_5 = List.Create(startPoint_3, endPoint_3)
transpose_5 = List.Transpose(create_5)
byName_3 = FamilyType.ByName(giằng_ngang_600.out1)
byPoints_3 = AdaptiveComponent.ByPoints(points=transpose_5, familyType=byName_3)
code_block_9 = CodeBlock(p=startPoint_3) { p; }
flatten_13 = Flatten(code_block_9)
ZAxis_5 = Vector.ZAxis()
project_5 = Point.Project(flatten_13, code_block_3, ZAxis_5, lacing=Longest)
flatten_14 = Flatten(project_5)
byStartPointEndPoint_5 = Line.ByStartPointEndPoint(startPoint=flatten_13, endPoint=flatten_14)
length_5 = Curve.Length(byStartPointEndPoint_5)
round_5 = Math.Round(length_5)
code_block_10 = CodeBlock(p=endPoint_3) { p; }
flatten_15 = Flatten(code_block_10)
ZAxis_6 = Vector.ZAxis()
project_6 = Point.Project(flatten_15, code_block_3, ZAxis_6, lacing=Longest)
flatten_16 = Flatten(project_6)
byStartPointEndPoint_6 = Line.ByStartPointEndPoint(startPoint=flatten_15, endPoint=flatten_16)
length_6 = Curve.Length(byStartPointEndPoint_6)
round_6 = Math.Round(length_6)
create_6 = List.Create(round_5, round_6)
transpose_6 = List.Transpose(create_6)
python_script_6 = Python(IN[0]=transpose_6)  # same code as python_script_2
code_block_11 = CodeBlock(adaptivecomponent1=byPoints_3, num2=python_script_6, num1=chiều_cao_chân)  # same code as code_block_5
giằng_chéo_1200x1000 = CodeBlock { "Line_WedgeLock_Diagonal Brace_1200x1000"; "Adt-Wedgelock-Sys of Diagonal Brace 1200x1000-2 points"; }
python_script_7 = Python(IN[0]=giằng_chéo_1200x1000.out0, IN[1]=select_all_lines)  # same code as python_script
geometry_4 = Element.Geometry(python_script_7)
flatten_17 = Flatten(geometry_4)
startPoint_4 = Curve.StartPoint(flatten_17)
endPoint_4 = Curve.EndPoint(flatten_17)
create_7 = List.Create(startPoint_4, endPoint_4)
transpose_7 = List.Transpose(create_7)
byName_4 = FamilyType.ByName(giằng_chéo_1200x1000.out1)
byPoints_4 = AdaptiveComponent.ByPoints(points=transpose_7, familyType=byName_4)
code_block_12 = CodeBlock(p=startPoint_4) { p; }
flatten_18 = Flatten(code_block_12)
ZAxis_7 = Vector.ZAxis()
project_7 = Point.Project(flatten_18, code_block_3, ZAxis_7, lacing=Longest)
flatten_19 = Flatten(project_7)
byStartPointEndPoint_7 = Line.ByStartPointEndPoint(startPoint=flatten_18, endPoint=flatten_19)
length_7 = Curve.Length(byStartPointEndPoint_7)
round_7 = Math.Round(length_7)
code_block_13 = CodeBlock(p=endPoint_4) { p; }
flatten_20 = Flatten(code_block_13)
ZAxis_8 = Vector.ZAxis()
project_8 = Point.Project(flatten_20, code_block_3, ZAxis_8, lacing=Longest)
flatten_21 = Flatten(project_8)
byStartPointEndPoint_8 = Line.ByStartPointEndPoint(startPoint=flatten_20, endPoint=flatten_21)
length_8 = Curve.Length(byStartPointEndPoint_8)
round_8 = Math.Round(length_8)
create_8 = List.Create(round_7, round_8)
transpose_8 = List.Transpose(create_8)
python_script_8 = Python(IN[0]=transpose_8)  # same code as python_script_2
code_block_14 = CodeBlock(adaptivecomponent1=byPoints_4, num2=python_script_8, num1=chiều_cao_chân)  # same code as code_block_5
select_single_face = DSFaceSelection()  # 1 picked in the model
perimeterCurves = Surface.PerimeterCurves(select_single_face)
startPoint_5 = Curve.StartPoint(perimeterCurves)
byBestFitThroughPoints = Plane.ByBestFitThroughPoints(startPoint_5)
curves = Element.Curves(python_script)
startPoint_6 = Curve.StartPoint(curves)
code_block_15 = CodeBlock(p=startPoint_6) { p; }
flatten_22 = Flatten(code_block_15)
ZAxis_9 = Vector.ZAxis()
project_9 = Point.Project(flatten_22, code_block_3, ZAxis_9, lacing=Longest)
flatten_23 = Flatten(project_9)
byStartPointEndPoint_9 = Line.ByStartPointEndPoint(startPoint=flatten_22, endPoint=flatten_23)
length_9 = Curve.Length(byStartPointEndPoint_9)
round_9 = Math.Round(length_9)
code_block_16 = CodeBlock { 6600; }
le = round_9 <= code_block_16
boolean = BoolSelector(true)
allIndicesOf = List.AllIndicesOf(list=le, item=boolean)
getItemAtIndex = List.GetItemAtIndex(list=code_block_15, index=allIndicesOf)
flatten_24 = Flatten(getItemAtIndex)
curves_2 = Element.Curves(python_script_3)
startPoint_7 = Curve.StartPoint(curves_2)
code_block_17 = CodeBlock(p=startPoint_7) { p; }
flatten_25 = Flatten(code_block_17)
ZAxis_10 = Vector.ZAxis()
project_10 = Point.Project(flatten_25, code_block_3, ZAxis_10, lacing=Longest)
flatten_26 = Flatten(project_10)
byStartPointEndPoint_10 = Line.ByStartPointEndPoint(startPoint=flatten_25, endPoint=flatten_26)
length_10 = Curve.Length(byStartPointEndPoint_10)
round_10 = Math.Round(length_10)
le_2 = round_10 <= code_block_16
boolean_2 = BoolSelector(true)
allIndicesOf_2 = List.AllIndicesOf(list=le_2, item=boolean_2)
getItemAtIndex_2 = List.GetItemAtIndex(list=code_block_17, index=allIndicesOf_2)
flatten_27 = Flatten(getItemAtIndex_2)
curves_3 = Element.Curves(python_script_5)
startPoint_8 = Curve.StartPoint(curves_3)
code_block_18 = CodeBlock(p=startPoint_8) { p; }
flatten_28 = Flatten(code_block_18)
ZAxis_11 = Vector.ZAxis()
project_11 = Point.Project(flatten_28, code_block_3, ZAxis_11, lacing=Longest)
flatten_29 = Flatten(project_11)
byStartPointEndPoint_11 = Line.ByStartPointEndPoint(startPoint=flatten_28, endPoint=flatten_29)
length_11 = Curve.Length(byStartPointEndPoint_11)
round_11 = Math.Round(length_11)
le_3 = round_11 <= code_block_16
boolean_3 = BoolSelector(true)
allIndicesOf_3 = List.AllIndicesOf(list=le_3, item=boolean_3)
getItemAtIndex_3 = List.GetItemAtIndex(list=code_block_18, index=allIndicesOf_3)
flatten_30 = Flatten(getItemAtIndex_3)
create_9 = List.Create(flatten_24, flatten_27, flatten_30)
flatten_31 = Flatten(create_9)
cây_chống = CodeBlock { "Adt-Wedgelock-Sys of Post w Head U less than 6000-1 points"; }
byName_5 = FamilyType.ByName(cây_chống)
byPoints_5 = AdaptiveComponent.ByPoints(points=flatten_31, familyType=byName_5)
getItemAtIndex_4 = List.GetItemAtIndex(list=round_9, index=allIndicesOf)
getItemAtIndex_5 = List.GetItemAtIndex(list=round_10, index=allIndicesOf_2)
getItemAtIndex_6 = List.GetItemAtIndex(list=round_11, index=allIndicesOf_3)
create_10 = List.Create(getItemAtIndex_4, getItemAtIndex_5, getItemAtIndex_6)
flatten_32 = Flatten(create_10)
code_block_19 = CodeBlock(adaptivecomponent1=byPoints_5, num2=flatten_32, num1=chiều_cao_chân)  # same code as code_block_5
flatten_33 = Flatten(code_block_2)  # frozen
perimeterCurves_2 = Surface.PerimeterCurves(flatten_33)
startPoint_9 = Curve.StartPoint(perimeterCurves_2)
select_joine_geometry_to_project = DSModelElementSelection()  # 1 picked in the model
solids = Element.Solids(select_joine_geometry_to_project)
geometry_5 = Element.Geometry(select_joine_geometry_to_project)
le_4 = round_9 <= code_block_16
boolean_4 = BoolSelector(false)
allIndicesOf_4 = List.AllIndicesOf(list=le_4, item=boolean_4)
getItemAtIndex_7 = List.GetItemAtIndex(list=code_block_15, index=allIndicesOf_4)
flatten_34 = Flatten(getItemAtIndex_7)
le_5 = round_10 <= code_block_16
boolean_5 = BoolSelector(false)
allIndicesOf_5 = List.AllIndicesOf(list=le_5, item=boolean_5)
getItemAtIndex_8 = List.GetItemAtIndex(list=code_block_17, index=allIndicesOf_5)
flatten_35 = Flatten(getItemAtIndex_8)
le_6 = round_11 <= code_block_16
boolean_6 = BoolSelector(false)
allIndicesOf_6 = List.AllIndicesOf(list=le_6, item=boolean_6)
getItemAtIndex_9 = List.GetItemAtIndex(list=code_block_18, index=allIndicesOf_6)
flatten_36 = Flatten(getItemAtIndex_9)
create_11 = List.Create(flatten_34, flatten_35, flatten_36)
flatten_37 = Flatten(create_11)
cây_chống_2 = CodeBlock { "Adt-Wedgelock-Sys of Post w Head U-1 points"; }
byName_6 = FamilyType.ByName(cây_chống_2)
byPoints_6 = AdaptiveComponent.ByPoints(points=flatten_37, familyType=byName_6)
getItemAtIndex_10 = List.GetItemAtIndex(list=round_9, index=allIndicesOf_4)
getItemAtIndex_11 = List.GetItemAtIndex(list=round_10, index=allIndicesOf_5)
getItemAtIndex_12 = List.GetItemAtIndex(list=round_11, index=allIndicesOf_6)
create_12 = List.Create(getItemAtIndex_10, getItemAtIndex_11, getItemAtIndex_12)
flatten_38 = Flatten(create_12)
code_block_20 = CodeBlock(adaptivecomponent1=byPoints_6, num2=flatten_38, num1=chiều_cao_chân)  # same code as code_block_5
