# Dynamo graph ReverseStartEnd2PointAdaptiveComponent-0901-171228-OK.dyn (Dynamo 0.9.1.4062)

select_adaptive_components = DSModelElementsSelection()
locations = AdaptiveComponent.Locations(select_adaptive_components)
transpose = List.Transpose(locations)
reverse = List.Reverse(transpose)
transpose_2 = List.Transpose(reverse)
firstItem = List.FirstItem(select_adaptive_components)
type = FamilyInstance.Type(firstItem)
byPoints = AdaptiveComponent.ByPoints(points=transpose_2, familyType=type)
code_block = CodeBlock { "GridName"; }
getParameterValueByName = Element.GetParameterValueByName(element=select_adaptive_components, parameterName=code_block)
setParameterByName = Element.SetParameterByName(element=byPoints, parameterName=code_block, value=getParameterValueByName)
delete_old_ones = Python(IN[0]=select_adaptive_components)
# ---------- delete_old_ones.python (44 lines) ----------
import clr
clr.AddReference('ProtoGeometry')
from Autodesk.DesignScript.Geometry import *
# Import ToDSType(bool) extension method
clr.AddReference("RevitNodes")
import Revit
clr.ImportExtensions(Revit.Elements)
# Import geometry conversion extension methods
clr.ImportExtensions(Revit.GeometryConversion)
# Import DocumentManager and TransactionManager
clr.AddReference("RevitServices")
import RevitServices
from RevitServices.Persistence import DocumentManager
from RevitServices.Transactions import TransactionManager
from System.Collections.Generic import *
# Import RevitAPI
clr.AddReference("RevitAPI")
import Autodesk
from Autodesk.Revit.DB import *

doc = DocumentManager.Instance.CurrentDBDocument
uiapp = DocumentManager.Instance.CurrentUIApplication
app = uiapp.Application

elt = []
for i in IN[0]:
	elt.append(UnwrapElement(i).Id)

# Start Transaction
TransactionManager.Instance.EnsureInTransaction(doc)


cantdelete=[]
for item in elt:
	try:
		doc.Delete(item)
	except:
		cantdelete.append(item)
		

# End Transaction
TransactionManager.Instance.TransactionTaskDone()
doc.Regenerate()
OUT=cantdelete
# ----------------------------------------
