# Dynamo graph External Work-Wedgelock 0901 180418-OK.dyn (Dynamo 0.9.1.4062)

bracket_1800 = CodeBlock { "Line_Bracket I_1800"; "Adt-Bracket I 1800-2 points"; }
select_all_lines = DSModelElementsSelection()  # 4 picked in the model
python_script = Python(IN[0]=bracket_1800.out0, IN[1]=select_all_lines)
# ---------- python_script.python (46 lines) ----------
import clr
clr.AddReference('ProtoGeometry')
from Autodesk.DesignScript.Geometry import *
clr.AddReference('RevitAPI')
from Autodesk.Revit.DB import *
from Autodesk.Revit.DB import ElementId
clr.AddReference('RevitAPIUI')
from Autodesk.Revit.UI import TaskDialog
clr.AddReference("RevitNodes")
import Revit
clr.ImportExtensions(Revit.Elements)
clr.ImportExtensions(Revit.GeometryConversion)
clr.AddReference("RevitServices")
import RevitServices
from RevitServices.Persistence import DocumentManager
from RevitServices.Transactions import TransactionManager
from System.Collections.Generic import *

doc = DocumentManager.Instance.CurrentDBDocument
uiapp = DocumentManager.Instance.CurrentUIApplication
app = uiapp.Application

dataEnteringNode = IN
catName = IN[0]
#selectElems = IN[1]
selectElems = UnwrapElement(IN[1])

graphStyles = FilteredElementCollector(doc).OfClass(GraphicsStyle)
graphId = []
result = []

for style in graphStyles:
	name = style.Name
	if name == catName:
		graphId.append(style.Id)
id = graphId[0]

elemID = doc.GetElement(id)

for elem in selectElems:	 
	if elem.LineStyle.Id == elemID.Id:
	#if elem.GetParameterValueByName("Line Style").Id == elemID:
		result.append(elem)

#Assign your output to the OUT variable.
OUT = result
# ----------------------------------------
geometry = Element.Geometry(python_script)
flatten = Flatten(geometry)
startPoint = Curve.StartPoint(flatten)
endPoint = Curve.EndPoint(flatten)
create = List.Create(startPoint, endPoint)
transpose = List.Transpose(create)
byName = FamilyType.ByName(bracket_1800.out1)
byPoints = AdaptiveComponent.ByPoints(points=transpose, familyType=byName)
bracket_góc = CodeBlock { "Line_Bracket I_1800_Corner"; "Adt-Bracket I-Corner-2 points"; }
python_script_2 = Python(IN[0]=bracket_góc.out0, IN[1]=select_all_lines)  # same code as python_script
geometry_2 = Element.Geometry(python_script_2)
flatten_2 = Flatten(geometry_2)
startPoint_2 = Curve.StartPoint(flatten_2)
endPoint_2 = Curve.EndPoint(flatten_2)
create_2 = List.Create(startPoint_2, endPoint_2)
transpose_2 = List.Transpose(create_2)
byName_2 = FamilyType.ByName(bracket_góc.out1)
byPoints_2 = AdaptiveComponent.ByPoints(points=transpose_2, familyType=byName_2)
dầm_i_120 = CodeBlock { "Line_Beam I120"; "Adt-Beam I 120-2 points"; }
python_script_3 = Python(IN[0]=dầm_i_120.out0, IN[1]=select_all_lines)  # same code as python_script
geometry_3 = Element.Geometry(python_script_3)
flatten_3 = Flatten(geometry_3)
startPoint_3 = Curve.StartPoint(flatten_3)
endPoint_3 = Curve.EndPoint(flatten_3)
create_3 = List.Create(startPoint_3, endPoint_3)
transpose_3 = List.Transpose(create_3)
byName_3 = FamilyType.ByName(dầm_i_120.out1)
byPoints_3 = AdaptiveComponent.ByPoints(points=transpose_3, familyType=byName_3)
chân_giáo_hoa_khế = CodeBlock { "Line_WedgeLock_Post@900"; "Adt-Wedgelock-Sys of Post-2 points"; }
python_script_4 = Python(IN[0]=chân_giáo_hoa_khế.out0, IN[1]=select_all_lines)  # same code as python_script
geometry_4 = Element.Geometry(python_script_4)
flatten_4 = Flatten(geometry_4)
startPoint_4 = Curve.StartPoint(flatten_4)
endPoint_4 = Curve.EndPoint(flatten_4)
create_4 = List.Create(startPoint_4, endPoint_4)
transpose_4 = List.Transpose(create_4)
byName_4 = FamilyType.ByName(chân_giáo_hoa_khế.out1)
byPoints_4 = AdaptiveComponent.ByPoints(points=transpose_4, familyType=byName_4)
chiều_cao_tổng = CodeBlock { 28300; }
chiều_cao_chân = CodeBlock { 300; }
code_block = CodeBlock(adaptivecomponent1=byPoints_4, num2=chiều_cao_tổng, num1=chiều_cao_chân)
# ---------- code_block.designscript (4 lines) ----------
str1 = "Chieu_Cao_Chan";
str2 = "Chieu_Cao_Tong";
element2 = adaptivecomponent1.SetParameterByName(str2, num2);
element1 = adaptivecomponent1.SetParameterByName(str1, num1);
# ----------------------------------------
cùm_tuýp = CodeBlock { "Line_Tube"; "Adt-Coupler Tube-2 points"; }
python_script_5 = Python(IN[0]=cùm_tuýp.out0, IN[1]=select_all_lines)  # same code as python_script
geometry_5 = Element.Geometry(python_script_5)
flatten_5 = Flatten(geometry_5)
startPoint_5 = Curve.StartPoint(flatten_5)
endPoint_5 = Curve.EndPoint(flatten_5)
create_5 = List.Create(startPoint_5, endPoint_5)
transpose_5 = List.Transpose(create_5)
byName_5 = FamilyType.ByName(cùm_tuýp.out1)
byPoints_5 = AdaptiveComponent.ByPoints(points=transpose_5, familyType=byName_5)
giằng_ngang_1800 = CodeBlock { "Line_WedgeLock_Brace_1800"; "Adt-Wedgelock-Sys of Hoz Brace 1800-2 points"; }
python_script_6 = Python(IN[0]=giằng_ngang_1800.out0, IN[1]=select_all_lines)  # same code as python_script
geometry_6 = Element.Geometry(python_script_6)
flatten_6 = Flatten(geometry_6)
startPoint_6 = Curve.StartPoint(flatten_6)
endPoint_6 = Curve.EndPoint(flatten_6)
create_6 = List.Create(startPoint_6, endPoint_6)
transpose_6 = List.Transpose(create_6)
byName_6 = FamilyType.ByName(giằng_ngang_1800.out1)
byPoints_6 = AdaptiveComponent.ByPoints(points=transpose_6, familyType=byName_6)
code_block_2 = CodeBlock(adaptivecomponent1=byPoints_6, num2=chiều_cao_tổng, num1=chiều_cao_chân)  # same code as code_block
giằng_ngang_1200 = CodeBlock { "Line_WedgeLock_Brace_1200"; "Adt-Wedgelock-Sys of Hoz Brace 1200-2 points"; }
python_script_7 = Python(IN[0]=giằng_ngang_1200.out0, IN[1]=select_all_lines)  # same code as python_script
geometry_7 = Element.Geometry(python_script_7)
flatten_7 = Flatten(geometry_7)
startPoint_7 = Curve.StartPoint(flatten_7)
endPoint_7 = Curve.EndPoint(flatten_7)
create_7 = List.Create(startPoint_7, endPoint_7)
transpose_7 = List.Transpose(create_7)
byName_7 = FamilyType.ByName(giằng_ngang_1200.out1)
byPoints_7 = AdaptiveComponent.ByPoints(points=transpose_7, familyType=byName_7)
code_block_3 = CodeBlock(adaptivecomponent1=byPoints_7, num2=chiều_cao_tổng, num1=chiều_cao_chân)  # same code as code_block
giằng_chéo_1800x2000 = CodeBlock { "Line_WedgeLock_Diagonal Brace_1800x2000"; "Adt-Wedgelock-Sys of Diagonal Brace 1800x2000-2 points"; }
python_script_8 = Python(IN[0]=giằng_chéo_1800x2000.out0, IN[1]=select_all_lines)  # same code as python_script
geometry_8 = Element.Geometry(python_script_8)
flatten_8 = Flatten(geometry_8)
startPoint_8 = Curve.StartPoint(flatten_8)
endPoint_8 = Curve.EndPoint(flatten_8)
create_8 = List.Create(startPoint_8, endPoint_8)
transpose_8 = List.Transpose(create_8)
byName_8 = FamilyType.ByName(giằng_chéo_1800x2000.out1)
byPoints_8 = AdaptiveComponent.ByPoints(points=transpose_8, familyType=byName_8)
code_block_4 = CodeBlock(adaptivecomponent1=byPoints_8, num2=chiều_cao_tổng, num1=chiều_cao_chân)  # same code as code_block
giằng_chéo_1200x2000 = CodeBlock { "Line_WedgeLock_Diagonal Brace_1200x2000"; "Adt-Wedgelock-Sys of Diagonal Brace 1200x2000-2 points"; }
python_script_9 = Python(IN[0]=giằng_chéo_1200x2000.out0, IN[1]=select_all_lines)  # same code as python_script
geometry_9 = Element.Geometry(python_script_9)
flatten_9 = Flatten(geometry_9)
startPoint_9 = Curve.StartPoint(flatten_9)
endPoint_9 = Curve.EndPoint(flatten_9)
create_9 = List.Create(startPoint_9, endPoint_9)
transpose_9 = List.Transpose(create_9)
byName_9 = FamilyType.ByName(giằng_chéo_1200x2000.out1)
byPoints_9 = AdaptiveComponent.ByPoints(points=transpose_9, familyType=byName_9)
code_block_5 = CodeBlock(adaptivecomponent1=byPoints_9, num2=chiều_cao_tổng, num1=chiều_cao_chân)  # same code as code_block
i_beam_2440 = CodeBlock { "Line_Z Beam 2440"; "Adt-I Beam 2440-2 points"; }
python_script_10 = Python(IN[0]=i_beam_2440.out0, IN[1]=select_all_lines)  # same code as python_script
geometry_10 = Element.Geometry(python_script_10)
flatten_10 = Flatten(geometry_10)
startPoint_10 = Curve.StartPoint(flatten_10)
endPoint_10 = Curve.EndPoint(flatten_10)
create_10 = List.Create(startPoint_10, endPoint_10)
transpose_10 = List.Transpose(create_10)
byName_10 = FamilyType.ByName(i_beam_2440.out1)
byPoints_10 = AdaptiveComponent.ByPoints(points=transpose_10, familyType=byName_10)
i_beam_4720 = CodeBlock { "Line_Z Beam 4270"; "Adt-I Beam 4720-2 points"; }
python_script_11 = Python(IN[0]=i_beam_4720.out0, IN[1]=select_all_lines)  # same code as python_script
geometry_11 = Element.Geometry(python_script_11)
flatten_11 = Flatten(geometry_11)
startPoint_11 = Curve.StartPoint(flatten_11)
endPoint_11 = Curve.EndPoint(flatten_11)
create_11 = List.Create(startPoint_11, endPoint_11)
transpose_11 = List.Transpose(create_11)
byName_11 = FamilyType.ByName(i_beam_4720.out1)
byPoints_11 = AdaptiveComponent.ByPoints(points=transpose_11, familyType=byName_11)
giằng_ngang_900 = CodeBlock { "Line_WedgeLock_Brace_900"; "Adt-Wedgelock-Sys of Hoz Brace 900-2 points"; }
python_script_12 = Python(IN[0]=giằng_ngang_900.out0, IN[1]=select_all_lines)  # same code as python_script
geometry_12 = Element.Geometry(python_script_12)
flatten_12 = Flatten(geometry_12)
startPoint_12 = Curve.StartPoint(flatten_12)
endPoint_12 = Curve.EndPoint(flatten_12)
create_12 = List.Create(startPoint_12, endPoint_12)
transpose_12 = List.Transpose(create_12)
byName_12 = FamilyType.ByName(giằng_ngang_900.out1)
byPoints_12 = AdaptiveComponent.ByPoints(points=transpose_12, familyType=byName_12)
code_block_6 = CodeBlock(adaptivecomponent1=byPoints_12, num2=chiều_cao_tổng, num1=chiều_cao_chân)  # same code as code_block
bracket_1500 = CodeBlock { "Line_Bracket I_1500"; "Adt-Bracket I 1500-2 points"; }
python_script_13 = Python(IN[0]=bracket_1500.out0, IN[1]=select_all_lines)  # same code as python_script
geometry_13 = Element.Geometry(python_script_13)
flatten_13 = Flatten(geometry_13)
startPoint_13 = Curve.StartPoint(flatten_13)
endPoint_13 = Curve.EndPoint(flatten_13)
create_13 = List.Create(startPoint_13, endPoint_13)
transpose_13 = List.Transpose(create_13)
byName_13 = FamilyType.ByName(bracket_1500.out1)
byPoints_13 = AdaptiveComponent.ByPoints(points=transpose_13, familyType=byName_13)
giằng_ngang_600 = CodeBlock { "Line_WedgeLock_Brace_600"; "Adt-Wedgelock-Sys of Hoz Brace 600-2 points"; }
python_script_14 = Python(IN[0]=giằng_ngang_600.out0, IN[1]=select_all_lines)  # same code as python_script
geometry_14 = Element.Geometry(python_script_14)
flatten_14 = Flatten(geometry_14)
startPoint_14 = Curve.StartPoint(flatten_14)
endPoint_14 = Curve.EndPoint(flatten_14)
create_14 = List.Create(startPoint_14, endPoint_14)
transpose_14 = List.Transpose(create_14)
byName_14 = FamilyType.ByName(giằng_ngang_600.out1)
byPoints_14 = AdaptiveComponent.ByPoints(points=transpose_14, familyType=byName_14)
code_block_7 = CodeBlock(adaptivecomponent1=byPoints_14, num2=chiều_cao_tổng, num1=chiều_cao_chân)  # same code as code_block
