# Dynamo graph External Work-Wedgelock-Flip Diagonal Braces 0901 180419-OK.dyn (Dynamo 0.9.1.4062)

# group: INPUT
select_model_elements = DSModelElementsSelection()  # 4 picked in the model

delete = Python(IN[0]=select_model_elements)  # frozen
# ---------- delete.python (44 lines) ----------
import clr
clr.AddReference('ProtoGeometry')
from Autodesk.DesignScript.Geometry import *
# Import ToDSType(bool) extension method
clr.AddReference("RevitNodes")
import Revit
clr.ImportExtensions(Revit.Elements)
# Import geometry conversion extension methods
clr.ImportExtensions(Revit.GeometryConversion)
# Import DocumentManager and TransactionManager
clr.AddReference("RevitServices")
import RevitServices
from RevitServices.Persistence import DocumentManager
from RevitServices.Transactions import TransactionManager
from System.Collections.Generic import *
# Import RevitAPI
clr.AddReference("RevitAPI")
import Autodesk
from Autodesk.Revit.DB import *

doc = DocumentManager.Instance.CurrentDBDocument
uiapp = DocumentManager.Instance.CurrentUIApplication
app = uiapp.Application

elt = []
for i in IN[0]:
	elt.append(UnwrapElement(i).Id)

# Start Transaction
TransactionManager.Instance.EnsureInTransaction(doc)


cantdelete=[]
for item in elt:
	try:
		doc.Delete(item)
	except:
		cantdelete.append(item)
		

# End Transaction
TransactionManager.Instance.TransactionTaskDone()
doc.Regenerate()
OUT=cantdelete
# ----------------------------------------
code_block = CodeBlock()
# ---------- code_block.designscript (2 lines) ----------
"Family Type: Adt-Wedgelock-Sys of Diagonal Brace 1800x2000-2 points, Family: Adt-Wedgelock-Sys of Diagonal Brace 1800x2000-2 points";
"Adt-Wedgelock-Sys of Diagonal Brace 1800x2000 flipped-2 points";
# ----------------------------------------
code_block_2 = CodeBlock()
# ---------- code_block_2.designscript (2 lines) ----------
"Family Type: Adt-Wedgelock-Sys of Diagonal Brace 1200x2000-2 points, Family: Adt-Wedgelock-Sys of Diagonal Brace 1200x2000-2 points";
"Adt-Wedgelock-Sys of Diagonal Brace 1200x2000 flipped-2 points";
# ----------------------------------------
python_script = Python(IN[0]=select_model_elements, IN[1]=code_block.out0, IN[2]=code_block_2.out0)
# ---------- python_script.python (23 lines) ----------
import clr
clr.AddReference('ProtoGeometry')
from Autodesk.DesignScript.Geometry import *
#The inputs to this node will be stored as a list in the IN variables.
dataEnteringNode = IN
elems = IN[0]
cond1 = IN[1]
cond2 = IN[2]

result=[]
result1=[]
result2=[]
for e in elems:
	type = e.GetParameterValueByName("Type").ToString()
	result.append(type)
	if type == cond1:
		result1.append(e)
	if type == cond2:
		result2.append(e)


#Assign your output to the OUT variable.
OUT = result1 , result2
# ----------------------------------------
code_block_3 = CodeBlock(curves=python_script) { curves[0]; curves[1]; }
curves = Element.Curves(code_block_3.out0)
python_script_2 = Python(IN[0]=curves)
# ---------- python_script_2.python (12 lines) ----------
import clr
clr.AddReference('ProtoGeometry')
from Autodesk.DesignScript.Geometry import *
#The inputs to this node will be stored as a list in the IN variables.
dataEnteringNode = IN
curves = IN[0]
result=[]
for c in curves:
	result.append(c[0])

#Assign your output to the OUT variable.
OUT = result
# ----------------------------------------
ZAxis = Vector.ZAxis()
code_block_4 = CodeBlock { -550; }
translate = Geometry.Translate(geometry=python_script_2, direction=ZAxis, distance=code_block_4)
startPoint = Curve.StartPoint(translate)
endPoint = Curve.EndPoint(translate)
create = List.Create(startPoint, endPoint)
transpose = List.Transpose(create)
byName = FamilyType.ByName(code_block.out1)
byPoints = AdaptiveComponent.ByPoints(points=transpose, familyType=byName)
code_block_5 = CodeBlock { "Type"; "Chieu_Cao_Tong"; "Chieu_Cao_Chan"; }
getParameterValueByName = Element.GetParameterValueByName(element=select_model_elements, parameterName=code_block_5.out2)
setParameterByName = Element.SetParameterByName(element=byPoints, parameterName=code_block_5.out2, value=getParameterValueByName)
getParameterValueByName_2 = Element.GetParameterValueByName(element=select_model_elements, parameterName=code_block_5.out1)
setParameterByName_2 = Element.SetParameterByName(element=setParameterByName, parameterName=code_block_5.out1, value=getParameterValueByName_2)
curves_2 = Element.Curves(code_block_3.out1)
python_script_3 = Python(IN[0]=curves_2)  # same code as python_script_2
ZAxis_2 = Vector.ZAxis()
code_block_6 = CodeBlock { -550; }
translate_2 = Geometry.Translate(geometry=python_script_3, direction=ZAxis_2, distance=code_block_6)
startPoint_2 = Curve.StartPoint(translate_2)
endPoint_2 = Curve.EndPoint(translate_2)
create_2 = List.Create(startPoint_2, endPoint_2)
transpose_2 = List.Transpose(create_2)
byName_2 = FamilyType.ByName(code_block_2.out1)
byPoints_2 = AdaptiveComponent.ByPoints(points=transpose_2, familyType=byName_2)
setParameterByName_3 = Element.SetParameterByName(element=byPoints_2, parameterName=code_block_5.out2, value=getParameterValueByName)
setParameterByName_4 = Element.SetParameterByName(element=setParameterByName_3, parameterName=code_block_5.out1, value=getParameterValueByName_2)
create_3 = List.Create(setParameterByName_2, setParameterByName_4)
code_block_7 = CodeBlock(deleteElem=create_3) { deleteElem[2]; }
