# Dynamo graph ReLocateViewport by Saved Position info 0901 181219-OK.dyn (Dynamo 0.9.1.4062)

select_viewport_to_get_location = DSModelElementSelection()  # "Select viewport to get Location on sheet"; 1 picked in the model
select_viewport_to_move = DSModelElementSelection()  # 1 picked in the model
python_script = Python(IN[0]=select_viewport_to_get_location, IN[1]=select_viewport_to_move)
# ---------- python_script.python (66 lines) ----------
import clr
clr.AddReference('ProtoGeometry')
from Autodesk.DesignScript.Geometry import *
clr.AddReference('RevitAPI')
from Autodesk.Revit.DB import *
from Autodesk.Revit.Creation import *
clr.AddReference('RevitAPIUI')
from Autodesk.Revit.UI import TaskDialog
clr.AddReference("RevitNodes")
import Revit
clr.ImportExtensions(Revit.Elements)
clr.ImportExtensions(Revit.GeometryConversion)

clr.AddReference("RevitServices")
import RevitServices
from RevitServices.Persistence import DocumentManager
from RevitServices.Transactions import TransactionManager
from System.Collections.Generic import *

doc = DocumentManager.Instance.CurrentDBDocument
uiapp = DocumentManager.Instance.CurrentUIApplication
app = uiapp.Application
#The inputs to this node will be stored as a list in the IN variables.
dataEnteringNode = IN
pos = IN[0]
viewport = UnwrapElement(IN[1])

viewport0 = UnwrapElement(IN[0])

sheet0 = doc.GetElement(viewport0.SheetId)

bdbox0 = viewport0.get_BoundingBox(sheet0)

pos= (bdbox0.Max + bdbox0.Min)/2

x1 = pos[0]
y1 = pos[1]
z1 = pos[2]

sheet = doc.GetElement(viewport.SheetId)
bdbox = viewport.get_BoundingBox(sheet)
positions= (bdbox.Max + bdbox.Min)/2
x2 = positions.X
y2 = positions.Y
z2 = positions.Z


#vpid = viewport.Id
#xyz = app.Create.NewXYZ(x1,y1,z1)
loc = viewport.Location
xyz = app.Create.NewXYZ(x1-x2,y1-y2,z1)

# Start Transaction
TransactionManager.Instance.EnsureInTransaction(doc)
try:
	#MoveElement(doc, vpid, xyz)
	newloc = loc.Move(xyz)
except:
	pass
 
# End Transaction
TransactionManager.Instance.TransactionTaskDone()
doc.Regenerate()

#Assign your output to the OUT variable.
OUT = newloc
# ----------------------------------------
