# Dynamo graph WallReseach.dyn (Dynamo 0.9.1.4062)

select_model_elements = DSModelElementsSelection()  # 1 picked in the model
python_script = Python(IN[0]=select_model_elements)  # frozen
# ---------- python_script.python (86 lines) ----------
import clr
clr.AddReference('ProtoGeometry')
from Autodesk.DesignScript.Geometry import *
clr.AddReference('RevitAPI')
from Autodesk.Revit.DB import *
clr.AddReference('RevitServices')
from RevitServices.Transactions import TransactionManager
from RevitServices.Persistence import DocumentManager

doc = DocumentManager.Instance.CurrentDBDocument
uiapp = DocumentManager.Instance.CurrentUIApplication
app = uiapp.Application

#The inputs to this node will be stored as a list in the IN variables.
dataEnteringNode = IN

walls = UnwrapElement(IN[0])
#####################################################
walltypes=[]#WallType
wallthicks=[]#double
wallsPinned=[]#bool
wallsIsStacked=[]#bool
wallsFlipped=[]#bool
wallLevelIds=[]#Id
wallLocations=[]#LocationCurve

compoundStrucs=[]
compoundStrucLayers=[]
compoundStrucLayerMaterialIds=[]
compoundStrucLayerMaterials=[]
materialFunctionAssigns=[]
materialFunctionWidths=[]
wallCurves=[]
wallEndpoints=[]

for wall in walls:
	walltypes.append(wall.WallType)
	wallthicks.append(wall.Width*304.8)# feet to mm
	wallsPinned.append(wall.Pinned)
	wallsIsStacked.append(wall.IsStackedWall)
	wallsFlipped.append(wall.Flipped)
	wallLevelIds.append(wall.LevelId)
	wallLocations.append(wall.Location)
	
for wallLocation in wallLocations:
	wallCurves.append(wallLocation.Curve)
	endpoints=[]
	endpoints.append(wallLocation.Curve.GetEndPoint(0))
	endpoints.append(wallLocation.Curve.GetEndPoint(1))
	wallEndpoints.append(endpoints)	
	

for walltype in walltypes:
	compoundStrucs.append(walltype.GetCompoundStructure())
for compoundStruc in compoundStrucs:
	compoundStrucLayers.append(compoundStruc.GetLayers())
	
for compoundStrucLayer in compoundStrucLayers:
	matFuncAssign=[]
	matFuncWidth=[]
	matIds=[]
	mats=[]
	for layer in compoundStrucLayer:		
		matFuncAssign.append(layer.Function)
		matFuncWidth.append(layer.Width*304.8)
		matIds.append(layer.MaterialId)
		matelem = doc.GetElement(layer.MaterialId)
		mats.append(matelem.Name) #################### Cần xét tới khả năng <By Category> của vật liệu
	materialFunctionAssigns.append(matFuncAssign)
	materialFunctionWidths.append(matFuncWidth)
	compoundStrucLayerMaterialIds.append(matIds)
	compoundStrucLayerMaterials.append(mats)
# Start Transaction
TransactionManager.Instance.EnsureInTransaction(doc)



# End Transaction
TransactionManager.Instance.TransactionTaskDone()
doc.Regenerate()

#Assign your output to the OUT variable.
OUT = compoundStrucLayers,compoundStrucLayerMaterialIds,compoundStrucLayerMaterials
#wallCurves, wallEndpoints
#compoundStrucs,compoundStrucLayers,materialFunctionAssigns, materialFunctionWidths
#walltypes,wallthicks,wallsPinned,wallsIsStacked,wallsFlipped,wallLevelIds,wallLocations
# ----------------------------------------
watch = Watch(python_script)
python_script_2 = Python(IN[0]=select_model_elements)
# ---------- python_script_2.python (31 lines) ----------
import clr
clr.AddReference('ProtoGeometry')
from Autodesk.DesignScript.Geometry import *
clr.AddReference('RevitAPI')
from Autodesk.Revit.DB import *
clr.AddReference('RevitServices')
from RevitServices.Transactions import TransactionManager
from RevitServices.Persistence import DocumentManager

doc = DocumentManager.Instance.CurrentDBDocument
uiapp = DocumentManager.Instance.CurrentUIApplication
app = uiapp.Application

#The inputs to this node will be stored as a list in the IN variables.
dataEnteringNode = IN

wall = UnwrapElement(IN[0])
#####################################################
geo = wall.get_Geometry(Autodesk.Revit.DB.Options)




# Start Transaction
TransactionManager.Instance.EnsureInTransaction(doc)
# End Transaction
TransactionManager.Instance.TransactionTaskDone()
doc.Regenerate()

#Assign your output to the OUT variable.
OUT = geo
# ----------------------------------------
