# Dynamo graph 180802 Lean Concrete Floor.dyn (Dynamo 0.9.1.4062)

select_model_elements = DSModelElementsSelection()  # 199 picked in the model
code_block = CodeBlock { "Structural Foundations"; "Structural Columns"; "Walls"; "Structural Framing"; "Floors"; }
python_script = Python(IN[0]=select_model_elements, IN[1]=code_block.out0, IN[2]=code_block.out1, IN[3]=code_block.out2, IN[4]=code_block.out3, IN[5]=code_block.out4)
# ---------- python_script.python (60 lines) ----------
import clr
clr.AddReference('ProtoGeometry')
from Autodesk.DesignScript.Geometry import *
clr.AddReference('RevitAPI')
from Autodesk.Revit.DB import *
clr.AddReference('RevitAPIUI')
from Autodesk.Revit.UI import TaskDialog
clr.AddReference("RevitNodes")
import Revit
clr.ImportExtensions(Revit.Elements)
clr.AddReference("RevitServices")
import RevitServices
from RevitServices.Persistence import DocumentManager
from RevitServices.Transactions import TransactionManager
from System.Collections.Generic import *
clr.ImportExtensions(Revit.GeometryConversion)
 
doc = DocumentManager.Instance.CurrentDBDocument
uiapp = DocumentManager.Instance.CurrentUIApplication
app = uiapp.Application
 
import sys
import System
import Autodesk.Revit.DB.JoinGeometryUtils as JGU # de Join

#The inputs to this node will be stored as a list in the IN variables.
dataEnteringNode = IN

elems = UnwrapElement(IN[0])
f=IN[1]
c=IN[2]
w=IN[3]
fr=IN[4]
fl=IN[5]


FD=[]
SC=[]
SW=[]
SFR=[]
SFL=[]

res = []

for e in elems:
	if e.Category.Name == f:
		FD.append(e)
	elif e.Category.Name == c:
		SC.append(e)
	elif e.Category.Name == w:
		SW.append(e)
	elif e.Category.Name == fr:
		SFR.append(e)
	elif e.Category.Name == fl:
		SFL.append(e)
	else:
		res.append(e)

#Assign your output to the OUT variable.
OUT = FD,SC,SW,SFR,SFL,res
# ----------------------------------------
code_block_2 = CodeBlock(elemList=python_script)
# ---------- code_block_2.designscript (6 lines) ----------
elemList;
foundations = elemList[0];
columns = elemList[1];
walls = elemList[2];
framings = elemList[3];
floors = elemList[4];
# ----------------------------------------
tên_loại_sàn_bt_lót = StringInput("Generic 50mm")
string = StringInput("Reference Level")
code_block_3 = CodeBlock(code_block_2.framings, tên_loại_sàn_bt_lót, string)  # frozen
# ---------- code_block_3.designscript (12 lines) ----------
inputElems = t4;
floorTypeName = t5;
paramName = t6;
t1 = inputElems;
t2 = floorTypeName;
t3 = paramName;
t7 = t1.Geometry();
num3 = List.Count(t7<1L>);
t8 = List.AllIndicesOf(num3, 0);
num4 = Count(t8);
t9 = num4 == 0;
t10 = List.RemoveItemAtIndex(t1, t8);
# ----------------------------------------
if_ = If(test=code_block_3.t9, true=code_block_3.t1, false=code_block_3.t10)
code_block_4 = CodeBlock(t2=code_block_3.t7, t9=code_block_3.t2, t11=if_, t12=code_block_3.t3)
# ---------- code_block_4.designscript (14 lines) ----------
t1 = Flatten(t2);
geometry1 = t1.Explode();
t3 = Flatten(geometry1);
vector1 = geometry1.NormalAtParameter(0.5, 0.5);
num3 = vector1.Z;
t4 = num3 == -1;
t5 = Flatten(t4);
t6 = true;
t7 = List.AllIndicesOf(t5, t6);
t8 = List.GetItemAtIndex(t3, t7);
curve1 = t8.PerimeterCurves();
floortype1 = FloorType.ByName(t9);
t10 = t11.GetParameterValueByName(t12);
floor1 = Floor.ByOutlineTypeAndLevel(curve1, floortype1, t10);
# ----------------------------------------
string_2 = StringInput("Level")
code_block_5 = CodeBlock(code_block_2.foundations, tên_loại_sàn_bt_lót, string_2)  # frozen; same code as code_block_3
if_2 = If(test=code_block_5.t9, true=code_block_5.t1, false=code_block_5.t10)
code_block_6 = CodeBlock(t2=code_block_5.t7, t9=code_block_5.t2, t11=if_2, t12=code_block_5.t3)  # same code as code_block_4
code_block_7 = CodeBlock(inputElems=code_block_2.floors, floorTypeName=tên_loại_sàn_bt_lót, paramName=string_2) { inputElems; floorTypeName; paramName; }
geometry = Element.Geometry(code_block_7.inputElems)
flatten = Flatten(geometry)
explode = Geometry.Explode(flatten)
flatten_2 = Flatten(explode)
code_block_8 = CodeBlock { 0.5; }
normalAtParameter = Surface.NormalAtParameter(surface=explode, u=code_block_8, v=code_block_8)
Z = Vector.Z(normalAtParameter)
code_block_9 = CodeBlock { -1; }
eq = Z == code_block_9
flatten_3 = Flatten(eq)
boolean = BoolSelector(true)
allIndicesOf = List.AllIndicesOf(list=flatten_3, item=boolean)
getItemAtIndex = List.GetItemAtIndex(list=flatten_2, index=allIndicesOf)
perimeterCurves = Surface.PerimeterCurves(getItemAtIndex)
byName = FloorType.ByName(code_block_7.floorTypeName)
count = List.Count(geometry, lacing=Longest)
code_block_10 = CodeBlock { 0; }
allIndicesOf_2 = List.AllIndicesOf(list=count, item=code_block_10)
count_2 = Count(allIndicesOf_2)
code_block_11 = CodeBlock { 0; }
eq_2 = count_2 == code_block_11
removeItemAtIndex = List.RemoveItemAtIndex(list=code_block_7.inputElems, indices=allIndicesOf_2)
if_3 = If(test=eq_2, true=code_block_7.inputElems, false=removeItemAtIndex)
getParameterValueByName = Element.GetParameterValueByName(element=if_3, parameterName=code_block_7.paramName)
byOutlineTypeAndLevel = Floor.ByOutlineTypeAndLevel(outlineCurves=perimeterCurves, floorType=byName, level=getParameterValueByName)
python_script_2 = Python(IN[0]=perimeterCurves)
# ---------- python_script_2.python (19 lines) ----------
import clr
clr.AddReference('ProtoGeometry')
from Autodesk.DesignScript.Geometry import *
#The inputs to this node will be stored as a list in the IN variables.
dataEnteringNode = IN

list = IN[0]
res = []

for l in list:
	l0 = l[0]
	reslist = l[:]
	reslist.remove(l0)
	
	polyC = Curve.Join(l0,reslist)
	res.append(polyC)

#Assign your output to the OUT variable.
OUT = res
# ----------------------------------------
byOutlineTypeAndLevel_2 = Floor.ByOutlineTypeAndLevel(outline=python_script_2)
code_block_12 = CodeBlock(inputElems=code_block_2.floors, floorTypeName=tên_loại_sàn_bt_lót, paramName=string_2) { inputElems; floorTypeName; paramName; }  # frozen
geometry_2 = Element.Geometry(code_block_12.inputElems)
flatten_4 = Flatten(geometry_2)
explode_2 = Geometry.Explode(flatten_4)
flatten_5 = Flatten(explode_2)
code_block_13 = CodeBlock { 0.5; }
normalAtParameter_2 = Surface.NormalAtParameter(surface=explode_2, u=code_block_13, v=code_block_13)
Z_2 = Vector.Z(normalAtParameter_2)
code_block_14 = CodeBlock { -1; }
eq_3 = Z_2 == code_block_14
flatten_6 = Flatten(eq_3)
boolean_2 = BoolSelector(true)
allIndicesOf_3 = List.AllIndicesOf(list=flatten_6, item=boolean_2)
getItemAtIndex_2 = List.GetItemAtIndex(list=flatten_5, index=allIndicesOf_3)
perimeterCurves_2 = Surface.PerimeterCurves(getItemAtIndex_2)
byName_2 = FloorType.ByName(code_block_12.floorTypeName)
count_3 = List.Count(geometry_2, lacing=Longest)
code_block_15 = CodeBlock { 0; }
allIndicesOf_4 = List.AllIndicesOf(list=count_3, item=code_block_15)
count_4 = Count(allIndicesOf_4)
code_block_16 = CodeBlock { 0; }
eq_4 = count_4 == code_block_16
removeItemAtIndex_2 = List.RemoveItemAtIndex(list=code_block_12.inputElems, indices=allIndicesOf_4)
if_4 = If(test=eq_4, true=code_block_12.inputElems, false=removeItemAtIndex_2)
getParameterValueByName_2 = Element.GetParameterValueByName(element=if_4, parameterName=code_block_12.paramName)
byOutlineTypeAndLevel_3 = Floor.ByOutlineTypeAndLevel(outlineCurves=perimeterCurves_2, floorType=byName_2, level=getParameterValueByName_2)
python_script_3 = Python(IN[0]=perimeterCurves_2)  # same code as python_script_2
byOutlineTypeAndLevel_4 = Floor.ByOutlineTypeAndLevel(outline=python_script_3)
