# Dynamo graph AutoJoin-StrucColumnsBeams.dyn (Dynamo 0.9.1.4062)

column = DSModelElementSelection()
solids = Element.Solids(column)
framing = DSModelElementSelection()
solids_2 = Element.Solids(framing)
doesIntersect = Geometry.DoesIntersect(geometry=solids, other=solids_2)  # frozen
areElementsJoined = StringInput("""import clr
clr.AddReference('ProtoGeometry')
from Autodesk.DesignScript.Geometry import *

clr.AddReference("RevitAPI")
import Autodesk
import Autodesk.Revit.DB.JoinGeometryUtils as rdj

clr.AddReference("RevitServices")
import RevitServices
from RevitServices.Persistence import DocumentManager
from RevitServices.Transactions import TransactionManager

clr.AddReference("RevitNodes")
import Revit
clr.ImportExtensions(Revit.Elements)
#The inputs to this node will be stored as a list in the IN variables.
dataEnteringNode = IN

A = UnwrapElement(IN[0]) # First Elements
B = UnwrapElement(IN[1]) # Second Elements

doc = DocumentManager.Instance.CurrentDBDocument
results = []

TransactionManager.Instance.EnsureInTransaction(doc)
try:
 results = rdj.AreElementsJoined(doc,A,B)
except:
 pass





TransactionManager.Instance.TransactionTaskDone()
#Assign your output to the OUT variable.
OUT = results""")
unjoin = StringInput("""import clr
clr.AddReference('ProtoGeometry')
from Autodesk.DesignScript.Geometry import *

clr.AddReference("RevitAPI")
import Autodesk
import Autodesk.Revit.DB.JoinGeometryUtils as rdj

clr.AddReference("RevitServices")
import RevitServices
from RevitServices.Persistence import DocumentManager
from RevitServices.Transactions import TransactionManager

clr.AddReference("RevitNodes")
import Revit
clr.ImportExtensions(Revit.Elements)
#The inputs to this node will be stored as a list in the IN variables.
dataEnteringNode = IN

A = UnwrapElement(IN[0]) # First Elements
B = UnwrapElement(IN[1]) # Second Elements

doc = DocumentManager.Instance.CurrentDBDocument
results = []

TransactionManager.Instance.EnsureInTransaction(doc)
try:
 results = rdj.UnjoinGeometry(doc,A,B)
except:
 pass





TransactionManager.Instance.TransactionTaskDone()
#Assign your output to the OUT variable.
OUT = A,B""")
if_ = If(test=doesIntersect, true=areElementsJoined, false=unjoin)
are_elements_joined = PythonStringNode(script=if_, IN[0]=column, IN[1]=framing)
isCuttingElementInJoin = StringInput("""import clr
clr.AddReference('ProtoGeometry')
from Autodesk.DesignScript.Geometry import *

clr.AddReference("RevitAPI")
import Autodesk
import Autodesk.Revit.DB.JoinGeometryUtils as rdj

clr.AddReference("RevitServices")
import RevitServices
from RevitServices.Persistence import DocumentManager
from RevitServices.Transactions import TransactionManager

clr.AddReference("RevitNodes")
import Revit
clr.ImportExtensions(Revit.Elements)
#The inputs to this node will be stored as a list in the IN variables.
dataEnteringNode = IN

A = UnwrapElement(IN[0]) # First Elements
B = UnwrapElement(IN[1]) # Second Elements

doc = DocumentManager.Instance.CurrentDBDocument
results = []

TransactionManager.Instance.EnsureInTransaction(doc)
try:
 results = rdj.IsCuttingElementInJoin(doc,A,B)
except:
 pass





TransactionManager.Instance.TransactionTaskDone()
#Assign your output to the OUT variable.
OUT = results""")
join = StringInput("""import clr
clr.AddReference('ProtoGeometry')
from Autodesk.DesignScript.Geometry import *

clr.AddReference("RevitAPI")
import Autodesk
import Autodesk.Revit.DB.JoinGeometryUtils as rdj

clr.AddReference("RevitServices")
import RevitServices
from RevitServices.Persistence import DocumentManager
from RevitServices.Transactions import TransactionManager

clr.AddReference("RevitNodes")
import Revit
clr.ImportExtensions(Revit.Elements)
#The inputs to this node will be stored as a list in the IN variables.
dataEnteringNode = IN

A = UnwrapElement(IN[0]) # First Elements
B = UnwrapElement(IN[1]) # Second Elements

doc = DocumentManager.Instance.CurrentDBDocument
results = []

TransactionManager.Instance.EnsureInTransaction(doc)
try:
 results = rdj.JoinGeometry(doc,A,B)
except:
 pass





TransactionManager.Instance.TransactionTaskDone()
#Assign your output to the OUT variable.
OUT = A,B""")
if_2 = If(test=are_elements_joined, true=isCuttingElementInJoin, false=join)
isCuttingElementInJoin_2 = PythonStringNode(script=if_2, IN[0]=column, IN[1]=framing)
code_block = CodeBlock { "Successful"; }
switchJoinOrder = StringInput("""import clr
clr.AddReference('ProtoGeometry')
from Autodesk.DesignScript.Geometry import *

clr.AddReference("RevitAPI")
import Autodesk
import Autodesk.Revit.DB.JoinGeometryUtils as rdj

clr.AddReference("RevitServices")
import RevitServices
from RevitServices.Persistence import DocumentManager
from RevitServices.Transactions import TransactionManager

clr.AddReference("RevitNodes")
import Revit
clr.ImportExtensions(Revit.Elements)
#The inputs to this node will be stored as a list in the IN variables.
dataEnteringNode = IN

A = UnwrapElement(IN[0]) # First Elements
B = UnwrapElement(IN[1]) # Second Elements

doc = DocumentManager.Instance.CurrentDBDocument
results = []

TransactionManager.Instance.EnsureInTransaction(doc)
try:
 results = rdj.SwitchJoinOrder(doc,B,A)
except:
 pass





TransactionManager.Instance.TransactionTaskDone()
#Assign your output to the OUT variable.
OUT = results""")
if_3 = If(test=isCuttingElementInJoin_2, true=code_block, false=switchJoinOrder)
switchJoinOrder_2 = PythonStringNode(script=if_3, IN[0]=column, IN[1]=framing)
getJoin = StringInput("""import clr
clr.AddReference('ProtoGeometry')
from Autodesk.DesignScript.Geometry import *

clr.AddReference("RevitAPI")
import Autodesk
import Autodesk.Revit.DB.JoinGeometryUtils as rdj

clr.AddReference("RevitServices")
import RevitServices
from RevitServices.Persistence import DocumentManager
from RevitServices.Transactions import TransactionManager

clr.AddReference("RevitNodes")
import Revit
clr.ImportExtensions(Revit.Elements)
#The inputs to this node will be stored as a list in the IN variables.
dataEnteringNode = IN

elementA = UnwrapElement(IN[0]) # First Elements

doc = DocumentManager.Instance.CurrentDBDocument
results = []

results = rdj.GetJoinedElements (doc,elementA)






TransactionManager.Instance.TransactionTaskDone()
#Assign your output to the OUT variable.
OUT = results""")
categories = Categories("StructuralColumns")

# group: Đối tượng ***bị Cắt
all_elements_of_category = ElementsOfCategory(categories)
flatten = Flatten(all_elements_of_category)

categories_2 = Categories("StructuralFraming")

# group: Đối tượng ***Cắt
all_elements_of_category_2 = ElementsOfCategory(categories_2)
flatten_2 = Flatten(all_elements_of_category_2)

solids_3 = Element.Solids(flatten)
flatten_3 = Flatten(solids_3)
solids_4 = Element.Solids(flatten_2)
flatten_4 = Flatten(solids_4)
python_script = Python(IN[0]=flatten, IN[1]=flatten_2, IN[2]=flatten_3, IN[3]=flatten_4)
# ---------- python_script.python (49 lines) ----------
import clr
clr.AddReference('ProtoGeometry')
from Autodesk.DesignScript.Geometry import *

clr.AddReference("RevitAPI")
import Autodesk
import Autodesk.Revit.DB.JoinGeometryUtils as rdj

clr.AddReference("RevitServices")
import RevitServices
from RevitServices.Persistence import DocumentManager
from RevitServices.Transactions import TransactionManager

clr.AddReference("RevitNodes")
import Revit
clr.ImportExtensions(Revit.Elements)
#The inputs to this node will be stored as a list in the IN variables.
dataEnteringNode = IN

elementA = UnwrapElement(IN[0])
elementB = UnwrapElement(IN[1])
geo1 = IN[2]
geo2 = IN[3]

doc = DocumentManager.Instance.CurrentDBDocument
results = []
TransactionManager.Instance.EnsureInTransaction(doc)
for i in range(0,len(elementA)-1):
	g1=geo1[i]
	A=elementA[i]
	for j in range(0,len(elementB)-1):
		g2=geo2[j]
		B=elementB[j]
		try:
			if not g1.DoesIntersect(g2):
				results = rdj.UnjoinGeometry(doc,A,B)
			
			elif not rdj.AreElementsJoined(doc,A,B):				
				results = rdj.JoinGeometry(doc,A,B)
			elif not rdj.IsCuttingElementInJoin(doc,A,B):
				results = rdj.SwitchJoinOrder(doc,B,A)
			else:
				results = "Nothing to join"
		except:
			pass

TransactionManager.Instance.TransactionTaskDone()
#Assign your output to the OUT variable.
OUT = results
# ----------------------------------------
