# Dynamo graph AutoJoinGeometry-fix unjoin then join-170913.dyn (Dynamo 0.9.1.4062)

categories = Categories("Walls")
categories_2 = Categories("StructuralColumns")
categories_3 = Categories("Floors")
categories_4 = Categories("StructuralFraming")

# group: Đối tượng ***bị Cắt
select_model_elements = DSModelElementsSelection()
all_elements_of_category = ElementsOfCategory(categories_4)

# group: Đối tượng ***Cắt
select_model_elements_2 = DSModelElementsSelection()
all_elements_of_category_2 = ElementsOfCategory(categories_3)
flatten = Flatten(all_elements_of_category)

# group (continued): Đối tượng ***bị Cắt
flatten_2 = Flatten(all_elements_of_category_2)

solids = Element.Solids(flatten_2)
byUnion = Solid.ByUnion(solids)
solids_2 = Element.Solids(flatten)
byUnion_2 = Solid.ByUnion(solids_2)
python_script = Python(IN[0]=flatten_2, IN[1]=flatten, IN[2]=byUnion, IN[3]=byUnion_2)
# ---------- python_script.python (54 lines) ----------
import clr
clr.AddReference('ProtoGeometry')
from Autodesk.DesignScript.Geometry import *

clr.AddReference("RevitAPI")
import Autodesk

clr.AddReference("RevitServices")
import RevitServices
from RevitServices.Persistence import DocumentManager
from RevitServices.Transactions import TransactionManager

clr.AddReference("RevitNodes")
import Revit
clr.ImportExtensions(Revit.Elements)
#The inputs to this node will be stored as a list in the IN variables.
dataEnteringNode = IN

elementA = UnwrapElement(IN[0])
elementB = UnwrapElement(IN[1])
geo1 = IN[2]
geo2 = IN[3]

doc = DocumentManager.Instance.CurrentDBDocument
results = []
TransactionManager.Instance.EnsureInTransaction(doc)
for i in range(0, len(elementA)):
	for j in range(0, len(elementB)):
		A = elementA[i]
		B = elementB[j]
		try:
			if Autodesk.Revit.DB.JoinGeometryUtils.IsCuttingElementInJoin(doc,A,B) :
				result = Autodesk.Revit.DB.JoinGeometryUtils.UnjoinGeometry(doc,A,B)# Neu 2 cau kien dang join voi nhau thi Unjoin
		except:
			pass
		
for i in range(0, len(elementA)):
	for j in range(0, len(elementB)):
		A = elementA[i]
		B = elementB[j]
		try:
			if geo1[i].DoesIntersect(geo2[j]):#Neu cau kien intersect voi nhau
				if not Autodesk.Revit.DB.JoinGeometryUtils.AreElementsJoined(doc,A,B): #Neu cau kien khong Join nhau thi tien hanh Join
					result = Autodesk.Revit.DB.JoinGeometryUtils.JoinGeometry(doc,A,B)
					if not Autodesk.Revit.DB.JoinGeometryUtils.IsCuttingElementInJoin(doc,A,B): #NEu thu tu Join khong dung thi swtitchJoin
						result = Autodesk.Revit.DB.JoinGeometryUtils.SwitchJoinOrder(doc,A,B)
				elif not Autodesk.Revit.DB.JoinGeometryUtils.IsCuttingElementInJoin(doc,A,B): #Neu cau kien dang join thi kiem tra de switch join
					result = Autodesk.Revit.DB.JoinGeometryUtils.SwitchJoinOrder(doc,A,B)
				results.append(result)
		except:
			pass
TransactionManager.Instance.TransactionTaskDone()
#Assign your output to the OUT variable.
OUT = results
# ----------------------------------------
