# Dynamo graph Bo Tri Gian Giao 04.dyn (Dynamo 0.9.1.4062)

n2d_adaptive_family_type_name = CodeBlock { "Adt-WL-2D-Hoz Brace 600-2 pts"; "Adt-WL-2D-Hoz Brace 900-2 pts"; "Adt-WL-2D-Hoz Brace 1200-2 pts"; }  # "[2D Adaptive] Family Type Name"
sub_2d_adaptive_family_type_name = CodeBlock { "Adt-WL-2D-Hoz Brace 600-2 pts"; "Adt-WL-2D-Hoz Brace 900-2 pts 2"; "Adt-WL-2D-Hoz Brace 1200-2 pts 2"; }
# note: Chọn đối tượng
# Revit lines là Layout giàn giáo
select_model_elements_revit = DSModelElementsSelection()  # "Select Model Elements [Revit Lines]"; 7 picked in the model
cad_sub_cat = CodeBlock { "Brace_600"; "Brace_900"; "Brace_1200"; }
create = List.Create(cad_sub_cat.out0, cad_sub_cat.out1, cad_sub_cat.out2)

# group: REVIT LINES
filter_needed_revit_lines = Python(IN[0]=select_model_elements_revit, IN[1]=create)
# ---------- filter_needed_revit_lines.python (39 lines) ----------
import clr
clr.AddReference('ProtoGeometry')
from Autodesk.DesignScript.Geometry import *
clr.AddReference('RevitAPI')
from Autodesk.Revit.DB import *
clr.AddReference('RevitAPIUI')
from Autodesk.Revit.UI import TaskDialog
clr.AddReference("RevitNodes")
import Revit
clr.ImportExtensions(Revit.Elements)
clr.AddReference("RevitServices")
import RevitServices
from RevitServices.Persistence import DocumentManager
from RevitServices.Transactions import TransactionManager
from System.Collections.Generic import *
clr.ImportExtensions(Revit.GeometryConversion)
 
doc = DocumentManager.Instance.CurrentDBDocument
uiapp = DocumentManager.Instance.CurrentUIApplication
app = uiapp.Application
 
import sys
import System

#The inputs to this node will be stored as a list in the IN variables.
dataEnteringNode = IN

lines = UnwrapElement(IN[0])
neededLineNames = IN[1]
_LINEs = []
for l in lines:
	geo = l.Geometry[Options()]
	#crv = geo.GetInstanceGeometry()
	for n in neededLineNames:
		if n == doc.GetElement(geo.GraphicsStyleId).GraphicsStyleCategory.Name:
			_LINEs.append(l)
	
#Assign your output to the OUT variable.
OUT = _LINEs
# ----------------------------------------
curves = Element.Curves(filter_needed_revit_lines)
flatten = Flatten(curves)

code_block = CodeBlock(t5=flatten)
# ---------- code_block.designscript (10 lines) ----------
crvs = t5;
res = Flatten(crvs);
point1 = res.StartPoint;
t1 = Flatten(point1);
point2 = res.EndPoint;
t2 = Flatten(point2);
t3 = {t1, t2};
t4 = List.Transpose(t3);
t6 = List.Sublists(t4, 0, 1);
t7 = Flatten(t4);
# ----------------------------------------
n3d_adaptive_family_type_name = CodeBlock { "Adt-Wedgelock-Sys of Hoz Brace 1200 @1500-2 points"; "Adt-Wedgelock-Sys of Post w Head U non Moduled-1 points"; }  # "[3D Adaptive] Family Type Name"
byName = FamilyType.ByName(n3d_adaptive_family_type_name.out1)
byPoints = AdaptiveComponent.ByPoints(points=code_block.t7, familyType=byName)
byName_2 = FamilyType.ByName(n3d_adaptive_family_type_name.out0)
byPoints_2 = AdaptiveComponent.ByPoints(points=code_block.t6, familyType=byName_2)
# note: Chọn line 1 để xác định
#  vector / Hướng sẽ loại bỏ
select_model_element_1_revit = DSModelElementSelection()  # "Select Model Element [1 Revit Line]"; 1 picked in the model
code_block_2 = CodeBlock(flatten, select_model_element_1_revit)
# ---------- code_block_2.designscript (12 lines) ----------
t1 = t5;
t2 = t6;
vector1 = t1.Normal;
num1 = vector1.Z;
curve1 = t2.Curves;
t3 = Flatten(curve1);
vector2 = t3.Normal;
num2 = vector2.Z;
t4 = num1<1L> == num2<1L>;
t7 = List.FilterByBoolMask(t5, t4);
t8 = __TryGetValueFromNestedDictionaries(t7, "in");
t9 = __TryGetValueFromNestedDictionaries(t7, "out");
# ----------------------------------------
# note: Chọn line 2 để xác định
#  vector / Hướng sẽ loại bỏ
select_model_element_1_revit_2 = DSModelElementSelection()  # "Select Model Element [1 Revit Line]"; 1 picked in the model
select_model_element_1_revit_3 = DSModelElementSelection()  # "Select Model Element [1 Revit Line]"; 1 picked in the model
watch = Watch(code_block.t7)
code_block_3 = CodeBlock { 100; }
byCenterPointRadius = Sphere.ByCenterPointRadius(centerPoint=code_block.t7, radius=code_block_3)  # frozen
watch_2 = Watch(byCenterPointRadius)
python_script = Python(IN[0]=code_block.t6, IN[1]=byCenterPointRadius)  # frozen
# ---------- python_script.python (45 lines) ----------
import clr
clr.AddReference('ProtoGeometry')
from Autodesk.DesignScript.Geometry import *
clr.AddReference('RevitAPI')
from Autodesk.Revit.DB import *
clr.AddReference('RevitAPIUI')
from Autodesk.Revit.UI import TaskDialog
clr.AddReference("RevitNodes")
import Revit
clr.ImportExtensions(Revit.Elements)
clr.AddReference("RevitServices")
import RevitServices
from RevitServices.Persistence import DocumentManager
from RevitServices.Transactions import TransactionManager
from System.Collections.Generic import *
clr.ImportExtensions(Revit.GeometryConversion)
 
doc = DocumentManager.Instance.CurrentDBDocument
uiapp = DocumentManager.Instance.CurrentUIApplication
app = uiapp.Application
 
import sys
import System

#The inputs to this node will be stored as a list in the IN variables.
dataEnteringNode = IN

_pts = IN[0]
_sph0 = IN[1]

_sph1 = _sph0[:]
_sph2 = _sph0[:]
_res = []

for s1 in _sph1:
	_sph2.Remove(s1)
	bres=[]
	for s2 in _sph2:
		bres.append(s1.DoesIntersect(s2))
	sb = sum(bool(b) for b in bres)
	if sb > 0:
		_res.append(s1)
	_sph1.Remove(s1)
#Assign your output to the OUT variable.
OUT = _res
# ----------------------------------------
watch_3 = Watch(python_script)
python_script_2 = Python(IN[0]=code_block.t7)
# ---------- python_script_2.python (41 lines) ----------
import clr
clr.AddReference('ProtoGeometry')
from Autodesk.DesignScript.Geometry import *
clr.AddReference('RevitAPI')
from Autodesk.Revit.DB import *
clr.AddReference('RevitAPIUI')
from Autodesk.Revit.UI import TaskDialog
clr.AddReference("RevitNodes")
import Revit
clr.ImportExtensions(Revit.Elements)
clr.AddReference("RevitServices")
import RevitServices
from RevitServices.Persistence import DocumentManager
from RevitServices.Transactions import TransactionManager
from System.Collections.Generic import *
clr.ImportExtensions(Revit.GeometryConversion)
 
doc = DocumentManager.Instance.CurrentDBDocument
uiapp = DocumentManager.Instance.CurrentUIApplication
app = uiapp.Application
 
import sys
import System

#The inputs to this node will be stored as a list in the IN variables.
dataEnteringNode = IN

pts = IN[0]

pts1 = pts[:]
pts2 = pts[:]

res=[]
for p1 in pts1:
	for p2 in pts2:
		if p1.DistanceTo(p2) == 0:
			if not index(p1) == index(p2)
				pts2.Remove(p2)

#Assign your output to the OUT variable.
OUT = pts1,pts2
# ----------------------------------------
watch_4 = Watch(python_script_2)
byCoordinates = Point.ByCoordinates()
byCoordinates_2 = Point.ByCoordinates()
distanceTo = Geometry.DistanceTo(geometry=byCoordinates, other=byCoordinates_2)
code_block_4 = CodeBlock { point1 = Point.ByCoordinates(0, 0, 0); point2 = Point.ByCoordinates(0, 0, 0); num1 = point1.DistanceTo(point2); }
