# Dynamo graph Structure Joining by Orders 180801.dyn (Dynamo 0.9.1.4062)

categories = Categories("StructuralFoundation")
all_elements_of_category = ElementsOfCategory(categories)
categories_2 = Categories("StructuralColumns")
all_elements_of_category_2 = ElementsOfCategory(categories_2)
# note: [1] Toàn bộ Cá thể
# Structural Foundations
categories_3 = Categories("StructuralFraming")
all_elements_of_category_3 = ElementsOfCategory(categories_3)
# note: [1] Toàn bộ Cá thể
# Structural Columns
# note: [1] Toàn bộ Cá thể
# Structural Framings
categories_4 = Categories("Floors")
all_elements_of_category_4 = ElementsOfCategory(categories_4)
string = StringInput("""import clr
clr.AddReference('ProtoGeometry')
from Autodesk.DesignScript.Geometry import *
clr.AddReference('RevitAPI')
from Autodesk.Revit.DB import *
clr.AddReference('RevitAPIUI')
from Autodesk.Revit.UI import TaskDialog
clr.AddReference("RevitNodes")
import Revit
clr.ImportExtensions(Revit.Elements)
clr.AddReference("RevitServices")
import RevitServices
from RevitServices.Persistence import DocumentManager
from RevitServices.Transactions import TransactionManager
from System.Collections.Generic import *
clr.ImportExtensions(Revit.GeometryConversion)
 
doc = DocumentManager.Instance.CurrentDBDocument
uiapp = DocumentManager.Instance.CurrentUIApplication
app = uiapp.Application
 
import sys
import System

import Autodesk.Revit.DB.JoinGeometryUtils as JGU
#The inputs to this node will be stored as a list in the IN variables.
dataEnteringNode = IN

elems = UnwrapElement(IN[0])
res = []

finRes = []

if not len(elems) == 0:
 for e in elems:
  je = JGU.GetJoinedElements(doc,e)
  ees = []
  for id in je:
   ee = doc.GetElement(id)
   ees.append(ee)   
  res.append(ees)
 finRes.append(elems)
 finRes.append(res)
else:
 finRes = 0

#Assign your output to the OUT variable.
OUT = finRes""")
# note: [0] Chọn toàn bộ các Cấu kiện KC theo Tầng
# note: Thứ tự ưu tiên JOIN;
# 1. Móng
# 2. Cột
# 3. Tường
# 4. Dầm
# 5. Sàn
select_model_elements = DSModelElementsSelection()  # 52 picked in the model
# note: [1] Toàn bộ Cá thể
# Floors
# note: [1] Lọc theo category
code_block = CodeBlock { "Structural Foundations"; "Structural Columns"; "Walls"; "Structural Framing"; "Floors"; }
python_script = Python(IN[0]=select_model_elements, IN[1]=code_block.out0, IN[2]=code_block.out1, IN[3]=code_block.out2, IN[4]=code_block.out3, IN[5]=code_block.out4)
# ---------- python_script.python (60 lines) ----------
import clr
clr.AddReference('ProtoGeometry')
from Autodesk.DesignScript.Geometry import *
clr.AddReference('RevitAPI')
from Autodesk.Revit.DB import *
clr.AddReference('RevitAPIUI')
from Autodesk.Revit.UI import TaskDialog
clr.AddReference("RevitNodes")
import Revit
clr.ImportExtensions(Revit.Elements)
clr.AddReference("RevitServices")
import RevitServices
from RevitServices.Persistence import DocumentManager
from RevitServices.Transactions import TransactionManager
from System.Collections.Generic import *
clr.ImportExtensions(Revit.GeometryConversion)
 
doc = DocumentManager.Instance.CurrentDBDocument
uiapp = DocumentManager.Instance.CurrentUIApplication
app = uiapp.Application
 
import sys
import System
import Autodesk.Revit.DB.JoinGeometryUtils as JGU # de Join

#The inputs to this node will be stored as a list in the IN variables.
dataEnteringNode = IN

elems = UnwrapElement(IN[0])
f=IN[1]
c=IN[2]
w=IN[3]
fr=IN[4]
fl=IN[5]


FD=[]
SC=[]
SW=[]
SFR=[]
SFL=[]

res = []

for e in elems:
	if e.Category.Name == f:
		FD.append(e)
	elif e.Category.Name == c:
		SC.append(e)
	elif e.Category.Name == w:
		SW.append(e)
	elif e.Category.Name == fr:
		SFR.append(e)
	elif e.Category.Name == fl:
		SFL.append(e)
	else:
		res.append(e)

#Assign your output to the OUT variable.
OUT = FD,SC,SW,SFR,SFL,res
# ----------------------------------------
code_block_2 = CodeBlock(elemList=python_script)
# ---------- code_block_2.designscript (6 lines) ----------
elemList;
foundations = elemList[0];
columns = elemList[1];
walls = elemList[2];
framings = elemList[3];
floors = elemList[4];
# ----------------------------------------
# note: Tìm các cá thể join với đối tượng lọc
python_script_from_string = PythonStringNode(script=string, IN[0]=code_block_2.foundations)
transpose = List.Transpose(python_script_from_string)
# note: Loại bỏ Null / Empty list
python_script_2 = Python(IN[0]=transpose)
# ---------- python_script_2.python (21 lines) ----------
import clr
clr.AddReference('ProtoGeometry')
from Autodesk.DesignScript.Geometry import *
#The inputs to this node will be stored as a list in the IN variables.
dataEnteringNode = IN

list = IN[0]

res = []

for l in list:
	e = l[0]
	je = l[1]
	
	if len(je) == 0:
		res.append(l)
		list.remove(l)


#Assign your output to the OUT variable.
OUT = list#,res
# ----------------------------------------
watch = Watch(python_script_2)
python_script_from_string_2 = PythonStringNode(script=string, IN[0]=code_block_2.columns)
python_script_from_string_3 = PythonStringNode(script=string, IN[0]=code_block_2.walls)
python_script_from_string_4 = PythonStringNode(script=string, IN[0]=code_block_2.framings)
python_script_from_string_5 = PythonStringNode(script=string, IN[0]=code_block_2.floors)
transpose_2 = List.Transpose(python_script_from_string_5)
python_script_3 = Python(IN[0]=transpose_2)  # same code as python_script_2
python_script_4 = Python(IN[0]=python_script_3)
# ---------- python_script_4.python (42 lines) ----------
import clr
clr.AddReference('ProtoGeometry')
from Autodesk.DesignScript.Geometry import *
clr.AddReference('RevitAPI')
from Autodesk.Revit.DB import *
clr.AddReference('RevitAPIUI')
from Autodesk.Revit.UI import TaskDialog
clr.AddReference("RevitNodes")
import Revit
clr.ImportExtensions(Revit.Elements)
clr.AddReference("RevitServices")
import RevitServices
from RevitServices.Persistence import DocumentManager
from RevitServices.Transactions import TransactionManager
from System.Collections.Generic import *
clr.ImportExtensions(Revit.GeometryConversion)
 
doc = DocumentManager.Instance.CurrentDBDocument
uiapp = DocumentManager.Instance.CurrentUIApplication
app = uiapp.Application
 
import sys
import System
import Autodesk.Revit.DB.JoinGeometryUtils as JGU # de Join 

#The inputs to this node will be stored as a list in the IN variables.
dataEnteringNode = IN

list = IN[0]

res = []

for l in list:
	A = l[0]
	jes = l[1]
	
	for B in jes:
		res.append(JGU.IsCuttingElementInJoin (doc,A,B))


#Assign your output to the OUT variable.
OUT = res
# ----------------------------------------
