# Dynamo graph 01-Disallow Join Selected Walls.dyn (Dynamo 0.9.1.4062)

# note: 0: Unjoint End 0
# 1: Unjoint End 1
# 2: Unjoint 2 Ends
unjoin_mode = CodeBlock { 2; }
n0_unjoin_end_0 = StringInput("import clr\n\nclr.AddReference(\"RevitServices\")\nimport RevitServices\nfrom RevitServices.Persistence import DocumentManager\nfrom RevitServices.Transactions import TransactionManager\ndoc = DocumentManager.Instance.CurrentDBDocument\n\nclr.AddReference(\"RevitAPI\")\nfrom Autodesk.Revit.DB import WallUtils\n\nwalls = UnwrapElement(IN[0])\n\nTransactionManager.Instance.EnsureInTransaction(doc)\n\nfor i in range(0,len(walls)):\n WallUtils.DisallowWallJoinAtEnd(walls[i],0)\n \nTransactionManager.Instance.TransactionTaskDone()\nOUT = \"Successfull\"")  # "0: Unjoin End 0"
n1_unjoin_end_1 = StringInput("import clr\n\nclr.AddReference(\"RevitServices\")\nimport RevitServices\nfrom RevitServices.Persistence import DocumentManager\nfrom RevitServices.Transactions import TransactionManager\ndoc = DocumentManager.Instance.CurrentDBDocument\n\nclr.AddReference(\"RevitAPI\")\nfrom Autodesk.Revit.DB import WallUtils\n\nwalls = UnwrapElement(IN[0])\n\nTransactionManager.Instance.EnsureInTransaction(doc)\n\nfor i in range(0,len(walls)):\n WallUtils.DisallowWallJoinAtEnd(walls[i],1)\n \nTransactionManager.Instance.TransactionTaskDone()\nOUT = \"Successfull\"")  # "1: Unjoin End 1"
n2_unjoin_2_ends = StringInput("import clr\n\nclr.AddReference(\"RevitServices\")\nimport RevitServices\nfrom RevitServices.Persistence import DocumentManager\nfrom RevitServices.Transactions import TransactionManager\ndoc = DocumentManager.Instance.CurrentDBDocument\n\nclr.AddReference(\"RevitAPI\")\nfrom Autodesk.Revit.DB import WallUtils\n\nwalls = UnwrapElement(IN[0])\n\nTransactionManager.Instance.EnsureInTransaction(doc)\n\nfor i in range(0,len(walls)):\n WallUtils.DisallowWallJoinAtEnd(walls[i],0)\n WallUtils.DisallowWallJoinAtEnd(walls[i],1)\n \nTransactionManager.Instance.TransactionTaskDone()\nOUT = \"Successfull\"")  # "2: Unjoin 2 Ends"
python_script = Python(IN[0]=unjoin_mode, IN[1]=n0_unjoin_end_0, IN[2]=n1_unjoin_end_1, IN[3]=n2_unjoin_2_ends)
# ---------- python_script.python (23 lines) ----------
import clr
clr.AddReference('ProtoGeometry')
from Autodesk.DesignScript.Geometry import *
#The inputs to this node will be stored as a list in the IN variables.
dataEnteringNode = IN
mode = IN[0]
s0 = IN[1]
s1 = IN[2]
s2 = IN[3]

res = []

if mode == 0:
	res = s0
elif mode == 1:
	res = s1
elif mode == 2:
	res = s2
else:
	res = 0
	
#Assign your output to the OUT variable.
OUT = res
# ----------------------------------------
select_model_elements_walls = DSModelElementsSelection()  # 16 picked in the model
string = StringInput("Walls")
revit_category_filterer_1 = Custom[Revit Category Filterer 1](select_model_elements_walls, string)
code_block = CodeBlock(e=revit_category_filterer_1) { e; }
start = Revit.Transaction.Transaction.Start(code_block)
firstItem = List.FirstItem(start)
addItemToFront = List.AddItemToFront(item=firstItem, list=start)
python_script_from_string = PythonStringNode(script=python_script, IN[0]=addItemToFront)
end = Revit.Transaction.Transaction.End(python_script_from_string)
