# Dynamo graph 03-MERGE STRUCTURE.dyn (Dynamo 0.9.1.4062)

select_model_elements = DSModelElementsSelection()  # 127 picked in the model
filter = CodeBlock { "Structural Foundations"; "Structural Columns"; "Structural Framing"; "Floors"; "Walls"; }
filterer = Python(IN[0]=select_model_elements, IN[1]=filter.out0)  # frozen
# ---------- filterer.python (17 lines) ----------
import clr
clr.AddReference('ProtoGeometry')
from Autodesk.DesignScript.Geometry import *
#The inputs to this node will be stored as a list in the IN variables.
dataEnteringNode = IN
elems = IN[0]
cateName = IN[1]

res = []

for e in elems:
	ee = UnwrapElement(e)
	if ee.Category.Name == cateName:
		res.append(e)

#Assign your output to the OUT variable.
OUT = res
# ----------------------------------------
solids = Element.Solids(filterer)
flatten = Flatten(solids)
filterer_2 = Python(IN[0]=select_model_elements, IN[1]=filter.out1)  # frozen; same code as filterer
solids_2 = Element.Solids(filterer_2)
flatten_2 = Flatten(solids_2)
filterer_3 = Python(IN[0]=select_model_elements, IN[1]=filter.out2)  # same code as filterer
solids_3 = Element.Solids(filterer_3)
flatten_3 = Flatten(solids_3)
filterer_4 = Python(IN[0]=select_model_elements, IN[1]=filter.out3)  # same code as filterer
solids_4 = Element.Solids(filterer_4)
flatten_4 = Flatten(solids_4)
filterer_5 = Python(IN[0]=select_model_elements, IN[1]=filter.out4)  # frozen; same code as filterer
solids_5 = Element.Solids(filterer_5)
flatten_5 = Flatten(solids_5)
create = List.Create(flatten, flatten_2, flatten_3, flatten_4, flatten_5)
create_2 = List.Create(flatten_3, flatten_4)
flatten_6 = Flatten(create_2)
deconstruct = List.Deconstruct(list=flatten_6)
unionAll = Solid.UnionAll(deconstruct.first, deconstruct.rest)
file_path = Filename("R:\BimESC\03_KIEM SOAT KHOI LUONG_3D QUANTITY\2002 CO GIANG SOHO\2 WIP\REVIT\DATA\Struc 7F Merged-Framing Slab.sat")
exportToSAT = ExportWithUnits(unionAll, file_path, exportedUnit=Millimeters)
