# Dynamo graph 04-CEILING DATA-Ceiling Finish.dyn (Dynamo 0.9.1.4062)

select_model_elements = DSModelElementsSelection()  # 286 picked in the model
string = StringInput("Rooms")
python_script = Python(IN[0]=select_model_elements, IN[1]=string)
# ---------- python_script.python (17 lines) ----------
import clr
clr.AddReference('ProtoGeometry')
from Autodesk.DesignScript.Geometry import *
#The inputs to this node will be stored as a list in the IN variables.
dataEnteringNode = IN
elems = IN[0]
cateName = IN[1]

res = []

for e in elems:
	ee = UnwrapElement(e)
	if ee.Category.Name == cateName:
		res.append(e)

#Assign your output to the OUT variable.
OUT = res
# ----------------------------------------
room_param = CodeBlock { "Name"; "Ceiling Finish"; "Limit Offset"; }
getParameterValueByName = Element.GetParameterValueByName(element=python_script, parameterName=room_param.out0)
file_path = Filename("R:\BimESC\03_KIEM SOAT KHOI LUONG_3D QUANTITY\2002 CO GIANG SOHO\2 WIP\REVIT\DATA\Room Schedule 1F RV2.xls")
fromPath = FileObject(file_path)  # "File.FromPath"
excel_para = CodeBlock { "Room Schedule 1F RV2"; }
boolean = BoolSelector(false)
readFromFile = Excel.ReadFromFile(file=fromPath, sheetName=excel_para, readAsStrings=boolean)
transpose = List.Transpose(readFromFile)
code_block = CodeBlock(list=transpose) { names = list[1]; ceilingFin = list[4]; limits = list[8]; }
python_script_matching_data = Python(IN[0]=getParameterValueByName, IN[1]=code_block.names, IN[2]=code_block.ceilingFin)
# ---------- python_script_matching_data.python (19 lines) ----------
import clr
clr.AddReference('ProtoGeometry')
from Autodesk.DesignScript.Geometry import *
#The inputs to this node will be stored as a list in the IN variables.
dataEnteringNode = IN

roomNames = IN[0]
names = IN[1]
ceiFins = IN[2]

res = []

for i in range(len(roomNames)):
	for j in range(len(names)):
		if roomNames[i] == names[j]:
			res.append(ceiFins[j])

#Assign your output to the OUT variable.
OUT = res
# ----------------------------------------
setParameterByName = Element.SetParameterByName(element=python_script, parameterName=room_param.out1, value=python_script_matching_data)
python_script_matching_data_2 = Python(IN[0]=getParameterValueByName, IN[1]=code_block.names, IN[2]=code_block.limits)  # same code as python_script_matching_data
setParameterByName_2 = Element.SetParameterByName(element=python_script, parameterName=room_param.out2, value=python_script_matching_data_2)
