# Dynamo graph 05-DATA FOUNDATION.dyn (Dynamo 0.9.1.4062)

file_path = Filename("C:\Users\USER\Documents\MARUBENI COFFEE\BIM QTO\Dynamo Data-Foundation.xlsx")
string = StringInput("Sheet1")
row = CodeBlock { 3; }
column = CodeBlock()
# ---------- column.designscript (48 lines) ----------
0;
//Foundation Type
1;
//Loc X
2;
//Loc Y
3;
//Loc Z
4;
//Rot X
5;
//Elev Bottom
6;
//Elev Top
7;
//Thickness
8;
//Level
9;
//Offset from level
10;
//Building Item #
11;
//Zone #
12;
//Volume Body concrete
13;
//Volume Lean concrete
14;
//Formwork Body concrete
15;
//Formwork Lean concrete
16;
//Volume Excavation
17;
//Volume Backfill
18;
//Volume Embankment
19;
//Area impactment Bottom of Foundation
20;
//Area impactment Top of Backfill
21;
//Area plastic sheet
22;
//Family
23;
//Type
# ----------------------------------------
foundation = StringInput("OST_StructuralFoundation")
byName = Category.ByName(foundation)
all_elements_of_category = ElementsOfCategory(byName)
code_block = CodeBlock(elems=all_elements_of_category) { elems; }
code_block_2 = CodeBlock { "Comments"; "Comments"; "Comments"; }
getParameterValueByName = Element.GetParameterValueByName(element=code_block, parameterName=code_block_2.out0)
boolean = BoolSelector(false)
writeToFile = Excel.WriteToFile(filePath=file_path, sheetName=string, startRow=row, startCol=column.out0, data=getParameterValueByName, overWrite=boolean)  # frozen
code_block_3 = CodeBlock(t2=file_path, t3=string, num1=row, num2=column.out0, t4=getParameterValueByName) { t1 = false; t5 = Excel.WriteToFile(t2, t3, num1, num2, t4, t1); }
getParameterValueByName_2 = Element.GetParameterValueByName(element=code_block, parameterName=code_block_2.out1)
code_block_4 = CodeBlock(t2=file_path, t3=string, num1=row, num2=column.out10, t4=getParameterValueByName_2) { t1 = false; t5 = Excel.WriteToFile(t2, t3, num1, num2, t4, t1); }
getParameterValueByName_3 = Element.GetParameterValueByName(element=code_block, parameterName=code_block_2.out2)
code_block_5 = CodeBlock(t2=file_path, t3=string, num1=row, num2=column.out11, t4=getParameterValueByName_3) { t1 = false; t5 = Excel.WriteToFile(t2, t3, num1, num2, t4, t1); }

# group: Position XYZ
location = FamilyInstance.Location(code_block)
Z = Point.Z(location)
round = Math.Round(Z)
X = Point.X(location)
round_2 = Math.Round(X)
Y = Point.Y(location)
round_3 = Math.Round(Y)

code_block_6 = CodeBlock(t2=file_path, t3=string, num1=row, num2=column.out1, t4=round_2) { t1 = false; t5 = Excel.WriteToFile(t2, t3, num1, num2, t4, t1); }
code_block_7 = CodeBlock(t2=file_path, t3=string, num1=row, num2=column.out2, t4=round_3) { t1 = false; t5 = Excel.WriteToFile(t2, t3, num1, num2, t4, t1); }
code_block_8 = CodeBlock(t2=file_path, t3=string, num1=row, num2=column.out3, t4=round_2) { t1 = false; t5 = Excel.WriteToFile(t2, t3, num1, num2, t4, t1); }
built_in_parameters = CodeBlock { "Elevation at Top"; "Elevation at Bottom"; "Level"; "Height Offset From Level"; "Family"; "Type"; }
getParameterValueByName_4 = Element.GetParameterValueByName(element=code_block, parameterName=built_in_parameters.out1)
code_block_9 = CodeBlock(t2=file_path, t3=string, num1=row, num2=column.out5, t4=getParameterValueByName_4) { t1 = false; t5 = Excel.WriteToFile(t2, t3, num1, num2, t4, t1); }
getParameterValueByName_5 = Element.GetParameterValueByName(element=code_block, parameterName=built_in_parameters.out0)
code_block_10 = CodeBlock(t2=file_path, t3=string, num1=row, num2=column.out6, t4=getParameterValueByName_5) { t1 = false; t5 = Excel.WriteToFile(t2, t3, num1, num2, t4, t1); }
shareParameters = CodeBlock()
# ---------- shareParameters.designscript (8 lines) ----------
"Foundation-Type";
"Building Item #";
"Zone";
"TypeThickness";
"TypeVolumeConcrete";
"TypeVolumeLeanConcrete";
"TypeAreaFormwork";
"TypeAreaFormworkLeanConcrete";
# ----------------------------------------
getParameterValueByName_6 = Element.GetParameterValueByName(element=code_block, parameterName=shareParameters.out3)
code_block_11 = CodeBlock(t2=file_path, t3=string, num1=row, num2=column.out7, t4=getParameterValueByName_6) { t1 = false; t5 = Excel.WriteToFile(t2, t3, num1, num2, t4, t1); }
code_block_12 = CodeBlock(list=code_block) { list[0]; }
parameters = Element.Parameters(code_block_12)
watch = Watch(parameters)
getParameterValueByName_7 = Element.GetParameterValueByName(element=code_block, parameterName=built_in_parameters.out3)
code_block_13 = CodeBlock(t2=file_path, t3=string, num1=row, num2=column.out9, t4=getParameterValueByName_7) { t1 = false; t5 = Excel.WriteToFile(t2, t3, num1, num2, t4, t1); }
getParameterValueByName_8 = Element.GetParameterValueByName(element=code_block, parameterName=built_in_parameters.out2)
string_from_object = FromObject(getParameterValueByName_8)
code_block_14 = CodeBlock(t2=file_path, t3=string, num1=row, num2=column.out8, t4=string_from_object) { t1 = false; t5 = Excel.WriteToFile(t2, t3, num1, num2, t4, t1); }
getParameterValueByName_9 = Element.GetParameterValueByName(element=code_block, parameterName=shareParameters.out4)
code_block_15 = CodeBlock(t2=file_path, t3=string, num1=row, num2=column.out12, t4=getParameterValueByName_9) { t1 = false; t5 = Excel.WriteToFile(t2, t3, num1, num2, t4, t1); }
getParameterValueByName_10 = Element.GetParameterValueByName(element=code_block, parameterName=shareParameters.out5)
code_block_16 = CodeBlock(t2=file_path, t3=string, num1=row, num2=column.out13, t4=getParameterValueByName_10) { t1 = false; t5 = Excel.WriteToFile(t2, t3, num1, num2, t4, t1); }
getParameterValueByName_11 = Element.GetParameterValueByName(element=code_block, parameterName=shareParameters.out7)
code_block_17 = CodeBlock(t2=file_path, t3=string, num1=row, num2=column.out15, t4=getParameterValueByName_11) { t1 = false; t5 = Excel.WriteToFile(t2, t3, num1, num2, t4, t1); }
getParameterValueByName_12 = Element.GetParameterValueByName(element=code_block, parameterName=shareParameters.out6)
code_block_18 = CodeBlock(t2=file_path, t3=string, num1=row, num2=column.out14, t4=getParameterValueByName_12) { t1 = false; t5 = Excel.WriteToFile(t2, t3, num1, num2, t4, t1); }
getParameterValueByName_13 = Element.GetParameterValueByName(element=code_block, parameterName=built_in_parameters.out4)
string_from_object_2 = FromObject(getParameterValueByName_13)
code_block_19 = CodeBlock(t2=file_path, t3=string, num1=row, num2=column.out22, t4=string_from_object_2) { t1 = false; t5 = Excel.WriteToFile(t2, t3, num1, num2, t4, t1); }
getParameterValueByName_14 = Element.GetParameterValueByName(element=code_block, parameterName=built_in_parameters.out5)
string_from_object_3 = FromObject(getParameterValueByName_14)
code_block_20 = CodeBlock(t2=file_path, t3=string, num1=row, num2=column.out23, t4=string_from_object_3) { t1 = false; t5 = Excel.WriteToFile(t2, t3, num1, num2, t4, t1); }
