# Dynamo graph 06-FOUNDATION EXCAVATION-FROM EXCEL DATA.dyn (Dynamo 0.9.1.4062)

file_path = Filename("R:\BimESC\03_KIEM SOAT KHOI LUONG_3D QUANTITY\2002 MARUBENI COFFEE\02 WIP\REVIT\DATA\Dynamo Data-Foundation.xlsx")
fromPath = FileObject(file_path)  # "File.FromPath"
string = StringInput("Sheet1")
boolean = BoolSelector(false)
readFromFile = Excel.ReadFromFile(file=fromPath, sheetName=string, readAsStrings=boolean)
code_block = CodeBlock { 3; }
dropItems = List.DropItems(list=readFromFile, amount=code_block)
transpose = List.Transpose(dropItems)
code_block_2 = CodeBlock(list=transpose) { x=list[1]; y=list[2]; z=list[3]; }
code_block_3 = CodeBlock(t2=code_block_2.x)
# ---------- code_block_3.designscript (5 lines) ----------
bool1 = DSCore.Object.IsNull(t2);
t3 = List.FilterByBoolMask(t2, bool1);
t4 = __TryGetValueFromNestedDictionaries(t3, "in");
t5 = __TryGetValueFromNestedDictionaries(t3, "out");
x = t5;
# ----------------------------------------
code_block_4 = CodeBlock(t2=code_block_2.y)
# ---------- code_block_4.designscript (5 lines) ----------
bool1 = DSCore.Object.IsNull(t2);
t3 = List.FilterByBoolMask(t2, bool1);
t4 = __TryGetValueFromNestedDictionaries(t3, "in");
t5 = __TryGetValueFromNestedDictionaries(t3, "out");
y = t5;
# ----------------------------------------
code_block_5 = CodeBlock(t2=code_block_2.z)
# ---------- code_block_5.designscript (5 lines) ----------
bool1 = DSCore.Object.IsNull(t2);
t3 = List.FilterByBoolMask(t2, bool1);
t4 = __TryGetValueFromNestedDictionaries(t3, "in");
t5 = __TryGetValueFromNestedDictionaries(t3, "out");
z = t5;
# ----------------------------------------
byCoordinates = Point.ByCoordinates(x=code_block_3.x, y=code_block_4.y, z=code_block_5.z)
