# Dynamo graph 08-GROUND BEAM EXVAVATION.dyn (Dynamo 0.9.1.4062)

chọn_dầm = DSModelElementsSelection()  # 57 picked in the model
code_block = CodeBlock(elems=chọn_dầm) { elems; }
category_name = StringInput("Structural Framing")
python_script_filter_framings = Python(IN[0]=code_block, IN[1]=category_name)
# ---------- python_script_filter_framings.python (17 lines) ----------
import clr
clr.AddReference('ProtoGeometry')
from Autodesk.DesignScript.Geometry import *
#The inputs to this node will be stored as a list in the IN variables.
dataEnteringNode = IN
elems = IN[0]
cateName = IN[1]

res = []

for e in elems:
	ee = UnwrapElement(e)
	if ee.Category.Name == cateName:
		res.append(e)

#Assign your output to the OUT variable.
OUT = res
# ----------------------------------------
code_block_2 = CodeBlock(framings=python_script_filter_framings) { framings; }
parameters = Element.Parameters(code_block_2)
string = StringInput("Excavate Hole-Taluy-Ground Beam")
byName = FamilyType.ByName(string)
location = FamilyInstance.Location(code_block_2)
levels = Levels("Exc LV")

# group: MIDPOINT
number = DoubleInput(0.5)
pointAtParameter = Curve.PointAtParameter(curve=location, param=number)
X = Point.X(pointAtParameter)
Y = Point.Y(pointAtParameter)
elevation = Level.Elevation(levels)
byCoordinates = Point.ByCoordinates(x=X, y=Y, z=elevation)

byPoint = FamilyInstance.ByPoint(familyType=byName, point=byCoordinates)
code_block_3 = CodeBlock { "Width"; "Length"; "Height"; "Comments"; "HostID1"; "TrackingHostID1"; }
comment_after_placing = StringInput("Ground Beam Excavation")
setParameterByName = Element.SetParameterByName(element=byPoint, parameterName=code_block_3.out3, value=comment_after_placing)
code_block_4 = CodeBlock { "Cut Length"; "Elevation at Bottom"; "Elevation at Top"; "Width"; "Length"; "Height"; }
getParameterValueByName = Element.GetParameterValueByName(element=code_block_2, parameterName=code_block_4.out3)
setParameterByName_2 = Element.SetParameterByName(element=setParameterByName, parameterName=code_block_3.out0, value=getParameterValueByName)
getParameterValueByName_2 = Element.GetParameterValueByName(element=code_block_2, parameterName=code_block_4.out0)
element_setparameterbyname = Element.SetParameterByName(element=setParameterByName_2, parameterName=code_block_3.out1, value=getParameterValueByName_2)  # "Element.SetParameterByName-Length"
startPoint = Curve.StartPoint(location)
Y_2 = Point.Y(startPoint)
endPoint = Curve.EndPoint(location)
Y_3 = Point.Y(endPoint)
gt = Y_2 > Y_3
byTwoPoints = Vector.ByTwoPoints(start=startPoint, end=endPoint)
XAxis = Vector.XAxis()
angleBetween = Vector.AngleBetween(byTwoPoints, XAxis)
round = Math.Round(angleBetween)
code_block_5 = CodeBlock(a=round) { a*(-1); a; }
if_ = If(test=gt, true=code_block_5.out0, false=code_block_5.a)
setRotation = FamilyInstance.SetRotation(familyInstance=element_setparameterbyname, degree=if_)
location_2 = StructuralFraming.Location(code_block_2)
code_block_6 = CodeBlock(curves=location_2) { curves; }
endPoint_2 = Curve.EndPoint(code_block_6)
code_block_7 = CodeBlock(endP=endPoint_2) { endP; }
Z = Point.Z(code_block_7)
Y_4 = Point.Y(code_block_7)
X_2 = Point.X(code_block_7)
startPoint_2 = Curve.StartPoint(code_block_6)
code_block_8 = CodeBlock(startP=startPoint_2) { startP; }
Y_5 = Point.Y(code_block_8)
X_3 = Point.X(code_block_8)
Z_2 = Point.Z(code_block_8)
byTwoPoints_2 = Vector.ByTwoPoints(start=code_block_8, end=code_block_7)
lean_concrete_thickness = DoubleInput(100)
getParameterValueByName_3 = Element.GetParameterValueByName(element=code_block_2, parameterName=code_block_4.out1)
code_block_9 = CodeBlock(excL=elevation, eab=getParameterValueByName_3) { eh = excL-eab; }
id = Element.Id(code_block_2)
element_setparameterbyname_host = Element.SetParameterByName(element=element_setparameterbyname, parameterName=code_block_3.out4, value=id)  # "Element.SetParameterByName-Host ID"
element_setparameterbyname_2 = Element.SetParameterByName(element=element_setparameterbyname, parameterName=code_block_3.out5, value=id)  # "Element.SetParameterByName-Tracking host ID"
