# Dynamo graph 11-MERGE EXCAVATION.dyn (Dynamo 0.9.1.4062)

select_model_elements = DSModelElementsSelection()  # 250 picked in the model
code_block = CodeBlock(holes=select_model_elements) { holes; }
solids = Element.Solids(code_block)
flatten = Flatten(solids)
deconstruct = List.Deconstruct(list=flatten)
unionAll = Solid.UnionAll(deconstruct.first, deconstruct.rest)
directory_path = Directory("C:\Users\thuctapesc\Desktop")
string = StringInput("\")
file_name = StringInput("Excavation Merged")
volume = Solid.Volume(unionAll)
number = DoubleInput(1000000000)
div = volume / number
number_2 = DoubleInput(0)
round = Math.Round(number=div, digits=number_2)
code_block_2 = CodeBlock(dir=directory_path, plash=string, filename=file_name, Info=round) { filepath = dir+plash+filename+"-"+Info+" m3"+".sat"; }
exportToSAT = ExportWithUnits(unionAll, code_block_2, exportedUnit=Millimeters)
string_from_object = FromObject(directory_path)
