# Dynamo graph 12-MERGE UNDERGROUND CONCRETE.dyn (Dynamo 0.9.1.4062)

select_model_elements = DSModelElementsSelection()  # 156 picked in the model
category_name = StringInput("Structural Foundations")
category_name_2 = StringInput("Walls")
category_name_3 = StringInput("Structural Columns")
category_name_4 = StringInput("Structural Framing")
python_script = Python(IN[0]=select_model_elements, IN[1]=category_name, IN[2]=category_name_2, IN[3]=category_name_3, IN[4]=category_name_4)
# ---------- python_script.python (21 lines) ----------
import clr
clr.AddReference('ProtoGeometry')
from Autodesk.DesignScript.Geometry import *
#The inputs to this node will be stored as a list in the IN variables.
dataEnteringNode = IN
elems = IN[0]
cateName1 = IN[1]
cateName2 = IN[2]
cateName3 = IN[3]
cateName4 = IN[4]

res = []

for e in elems:
	ee = UnwrapElement(e)
	cat = ee.Category.Name
	if cat == cateName1 or cat == cateName2 or cat == cateName3 or cat == cateName4:
		res.append(e)

#Assign your output to the OUT variable.
OUT = res
# ----------------------------------------
check_comments = StringInput("Comments")
getParameterValueByName = Element.GetParameterValueByName(element=python_script, parameterName=check_comments)
contain = StringInput("Underground")
contains = String.Contains(str=getParameterValueByName, searchFor=contain)
filterByBoolMask = List.FilterByBoolMask(list=select_model_elements, mask=contains)
code_block = CodeBlock(elems=filterByBoolMask.in) { elems; }
solids = Element.Solids(code_block)
flatten = Flatten(solids)
deconstruct = List.Deconstruct(list=flatten)
unionAll = Solid.UnionAll(deconstruct.first, deconstruct.rest)
directory_path = Directory("C:\Users\USER\Documents\MARUBENI COFFEE\BIM QTO")
string = StringInput("\")
file_name = StringInput("Undergorund Struc")
volume = Solid.Volume(unionAll)
number = DoubleInput(1000000000)
div = volume / number
number_2 = DoubleInput(0)
round = Math.Round(number=div, digits=number_2)
string_from_object = FromObject(round)
code_block_2 = CodeBlock { 0; }
code_block_3 = CodeBlock { "."; }
indexOf = String.IndexOf(string=string_from_object, searchFor=code_block_3)
substring = String.Substring(str=string_from_object, startIndex=code_block_2, length=indexOf)
code_block_4 = CodeBlock(dir=directory_path, plash=string, filename=file_name, Info=substring) { filepath = dir+plash+filename+"-"+Info+" m3"+".sat"; }
exportToSAT = ExportWithUnits(unionAll, code_block_4, exportedUnit=Millimeters)
string_from_object_2 = FromObject(directory_path)
