# Dynamo graph 14-FRAMING FORMWORK 2.dyn (Dynamo 0.9.1.4062)

string = StringInput("FW-PLY-Framing")
byName = FamilyType.ByName(string)
# note: need fix: Rotation
# condition: Justification LEFT / Right
chọn_dầm = DSModelElementsSelection()  # 9 picked in the model
code_block = CodeBlock(elems=chọn_dầm) { elems; }
category_name = StringInput("Structural Framing")
python_script_filter_framings = Python(IN[0]=code_block, IN[1]=category_name)
# ---------- python_script_filter_framings.python (17 lines) ----------
import clr
clr.AddReference('ProtoGeometry')
from Autodesk.DesignScript.Geometry import *
#The inputs to this node will be stored as a list in the IN variables.
dataEnteringNode = IN
elems = IN[0]
cateName = IN[1]

res = []

for e in elems:
	ee = UnwrapElement(e)
	if ee.Category.Name == cateName:
		res.append(e)

#Assign your output to the OUT variable.
OUT = res
# ----------------------------------------
code_block_2 = CodeBlock(framings=python_script_filter_framings) { framings; }
location = FamilyInstance.Location(code_block_2)
levels = Levels("Level 7")

# group: MIDPOINT
number = DoubleInput(0.5)
pointAtParameter = Curve.PointAtParameter(curve=location, param=number)
X = Point.X(pointAtParameter)
Y = Point.Y(pointAtParameter)
elevation = Level.Elevation(levels)

framing_param = CodeBlock { "Cut Length"; "Elevation at Bottom"; "Elevation at Top"; "Width"; "Length"; "Height"; "z Offset Value"; }
getParameterValueByName = Element.GetParameterValueByName(element=code_block_2, parameterName=framing_param.out6)
code_block_3 = CodeBlock(excL=elevation, zo=getParameterValueByName) { eh = excL+zo; }

# group (continued): MIDPOINT
byCoordinates = Point.ByCoordinates(x=X, y=Y, z=code_block_3)

byPoint = FamilyInstance.ByPoint(familyType=byName, point=byCoordinates)
code_block_4 = CodeBlock(elems=byPoint) { elems; }
fw_param = CodeBlock { "Width"; "Length"; "Height"; "Comments"; "HostID1"; "TrackingHostID1"; }
comment_after_placing = StringInput(", Beam Formwork")
setParameterByName = Element.SetParameterByName(element=code_block_4, parameterName=fw_param.out3, value=comment_after_placing)
parameters = Element.Parameters(code_block_2)
startPoint = Curve.StartPoint(location)
endPoint = Curve.EndPoint(location)
byTwoPoints = Vector.ByTwoPoints(start=startPoint, end=endPoint)
XAxis = Vector.XAxis()
angleBetween = Vector.AngleBetween(byTwoPoints, XAxis)
round = Math.Round(angleBetween)
code_block_5 = CodeBlock(a=round) { a+90; a; }
setRotation = FamilyInstance.SetRotation(familyInstance=code_block_4, degree=code_block_5.a)
Y_2 = Point.Y(startPoint)
Y_3 = Point.Y(endPoint)
gt = Y_2 > Y_3
if_ = If(test=gt, true=code_block_5.out0, false=code_block_5.a)
location_2 = StructuralFraming.Location(code_block_2)
code_block_6 = CodeBlock(curves=location_2) { curves; }
endPoint_2 = Curve.EndPoint(code_block_6)
code_block_7 = CodeBlock(endP=endPoint_2) { endP; }
Z = Point.Z(code_block_7)
Y_4 = Point.Y(code_block_7)
X_2 = Point.X(code_block_7)
startPoint_2 = Curve.StartPoint(code_block_6)
code_block_8 = CodeBlock(startP=startPoint_2) { startP; }
Y_5 = Point.Y(code_block_8)
X_3 = Point.X(code_block_8)
Z_2 = Point.Z(code_block_8)
byTwoPoints_2 = Vector.ByTwoPoints(start=code_block_8, end=code_block_7)
getParameterValueByName_2 = Element.GetParameterValueByName(element=code_block_2, parameterName=framing_param.out0)
element_setparameterbyname = Element.SetParameterByName(element=code_block_4, parameterName=fw_param.out1, value=getParameterValueByName_2)  # "Element.SetParameterByName-Length"
getParameterValueByName_3 = Element.GetParameterValueByName(element=code_block_2, parameterName=framing_param.out1)
lean_concrete_thickness = DoubleInput(100)
getParameterValueByName_4 = Element.GetParameterValueByName(element=code_block_2, parameterName=framing_param.out3)
setParameterByName_2 = Element.SetParameterByName(element=code_block_4, parameterName=fw_param.out0, value=getParameterValueByName_4)
comment_after_placing_2 = StringInput(", Ground Beam Formwork")
id = Element.Id(code_block_2)
element_setparameterbyname_host = Element.SetParameterByName(element=code_block_4, parameterName=fw_param.out4, value=id)  # "Element.SetParameterByName-Host ID"
element_setparameterbyname_2 = Element.SetParameterByName(element=code_block_4, parameterName=fw_param.out5, value=id)  # "Element.SetParameterByName-Tracking host ID"
getParameterValueByName_5 = Element.GetParameterValueByName(element=code_block_2, parameterName=framing_param.out5)
element_setparameterbyname_3 = Element.SetParameterByName(element=code_block_4, parameterName=fw_param.out2, value=getParameterValueByName_5)  # "Element.SetParameterByName-Length"
