# Dynamo graph 14-WALL FORMWORK.dyn (Dynamo 0.9.1.4062)

levels = Levels("Level 1")
string = StringInput("FW-PLY-Wall")
byName = FamilyType.ByName(string)
# note: need fix: Rotation
# condition: Justification LEFT / Right
chọn_dầm = DSModelElementsSelection()  # 4 picked in the model
code_block = CodeBlock(elems=chọn_dầm) { elems; }
category_name = StringInput("Walls")
python_script_filter_framings = Python(IN[0]=code_block, IN[1]=category_name)
# ---------- python_script_filter_framings.python (17 lines) ----------
import clr
clr.AddReference('ProtoGeometry')
from Autodesk.DesignScript.Geometry import *
#The inputs to this node will be stored as a list in the IN variables.
dataEnteringNode = IN
elems = IN[0]
cateName = IN[1]

res = []

for e in elems:
	ee = UnwrapElement(e)
	if ee.Category.Name == cateName:
		res.append(e)

#Assign your output to the OUT variable.
OUT = res
# ----------------------------------------
code_block_2 = CodeBlock(walls=python_script_filter_framings) { walls; }
framing_param = CodeBlock()
# ---------- framing_param.designscript (9 lines) ----------
"Cut Length";
"Elevation at Bottom";
"Elevation at Top";
"Width";
"Length";
"Height";
"z Offset Value";
"Base Constraint";
"Base Offset";
# ----------------------------------------
getParameterValueByName = Element.GetParameterValueByName(element=code_block_2, parameterName=framing_param.out7)
elevation = Level.Elevation(getParameterValueByName)
getParameterValueByName_2 = Element.GetParameterValueByName(element=code_block_2, parameterName=framing_param.out8)
add = elevation + getParameterValueByName_2

# group: MIDPOINT
python_script_wall_location = Python(IN[0]=code_block_2)
# ---------- python_script_wall_location.python (25 lines) ----------
import clr
clr.AddReference('ProtoGeometry')
from Autodesk.DesignScript.Geometry import *
#The inputs to this node will be stored as a list in the IN variables.
dataEnteringNode = IN

walls = UnwrapElement(IN[0])
res = []
for w in walls:
	xym = []
	lc = w.Location.Curve
	x1 = lc.GetEndPoint(0).X
	x2 = lc.GetEndPoint(1).X
	y1 = lc.GetEndPoint(0).Y
	y2 = lc.GetEndPoint(1).Y
	
	
	xm = 304.8*(x1 + x2)/2
	ym = 304.8*(y1 + y2)/2
	
	xym.append(xm)
	xym.append(ym)
	res.append(xym)
#Assign your output to the OUT variable.
OUT = res
# ----------------------------------------
transpose = List.Transpose(python_script_wall_location)
code_block_3 = CodeBlock(list=transpose) { x = list[0]; y = list[1]; }
byCoordinates = Point.ByCoordinates(x=code_block_3.x, y=code_block_3.x, z=add)

byPoint = FamilyInstance.ByPoint(familyType=byName, point=byCoordinates)
code_block_4 = CodeBlock(elems=byPoint) { elems; }
fw_param = CodeBlock { "Width"; "Length"; "Height"; "Comments"; "HostID1"; "TrackingHostID1"; }
comment_after_placing = StringInput(", Beam Formwork")
setParameterByName = Element.SetParameterByName(element=code_block_4, parameterName=fw_param.out3, value=comment_after_placing)
parameters = Element.Parameters(code_block_2)
setRotation = FamilyInstance.SetRotation(familyInstance=code_block_4)
getParameterValueByName_3 = Element.GetParameterValueByName(element=code_block_2, parameterName=framing_param.out0)
element_setparameterbyname = Element.SetParameterByName(element=code_block_4, parameterName=fw_param.out1, value=getParameterValueByName_3)  # "Element.SetParameterByName-Length"
getParameterValueByName_4 = Element.GetParameterValueByName(element=code_block_2, parameterName=framing_param.out1)
lean_concrete_thickness = DoubleInput(100)
getParameterValueByName_5 = Element.GetParameterValueByName(element=code_block_2, parameterName=framing_param.out3)
setParameterByName_2 = Element.SetParameterByName(element=code_block_4, parameterName=fw_param.out0, value=getParameterValueByName_5)
comment_after_placing_2 = StringInput(", Ground Beam Formwork")
id = Element.Id(code_block_2)
element_setparameterbyname_host = Element.SetParameterByName(element=code_block_4, parameterName=fw_param.out4, value=id)  # "Element.SetParameterByName-Host ID"
element_setparameterbyname_2 = Element.SetParameterByName(element=code_block_4, parameterName=fw_param.out5, value=id)  # "Element.SetParameterByName-Tracking host ID"
getParameterValueByName_6 = Element.GetParameterValueByName(element=code_block_2, parameterName=framing_param.out5)
element_setparameterbyname_3 = Element.SetParameterByName(element=code_block_4, parameterName=fw_param.out2, value=getParameterValueByName_6)  # "Element.SetParameterByName-Length"
getParameterValueByName_7 = Element.GetParameterValueByName(element=code_block_2, parameterName=framing_param.out6)
code_block_5 = CodeBlock(w=code_block_2) { w[0]; }
parameters_2 = Element.Parameters(code_block_5)
