# Dynamo graph 18-MATCH BEAMs INFO w CAD DATA.dyn (Dynamo 0.9.1.4062)

select_model_elements = DSModelElementsSelection()  # 113 picked in the model
string = StringInput("Structural Framing")
FILTERER = Python(IN[0]=select_model_elements, IN[1]=string)
# ---------- FILTERER.python (17 lines) ----------
import clr
clr.AddReference('ProtoGeometry')
from Autodesk.DesignScript.Geometry import *
#The inputs to this node will be stored as a list in the IN variables.
dataEnteringNode = IN
elems = IN[0]
cateName = IN[1]

res = []

for e in elems:
	ee = UnwrapElement(e)
	if ee.Category.Name == cateName:
		res.append(e)

#Assign your output to the OUT variable.
OUT = res
# ----------------------------------------
param_name = StringInput("Comments")
location = StructuralFraming.Location(FILTERER)
flatten = Flatten(location)
startPoint = Curve.StartPoint(flatten)
X = Point.X(startPoint)
Y = Point.Y(startPoint)
byCoordinates = Point.ByCoordinates(x=X, y=Y)
endPoint = Curve.EndPoint(flatten)
X_2 = Point.X(endPoint)
Y_2 = Point.Y(endPoint)
byCoordinates_2 = Point.ByCoordinates(x=X_2, y=Y_2)
byStartPointEndPoint = Line.ByStartPointEndPoint(startPoint=byCoordinates, endPoint=byCoordinates_2)
file_path = Filename("R:\BimESC\03_KIEM SOAT KHOI LUONG_3D QUANTITY\2002 MARUBENI COFFEE\02 WIP\CAD\01 MAIN FACTORY\DATA BEAM LV2.xlsx")
fromPath = FileObject(file_path)  # "File.FromPath"
string_2 = StringInput("Sheet1")
boolean = BoolSelector(false)
readFromFile = Excel.ReadFromFile(file=fromPath, sheetName=string_2, readAsStrings=boolean)
deconstruct = List.Deconstruct(list=readFromFile)
transpose = List.Transpose(deconstruct.rest)
code_block = CodeBlock(list=transpose) { list; x = list[2]; y = list[3]; z = list[4]; info = list[1]; }
toNumber = String.ToNumber(code_block.x)
round = Math.Round(toNumber)
toNumber_2 = String.ToNumber(code_block.y)
round_2 = Math.Round(toNumber_2)
byCoordinates_3 = Point.ByCoordinates(x=round, y=round_2)
radius_of_text_circle = CodeBlock { 2000; }
byCenterPointRadius = Circle.ByCenterPointRadius(centerPoint=byCoordinates_3, radius=radius_of_text_circle)
python_script = Python(IN[0]=byStartPointEndPoint, IN[1]=byCenterPointRadius, IN[2]=code_block.info)
# ---------- python_script.python (25 lines) ----------
import clr
clr.AddReference('ProtoGeometry')
from Autodesk.DesignScript.Geometry import *
#The inputs to this node will be stored as a list in the IN variables.
dataEnteringNode = IN

crs = IN[0]
cs = IN[1]
infos = IN[2]

bs = ", "

res = []

for i in range(len(crs)):
	cr = crs[i]
	str = ""
	for j in range(len(cs)):
		cl = cs[j]
		if cl.DoesIntersect(cr):
			str = str + bs + infos[j]
	res.append(str)

#Assign your output to the OUT variable.
OUT = res
# ----------------------------------------
setParameterByName = Element.SetParameterByName(element=FILTERER, parameterName=param_name, value=python_script)
