# Dynamo graph 19-MATCH COLUMN INFO w CAD DATA.dyn (Dynamo 0.9.1.4062)

select_model_elements = DSModelElementsSelection()  # 93 picked in the model
string = StringInput("Structural Columns")
FILTERER = Python(IN[0]=select_model_elements, IN[1]=string)
# ---------- FILTERER.python (17 lines) ----------
import clr
clr.AddReference('ProtoGeometry')
from Autodesk.DesignScript.Geometry import *
#The inputs to this node will be stored as a list in the IN variables.
dataEnteringNode = IN
elems = IN[0]
cateName = IN[1]

res = []

for e in elems:
	ee = UnwrapElement(e)
	if ee.Category.Name == cateName:
		res.append(e)

#Assign your output to the OUT variable.
OUT = res
# ----------------------------------------
param_name = StringInput("Comments")
python_script_col_location = Python(IN[0]=FILTERER)
# ---------- python_script_col_location.python (18 lines) ----------
import clr
clr.AddReference('ProtoGeometry')
from Autodesk.DesignScript.Geometry import *
#The inputs to this node will be stored as a list in the IN variables.
dataEnteringNode = IN

columns = UnwrapElement(IN[0])
res = []
for c in columns:
	xyz = []
	xyz.append(c.Location.Point.X*304.8)
	xyz.append(c.Location.Point.Y*304.8)
	xyz.append(c.Location.Point.Z*304.8)
	
	res.append(xyz)

#Assign your output to the OUT variable.
OUT = res
# ----------------------------------------
transpose = List.Transpose(python_script_col_location)
code_block = CodeBlock(list=transpose) { x = list[0]; y = list[1]; }
byCoordinates = Point.ByCoordinates(x=code_block.x, y=code_block.y)
code_block_2 = CodeBlock { 2000; }
byCenterPointRadius = Circle.ByCenterPointRadius(centerPoint=byCoordinates, radius=code_block_2)
file_path = Filename("R:\BimESC\03_KIEM SOAT KHOI LUONG_3D QUANTITY\2002 MARUBENI COFFEE\02 WIP\CAD\01 MAIN FACTORY\DATA COLUMN LV2.xlsx")
fromPath = FileObject(file_path)  # "File.FromPath"
string_2 = StringInput("Sheet1")
boolean = BoolSelector(false)
readFromFile = Excel.ReadFromFile(file=fromPath, sheetName=string_2, readAsStrings=boolean)
deconstruct = List.Deconstruct(list=readFromFile)
transpose_2 = List.Transpose(deconstruct.rest)
code_block_3 = CodeBlock(list=transpose_2) { list; x = list[2]; y = list[3]; z = list[4]; info = list[1]; }
toNumber = String.ToNumber(code_block_3.x)
round = Math.Round(toNumber)
toNumber_2 = String.ToNumber(code_block_3.y)
round_2 = Math.Round(toNumber_2)
byCoordinates_2 = Point.ByCoordinates(x=round, y=round_2)
radius_of_text_circle = CodeBlock { 1500; }
byCenterPointRadius_2 = Circle.ByCenterPointRadius(centerPoint=byCoordinates_2, radius=radius_of_text_circle)
python_script = Python(IN[0]=byCenterPointRadius, IN[1]=byCenterPointRadius_2, IN[2]=code_block_3.info)
# ---------- python_script.python (25 lines) ----------
import clr
clr.AddReference('ProtoGeometry')
from Autodesk.DesignScript.Geometry import *
#The inputs to this node will be stored as a list in the IN variables.
dataEnteringNode = IN

crs = IN[0]
cs = IN[1]
infos = IN[2]

bs = ", "

res = []

for i in range(len(crs)):
	cr = crs[i]
	str = ""
	for j in range(len(cs)):
		cl = cs[j]
		if cl.DoesIntersect(cr):
			str = str + bs + infos[j]
	res.append(str)

#Assign your output to the OUT variable.
OUT = res
# ----------------------------------------
setParameterByName = Element.SetParameterByName(element=FILTERER, parameterName=param_name, value=python_script)
