# Dynamo graph 20-FLOOR BY ROOM 2.dyn (Dynamo 0.9.1.4062)

levels = Levels("Exc LV")
select_rooms = DSModelElementsSelection()  # 21 picked in the model
filter = StringInput("Rooms")
python_script_filterer = Python(IN[0]=select_rooms, IN[1]=filter)
# ---------- python_script_filterer.python (17 lines) ----------
import clr
clr.AddReference('ProtoGeometry')
from Autodesk.DesignScript.Geometry import *
#The inputs to this node will be stored as a list in the IN variables.
dataEnteringNode = IN
elems = IN[0]
cateName = IN[1]

res = []

for e in elems:
	ee = UnwrapElement(e)
	if ee.Category.Name == cateName:
		res.append(e)

#Assign your output to the OUT variable.
OUT = res
# ----------------------------------------
solids = Element.Solids(python_script_filterer)
flatten = Flatten(solids)
explode = Geometry.Explode(flatten)
python_script_get_surface_vector = Python(IN[0]=explode)  # "Python Script-Get Surface vector Z -1"
# ---------- python_script_get_surface_vector.python (17 lines) ----------
import clr
clr.AddReference('ProtoGeometry')
from Autodesk.DesignScript.Geometry import *
#The inputs to this node will be stored as a list in the IN variables.
dataEnteringNode = IN

listSurfaces = IN[0]

res = []
for list in listSurfaces:
	for sf in list:
		if sf.NormalAtParameter(0.5,0.5).Z == -1:
			res.append(sf)
			

#Assign your output to the OUT variable.
OUT = res
# ----------------------------------------
perimeterCurves = Surface.PerimeterCurves(python_script_get_surface_vector)
floor_type_name = StringInput("RC SLAB 150mm")
byName = FloorType.ByName(floor_type_name)
levels_2 = Levels("Level 1")
byOutlineTypeAndLevel = Floor.ByOutlineTypeAndLevel(outlineCurves=perimeterCurves, floorType=byName, level=levels_2)
floor_param = CodeBlock { "Comments"; }
room_param = CodeBlock { "Name"; }
getParameterValueByName = Element.GetParameterValueByName(element=python_script_filterer, parameterName=room_param)
setParameterByName = Element.SetParameterByName(element=byOutlineTypeAndLevel, parameterName=floor_param, value=getParameterValueByName)
