# Dynamo graph 21-WALL FINISH BY ROOM.dyn (Dynamo 0.9.1.4062)

levels = Levels("Exc LV")
select_rooms = DSModelElementsSelection()  # 21 picked in the model
filter = StringInput("Rooms")
python_script_filterer = Python(IN[0]=select_rooms, IN[1]=filter)
# ---------- python_script_filterer.python (17 lines) ----------
import clr
clr.AddReference('ProtoGeometry')
from Autodesk.DesignScript.Geometry import *
#The inputs to this node will be stored as a list in the IN variables.
dataEnteringNode = IN
elems = IN[0]
cateName = IN[1]

res = []

for e in elems:
	ee = UnwrapElement(e)
	if ee.Category.Name == cateName:
		res.append(e)

#Assign your output to the OUT variable.
OUT = res
# ----------------------------------------
solids = Element.Solids(python_script_filterer)
flatten = Flatten(solids)
explode = Geometry.Explode(flatten)
python_script_get_surface_vector = Python(IN[0]=explode)  # "Python Script-Get Surface vector Z -1"
# ---------- python_script_get_surface_vector.python (17 lines) ----------
import clr
clr.AddReference('ProtoGeometry')
from Autodesk.DesignScript.Geometry import *
#The inputs to this node will be stored as a list in the IN variables.
dataEnteringNode = IN

listSurfaces = IN[0]

res = []
for list in listSurfaces:
	for sf in list:
		if sf.NormalAtParameter(0.5,0.5).Z == -1:
			res.append(sf)
			

#Assign your output to the OUT variable.
OUT = res
# ----------------------------------------
perimeterCurves = Surface.PerimeterCurves(python_script_get_surface_vector)
byJoinedCurves = PolyCurve.ByJoinedCurves(perimeterCurves)
wall_type_name = StringInput("FW")
byName = WallType.ByName(wall_type_name)
wall_param = CodeBlock { param = "Comments"; "Room Bounding"; "Location Line"; "Width"; }
getParameterValueByName = Element.GetParameterValueByName(element=byName, parameterName=wall_param.out3)
wall_options = CodeBlock()
# ---------- wall_options.designscript (4 lines) ----------
100;
//Wall height over Ceiling;
0;
//wall offset (for Wall Base/len);
# ----------------------------------------
code_block = CodeBlock(w=getParameterValueByName, o=wall_options.out1) { w/2+o; }
filter_polycurves = Python(IN[0]=byJoinedCurves, IN[1]=code_block)
# ---------- filter_polycurves.python (22 lines) ----------
import clr
clr.AddReference('ProtoGeometry')
from Autodesk.DesignScript.Geometry import *
#The inputs to this node will be stored as a list in the IN variables.
dataEnteringNode = IN

polycurve = IN[0]
distance = IN[1]
extend = False

res = []
for p in polycurve:
	newC1 = p.Offset (distance,extend)
	newC2 = p.Offset (-distance,extend)
	
	if newC1.Length > newC2.Length:
		res.append(newC2)
	else:
		res.append(newC1)

#Assign your output to the OUT variable.
OUT = res
# ----------------------------------------
explode_2 = Geometry.Explode(filter_polycurves)
room_param = CodeBlock { "Name"; "Unbounded Height"; }
getParameterValueByName_2 = Element.GetParameterValueByName(element=python_script_filterer, parameterName=room_param.out1)
add = getParameterValueByName_2 + wall_options.out0
levels_2 = Levels("Level 1")
python_script_wall_by_curve_over = Python(IN[0]=explode_2, IN[1]=add, IN[2]=levels_2, IN[3]=byName)  # "Python Script-Wall by curve over Room height"
# ---------- python_script_wall_by_curve_over.python (24 lines) ----------
import clr
clr.AddReference('ProtoGeometry')
from Autodesk.DesignScript.Geometry import *
clr.AddReference("RevitNodes")
from Revit.Elements import *
#The inputs to this node will be stored as a list in the IN variables.
dataEnteringNode = IN

listlistCurve = IN[0]
listHeight = IN[1]
level = IN[2]
walltype = IN[3]

res = []

for i in range(len(listlistCurve)):
	list = []
	for c in listlistCurve[i]:
		w = Wall.ByCurveAndHeight(c, listHeight[i], level, walltype)
		list.append(w)
	res.append(list)

#Assign your output to the OUT variable.
OUT = res
# ----------------------------------------
boolean_room_bounding = BoolSelector(false)
setParameterByName = Element.SetParameterByName(element=python_script_wall_by_curve_over, parameterName=wall_param.out1, value=boolean_room_bounding)
location_line = CodeBlock()
# ---------- location_line.designscript (8 lines) ----------
0;
//Wall centerline;
1;
2;
3;
4;
//Core face ext;
5;
# ----------------------------------------
setParameterByName_2 = Element.SetParameterByName(element=python_script_wall_by_curve_over, parameterName=wall_param.out2, value=location_line.out5)
code_block_2 = CodeBlock { 10; }
getParameterValueByName_3 = Element.GetParameterValueByName(element=python_script_filterer, parameterName=room_param.out0)
python_script_set_parameter_room = Python(IN[0]=python_script_wall_by_curve_over, IN[1]=wall_param.param, IN[2]=getParameterValueByName_3)  # "Python Script-Set parameter (Room Name info)"
# ---------- python_script_set_parameter_room.python (20 lines) ----------
import clr
clr.AddReference('ProtoGeometry')
from Autodesk.DesignScript.Geometry import *
clr.AddReference("RevitNodes")
from Revit.Elements import *
#The inputs to this node will be stored as a list in the IN variables.
dataEnteringNode = IN

walls = IN[0]
paramName = IN[1]
values = IN[2]

res = []

for i in range(len(walls)):
	for w in walls[i]:
		w.SetParameterByName(paramName,values[i])

#Assign your output to the OUT variable.
OUT = res
# ----------------------------------------
