# Dynamo graph 24-CHANGE FRAMING Y JUSTIFICATION.dyn (Dynamo 0.9.1.4062)

select_model_elements = DSModelElementsSelection()  # 55 picked in the model
string = StringInput("Structural Framing")
python_script = Python(IN[0]=select_model_elements, IN[1]=string)
# ---------- python_script.python (17 lines) ----------
import clr
clr.AddReference('ProtoGeometry')
from Autodesk.DesignScript.Geometry import *
#The inputs to this node will be stored as a list in the IN variables.
dataEnteringNode = IN
elems = IN[0]
cateName = IN[1]

res = []

for e in elems:
	ee = UnwrapElement(e)
	if ee.Category.Name == cateName:
		res.append(e)

#Assign your output to the OUT variable.
OUT = res
# ----------------------------------------
framing_param = CodeBlock { "y Justification"; }
code_block = CodeBlock()
# ---------- code_block.designscript (8 lines) ----------
0;
//left;
1;
//center
2;
// origin;
3;
//right;
# ----------------------------------------
setParameterByName = Element.SetParameterByName(element=python_script, parameterName=framing_param, value=code_block.out2)
getParameterValueByName = Element.GetParameterValueByName(element=python_script, parameterName=framing_param)
