# Dynamo graph 25-CONCRETE STRUCTURE FORMWORK-FACE THICKEN.dyn (Dynamo 0.9.1.4062)

select_model_elements = DSModelElementsSelection()  # 45 picked in the model
category_name = StringInput("Structural Foundations")
category_name_2 = StringInput("Walls")
category_name_3 = StringInput("Structural Columns")
category_name_4 = StringInput("Structural Framing")
python_script = Python(IN[0]=select_model_elements, IN[1]=category_name, IN[2]=category_name_2, IN[3]=category_name_3, IN[4]=category_name_4)
# ---------- python_script.python (21 lines) ----------
import clr
clr.AddReference('ProtoGeometry')
from Autodesk.DesignScript.Geometry import *
#The inputs to this node will be stored as a list in the IN variables.
dataEnteringNode = IN
elems = IN[0]
cateName1 = IN[1]
cateName2 = IN[2]
cateName3 = IN[3]
cateName4 = IN[4]

res = []

for e in elems:
	ee = UnwrapElement(e)
	cat = ee.Category.Name
	if cat == cateName1 or cat == cateName2 or cat == cateName3 or cat == cateName4:
		res.append(e)

#Assign your output to the OUT variable.
OUT = res
# ----------------------------------------
code_block = CodeBlock(elems=python_script) { elems; }
solids = Element.Solids(code_block)
flatten = Flatten(solids)
isNull = Object.IsNull(flatten)
filterByBoolMask = List.FilterByBoolMask(list=flatten, mask=isNull)
deconstruct = List.Deconstruct(list=filterByBoolMask.out)
unionAll = Solid.UnionAll(deconstruct.first, deconstruct.rest)
explode = Geometry.Explode(unionAll)
flatten_2 = Flatten(explode)
code_block_2 = CodeBlock { 1; -1; }
solid_to_sufaces_filtered_vector = Custom[Filter Surface by Vector Z](Surfaces=flatten_2, ZValue=code_block_2.out0)  # "Solid to Sufaces filtered vector Z"
solid_to_sufaces_filtered_vector_2 = Custom[Filter Surface by Vector Z](Surfaces=solid_to_sufaces_filtered_vector, ZValue=code_block_2.out1)  # "Solid to Sufaces filtered vector Z"
fw_thickness = CodeBlock { 20; }
boolean = BoolSelector(false)
thicken = Surface.Thicken(surface=solid_to_sufaces_filtered_vector_2, thickness=fw_thickness, both_sides=boolean)
union_list_solids = Custom[Union List Solids](ListSolids=thicken)
directory_path = Directory("C:\Users\USER\Desktop")
string = StringInput("\")
file_name = StringInput("FW Concrete")
volume = Solid.Volume(unionAll)
number = DoubleInput(1000000000)
div = volume / number
number_2 = DoubleInput(0)
round = Math.Round(number=div, digits=number_2)
string_from_object = FromObject(round)
code_block_3 = CodeBlock { 0; }
code_block_4 = CodeBlock { "."; }
indexOf = String.IndexOf(string=string_from_object, searchFor=code_block_4)
substring = String.Substring(str=string_from_object, startIndex=code_block_3, length=indexOf)
code_block_5 = CodeBlock(dir=directory_path, plash=string, filename=file_name, Info=substring) { filepath = dir+plash+filename+"-"+Info+" m3"+".sat"; }
exportToSAT = ExportWithUnits(union_list_solids, code_block_5, exportedUnit=Millimeters)
check_comments = StringInput("Comments")
getParameterValueByName = Element.GetParameterValueByName(element=python_script, parameterName=check_comments)
contain = StringInput("Concrete")
contains = String.Contains(str=getParameterValueByName, searchFor=contain)
filterByBoolMask_2 = List.FilterByBoolMask(list=select_model_elements, mask=contains)
