# Dynamo graph 26-MATCHING ROOM NAME to WALLS.dyn (Dynamo 0.9.1.4062)

select_model_elements = DSModelElementsSelection()  # 48 picked in the model
filter = CodeBlock { "Rooms"; }
python_script_filterer = Python(IN[0]=select_model_elements, IN[1]=filter)
# ---------- python_script_filterer.python (17 lines) ----------
import clr
clr.AddReference('ProtoGeometry')
from Autodesk.DesignScript.Geometry import *
#The inputs to this node will be stored as a list in the IN variables.
dataEnteringNode = IN
elems = IN[0]
cateName = IN[1]

res = []

for e in elems:
	ee = UnwrapElement(e)
	if ee.Category.Name == cateName:
		res.append(e)

#Assign your output to the OUT variable.
OUT = res
# ----------------------------------------
solids = Element.Solids(python_script_filterer)
flatten = Flatten(solids)
isNull = Object.IsNull(flatten)
filterByBoolMask = List.FilterByBoolMask(list=solids, mask=isNull)
flatten_2 = Flatten(filterByBoolMask.out)
explode = Geometry.Explode(flatten_2)
flatten_3 = Flatten(explode)
code_block = CodeBlock { 0.5; }
normalAtParameter = Surface.NormalAtParameter(surface=flatten_3, u=code_block, v=code_block)
Z = Vector.Z(normalAtParameter)
code_block_2 = CodeBlock { -1; 1; }
eq = Z == code_block_2.out0
filterByBoolMask_2 = List.FilterByBoolMask(list=flatten_3, mask=eq)
code_block_3 = CodeBlock(surfaces=filterByBoolMask_2.in) { surfaces; }
perimeterCurves = Surface.PerimeterCurves(code_block_3)
flatten_4 = Flatten(perimeterCurves)  # frozen
python_script_group_curve = Python(IN[0]=flatten_4)  # "Python Script-Group Curve flatten"
# ---------- python_script_group_curve.python (32 lines) ----------
import clr
clr.AddReference('ProtoGeometry')
from Autodesk.DesignScript.Geometry import *

#The inputs to this node will be stored as a list in the IN variable.
dataEnteringNode = IN

inputCurves = IN[0]

#join/group curves function
def groupCurves(Line_List):
    ignore_distance = 0.1 # Assume points this close or closer to each other are touching 
    Grouped_Lines = []
    Queue = set()
    while Line_List:
        Shape = []
        Queue.add(Line_List.pop()) # Move a line from the Line_List to our queue 
        while Queue:
            Current_Line = Queue.pop()
            Shape.append(Current_Line)
            for Potential_Match in Line_List:
                Points = (Potential_Match.StartPoint, Potential_Match.EndPoint)
                for P1 in Points:
                    for P2 in (Current_Line.StartPoint, Current_Line.EndPoint):
                        distance = P1.DistanceTo(P2)
                        if distance <= ignore_distance:
                            Queue.add(Potential_Match)
            Line_List = [item for item in Line_List if item not in Queue]
        Grouped_Lines.append(Shape)
    return Grouped_Lines

OUT = groupCurves(inputCurves)
# ----------------------------------------
# note: Nên cắt tường theo Room
filter_2 = CodeBlock { "Walls"; "Doors"; "Windows"; }
python_script_filterer_2 = Python(IN[0]=select_model_elements, IN[1]=filter_2.out0)  # same code as python_script_filterer
room_param = CodeBlock { "Name"; }
getParameterValueByName = Element.GetParameterValueByName(element=python_script_filterer, parameterName=room_param)
intersect_radius = CodeBlock { 900; }
param_to_write = CodeBlock { "Comments"; }
python_script_group_curve_2 = Python(IN[0]=perimeterCurves)
# ---------- python_script_group_curve_2.python (35 lines) ----------
import clr
clr.AddReference('ProtoGeometry')
from Autodesk.DesignScript.Geometry import *

#The inputs to this node will be stored as a list in the IN variable.
dataEnteringNode = IN

inputCurves = IN[0]

#join/group curves function
def groupCurves(Line_List):
    ignore_distance = 0.1 # Assume points this close or closer to each other are touching 
    Grouped_Lines = []
    Queue = set()
    while Line_List:
        Shape = []
        Queue.add(Line_List.pop()) # Move a line from the Line_List to our queue 
        while Queue:
            Current_Line = Queue.pop()
            Shape.append(Current_Line)
            for Potential_Match in Line_List:
                Points = (Potential_Match.StartPoint, Potential_Match.EndPoint)
                for P1 in Points:
                    for P2 in (Current_Line.StartPoint, Current_Line.EndPoint):
                        distance = P1.DistanceTo(P2)
                        if distance <= ignore_distance:
                            Queue.add(Potential_Match)
            Line_List = [item for item in Line_List if item not in Queue]
        Grouped_Lines.append(Shape)
    return Grouped_Lines

res = []
for list in inputCurves:
	res.append(groupCurves(list))
OUT = res
# ----------------------------------------
byJoinedCurves = PolyCurve.ByJoinedCurves(python_script_group_curve_2)
XY = Plane.XY()
pullOntoPlane = Curve.PullOntoPlane(curve=byJoinedCurves, plane=XY)
code_block_4 = CodeBlock(elems=python_script_filterer_2, data=getParameterValueByName, radius=intersect_radius, param=param_to_write, curves=pullOntoPlane) { elems; data; radius; param; curves; }
boundingBox = Element.BoundingBox(code_block_4.elems)
maxPoint = BoundingBox.MaxPoint(boundingBox)
minPoint = BoundingBox.MinPoint(boundingBox)
byStartPointEndPoint = Line.ByStartPointEndPoint(startPoint=maxPoint, endPoint=minPoint)
code_block_5 = CodeBlock { 0.5; }
pointAtParameter = Curve.PointAtParameter(curve=byStartPointEndPoint, param=code_block_5)
X = Point.X(pointAtParameter)
Y = Point.Y(pointAtParameter)
byCoordinates = Point.ByCoordinates(x=X, y=Y)
byCenterPointRadius = Circle.ByCenterPointRadius(centerPoint=byCoordinates, radius=code_block_4.radius)
XY_2 = Plane.XY()
pullOntoPlane_2 = Curve.PullOntoPlane(curve=byCenterPointRadius, plane=XY_2)
python_script_check_intersect = Python(IN[0]=code_block_4.curves, IN[1]=pullOntoPlane_2, IN[2]=code_block_4.data)
# ---------- python_script_check_intersect.python (25 lines) ----------
import clr
clr.AddReference('ProtoGeometry')
from Autodesk.DesignScript.Geometry import *
#The inputs to this node will be stored as a list in the IN variables.
dataEnteringNode = IN

listROL = IN[0]
listCir = IN[1]
listData = IN[2]

res = []

for c in listCir:
	data =""
	br = ", "
	for i in range(len(listROL)):
		
		r = listROL[i]
		for j in range (len(r)):
			rr = r[j]
			if c.DoesIntersect(rr):
				data = data + listData[i]+br
	res.append(data)
#Assign your output to the OUT variable.
OUT = res
# ----------------------------------------
setParameterByName = Element.SetParameterByName(element=code_block_4.elems, parameterName=code_block_4.param, value=python_script_check_intersect)
python_script_filter_out = Python(IN[0]=python_script_group_curve_2)  # "Python Script-Filter out Outlines"; frozen
# ---------- python_script_filter_out.python (27 lines) ----------
import clr
clr.AddReference('ProtoGeometry')
from Autodesk.DesignScript.Geometry import *
#The inputs to this node will be stored as a list in the IN variables.
dataEnteringNode = IN

listlistCurve = IN[0]

res = []

for listCurve in listlistCurve:
	if len(listCurve) == 1:
		res.append(listCurve[0])
	else:
		r = []
		L = 0
		for list in listCurve:
			LL = 0
			for c in list:
				LL += c.Length
			if LL > L:
				r.Clear()
				r = list[:]
				L=LL
		res.append(r)
#Assign your output to the OUT variable.
OUT = res
# ----------------------------------------
byJoinedCurves_2 = PolyCurve.ByJoinedCurves(python_script_filter_out)
code_block_6 = CodeBlock { 100; }
python_script_filter = Python(IN[0]=byJoinedCurves_2, IN[1]=code_block_6)
# ---------- python_script_filter.python (22 lines) ----------
import clr
clr.AddReference('ProtoGeometry')
from Autodesk.DesignScript.Geometry import *
#The inputs to this node will be stored as a list in the IN variables.
dataEnteringNode = IN

polycurve = IN[0]
distance = IN[1]
extend = False

res = []
for p in polycurve:
	newC1 = p.Offset (distance,extend)
	newC2 = p.Offset (-distance,extend)
	
	if Surface.ByPatch(newC1).Area > Surface.ByPatch(newC2).Area:
		res.append(newC1)
	else:
		res.append(newC2)

#Assign your output to the OUT variable.
OUT = res
# ----------------------------------------
XY_3 = Plane.XY()
pullOntoPlane_3 = Curve.PullOntoPlane(curve=python_script_filter, plane=XY_3)
python_script_check_intersect_2 = Python(IN[1]=pullOntoPlane_2, IN[2]=code_block_4.data)  # frozen
# ---------- python_script_check_intersect_2.python (22 lines) ----------
import clr
clr.AddReference('ProtoGeometry')
from Autodesk.DesignScript.Geometry import *
#The inputs to this node will be stored as a list in the IN variables.
dataEnteringNode = IN

listROL = IN[0]
listCir = IN[1]
listData = IN[2]

res = []

for c in listCir:
	data =""
	br = ", "
	for i in range(len(listROL)):
		r = listROL[i]
		if c.DoesIntersect(r):
			data = data + listData[i]+br
	res.append(data)
#Assign your output to the OUT variable.
OUT = res
# ----------------------------------------
python_script_filterer_3 = Python(IN[0]=select_model_elements, IN[1]=filter_2.out1)  # same code as python_script_filterer
code_block_7 = CodeBlock(elems=python_script_filterer_3, data=getParameterValueByName, radius=intersect_radius, param=param_to_write, curves=pullOntoPlane) { elems; data; radius; param; curves; }
boundingBox_2 = Element.BoundingBox(code_block_7.elems)
maxPoint_2 = BoundingBox.MaxPoint(boundingBox_2)
minPoint_2 = BoundingBox.MinPoint(boundingBox_2)
byStartPointEndPoint_2 = Line.ByStartPointEndPoint(startPoint=maxPoint_2, endPoint=minPoint_2)
code_block_8 = CodeBlock { 0.5; }
pointAtParameter_2 = Curve.PointAtParameter(curve=byStartPointEndPoint_2, param=code_block_8)
X_2 = Point.X(pointAtParameter_2)
Y_2 = Point.Y(pointAtParameter_2)
byCoordinates_2 = Point.ByCoordinates(x=X_2, y=Y_2)
byCenterPointRadius_2 = Circle.ByCenterPointRadius(centerPoint=byCoordinates_2, radius=code_block_7.radius)
XY_4 = Plane.XY()
pullOntoPlane_4 = Curve.PullOntoPlane(curve=byCenterPointRadius_2, plane=XY_4)
python_script_check_intersect_3 = Python(IN[0]=code_block_7.curves, IN[1]=pullOntoPlane_4, IN[2]=code_block_7.data)  # same code as python_script_check_intersect
setParameterByName_2 = Element.SetParameterByName(element=code_block_7.elems, parameterName=code_block_7.param, value=python_script_check_intersect_3)
python_script_check_intersect_4 = Python(IN[1]=pullOntoPlane_4, IN[2]=code_block_7.data)  # frozen; same code as python_script_check_intersect_2
python_script_filterer_4 = Python(IN[0]=select_model_elements, IN[1]=filter_2.out2)  # same code as python_script_filterer
code_block_9 = CodeBlock(elems=python_script_filterer_4, data=getParameterValueByName, radius=intersect_radius, param=param_to_write, curves=pullOntoPlane) { elems; data; radius; param; curves; }
boundingBox_3 = Element.BoundingBox(code_block_9.elems)
maxPoint_3 = BoundingBox.MaxPoint(boundingBox_3)
minPoint_3 = BoundingBox.MinPoint(boundingBox_3)
byStartPointEndPoint_3 = Line.ByStartPointEndPoint(startPoint=maxPoint_3, endPoint=minPoint_3)
code_block_10 = CodeBlock { 0.5; }
pointAtParameter_3 = Curve.PointAtParameter(curve=byStartPointEndPoint_3, param=code_block_10)
X_3 = Point.X(pointAtParameter_3)
Y_3 = Point.Y(pointAtParameter_3)
byCoordinates_3 = Point.ByCoordinates(x=X_3, y=Y_3)
byCenterPointRadius_3 = Circle.ByCenterPointRadius(centerPoint=byCoordinates_3, radius=code_block_9.radius)
XY_5 = Plane.XY()
pullOntoPlane_5 = Curve.PullOntoPlane(curve=byCenterPointRadius_3, plane=XY_5)
python_script_check_intersect_5 = Python(IN[0]=code_block_9.curves, IN[1]=pullOntoPlane_5, IN[2]=code_block_9.data)  # same code as python_script_check_intersect
setParameterByName_3 = Element.SetParameterByName(element=code_block_9.elems, parameterName=code_block_9.param, value=python_script_check_intersect_5)
python_script_check_intersect_6 = Python(IN[1]=pullOntoPlane_5, IN[2]=code_block_9.data)  # frozen; same code as python_script_check_intersect_2
