# Dynamo graph 28-UNDERGROUND STRUC FOR EXCAVATION BACKFILL.dyn (Dynamo 0.9.1.4062)

select_model_elements = DSModelElementsSelection()  # 1048 picked in the model
category_name = StringInput("Structural Foundations")
category_name_2 = StringInput("Walls")
category_name_3 = StringInput("Structural Columns")
category_name_4 = StringInput("Structural Framing")
category_name_5 = StringInput("Floors")
python_script = Python(IN[0]=select_model_elements, IN[1]=category_name, IN[2]=category_name_2, IN[3]=category_name_3, IN[4]=category_name_4, IN[5]=category_name_5)
# ---------- python_script.python (22 lines) ----------
import clr
clr.AddReference('ProtoGeometry')
from Autodesk.DesignScript.Geometry import *
#The inputs to this node will be stored as a list in the IN variables.
dataEnteringNode = IN
elems = IN[0]
cateName1 = IN[1]
cateName2 = IN[2]
cateName3 = IN[3]
cateName4 = IN[4]
cateName5 = IN[5]

res = []

for e in elems:
	ee = UnwrapElement(e)
	cat = ee.Category.Name
	if cat == cateName1 or cat == cateName2 or cat == cateName3 or cat == cateName4 or cat == cateName5:
		res.append(e)

#Assign your output to the OUT variable.
OUT = res
# ----------------------------------------
code_block = CodeBlock(elems=python_script) { elems; }
solids = Element.Solids(code_block)
isNull = Object.IsNull(solids)
filterByBoolMask = List.FilterByBoolMask(list=solids, mask=isNull)
flatten = Flatten(filterByBoolMask.out)
deconstruct = List.Deconstruct(list=flatten)
unionAll = Solid.UnionAll(deconstruct.first, deconstruct.rest)
select_model_element = DSModelElementSelection()  # 1 picked in the model
solids_2 = Element.Solids(select_model_element)
difference = Solid.Difference(solid=unionAll, other=solids_2)
directory_path = Directory("R:\BimESC\03_KIEM SOAT KHOI LUONG_3D QUANTITY\2002 MARUBENI COFFEE\02 WIP\REVIT\DATA")
string = StringInput("\")
file_name = StringInput("Undergorund Struc for excavation backill z1")
volume = Solid.Volume(difference)
number = DoubleInput(1000000000)
div = volume / number
number_2 = DoubleInput(3)
round = Math.Round(number=div, digits=number_2)
code_block_2 = CodeBlock(dir=directory_path, plash=string, filename=file_name, Info=round) { filepath = dir+plash+filename+"-"+Info+" m3"+".sat"; }
exportToSAT = ExportWithUnits(difference, code_block_2, exportedUnit=Millimeters)
string_from_object = FromObject(directory_path)
