# Dynamo graph 29-CONCRETE STRUCTURE FORMWORK-FACE THICKEN-classification.dyn (Dynamo 0.9.1.4062)

select_model_elements = DSModelElementsSelection()  # 8 picked in the model
category_name = StringInput("Structural Columns")
revit_category_filterer_1 = Custom[Revit Category Filterer 1](select_model_elements, category_name)
revit_elements_to_merged_solid = Custom[Revit Elements to Merged Solid](RevitElements=revit_category_filterer_1)
explode = Geometry.Explode(revit_elements_to_merged_solid)
flatten = Flatten(explode)
code_block = CodeBlock { 0.5; }
normalAtParameter = Surface.NormalAtParameter(surface=flatten, u=code_block, v=code_block)
Z = Vector.Z(normalAtParameter)
abs = Math.Abs(Z)
code_block_2 = CodeBlock { 1; }
eq = abs == code_block_2
filterByBoolMask = List.FilterByBoolMask(list=flatten, mask=eq)
code_block_3 = CodeBlock(notBottomFace=filterByBoolMask.out) { notBottomFace; }
# note: /!\ Phải thực hiện quy trình Join kết cấu trước
python_script_find_joined = Python(IN[0]=revit_category_filterer_1)  # "Python Script-Find Joined Elements"
# ---------- python_script_find_joined.python (49 lines) ----------
import clr
clr.AddReference('ProtoGeometry')
from Autodesk.DesignScript.Geometry import *
clr.AddReference('RevitAPI')
from Autodesk.Revit.DB import *
clr.AddReference('RevitAPIUI')
from Autodesk.Revit.UI import TaskDialog
clr.AddReference("RevitNodes")
import Revit
clr.ImportExtensions(Revit.Elements)
clr.AddReference("RevitServices")
import RevitServices
from RevitServices.Persistence import DocumentManager
from RevitServices.Transactions import TransactionManager
from System.Collections.Generic import *
clr.ImportExtensions(Revit.GeometryConversion)
 
doc = DocumentManager.Instance.CurrentDBDocument
uiapp = DocumentManager.Instance.CurrentUIApplication
app = uiapp.Application
 
import sys
import System

import Autodesk.Revit.DB.JoinGeometryUtils as JGU
#The inputs to this node will be stored as a list in the IN variables.
dataEnteringNode = IN

elems = UnwrapElement(IN[0])

res = []

finRes = []

if not len(elems) == 0:
	for e in elems:
		je = JGU.GetJoinedElements(doc,e)
		ees = []
		for id in je:
			ee = doc.GetElement(id)
			ees.append(ee)			
		res.append(ees)
	finRes.append(elems)
	finRes.append(res)
else:
	finRes = 0

#Assign your output to the OUT variable.
OUT = finRes
# ----------------------------------------
code_block_4 = CodeBlock(list=python_script_find_joined) { jes = list[1]; }
python_script_jse_solid_union = Python(IN[0]=code_block_4)
# ---------- python_script_jse_solid_union.python (24 lines) ----------
import clr
clr.AddReference('ProtoGeometry')
from Autodesk.DesignScript.Geometry import *
#The inputs to this node will be stored as a list in the IN variables.
dataEnteringNode = IN
listElems = IN[0]
res = []
res2 = []
for list in listElems:	
	listSol = []
	for e in list:		
		sols = e.Solids
		if len(sols) == 1:
			listSol.append(sols[0])
		else:
			for s in sols:
				listSol.append(s)
	res.append(listSol)
for i in range(len(res)):	
	s = res[i][0]
	sol = s.UnionAll(res[i][0:])
	res2.append(sol)
#Assign your output to the OUT variable.
OUT = res2
# ----------------------------------------
deconstruct = List.Deconstruct(list=python_script_jse_solid_union)
unionAll = Solid.UnionAll(deconstruct.first, deconstruct.rest)
python_script = Python(IN[0]=code_block_3, IN[1]=unionAll)
# ---------- python_script.python (18 lines) ----------
import clr
clr.AddReference('ProtoGeometry')
from Autodesk.DesignScript.Geometry import *
#The inputs to this node will be stored as a list in the IN variables.
dataEnteringNode = IN
listFace = IN[0]
solid = IN[1]

res = []

for f in listFace:
	s = f.Thicken(20,False)
	if s.DoesIntersect(solid):
		res.append(s.Difference(solid))
	else:
		res.append(s)
#Assign your output to the OUT variable.
OUT = res
# ----------------------------------------
directory_path = Directory("C:\Users\USER\Desktop")
string = StringInput("\")
file_name = StringInput("testFWThicken")
volume = Solid.Volume(python_script)
sum = Math.Sum(volume)
code_block_5 = CodeBlock { 1000000000; 0.02; }
div = sum / code_block_5.out0
area = div / code_block_5.out1
code_block_6 = CodeBlock(dir=directory_path, plash=string, filename=file_name, Info=area) { filepath = dir+plash+filename+"-"+Info+" m2"+".sat"; }
exportToSAT = ExportWithUnits(python_script, code_block_6, exportedUnit=Millimeters)
category_name_2 = StringInput("Structural Foundations")
category_name_3 = StringInput("Walls")
category_name_4 = StringInput("Structural Framing")
category_name_5 = StringInput("Floors")
python_script_2 = Python(IN[0]=select_model_elements, IN[1]=category_name_2, IN[2]=category_name_3, IN[3]=category_name, IN[4]=category_name_4, IN[5]=category_name_5)  # frozen
# ---------- python_script_2.python (22 lines) ----------
import clr
clr.AddReference('ProtoGeometry')
from Autodesk.DesignScript.Geometry import *
#The inputs to this node will be stored as a list in the IN variables.
dataEnteringNode = IN
elems = IN[0]
cateName1 = IN[1]
cateName2 = IN[2]
cateName3 = IN[3]
cateName4 = IN[4]
cateName5 = IN[5]

res = []

for e in elems:
	ee = UnwrapElement(e)
	cat = ee.Category.Name
	if cat == cateName1 or cat == cateName2 or cat == cateName3 or cat == cateName4 or cat == cateName5:
		res.append(e)

#Assign your output to the OUT variable.
OUT = res
# ----------------------------------------
fw_thickness = CodeBlock { 20; }
