# Dynamo graph 32-EMBANKMENT SAND-FOUNDATION.dyn (Dynamo 0.9.1.4062)

select_model_elements = DSModelElementsSelection()  # 771 picked in the model
string = StringInput("Structural Foundations")
revit_category_filterer_1 = Custom[Revit Category Filterer 1](select_model_elements, string)
parameters = Element.Parameters(revit_category_filterer_1)
code_block = CodeBlock(elems=revit_category_filterer_1) { elems; }
code_block_2 = CodeBlock { 0; }
code_block_3 = CodeBlock(OffsetLeanConcrete=code_block_2) { "TypeWidth"; "Elevation at Bottom"; OffsetLeanConcrete; "Elevation at Top"; "Cut Length"; }
getParameterValueByName = Element.GetParameterValueByName(element=code_block, parameterName=code_block_3.out1)
levels = Levels("Level Exc")
elevation = Level.Elevation(levels)
lt = getParameterValueByName < elevation
filterByBoolMask = List.FilterByBoolMask(list=code_block, mask=lt)
code_block_4 = CodeBlock(elems=filterByBoolMask.out) { elems; }  # frozen
getParameterValueByName_2 = Element.GetParameterValueByName(element=code_block_4, parameterName=code_block_3.out3)
round = Math.Round(getParameterValueByName_2)
location = StructuralFraming.Location(code_block_4)
code_block_5 = CodeBlock(locCurve=location) { locCurve; }
length = Curve.Length(code_block_5)
getParameterValueByName_3 = Element.GetParameterValueByName(element=code_block_4, parameterName=code_block_3.out4)
sub = length - getParameterValueByName_3
round_2 = Math.Round(sub)
code_block_6 = CodeBlock(d=round_2, l=length) { d/2; -d/2; l-d/2; }
pointAtDistance = Curve.PointAtDistance(code_block_5, code_block_6.out0)
pointAtDistance_2 = Curve.PointAtDistance(code_block_5, code_block_6.out2)
byStartPointEndPoint = Line.ByStartPointEndPoint(startPoint=pointAtDistance, endPoint=pointAtDistance_2)
code_block_7 = CodeBlock(curves=byStartPointEndPoint) { curves; }
code_block_8 = CodeBlock { vector1 = Vector.ByCoordinates(0, 0, -1); }
code_block_9 = CodeBlock(e=elevation) { e; }
translate = Geometry.Translate(geometry=code_block_7, direction=code_block_8, distance=code_block_9)
getParameterValueByName_4 = Element.GetParameterValueByName(element=code_block_4, parameterName=code_block_3.out0)
code_block_10 = CodeBlock(w=getParameterValueByName_4, o=code_block_3.OffsetLeanConcrete) { w+o; -w-o; }
offset = Curve.Offset(curve=translate, distance=code_block_10.out0)
offset_2 = Curve.Offset(curve=translate, distance=code_block_10.out1)
startPoint = Curve.StartPoint(offset)
startPoint_2 = Curve.StartPoint(offset_2)
byStartPointEndPoint_2 = Line.ByStartPointEndPoint(startPoint=startPoint, endPoint=startPoint_2)
endPoint = Curve.EndPoint(offset)
endPoint_2 = Curve.EndPoint(offset_2)
byStartPointEndPoint_3 = Line.ByStartPointEndPoint(startPoint=endPoint, endPoint=endPoint_2)
create = List.Create(offset, offset_2, byStartPointEndPoint_2, byStartPointEndPoint_3)
transpose = List.Transpose(create)
byJoinedCurves = PolyCurve.ByJoinedCurves(transpose)
code_block_11 = CodeBlock { vector1 = Vector.ByCoordinates(0, 0, 1); }
getParameterValueByName_5 = Element.GetParameterValueByName(element=code_block_4, parameterName=code_block_3.out1)
code_block_12 = CodeBlock(b=getParameterValueByName_5, e=elevation) { b-e; }
extrudeAsSolid = Curve.ExtrudeAsSolid(curve=byJoinedCurves, direction=code_block_11, distance=code_block_12)
directory_path = Directory("C:\Users\tvpduy\Desktop")
string_2 = StringInput("test Embankment Framing")
solid_volume_sum_meter_cubic = Custom[Solid Volume Sum Meter Cubic](solids=extrudeAsSolid)
export_sat_w_info = Custom[Export SAT w Info](geometries=extrudeAsSolid, DirPath=directory_path, fileName=string_2, info=solid_volume_sum_meter_cubic)
location_2 = FamilyInstance.Location(code_block_4)
