# Dynamo graph 32-EMBANKMENT SAND.dyn (Dynamo 0.9.1.4062)

select_model_elements = DSModelElementsSelection()  # 2 picked in the model
revit_elements_to_merged_solid = Custom[Revit Elements to Merged Solid](RevitElements=select_model_elements)
volume = Solid.Volume(revit_elements_to_merged_solid)
code_block = CodeBlock { 1000000000; }
div = volume / code_block
watch = Watch(div)
solid_bottom_surface = Custom[Solid Bottom Surface](solid=revit_elements_to_merged_solid)
code_block_2 = CodeBlock { 0.5; }
pointAtParameter = Surface.PointAtParameter(surface=solid_bottom_surface, u=code_block_2, v=code_block_2)
Z = Point.Z(pointAtParameter)
levels = Levels("Level Exc")
elevation = Level.Elevation(levels)
lt = Z < elevation
filterByBoolMask = List.FilterByBoolMask(list=solid_bottom_surface, mask=lt)
watch_2 = Watch(filterByBoolMask.out)
filterByBoolMask_2 = List.FilterByBoolMask(list=pointAtParameter, mask=lt)
byGeometry = BoundingBox.ByGeometry(revit_elements_to_merged_solid)
toCuboid = BoundingBox.ToCuboid(byGeometry)
XY = Plane.XY()
ZAxis = Vector.ZAxis()
translate = Geometry.Translate(geometry=XY, direction=ZAxis, distance=elevation)
intersect = Geometry.Intersect(geometry=toCuboid, other=translate)
distanceTo = Geometry.DistanceTo(geometry=filterByBoolMask_2.out, other=intersect, lacing=Longest)
round = Math.Round(distanceTo)
watch_3 = Watch(round)
perimeterCurves = Surface.PerimeterCurves(filterByBoolMask.out)
byJoinedCurves = PolyCurve.ByJoinedCurves(perimeterCurves)
watch_4 = Watch(byJoinedCurves)
code_block_3 = CodeBlock { 0; -1; }
byCoordinates = Vector.ByCoordinates(x=code_block_3.out0, y=code_block_3.out0, z=code_block_3.out1)
extrudeAsSolid = Curve.ExtrudeAsSolid(curve=byJoinedCurves, direction=byCoordinates, distance=round)
directory_path = Directory("C:\Users\tvpduy\Desktop")
string = StringInput("test Embankment")
solid_volume_sum_meter_cubic = Custom[Solid Volume Sum Meter Cubic](solids=extrudeAsSolid)
export_sat_w_info = Custom[Export SAT w Info](geometries=extrudeAsSolid, DirPath=directory_path, fileName=string, info=solid_volume_sum_meter_cubic)
watch_5 = Watch(Z)
