# Dynamo graph 33-MERGE UNDERGROUND CONCRETE.dyn (Dynamo 0.9.1.4062)

select_model_elements = DSModelElementsSelection()  # 1048 picked in the model
category_name = StringInput("Floors")
code_block = CodeBlock(cat=category_name) { cat; }
revit_category_filterer_1 = Custom[Revit Category Filterer 1](select_model_elements, code_block)
python_script_solid_1_by_1 = Python(IN[0]=revit_category_filterer_1)
# ---------- python_script_solid_1_by_1.python (27 lines) ----------
import clr
clr.AddReference('ProtoGeometry')
from Autodesk.DesignScript.Geometry import *
clr.AddReference('DSCoreNodes')
from DSCore import *
#The inputs to this node will be stored as a list in the IN variables.
dataEnteringNode = IN


elems = IN[0]
res = []

for e in elems:
	sols = e.Solids
	if len(sols) > 1:
		l0 = List.Deconstruct(sols)
		l1 = l0["first"]
		l2 = l0["rest"]
		
		sol = l1.UnionAll(l2)
		res.append(sol)
	else:
		res.append(sols[0])
		
		
#Assign your output to the OUT variable.
OUT = res
# ----------------------------------------
create = List.Create(python_script_solid_1_by_1)  # frozen
directory_path = Directory("C:\Users\tvpduy\Desktop")
string = StringInput("\")
file_name = StringInput("Raw Concrete")
code_block_2 = CodeBlock(sf=file_name, cat=code_block) { sf+" "+cat; }
solid_volume_sum_meter_cubic = Custom[Solid Volume Sum Meter Cubic](solids=python_script_solid_1_by_1)
code_block_3 = CodeBlock(dir=directory_path, plash=string, filename=code_block_2, Info=solid_volume_sum_meter_cubic) { filepath = dir+plash+filename+"-"+Info+" m3"+".sat"; }
exportToSAT = ExportWithUnits(create, code_block_3, exportedUnit=Millimeters)
category_name_2 = StringInput("Structural Foundations")
category_name_3 = StringInput("Walls")
category_name_4 = StringInput("Structural Columns")
category_name_5 = StringInput("Structural Framing")
