# Dynamo graph 34-IMPORT SAT.dyn (Dynamo 0.9.1.4062)

file_path = Filename("C:\Users\USER\Desktop\Raw Concrete Structural Columns-2.160000 m3.sat")
importFromSAT = Geometry.ImportFromSAT(file_path)
solid_formwork_faces = Custom[Solid Formwork Faces](solids=importFromSAT)  # frozen
file_path_2 = Filename("C:\Users\USER\Desktop\Raw Concrete Foundation-20.032000 m3.sat")
importFromSAT_2 = Geometry.ImportFromSAT(file_path_2)
file_path_3 = Filename("C:\Users\USER\Desktop\Raw Concrete Framing-34.256736 m3.sat")
importFromSAT_3 = Geometry.ImportFromSAT(file_path_3)
file_path_4 = Filename("C:\Users\USER\Desktop\Raw Concrete Floors-38.446094 m3.sat")
importFromSAT_4 = Geometry.ImportFromSAT(file_path_4)
create = List.Create(importFromSAT_2, importFromSAT_3, importFromSAT_4)  # frozen
flatten = Flatten(create)
deconstruct = List.Deconstruct(list=flatten)
unionAll = Solid.UnionAll(deconstruct.first, deconstruct.rest)
code_block = CodeBlock { 20; }
thicken_faces_difference_solid = Custom[Thicken Faces difference Solid](surfaces=solid_formwork_faces.restFaces, solid=unionAll, thickness=code_block)
