# Dynamo graph 35-MERGE SAT IMPORTS.dyn (Dynamo 0.9.1.4062)

file_path = Filename("C:\Users\tvpduy\Desktop\UG Struc for Embank-Structural Foundations-1764.282000 m3.sat")
importFromSAT = Geometry.ImportFromSAT(file_path)
file_path_2 = Filename("C:\Users\tvpduy\Desktop\UG Struc for Embank-Structural Columns-29.515000 m3.sat")
importFromSAT_2 = Geometry.ImportFromSAT(file_path_2)  # frozen
file_path_3 = Filename("C:\Users\tvpduy\Desktop\UG Struc for Embank-Structural Framing-450.775000 m3.sat")
importFromSAT_3 = Geometry.ImportFromSAT(file_path_3)  # frozen
file_path_4 = Filename("C:\Users\tvpduy\Desktop\UG Struc for Embank-Floors-2559.436000 m3.sat")
importFromSAT_4 = Geometry.ImportFromSAT(file_path_4)  # frozen
file_path_5 = Filename("C:\Users\tvpduy\Desktop\UG Struc for Embank-Walls-25.872000 m3.sat")
importFromSAT_5 = Geometry.ImportFromSAT(file_path_5)  # frozen
