# Dynamo graph 40-ZONING CONCRETE.dyn (Dynamo 0.9.1.4062)

# note: Chọn Đối tượng Kết cấu
select_model_elements = DSModelElementsSelection()
code_block = CodeBlock { "Areas"; "Parts"; "Structural Framing"; }
code_block_2 = CodeBlock(cat=code_block.out2) { cat; }
revit_category_filterer_1 = Custom[Revit Category Filterer 1](elems=select_model_elements, catName=code_block_2)
code_block_3 = CodeBlock(elems=revit_category_filterer_1) { elems; }
solids = Element.Solids(code_block_3)
flatten = Flatten(solids)
isNull = Object.IsNull(flatten)
filterByBoolMask = List.FilterByBoolMask(list=flatten, mask=isNull)
# note: Chọn Zone (đối tương Areas)
select_model_elements_2 = DSModelElementsSelection()
revit_category_filterer_1_2 = Custom[Revit Category Filterer 1](elems=select_model_elements_2, catName=code_block.out0)
code_block_4 = CodeBlock(elems=revit_category_filterer_1_2) { elems; }
python_script_area_curves = Python(IN[0]=code_block_4)
# ---------- python_script_area_curves.python (33 lines) ----------
import clr
clr.AddReference('ProtoGeometry')
from Autodesk.DesignScript.Geometry import *

clr.AddReference('RevitAPI')
from Autodesk.Revit.DB import *
clr.AddReference('RevitAPIUI')
from Autodesk.Revit.UI import TaskDialog
clr.AddReference("RevitNodes")
import Revit
clr.ImportExtensions(Revit.Elements)
clr.AddReference("RevitServices")
import RevitServices
from RevitServices.Persistence import DocumentManager
from RevitServices.Transactions import TransactionManager
from System.Collections.Generic import *
clr.ImportExtensions(Revit.GeometryConversion)

#The inputs to this node will be stored as a list in the IN variables.
dataEnteringNode = IN
areaElems = UnwrapElement(IN[0])

res = []
for a in areaElems:
	opt = SpatialElementBoundaryOptions()
	lines = a.GetBoundarySegments(opt)
	convertLines = []
	for l in lines[0]:
		convertLines.append(l.GetCurve().ToProtoType())	
	res.append(convertLines)

#Assign your output to the OUT variable.
OUT = res
# ----------------------------------------
byJoinedCurves = PolyCurve.ByJoinedCurves(python_script_area_curves)
isNull_2 = Object.IsNull(byJoinedCurves)
filterByBoolMask_2 = List.FilterByBoolMask(list=byJoinedCurves, mask=isNull_2)
ZAxis = Vector.ZAxis()
translate_distance = CodeBlock { 4000; }
translate = Geometry.Translate(geometry=filterByBoolMask_2.out, direction=ZAxis, distance=translate_distance)
depth_start_end = CodeBlock { 1000; }
code_block_5 = CodeBlock(d=depth_start_end) { d; -d; }
translate_2 = Geometry.Translate(geometry=translate, direction=ZAxis, distance=code_block_5.out1)
translate_3 = Geometry.Translate(geometry=translate, direction=ZAxis, distance=code_block_5.d)
create = List.Create(translate_2, translate_3)
transpose = List.Transpose(create)
byLoft = Solid.ByLoft(transpose)
isNull_3 = Object.IsNull(byLoft)
filterByBoolMask_3 = List.FilterByBoolMask(list=byLoft, mask=isNull_3)
param_name = CodeBlock { "Name"; }
getParameterValueByName = Element.GetParameterValueByName(element=code_block_4, parameterName=param_name)
filterByBoolMask_4 = List.FilterByBoolMask(list=getParameterValueByName, mask=isNull_2)
filterByBoolMask_5 = List.FilterByBoolMask(list=filterByBoolMask_4.out, mask=isNull_2)
param_name_2 = CodeBlock { "Zone"; }
filterByBoolMask_6 = List.FilterByBoolMask(list=revit_category_filterer_1, mask=isNull)
python_script = Python(IN[0]=filterByBoolMask.out, IN[1]=filterByBoolMask_3.out, IN[2]=filterByBoolMask_5.out, IN[3]=param_name_2, IN[4]=filterByBoolMask_6.out)
# ---------- python_script.python (27 lines) ----------
import clr
clr.AddReference('ProtoGeometry')
from Autodesk.DesignScript.Geometry import *
#The inputs to this node will be stored as a list in the IN variables.
dataEnteringNode = IN

parts = IN[0]
zones = IN[1]
names = IN[2]
param = IN[3]
elems = IN[4]


result = []

for j in range(len(parts)):
	p = parts[j]
	info = ""
	for i in range(len(zones)):
		z = zones[i]
		if p.DoesIntersect(z):
			info += ", "+ names[i]
	e = elems[j]
	e.SetParameterByName(param,info)
	
#Assign your output to the OUT variable.
OUT = 0
# ----------------------------------------
