# Dynamo graph 41-CUT WALLS.dyn (Dynamo 0.9.1.4062)

category = CodeBlock { filteredThickness; }
select_model_elements = DSModelElementsSelection()  # 3 picked in the model
category_2 = CodeBlock { "Walls"; }
code_block = CodeBlock(cat=category_2) { cat; }
revit_category_filterer_1 = Custom[Revit Category Filterer 1](select_model_elements, code_block)
param = CodeBlock { "Type"; "Width"; }
getParameterValueByName = Element.GetParameterValueByName(element=revit_category_filterer_1, parameterName=param.out0)
getParameterValueByName_2 = Element.GetParameterValueByName(element=getParameterValueByName, parameterName=param.out1)
thickness_fitlterer = DoubleInput(50)
gt = getParameterValueByName_2 > thickness_fitlterer
filterByBoolMask = List.FilterByBoolMask(list=revit_category_filterer_1, mask=gt)
code_block_2 = CodeBlock(walls=filterByBoolMask.in) { walls; }
get_wall_curves = Custom[Get Wall Curves](walls=code_block_2)
get_intersected_points_of_curves = Custom[Get Intersected points of curves](curves=get_wall_curves)
python_script_list_pair_wall = Python(IN[0]=get_wall_curves, IN[1]=code_block_2)  # "Python Script-List Pair (Wall, Intersect Points)"
# ---------- python_script_list_pair_wall.python (50 lines) ----------
import clr
clr.AddReference('ProtoGeometry')
from Autodesk.DesignScript.Geometry import *
 

#The inputs to this node will be stored as a list in the IN variables.
dataEnteringNode = IN
curves = IN[0]
walls = IN[1]

def getIntersectPoints(curves, walls):
	res = []
	i = 1
	for i in range(len(curves)):
		r = []
		c0 = curves[i]
		
		rest = curves[:]
		rest.remove(c0)
		
		r.append(walls[i])
		r.append(c0)
		for c in rest:
			flag = c0.DoesIntersect(c)
			if flag:
				p = c0.Intersect(c)
				
				boolA = not abs(c0.ParameterAtPoint(p[0])) == 1
				boolB = not abs(c0.ParameterAtPoint(p[0])) == 0
				
				#bool1 = not c0.StartPoint.X == p[0].X
				#bool2 = not  c0.StartPoint.Y == p[0].Y
				#bool3 = not  c0.StartPoint.Z == p[0].Z
				
				#bool4 = not  c0.EndPoint.X == p[0].X
				#bool5 = not  c0.EndPoint.Y == p[0].Y
				#bool6 = not  c0.EndPoint.Z == p[0].Z
				
				#bool = bool1 and bool2 and bool3 and bool4 and bool5 and bool6
				boolAB = boolA and boolB
				
				if boolAB:
					r.append(p[0])
					res.append(r)
		
	return res

res = getIntersectPoints(curves,walls)
#Assign your output to the OUT variable.
OUT = res
# ----------------------------------------
python_script_splitting_walls = Python(IN[0]=python_script_list_pair_wall)
# ---------- python_script_splitting_walls.python (62 lines) ----------
import clr
clr.AddReference('ProtoGeometry')
from Autodesk.DesignScript.Geometry import *
import Autodesk.DesignScript.Geometry.Line as protoLine
clr.AddReference('RevitAPI')
from Autodesk.Revit.DB import *
clr.AddReference('RevitAPIUI')
from Autodesk.Revit.UI import TaskDialog
clr.AddReference("RevitNodes")
import Revit
clr.ImportExtensions(Revit.Elements)
clr.AddReference("RevitServices")
import RevitServices
from RevitServices.Persistence import DocumentManager
from RevitServices.Transactions import TransactionManager
from System.Collections.Generic import *
clr.ImportExtensions(Revit.GeometryConversion)
 
 
 
doc = DocumentManager.Instance.CurrentDBDocument
uiapp = DocumentManager.Instance.CurrentUIApplication
app = uiapp.Application


#The inputs to this node will be stored as a list in the IN variables.
dataEnteringNode = IN
list = IN[0]

res = []

opt = Options()

for i in range(len(list)):
	r = []
	
	pair = list[i]
	w = UnwrapElement(pair[0])
	c = pair[1]	
	
	typeid = w.WallType.Id	
	r.append(typeid)
	
	for j in range(2,len(pair)):
		xyz = pair[j]
		try:
			c0 = protoLine.ByStartPointEndPoint(c.StartPoint,xyz)
			r.append(c0)
		except:
			pass
		try:	
			c1 = protoLine.ByStartPointEndPoint(c.EndPoint,xyz)
			r.append(c1)
		except:
			pass
		
	if len(r) > 2:
		res.append(r)
#TransactionManager.Instance.EnsureInTransaction(doc)	
#TransactionManager.Instance.TransactionTaskDone()
#Assign your output to the OUT variable.
OUT = res
# ----------------------------------------
flatten = Flatten(python_script_splitting_walls)
string_from_object = FromObject(flatten)
code_block_3 = CodeBlock { "Line"; }
contains = String.Contains(str=string_from_object, searchFor=code_block_3)
filterByBoolMask_2 = List.FilterByBoolMask(list=flatten, mask=contains)
code_block_4 = CodeBlock { 2000; }
levels = Levels("Level 1")
string = StringInput("test wall")
byName = WallType.ByName(string)
byCurveAndHeight = Wall.ByCurveAndHeight(curve=filterByBoolMask_2.in, height=code_block_4, level=levels, wallType=byName)
