# Dynamo graph 41-MATCHING FRAMING INFO.dyn (Dynamo 0.9.1.4062)

select_model_elements = DSModelElementsSelection()  # 1200 picked in the model
category = CodeBlock { "Structural Framing"; }
revit_category_filterer_1 = Custom[Revit Category Filterer 1](select_model_elements, category)
param_name = CodeBlock { "Framing-Type"; "FunctionLocation"; "Zone"; }
file_path = Filename("R:\BimESC\01_PROJECTS\THU THIEM PARK\01-PHAN NGAM\01-Incoming\200324 ten dam\BeamData.xlsx")
fromPath = FileObject(file_path)  # "File.FromPath"
sheet_name = CodeBlock { "Beam data"; }
boolean = BoolSelector(true)
readFromFile = Excel.ReadFromFile(file=fromPath, sheetName=sheet_name, readAsStrings=boolean)
transpose = List.Transpose(readFromFile)
code_block = CodeBlock(list=transpose) { names = list[1]; zones = list[2]; locFunc = list[3]; }
python_script = Python(IN[0]=revit_category_filterer_1, IN[1]=param_name.out0, IN[2]=code_block.names, IN[3]=code_block.locFunc, IN[4]=param_name.out1, IN[5]=param_name.out2, IN[6]=code_block.zones)
# ---------- python_script.python (30 lines) ----------
import clr
clr.AddReference('ProtoGeometry')
from Autodesk.DesignScript.Geometry import *

import re

#The inputs to this node will be stored as a list in the IN variables.
dataEnteringNode = IN

elems = IN[0]
param = IN[1]
names = IN[2]
locFuncs = IN[3]
paramW1 = IN[4]
paramW2 = IN[5]
zones = IN[6]

for e in elems:
	v = e.GetParameterValueByName(param)
	newInf1 = ""
	newInf2 = ""
	for i in range(len(names)):	
		n = names[i]
		if re.search(n,v,re.IGNORECASE):
			newInf1 = locFuncs[i]
			newInf2 = zones[i]
	e.SetParameterByName(paramW1,newInf1)
	e.SetParameterByName(paramW2,newInf2)
#Assign your output to the OUT variable.
OUT = 0
# ----------------------------------------
