# Dynamo graph 42-Data Door Window.dyn (Dynamo 0.9.1.4062)

select_model_elements = DSModelElementsSelection()  # 21 picked in the model
category_name = CodeBlock { "Doors"; "Windows"; }
code_block = CodeBlock(cat=category_name.out0) { cat; }
revit_category_filterer_1 = Custom[Revit Category Filterer 1](elems=select_model_elements, catName=code_block)
code_block_2 = CodeBlock(elems=revit_category_filterer_1) { elems; }
param = CodeBlock { "Type"; "Width"; "Height"; "Level"; "Sill Height"; "Category"; }
getParameterValueByName = Element.GetParameterValueByName(element=code_block_2, parameterName=param.out3)
elevation = Level.Elevation(getParameterValueByName)
round = Math.Round(elevation)
directory_path = Directory("C:\Users\USER\Desktop")
string = StringInput("\")
code_block_3 = CodeBlock(dir=directory_path, br=string, fn=code_block) { fp = dir + br + "DW"+"-Data"+".xls"; shn = fn+"-Data"; }
code_block_4 = CodeBlock { 0; }
row_0 = CodeBlock { "Category"; "Family"; "Type"; "X"; "Y"; "Z"; "FaceRot"; "Level"; "Sill Height"; "Width"; "Height"; }
create = List.Create(row_0.out0, row_0.out1, row_0.out2, row_0.out3, row_0.out4, row_0.out5, row_0.out6, row_0.out7, row_0.out8, row_0.out9, row_0.out10)
getParameterValueByName_2 = Element.GetParameterValueByName(element=code_block_2, parameterName=param.out5)
name = Category.Name(getParameterValueByName_2)
getParameterValueByName_3 = Element.GetParameterValueByName(element=code_block_2, parameterName=param.out0)
code_block_5 = CodeBlock(types=getParameterValueByName_3) { types; }
family = FamilyType.Family(code_block_5)
name_2 = Family.Name(family)
name_3 = FamilyType.Name(code_block_5)
location = FamilyInstance.Location(code_block_2)
X = Point.X(location)
round_2 = Math.Round(X)
Y = Point.Y(location)
round_3 = Math.Round(Y)
Z = Point.Z(location)
round_4 = Math.Round(Z)
facingOrientation = FamilyInstance.FacingOrientation(code_block_2)
XAxis = Vector.XAxis()
ZAxis = Vector.ZAxis()
angleBetween = Vector.AngleBetween(facingOrientation, XAxis, ZAxis)
round_5 = Math.Round(angleBetween)
name_4 = Level.Name(getParameterValueByName)
getParameterValueByName_4 = Element.GetParameterValueByName(element=code_block_2, parameterName=param.out4)
round_6 = Math.Round(getParameterValueByName_4)
getParameterValueByName_5 = Element.GetParameterValueByName(element=code_block_5, parameterName=param.out1)
round_7 = Math.Round(getParameterValueByName_5)
getParameterValueByName_6 = Element.GetParameterValueByName(element=code_block_5, parameterName=param.out2)
round_8 = Math.Round(getParameterValueByName_6)
create_2 = List.Create(name, name_2, name_3, round_2, round_3, round_4, round_5, name_4, round_6, round_7, round_8)
transpose = List.Transpose(create_2)
addItemToFront = List.AddItemToFront(item=create, list=transpose)
boolean = BoolSelector(true)
writeToFile = Excel.WriteToFile(filePath=code_block_3.fp, sheetName=code_block_3.shn, startRow=code_block_4, startCol=code_block_4, data=addItemToFront, overWrite=boolean)
