# Dynamo graph 46-REPLACE PRAM STRING VALUE.dyn (Dynamo 0.9.1.4062)

select_model_elements = DSModelElementsSelection()  # 28 picked in the model
PARAM = CodeBlock { "Zone"; "Name"; }
getParameterValueByName = Element.GetParameterValueByName(element=select_model_elements, parameterName=PARAM.out0)
string = StringInput(", ")
boolean = BoolSelector(true)
contains = String.Contains(str=getParameterValueByName, searchFor=string, ignoreCase=boolean)
filterByBoolMask = List.FilterByBoolMask(list=getParameterValueByName, mask=contains)
string_2 = StringInput("")
replace = String.Replace(str=filterByBoolMask.in, searchFor=string, replaceWith=string_2)
setParameterByName = Element.SetParameterByName(element=select_model_elements, parameterName=PARAM.out1, value=replace)
