# Dynamo graph 47-Write Data CSV match Element ID.dyn (Dynamo 0.9.1.4062)

select_model_elements = DSModelElementsSelection()  # 89 picked in the model
id = Element.Id(select_model_elements)
file_path = Filename("C:\Users\USER\Documents\TTRP\Part data.csv")
fromPath = FileObject(file_path)  # "File.FromPath"
readFromFile = CSV.ReadFromFile(fromPath)
transpose = List.Transpose(readFromFile)
code_block = CodeBlock(list=transpose) { paramSVs = list[2]; infoNeed = list[4]; }
deconstruct = List.Deconstruct(list=code_block.paramSVs)
param_write = StringInput("Zone")
python_script = Python(IN[0]=id, IN[1]=deconstruct.rest, IN[2]=code_block.infoNeed, IN[3]=select_model_elements, IN[4]=param_write)
# ---------- python_script.python (26 lines) ----------
import clr
clr.AddReference('ProtoGeometry')
from Autodesk.DesignScript.Geometry import *
#The inputs to this node will be stored as a list in the IN variables.
dataEnteringNode = IN

elemIds = IN[0]
dataIds = IN[1]
infos = IN[2]
elems = IN[3]
param = IN[4]

for i in range(len(elemIds)):
	eid = elemIds[i]
	e = elems[i]
	infoRes = ""
	for j in range(len(dataIds)):
		id = dataIds[j]
		inf = infos[j]
		
		if eid == id:
			infoRes = inf
			break
	e.SetParameterByName(param,infoRes)		
#Assign your output to the OUT variable.
OUT = 0
# ----------------------------------------
