# Dynamo graph 49-AREA to SVG.dyn (Dynamo 0.9.1.4062)

string = StringInput("")
# note: Chọn Zone (đối tương Areas)
select_model_elements = DSModelElementsSelection()  # 28 picked in the model
cat = CodeBlock { "Areas"; }
revit_category_filterer_1 = Custom[Revit Category Filterer 1](elems=select_model_elements, catName=cat)
code_block = CodeBlock(elems=revit_category_filterer_1) { elems; }
python_script_area_curves = Python(IN[0]=code_block)
# ---------- python_script_area_curves.python (33 lines) ----------
import clr
clr.AddReference('ProtoGeometry')
from Autodesk.DesignScript.Geometry import *

clr.AddReference('RevitAPI')
from Autodesk.Revit.DB import *
clr.AddReference('RevitAPIUI')
from Autodesk.Revit.UI import TaskDialog
clr.AddReference("RevitNodes")
import Revit
clr.ImportExtensions(Revit.Elements)
clr.AddReference("RevitServices")
import RevitServices
from RevitServices.Persistence import DocumentManager
from RevitServices.Transactions import TransactionManager
from System.Collections.Generic import *
clr.ImportExtensions(Revit.GeometryConversion)

#The inputs to this node will be stored as a list in the IN variables.
dataEnteringNode = IN
areaElems = UnwrapElement(IN[0])

res = []
for a in areaElems:
	opt = SpatialElementBoundaryOptions()
	lines = a.GetBoundarySegments(opt)
	convertLines = []
	for l in lines[0]:
		convertLines.append(l.GetCurve().ToProtoType())	
	res.append(convertLines)

#Assign your output to the OUT variable.
OUT = res
# ----------------------------------------
byJoinedCurves = PolyCurve.ByJoinedCurves(python_script_area_curves)
isNull = Object.IsNull(byJoinedCurves)
filterByBoolMask = List.FilterByBoolMask(list=python_script_area_curves, mask=isNull)
file_path = Filename("C:\Users\USER\Documents\GitHub\cofico\cofico\COF_FireBase\public\bienPhapThiCong\svg\site-zone-raw from revit.svg")
string_2 = StringInput("<path id=\"ZONE ")
param_name = CodeBlock { "Name"; }
getParameterValueByName = Element.GetParameterValueByName(element=code_block, parameterName=param_name)
filterByBoolMask_2 = List.FilterByBoolMask(list=getParameterValueByName, mask=isNull)
string_3 = StringInput("\"")
string_4 = StringInput(" onmouseover=\"displayName('")
string_5 = StringInput("')\"")
code_block_2 = CodeBlock(a=string_4, b=filterByBoolMask_2.out, c=string_5) { a+"ZONE "+b+c; }
code_block_3 = CodeBlock(event=code_block_2) { event; }
string_6 = StringInput(" d=\"")
filterByBoolMask_3 = List.FilterByBoolMask(list=byJoinedCurves, mask=isNull)
scale_1_x = CodeBlock { x=500; }
code_block_4 = CodeBlock(X=scale_1_x) { 1/X; }
scale = Geometry.Scale(geometry=filterByBoolMask_3.out, amount=code_block_4)
curves = PolyCurve.Curves(scale)
code_block_5 = CodeBlock(curves=curves) { curves; }
startPoint = Curve.StartPoint(code_block_5)
X = Point.X(startPoint)
code_block_6 = CodeBlock { 3; }
round = Math.Round(number=X, digits=code_block_6)
reverse_x = BoolSelector(false)
code_block_7 = CodeBlock { -1; 1; }
if_ = If(test=reverse_x, true=code_block_7.out0, false=code_block_7.out1)
Y = Point.Y(startPoint)
round_2 = Math.Round(number=Y, digits=code_block_6)
reverse_y = BoolSelector(true)
if_2 = If(test=reverse_y, true=code_block_7.out0, false=code_block_7.out1)
code_block_8 = CodeBlock(x=round, a=if_, y=round_2, b=if_2) { x*a+" "+y*b; }
python_script_merge_x_y = Python(IN[0]=code_block_8)
# ---------- python_script_merge_x_y.python (16 lines) ----------
import clr
clr.AddReference('ProtoGeometry')
from Autodesk.DesignScript.Geometry import *
#The inputs to this node will be stored as a list in the IN variables.
dataEnteringNode = IN

list=IN[0]
res = []
for l in list:
	str = "M"+l[0]+" "
	for i in range(1,len(l)):
		xy = l[i]
		str+="L"+xy+" "
	res.append(str)	
#Assign your output to the OUT variable.
OUT = res
# ----------------------------------------
string_7 = StringInput("z\"/>")
code_block_9 = CodeBlock(t1=string_2, t2=filterByBoolMask_2.out, t3=string_3, t4=code_block_3, t5=string_6, t6=python_script_merge_x_y, t7=string_7) { t1+t2+t3+t4+t5+t6+t7; }
writeToFile = CSV.WriteToFile(file_path, code_block_9)
