# Dynamo graph 50-ON OFF ENABLE ANALYTICAL MODEL.dyn (Dynamo 0.9.1.4062)

select_model_elements = DSModelElementsSelection()  # 32 picked in the model
category = CodeBlock { "Structural Foundations"; "Structural Columns"; "Structural Framing"; "Floors"; "Walls"; }
revit_category_filterer_1 = Custom[Revit Category Filterer 1](elems=select_model_elements, catName=category.out0)
code_block = CodeBlock { "Enable Analytical Model"; }
code_block_2 = CodeBlock { 0; }
code_block_3 = CodeBlock(param=code_block, value=code_block_2) { param; value; }
setParameterByName = Element.SetParameterByName(element=revit_category_filterer_1, parameterName=code_block_3.param, value=code_block_3.value)
boolean = BoolSelector(false)
revit_category_filterer_1_2 = Custom[Revit Category Filterer 1](elems=select_model_elements, catName=category.out1)
setParameterByName_2 = Element.SetParameterByName(element=revit_category_filterer_1_2, parameterName=code_block_3.param, value=code_block_3.value)
revit_category_filterer_1_3 = Custom[Revit Category Filterer 1](elems=select_model_elements, catName=category.out2)
setParameterByName_3 = Element.SetParameterByName(element=revit_category_filterer_1_3, parameterName=code_block_3.param, value=code_block_3.value)
revit_category_filterer_1_4 = Custom[Revit Category Filterer 1](elems=select_model_elements, catName=category.out3)
setParameterByName_4 = Element.SetParameterByName(element=revit_category_filterer_1_4, parameterName=code_block_3.param, value=code_block_3.value)
revit_category_filterer_1_5 = Custom[Revit Category Filterer 1](elems=select_model_elements, catName=category.out4)
setParameterByName_5 = Element.SetParameterByName(element=revit_category_filterer_1_5, parameterName=code_block_3.param, value=code_block_3.value)
