# Dynamo graph 52-TOPOGRAPHY from CAD DATA.dyn (Dynamo 0.9.1.4062)

file_path = Filename("C:\Users\USER\Documents\ANH NAM\DIA HINH-COMBINE ELEV.xls")
fromPath = FileObject(file_path)  # "File.FromPath"
tên_sheet = StringInput("Summary")
boolean = BoolSelector(false)
readFromFile = Excel.ReadFromFile(file=fromPath, sheetName=tên_sheet, readAsStrings=boolean)
watch = Watch(readFromFile)
deconstruct = List.Deconstruct(list=readFromFile)
transpose = List.Transpose(deconstruct.rest)
watch_2 = Watch(transpose)
danh_sách_dữ_liệu = CodeBlock(list=transpose)
# ---------- danh_sách_dữ_liệu.designscript (11 lines) ----------
list;
blockname = list[1];
x = list[2];
y = list[3];
z = list[4];
rot = list[5];
pointDesc = list[6];
pointName = list[7];
preElev = list[8];
subElev = list[9];
elevation = list[10];
# ----------------------------------------
lọc_block_name = StringInput("Elev_Point_Blk2")
code_block = CodeBlock(f=lọc_block_name) { f; }
boolean_2 = BoolSelector(true)
contains = String.Contains(str=danh_sách_dữ_liệu.blockname, searchFor=code_block, ignoreCase=boolean_2)
filterByBoolMask = List.FilterByBoolMask(list=danh_sách_dữ_liệu.blockname, mask=contains)
filterByBoolMask_2 = List.FilterByBoolMask(list=danh_sách_dữ_liệu.x, mask=contains)
filterByBoolMask_3 = List.FilterByBoolMask(list=danh_sách_dữ_liệu.y, mask=contains)
filterByBoolMask_4 = List.FilterByBoolMask(list=danh_sách_dữ_liệu.z, mask=contains)
filterByBoolMask_5 = List.FilterByBoolMask(list=danh_sách_dữ_liệu.rot, mask=contains)
filterByBoolMask_6 = List.FilterByBoolMask(list=danh_sách_dữ_liệu.pointDesc, mask=contains)
filterByBoolMask_7 = List.FilterByBoolMask(list=danh_sách_dữ_liệu.pointName, mask=contains)
filterByBoolMask_8 = List.FilterByBoolMask(list=danh_sách_dữ_liệu.preElev, mask=contains)
filterByBoolMask_9 = List.FilterByBoolMask(list=danh_sách_dữ_liệu.subElev, mask=contains)
filterByBoolMask_10 = List.FilterByBoolMask(list=danh_sách_dữ_liệu.elevation, mask=contains)
danh_sách_đã_lọc = CodeBlock(blockname=filterByBoolMask.in, x=filterByBoolMask_2.in, y=filterByBoolMask_3.in, z=filterByBoolMask_4.in, rot=filterByBoolMask_5.in, pointDesc=filterByBoolMask_6.in, pointName=filterByBoolMask_7.in, preElev=filterByBoolMask_8.in, subElev=filterByBoolMask_9.in, elevation=filterByBoolMask_10.in) { blockname; x; y; z; rot; pointDesc; pointName; preElev; subElev; elevation; }
watch_3 = Watch(danh_sách_đã_lọc.elevation)
toNumber = String.ToNumber(danh_sách_đã_lọc.x)
round = Math.Round(toNumber)
toNumber_2 = String.ToNumber(danh_sách_đã_lọc.y)
round_2 = Math.Round(toNumber_2)
round_3 = Math.Round(danh_sách_đã_lọc.elevation)
chuyển_vị_z = DoubleInput(-12000)
add = round_3 + chuyển_vị_z
byCoordinates = Point.ByCoordinates(x=round, y=round_2, z=add)
byPoints = Topography.ByPoints(byCoordinates)
toNumber_3 = String.ToNumber(danh_sách_đã_lọc.elevation)
