# Dynamo graph EXCAVATION MODELING.dyn (Dynamo 0.9.1.4062)

string = StringInput("OST_StructuralFoundation")
byName = Category.ByName(string)
all_elements_of_category = ElementsOfCategory(byName)
select_model_elements = DSModelElementsSelection()  # 4 picked in the model
code_block = CodeBlock(foundations=select_model_elements) { foundations; }
solids = Element.Solids(code_block)
python_script_merge_solid_then = Python(IN[0]=solids)  # "Python Script Merge Solid then Explode"
# ---------- python_script_merge_solid_then.python (22 lines) ----------
import clr
clr.AddReference('ProtoGeometry')
from Autodesk.DesignScript.Geometry import *
#The inputs to this node will be stored as a list in the IN variables.
dataEnteringNode = IN

resMergeSolids = []
resExplode = []
resSurfaces = []	

listList = IN[0]
for list in listList:
	if len(list)>1:
		mergeSol = list[0].UnionAll(list)		
		resMergeSolids.append(mergeSol)
	
for solid in resMergeSolids:
	resExplode.append(solid.Explode())

	
#Assign your output to the OUT variable.
OUT = resMergeSolids,resExplode
# ----------------------------------------
code_block_2 = CodeBlock(list=python_script_merge_solid_then) { solids = list[0]; surface = list[1]; }
