# Dynamo graph FW BY FACE.dyn (Dynamo 0.9.1.4062)

select_merged_part = DSModelElementSelection()  # frozen
python_script = Python()
# ---------- python_script.python (24 lines) ----------
# Importing Reference Modules
import clr
clr.AddReference('ProtoGeometry')
import Autodesk
from Autodesk.DesignScript.Geometry import *

# create empty lists to store values
subDir = []

# give geometry a nickname for easy reference
geo = Autodesk.DesignScript.Geometry

# dir returns a list of module/class/object attributes
# for each item in topDir
for i in dir(geo) :
	# create a string equivalent to geo.i
	# eg 'Autodesk.DesignScript.Geometry.Application'
	dir_str = getattr(geo, i)
	# to find nested dir
	# append to subDir the dir of dir(geo)
	subDir.append(dir(dir_str))

# output dir(geo) and sub dir
OUT = dir(geo), subDir
# ----------------------------------------
string = StringInput("""# Importing Reference Modules
import clr
clr.AddReference('ProtoGeometry')
import Autodesk
from Autodesk.DesignScript.Geometry import *

# create empty lists to store values
subDir = []

# give geometry a nickname for easy reference
geo = Autodesk.DesignScript.Geometry

# dir returns a list of module/class/object attributes
# for each item in topDir
for i in dir(geo) :
 # create a string equivalent to geo.i
 # eg 'Autodesk.DesignScript.Geometry.Application'
 dir_str = getattr(geo, i)
 # to find nested dir
 # append to subDir the dir of dir(geo)
 subDir.append(dir(dir_str))

# output dir(geo) and sub dir
OUT = dir(geo), subDir""")
# note: View--> show all part and origin ---->
select_original_elements = DSModelElementsSelection()
solids = Element.Solids(select_original_elements)
flatten = Flatten(solids)
byUnion = Solid.ByUnion(flatten)
explode = Geometry.Explode(byUnion)
flatten_2 = Flatten(explode)
code_block = CodeBlock { 0.5; }
normalAtParameter = Surface.NormalAtParameter(surface=flatten_2, u=code_block, v=code_block)
Z = Vector.Z(normalAtParameter)
abs = Math.Abs(Z)
code_block_2 = CodeBlock { 1; -1; }
eq = Z == code_block_2.out0
filterByBoolMask = List.FilterByBoolMask(list=flatten_2, mask=eq)
normalAtParameter_2 = Surface.NormalAtParameter(surface=filterByBoolMask.out, u=code_block, v=code_block)
Z_2 = Vector.Z(normalAtParameter_2)
eq_2 = Z_2 == code_block_2.out0
filterByBoolMask_2 = List.FilterByBoolMask(list=filterByBoolMask.out, mask=eq_2)
pointAtParameter = Surface.PointAtParameter(surface=filterByBoolMask_2.out, u=code_block, v=code_block)
Z_3 = Point.Z(pointAtParameter)
boolean = BoolSelector(true)
sortIndexByValue = SortIndexByValue(Z_3, boolean)
getItemAtIndex = List.GetItemAtIndex(list=filterByBoolMask_2.out, index=sortIndexByValue)
deconstruct = List.Deconstruct(list=getItemAtIndex)
code_block_3 = CodeBlock(surface=deconstruct.rest) { surface; }
select_scope_box_of_slab_and = DSModelElementsSelection()  # "Select Scope Box of Slab and Framing"
boundingBox = Element.BoundingBox(select_scope_box_of_slab_and)
code_block_4 = CodeBlock { 0.5; }
pointAtParameter_2 = Surface.PointAtParameter(surface=code_block_3, u=code_block_4, v=code_block_4)
contains = BoundingBox.Contains(boundingBox, pointAtParameter_2)
filterByBoolMask_3 = List.FilterByBoolMask(list=code_block_3, mask=contains)
code_block_5 = CodeBlock { 20; }
boolean_2 = BoolSelector(false)
thicken = Surface.Thicken(surface=filterByBoolMask_3.in, thickness=code_block_5, both_sides=boolean_2)
file_path = Filename("C:\Users\USER\Documents\MARUBENI COFFEE\BIM QTO\FW Slab Beam 1.sat")
exportToSAT = ExportWithUnits(thicken, file_path, exportedUnit=Millimeters)
boolean_3 = BoolSelector(false)
thicken_2 = Surface.Thicken(surface=filterByBoolMask_3.out, thickness=code_block_5, both_sides=boolean_3)
file_path_2 = Filename("C:\Users\USER\Documents\MARUBENI COFFEE\BIM QTO\FW COL 1.sat")
exportToSAT_2 = ExportWithUnits(thicken_2, file_path_2, exportedUnit=Millimeters)
