# Dynamo graph PLACE EXVAVATE HOLES-LINE BASED.dyn (Dynamo 0.9.1.4062)

select_model_elements = DSModelElementsSelection()  # 1 picked in the model
location = FamilyInstance.Location(select_model_elements)
length = Curve.Length(location)
parameters = Element.Parameters(select_model_elements)
string = StringInput("Excavate Hole-Taluy")
byName = FamilyType.ByName(string)
number = DoubleInput(0.5)
pointAtParameter = Curve.PointAtParameter(curve=location, param=number)
X = Point.X(pointAtParameter)
Y = Point.Y(pointAtParameter)
levels = Levels("GF")
elevation = Level.Elevation(levels)
byCoordinates = Point.ByCoordinates(x=X, y=Y, z=elevation)
byPoint = FamilyInstance.ByPoint(familyType=byName, point=byCoordinates)
code_block = CodeBlock { "Width"; }
code_block_2 = CodeBlock { "Cut Length"; "Elevation at Bottom"; "Elevation at Top"; }
getParameterValueByName = Element.GetParameterValueByName(element=select_model_elements, parameterName=code_block_2.out0)
setParameterByName = Element.SetParameterByName(element=byPoint, parameterName=code_block, value=getParameterValueByName)
startPoint = Curve.StartPoint(location)
Y_2 = Point.Y(startPoint)
endPoint = Curve.EndPoint(location)
Y_3 = Point.Y(endPoint)
gt = Y_2 > Y_3
byTwoPoints = Vector.ByTwoPoints(start=startPoint, end=endPoint)
XAxis = Vector.XAxis()
angleBetween = Vector.AngleBetween(byTwoPoints, XAxis)
round = Math.Round(angleBetween)
code_block_3 = CodeBlock(a=round) { a*(-1); a; }
if_ = If(test=gt, true=code_block_3.a, false=code_block_3.out0)
setRotation = FamilyInstance.SetRotation(familyInstance=setParameterByName, degree=if_)
normalized = Vector.Normalized(byTwoPoints)
