# Dynamo graph READ EXCEL 901.dyn (Dynamo 0.9.1.4062)

file_path = Filename("C:\Users\USER\Documents\MARUBENI COFFEE\BIM QTO\[1]TK CAU KIEN KC BT.xlsx")
fromPath = FileObject(file_path)  # "File.FromPath"
string = StringInput("MCFS")
readFromFile = Excel.ReadFromFile(file=fromPath, sheetName=string)
