# Dynamo graph SAT FACE AREA M2.dyn (Dynamo 0.9.1.4062)

select_model_element = DSModelElementSelection()  # 1 picked in the model
geometry = Element.Geometry(select_model_element)
area = Surface.Area(geometry)
isNull = Object.IsNull(area)
filterByBoolMask = List.FilterByBoolMask(list=area, mask=isNull)
sum = Math.Sum(filterByBoolMask.out)
code_block = CodeBlock { 1000000; }
div = sum / code_block
