# Dynamo graph Switch Join Slabs 901 200219.dyn (Dynamo 0.9.1.4062)

string = StringInput("OST_Floors")
byName = Category.ByName(string)
all_elements_of_category = ElementsOfCategory(byName)
string_2 = StringInput("OST_StructuralColumns")
byName_2 = Category.ByName(string_2)
all_elements_of_category_2 = ElementsOfCategory(byName_2)
string_3 = StringInput("OST_StructuralFoundation")
byName_3 = Category.ByName(string_3)
all_elements_of_category_3 = ElementsOfCategory(byName_3)
string_4 = StringInput("OST_Walls")
byName_4 = Category.ByName(string_4)
all_elements_of_category_4 = ElementsOfCategory(byName_4)
string_5 = StringInput("OST_StructuralFraming")
byName_5 = Category.ByName(string_5)
all_elements_of_category_5 = ElementsOfCategory(byName_5)
create = List.Create(all_elements_of_category_2, all_elements_of_category_3, all_elements_of_category_4, all_elements_of_category_5)
flatten = Flatten(create)
python_script = Python(IN[0]=all_elements_of_category, IN[1]=flatten)
# ---------- python_script.python (52 lines) ----------
import clr
clr.AddReference('ProtoGeometry')
from Autodesk.DesignScript.Geometry import *
clr.AddReference('RevitAPI')
from Autodesk.Revit.DB import *
clr.AddReference('RevitAPIUI')
from Autodesk.Revit.UI import TaskDialog
clr.AddReference("RevitNodes")
import Revit
clr.ImportExtensions(Revit.Elements)
clr.AddReference("RevitServices")
import RevitServices
from RevitServices.Persistence import DocumentManager
from RevitServices.Transactions import TransactionManager
from System.Collections.Generic import *
clr.ImportExtensions(Revit.GeometryConversion)
 
doc = DocumentManager.Instance.CurrentDBDocument
uiapp = DocumentManager.Instance.CurrentUIApplication
app = uiapp.Application
 
import sys
import System
import Autodesk.Revit.DB.JoinGeometryUtils as JGU # de Join 

#The inputs to this node will be stored as a list in the IN variables.
dataEnteringNode = IN

list = IN[0]
list2 = IN[1]

res = []

# Start Transaction
TransactionManager.Instance.EnsureInTransaction(doc)
try:
	for l in list:
		A = UnwrapElement(l[0])		
		for j in list2:
			B = UnwrapElement(j)
			boolCut = JGU.IsCuttingElementInJoin(doc,A,B)
			if boolCut == True:
				JGU.SwitchJoinOrder(doc,B,A)
except:
    pass
 
# End Transaction
TransactionManager.Instance.TransactionTaskDone()
doc.Regenerate()

#Assign your output to the OUT variable.
OUT = 0
# ----------------------------------------
