# Dynamo custom node Color Elements.dyf (Dynamo 0.9.1.4062)
# category: Revit.Elements

number_slider = DoubleSlider(103, range=0..255 step 1)
number_slider_2 = DoubleSlider(255, range=0..255 step 1)
number_slider_3 = DoubleSlider(0, range=0..255 step 1)
number_slider_4 = DoubleSlider(255, range=0..255 step 1)
elems = Input()
A = Input()
R = Input()
G = Input()
B = Input()
byARGB = Color.ByARGB(a=A, r=R, g=G, b=B)
overrideColorInView = Element.OverrideColorInView(element=elems, color=byARGB)
elems_2 = Output(overrideColorInView)  # "elems"
