# Dynamo custom node Filter Revit Structural Elements.dyf (Dynamo 0.9.1.4062)
# category: Revit.Selection

RevitElements = Input()
category_name = StringInput("Structural Foundations")
category_name_2 = StringInput("Walls")
category_name_3 = StringInput("Structural Columns")
category_name_4 = StringInput("Structural Framing")
python_script = Python(IN[0]=RevitElements, IN[1]=category_name, IN[2]=category_name_2, IN[3]=category_name_3, IN[4]=category_name_4)
# ---------- python_script.python (21 lines) ----------
import clr
clr.AddReference('ProtoGeometry')
from Autodesk.DesignScript.Geometry import *
#The inputs to this node will be stored as a list in the IN variables.
dataEnteringNode = IN
elems = IN[0]
cateName1 = IN[1]
cateName2 = IN[2]
cateName3 = IN[3]
cateName4 = IN[4]

res = []

for e in elems:
	ee = UnwrapElement(e)
	cat = ee.Category.Name
	if cat == cateName1 or cat == cateName2 or cat == cateName3 or cat == cateName4:
		res.append(e)

#Assign your output to the OUT variable.
OUT = res
# ----------------------------------------
StrucElements = Output(python_script)
