# Dynamo custom node Filter Surface by Vector Z.dyf (Dynamo 0.9.1.4062)
# category: Revit.Selection

invert = Input()
Surfaces = Input()
code_block = CodeBlock { 0.5; }
normalAtParameter = Surface.NormalAtParameter(surface=Surfaces, u=code_block, v=code_block)
Z = Vector.Z(normalAtParameter)
ZValue = Input()
eq = Z == ZValue
filterByBoolMask = List.FilterByBoolMask(list=Surfaces, mask=eq)
if_ = If(test=invert, true=filterByBoolMask.in, false=filterByBoolMask.out)
ResultSurfaces = Output(if_)
