# Dynamo custom node Get Intersected points of curves.dyf (Dynamo 0.9.1.4062)
# category: Geometry.Curve

curves = Input()
python_script_intersect_point = Python(IN[0]=curves)
# ---------- python_script_intersect_point.python (27 lines) ----------
import clr
clr.AddReference('ProtoGeometry')
from Autodesk.DesignScript.Geometry import *
 

#The inputs to this node will be stored as a list in the IN variables.
dataEnteringNode = IN
curves = IN[0]

def getIntersectPoints(curves):
	res = []	
	still = True
	i = 1
	while i < len(curves):
		c0 = curves[i-1]		
		rest = curves[i:]		
		for c in rest:
			flag = c0.DoesIntersect(c)
			if flag:
				p = c0.Intersect(c)
				res.append(p)
		i+=1
	return res

res = getIntersectPoints(curves)
#Assign your output to the OUT variable.
OUT = res
# ----------------------------------------
flatten = Flatten(python_script_intersect_point)
points = Output(flatten)
