# Dynamo custom node Get Wall Curves.dyf (Dynamo 0.9.1.4062)
# category: Revit.Elements

walls = Input()
python_script_get_wall_curve = Python(IN[0]=walls)
# ---------- python_script_get_wall_curve.python (39 lines) ----------
import clr
clr.AddReference('ProtoGeometry')
from Autodesk.DesignScript.Geometry import *
clr.AddReference('RevitAPI')
from Autodesk.Revit.DB import *
clr.AddReference('RevitAPIUI')
from Autodesk.Revit.UI import TaskDialog
clr.AddReference("RevitNodes")
import Revit
clr.ImportExtensions(Revit.Elements)
clr.AddReference("RevitServices")
import RevitServices
from RevitServices.Persistence import DocumentManager
from RevitServices.Transactions import TransactionManager
from System.Collections.Generic import *
clr.ImportExtensions(Revit.GeometryConversion)
 
 
 
doc = DocumentManager.Instance.CurrentDBDocument
uiapp = DocumentManager.Instance.CurrentUIApplication
app = uiapp.Application

#The inputs to this node will be stored as a list in the IN variables.
dataEnteringNode = IN
walls = UnwrapElement(IN[0])

res = []

opt = Options()

for w in walls:	
	loc = w.Location
	c = loc.Curve
	res.append(c.ToProtoType())


#Assign your output to the OUT variable.
OUT = res
# ----------------------------------------
curves = Output(python_script_get_wall_curve)
