# Dynamo custom node Solid Bottom Surface.dyf (Dynamo 0.9.1.4062)
# category: Geometry.Solid

solid = Input()
explode = Geometry.Explode(solid)
flatten = Flatten(explode)
code_block = CodeBlock { 0.5; }
normalAtParameter = Surface.NormalAtParameter(surface=flatten, u=code_block, v=code_block)
Z = Vector.Z(normalAtParameter)
code_block_2 = CodeBlock { -1; }
eq = Z == code_block_2
filterByBoolMask = List.FilterByBoolMask(list=flatten, mask=eq)
Surface = Output(filterByBoolMask.in)
