# Dynamo custom node Solid By Merged Surfaces 1.dyf (Dynamo 0.9.1.4062)
# category: Geometry.Solid

topSurface = Input()
bottomSurface = Input()
code_block = CodeBlock(topSurface=topSurface, bottomSurface=bottomSurface) { topSurface; bottomSurface; }
explode = Geometry.Explode(code_block.topSurface)
perimeterCurves = Surface.PerimeterCurves(explode)
flatten = Flatten(perimeterCurves)
explode_2 = Geometry.Explode(code_block.bottomSurface)
perimeterCurves_2 = Surface.PerimeterCurves(explode_2)
flatten_2 = Flatten(perimeterCurves_2)
create = List.Create(flatten, flatten_2)
transpose = List.Transpose(create)
byLoft = Surface.ByLoft(transpose)
create_2 = List.Create(code_block.topSurface, code_block.bottomSurface, byLoft)
flatten_3 = Flatten(create_2)
byJoinedSurfaces = Solid.ByJoinedSurfaces(flatten_3)
volume = Solid.Volume(byJoinedSurfaces)
solid = Output(byJoinedSurfaces)
