# Dynamo custom node Solid Formwork Faces.dyf (Dynamo 0.9.1.4062)
# category: Geometry.Solid

solids = Input()
explode = Geometry.Explode(solids)
flatten = Flatten(explode)
code_block = CodeBlock { 0.5; }
normalAtParameter = Surface.NormalAtParameter(surface=flatten, u=code_block, v=code_block)
Z = Vector.Z(normalAtParameter)
code_block_2 = CodeBlock { 1; -1; }
eq = Z == code_block_2.out0
filterByBoolMask = List.FilterByBoolMask(list=flatten, mask=eq)
code_block_3 = CodeBlock { 0.5; }
normalAtParameter_2 = Surface.NormalAtParameter(surface=filterByBoolMask.out, u=code_block_3, v=code_block_3)
Z_2 = Vector.Z(normalAtParameter_2)
eq_2 = Z_2 == code_block_2.out1
filterByBoolMask_2 = List.FilterByBoolMask(list=filterByBoolMask.out, mask=eq_2)
code_block_4 = CodeBlock(bottomFace=filterByBoolMask_2.in, topFace=filterByBoolMask.in, restFaces=filterByBoolMask_2.out) { bottomFace; topFace; restFaces; }
bottomFace = Output(code_block_4.bottomFace)
topFace = Output(code_block_4.topFace)
restFaces = Output(code_block_4.restFaces)
