# Dynamo custom node Solid Volume Sum Meter Cubic.dyf (Dynamo 0.9.1.4062)
# category: Geometry.Solid

solids = Input()
volume = Solid.Volume(solids)
sum = Math.Sum(volume)
code_block = CodeBlock { 1000000000; }
div = sum / code_block
code_block_2 = CodeBlock { 3; }
round = Math.Round(number=div, digits=code_block_2)
Output = Output(round)  # ""
