# Dynamo custom node Solid to Sufaces filtered vector Z.dyf (Dynamo 0.9.1.4062)
# category: Revit.Selection

eq = _ == _
Solids = Input()
explode = Geometry.Explode(Solids)
flatten = Flatten(explode)
code_block = CodeBlock { 0.5; }
normalAtParameter = Surface.NormalAtParameter(surface=flatten, u=code_block, v=code_block)
Z = Vector.Z(normalAtParameter)
ZValue = Input()
ne = Z != ZValue
filterByBoolMask = List.FilterByBoolMask(list=flatten, mask=ne)
ResultSurfaces = Output(filterByBoolMask.in)
