# Dynamo graph 01.dyn (Dynamo 0.9.1.4062)

file_path = Filename("C:\Users\USER\Downloads\TAG MONG WH1.xls")
fromPath = FileObject(file_path)  # "File.FromPath"
code_block = CodeBlock { "Summary"; false; }
readFromFile = Excel.ReadFromFile(file=fromPath, sheetName=code_block.out0, readAsStrings=code_block.out1)
deconstruct = List.Deconstruct(list=readFromFile)
transpose = List.Transpose(deconstruct.rest)
code_block_2 = CodeBlock(list=transpose) { values = list[0]; x = list[1]; y = list[2]; z= list[3]; rot = list[4]; }
toNumber = String.ToNumber(code_block_2.z)
round = Math.Round(toNumber)
toNumber_2 = String.ToNumber(code_block_2.rot)
round_2 = Math.Round(toNumber_2)
family_type_name = StringInput("1000x1000x1000")
byName = FamilyType.ByName(family_type_name)
file_path_2 = Filename("C:\Users\USER\Downloads\MONG WH1.xls")
fromPath_2 = FileObject(file_path_2)  # "File.FromPath"
code_block_3 = CodeBlock { "Summary"; false; }
readFromFile_2 = Excel.ReadFromFile(file=fromPath_2, sheetName=code_block_3.out0, readAsStrings=code_block_3.out1)
deconstruct_2 = List.Deconstruct(list=readFromFile_2)
transpose_2 = List.Transpose(deconstruct_2.rest)
code_block_4 = CodeBlock(list=transpose_2) { blocknames = list[0]; x = list[1]; y = list[2]; z= list[3]; rot = list[4]; }
toNumber_3 = String.ToNumber(code_block_4.x)
round_3 = Math.Round(toNumber_3)
toNumber_4 = String.ToNumber(code_block_4.y)
round_4 = Math.Round(toNumber_4)
byCoordinates = Point.ByCoordinates(x=round_3, y=round_4)
levels = Levels("Level 1")
byPointAndLevel = FamilyInstance.ByPointAndLevel(familyType=byName, point=byCoordinates, level=levels)
toNumber_5 = String.ToNumber(code_block_4.z)
round_5 = Math.Round(toNumber_5)
setRotation = FamilyInstance.SetRotation(familyInstance=byPointAndLevel, degree=round_5)
code_block_5 = CodeBlock { "Height Offset From Level"; "Comments"; }
toNumber_6 = String.ToNumber(code_block_4.rot)
round_6 = Math.Round(toNumber_6)
setParameterByName = Element.SetParameterByName(element=setRotation, parameterName=code_block_5.out0, value=round_6)

# group: Infomation Processes
inputs = CodeBlock(elems=setParameterByName, newInfos=code_block_4.blocknames) { elems; newInfos; }
getParameterValueByName = Element.GetParameterValueByName(element=inputs.elems, parameterName=code_block_5.out1)
python_script_append_info_to = Python(IN[0]=getParameterValueByName, IN[1]=inputs.newInfos)  # "Python Script-Append Info to Right if not exist"
# ---------- python_script_append_info_to.python (46 lines) ----------
import clr
clr.AddReference('ProtoGeometry')
from Autodesk.DesignScript.Geometry import *
#The inputs to this node will be stored as a list in the IN variables.
dataEnteringNode = IN

def replaceInfo(old,beReplaced,newInfoReplace):
	res = []
	if beReplaced in old:
		res = old.replace(beReplaced,newInfoReplace)
	else:
		res = old
	return res


def appendInfo(breakText,old,new):
	res = []
	str1 = "{}{}{}"
	str2="{}"
	if not new in old:
		res = str1.format(old,breakText,new)
	else:
		res = str2.format(old)
	return res


oldInfos = IN[0]
newInfos = IN[1]

res = []
test = []

flag1 = len(oldInfos) == len(newInfos)
if flag1:
	OUT = "Count not matched"


for i in range(len(newInfos)):
	n = newInfos[i]
	o = oldInfos[i]
	
	res.append(appendInfo(", ",o,n))

		
#Assign your output to the OUT variable.
OUT = res
# ----------------------------------------
setParameterByName_2 = Element.SetParameterByName(element=inputs.elems, parameterName=code_block_5.out1, value=python_script_append_info_to)

create = List.Create(round_3, round_4)
toNumber_7 = String.ToNumber(code_block_2.x)
round_7 = Math.Round(toNumber_7)
toNumber_8 = String.ToNumber(code_block_2.y)
round_8 = Math.Round(toNumber_8)
create_2 = List.Create(round_7, round_8)
python_script = Python(IN[0]=create, IN[1]=create_2)
# ---------- python_script.python (31 lines) ----------
import clr
clr.AddReference('ProtoGeometry')
from Autodesk.DesignScript.Geometry import *
#The inputs to this node will be stored as a list in the IN variables.
dataEnteringNode = IN

listXY1 = IN[0]
listXY2 = IN[1]

def findNearestPointIndices(count,listX1,listX2,listY1,listY2):
	idxs = []
	for i in range(len(listX1)):
		x1 = listX1[i]
		y1 = listY1[i]
		res = []
		for j in range(len(listX2)):
			x2 = listX2[j]
			y2 = listY2[j]
			distance = ((x1-x2)**2 + (y1-y2)**2)**0.5
			res.append(distance)			
		idx = [i[0] for i in sorted(enumerate(res), key=lambda x:x[1])]#sorted(range(len(res)),key=res.__getitem__)		
		idx.sort(reverse=True)
		
		idxs.append(idx[:count])
	#res.sort()		
	return idxs

res = findNearestPointIndices(1,listXY1[0],listXY1[1],listXY2[0],listXY2[1])

#Assign your output to the OUT variable.
OUT = res
# ----------------------------------------
