# Dynamo graph 00-AutoJoin Structure-210225.dyn (Dynamo 2.3.0.5885)

# note: Thứ tự ưu tiên JOIN;
# 1. Móng
# 2. Cột
# 3. Tường
# 4. Dầm
# 5. Sàn
string_category_name = StringInput("Structural Foundations")  # graph input
string_category_name_2 = StringInput("Structural Columns")  # graph input
python_script = Python(IN[0]=string_category_name, IN[1]=string_category_name_2)  # frozen
# ---------- python_script.python (115 lines) ----------
# Load the Python Standard and DesignScript Libraries
import sys
import clr
clr.AddReference('ProtoGeometry')
from Autodesk.DesignScript.Geometry import *

clr.AddReference('RevitAPI')
from Autodesk.Revit.DB import *
clr.AddReference('RevitAPIUI')
from Autodesk.Revit.UI import TaskDialog
clr.AddReference("RevitNodes")
import Revit
clr.ImportExtensions(Revit.Elements)
clr.AddReference("RevitServices")
import RevitServices
from RevitServices.Persistence import DocumentManager
from RevitServices.Transactions import TransactionManager
from System.Collections.Generic import *
clr.ImportExtensions(Revit.GeometryConversion)

clr.AddReference('System.Windows.Forms')
import System.Windows.Forms
from System.Windows.Forms import *

import Autodesk.Revit.DB.JoinGeometryUtils as JGU

##
doc = DocumentManager.Instance.CurrentDBDocument
uiapp = DocumentManager.Instance.CurrentUIApplication
app = uiapp.Application
opt = Options()
# The inputs to this node will be stored as a list in the IN variables.
dataEnteringNode = IN
# Place your code below this line

catName1 = IN[0]
catName2 = IN[1]


def allElemsOfCat (catName,doc):
	res = []
	cat = []
	for e in doc.Settings.Categories:
	#res.append(e.Name)
		if e.Name == catName.ToString():
			cat = e	
	elems = FilteredElementCollector(doc).OfCategoryId(cat.Id).WhereElementIsNotElementType()	
	for e in elems:
		res.append(e)
	return res

def allElemsIntersectedOfCat(ee,catName,doc):
	res = []
	cat = []
	for e in doc.Settings.Categories:
	#res.append(e.Name)
		if e.Name == catName.ToString():
			cat = e	
	elems = FilteredElementCollector(doc).OfCategoryId(cat.Id).WherePasses(ElementIntersectsElementFilter(ee))#.WhereElementIsNotElementType()
	for eee in elems:
		res.append(eee)
	return res 
  

def allElemsNOTIntersectedOfCat(ee,catName,doc):
	res = []
	cat = []
	for e in doc.Settings.Categories:
	#res.append(e.Name)
		if e.Name == catName.ToString():
			cat = e	
	elems = FilteredElementCollector(doc).OfCategoryId(cat.Id).WherePasses(ElementIntersectsElementFilter(ee),False)#.WhereElementIsNotElementType()
	for eee in elems:
		res.append(eee)
	return res

def joinTwoElement(a,b):	
	boolCut = JGU.AreElementsJoined(doc,a,b)
	if not boolCut:
		JGU.JoinGeometry(doc,a,b)
		if not JGU.IsCuttingElementInJoin(doc,a,b):
			JGU.SwitchJoinOrder(doc,a,b)
def UNjoinTwoElement(a,b):
	JGU.UnjoinGeometry(doc,a,b)

def joinAllEnableJoinedElemsOfCat(e,cat,doc):
	elems = allElemsIntersectedOfCat(e,cat,doc)
	for el in elems:
		joinTwoElement(e,el)
def UNjoinAllNOTJoinedElemsOfCat(e,cat,doc):
	elems = allElemsNOTIntersectedOfCat(e,cat,doc)
	for el in elems:
		UNjoinTwoElement(e,el)
#Get all elements of 2 category
elem1 = allElemsOfCat(catName1,doc)
elem2 = allElemsOfCat(catName2,doc)

# Start Transaction
TransactionManager.Instance.EnsureInTransaction(doc)
res=[]
try:
	for e1 in elem1:
		joinAllEnableJoinedElemsOfCat(e1,catName2,doc)
		UNjoinAllNOTJoinedElemsOfCat(e1,catName2,doc)
		#res = allElemsIntersectedOfCat(e1,catName2,doc)
except:
    pass
 
# End Transaction
TransactionManager.Instance.TransactionTaskDone()
doc.Regenerate()

#MessageBox.Show('Hello')
# Assign your output to the OUT variable.
OUT = elem1 , elem2,res
# ----------------------------------------
watch = Watch()  # unwired: arg0
string = StringInput("""# Load the Python Standard and DesignScript Libraries
import sys
import clr
clr.AddReference('ProtoGeometry')
from Autodesk.DesignScript.Geometry import *

clr.AddReference('RevitAPI')
from Autodesk.Revit.DB import *
clr.AddReference('RevitAPIUI')
from Autodesk.Revit.UI import TaskDialog
clr.AddReference("RevitNodes")
import Revit
clr.ImportExtensions(Revit.Elements)
clr.AddReference("RevitServices")
import RevitServices
from RevitServices.Persistence import DocumentManager
from RevitServices.Transactions import TransactionManager
from System.Collections.Generic import *
clr.ImportExtensions(Revit.GeometryConversion)

clr.AddReference('System.Windows.Forms')
import System.Windows.Forms
from System.Windows.Forms import *

import Autodesk.Revit.DB.JoinGeometryUtils as JGU

##
doc = DocumentManager.Instance.CurrentDBDocument
uiapp = DocumentManager.Instance.CurrentUIApplication
app = uiapp.Application
opt = Options()
# The inputs to this node will be stored as a list in the IN variables.
dataEnteringNode = IN
# Place your code below this line

catName1 = IN[0]
catName2 = IN[1]


def allElemsOfCat (catName,doc):
	res = []
	cat = []
	for e in doc.Settings.Categories:
	#res.append(e.Name)
		if e.Name == catName.ToString():
			cat = e	
	elems = FilteredElementCollector(doc).OfCategoryId(cat.Id).WhereElementIsNotElementType()	
	for e in elems:
		res.append(e)
	return res

def allElemsIntersectedOfCat(ee,catName,doc):
	res = []
	cat = []
	for e in doc.Settings.Categories:
	#res.append(e.Name)
		if e.Name == catName.ToString():
			cat = e	
	elems = FilteredElementCollector(doc).OfCategoryId(cat.Id).WherePasses(ElementIntersectsElementFilter(ee))#.WhereElementIsNotElementType()
	for eee in elems:
		res.append(eee)
	return res 
  

def allElemsNOTIntersectedOfCat(ee,catName,doc):
	res = []
	cat = []
	for e in doc.Settings.Categories:
	#res.append(e.Name)
		if e.Name == catName.ToString():
			cat = e	
	elems = FilteredElementCollector(doc).OfCategoryId(cat.Id).WherePasses(ElementIntersectsElementFilter(ee),False)#.WhereElementIsNotElementType()
	for eee in elems:
		res.append(eee)
	return res

def joinTwoElement(a,b):	
	boolCut = JGU.AreElementsJoined(doc,a,b)
	if not boolCut:
		JGU.JoinGeometry(doc,a,b)
		if not JGU.IsCuttingElementInJoin(doc,a,b):
			JGU.SwitchJoinOrder(doc,a,b)
def UNjoinTwoElement(a,b):
	JGU.UnjoinGeometry(doc,a,b)

def joinAllEnableJoinedElemsOfCat(e,cat,doc):
	elems = allElemsIntersectedOfCat(e,cat,doc)
	for el in elems:
		joinTwoElement(e,el)
def UNjoinAllNOTJoinedElemsOfCat(e,cat,doc):
	elems = allElemsNOTIntersectedOfCat(e,cat,doc)
	for el in elems:
		UNjoinTwoElement(e,el)
#Get all elements of 2 category
elem1 = allElemsOfCat(catName1,doc)
elem2 = allElemsOfCat(catName2,doc)

# Start Transaction
TransactionManager.Instance.EnsureInTransaction(doc)
res=[]
try:
	for e1 in elem1:
		joinAllEnableJoinedElemsOfCat(e1,catName2,doc)
		UNjoinAllNOTJoinedElemsOfCat(e1,catName2,doc)
		#res = allElemsIntersectedOfCat(e1,catName2,doc)
except:
    pass
 
# End Transaction
TransactionManager.Instance.TransactionTaskDone()
doc.Regenerate()

#MessageBox.Show('Hello')
# Assign your output to the OUT variable.
OUT = elem1 , elem2,res""")
python_script_from_string = PythonStringNode(script=string, IN[0]=string_category_name, IN[1]=string_category_name_2)
string_category_name_3 = StringInput("Walls")  # graph input
python_script_from_string_2 = PythonStringNode(script=string, IN[0]=string_category_name, IN[1]=string_category_name_3)
string_category_name_4 = StringInput("Structural Framing")  # graph input
python_script_from_string_3 = PythonStringNode(script=string, IN[0]=string_category_name, IN[1]=string_category_name_4)
string_category_name_5 = StringInput("Floors")  # graph input
python_script_from_string_4 = PythonStringNode(script=string, IN[0]=string_category_name, IN[1]=string_category_name_5)
python_script_from_string_5 = PythonStringNode(script=string, IN[0]=string_category_name_2, IN[1]=string_category_name_3)
python_script_from_string_6 = PythonStringNode(script=string, IN[0]=string_category_name_2, IN[1]=string_category_name_4)
python_script_from_string_7 = PythonStringNode(script=string, IN[0]=string_category_name_2, IN[1]=string_category_name_5)
python_script_from_string_8 = PythonStringNode(script=string, IN[0]=string_category_name_3, IN[1]=string_category_name_4)
python_script_from_string_9 = PythonStringNode(script=string, IN[0]=string_category_name_3, IN[1]=string_category_name_5)
python_script_from_string_10 = PythonStringNode(script=string, IN[0]=string_category_name_4, IN[1]=string_category_name_5)
python_script_2 = Python()  # frozen; unwired: IN[0]; same code as python_script
