# Dynamo graph 01-OUTPUT-00-WRITE EXCEL REQUIREMENT TO TXT-2.dyn (Dynamo 2.3.0.5885)

python_script_setup_units = Python()  # unwired: IN[0]
# ---------- python_script_setup_units.python (60 lines) ----------
# Load the Python Standard and DesignScript Libraries
import sys
import clr
clr.AddReference('ProtoGeometry')
from Autodesk.DesignScript.Geometry import *

clr.AddReference('RevitAPI')
from Autodesk.Revit.DB import *
clr.AddReference('RevitAPIUI')
from Autodesk.Revit.UI import TaskDialog
clr.AddReference("RevitNodes")
import Revit
clr.ImportExtensions(Revit.Elements)
clr.AddReference("RevitServices")
import RevitServices
from RevitServices.Persistence import DocumentManager
from RevitServices.Transactions import TransactionManager
from System.Collections.Generic import *
clr.ImportExtensions(Revit.GeometryConversion)

##
doc = DocumentManager.Instance.CurrentDBDocument
uiapp = DocumentManager.Instance.CurrentUIApplication
app = uiapp.Application


# The inputs to this node will be stored as a list in the IN variables.
dataEnteringNode = IN

# Place your code below this line


t = Transaction(doc)
	
t.Start("Units setup")
try:
	#Area
	unit = Units(UnitSystem.Metric)

	fmOp = FormatOptions(DisplayUnitType.DUT_SQUARE_METERS,UnitSymbolType.UST_NONE,0.001)
	
	unit.SetFormatOptions(UnitType.UT_Area,fmOp)
	
	doc.SetUnits(unit)
	#Volume
	unit1 = Units(UnitSystem.Metric)

	fmOp1 = FormatOptions(DisplayUnitType.DUT_CUBIC_METERS,UnitSymbolType.UST_NONE,0.001)
	
	unit.SetFormatOptions(UnitType.UT_Volume,fmOp1)
	
	doc.SetUnits(unit)
	#doc.GetUnits().SetFormatOptions(UnitType.UT_Area,fmOp)
except Exception, e:
	pass
t.Commit()


# Assign your output to the OUT variable.
OUT = 0
# ----------------------------------------

# group: DIR
browse_dir_manualy = BoolSelector(false)  # graph input
directory_path = Directory("R:\BimESC\00-BIM STANDARD\DYNAMO\210223")  # graph input

# group: Get Revit models' dir
python_script = Python()  # unwired: IN[0]
# ---------- python_script.python (50 lines) ----------
# Load the Python Standard and DesignScript Libraries
import sys
import clr
clr.AddReference('ProtoGeometry')
from Autodesk.DesignScript.Geometry import *

clr.AddReference('RevitAPI')
from Autodesk.Revit.DB import *
clr.AddReference('RevitAPIUI')
from Autodesk.Revit.UI import TaskDialog
clr.AddReference("RevitNodes")
import Revit
clr.ImportExtensions(Revit.Elements)
clr.AddReference("RevitServices")
import RevitServices
from RevitServices.Persistence import DocumentManager
from RevitServices.Transactions import TransactionManager
from System.Collections.Generic import *
clr.ImportExtensions(Revit.GeometryConversion)

##
doc = DocumentManager.Instance.CurrentDBDocument
uiapp = DocumentManager.Instance.CurrentUIApplication
app = uiapp.Application

opt = Options()
# The inputs to this node will be stored as a list in the IN variables.
dataEnteringNode = IN



##

res = []
dir = ""
dataFullPath =""

#
try:
	p = doc.PathName.split("\\")
	pp = p[0:len(p)-1]

	for s in pp:
		dir += s + "\\"
except:
	pass


# Assign your output to the OUT variable.
OUT = dir
# ----------------------------------------

if_ = If(test=browse_dir_manualy, true=directory_path, false=python_script)

# group (continued): Get Revit models' dir
code_block = CodeBlock(dir=if_) { dir; }

code_block_2 = CodeBlock { excelFileName = "BIMData"; }
code_block_3 = CodeBlock(dir=code_block, shn=code_block_2) { dir+shn+".xlsx"; true; }
file_from_path = FileObject(path=code_block_3.out0)

# group: INPUT MAIN
code_block_4 = CodeBlock { shn = "QTOreq"; SOCats = "SOCats"; }

importExcel = Data.ImportExcel(file=file_from_path, sheetName=code_block_4.SOCats, readAsStrings=code_block_3.out1, showExcel=code_block_3.out1)

# group: write to txt
code_block_5 = CodeBlock(dir=code_block, shn=code_block_4.SOCats) { dir+shn+".txt"; }
python_script_write_txt = Python(IN[0]=importExcel, IN[1]=code_block_5)
# ---------- python_script_write_txt.python (68 lines) ----------
# Load the Python Standard and DesignScript Libraries
import sys
import clr
clr.AddReference('ProtoGeometry')
from Autodesk.DesignScript.Geometry import *

clr.AddReference('System.IO')
clr.AddReference('System.Drawing')
clr.AddReference('System.Reflection')
clr.AddReference('System.Threading')
clr.AddReference("System.Windows.Forms")

import System
import System.IO
import System.Drawing
import System.Reflection
import System.Windows.Forms

from System.Threading import ApartmentState, Thread, ThreadStart
from System.Windows.Forms import *

import os
# The inputs to this node will be stored as a list in the IN variables.
dataEnteringNode = IN
exDat = IN[0]
path = IN[1]
#list1Line = []
allText=""

TAB = "\t"
BREAKLINE = "\n"

test1 = os.path.isdir(path)
test2 = os.path.exists(path)
test3 = os.path.isfile(path)

# Place your code below this line

def writeTxtFromExcelDat(exDat,_TAB,_BREAKLINE): #from excel data list
	allText=""
	TAB = _TAB
	BREAKLINE = _BREAKLINE	
	for d in exDat:
		str = ""
		strF = "{0}{1}"		
		if d[0] and len(d)>0:		
			for c in d:
				if c:
					str += strF.format(c,TAB)
		if len(str)>0:
			str += BREAKLINE	
		#list1Line.append(str)
		allText += str	
	f = open(path,"w")
	f.write(allText.encode('utf8'))
	f.close
	return allText
def writeTxtFromTxtString(exDat,_TAB,_BREAKLINE): #from txt string	
	f = open(path,"w")
	f.write(exDat.encode('utf8'))
	f.close
	return exDat
###################
if not test1 and len(exDat) >0:
	allText = writeTxtFromExcelDat(exDat,TAB,BREAKLINE)
#MessageBox.Show(allText)
# Assign your output to the OUT variable.
OUT = allText
# ----------------------------------------

importExcel_2 = Data.ImportExcel(file=file_from_path, sheetName=code_block_4.shn, readAsStrings=code_block_3.out1, showExcel=code_block_3.out1)

# group: write to txt
code_block_6 = CodeBlock(dir=code_block, shn=code_block_4.shn) { dir+shn+".txt"; }
python_script_write_txt_2 = Python(IN[0]=importExcel_2, IN[1]=code_block_6)  # same code as python_script_write_txt
