# Dynamo graph 02-DELETE SHARED PARAMETER-BY NAMEs.dyn "DELETE SHARED PARAMETER-BY NAMEs" (Dynamo 2.3.0.5885)

parameter_name = StringInput("FormWork Area")  # graph input
category_name = StringInput("Structural Foundations")  # graph input
python_script_detete_parameters = Python(IN[0]=parameter_name, IN[1]=category_name)  # "Python Script-DETETE PARAMETERS by name"
# ---------- python_script_detete_parameters.python (117 lines) ----------
# Load the Python Standard and DesignScript Libraries
import sys
import clr
clr.AddReference('ProtoGeometry')
from Autodesk.DesignScript.Geometry import *

clr.AddReference('RevitAPI')
from Autodesk.Revit.DB import *
from Autodesk.Revit.DB.ExternalFileUtils import *
from Autodesk.Revit.Creation import *

clr.AddReference('RevitAPIUI')
from Autodesk.Revit.UI import TaskDialog
clr.AddReference("RevitNodes")
import Revit
clr.ImportExtensions(Revit.Elements)
clr.AddReference("RevitServices")
import RevitServices
from RevitServices.Persistence import DocumentManager
from RevitServices.Transactions import TransactionManager
from System.Collections.Generic import *
clr.ImportExtensions(Revit.GeometryConversion)
import itertools
##
doc = DocumentManager.Instance.CurrentDBDocument
uiapp = DocumentManager.Instance.CurrentUIApplication
app = uiapp.Application


opt = Options()
# The inputs to this node will be stored as a list in the IN variables.
dataEnteringNode = IN

paramName = IN[0]
catName = IN[1]
"""
["Structural Foundations"
,"Structural Framing"
,"Structural Columns"
,"Floors"
,"Walls"
,"Ceilings"
,"Columns"
,"Doors"
,"Windows"
,"Stairs"
,"Ramps"]
"""

##Results
res = []
res1 = []
res2 = []
res3 = []
res4 = []
res5 = []

paraDefs = []
paraDefNames = []
##
def getParameterDefinitions(app):
	paraDefs = []
	paraDefNames = []
	definition = app.OpenSharedParameterFile()
	#res = definition.Groups.Item["COF"].Name	
	#CASE parameter file has ONLY 1 COF group
	defGSenum = enumerate(definition.Groups.GetEnumerator())
	for defG in defGSenum:
		if defG[1].Name == "COF":
			dg = defG[1]
			des = dg.Definitions
			for de in des:
				#str=de.GUID+spbr+de.Name+spbr+de.ParameterType+spbr+de.ParameterGroups+spbr+de.Visible+spbr+de.Description+spbr+de.UserModifiable+spbr+de.HideWhenNoValue # FAIL ParameterGroups
				paraDefs.append(de)
				paraDefNames.append(de.Name)
	return paraDefs, paraDefNames
def createMultiParameter(doc,paraDefs,cates):
	t = Transaction(doc)
	t.Start("Add Parameter")
	catsenum = enumerate(doc.Settings.Categories.GetEnumerator())
	catset = CategorySet()	
	for cat in catsenum:	
		for cate in cates:
			if cat[1].Name == cate:
				catset.Insert(cat[1])
	for de in paraDefs:
		# Case ALL
		if de.Name.split(spbr)[1] == "GEN" or de.Name.split(spbr)[1] == "CON":
			newIB = InstanceBinding(catset)
			doc.ParameterBindings.Insert(de,newIB,BuiltInParameterGroup.PG_CONSTRUCTION)
			#update by ReInsert
			doc.ParameterBindings.ReInsert(de,newIB,BuiltInParameterGroup.PG_CONSTRUCTION)
	t.Commit()

def DELETEparameterByName(doc,paramName,catName):
	t = Transaction(doc)
	t.Start("Delete Parameter")
	categories = doc.Settings.Categories
	for c in categories:
		if catName and c.Name == catName:
			e = FilteredElementCollector(doc).OfCategoryId(c.Id).WhereElementIsNotElementType().ToElements()[0]
			try:			
				param = e.LookupParameter(paramName)
				doc.ParameterBindings.Remove(param.Definition)
			except Exception, ex:
				pass
	t.Commit()
	return 0

	
## get share parameter from file
spbr = "_" #shareParamDataBreak
extDefs=[]
definition=""
	
# Assign yourr output to the OUT variable.
OUT = DELETEparameterByName(doc,paramName,catName)
# ----------------------------------------
