# Dynamo graph 02-INPUT-00-CREATE SHARED PARAMETER & SETUP UNIT-210225.dyn (Dynamo 2.3.0.5885)

# group: DIR
browse_dir_manualy = BoolSelector(false)  # graph input
directory_path = Directory("R:\BimESC\00-BIM STANDARD\DYNAMO\210223")  # graph input

# group: Get Revit models' dir
python_script = Python()  # unwired: IN[0]
# ---------- python_script.python (50 lines) ----------
# Load the Python Standard and DesignScript Libraries
import sys
import clr
clr.AddReference('ProtoGeometry')
from Autodesk.DesignScript.Geometry import *

clr.AddReference('RevitAPI')
from Autodesk.Revit.DB import *
clr.AddReference('RevitAPIUI')
from Autodesk.Revit.UI import TaskDialog
clr.AddReference("RevitNodes")
import Revit
clr.ImportExtensions(Revit.Elements)
clr.AddReference("RevitServices")
import RevitServices
from RevitServices.Persistence import DocumentManager
from RevitServices.Transactions import TransactionManager
from System.Collections.Generic import *
clr.ImportExtensions(Revit.GeometryConversion)

##
doc = DocumentManager.Instance.CurrentDBDocument
uiapp = DocumentManager.Instance.CurrentUIApplication
app = uiapp.Application

opt = Options()
# The inputs to this node will be stored as a list in the IN variables.
dataEnteringNode = IN



##

res = []
dir = ""
dataFullPath =""

#
try:
	p = doc.PathName.split("\\")
	pp = p[0:len(p)-1]

	for s in pp:
		dir += s + "\\"
except:
	pass


# Assign your output to the OUT variable.
OUT = dir
# ----------------------------------------

if_ = If(test=browse_dir_manualy, true=directory_path, false=python_script)

# group (continued): Get Revit models' dir
code_block = CodeBlock(dir=if_) { dir; }

# group: INPUT MAIN
code_block_2 = CodeBlock { shn = "QTO.ITEM.DAT"; SOCats = "SOCats"; QTOdata = "QTO.ITEM.DAT"; }

# group: create Category requirements
code_block_3 = CodeBlock(dir=code_block, shn=code_block_2.SOCats) { dir+shn+".txt"; }
python_script_read_txt_out_list = Python(IN[0]=code_block_3)  # "Python Script-Read txt-OUT List Cats"
# ---------- python_script_read_txt_out_list.python (43 lines) ----------
# Load the Python Standard and DesignScript Libraries
import sys
import clr
clr.AddReference('ProtoGeometry')
from Autodesk.DesignScript.Geometry import *

import os

# The inputs to this node will be stored as a list in the IN variables.
dataEnteringNode = IN
path = IN[0]
# ini
TAB = "\t"

###
def createQTOreqDic (path):
	dat=[]
	dic = []
	with open(path,"r") as f:
		lines = f.readlines()
		for l in lines:
			if len(l)>0:
				d =[]
				for att in l.decode('utf-8').split(TAB):
					d.append(att)
				dat.append(l.decode('utf-8'))
	for d in dat[1:]:
		#di = {}
		#di[d.split(TAB)[0]] = d.split(TAB)[1]
		dic.append(d.split(TAB)[0])
		#for att in d.split(TAB):
	
	return dic
# Place your code below this line

test1 = os.path.isdir(path)
test2 = os.path.exists(path)
test3 = os.path.isfile(path)

dat=createQTOreqDic (path)

# Assign your output to the OUT variable.
OUT = dat
# ----------------------------------------

python_script_create_parameters = Python(IN[0]=python_script_read_txt_out_list)
# ---------- python_script_create_parameters.python (112 lines) ----------
# Load the Python Standard and DesignScript Libraries
import sys
import clr
clr.AddReference('ProtoGeometry')
from Autodesk.DesignScript.Geometry import *

clr.AddReference('RevitAPI')
from Autodesk.Revit.DB import *
from Autodesk.Revit.DB.ExternalFileUtils import *
from Autodesk.Revit.Creation import *

clr.AddReference('RevitAPIUI')
from Autodesk.Revit.UI import TaskDialog
clr.AddReference("RevitNodes")
import Revit
clr.ImportExtensions(Revit.Elements)
clr.AddReference("RevitServices")
import RevitServices
from RevitServices.Persistence import DocumentManager
from RevitServices.Transactions import TransactionManager
from System.Collections.Generic import *
clr.ImportExtensions(Revit.GeometryConversion)
import itertools
##
doc = DocumentManager.Instance.CurrentDBDocument
uiapp = DocumentManager.Instance.CurrentUIApplication
app = uiapp.Application


opt = Options()
# The inputs to this node will be stored as a list in the IN variables.
dataEnteringNode = IN

cates = IN[0]
"""
["Structural Foundations"
,"Structural Framing"
,"Structural Columns"
,"Floors"
,"Walls"
,"Ceilings"
,"Columns"
,"Doors"
,"Windows"
,"Stairs"
,"Ramps"]
"""

##Results
res = []
res1 = []
res2 = []
res3 = []
res4 = []
res5 = []

paraDefs = []
paraDefNames = []
##
def getParameterDefinitions(app):
	paraDefs = []
	paraDefNames = []
	definition = app.OpenSharedParameterFile()
	#res = definition.Groups.Item["COF"].Name	
	#CASE parameter file has ONLY 1 COF group
	defGSenum = enumerate(definition.Groups.GetEnumerator())
	for defG in defGSenum:
		if defG[1].Name == "COF":
			dg = defG[1]
			des = dg.Definitions
			for de in des:
				#str=de.GUID+spbr+de.Name+spbr+de.ParameterType+spbr+de.ParameterGroups+spbr+de.Visible+spbr+de.Description+spbr+de.UserModifiable+spbr+de.HideWhenNoValue # FAIL ParameterGroups
				paraDefs.append(de)
				paraDefNames.append(de.Name)
	return paraDefs, paraDefNames
def createMultiParameter(doc,paraDefs,cates):
	t = Transaction(doc)
	t.Start("Add Parameter")
	catsenum = enumerate(doc.Settings.Categories.GetEnumerator())
	catset = CategorySet()	
	for cat in catsenum:	
		for cate in cates:
			if cat[1].Name == cate:
				catset.Insert(cat[1])
	for de in paraDefs:
		# Case ALL
		if de.Name.split(spbr)[1] == "GEN" or de.Name.split(spbr)[1] == "CON":
			newIB = InstanceBinding(catset)
			doc.ParameterBindings.Insert(de,newIB,BuiltInParameterGroup.PG_CONSTRUCTION)
			#update by ReInsert
			doc.ParameterBindings.ReInsert(de,newIB,BuiltInParameterGroup.PG_CONSTRUCTION)
	t.Commit()


## get share parameter from file
spbr = "_" #shareParamDataBreak
extDefs=[]
definition=""
try:
	paraDefs = getParameterDefinitions(app)[0]
	paraDefNames = getParameterDefinitions(app)[1]
except Exception, e:
	OUT = e.ToString()

try:
	createMultiParameter(doc,paraDefs,cates)
except Exception, e:
	OUT = e.ToString()

	
# Assign yourr output to the OUT variable.
OUT = paraDefNames
# ----------------------------------------
python_script_units = Python()  # unwired: IN[0]
# ---------- python_script_units.python (60 lines) ----------
# Load the Python Standard and DesignScript Libraries
import sys
import clr
clr.AddReference('ProtoGeometry')
from Autodesk.DesignScript.Geometry import *

clr.AddReference('RevitAPI')
from Autodesk.Revit.DB import *
clr.AddReference('RevitAPIUI')
from Autodesk.Revit.UI import TaskDialog
clr.AddReference("RevitNodes")
import Revit
clr.ImportExtensions(Revit.Elements)
clr.AddReference("RevitServices")
import RevitServices
from RevitServices.Persistence import DocumentManager
from RevitServices.Transactions import TransactionManager
from System.Collections.Generic import *
clr.ImportExtensions(Revit.GeometryConversion)

##
doc = DocumentManager.Instance.CurrentDBDocument
uiapp = DocumentManager.Instance.CurrentUIApplication
app = uiapp.Application


# The inputs to this node will be stored as a list in the IN variables.
dataEnteringNode = IN

# Place your code below this line


t = Transaction(doc)
	
t.Start("Units setup")
try:
	#Area
	unit = Units(UnitSystem.Metric)

	fmOp = FormatOptions(DisplayUnitType.DUT_SQUARE_METERS,UnitSymbolType.UST_NONE,0.001)
	
	unit.SetFormatOptions(UnitType.UT_Area,fmOp)
	
	doc.SetUnits(unit)
	#Volume
	unit1 = Units(UnitSystem.Metric)

	fmOp1 = FormatOptions(DisplayUnitType.DUT_CUBIC_METERS,UnitSymbolType.UST_NONE,0.001)
	
	unit.SetFormatOptions(UnitType.UT_Volume,fmOp1)
	
	doc.SetUnits(unit)
	#doc.GetUnits().SetFormatOptions(UnitType.UT_Area,fmOp)
except Exception, e:
	pass
t.Commit()


# Assign your output to the OUT variable.
OUT = 0
# ----------------------------------------
