# Dynamo graph 05-INPUT-03-Repeat Value-2.dyn (Dynamo 2.3.0.5885)

brow_dir_path_manual = BoolSelector(false)  # graph input
directory_path = Directory("C:\Users\hnthanhhang\Desktop")  # graph input
code_block = CodeBlock(dir=directory_path) { dir + "\\"; }
python_script = Python()
# ---------- python_script.python (41 lines) ----------
# Load the Python Standard and DesignScript Libraries
import sys
import clr
clr.AddReference('ProtoGeometry')
from Autodesk.DesignScript.Geometry import *

clr.AddReference('RevitAPI')
from Autodesk.Revit.DB import *
clr.AddReference('RevitAPIUI')
from Autodesk.Revit.UI import TaskDialog
clr.AddReference("RevitNodes")
import Revit
clr.ImportExtensions(Revit.Elements)
clr.AddReference("RevitServices")
import RevitServices
from RevitServices.Persistence import DocumentManager
from RevitServices.Transactions import TransactionManager
from System.Collections.Generic import *
clr.ImportExtensions(Revit.GeometryConversion)

##
doc = DocumentManager.Instance.CurrentDBDocument
uiapp = DocumentManager.Instance.CurrentUIApplication
app = uiapp.Application

opt = Options()
# The inputs to this node will be stored as a list in the IN variables.
dataEnteringNode = IN

dir = ""
try:
	p = doc.PathName.split("\\")
	pp = p[0:len(p)-1]

	for s in pp:
		dir += s + "\\"
except:
	pass

# Assign your output to the OUT variable.
OUT = dir,doc.PathName.split("\\")[-1].split(".")[0]
# ----------------------------------------
code_block_2 = CodeBlock(res=python_script) { dir = res[0]; pn = res[1]; }
if_ = If(test=brow_dir_path_manual, true=code_block, false=code_block_2.dir)
code_block_3 = CodeBlock(path=if_) { path; }
string_const = CodeBlock { QTOreq = "QTOreq"; SOCats = "SOCats"; }
code_block_4 = CodeBlock(dir=code_block_3, shn=string_const.SOCats) { dir+shn+".txt"; }
python_script_read_txt_out_list = Python(IN[0]=code_block_4)  # "Python Script-Read txt-OUT List Cats"
# ---------- python_script_read_txt_out_list.python (43 lines) ----------
# Load the Python Standard and DesignScript Libraries
import sys
import clr
clr.AddReference('ProtoGeometry')
from Autodesk.DesignScript.Geometry import *

import os

# The inputs to this node will be stored as a list in the IN variables.
dataEnteringNode = IN
path = IN[0]
# ini
TAB = "\t"

###
def createQTOreqDic (path):
	dat=[]
	dic = []
	with open(path,"r") as f:
		lines = f.readlines()
		for l in lines:
			if len(l)>0:
				d =[]
				for att in l.decode('utf-8').split(TAB):
					d.append(att)
				dat.append(l.decode('utf-8'))
	for d in dat[1:]:
		#di = {}
		#di[d.split(TAB)[0]] = d.split(TAB)[1]
		dic.append(d.split(TAB)[0])
		#for att in d.split(TAB):
	
	return dic
# Place your code below this line

test1 = os.path.isdir(path)
test2 = os.path.exists(path)
test3 = os.path.isfile(path)

dat=createQTOreqDic (path)

# Assign your output to the OUT variable.
OUT = dat
# ----------------------------------------
parameter_name = StringInput("COF_GEN__RepeatValue")  # graph input
parameter_value = DoubleInput(1)  # graph input
python_script_get_elements_of = Python(IN[0]=python_script_read_txt_out_list, IN[1]=parameter_name, IN[2]=parameter_value)  # "Python Script-Get Elements Of Listed Categories & Set Parameter Value"
# ---------- python_script_get_elements_of.python (66 lines) ----------
# Load the Python Standard and DesignScript Libraries
import sys
import clr
clr.AddReference('ProtoGeometry')
from Autodesk.DesignScript.Geometry import *

clr.AddReference('RevitAPI')
from Autodesk.Revit.DB import *
clr.AddReference('RevitAPIUI')
from Autodesk.Revit.UI import TaskDialog
clr.AddReference("RevitNodes")
import Revit
clr.ImportExtensions(Revit.Elements)
clr.AddReference("RevitServices")
import RevitServices
from RevitServices.Persistence import DocumentManager
from RevitServices.Transactions import TransactionManager
from System.Collections.Generic import *
clr.ImportExtensions(Revit.GeometryConversion)

##
doc = DocumentManager.Instance.CurrentDBDocument
uiapp = DocumentManager.Instance.CurrentUIApplication
app = uiapp.Application

opt = Options()
categories = doc.Settings.Categories
# The inputs to this node will be stored as a list in the IN variables.
dataEnteringNode = IN
cats = IN[0]
paramName = IN[1]
paramValue = IN[2]
# Place your code below this line
res = []
model_cat = []
"""
anno_cat = []
ana_cat = []
internal_cat = []"""

try:
	for c in categories:
		for cat in cats:
			if cat and c.Name == cat:
				res.append(FilteredElementCollector(doc).OfCategoryId(c.Id).WhereElementIsNotElementType().ToElements())
except Except, e:
	res.append(e)
	pass

res2 = []

TransactionManager.Instance.EnsureInTransaction(doc)	
try:
	for e in res:
		for ee in e:
			param = ee.LookupParameter(paramName)
			res2.append(ee)
			param.Set(paramValue)
		
	
except Exception, e:
	OUT = e.ToString()
TransactionManager.Instance.TransactionTaskDone()
doc.Regenerate()
# Assign your output to the OUT variable.
OUT = res2
# ----------------------------------------
