# Dynamo graph 06-INPUT-04-UniqueId-2.dyn (Dynamo 2.3.0.5885)

brow_file_path_manual = BoolSelector(false)
directory_path = Directory("C:\Users\USER\Desktop")  # graph input
python_script = Python()
# ---------- python_script.python (42 lines) ----------
# Load the Python Standard and DesignScript Libraries
import sys
import clr
clr.AddReference('ProtoGeometry')
from Autodesk.DesignScript.Geometry import *

clr.AddReference('RevitAPI')
from Autodesk.Revit.DB import *
clr.AddReference('RevitAPIUI')
from Autodesk.Revit.UI import TaskDialog
clr.AddReference("RevitNodes")
import Revit
clr.ImportExtensions(Revit.Elements)
clr.AddReference("RevitServices")
import RevitServices
from RevitServices.Persistence import DocumentManager
from RevitServices.Transactions import TransactionManager
from System.Collections.Generic import *
clr.ImportExtensions(Revit.GeometryConversion)

##
doc = DocumentManager.Instance.CurrentDBDocument
uiapp = DocumentManager.Instance.CurrentUIApplication
app = uiapp.Application

opt = Options()
# The inputs to this node will be stored as a list in the IN variables.
dataEnteringNode = IN

dir = ""
try:
	p = doc.PathName.split("\\")
	pp = p[0:len(p)-1]

	for s in pp:
		dir += s + "\\"
except:
	pass


# Assign your output to the OUT variable.
OUT = dir,doc.PathName.split("\\")[-1].split(".")[0]
# ----------------------------------------
code_block = CodeBlock(res=python_script) { dir = res[0]; pn = res[1]; }
if_ = If(test=brow_file_path_manual, true=directory_path, false=code_block.dir)
code_block_2 = CodeBlock(path=if_) { path; }
string_const = CodeBlock { QTOreq = "QTOreq"; SOCats = "SOCats"; }
code_block_3 = CodeBlock(dir=code_block_2, shn=string_const.SOCats) { dir+shn+".txt"; }
python_script_read_txt_out_list = Python(IN[0]=code_block_3)  # "Python Script-Read txt-OUT List Cats"
# ---------- python_script_read_txt_out_list.python (43 lines) ----------
# Load the Python Standard and DesignScript Libraries
import sys
import clr
clr.AddReference('ProtoGeometry')
from Autodesk.DesignScript.Geometry import *

import os

# The inputs to this node will be stored as a list in the IN variables.
dataEnteringNode = IN
path = IN[0]
# ini
TAB = "\t"

###
def createQTOreqDic (path):
	dat=[]
	dic = []
	with open(path,"r") as f:
		lines = f.readlines()
		for l in lines:
			if len(l)>0:
				d =[]
				for att in l.decode('utf-8').split(TAB):
					d.append(att)
				dat.append(l.decode('utf-8'))
	for d in dat[1:]:
		#di = {}
		#di[d.split(TAB)[0]] = d.split(TAB)[1]
		dic.append(d.split(TAB)[0])
		#for att in d.split(TAB):
	
	return dic
# Place your code below this line

test1 = os.path.isdir(path)
test2 = os.path.exists(path)
test3 = os.path.isfile(path)

dat=createQTOreqDic (path)

# Assign your output to the OUT variable.
OUT = dat
# ----------------------------------------
# note: Ghi mã Uquiqe Id của đối tượng vào Parameter chỉ định
parameter_name = StringInput("COF_GEN__UniqueID")  # graph input
python_script_get_elements_of = Python(IN[0]=python_script_read_txt_out_list, IN[1]=parameter_name)  # "Python Script-Get Elements Of Listed Categories then Write UniID"
# ---------- python_script_get_elements_of.python (51 lines) ----------
# Load the Python Standard and DesignScript Libraries
import sys
import clr
clr.AddReference('ProtoGeometry')
from Autodesk.DesignScript.Geometry import *

clr.AddReference('RevitAPI')
from Autodesk.Revit.DB import *
clr.AddReference('RevitAPIUI')
from Autodesk.Revit.UI import TaskDialog
clr.AddReference("RevitNodes")
import Revit
clr.ImportExtensions(Revit.Elements)
clr.AddReference("RevitServices")
import RevitServices
from RevitServices.Persistence import DocumentManager
from RevitServices.Transactions import TransactionManager
from System.Collections.Generic import *
clr.ImportExtensions(Revit.GeometryConversion)

##
doc = DocumentManager.Instance.CurrentDBDocument
uiapp = DocumentManager.Instance.CurrentUIApplication
app = uiapp.Application

opt = Options()
categories = doc.Settings.Categories
# The inputs to this node will be stored as a list in the IN variables.
dataEnteringNode = IN
cats = IN[0]
paramName = IN[1]
# Place your code below this line
res = []
t = Transaction(doc)

t.Start("UNIID")
	
for c in categories:
	for cat in cats:
		if cat and c.Name == cat:
			for e in FilteredElementCollector(doc).OfCategoryId(c.Id).WhereElementIsNotElementType().ToElements():
				res.append(e)
				try:			
					param = e.LookupParameter(paramName)
					param.Set(e.UniqueId)
					
				except:
					pass
t.Commit()
# Assign your output to the OUT variable.
OUT = res
# ----------------------------------------
