# Dynamo graph 07-INPUT-05-Comments.dyn "02-INPUT-01-Comments" (Dynamo 2.3.0.5885)

select_model_elements = DSModelElementsSelection()  # 24 picked in the model; graph input
parameter_name = StringInput("Comments")  # graph input
parameter_value = StringInput("Manhole")  # graph input
setParameterByName = Element.SetParameterByName(element=select_model_elements, parameterName=parameter_name, value=parameter_value)
