# Dynamo graph 08-OUTPUT-02-WRITE ALL DATA TO TXT-2.dyn (Dynamo 2.10.0.3455)

python_script_setup_units = Python()  # IronPython2; unwired: IN[0]
# ---------- python_script_setup_units.python (60 lines) ----------
# Load the Python Standard and DesignScript Libraries
import sys
import clr
clr.AddReference('ProtoGeometry')
from Autodesk.DesignScript.Geometry import *

clr.AddReference('RevitAPI')
from Autodesk.Revit.DB import *
clr.AddReference('RevitAPIUI')
from Autodesk.Revit.UI import TaskDialog
clr.AddReference("RevitNodes")
import Revit
clr.ImportExtensions(Revit.Elements)
clr.AddReference("RevitServices")
import RevitServices
from RevitServices.Persistence import DocumentManager
from RevitServices.Transactions import TransactionManager
from System.Collections.Generic import *
clr.ImportExtensions(Revit.GeometryConversion)

##
doc = DocumentManager.Instance.CurrentDBDocument
uiapp = DocumentManager.Instance.CurrentUIApplication
app = uiapp.Application


# The inputs to this node will be stored as a list in the IN variables.
dataEnteringNode = IN

# Place your code below this line


t = Transaction(doc)
	
t.Start("Units setup")
try:
	#Area
	unit = Units(UnitSystem.Metric)

	fmOp = FormatOptions(DisplayUnitType.DUT_SQUARE_METERS,UnitSymbolType.UST_NONE,0.001)
	
	unit.SetFormatOptions(UnitType.UT_Area,fmOp)
	
	doc.SetUnits(unit)
	#Volume
	unit1 = Units(UnitSystem.Metric)

	fmOp1 = FormatOptions(DisplayUnitType.DUT_CUBIC_METERS,UnitSymbolType.UST_NONE,0.001)
	
	unit.SetFormatOptions(UnitType.UT_Volume,fmOp1)
	
	doc.SetUnits(unit)
	#doc.GetUnits().SetFormatOptions(UnitType.UT_Area,fmOp)
except Exception, e:
	pass
t.Commit()


# Assign your output to the OUT variable.
OUT = 0
# ----------------------------------------

# group: DIR
browse_dir_manualy = BoolSelector(false)  # graph input
directory_path = Directory("C:\Users\USER\Downloads")  # graph input

# group: Get Revit models' dir
python_script = Python()  # IronPython2; unwired: IN[0]
# ---------- python_script.python (50 lines) ----------
# Load the Python Standard and DesignScript Libraries
import sys
import clr
clr.AddReference('ProtoGeometry')
from Autodesk.DesignScript.Geometry import *

clr.AddReference('RevitAPI')
from Autodesk.Revit.DB import *
clr.AddReference('RevitAPIUI')
from Autodesk.Revit.UI import TaskDialog
clr.AddReference("RevitNodes")
import Revit
clr.ImportExtensions(Revit.Elements)
clr.AddReference("RevitServices")
import RevitServices
from RevitServices.Persistence import DocumentManager
from RevitServices.Transactions import TransactionManager
from System.Collections.Generic import *
clr.ImportExtensions(Revit.GeometryConversion)

##
doc = DocumentManager.Instance.CurrentDBDocument
uiapp = DocumentManager.Instance.CurrentUIApplication
app = uiapp.Application

opt = Options()
# The inputs to this node will be stored as a list in the IN variables.
dataEnteringNode = IN



##

res = []
dir = ""
dataFullPath =""

#
try:
	p = doc.PathName.split("\\")
	pp = p[0:len(p)-1]

	for s in pp:
		dir += s + "\\"
except:
	pass


# Assign your output to the OUT variable.
OUT = dir,doc.PathName.split("\\")[-1].split(".")[0]
# ----------------------------------------

code_block = CodeBlock(res=python_script) { dir = res[0]; pn = res[1]; }
if_ = If(test=browse_dir_manualy, true=directory_path, false=code_block.dir)

# group (continued): Get Revit models' dir
code_block_2 = CodeBlock(dir=if_) { dir; }

# group: INPUT MAIN
code_block_3 = CodeBlock { shn = "QTO.ITEM.DAT"; SOCats = "SOCats"; QTOdata = "QTO.ITEM.DAT"; }

# group: create Category requirements
code_block_4 = CodeBlock(dir=code_block_2, shn=code_block_3.SOCats) { dir+shn+".txt"; }
python_script_read_txt_out_list = Python(IN[0]=code_block_4)  # "Python Script-Read txt-OUT List Cats"; IronPython2
# ---------- python_script_read_txt_out_list.python (43 lines) ----------
# Load the Python Standard and DesignScript Libraries
import sys
import clr
clr.AddReference('ProtoGeometry')
from Autodesk.DesignScript.Geometry import *

import os

# The inputs to this node will be stored as a list in the IN variables.
dataEnteringNode = IN
path = IN[0]
# ini
TAB = "\t"

###
def createQTOreqDic (path):
	dat=[]
	dic = []
	with open(path,"r") as f:
		lines = f.readlines()
		for l in lines:
			if len(l)>0:
				d =[]
				for att in l.decode('utf-8').split(TAB):
					d.append(att)
				dat.append(l.decode('utf-8'))
	for d in dat[1:]:
		#di = {}
		#di[d.split(TAB)[0]] = d.split(TAB)[1]
		dic.append(d.split(TAB)[0])
		#for att in d.split(TAB):
	
	return dic
# Place your code below this line

test1 = os.path.isdir(path)
test2 = os.path.exists(path)
test3 = os.path.isfile(path)

dat=createQTOreqDic (path)

# Assign your output to the OUT variable.
OUT = dat
# ----------------------------------------

# group: Get Project Inforamtion data
python_script_oneline_project = Python()  # "Python Script-OneLine Project Info Property"; IronPython2
# ---------- python_script_oneline_project.python (69 lines) ----------
# Load the Python Standard and DesignScript Libraries
import sys
import clr
clr.AddReference('ProtoGeometry')
from Autodesk.DesignScript.Geometry import *

clr.AddReference('RevitAPI')
from Autodesk.Revit.DB import *
clr.AddReference('RevitAPIUI')
from Autodesk.Revit.UI import TaskDialog
clr.AddReference("RevitNodes")
import Revit
clr.ImportExtensions(Revit.Elements)
clr.AddReference("RevitServices")
import RevitServices
from RevitServices.Persistence import DocumentManager
from RevitServices.Transactions import TransactionManager
from System.Collections.Generic import *
clr.ImportExtensions(Revit.GeometryConversion)

##
doc = DocumentManager.Instance.CurrentDBDocument
uiapp = DocumentManager.Instance.CurrentUIApplication
app = uiapp.Application
####

BREAK = "____"
ATTBREAK = " : "



def getProperties (params):
	oneline = ""
	for p in params:		
		try:
			cbTxt = "{0}{2}{1}"			
			n = p.Definition.Name
			v= ""
			if p.AsValueString():
				v = p.AsValueString()
			else:
				if p.StorageType == StorageType.String:
					if p.AsString():
						v = p.AsString()		
			oneline += cbTxt.format(n,v,ATTBREAK) + BREAK
		except:
			pass
	return oneline
###
opt = Options()
categories = doc.Settings.Categories
# The inputs to this node will be stored as a list in the IN variables.
dataEnteringNode = IN
# Place your code below this line
projectInfoDat=""

try:
	### get all elements of categories
	for c in categories:
		if c.Name == "Project Information":
			projInfo = FilteredElementCollector(doc).OfCategoryId(c.Id).WhereElementIsNotElementType().ToElements()[0]
	######## ParameterSet
	#instance property
	projectInfoDat = getProperties(projInfo.Parameters)
		
except:
	pass

OUT = projectInfoDat
# ----------------------------------------

# group: get All elements data
# note: Out Put = All oneline properties of all elements
python_script_all_oneline = Python(IN[0]=python_script_read_txt_out_list, IN[1]=python_script_oneline_project)  # "Python Script-ALL OneLine Element Property"; IronPython2
# ---------- python_script_all_oneline.python (89 lines) ----------
# Load the Python Standard and DesignScript Libraries
import sys
import clr
clr.AddReference('ProtoGeometry')
from Autodesk.DesignScript.Geometry import *

clr.AddReference('RevitAPI')
from Autodesk.Revit.DB import *
clr.AddReference('RevitAPIUI')
from Autodesk.Revit.UI import TaskDialog
clr.AddReference("RevitNodes")
import Revit
clr.ImportExtensions(Revit.Elements)
clr.AddReference("RevitServices")
import RevitServices
from RevitServices.Persistence import DocumentManager
from RevitServices.Transactions import TransactionManager
from System.Collections.Generic import *
clr.ImportExtensions(Revit.GeometryConversion)

##
doc = DocumentManager.Instance.CurrentDBDocument
uiapp = DocumentManager.Instance.CurrentUIApplication
app = uiapp.Application

opt = Options()
categories = doc.Settings.Categories
# The inputs to this node will be stored as a list in the IN variables.
dataEnteringNode = IN
cats = IN[0]
projectInfoDat = IN[1]
# Place your code below this line
res = []
model_cat = []
paramsets = []
typeparamsets = []

elemDat=[]

#NOTE

TAB = "____"
ATTBREAK = " : "
LINEBREAK = "\n"
def getProperties (params):
	oneline = ""
	for p in params:		
		try:
			cbTxt = "{0}{2}{1}"			
			n = p.Definition.Name
			v= ""
			if p.AsValueString():
				v = p.AsValueString()
			else:
				if p.StorageType == StorageType.String:
					if p.AsString():
						v = p.AsString()		
			oneline += cbTxt.format(n,v,ATTBREAK) + TAB
		except:
			pass
	return oneline

###
try:
	### get all elements of categories
	for c in categories:
		for cat in cats:
			if cat and c.Name == cat:
				for e in FilteredElementCollector(doc).OfCategoryId(c.Id).WhereElementIsNotElementType().ToElements():
					res.append(e)
except:
	pass

######## ParameterSet
strDat = ""
for e in res:
	try:
		# projectInfoDat + BREAK
		#type property
		typ = doc.GetElement(e.GetTypeId())
		strDat += getProperties(typ.Parameters) + TAB
		#instance property
		strDat +=  getProperties(e.Parameters) + TAB	
		strDat +=  LINEBREAK	
		elemDat.append(strDat)	
	except:
		pass	
# Assign your output to the OUT variable.
OUT = strDat#elemDat
# ----------------------------------------

# group: write to txt
code_block_5 = CodeBlock(dir=code_block_2, shn=code_block_3.QTOdata, pn=code_block.pn) { dir+shn+"-"+pn+".txt"; }
python_script_write_txt = Python(IN[0]=python_script_all_oneline, IN[1]=code_block_5)  # IronPython2
# ---------- python_script_write_txt.python (79 lines) ----------
# Load the Python Standard and DesignScript Libraries
import sys
import clr
clr.AddReference('ProtoGeometry')
from Autodesk.DesignScript.Geometry import *

clr.AddReference('System.IO')
clr.AddReference('System.Drawing')
clr.AddReference('System.Reflection')
clr.AddReference('System.Threading')
clr.AddReference("System.Windows.Forms")

import System
import System.IO
import System.Drawing
import System.Reflection
import System.Windows.Forms

from System.Threading import ApartmentState, Thread, ThreadStart
from System.Windows.Forms import *

from shutil import copyfile
import tempfile
import os
# The inputs to this node will be stored as a list in the IN variables.
dataEnteringNode = IN
exDat = IN[0]
_path = IN[1]
#list1Line = []
allText=""

TAB = "\t"
BREAKLINE = "\n"

test1 = os.path.isdir(_path)
test2 = os.path.exists(_path)
test3 = os.path.isfile(_path)

# Place your code below this line

#WRITE EXCEL DATA LIST TO TEMP TXT FILE THEN COPY TO TARGET PATH
def writeTxtFromExcelDat(exDat,_TAB,_BREAKLINE): #from excel data list
	allText=""
	TAB = _TAB
	BREAKLINE = _BREAKLINE	
	for d in exDat:
		str = ""
		strF = "{0}{1}"		
		if d[0] and len(d)>0:		
			for c in d:
				if c:
					str += strF.format(c,TAB)
		if len(str)>0:
			str += BREAKLINE	
		#list1Line.append(str)
		allText += str	
	f = open(path,"w")
	f.write(allText.encode('utf8'))
	f.close
	return allText
	
#WRITE "ONE_LINE" DATA TO TEMP TXT FILE THEN COPY TO TARGET PATH
def writeTxtFromTxtString(PATH, exDat,_TAB,_BREAKLINE): #from txt string
	with open(PATH,"w") as f:
		f.write(exDat.encode('utf8'))		
	copyfile(PATH, _path)
	if os.path.isfile(_path):
		os.remove(PATH)
	return exDat
###################

tempDir = tempfile.gettempdir()
fileName = _path.split("\\")[-1]
PATH = tempDir + fileName
if not test1 and len(exDat) >0:
	allText = writeTxtFromTxtString(PATH, exDat,TAB,BREAKLINE)
#MessageBox.Show(allText)
# Assign your output to the OUT variable.
OUT = allText
# ----------------------------------------

python_script_all_oneline_2 = Python(IN[0]=python_script_read_txt_out_list, IN[1]=python_script_oneline_project)  # "Python Script-ALL OneLine Element Property"; IronPython2; frozen
# ---------- python_script_all_oneline_2.python (76 lines) ----------
# Load the Python Standard and DesignScript Libraries
import sys
import clr
clr.AddReference('ProtoGeometry')
from Autodesk.DesignScript.Geometry import *

clr.AddReference('RevitAPI')
from Autodesk.Revit.DB import *
clr.AddReference('RevitAPIUI')
from Autodesk.Revit.UI import TaskDialog
clr.AddReference("RevitNodes")
import Revit
clr.ImportExtensions(Revit.Elements)
clr.AddReference("RevitServices")
import RevitServices
from RevitServices.Persistence import DocumentManager
from RevitServices.Transactions import TransactionManager
from System.Collections.Generic import *
clr.ImportExtensions(Revit.GeometryConversion)

##
doc = DocumentManager.Instance.CurrentDBDocument
uiapp = DocumentManager.Instance.CurrentUIApplication
app = uiapp.Application

opt = Options()
categories = doc.Settings.Categories
# The inputs to this node will be stored as a list in the IN variables.
dataEnteringNode = IN
cats = IN[0]
projectInfoDat = IN[1]
# Place your code below this line
res = []
model_cat = []
paramsets = []
typeparamsets = []

elemDat=[]

#NOTE

TAB = "____"
ATTBREAK = " : "
LINEBREAK = "\n"
def getProperties (params):
	oneline = ""
	for p in params:		
		try:
			cbTxt = "{0}{2}{1}"			
			n = p.Definition.Name
			v= ""
			if p.AsValueString():
				v = p.AsValueString()
			else:
				if p.StorageType == StorageType.String:
					if p.AsString():
						v = p.AsString()		
			oneline += cbTxt.format(n,v,ATTBREAK) + TAB
		except:
			pass
	return oneline

###
try:
	### get all elements of categories
	for c in categories:
		for cat in cats:
			if cat and c.Name == cat:
				for e in FilteredElementCollector(doc).OfCategoryId(c.Id).WhereElementIsNotElementType().ToElements():
					res.append(e)
except:
	pass

	
# Assign your output to the OUT variable.
OUT = res
# ----------------------------------------
manual_name_prefix = BoolSelector(false)
if_2 = If(test=manual_name_prefix)  # unwired: true, false
python_script_2 = Python()  # IronPython2; unwired: IN[0]
# ---------- python_script_2.python (14 lines) ----------
# Load the Python Standard and DesignScript Libraries
import sys
import clr
clr.AddReference('ProtoGeometry')
from Autodesk.DesignScript.Geometry import *

import os
# The inputs to this node will be stored as a list in the IN variables.
dataEnteringNode = IN

# Place your code below this line

# Assign your output to the OUT variable.
OUT = dir(os)
# ----------------------------------------
watch = Watch(python_script_2)
