# Dynamo graph DELETE ELEMENTS-BY GIVEN GUIDS.dyn (Dynamo 2.1.0.7500)

list_guids = StringInput("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")  # graph input
python_script_detete_parameters = Python(IN[0]=list_guids)  # "Python Script-DETETE PARAMETERS by name"
# ---------- python_script_detete_parameters.python (51 lines) ----------
# Load the Python Standard and DesignScript Libraries
import sys
import clr
clr.AddReference('ProtoGeometry')
from Autodesk.DesignScript.Geometry import *

clr.AddReference('RevitAPI')
from Autodesk.Revit.DB import *
from Autodesk.Revit.DB.ExternalFileUtils import *
from Autodesk.Revit.Creation import *

clr.AddReference('RevitAPIUI')
from Autodesk.Revit.UI import TaskDialog
clr.AddReference("RevitNodes")
import Revit
clr.ImportExtensions(Revit.Elements)
clr.AddReference("RevitServices")
import RevitServices
from RevitServices.Persistence import DocumentManager
from RevitServices.Transactions import TransactionManager
from System.Collections.Generic import *
clr.ImportExtensions(Revit.GeometryConversion)
import itertools
##
doc = DocumentManager.Instance.CurrentDBDocument
uiapp = DocumentManager.Instance.CurrentUIApplication
app = uiapp.Application


opt = Options()
# The inputs to this node will be stored as a list in the IN variables.
dataEnteringNode = IN

guids = IN[0]

t = Transaction(doc)
t.Start("Delete Elements by Guids")

try:
	for eid in guids.split("\n"):
		gui = eid[:-1]
		e = doc.GetElement(gui)
		doc.Delete(e.Id)
except:
	pass
t.Commit()



# Assign yourr output to the OUT variable.
OUT = 0
# ----------------------------------------
