# Dynamo graph GetDYNFileName.dyn (Dynamo 2.1.0.7500)

python_script_get_dyn_dir = Python()  # unwired: IN[0]
# ---------- python_script_get_dyn_dir.python (18 lines) ----------
# Load the Python Standard and DesignScript Libraries
import sys
import clr
clr.AddReference('ProtoGeometry')
from Autodesk.DesignScript.Geometry import *
clr.AddReference('DynamoRevitDS')
import Dynamo 


# The inputs to this node will be stored as a list in the IN variables.
dataEnteringNode = IN

# access to the current Dynamo instance and workspace
dynamoRevit = Dynamo.Applications.DynamoRevit()
currentWorkspace = dynamoRevit.RevitDynamoModel.CurrentWorkspace

# Assign your output to the OUT variable.
OUT = dynamoRevit,currentWorkspace,currentWorkspace.FileName
# ----------------------------------------
python_script_get_module_dir = Python()  # unwired: IN[0]
# ---------- python_script_get_module_dir.python (19 lines) ----------
# Load the Python Standard and DesignScript Libraries
import sys
import clr
import os
clr.AddReference('ProtoGeometry')
from Autodesk.DesignScript.Geometry import *

clr.AddReference('RevitAPI')
from Autodesk.Revit.DB import *
clr.AddReference("RevitServices")
import RevitServices

# The inputs to this node will be stored as a list in the IN variables.
dataEnteringNode = IN

# Place your code below this line

# Assign your output to the OUT variable.
OUT = path = os.path.abspath(RevitServices.__file__)
# ----------------------------------------
watch = Watch(python_script_get_module_dir)
