# Dynamo graph GP-02-JoinElements.dyn (Dynamo 2.1.0.7500)

string = StringInput("Structural Columns")  # graph input
string_2 = StringInput("Floors")  # graph input
python_script = Python(IN[0]=string, IN[1]=string_2)
# ---------- python_script.python (101 lines) ----------
# Load the Python Standard and DesignScript Libraries
import sys
import clr
clr.AddReference('ProtoGeometry')
from Autodesk.DesignScript.Geometry import *

clr.AddReference('RevitAPI')
from Autodesk.Revit.DB import *
from Autodesk.Revit.DB.SolidSolidCutUtils import *


clr.AddReference('RevitAPIUI')
from Autodesk.Revit.UI import TaskDialog
clr.AddReference("RevitNodes")
import Revit
clr.ImportExtensions(Revit.Elements)
clr.AddReference("RevitServices")
import RevitServices
from RevitServices.Persistence import DocumentManager
from RevitServices.Transactions import TransactionManager
from System.Collections.Generic import *
clr.ImportExtensions(Revit.GeometryConversion)

clr.AddReference('System.Windows.Forms')
import System.Windows.Forms
from System.Windows.Forms import *

import System

##
doc = DocumentManager.Instance.CurrentDBDocument
uiapp = DocumentManager.Instance.CurrentUIApplication
app = uiapp.Application
opt = Options()
# The inputs to this node will be stored as a list in the IN variables.
dataEnteringNode = IN
# Place your code below this line

catName1 = IN[0]
catName2 = IN[1]
res = []
cat = []
####
def getSolids(e):
	solid = []
	geoE1 = e.get_Geometry(opt)
	enum = geoE1.GetEnumerator()
	geoE2 = []
	while enum.MoveNext():
		geoE2 = enum.Current
	if isinstance(geoE2,Solid):
		solid.Add(geoE2)
	
	else:
		if isinstance(geoE2,GeometryInstance):
			geoObj = geoE2.GetInstanceGeometry()
			for s in geoObj:
				if isinstance(s,Solid) and s.Volume > 0:
					solid.Add(s)
	return solid
####
def allElemsOfCat (catName,doc):
	res = []
	cat = []
	for e in doc.Settings.Categories:
	#res.append(e.Name)
		if e.Name == catName.ToString():
			cat = e	
	elems = FilteredElementCollector(doc).OfCategoryId(cat.Id).WhereElementIsNotElementType()	
	for e in elems:
		res.append(e)
	return res

def CanSolidsCut (e1, e2):	
	res = False
	report = []
	try:
		if CanElementCutElement(e1,e2):
			res = True
	except Exception, ex:
		#MessageBox.Show(ex.ToString())
		pass
	#MessageBox.Show(report.ToString())
	return res


#####################################################
res1 = allElemsOfCat(catName1,doc)
res2 = allElemsOfCat(catName2,doc)

res = []


for e1 in res1:
	for e2 in res2:
		res.append(CanSolidsCut(e1, e2))

		
#MessageBox.Show('Hello')
# Assign your output to the OUT variable.
OUT = res1,res2,res
# ----------------------------------------
watch = Watch(python_script)
