# Dynamo graph GetDYNFileName.dyn (Dynamo 2.1.0.7500)

python_script = Python()  # unwired: IN[0]
# ---------- python_script.python (21 lines) ----------
# Load the Python Standard and DesignScript Libraries
import sys
import clr
clr.AddReference('ProtoGeometry')
from Autodesk.DesignScript.Geometry import *

# The inputs to this node will be stored as a list in the IN variables.
dataEnteringNode = IN


# Adding the DynamoRevitDS.dll module to work with the Dynamo API
clr.AddReference('DynamoRevitDS')
import Dynamo 

# access to the current Dynamo instance and workspace
dynamoRevit = Dynamo.Applications.DynamoRevit()
currentWorkspace = dynamoRevit.RevitDynamoModel.CurrentWorkspace


# Assign your output to the OUT variable.
OUT = dynamoRevit,currentWorkspace,currentWorkspace.FileName
# ----------------------------------------
watch = Watch(python_script)
