# Dynamo graph Python Study.dyn (Dynamo 2.1.0.7500)

python_script_open_csv_or_text = Python()  # frozen; unwired: IN[0]
# ---------- python_script_open_csv_or_text.python (20 lines) ----------
# Load the Python Standard and DesignScript Libraries
import sys
import clr
clr.AddReference('ProtoGeometry')
from Autodesk.DesignScript.Geometry import *

fr=[]
path = "C:\\Users\\USER\\Documents\\PythonMachineLearning\\pandas\\BIM PARAMS 2021.csv"
#"C:\\Users\\USER\\Documents\\PythonMachineLearning\\pythonFromZero\\readFile.txt"
with open(path,"r") as f:
	for d in f:
		fr.append(d)

# The inputs to this node will be stored as a list in the IN variables.
dataEnteringNode = IN

# Place your code below this line

# Assign your output to the OUT variable.
OUT = fr#[0].split("\t")
# ----------------------------------------
watch = Watch(python_script_open_csv_or_text)
python_script_import_modules = Python()  # unwired: IN[0]
# ---------- python_script_import_modules.python (41 lines) ----------
# Load the Python Standard and DesignScript Libraries
import sys
allsysModuleMembers = dir(sys)
import clr
allclrModuleMembers = dir(clr)

clr.AddReference('ProtoGeometry')
from Autodesk.DesignScript.Geometry import *

import os
allosModuleMembers = dir(os)
#import matplotlib.pyplot as plt #ironpython have no matplotlib module
#import pandas as pd#ironpython have no pandas module

import math
allMathModuleMembers = dir(math)

import platform
allplatformModuleMembers = dir(platform)

import random
allrandomModuleMembers = dir(random)

import argparse 
allargparseModuleMembers = dir(argparse)


clr.AddReference('System.IO')
clr.AddReference('System.Drawing')
clr.AddReference('System.Reflection')
clr.AddReference('System.Threading')
clr.AddReference("System.Windows.Forms")

import System
import System.IO
import System.Drawing
import System.Reflection
import System.Windows.Forms
#from System.Windows.Forms import *
# Assign your output to the OUT variable.
OUT = allsysModuleMembers,allclrModuleMembers,allosModuleMembers,allMathModuleMembers,allplatformModuleMembers,allrandomModuleMembers,allargparseModuleMembers
# ----------------------------------------
watch_2 = Watch(python_script_import_modules)
python_script_run_other_python = Python()  # "Python Script-Run Other Python Script"; unwired: IN[0]
# ---------- python_script_run_other_python.python (25 lines) ----------
# Load the Python Standard and DesignScript Libraries
import sys
allsysModuleMembers = dir(sys)
import clr
allclrModuleMembers = dir(clr)

clr.AddReference('ProtoGeometry')
from Autodesk.DesignScript.Geometry import *

import argparse 
allargparseModuleMembers = dir(argparse)

clr.AddReference("System.Windows.Forms")
clr.AddReference("System.Drawing")
from System.Windows.Forms import *
#import otherScript as ots

#mbrtb = RichTextBox()
#mbrtb.
#mbrtb.Show()

MessageBox.Show("Hello work")

# Assign your output to the OUT variable.
OUT = 0
# ----------------------------------------
watch_3 = Watch(python_script_run_other_python)
