# Dynamo graph Setting Survey Point.dyn (Dynamo 2.1.0.7500)

python_script = Python()
# ---------- python_script.python (37 lines) ----------
# Load the Python Standard and DesignScript Libraries
import sys
import clr
clr.AddReference('ProtoGeometry')
from Autodesk.DesignScript.Geometry import *

clr.AddReference('RevitAPI')
from Autodesk.Revit.DB import *
clr.AddReference('RevitAPIUI')
from Autodesk.Revit.UI import TaskDialog
clr.AddReference("RevitNodes")
import Revit
clr.ImportExtensions(Revit.Elements)
clr.AddReference("RevitServices")
import RevitServices
from RevitServices.Persistence import DocumentManager
from RevitServices.Transactions import TransactionManager
from System.Collections.Generic import *
clr.ImportExtensions(Revit.GeometryConversion)

##
doc = DocumentManager.Instance.CurrentDBDocument
uiapp = DocumentManager.Instance.CurrentUIApplication
app = uiapp.Application
opt = Options()



# The inputs to this node will be stored as a list in the IN variables.
dataEnteringNode = IN


# Place your code below this line
#Boilerplate code
sPoint = FilteredElementCollector(doc).OfCategory(BuiltInCategory.OST_SharedBasePoint).WhereElementIsNotElementType().ToElements()
# Assign your output to the OUT variable.
OUT = sPoint[0]
# ----------------------------------------
parameters = Element.Parameters(element=python_script)
watch = Watch(parameters)
code_block = CodeBlock { "E/W"; "N/S"; }
code_block_2 = CodeBlock { 10000; 20000; }
setParameterByName = Element.SetParameterByName(element=python_script, parameterName=code_block.out0, value=code_block_2.out0)
setParameterByName_2 = Element.SetParameterByName(element=python_script, parameterName=code_block.out1, value=code_block_2.out1)
