# Dynamo graph 01-EXCEL DATA TO TXT.dyn (Dynamo 2.3.0.5885)

file_path_getdata = Filename("..\..\..\01_PROJECTS\DANON FACTORY\02 WIP\05-ONEPLACE-210127\DOF- SCHEDULE REPORT-210130 (2).xlsx")  # graph input
file_from_path = FileObject(path=file_path_getdata)
sheet_name = StringInput("DetailData")  # graph input
boolean = BoolSelector(true)
importExcel = Data.ImportExcel(file=file_from_path, sheetName=sheet_name, readAsStrings=boolean, showExcel=boolean)
python_script = Python(IN[0]=importExcel, IN[1]=file_path_getdata)
# ---------- python_script.python (82 lines) ----------
# Load the Python Standard and DesignScript Libraries
import sys
import clr
clr.AddReference('ProtoGeometry')
from Autodesk.DesignScript.Geometry import *

clr.AddReference('System.IO')
clr.AddReference('System.Drawing')
clr.AddReference('System.Reflection')
clr.AddReference('System.Threading')
clr.AddReference("System.Windows.Forms")

import System
import System.IO
import System.Drawing
import System.Reflection
import System.Windows.Forms

from System.Threading import ApartmentState, Thread, ThreadStart
from System.Windows.Forms import *

from shutil import copyfile
import tempfile
import os
# The inputs to this node will be stored as a list in the IN variables.
dataEnteringNode = IN
exDat = IN[0]
pathIN = IN[1]


tempDir = tempfile.gettempdir()
#FILE PATH
dir = ""
for p in pathIN.split("\\")[:-1]:
	dir += p + "\\" 
path = dir+pathIN.split("\\")[-1].split(".")[0]+".txt"

allText=""

TAB = "\t"
BREAKLINE = "\n"

test1 = os.path.isdir(pathIN)
#test2 = os.path.exists(pathIN)
#test3 = os.path.isfile(pathIN)

# Place your code below this line

def writeTxtFromExcelDat(exDat,_TAB,_BREAKLINE): #from excel data list
	allText=""
	TAB = _TAB
	BREAKLINE = _BREAKLINE	
	for d in exDat:
		str = ""
		strF = "{0}{1}"		
		if len(d)>0:
			for c in d:
				if c:
					str += strF.format(c,TAB)
				if c is None:
					str += strF.format("",TAB)
		if len(str)>0:
			str += BREAKLINE	
		#list1Line.append(str)
		allText += str	
	f = open(path,"w")
	f.write(allText.encode('utf8'))
	f.close
	return allText
"""
def writeTxtFromTxtString(PATH, exDat,_TAB,_BREAKLINE): #from txt string	
	with open(PATH,"w") as f:
		f.write(exDat.encode('utf8'))		
	copyfile(TEMPPATH,PATH)	
	return exDat
"""
###################
if not test1 and len(exDat) >0:
	allText = writeTxtFromExcelDat(exDat,TAB,BREAKLINE)
#MessageBox.Show(allText)
# Assign your output to the OUT variable.
OUT = allText
# ----------------------------------------
watch = Watch(python_script)
watch_2 = Watch(importExcel)
