# Dynamo graph 02-TXTs MIX.dyn (Dynamo 2.3.0.5885)

file_path_txt2_received = Filename("..\..\..\..\01_PROJECTS\DANON FACTORY\02 WIP\05-ONEPLACE-210127\DOF- SCHEDULE REPORT-210130 (2).txt")
python_script = Python(IN[0]=file_path_txt2_received)
# ---------- python_script.python (39 lines) ----------
# Load the Python Standard and DesignScript Libraries
import sys
import clr
clr.AddReference('ProtoGeometry')
from Autodesk.DesignScript.Geometry import *

import os

# The inputs to this node will be stored as a list in the IN variables.
dataEnteringNode = IN
path = IN[0]
# ini
TAB = "\t"
BREAKLINE = "\n"

###
def createQTOreqDic (path):
	dat=[]
	di = {}	
	with open(path,"r") as f:
		lines = f.readlines()
		for l in lines[1:]:
			
			if len(l)>0:
				key = l.split(TAB)[0]
				value = l[l.find(TAB)+2:-1]
				di[key] = value[:-2]
				#dic.append(l)
	return di
# Place your code below this line

test1 = os.path.isdir(path)
test2 = os.path.exists(path)
test3 = os.path.isfile(path)

dat=createQTOreqDic(path)

# Assign your output to the OUT variable.
OUT = dat
# ----------------------------------------
watch = Watch(python_script)
file_path_txt1_data_delivery = Filename("..\..\..\..\01_PROJECTS\DANON FACTORY\02 WIP\05-ONEPLACE-210127\QTO-DOF-S-01-ZZ-FACTORY2.txt")  # graph input
python_script_2 = Python(IN[0]=file_path_txt1_data_delivery)
# ---------- python_script_2.python (47 lines) ----------
# Load the Python Standard and DesignScript Libraries
import sys
import clr
clr.AddReference('ProtoGeometry')
from Autodesk.DesignScript.Geometry import *

import os

# The inputs to this node will be stored as a list in the IN variables.
dataEnteringNode = IN
path = IN[0]
# ini
TAB = "\t"

###
def createQTOreqDic (path):
	dat=[]
	dic = []
	with open(path,"r") as f:
		lines = f.readlines()
		for l in lines:
			if len(l)>0:
				d =[]
				for att in l.decode('utf-8').split(TAB):
					d.append(att)
				dat.append(l.decode('utf-8'))
	di = {}
	for d in dat[1:]:		
		reqs = []
		for req in d.split(TAB)[1:]:			
			if req and not req == "\n":
				reqs.append(req)
			
		di[d.split(TAB)[0]] = reqs
		#for att in d.split(TAB):
	
	return di
# Place your code below this line

test1 = os.path.isdir(path)
test2 = os.path.exists(path)
test3 = os.path.isfile(path)

dat=createQTOreqDic (path)

# Assign your output to the OUT variable.
OUT = dat
# ----------------------------------------
watch_2 = Watch(python_script_2)
python_script_compose_data_to = Python(IN[0]=python_script_2, IN[1]=python_script)  # "Python Script-Compose data to list array"
# ---------- python_script_compose_data_to.python (32 lines) ----------
# Load the Python Standard and DesignScript Libraries
import sys
import clr
clr.AddReference('ProtoGeometry')
from Autodesk.DesignScript.Geometry import *

# The inputs to this node will be stored as a list in the IN variables.
dataEnteringNode = IN

dic1 = IN[0]
dic2 = IN[1]

TAB = "\t"
res = []
strres = ""
for k in dic2:
	r = []
	ss="{0}{1}"
	sss = ss.format(k,TAB)
	str = "{0}\t{1}\t{2}"
	try :
		if dic1.has_key(k):
			sss += dic1.get(k)[0] + "\t"
			sss += dic1.get(k)[1]
			sss += dic2.get(k)
	except:
		pass
	strres += sss +"\n"
# Place your code below this line

# Assign your output to the OUT variable.
OUT = strres#,dir(dic1)
# ----------------------------------------
watch_3 = Watch(python_script_compose_data_to)
manual_browse_dir_if_false_auto = BoolSelector(false)  # "Manual Browse DIR ? if FALSE auto at TXT1 Dir"; graph input
dir_path_mixed_txt1_to_txt2 = Directory("C:\Users\tvpduy\Desktop")  # graph input
code_block = CodeBlock(dir=dir_path_mixed_txt1_to_txt2) { dir + "\\"; }
python_script_3 = Python(IN[0]=file_path_txt1_data_delivery)
# ---------- python_script_3.python (16 lines) ----------
# Load the Python Standard and DesignScript Libraries
import sys
import clr
clr.AddReference('ProtoGeometry')
from Autodesk.DesignScript.Geometry import *

# The inputs to this node will be stored as a list in the IN variables.
dataEnteringNode = IN

# Place your code below this line
d=""
for p in IN[0].split("\\")[:-1]:
	d += p+"\\"

# Assign your output to the OUT variable.
OUT = d
# ----------------------------------------
if_ = If(test=manual_browse_dir_if_false_auto, true=code_block, false=python_script_3)
mixed_txt1_to_txt2_file_name = StringInput("mixTxt")  # graph input
code_block_2 = CodeBlock(dir=if_, name=mixed_txt1_to_txt2_file_name) { dir +name+".txt"; }
# note: Input : Data = String with \t \n (encode utf-8)
python_script_write_txt_file = Python(IN[0]=python_script_compose_data_to, IN[1]=code_block_2)
# ---------- python_script_write_txt_file.python (76 lines) ----------
# Load the Python Standard and DesignScript Libraries
import sys
import clr
clr.AddReference('ProtoGeometry')
from Autodesk.DesignScript.Geometry import *

clr.AddReference('System.IO')
clr.AddReference('System.Drawing')
clr.AddReference('System.Reflection')
clr.AddReference('System.Threading')
clr.AddReference("System.Windows.Forms")

import System
import System.IO
import System.Drawing
import System.Reflection
import System.Windows.Forms

from System.Threading import ApartmentState, Thread, ThreadStart
from System.Windows.Forms import *

from shutil import copyfile
import tempfile
import os
# The inputs to this node will be stored as a list in the IN variables.
dataEnteringNode = IN
exDat = IN[0]
_path = IN[1]
#list1Line = []
allText=""

TAB = "\t"
BREAKLINE = "\n"

test1 = os.path.isdir(_path)
test2 = os.path.exists(_path)
test3 = os.path.isfile(_path)

# Place your code below this line

#WRITE EXCEL DATA LIST TO TEMP TXT FILE THEN COPY TO TARGET PATH
def writeTxtFromExcelDat(exDat,_TAB,_BREAKLINE): #from excel data list
	allText=""
	TAB = _TAB
	BREAKLINE = _BREAKLINE	
	for d in exDat:
		str = ""
		strF = "{0}{1}"		
		if d[0] and len(d)>0:		
			for c in d:
				if c:
					str += strF.format(c,TAB)
		if len(str)>0:
			str += BREAKLINE	
		#list1Line.append(str)
		allText += str	
	f = open(path,"w")
	f.write(allText.encode('utf8'))
	f.close
	return allText
	
#WRITE "ONE_LINE" DATA TO TEMP TXT FILE THEN COPY TO TARGET PATH
def writeTxtFromTxtString(PATH, exDat,_TAB,_BREAKLINE): #from txt string	
	with open(PATH,"w") as f:
		f.write(exDat.encode('utf8'))		
	copyfile(PATH,_path)	
	return exDat
###################
tempDir = tempfile.gettempdir()
fileName = _path.split("\\")[-1]
PATH = tempDir + fileName
if not exDat ==  None and not test1 and len(exDat) >0:
	allText = writeTxtFromTxtString(PATH, exDat,TAB,BREAKLINE)
#MessageBox.Show(allText)
# Assign your output to the OUT variable.
OUT = allText
# ----------------------------------------
