# Dynamo graph 03 to REVIT.dyn "TXT to REVIT" (Dynamo 2.3.0.5885)

brow_dir_path_manual = BoolSelector(false)
dir_path = Directory("C:\Users\tvpduy\Desktop")  # graph input
code_block = CodeBlock(dir=dir_path) { dir + "\\"; }
python_script = Python()
# ---------- python_script.python (44 lines) ----------
# Load the Python Standard and DesignScript Libraries
import sys
import clr
clr.AddReference('ProtoGeometry')
from Autodesk.DesignScript.Geometry import *

clr.AddReference('RevitAPI')
from Autodesk.Revit.DB import *
clr.AddReference('RevitAPIUI')
from Autodesk.Revit.UI import TaskDialog
clr.AddReference("RevitNodes")
import Revit
clr.ImportExtensions(Revit.Elements)
clr.AddReference("RevitServices")
import RevitServices
from RevitServices.Persistence import DocumentManager
from RevitServices.Transactions import TransactionManager
from System.Collections.Generic import *
clr.ImportExtensions(Revit.GeometryConversion)

##
doc = DocumentManager.Instance.CurrentDBDocument
uiapp = DocumentManager.Instance.CurrentUIApplication
app = uiapp.Application

opt = Options()
# The inputs to this node will be stored as a list in the IN variables.
dataEnteringNode = IN

dir = ""
dataFullPath =""

#
try:
	p = doc.PathName.split("\\")
	pp = p[0:len(p)-1]

	for s in pp:
		dir += s + "\\"
except:
	pass

# Assign your output to the OUT variable.
OUT = dir,doc.PathName.split("\\")[-1].split(".")[0]
# ----------------------------------------
code_block_2 = CodeBlock(res=python_script) { dir = res[0]; pn = res[1]; }
if_ = If(test=brow_dir_path_manual, true=code_block, false=code_block_2.dir)
code_block_3 = CodeBlock(path=if_) { path; }
string_const = CodeBlock { QTOreq = "QTOreq"; SOCats = "SOCats"; }
code_block_4 = CodeBlock(dir=code_block_3, shn=string_const.SOCats) { dir+shn+".txt"; }
python_script_read_txt_out_list = Python(IN[0]=code_block_4)  # "Python Script-Read txt-OUT List Cats"
# ---------- python_script_read_txt_out_list.python (43 lines) ----------
# Load the Python Standard and DesignScript Libraries
import sys
import clr
clr.AddReference('ProtoGeometry')
from Autodesk.DesignScript.Geometry import *

import os

# The inputs to this node will be stored as a list in the IN variables.
dataEnteringNode = IN
path = IN[0]
# ini
TAB = "\t"

###
def createQTOreqDic (path):
	dat=[]
	dic = []
	with open(path,"r") as f:
		lines = f.readlines()
		for l in lines:
			if len(l)>0:
				d =[]
				for att in l.decode('utf-8').split(TAB):
					d.append(att)
				dat.append(l.decode('utf-8'))
	for d in dat[1:]:
		#di = {}
		#di[d.split(TAB)[0]] = d.split(TAB)[1]
		dic.append(d.split(TAB)[0])
		#for att in d.split(TAB):
	
	return dic
# Place your code below this line

test1 = os.path.isdir(path)
test2 = os.path.exists(path)
test3 = os.path.isfile(path)

dat=createQTOreqDic (path)

# Assign your output to the OUT variable.
OUT = dat
# ----------------------------------------
parameter_name = StringInput("COF_CON__ActualEndTime")  # graph input
file_path_txt = Filename("..\..\..\..\01_PROJECTS\DANON FACTORY\02 WIP\05-ONEPLACE-210127\DOF- SCHEDULE REPORT-210130 (2).txt")  # graph input
python_script_dic_multi_keys = Python(IN[0]=file_path_txt)
# ---------- python_script_dic_multi_keys.python (53 lines) ----------
# Load the Python Standard and DesignScript Libraries
import sys
import clr
clr.AddReference('ProtoGeometry')
from Autodesk.DesignScript.Geometry import *

import os

# The inputs to this node will be stored as a list in the IN variables.
dataEnteringNode = IN
path = IN[0]
# ini
TAB = "\t"

###
def createQTOreqDicMultiKeys(path):
	dic=[]
	orders = []
	with open(path,"r") as f:
		lines = f.readlines()
		
		l0s = lines[0].split(TAB)
		
		for i in range(len(l0s)):
			l0 = l0s[i]
			if not l0 == None:
				orders.append(i)
		
		for l in lines[1:]:
			listAtt = l.split(TAB)
			di = {}	
			if len(l)>0:
				try:
					for ii in orders:				
						key = l0s[ii]
						value = listAtt[ii]
						di[key] = value	
				except:
					pass
					
			#dic.append(len(di.keys()))
			dic.append(di)
	return dic
# Place your code below this line

test1 = os.path.isdir(path)
test2 = os.path.exists(path)
test3 = os.path.isfile(path)

dat=createQTOreqDicMultiKeys(path)

# Assign your output to the OUT variable.
OUT = dat
# ----------------------------------------
ref_key_first_column_name = StringInput("ExID")
revit_param_2_for_verify_anti = StringInput("COF_GEN__BuildingNumber")  # "Revit Param 2 -for Verify anti duplicated Guid"
revit_param_2_value = StringInput("FAC2")
txt_target_key_column_name_of = StringInput("Acutal End Date / Actual Tracking date")  # "Txt Target key = Column name of transfered data"
python_script_get_elements_of = Python(IN[0]=python_script_read_txt_out_list, IN[1]=parameter_name, IN[2]=python_script_dic_multi_keys, IN[3]=ref_key_first_column_name, IN[4]=revit_param_2_for_verify_anti, IN[5]=revit_param_2_value, IN[6]=txt_target_key_column_name_of)  # "Python Script-Get Elements Of Listed Categories & Set Parameter Value"
# ---------- python_script_get_elements_of.python (84 lines) ----------
# Load the Python Standard and DesignScript Libraries
import sys
import clr
clr.AddReference('ProtoGeometry')
from Autodesk.DesignScript.Geometry import *

clr.AddReference('RevitAPI')
from Autodesk.Revit.DB import *
clr.AddReference('RevitAPIUI')
from Autodesk.Revit.UI import TaskDialog
clr.AddReference("RevitNodes")
import Revit
clr.ImportExtensions(Revit.Elements)
clr.AddReference("RevitServices")
import RevitServices
from RevitServices.Persistence import DocumentManager
from RevitServices.Transactions import TransactionManager
from System.Collections.Generic import *
clr.ImportExtensions(Revit.GeometryConversion)

##
doc = DocumentManager.Instance.CurrentDBDocument
uiapp = DocumentManager.Instance.CurrentUIApplication
app = uiapp.Application
opt = Options()

# The inputs to this node will be stored as a list in the IN variables.
dataEnteringNode = IN
cats = IN[0]
paramName = IN[1]
dataDICListUpdate = IN[2]
refkey = IN[3]
condParam2 = IN[4]
condParam2Value = IN[5]
targetKey = IN[6]

# Place your code below this line
res = []
model_cat = []

#-------------------------
def writeParameterValues(dataDICListUpdate):		
	TransactionManager.Instance.EnsureInTransaction(doc)	
	elems=[]
	params=[]
	for dic in dataDICListUpdate:	
		try:
			guid = dic.get(refkey)
			e = doc.GetElement(guid)
			if e:
				elems.append(e)
				paramsubVal = e.LookupParameter(condParam2).AsString()
				if paramsubVal and  paramsubVal == condParam2Value:
					params.append(paramsubVal)
					param = e.LookupParameter(paramName)
					param.Set(dic.get(targetKey))
				else:
					params.append("No Value")
		except Exception, ex:
			params.append(ex)
			pass
		
	TransactionManager.Instance.TransactionTaskDone()
	doc.Regenerate()
	
	return params
#-------------------------
def GetAllElementsOfCategories(cats):
	elems = []
	categories = doc.Settings.Categories
	try:
		for c in categories:
			for cat in cats:
				if cat and c.Name == cat:
					elems.append(FilteredElementCollector(doc).OfCategoryId(c.Id).WhereElementIsNotElementType().ToElements())
	except:
		pass
	return elems
#-------------------------

res = writeParameterValues(dataDICListUpdate)

# Assign your output to the OUT variable.
OUT = res
# ----------------------------------------
watch = Watch(python_script_dic_multi_keys)
python_script_get_elements_of_2 = Python(IN[0]=python_script_dic_multi_keys)  # "Python Script-Get Elements Of Listed Categories & Set Parameter Value"
# ---------- python_script_get_elements_of_2.python (33 lines) ----------
# Load the Python Standard and DesignScript Libraries
import sys
import clr
clr.AddReference('ProtoGeometry')
from Autodesk.DesignScript.Geometry import *

clr.AddReference('RevitAPI')
from Autodesk.Revit.DB import *
clr.AddReference('RevitAPIUI')
from Autodesk.Revit.UI import TaskDialog
clr.AddReference("RevitNodes")
import Revit
clr.ImportExtensions(Revit.Elements)
clr.AddReference("RevitServices")
import RevitServices
from RevitServices.Persistence import DocumentManager
from RevitServices.Transactions import TransactionManager
from System.Collections.Generic import *
clr.ImportExtensions(Revit.GeometryConversion)

##
doc = DocumentManager.Instance.CurrentDBDocument
uiapp = DocumentManager.Instance.CurrentUIApplication
app = uiapp.Application

opt = Options()

# The inputs to this node will be stored as a list in the IN variables.
dataEnteringNode = IN
dic = IN[0]
for d in dic:
	if d.get("ExID") == "78533a4b-9820-48ed-ae3a-fe95cdca4a74-000c72bd":
		OUT = doc.GetElement(d.get("ExID"))
# ----------------------------------------
python_script_2 = Python()  # unwired: IN[0]
# ---------- python_script_2.python (13 lines) ----------
# Load the Python Standard and DesignScript Libraries
import sys
import clr
clr.AddReference('ProtoGeometry')
from Autodesk.DesignScript.Geometry import *

# The inputs to this node will be stored as a list in the IN variables.
dataEnteringNode = IN

# Place your code below this line

# Assign your output to the OUT variable.
OUT = IN[0]
# ----------------------------------------
