# Dynamo graph 01-CREATE DATABASE.dyn (Dynamo 2.10.0.3455)

file_path_write_data_to = Filename(".\DOF- SCHEDULE REPORT-210130 (2).xlsx")
file_path_read_json = Filename(".\progress-210223.json")
file_path_getdata = Filename(".\dof.db")
python_script = Python(IN[0]=file_path_getdata)  # IronPython2
# ---------- python_script.python (50 lines) ----------
# Load the Python Standard and DesignScript Libraries
import sys
import clr
clr.AddReference('ProtoGeometry')
from Autodesk.DesignScript.Geometry import *

from shutil import copyfile
import tempfile
import os
from os import listdir
from os.path import isfile, join

import uuid
# The inputs to this node will be stored as a list in the IN variables.
#dataEnteringNode = IN
res = []

import sqlite3
dbName = "dof.db"
dbPath = IN[0]
conn = sqlite3.connect(dbPath)

#INSERT COMMAND
id = uuid.uuid4()
iniInsert = "INSERT INTO project4dTB VALUES ({},'0ace5d6b-9f8e-4d28-a62a-61937a6fa895-000cc472','DOF-01-FD','FD','23/02/2021','23/02/2021','23/02/2021','23/02/2021','tvpduy','NCR123456',0.5,100,'m3','Foundation','tvpduy','25/02/2021')"
commandInsert = iniInsert.format(id)


c = conn.cursor()
# CREATE TABLE 1 time, no need if database and table already created
# c.execute('''CREATE TABLE project4dTB (Id INTEGER PRIMARY KEY,guids TEXT, itNumber TEXT, itemName TEXT, PSdate TEXT, PEdate TEXT, ASdate TEXT, AEdate TEXT, personInCharged TEXT, NCR TEXT, complete REAL,quantity REAL, qUnit TEXT, abreviation TEXT, byUser TEXT, ActualUpdatedDate TEXT)''')

# Insert a row of data
#c.execute(commandInsert)
#SEARCH DATA

for cc in c.execute('SELECT * FROM project4dTB'):
    res.append(cc)


conn.commit()
# We can also close the connection if we are done with it.
# Just be sure any changes have been committed or they will be lost.
conn.close()


# Place your code below this line

# Assign your output to the OUT variable.
OUT = res
# ----------------------------------------
watch = Watch(python_script)
