# Dynamo graph 03-TXT TO DATABASE-NOT YET.dyn "TRANFER DATA EXCEL TO EXCEL" (Dynamo 2.10.0.3455)

file_path_getdata = Filename(".\BIMData.xlsx")
file_from_path = FileObject(path=file_path_getdata)
sheet_name_1 = StringInput("QTO")  # graph input
boolean = BoolSelector(true)
importExcel = Data.ImportExcel(file=file_from_path, sheetName=sheet_name_1, readAsStrings=boolean, showExcel=boolean)
python_script = Python(IN[0]=importExcel, IN[1]=file_path_getdata)  # IronPython2
# ---------- python_script.python (75 lines) ----------
# Load the Python Standard and DesignScript Libraries
import sys
import clr
clr.AddReference('ProtoGeometry')
from Autodesk.DesignScript.Geometry import *

clr.AddReference('System.IO')
clr.AddReference('System.Drawing')
clr.AddReference('System.Reflection')
clr.AddReference('System.Threading')
clr.AddReference("System.Windows.Forms")

import System
import System.IO
import System.Drawing
import System.Reflection
import System.Windows.Forms

from System.Threading import ApartmentState, Thread, ThreadStart
from System.Windows.Forms import *

import os
# The inputs to this node will be stored as a list in the IN variables.
dataEnteringNode = IN
exDat = IN[0]
pathIN = IN[1]

#FILE PATH
dir = ""
for p in pathIN.split("\\")[:-1]:
	dir += p + "\\" 
path = dir+pathIN.split("\\")[-1].split(".")[0]+".txt"

#list1Line = []
allText=""

TAB = "\t"
BREAKLINE = "\n"

test1 = os.path.isdir(path)
test2 = os.path.exists(path)
test3 = os.path.isfile(path)

# Place your code below this line

def writeTxtFromExcelDat(exDat,_TAB,_BREAKLINE): #from excel data list
	allText=""
	TAB = _TAB
	BREAKLINE = _BREAKLINE	
	for d in exDat:
		str = ""
		strF = "{0}{1}"		
		if d[0] and len(d)>0:		
			for c in d:
				if c:
					str += strF.format(c,TAB)
		if len(str)>0:
			str += BREAKLINE	
		#list1Line.append(str)
		allText += str	
	f = open(path,"w")
	f.write(allText.encode('utf8'))
	f.close
	return allText
def writeTxtFromTxtString(exDat,_TAB,_BREAKLINE): #from txt string	
	f = open(path,"w")
	f.write(exDat.encode('utf8'))
	f.close
	return exDat
###################
if not test1 and len(exDat) >0:
	allText = writeTxtFromExcelDat(exDat,TAB,BREAKLINE)
#MessageBox.Show(allText)
# Assign your output to the OUT variable.
OUT = allText
# ----------------------------------------
watch = Watch(python_script)
file_path_write_data_to = Filename(".\DOF- SCHEDULE REPORT-210130 (2).xlsx")
file_from_path_2 = FileObject(path=file_path_write_data_to)
sheet_name_2 = StringInput("WorkItemData")  # graph input
importExcel_2 = Data.ImportExcel(file=file_from_path_2, sheetName=sheet_name_2, readAsStrings=boolean, showExcel=boolean)
python_script_2 = Python(IN[0]=importExcel_2, IN[1]=file_path_getdata)  # IronPython2; same code as python_script
watch_2 = Watch(python_script_2)
