# Dynamo graph 02-INPUT-01-ActualStartDate.dyn (Dynamo 2.3.0.5885)

select_model_elements = DSModelElementsSelection()  # 24 picked in the model; graph input
parameter_name = StringInput("COF_CON__ActualEndTime")  # graph input
parameter_value = StringInput("24/02/2021")  # graph input
setParameterByName = Element.SetParameterByName(element=select_model_elements, parameterName=parameter_name, value=parameter_value)
