# Dynamo graph 09-WORK ITEM MANAGER.dyn (Dynamo 2.3.0.5885)

# group: DIR
browse_dir_manualy = BoolSelector(false)  # graph input
directory_path = Directory("C:\Users\USER\Desktop")  # graph input

code_block = CodeBlock(dir=directory_path) { dir + "\\"; }

# group: Get Revit models' dir
python_script = Python()  # unwired: IN[0]
# ---------- python_script.python (56 lines) ----------
# Load the Python Standard and DesignScript Libraries
import sys
import clr
clr.AddReference('ProtoGeometry')
from Autodesk.DesignScript.Geometry import *

clr.AddReference('RevitAPI')
from Autodesk.Revit.DB import *
clr.AddReference('RevitAPIUI')
from Autodesk.Revit.UI import TaskDialog
clr.AddReference("RevitNodes")
import Revit
clr.ImportExtensions(Revit.Elements)
clr.AddReference("RevitServices")
import RevitServices
from RevitServices.Persistence import DocumentManager
from RevitServices.Transactions import TransactionManager
from System.Collections.Generic import *
clr.ImportExtensions(Revit.GeometryConversion)

##
doc = DocumentManager.Instance.CurrentDBDocument
uiapp = DocumentManager.Instance.CurrentUIApplication
app = uiapp.Application

opt = Options()
# The inputs to this node will be stored as a list in the IN variables.
dataEnteringNode = IN

##

res = []
dir = ""
dataFullPath =""

"""
res.append(app.VersionName)
res.append(app.SharedParametersFilename)
res.append(app.Username)
res.append(doc.PathName)
res.append(list(enumerate(doc.ProjectLocations)))
res.append(doc.SiteLocation)
"""
#
try:
	p = doc.PathName.split("\\")
	pp = p[0:len(p)-1]

	for s in pp:
		dir += s + "\\"
except:
	pass


# Assign your output to the OUT variable.
OUT = dir,doc.PathName.split("\\")[-1].split(".rvt")[0]
# ----------------------------------------
code_block_2 = CodeBlock(res=python_script)
# ---------- code_block_2.designscript (3 lines) ----------
dir = res[0];
projN = res[1];
//res[1];
# ----------------------------------------

if_ = If(test=browse_dir_manualy, true=code_block, false=code_block_2.dir)

# group (continued): Get Revit models' dir
code_block_3 = CodeBlock(dir=if_) { dir; }

# group: INPUT MAIN
code_block_4 = CodeBlock()
# ---------- code_block_4.designscript (6 lines) ----------
ExcelPath = "BIMData.xlsx";
QTOdata = "QTO.ITEM.DAT";
QTOreq = "QTOreq";
SOCats = "SOCats";
QTO="QTO";
lookup = "Lookup4D";
# ----------------------------------------

# group: LIST SOCats = KEYS
code_block_5 = CodeBlock(dir=code_block_3, shn=code_block_4.SOCats) { dir+shn+".txt"; }
python_script_read_txt_out_dic = Python(IN[0]=code_block_5)
# ---------- python_script_read_txt_out_dic.python (42 lines) ----------
# Load the Python Standard and DesignScript Libraries
import sys
import clr
clr.AddReference('ProtoGeometry')
from Autodesk.DesignScript.Geometry import *

import os

# The inputs to this node will be stored as a list in the IN variables.
dataEnteringNode = IN
path = IN[0]
# ini
TAB = "\t"

###
def createCatslist(path):
	dat=[]
	dic = []
	with open(path,"r") as f:
		lines = f.readlines()
		for l in lines:
			if len(l)>0:
				d =[]
				for att in l.decode('utf-8').split(TAB):
					d.append(att)
				dat.append(l.decode('utf-8'))
	for d in dat[1:]:
		di = d.split(TAB)[0]
		dic.append(di)
		#for att in d.split(TAB):
	
	return dic
# Place your code below this line

test1 = os.path.isdir(path)
test2 = os.path.exists(path)
test3 = os.path.isfile(path)

dat=createCatslist(path)

# Assign your output to the OUT variable.
OUT = dat
# ----------------------------------------

# group: DIC SOCats
code_block_6 = CodeBlock(dir=code_block_3, shn=code_block_4.SOCats) { dir+shn+".txt"; }
python_script_read_txt_out_dic_2 = Python(IN[0]=code_block_6)
# ---------- python_script_read_txt_out_dic_2.python (41 lines) ----------
# Load the Python Standard and DesignScript Libraries
import sys
import clr
clr.AddReference('ProtoGeometry')
from Autodesk.DesignScript.Geometry import *

import os

# The inputs to this node will be stored as a list in the IN variables.
dataEnteringNode = IN
path = IN[0]
# ini
TAB = "\t"

###
def createQTOreqDic (path):
	dat=[]
	dic = []
	with open(path,"r") as f:
		lines = f.readlines()
		for l in lines:
			if len(l)>0:
				d =[]
				for att in l.decode('utf-8').split(TAB):
					d.append(att)
				dat.append(l.decode('utf-8'))
	di = {}
	for d in dat[1:]:		
		di[d.split(TAB)[0]] = d.split(TAB)[1]
		#for att in d.split(TAB):
	return di
# Place your code below this line

test1 = os.path.isdir(path)
test2 = os.path.exists(path)
test3 = os.path.isfile(path)

dat=createQTOreqDic(path)

# Assign your output to the OUT variable.
OUT = dat
# ----------------------------------------

# group: DIC QTOreq
code_block_7 = CodeBlock(dir=code_block_3, shn=code_block_4.QTOreq) { dir+shn+".txt"; }
python_script_read_txt_out_dic_3 = Python(IN[0]=code_block_7)  # "Python Script-Read txt-OUT DIC ARRAY"
# ---------- python_script_read_txt_out_dic_3.python (47 lines) ----------
# Load the Python Standard and DesignScript Libraries
import sys
import clr
clr.AddReference('ProtoGeometry')
from Autodesk.DesignScript.Geometry import *

import os

# The inputs to this node will be stored as a list in the IN variables.
dataEnteringNode = IN
path = IN[0]
# ini
TAB = "\t"

###
def createQTOreqDic (path):
	dat=[]
	dic = []
	with open(path,"r") as f:
		lines = f.readlines()
		for l in lines:
			if len(l)>0:
				d =[]
				for att in l.decode('utf-8').split(TAB):
					d.append(att)
				dat.append(l.decode('utf-8'))
	di = {}
	for d in dat[1:]:		
		reqs = []
		for req in d.split(TAB)[1:]:			
			if req and not req == "\n":
				reqs.append(req)
			
		di[d.split(TAB)[0]] = reqs
		#for att in d.split(TAB):
	
	return di
# Place your code below this line

test1 = os.path.isdir(path)
test2 = os.path.exists(path)
test3 = os.path.isfile(path)

dat=createQTOreqDic (path)

# Assign your output to the OUT variable.
OUT = dat
# ----------------------------------------

# group: create elem dat
code_block_8 = CodeBlock(dir=code_block_3, shn=code_block_4.QTOdata, pn=code_block_2.projN) { dir+shn+"-"+pn+".txt"; }
python_script_read_txt_out_list = Python(IN[0]=code_block_8, IN[1]=python_script_read_txt_out_dic, IN[2]=python_script_read_txt_out_dic_2, IN[3]=python_script_read_txt_out_dic_3)  # "Python Script-Read txt-OUT List DATA"; frozen
# ---------- python_script_read_txt_out_list.python (98 lines) ----------
# Load the Python Standard and DesignScript Libraries
import sys
import clr
clr.AddReference('ProtoGeometry')
from Autodesk.DesignScript.Geometry import *

import os

# The inputs to this node will be stored as a list in the IN variables.
dataEnteringNode = IN
path = IN[0]
keys = IN[1]
dic1 = IN[2]
dic2 = IN[3]

# ini
TAB = "____"
ATTBREAK = " : "
TAB1 = "\t"
BREAKLINE = "\n"
###
def readTxtDatToDic(path):
	dat=[]
	dic = []
	with open(path,"r") as f:
		lines = f.readlines()
		for l in lines:
			try:
				dL = {}
				if len(l)>0:
					d =[]
					spl = l.decode('utf-8').split(TAB)
					for att in spl:
						try:
							if len(att.split(ATTBREAK)) == 1:
								dL[att.split(ATTBREAK)[0]] = ""
							else:
								dL[att.split(ATTBREAK)[0]] = att.split(ATTBREAK)[1]
						except:
							pass
					#dat.append(l.decode('utf-8'))
					dat.append(dL)
			except:
				pass
			#dat.append(dL)	
	return dat




# Place your code below this line

test1 = os.path.isdir(path)
test2 = os.path.exists(path)
test3 = os.path.isfile(path)

dat=readTxtDatToDic(path)

res= []
fn = ""
exxx=[]
try:
	for d in dat:
		str = ""
		dicParamKey = ""
		dicParam=""
		try:
			for k in keys:
				if d.get('Category') == k:
					dicParamKey = dic1.get(k)
					dicParam = dic2.get(dicParamKey)
		except Exception, ex2:
			exxx.append(ex2)
			pass
		try:
			for p in dicParam:
				v=""
				if d.get(p) is None:
					d[p] = ""
				v= d.get(p).ToString()
				
				str += v + TAB1
				s2 = p + " : " + d.get(p)
		except Exception, ex2:
			exxx.append(ex2)
			pass
		fn += str + BREAKLINE
		res.append(str)
		
except Exception, ex3:
	exxx.append(ex3)
	pass
"""
for d1 in dic2.keys():
	res.append(dic2.get(d1))
"""
# Assign your output to the OUT variable.
OUT = fn#dat#createDic(dat)#dat[0].split(TAB) #
# ----------------------------------------

# group: Instantly data
code_block_9 = CodeBlock(dir=code_block_3, fn=code_block_4.QTO, proj=code_block_2.projN) { dir+fn+"-"+proj+".txt"; }
python_script_write_to_txt = Python(IN[0]=python_script_read_txt_out_list, IN[1]=code_block_9)  # frozen
# ---------- python_script_write_to_txt.python (76 lines) ----------
# Load the Python Standard and DesignScript Libraries
import sys
import clr
clr.AddReference('ProtoGeometry')
from Autodesk.DesignScript.Geometry import *

clr.AddReference('System.IO')
clr.AddReference('System.Drawing')
clr.AddReference('System.Reflection')
clr.AddReference('System.Threading')
clr.AddReference("System.Windows.Forms")

import System
import System.IO
import System.Drawing
import System.Reflection
import System.Windows.Forms

from System.Threading import ApartmentState, Thread, ThreadStart
from System.Windows.Forms import *

from shutil import copyfile
import tempfile
import os
# The inputs to this node will be stored as a list in the IN variables.
dataEnteringNode = IN
exDat = IN[0]
_path = IN[1]
#list1Line = []
allText=""

TAB = "\t"
BREAKLINE = "\n"

test1 = os.path.isdir(_path)
test2 = os.path.exists(_path)
test3 = os.path.isfile(_path)

# Place your code below this line

#WRITE EXCEL DATA LIST TO TEMP TXT FILE THEN COPY TO TARGET PATH
def writeTxtFromExcelDat(exDat,_TAB,_BREAKLINE): #from excel data list
	allText=""
	TAB = _TAB
	BREAKLINE = _BREAKLINE	
	for d in exDat:
		str = ""
		strF = "{0}{1}"		
		if d[0] and len(d)>0:		
			for c in d:
				if c:
					str += strF.format(c,TAB)
		if len(str)>0:
			str += BREAKLINE	
		#list1Line.append(str)
		allText += str	
	f = open(path,"w")
	f.write(allText.encode('utf8'))
	f.close
	return allText
	
#WRITE "ONE_LINE" DATA TO TEMP TXT FILE THEN COPY TO TARGET PATH
def writeTxtFromTxtString(PATH, exDat,_TAB,_BREAKLINE): #from txt string	
	with open(PATH,"w") as f:
		f.write(exDat.encode('utf8'))		
	copyfile(PATH,_path)	
	return exDat
###################
tempDir = tempfile.gettempdir()
fileName = _path.split("\\")[-1]
PATH = tempDir + fileName
if not exDat ==  None and not test1 and len(exDat) >0:
	allText = writeTxtFromTxtString(PATH, exDat,TAB,BREAKLINE)
#MessageBox.Show(allText)
# Assign your output to the OUT variable.
OUT = allText
# ----------------------------------------

# group: Combine data
code_block_10 = CodeBlock(dir=code_block_3, fn=code_block_4.QTO) { dir+fn+"-Combine.txt"; }  # frozen
python_script_write_to_txt_2 = Python(IN[0]=python_script_read_txt_out_list, IN[1]=code_block_10)  # "Python Script-Write to TXT-APPEND"; frozen
# ---------- python_script_write_to_txt_2.python (68 lines) ----------
# Load the Python Standard and DesignScript Libraries
import sys
import clr
clr.AddReference('ProtoGeometry')
from Autodesk.DesignScript.Geometry import *

clr.AddReference('System.IO')
clr.AddReference('System.Drawing')
clr.AddReference('System.Reflection')
clr.AddReference('System.Threading')
clr.AddReference("System.Windows.Forms")

import System
import System.IO
import System.Drawing
import System.Reflection
import System.Windows.Forms

from System.Threading import ApartmentState, Thread, ThreadStart
from System.Windows.Forms import *

import os
# The inputs to this node will be stored as a list in the IN variables.
dataEnteringNode = IN
exDat = IN[0]
path = IN[1]
#list1Line = []
allText=""

TAB = "\t"
BREAKLINE = "\n"

test1 = os.path.isdir(path)
test2 = os.path.exists(path)
test3 = os.path.isfile(path)

# Place your code below this line

def writeTxtFromExcelDat(exDat,_TAB,_BREAKLINE): #from excel data list
	allText=""
	TAB = _TAB
	BREAKLINE = _BREAKLINE	
	for d in exDat:
		str = ""
		strF = "{0}{1}"		
		if d[0] and len(d)>0:		
			for c in d:
				if c:
					str += strF.format(c,TAB)
		if len(str)>0:
			str += BREAKLINE	
		#list1Line.append(str)
		allText += str	
	f = open(path,"a")
	f.write(allText.encode('utf8'))
	f.close
	return allText
def writeTxtFromTxtString(exDat,_TAB,_BREAKLINE): #from txt string	
	f = open(path,"a")
	f.write(exDat.encode('utf8'))
	f.close
	return exDat
###################
if not test1 and len(exDat) >0:
	allText = writeTxtFromTxtString(exDat,TAB,BREAKLINE)
#MessageBox.Show(allText)
# Assign your output to the OUT variable.
OUT = path
# ----------------------------------------

python_script_read_txt_out_dic_4 = Python(IN[0]=python_script_write_to_txt_2)  # "Python Script-Read txt-OUT DIC ARRAY"; frozen
# ---------- python_script_read_txt_out_dic_4.python (38 lines) ----------
# Load the Python Standard and DesignScript Libraries
import sys
import clr
clr.AddReference('ProtoGeometry')
from Autodesk.DesignScript.Geometry import *

import os

# The inputs to this node will be stored as a list in the IN variables.
dataEnteringNode = IN
path = IN[0]
# ini
TAB = "\t"
BREAKLINE = "\n"
###
def createData(path):
	dic = {}
	with open(path,"r") as f:
		lines = f.readlines()
		for l in lines:
			dic[l.split(TAB)[0]] = l
			#dic.append(l)	
	
	return dic
# Place your code below this line

test1 = os.path.isdir(path)
test2 = os.path.exists(path)
test3 = os.path.isfile(path)

res = createData(path)
res2 = ""
for k in res.keys():
	res2 += res.get(k) + BREAKLINE
	

# Assign your output to the OUT variable.
OUT = res2
# ----------------------------------------
python_script_write_to_txt_3 = Python(IN[0]=python_script_read_txt_out_dic_4, IN[1]=code_block_10)  # "Python Script-Write to TXT-APPEND"; same code as python_script_write_to_txt_2
python_script_read_txt_out_list_2 = Python(IN[0]=code_block_8, IN[1]=python_script_read_txt_out_dic, IN[2]=python_script_read_txt_out_dic_2, IN[3]=python_script_read_txt_out_dic_3)  # "Python Script-Read txt-OUT List DATA"; frozen
# ---------- python_script_read_txt_out_list_2.python (107 lines) ----------
# Load the Python Standard and DesignScript Libraries
import sys
import clr
clr.AddReference('ProtoGeometry')
from Autodesk.DesignScript.Geometry import *

import os

# The inputs to this node will be stored as a list in the IN variables.
dataEnteringNode = IN
path = IN[0]
keys = IN[1]
dic1 = IN[2]
dic2 = IN[3]

# ini
TAB = "____"
ATTBREAK = " : "
TAB1 = "\t"
BREAKLINE = "\n"
###
def readTxtDatToDic(path):
	dat=[]
	dic = []
	with open(path,"r") as f:
		lines = f.readlines()
		for l in lines:
			try:
				dL = {}
				if len(l)>0:
					d =[]
					spl = l.decode('utf-8').split(TAB)
					for att in spl:
						try:
							if len(att.split(ATTBREAK)) == 1:
								dL[att.split(ATTBREAK)[0]] = ""
							else:
								dL[att.split(ATTBREAK)[0]] = att.split(ATTBREAK)[1]
						except:
							pass
					#dat.append(l.decode('utf-8'))
					dat.append(dL)
			except:
				pass
			#dat.append(dL)	
	return dat




# Place your code below this line

test1 = os.path.isdir(path)
test2 = os.path.exists(path)
test3 = os.path.isfile(path)

dat=readTxtDatToDic(path)

res= []
fn = ""
fn2 = []
exxx = []
try:
	for d in dat:
		str = ""
		f2 = []
		dicParamKey = ""
		dicParam=""
		try:
			for k in keys:
				if d.get('Category') == k:
					dicParamKey = dic1.get(k)
					dicParam = dic2.get(dicParamKey)
		except Exception, ex2:
			exxx.append(ex2)
			pass
		try:
			for p in dicParam:
				v=""
				if d.get(p) is None:
					d[p] = ""
				v= d.get(p).ToString()
				
				str += v + TAB1
				s2 = p + " : " + d.get(p)
				
				f2.append(s2)
		except Exception, ex2:
			exxx.append(ex2)
			pass
		fn += str + BREAKLINE
		res.append(str)
		
		fn2.append(f2)
		
except Exception, ex3:
	exxx.append(ex3)
	pass
	

t = dat[0].get('Width')
"""
for d1 in dic2.keys():
	res.append(dic2.get(d1))
"""
# Assign your output to the OUT variable.
OUT = dicParam,dat,fn2,exxx,t##dat#createDic(dat)#dat[0].split(TAB) #
# ----------------------------------------
code_block_11 = CodeBlock(r=python_script_read_txt_out_list_2) { r[0]; r[2]; r[1]; r[4]; }
watch = Watch(code_block_11.out0)
watch_2 = Watch(code_block_11.out1)
watch_3 = Watch(code_block_11.out2)
watch_4 = Watch(code_block_11.out3)
watch_5 = Watch(python_script_read_txt_out_list)
watch_6 = Watch(python_script_read_txt_out_dic)
watch_7 = Watch(python_script_read_txt_out_dic_2)
watch_8 = Watch(python_script_read_txt_out_dic_3)

# group: DIC LOOKUP
code_block_12 = CodeBlock(dir=code_block_3, shn=code_block_4.lookup) { dir+shn+".txt"; rowN = 2; colN = 0; }
python_script_read_txt_out_dic_5 = Python(IN[0]=code_block_12.out0, IN[1]=code_block_12.rowN, IN[2]=code_block_12.colN)  # "Python Script-Read txt-OUT DIC ARRAY-210302"
# ---------- python_script_read_txt_out_dic_5.python (49 lines) ----------
# Load the Python Standard and DesignScript Libraries
import sys
import clr
clr.AddReference('ProtoGeometry')
from Autodesk.DesignScript.Geometry import *

import os

# The inputs to this node will be stored as a list in the IN variables.
dataEnteringNode = IN
path = IN[0]
rowN = IN[1]
colN = IN[2]
# ini
TAB = "\t"
BREAKLINE = "\n"
###
def createQTOreqDic (path):
	dat=[]
	dic = []
	with open(path,"r") as f:
		lines = f.readlines()
		for l in lines:
			if len(l)>0:
				d =[]
				for att in l.decode('utf-8').split(TAB):
					d.append(att)
				dat.append(l.decode('utf-8'))
	di = {}
	for d in dat[rowN:]:		
		reqs = []
		for req in d.split(TAB)[1:]:			
			if req and not req == BREAKLINE:
				reqs.append(req)
			
		di[d.split(TAB)[0]] = reqs
		#for att in d.split(TAB):
	
	return di
# Place your code below this line
"""
test1 = os.path.isdir(path)
test2 = os.path.exists(path)
test3 = os.path.isfile(path)
"""
dat=createQTOreqDic (path)

# Assign your output to the OUT variable.
OUT = dat
# ----------------------------------------

watch_9 = Watch(python_script_read_txt_out_dic_5)
override_result = BoolSelector(false)  # graph input
if_2 = If(test=override_result)  # unwired: true, false
