# Dynamo graph 10-GetGridIntersect.dyn (Dynamo 2.3.0.5885)

python_script_grid_intersect = Python()
# ---------- python_script_grid_intersect.python (402 lines) ----------
# Load the Python Standard and DesignScript Libraries
import sys
import clr
from clr import StrongBox
clr.AddReference('ProtoGeometry')
from Autodesk.DesignScript.Geometry import *
clr.AddReference('RevitAPI')
from Autodesk.Revit.DB import *
from Autodesk.Revit.DB.SolidSolidCutUtils import *
clr.AddReference('RevitAPIUI')
from Autodesk.Revit.UI import TaskDialog
clr.AddReference("RevitNodes")
import Revit
clr.ImportExtensions(Revit.Elements)
clr.AddReference("RevitServices")
import RevitServices
from RevitServices.Persistence import DocumentManager
from RevitServices.Transactions import TransactionManager
from System.Collections.Generic import *
clr.ImportExtensions(Revit.GeometryConversion)
clr.AddReference('System.Windows.Forms')
import System.Windows.Forms
from System.Windows.Forms import *
import System
from System.Collections.Generic import List
from shutil import copyfile
import tempfile
import uuid
import os
##
doc = DocumentManager.Instance.CurrentDBDocument
uiapp = DocumentManager.Instance.CurrentUIApplication
app = uiapp.Application
opt = Options()
# The inputs to this node will be stored as a list in the IN variables.
dataEnteringNode = IN
# Place your code below this line

def allElemsOfCat(catName,doc):
	res = []
	cat = []
	try:
		for e in doc.Settings.Categories:			
			if e.Name == catName.ToString():
				cat = e	
		elems = FilteredElementCollector(doc).OfCategoryId(cat.Id).WhereElementIsNotElementType()	
		for e in elems:
			res.append(e)
	except:
		pass
	return res

def allElemsIntersectedOfCat(ee,catName,doc):
	res = []
	cat = []
	for e in doc.Settings.Categories:
	#res.append(e.Name)
		if e.Name == catName.ToString():
			cat = e	
	elems = FilteredElementCollector(doc).OfCategoryId(cat.Id).WherePasses(ElementIntersectsElementFilter(ee))#.WhereElementIsNotElementType()
	for eee in elems:
		res.append(eee)
	return res   

def allElemsNOTIntersectedOfCat(ee,catName,doc):
	res = []
	cat = []
	for e in doc.Settings.Categories:
	#res.append(e.Name)
		if e.Name == catName.ToString():
			cat = e	
	elems = FilteredElementCollector(doc).OfCategoryId(cat.Id).WherePasses(ElementIntersectsElementFilter(ee),False)#.WhereElementIsNotElementType()
	for eee in elems:
		res.append(eee)
	return res

def joinTwoElement(a,b):	
	boolCut = JGU.AreElementsJoined(doc,a,b)
	if not boolCut:
		JGU.JoinGeometry(doc,a,b)
		if not JGU.IsCuttingElementInJoin(doc,a,b):
			JGU.SwitchJoinOrder(doc,a,b)
def UNjoinTwoElement(a,b):
	JGU.UnjoinGeometry(doc,a,b)

def joinAllEnableJoinedElemsOfCat(e,cat,doc):
	elems = allElemsIntersectedOfCat(e,cat,doc)
	for el in elems:
		joinTwoElement(e,el)
def UNjoinAllNOTJoinedElemsOfCat(e,cat,doc):
	elems = allElemsNOTIntersectedOfCat(e,cat,doc)
	for el in elems:
		UNjoinTwoElement(e,el)
####
def getSolids(e):
	solid = []
	geoE1 = e.get_Geometry(opt)
	geoE2 = []
	try:
		enum = geoE1.GetEnumerator()	
		while enum.MoveNext():
			geoE2 = enum.Current
		if isinstance(geoE2,Solid):
			solid.Add(geoE2)
		
		else:
			if isinstance(geoE2,GeometryInstance):
				geoObj = geoE2.GetInstanceGeometry()
				for s in geoObj:
					if isinstance(s,Solid) and s.Volume > 0:
						solid.Add(s)	
	except Exceptyion, ex:
		mergedSolid.append(ex)
		pass	
	return solid
####
def UnionSolid (solids):
	mergedSolid = []
	try:
		if len(solids) == 0:
			return null
		if len(solids) == 1:
			return solids[0]
		else:			
			first = solids[0]
			res = solids[1:]
			second = UnionSolid(res)			
			mergedSolid = BooleanOperationsUtils.ExecuteBooleanOperation(first,second,BooleanOperationsType.Union)
	except Exceptyion, ex:
		mergedSolid.append(ex)
		pass
	return mergedSolid

def getRawVolume(solids):
	vol = 0
	try:
		for s in solids:
			vol += s.Volume*0.0283168
	except:	
		pass
	return vol

def getSeftVolume(solids): #Intersect SOlids togeget
	mergedSolid = []
	vol = []
	try:
		mergedSolid = UnionSolid(solids)
		vol = mergedSolid.Volume*0.0283168
	except:	
		pass
	return vol
def exportSolidToSAT(app,msolid,path):
	res = []
	#FAMILY CREATION
	famPath = app.FamilyTemplatePath + "\\Conceptual Mass\\Metric Mass.rft"
	famdoc = app.NewFamilyDocument(famPath)
	#create Freeform by solid
	with Transaction(famdoc,"Create Free Form") as t:
		t.Start()
		try:	
			freeFormElement = FreeFormElement.Create(famdoc,msolid)
		except Exception, ex:
			res.append(ex)
			pass
		t.Commit()
	tempDir = tempfile.gettempdir()
	tempFamName = tempDir + "\\temFamily"+".rfa"
	#if os.path.isfile(tempFamName):
		#tempFamName = tempDir + "\\temFamily"+"-"+ msolid.UniqueId.ToString() +".rfa"
	
	sao = SaveAsOptions()
	sao.OverwriteExistingFile = True
	famdoc.SaveAs(tempFamName,sao)
	"""
	sav = SaveOptions()
	famdoc.Save(sav)
	"""
	viewFamTypes = FilteredElementCollector(famdoc).OfClass(ViewFamilyType)
	viewTypeID = 0
	
	for vft in viewFamTypes:
		if vft.ViewFamily == ViewFamily.ThreeDimensional:
			viewTypeID = vft.Id
	
	#export SAT
	with Transaction(famdoc,"Export SAT") as tt:
		tt.Start()
		view3D = View3D.CreateIsometric(famdoc,viewTypeID)
		tt.Commit()
	
	viewSet = List[ElementId]()
	viewSet.Add(view3D.Id)
	exportOptions=SATExportOptions()
	famdoc.Export (path,"SolidFile.sat", viewSet, exportOptions)
	return res


def readLinesDYNString(str):
	res = []
	for s in catNames.split("\n"):
		res.append(s[:-1])
	return res

def exportSolidToSATMulti(app,listmsolid,path):
	
	res = []
	#FAMILY CREATION
	famPath = app.FamilyTemplatePath + "\\Conceptual Mass\\Metric Mass.rft"
	famdoc = app.NewFamilyDocument(famPath)	
	tempDir = tempfile.gettempdir()
	tempFamName = tempDir + "\\temFamily"+".rfa"
	#if os.path.isfile(tempFamName):
		#tempFamName = tempDir + "\\temFamily"+"-"+ msolid.UniqueId.ToString() +".rfa"	
	sao = SaveAsOptions()
	sao.OverwriteExistingFile = True
	famdoc.SaveAs(tempFamName,sao)
	"""
	sav = SaveOptions()
	famdoc.Save(sav)
	"""
	viewFamTypes = FilteredElementCollector(famdoc).OfClass(ViewFamilyType)
	viewTypeID = 0	
	for vft in viewFamTypes:
		if vft.ViewFamily == ViewFamily.ThreeDimensional:
			viewTypeID = vft.Id
	
	with Transaction(famdoc,"CreateView") as tt:
		tt.Start()
		view3D = View3D.CreateIsometric(famdoc,viewTypeID)
		tt.Commit()
	viewSet = List[ElementId]()
	viewSet.Add(view3D.Id)	
	
	#export SAT
	#create Freeform by solid
	for i in range(len(listmsolid)):
		msolid = listmsolid[i]
		with Transaction(famdoc,"Create Free Form") as t:
			t.Start()
			try:	
				freeFormElement = FreeFormElement.Create(famdoc,msolid)
			except Exception, ex:
				res.append(ex)
				pass
			t.Commit()
		exportOptions=SATExportOptions()
		satFN = "Solid" + "-" + str(i) +".sat"
		famdoc.Export (path,satFN, viewSet, exportOptions)
		with Transaction(famdoc,"Delete") as ttt:
			ttt.Start()
			if not os.path.isfile(path+"\\"+satFN):
				famdoc.Delete(freeFormElement.Id)	
			ttt.Commit()			
		
		#sav = SaveOptions()
		#famdoc.Save(sav)
		res.append(i)	
	
	return res
def getElementCurve(ee):
	curve = Line.CreateBound(XYZ(),XYZ(1,1,1))
	try:
		cv = ee.Curve
		if cv:
			curve = cv
	except:
		pass
	return curve
def getElementCurves(elems):
	curves = []
	try:	
		for ee in elems:
			cv = ee.Curve
			if cv:
				curves.append(cv)
	except:
		pass
	return curves
def flatLines(lines):
	curves = []
	try:		
		for ln in lines:
			sp = XYZ(ln.GetEndPoint(0).X,ln.GetEndPoint(0).Y,0)
			ep = XYZ(ln.GetEndPoint(1).X,ln.GetEndPoint(1).Y,0)
			newLn = Line.CreateBound(sp,ep)
			if newLn:
				curves.append(newLn)
	except Exception, ex:
		curves.append(ex)
		pass
	return curves
def flatLine(ln):
	newLn = Line.CreateBound(XYZ(),XYZ(1,1,1))
	try:
		sp = XYZ(ln.GetEndPoint(0).X,ln.GetEndPoint(0).Y,0)
		ep = XYZ(ln.GetEndPoint(1).X,ln.GetEndPoint(1).Y,0)
		newLn = Line.CreateBound(sp,ep)
	except:
		pass
	return newLn

def GetIntersectGridVsGrids(curve,curveElems):#lay danh sach diem giao truc
	res = []
	ce0 =getElementCurve(curve)
	count = len(curveElems)	
	for ce in curveElems:
		ira = StrongBox[IntersectionResultArray]()
		irs = IntersectionResult()
		try:
			cee = getElementCurve(ce)
			intesect = ce0.Intersect(cee,ira)
			irs = ira.get_Item(0)
			if intesect == SetComparisonResult.Overlap:
				ipt = irs.XYZPoint
				res.append(ipt)
		except:
			pass
	return res
def GetIntersectGridVsGrids2(curve,curveElems):#lay danh sach ten 2 truc giao
	res = []
	name1 = curve.LookupParameter("Name").AsString()
	ce0 =getElementCurve(curve)
	count = len(curveElems)	
	for ce in curveElems:
		name2 = ce.LookupParameter("Name").AsString()
		ira = StrongBox[IntersectionResultArray]()
		irs = IntersectionResult()
		try:
			cee = getElementCurve(ce)
			intesect = ce0.Intersect(cee,ira)
			irs = ira.get_Item(0)
			if intesect == SetComparisonResult.Overlap:
				ipt = irs.XYZPoint
				name = name1+"/"+name2
				
				#res.append(ipt)
				res.append(name)
		except:
			pass
	return res

def Get2CurvesIntersectPoint(ce0,cee):
	ipt = XYZ()
	ira = StrongBox[IntersectionResultArray]()
	irs = IntersectionResult()
	try:	
		ipt = ce0.Intersect(cee,ira)
		irs = ira.get_Item(0)
	except Exception, ex:
		ipt = ex
		pass
	return irs.XYZPoint
	
	
	
def intersectGridsPoints(doc,catName):
	grids = allElemsOfCat(catName,doc)	
	res = []	
	iniC = len(grids)
	count = iniC
	try:
		while count >2:
			gr = grids[iniC-count]
			rest = grids[iniC-count+1:]
			intersect = GetIntersectGridVsGrids(gr,rest)
			if len(intersect) > 0:
				for ints in intersect:
					res.Add(ints)
			count-=1	
	except:
		pass
	return res
	
def intersectGridsPointNames(doc,catName):#lay danh sach Giao truc và ten
	grids = allElemsOfCat(catName,doc)	
	res = []	
	iniC = len(grids)
	count = iniC
	try:
		while count >2:
			gr = grids[iniC-count]
			rest = grids[iniC-count+1:]			
			intersect = GetIntersectGridVsGrids(gr,rest)
			name = GetIntersectGridVsGrids2(gr,rest)
			if len(intersect) > 0 and len(intersect) == len(name):
				for i in range(len(intersect)):
					ints = intersect[i]
					n = name[i]					
					r = []
					r.append(n)
					r.append(ints)
					res.Add(r)
			count-=1	
	except:
		pass
	return res
###################################

catName = "Grids"
res1 = intersectGridsPoints(doc,catName)
res2 = intersectGridsPointNames(doc,catName)
OUT = res1,res2
# ----------------------------------------
code_block = CodeBlock(grids=python_script_grid_intersect)
# ---------- code_block.designscript (4 lines) ----------
grids[0];
//points;
grids[1];
//names;
# ----------------------------------------
watch = Watch(code_block.out0)
watch_2 = Watch(code_block.out1)
