# Dynamo graph 13-Tracking-StringRegex.dyn (Dynamo 2.3.0.5885)

input_2_column_sep_tab = StringInput("""25P5-1 (5/H)	17/12/2020
13P5-1 (6/F-G); 2P5-1 (6/P4-F); 1P5-1A (6-7/G); 2P5-1(6-7/P4-F); 7P5-1 (7/G); 7P5-1 (7/F); 7P5-1 (8/G)	19/12/2020
25P5-1 (10/H)	20/12/2020
2P5-1D (9/H); 2P5-1F (8-9/H); 13P5-1 (9/F-G); 2P5-1 (9/P4-F); 7P5-1 (8/F)	23/12/2020
1P5-3 (3-4/E), 2P5-3 (3/E), 4P5-3A (3-4/E-D), 5P5-3 (3/E-D), 5P5-3 (3-4/D), 4P5-1A (4+4,7m/C), 11P5-1 (5/F-G), 2P5-1F (6/H), 2P5-1F (6-7/H), 3P5-1 (8/H), 2P5-1 (8-9/P4-F)	27/12/2020
1P5-3 (1'-E), 6P5-3 (1/D-E), 6P5-3 (2/D-E), 3P5-3 (2/E), 1P5-1C (6-7/H'), 4P5-1D (7/H), 2P5-1G (8/H'), 1P5-1C (8-9/H'), 7P5-3 (3/D)	30/12/2020
8P5-3 (2/D), 9P5-3 (1/D), 2P5-3 (1'/D), 2P5-3 (1'/D-E), 4P5-3 (1/E), 2P5-1D (7/P4), 2P5-1 (8/P4)	3/1/2021
2P5-3 (1'/C-D)	5/1/2021
4P5-1 (10'/G), 7P5-1A (11/K), 6P5-1 (11/L), 3P5-1 (11'/M), 4P5-1B (11/M-N)	7/1/2021
2P5-1 (9-10/P4-F), 11P5-1B (10/F-G), 5P5-1B (11-12/M-N), 12P5-1 (12/M), 2P5-1 (10'-H)	9/1/2021
1P5-1A (8-9/G), 2P5-1 (10/P3), 2P5-1 (11-12/J), 2P5-1 (12/J), 11P5-1A (11/M), 16P5-1 (12/K-L), 2P5-1 (12-13/J-K), 5P5-1C (13/K), 4P5-1 (13/J), 4P5-1 (14/J), 1P5-1 (13-14/J-K), 1P5-1 (14-14'/P9)	13/1/2021
14P5-1 (4/B-C)	13/1/2021
3P5-3B (5/P3), 4P5-3 (6-P3), 1P5-3 (5-6/P2-P3), 2P5-3 (5-6/P2), 4P5-3 (6/P2), 1P5-3 (5-6/P1-P2), 2P5-3 (6/P1)	15/1/2021
2P5-1 (5-6/P4-F), dầm 1HB49, 1BV52	18/1/2021
2P5-1 (14/P6), 2P5-1 (14/P8), 2P5-1 (14/P9), 2P5-1D (14'/J), 8P5-1A (14/K)	25/1/2021
3P5-3 (7/P3), 4P5-3 (7/P2), 3P5-3 (7/P1), 3P5-3B (8/P3), 4P5-3 (8/P2), 4P5-3 (8/P1), 4P5-1C (9/P3), 3P5-3 (9/P2), 4P5-3B (9/P1), 1P5-3 (9-10/P2), 1P5-3 (9-10/P1)	27/1/2021
2P5-1B (10'/P2), 2P5-1H (10'/P1)	29/1/2021
1P5-1 (1'/A'), 1P5-1 (1'/A), 1P5-1 (1'/A-B), 1P5-1 (1'/B), 1P5-1 (1/A'), 4P5-1A (1/A), 1P5-1 (1/A-B), 5P5-1 (1/B), 7P5-1 (1/C), 3P5-1B (2/A), 5P5-1 (2/B), 6P5-1 (2/C), 1P5-1D (3/A), 13P5-1A (3/B-C)	30/1/2021
1P5-1 (4/E), 5P5-4 (4/D-E), 6P5-4 (4/D), 1P5-1 (4'/E), 2P5-1A (4'/D-E), 3P5-1A (4'/D), 2P5-1 (5'/H)	2/2/2021
1P5-1 (3-4/A), 1P5-1E (3-4/A), 1P5-1E (4/A), 1P5-1E (5/P4-F) 	3/2/2021
""")  # graph input
python_script = Python(IN[0]=input_2_column_sep_tab)
# ---------- python_script.python (232 lines) ----------
# Load the Python Standard and DesignScript Libraries
import sys
import clr
clr.AddReference('ProtoGeometry')
from Autodesk.DesignScript.Geometry import *

import re
# The inputs to this node will be stored as a list in the IN variables.
dataEnteringNode = IN

# Place your code below this line
str = IN[0]
"""
1P5-3 (3-4/E), 2P5-3 (3/E), 4P5-3A (3-4/E-D), 5P5-3 (3/E-D), 5P5-3 (3-4/D), 4P5-1A (4+4.7m/C), 11P5-1 (5/F-G), 2P5-1F (6/H), 2P5-1F (6-7/H), 3P5-1 (8/H), 2P5-1 (8-9/P4-F)	27/12/2020
"""
###################################################################################
def fun1(r1): # tach chuoi gia tri tim kiem sep = (
	res0 = []
	try:
		res0 = r1.split("(")[0]
	except:
		pass
		
def fun2(r1): #tach chuoi (ngay thang nam)
	res2 = []
	try:
		res2 = r1.split("(")[1].split(")")[0]
	except:
		pass	
	return res2
	
def fun21(r1): # tach chuoi gia tri tim kiem sep = (
	res0 = []
	try:
		res0.append(r1.split("(")[0])
		res0.append(r1.split("(")[1].split(")")[0])
	except:
		pass
	return res0
def fun22(r1): # tach chuoi gia tri tim kiem sep = (
	res0 = []
	try:
		res0.append(r1.split("(")[0])		
		for gri in fun6(r1.split("(")[1].split(")")[0]):		
			res0.Add(gri)
	except:
		pass
	return res0	
def fun3(r2): # tách chuoi Giao 2 truc: Truc 1 / Truc 2
	res3 = []
	try:
		res3.append(r2.split("/"))
	except:
		pass
	return res3
	
def fun4(cp): # Phan tich danhsach cap doi (doi tuong(s), ngay) thanh danh sach chi tiet cho tung doi tuong
	res = []
	if cp[0].split(";"):
		for cpp in cp[0].split(";"):
			npr = []
			npr.append(cpp)
			npr.append(cp[1])			
			res.append(npr)
	return res

def fun41(cp): # Phan tich danhsach cap doi (doi tuong(s), ngay) thanh danh sach chi tiet cho tung doi tuong
	res = []
	if cp[0].split(";"):
		for cpp in cp[0].split(";"):
			npr = []
			npr.append(fun21(cpp))
			npr.append(cp[1])			
			res.append(npr)
	return res
def fun42(cp): # Phan tich danhsach cap doi (doi tuong(s), ngay) thanh danh sach chi tiet cho tung doi tuong
	res = []
	if cp[0].split(";"):
		for cpp in cp[0].split(";"):
			npr = []
			npr.append(fun22(cpp))
			npr.append(cp[1])			
			res.append(npr)
	return res

def fun6(r2): # Tách giao truc
	res3 = []
	try:
		spl = r2.split("/")
		if len(spl) == 2:
			if "-" in spl[0]:
				for sp in spl[0].split("-"):
					if	"-" in spl[1]:
						for ssp in spl[1].split("-"):
							res3.append(sp + "/" + ssp)
					else:
						res3.append(sp + "/" + spl[1])
			else:
				if	"-" in spl[1]:
					for sssp in spl[1].split("-"):
						res3.append( spl[0] + "/" + sssp)
				else:
					res3.append(spl[0] + "/" + spl[1])
	
	except:
		pass	
	return res3
###################################################################################
lines = []
for ln in str.Split("\n"):	
	try:
		if ln:
			lines.append(ln[:-1])
	except:
		pass	


pairLookup=[]
for lk in lines:	
	try:
		pr = []	
		s = lk.Split("\t")[0]
		s = re.sub(" ","",s)	
		s = re.sub(",",";",s)
		pr.append(s)
		
		ss = lk.Split("\t")[1]
		ss = re.sub(" ","",ss)
		
		pr.append(ss)
		pairLookup.append(pr)#lk.Split("\t"))		
	
	except:
		pass

pairLookup2=[]
for lk in lines:	
	try:
		pr = []	
		s = lk.Split("\t")[0]
		s = re.sub(" ","",s)	
		s = re.sub(",",";",s)
		pr.append(s)
		
		ss = lk.Split("\t")[1]
		ss = re.sub(" ","",ss)
		
		pr.append(ss)
		
		ppr = fun4(pr)
		for pprr in ppr:	
			pairLookup2.Add(pprr)#lk.Split("\t"))		
	
	except:
		pass


pairLookup3=[]
for lk in lines:	
	try:
		pr = []	
		s = lk.Split("\t")[0]
		s = re.sub(" ","",s)	
		s = re.sub(",",";",s)
		pr.append(s)
		
		ss = lk.Split("\t")[1]
		ss = re.sub(" ","",ss)
		
		pr.append(ss)
		
		ppr = fun41(pr)
		for pprr in ppr:	
			pairLookup3.Add(pprr)#lk.Split("\t"))		
	
	except:
		pass


pairLookup4=[]
for lk in lines:	
	try:
		pr = []	
		s = lk.Split("\t")[0]
		s = re.sub(" ","",s)	
		s = re.sub(",",";",s)
		pr.append(s)
		
		ss = lk.Split("\t")[1]
		ss = re.sub(" ","",ss)
		
		pr.append(ss)
		
		ppr = fun42(pr)
		for pprr in ppr:	
			pairLookup4.Add(pprr)#lk.Split("\t"))		
	
	except:
		pass

spliter = str.Split("\t")[0].split(",")

res1= []
for s in spliter:
	try:
		s1 = re.sub(" ","",s)
		s2 = re.sub("\n","",s1)
		res1.append(s2)
	except:
		pass
res0 = []
for r1 in res1:
	try:
		res0.append(r1.split("(")[0])
	except:
		pass		
res2 = []

for r1 in res1:
	try:
		res2.append(r1.split("(")[1].split(")")[0])
	except:
		pass
	
res3 = []
for r2 in res2:
	try:
		res3.append(r2.split("/"))
	except:
		pass
# Assign your output to the OUT variable.
OUT = lines, pairLookup,pairLookup2,pairLookup3,pairLookup4
# ----------------------------------------
code_block = CodeBlock(res=python_script) { res[0]; res[1]; res[2]; res[3]; res[4]; }
watch = Watch(code_block.out0)
watch_2 = Watch(code_block.out1)
watch_3 = Watch(code_block.out2)
watch_4 = Watch(code_block.out3)
watch_5 = Watch(code_block.out4)
