# Dynamo graph StringRegex.dyn (Dynamo 2.10.0.3455)

python_script = Python()  # IronPython2
# ---------- python_script.python (50 lines) ----------
# Load the Python Standard and DesignScript Libraries
import sys
import clr
clr.AddReference('ProtoGeometry')
from Autodesk.DesignScript.Geometry import *

import re
# The inputs to this node will be stored as a list in the IN variables.
dataEnteringNode = IN

# Place your code below this line
str = """
1P5-3 (3-4/E), 2P5-3 (3/E), 4P5-3A (3-4/E-D), 5P5-3 (3/E-D), 5P5-3 (3-4/D), 4P5-1A (4+4.7m/C), 11P5-1 (5/F-G), 2P5-1F (6/H), 2P5-1F (6-7/H), 3P5-1 (8/H), 2P5-1 (8-9/P4-F)	27/12/2020
"""
str.Split("\t")
spliter = str.Split("\t")[0].split(",")

res= str.Split("\t")[1]

res1= []

for s in spliter:
	try:
		s1 = re.sub(" ","",s)
		s2 = re.sub("\n","",s1)
		res1.append(s2)
	except:
		pass
res0 = []
for r1 in res1:
	try:
		res0.append(r1.split("(")[0])
	except:
		pass		
res2 = []

for r1 in res1:
	try:
		res2.append(r1.split("(")[1].split(")")[0])
	except:
		pass
	
res3 = []
for r2 in res2:
	try:
		res3.append(r2.split("/"))
	except:
		pass
# Assign your output to the OUT variable.
OUT = res1, res2,res3,res0,res
# ----------------------------------------
code_block = CodeBlock(res=python_script) { res[0]; res[1]; res[2]; res[3]; res[4]; }
watch = Watch(code_block.out0)
watch_2 = Watch(code_block.out1)
watch_3 = Watch(code_block.out2)
watch_4 = Watch(code_block.out3)
watch_5 = Watch(code_block.out4)
