# Dynamo graph StringRegex2.dyn (Dynamo 2.10.0.3455)

python_script = Python()  # IronPython2; frozen
# ---------- python_script.python (50 lines) ----------
# Load the Python Standard and DesignScript Libraries
import sys
import clr
clr.AddReference('ProtoGeometry')
from Autodesk.DesignScript.Geometry import *

import re
# The inputs to this node will be stored as a list in the IN variables.
dataEnteringNode = IN

# Place your code below this line
str = """
1P5-3 (3-4/E), 2P5-3 (3/E), 4P5-3A (3-4/E-D), 5P5-3 (3/E-D), 5P5-3 (3-4/D), 4P5-1A (4+4.7m/C), 11P5-1 (5/F-G), 2P5-1F (6/H), 2P5-1F (6-7/H), 3P5-1 (8/H), 2P5-1 (8-9/P4-F)	27/12/2020
"""
str.Split("\t")
spliter = str.Split("\t")[0].split(",")

res= str.Split("\t")[1]

res1= []

for s in spliter:
	try:
		s1 = re.sub(" ","",s)
		s2 = re.sub("\n","",s1)
		res1.append(s2)
	except:
		pass
res0 = []
for r1 in res1:
	try:
		res0.append(r1.split("(")[0])
	except:
		pass		
res2 = []

for r1 in res1:
	try:
		res2.append(r1.split("(")[1].split(")")[0])
	except:
		pass
	
res3 = []
for r2 in res2:
	try:
		res3.append(r2.split("/"))
	except:
		pass
# Assign your output to the OUT variable.
OUT = res1, res2,res3,res0,res
# ----------------------------------------
code_block = CodeBlock(res=python_script) { res[0]; res[1]; res[2]; res[3]; res[4]; }
watch = Watch(code_block.out0)
watch_2 = Watch(code_block.out1)
watch_3 = Watch(code_block.out2)
watch_4 = Watch(code_block.out3)
watch_5 = Watch(code_block.out4)
string = StringInput("""u	u
ú	u
ù	u
ủ	u
ũ	u
ụ	u
ư	u
ứ	u
ừ	u
ử	u
ữ	u
ự	u
e	e
é	e
è	e
ẻ	e
ẽ	e
ẹ	e
ê	e
ế	e
ề	e
ể	e
ễ	e
ệ	e
o	o
ó	o
ò	o
ỏ	o
õ	o
ọ	o
ơ	o
ớ	o
ờ	o
ở	o
ỡ	o
ợ	o
ô	o
ố	o
ồ	o
ổ	o
ỗ	o
ộ	o
a	a
á	a
à	a
ả	a
ã	a
ạ	a
ă	a
ắ	a
ằ	a
ẳ	a
ẵ	a
ặ	a
â	a
ấ	a
ầ	a
ẩ	a
ẫ	a
ậ	a
i	i
í	i
ì	i
ỉ	i
ĩ	i
ị	i""")
python_script_2 = Python(IN[0]=string)  # IronPython2
# ---------- python_script_2.python (194 lines) ----------
# Load the Python Standard and DesignScript Libraries
import sys
import clr
clr.AddReference('ProtoGeometry')
from Autodesk.DesignScript.Geometry import *

import re
# The inputs to this node will be stored as a list in the IN variables.
dataEnteringNode = IN

# Place your code below this line
ss = """
Bê tông vách hố thang trục (5/H)
Bê tông vách hố thang trục (10/H)
Bê tông vách bể xử lý nước thải đến cote -1.900
Bê tông vách tường chắn đất, cột C74, C75, C76, C77, C78, C79 trục (6-9/H) đến cote +3.000
Bê tông cột C81, C82, C83, C84, C82a, C83a
Vách bể tự hoại trục (11-12/L-M)
Bê tông vách tường chắn đất, cột C74, C75, C76, C77, C78, C79 trục (6-9/H) từ cote +3.000 đến cote +4.700
Vách bể tự hoại trục (11-12/L-M)
Cột C20, C21, C28 bể XLNT
Vách thang máy 1F trục (5/H) đến cote +3.000
Cột C66, C68, C70, vách W15, W15a tầng 1
Vách thang máy 1F trục (10/H) đến cote +3.000
C47, C48, C49, C53, C54, C62, C63, C64, C67, C69, C71 trục (8-10/P2-G)
W18, W18a trục (9/F-G)
BÊ TÔNG NHÀ MẪU
Bê tông móng, đà kiềng, sàn căn 1, căn 2
Bê tông dầm, sàn tầng 1 căn 1, căn 2
Bê tông cột căn 1, căn 2
Bê tông dầm sàn tầng 1 phòng ngủ căn 1, căn 2
BÊ TÔNG SÀN
Sàn đáy bể xử lý nước thải
Sàn đáy bể tự hoại trục (11-12/L-M)
Dầm, sàn 1F trục (6-10/P4-H),
Sàn 1F khu vực lõi thang 02 trục (10/H)
Sàn 1F khu vực lõi thang 01 trục (5/H)
Sàn đáy bể nước ngầm trục (5-9/P1-P3)
Dầm, sàn 1F trục (11'-14'/P6-M)

"""
# Assign your output to the OUT variable.
ss = ss.ToLower()


cond1 = "\d,\d"
cond2 = """bê tông
vách
hố thang
bể xử lí nước thải
bể XLNT
XLNT
bể tự hoại
cột
chắn đất
thang máy
trục
đến cote"""
ViToEn="""u	u
ú	u
ù	u
ủ	u
ũ	u
ụ	u
ư	u
ứ	u
ừ	u
ử	u
ữ	u
ự	u
e	e
é	e
è	e
ẻ	e
ẽ	e
ẹ	e
ê	e
ế	e
ề	e
ể	e
ễ	e
ệ	e
o	o
ó	o
ò	o
ỏ	o
õ	o
ọ	o
ơ	o
ớ	o
ờ	o
ở	o
ỡ	o
ợ	o
ô	o
ố	o
ồ	o
ổ	o
ỗ	o
ộ	o
a	a
á	a
à	a
ả	a
ã	a
ạ	a
ă	a
ắ	a
ằ	a
ẳ	a
ẵ	a
ặ	a
â	a
ấ	a
ầ	a
ẩ	a
ẫ	a
ậ	a
i	i
í	i
ì	i
ỉ	i
ĩ	i
ị	i"""

rawData = """BÊ TÔNG VÁCH - CỘT
Bê tông vách hố thang trục (5/H)
Bê tông vách hố thang trục (10/H)
Bê tông vách bể xử lý nước thải đến cote -1.900
Bê tông vách tường chắn đất, cột C74, C75, C76, C77, C78, C79 trục (6-9/H) đến cote +3.000
Bê tông cột C81, C82, C83, C84, C82a, C83a
Vách bể tự hoại trục (11-12/L-M)
Bê tông vách tường chắn đất, cột C74, C75, C76, C77, C78, C79 trục (6-9/H) từ cote +3.000 đến cote +4.700
Vách bể tự hoại trục (11-12/L-M)
Cột C20, C21, C28 bể XLNT
Vách thang máy 1F trục (5/H) đến cote +3.000
Cột C66, C68, C70, vách W15, W15a tầng 1
Vách thang máy 1F trục (10/H) đến cote +3.000
C47, C48, C49, C53, C54, C62, C63, C64, C67, C69, C71 trục (8-10/P2-G)
W18, W18a trục (9/F-G)
BÊ TÔNG NHÀ MẪU
Bê tông móng, đà kiềng, sàn căn 1, căn 2
Bê tông dầm, sàn tầng 1 căn 1, căn 2
Bê tông cột căn 1, căn 2
Bê tông dầm sàn tầng 1 phòng ngủ căn 1, căn 2
BÊ TÔNG SÀN
Sàn đáy bể xử lý nước thải
Sàn đáy bể tự hoại trục (11-12/L-M)
Dầm, sàn 1F trục (6-10/P4-H),
Sàn 1F khu vực lõi thang 02 trục (10/H)
Sàn 1F khu vực lõi thang 01 trục (5/H)
Sàn đáy bể nước ngầm trục (5-9/P1-P3)
Dầm, sàn 1F trục (11'-14'/P6-M)
KHÁC
Mương lọc cote -1.800 bể XLNT trục (1-3/D'-E)"""

#
def tranferVItoEN(ViToEn,docstring):
	res = docstring
	for ve in ViToEn.Split("\n"):
		vee = ve.split("\t")
		try:
			res = re.sub(vee[0],vee[1],res)
		except:	
			pass
	return res
#xử lí tạo cond


for ve in ViToEn.Split("\n"):
	vee = ve.split("\t")
	try:
		cond2 = re.sub(vee[0],vee[1],cond2)
	except:	
		pass
try:
	test1 = re.findall(cond1,ss)
except Exception, ex:
	OUT = ex
	pass
	
# xu li du lieu
lines = tranferVItoEN(ViToEn,rawData).split("\n")

res = []
for i in range(len(lines)):
	rd = lines[i].lower()
	r = ""
	for c in cond2.split("\n"):
		if c in rd:
			r += "#"+c
	res.append(rd)

OUT = cond2,res
# ----------------------------------------
watch_6 = Watch(python_script_2)
