# Dynamo graph Xu Li Data String 210308.dyn (Dynamo 2.10.0.3455)

python_script = Python()  # IronPython2; unwired: IN[0]
# ---------- python_script.python (148 lines) ----------
# Load the Python Standard and DesignScript Libraries
import sys
import clr
clr.AddReference('ProtoGeometry')
from Autodesk.DesignScript.Geometry import *
import re

# The inputs to this node will be stored as a list in the IN variables.
dataEnteringNode = IN

# Place your code below this line
strIn = """Bê tông vách hố thang trục (5/H)
Bê tông vách hố thang trục (10/H)
Bê tông vách bể xử lý nước thải đến cote -1.900
Bê tông vách tường chắn đất, cột C74, C75, C76, C77, C78, C79 trục (6-9/H) đến cote +3.000
Bê tông cột C81, C82, C83, C84, C82a, C83a
Vách bể tự hoại trục (11-12/L-M)
Bê tông vách tường chắn đất, cột C74, C75, C76, C77, C78, C79 trục (6-9/H) từ cote +3.000 đến cote +4.700
Vách bể tự hoại trục (11-12/L-M)
Cột C20, C21, C28 bể XLNT
Vách thang máy 1F trục (5/H) đến cote +3.000
Cột C66, C68, C70, vách W15, W15a tầng 1
Vách thang máy 1F trục (10/H) đến cote +3.000
C47, C48, C49, C53, C54, C62, C63, C64, C67, C69, C71 trục (8-10/P2-G)
W18, W18a trục (9/F-G)
"""
cond1="""u	u
ú	u
ù	u
ủ	u
ũ	u
ụ	u
ư	u
ứ	u
ừ	u
ử	u
ữ	u
ự	u
e	e
é	e
è	e
ẻ	e
ẽ	e
ẹ	e
ê	e
ế	e
ề	e
ể	e
ễ	e
ệ	e
o	o
ó	o
ò	o
ỏ	o
õ	o
ọ	o
ơ	o
ớ	o
ờ	o
ở	o
ỡ	o
ợ	o
ô	o
ố	o
ồ	o
ổ	o
ỗ	o
ộ	o
a	a
á	a
à	a
ả	a
ã	a
ạ	a
ă	a
ắ	a
ằ	a
ẳ	a
ẵ	a
ặ	a
â	a
ấ	a
ầ	a
ẩ	a
ẫ	a
ậ	a
i	i
í	i
ì	i
ỉ	i
ĩ	i
ị	i
y	y
ý	y
ỳ	y
ỷ	y
ỹ	y
ỵ	y"""

cond2="""bê tông	Concrete
vách	Wall
hố thang	Elevator Pit
bể xử lí nước thải	Water Treatment Tank
bể XLNT	Water Treatment Tank
XLNT	Water Treatment
bể tự hoại	Sewage tank
cột	Column
chắn đất	Param Wall
thang máy	Elevator
trục	Grid
đến cote	Level Elevation"""
def fun1(str):
	res = re.sub(" ","",str)
	for cd in cond1.Split("\n"):
		res = re.sub(cd.Split("\t")[0],cd.Split("\t")[1],res).lower()
	return res#re.sub(" ","",str)
def fun2(cond2):
	res = []
	for cd2 in cond2.split("\n"):
		r=[]
		r.append(fun1(cd2.split("\t")[0]))
		r.append(fun1(cd2.split("\t")[1]))
		res.append(r)
	return res
def fun3(str,conds):
	res = ""
	for cd in conds:
		if cd[0] in str:
			res += "#"+cd[1]
	return res
def fun4(strIn,cond2): #hastag LIST
	res = []
	for str in strIn.Split("\n"):
		res.append(fun3(fun1(str),fun2(cond2)))
	return res
def fun41(strIn,cond2): #hastag 1 LINE
	res = ""
	for str in strIn.Split("\n"):
		res += fun3(fun1(str),fun2(cond2)) +"\n"
	return res	
def writeTxtFromTxtString(PATH, exDat): #from txt string
	with open(PATH,"w") as f:
		f.write(exDat.encode('utf8'))	
	return exDat
#write txt

# Assign your output to the OUT variable.
OUT = writeTxtFromTxtString("R:\\BimESC\\01_PROJECTS\MOVENPICK HOTEL\\02-WIP\\06 ONEPLACE\\test\\text.txt",fun41(strIn,cond2))
# ----------------------------------------
watch = Watch(python_script)
