# Dynamo custom node CategoryReq.dyf (Dynamo 2.10.0.3455)
# category: Revit

# group: DIR
browse_dir_manualy = BoolSelector(false)  # graph input
directory_path = Directory("No file selected.")  # graph input

# group: Get Revit models' dir
python_script = Python()  # IronPython2; unwired: IN[0]
# ---------- python_script.python (50 lines) ----------
# Load the Python Standard and DesignScript Libraries
import sys
import clr
clr.AddReference('ProtoGeometry')
from Autodesk.DesignScript.Geometry import *

clr.AddReference('RevitAPI')
from Autodesk.Revit.DB import *
clr.AddReference('RevitAPIUI')
from Autodesk.Revit.UI import TaskDialog
clr.AddReference("RevitNodes")
import Revit
clr.ImportExtensions(Revit.Elements)
clr.AddReference("RevitServices")
import RevitServices
from RevitServices.Persistence import DocumentManager
from RevitServices.Transactions import TransactionManager
from System.Collections.Generic import *
clr.ImportExtensions(Revit.GeometryConversion)

##
doc = DocumentManager.Instance.CurrentDBDocument
uiapp = DocumentManager.Instance.CurrentUIApplication
app = uiapp.Application

opt = Options()
# The inputs to this node will be stored as a list in the IN variables.
dataEnteringNode = IN



##

res = []
dir = ""
dataFullPath =""

#
try:
	p = doc.PathName.split("\\")
	pp = p[0:len(p)-1]

	for s in pp:
		dir += s + "\\"
except:
	pass


# Assign your output to the OUT variable.
OUT = dir
# ----------------------------------------

if_ = If(test=browse_dir_manualy, true=directory_path, false=python_script)

# group (continued): Get Revit models' dir
code_block = CodeBlock(dir=if_) { dir; }

# group: INPUT MAIN
code_block_2 = CodeBlock { shn = "QTO.ITEM.DAT"; SOCats = "SOCats"; QTOdata = "QTO.ITEM.DAT"; }

# group: create Category requirements
code_block_3 = CodeBlock(dir=code_block, shn=code_block_2.SOCats) { dir+shn+".txt"; }
python_script_read_txt_out_list = Python(IN[0]=code_block_3)  # "Python Script-Read txt-OUT List Cats"; IronPython2
# ---------- python_script_read_txt_out_list.python (43 lines) ----------
# Load the Python Standard and DesignScript Libraries
import sys
import clr
clr.AddReference('ProtoGeometry')
from Autodesk.DesignScript.Geometry import *

import os

# The inputs to this node will be stored as a list in the IN variables.
dataEnteringNode = IN
path = IN[0]
# ini
TAB = "\t"

###
def createQTOreqDic (path):
	dat=[]
	dic = []
	with open(path,"r") as f:
		lines = f.readlines()
		for l in lines:
			if len(l)>0:
				d =[]
				for att in l.decode('utf-8').split(TAB):
					d.append(att)
				dat.append(l.decode('utf-8'))
	for d in dat[1:]:
		#di = {}
		#di[d.split(TAB)[0]] = d.split(TAB)[1]
		dic.append(d.split(TAB)[0])
		#for att in d.split(TAB):
	
	return dic
# Place your code below this line

test1 = os.path.isdir(path)
test2 = os.path.exists(path)
test3 = os.path.isfile(path)

dat=createQTOreqDic (path)

# Assign your output to the OUT variable.
OUT = dat
# ----------------------------------------
