# Dynamo graph Geometry.dyn (Dynamo 2.3.0.5885)

python_script = Python()
# ---------- python_script.python (68 lines) ----------
# Load the Python Standard and DesignScript Libraries
import sys
import clr
#clr.AddReference('ProtoGeometry')
#from Autodesk.DesignScript.Geometry import *

clr.AddReference("RevitAPI")
from Autodesk.Revit.DB import *


clr.AddReference("RevitAPIUI")
from Autodesk.Revit.UI.Selection import *

clr.AddReference("RevitServices")
import RevitServices
from RevitServices.Persistence import DocumentManager
from RevitServices.Transactions import TransactionManager
 
doc = DocumentManager.Instance.CurrentDBDocument
uiapp = DocumentManager.Instance.CurrentUIApplication
app = uiapp.Application


# The inputs to this node will be stored as a list in the IN variables.
dataEnteringNode = IN
BREAK = "____"
ATTBREAK = " : "
def getProperties (params):
	storageTypes = []
	paramNames = []
	paramValues = []
	paramValuesToStrings = []
	oneline = ""
	for p in params:		
		try:
			cbTxt = "{0}{2}{1}"			
			n = p.Definition.Name
			v= ""
			if p.AsValueString():
				v = p.AsValueString()
			else:
				if p.StorageType == StorageType.String:
					if p.AsString():
						v = p.AsString()
			oneline += cbTxt.format(n,v,ATTBREAK)+BREAK
			storageTypes.append(p.StorageType)
			paramNames.append(p.Definition.Name)
			paramValues.append(p.AsValueString())
			paramValuesToStrings.append(p.AsString())
		except:
			pass
	return storageTypes,paramNames,paramValues,oneline#oneline

# Place your code below this line

#e = doc.GetElement(uiapp.ActiveUIDocument.Selection.PickObject(ObjectType.Element, "Chọn Wall").ElementId).UniqueId

#wall(builtin category) e6b44a4b-e6ba-49b1-b36b-5bf0da92857a-000009aa
#family e6b44a4b-e6ba-49b1-b36b-5bf0da92857a-000009ea
#family door e6b44a4b-e6ba-49b1-b36b-5bf0da92857a-000009b5
#stair a4b02019-1de5-42ed-9471-b5cc2c04ae77-0252c14e
e = doc.GetElement("a4b02019-1de5-42ed-9471-b5cc2c04ae77-0252c14e")

param = e.Parameters
typeparam = doc.GetElement(e.GetTypeId()).Parameters

# Assign your output to the OUT variable.
OUT = getProperties (param)
# ----------------------------------------
code_block = CodeBlock(res=python_script) { res[0]; res[1]; res[2]; res[3]; }
watch = Watch(code_block.out0)
watch_2 = Watch(code_block.out1)
watch_3 = Watch(code_block.out2)
watch_4 = Watch(code_block.out3)
python_script_2 = Python()
# ---------- python_script_2.python (68 lines) ----------
# Load the Python Standard and DesignScript Libraries
import sys
import clr
#clr.AddReference('ProtoGeometry')
#from Autodesk.DesignScript.Geometry import *

clr.AddReference("RevitAPI")
from Autodesk.Revit.DB import *


clr.AddReference("RevitAPIUI")
from Autodesk.Revit.UI.Selection import *

clr.AddReference("RevitServices")
import RevitServices
from RevitServices.Persistence import DocumentManager
from RevitServices.Transactions import TransactionManager
 
doc = DocumentManager.Instance.CurrentDBDocument
uiapp = DocumentManager.Instance.CurrentUIApplication
app = uiapp.Application


# The inputs to this node will be stored as a list in the IN variables.
dataEnteringNode = IN
BREAK = "____"
ATTBREAK = " : "
def getProperties (params):
	storageTypes = []
	paramNames = []
	paramValues = []
	paramValuesToStrings = []
	oneline = ""
	for p in params:		
		try:
			cbTxt = "{0}{2}{1}"			
			n = p.Definition.Name
			v= ""
			if p.AsValueString():
				v = p.AsValueString()
			else:
				if p.StorageType == StorageType.String:
					if p.AsString():
						v = p.AsString()
			oneline += cbTxt.format(n,v,ATTBREAK)+BREAK
			storageTypes.append(p.StorageType)
			paramNames.append(p.Definition.Name)
			paramValues.append(p.AsValueString())
			paramValuesToStrings.append(p.AsString())
		except:
			pass
	return storageTypes,paramNames,paramValues,oneline#oneline

# Place your code below this line

#e = doc.GetElement(uiapp.ActiveUIDocument.Selection.PickObject(ObjectType.Element, "Chọn Wall").ElementId).UniqueId

#wall(builtin category) e6b44a4b-e6ba-49b1-b36b-5bf0da92857a-000009aa
#family e6b44a4b-e6ba-49b1-b36b-5bf0da92857a-000009ea
#family door e6b44a4b-e6ba-49b1-b36b-5bf0da92857a-000009b5
#stair a4b02019-1de5-42ed-9471-b5cc2c04ae77-0252c14e
e = doc.GetElement("a4b02019-1de5-42ed-9471-b5cc2c04ae77-0252c14e")

param = e.Parameters
typeparam = doc.GetElement(e.GetTypeId()).Parameters

# Assign your output to the OUT variable.
OUT = getProperties (typeparam)
# ----------------------------------------
code_block_2 = CodeBlock(res=python_script_2) { res[0]; res[1]; res[2]; res[3]; }
watch_5 = Watch(code_block_2.out2)
watch_6 = Watch(code_block_2.out3)
watch_7 = Watch(code_block_2.out1)
watch_8 = Watch(code_block_2.out0)
python_script_3 = Python()
# ---------- python_script_3.python (79 lines) ----------
# Load the Python Standard and DesignScript Libraries
import sys
import clr
#clr.AddReference('ProtoGeometry')
#from Autodesk.DesignScript.Geometry import *

clr.AddReference("RevitAPI")
from Autodesk.Revit.DB import *


clr.AddReference("RevitAPIUI")
from Autodesk.Revit.UI.Selection import *

clr.AddReference("RevitServices")
import RevitServices
from RevitServices.Persistence import DocumentManager
from RevitServices.Transactions import TransactionManager
 
doc = DocumentManager.Instance.CurrentDBDocument
uiapp = DocumentManager.Instance.CurrentUIApplication
app = uiapp.Application


# The inputs to this node will be stored as a list in the IN variables.
dataEnteringNode = IN
BREAK = "____"
ATTBREAK = " : "
def getProperties (params):
	storageTypes = []
	paramNames = []
	paramValues = []
	paramValuesToStrings = []
	oneline = ""
	for p in params:		
		try:
			cbTxt = "{0}{2}{1}"			
			n = p.Definition.Name
			v= ""
			if p.AsValueString():
				v = p.AsValueString()
			else:
				if p.StorageType == StorageType.String:
					if p.AsString():
						v = p.AsString()
			oneline += cbTxt.format(n,v,ATTBREAK)+BREAK
			storageTypes.append(p.StorageType)
			paramNames.append(p.Definition.Name)
			paramValues.append(p.AsValueString())
			paramValuesToStrings.append(p.AsString())
		except:
			pass
	return storageTypes,paramNames,paramValues,oneline#oneline
def getGeometry(geoElem):
	geo = []
	isGeoElement = isinstance(geoElem,GeometryElement)
	isGeoInstance = isinstance(geoElem,GeometryInstance)
	if isGeoElement:
		geo.Add(getGeometry(geoElem))
	if isGeoInstance:
		geo.append(geoElem.GetInstanceGeometry())
	return geo
# Place your code below this line
#e = doc.GetElement(uiapp.ActiveUIDocument.Selection.PickObject(ObjectType.Element, "Chọn Wall").ElementId).UniqueId
#wall(builtin category) e6b44a4b-e6ba-49b1-b36b-5bf0da92857a-000009aa
#family e6b44a4b-e6ba-49b1-b36b-5bf0da92857a-000009ea
#family door e6b44a4b-e6ba-49b1-b36b-5bf0da92857a-000009b5
#stair a4b02019-1de5-42ed-9471-b5cc2c04ae77-0252c14e
e = doc.GetElement("a4b02019-1de5-42ed-9471-b5cc2c04ae77-0252c14e")

param = e.Parameters
typeparam = doc.GetElement(e.GetTypeId()).Parameters
#####
opt = Options()
geoElem = e.get_Geometry(opt)
dir = dir(geoElem)

geo = getGeometry(geoElem)
# Assign your output to the OUT variable.
OUT = geo
# ----------------------------------------
