# Dynamo graph QTO 3D-(0B)-WRITE EXCEL-GRID DATA (APPEND)-run on REVIT-210123.dyn (Dynamo 2.3.0.5885)

# group: INPUT MAIN
browser_manual = BoolSelector(true)  # graph input
file_path = Filename("..\..\..\01_PROJECTS\Z2\02-WIP\04_BIM_COORDINATED_MODEL\06 ONE PLACE\BIMData.xlsx")  # graph input
# note: GHI DU LIEU TRUC VA GIAO TRUC VAO EXCEL
code_block = CodeBlock { "Project Information"; "_DataSheet_Path"; defaultDataSheetName = "BIMData.xlsx"; }

byName = Category.ByName(name=code_block.out0)
all_elements_of_category = ElementsOfCategory(Category=byName)
getParameterValueByName = Element.GetParameterValueByName(element=all_elements_of_category, parameterName=code_block.out1)
python_script = Python(IN[0]=getParameterValueByName, IN[1]=code_block.defaultDataSheetName)
# ---------- python_script.python (67 lines) ----------
# Load the Python Standard and DesignScript Libraries
import sys
import clr
clr.AddReference('ProtoGeometry')
from Autodesk.DesignScript.Geometry import *

clr.AddReference('RevitAPI')
from Autodesk.Revit.DB import *
clr.AddReference('RevitAPIUI')
from Autodesk.Revit.UI import TaskDialog
clr.AddReference("RevitNodes")
import Revit
clr.ImportExtensions(Revit.Elements)
clr.AddReference("RevitServices")
import RevitServices
from RevitServices.Persistence import DocumentManager
from RevitServices.Transactions import TransactionManager
from System.Collections.Generic import *
clr.ImportExtensions(Revit.GeometryConversion)

##
doc = DocumentManager.Instance.CurrentDBDocument
uiapp = DocumentManager.Instance.CurrentUIApplication
app = uiapp.Application

opt = Options()
# The inputs to this node will be stored as a list in the IN variables.
dataEnteringNode = IN
datapath = IN[0]
dfDataSheetName = IN[1]


##

res = []

#res.append(app.VersionName)
#res.append(app.SharedParametersFilename)
#res.append(app.Username)
#res.append(doc.PathName)
#res.append(list(enumerate(doc.ProjectLocations)))
#res.append(doc.SiteLocation)
# Place your code below this line
dir = ""
dataFullPath =""

#
try:
	p = doc.PathName.split("\\")
	pp = p[0:len(p)-1]

	for s in pp:
		dir += s + "\\"
except:
	pass
#
dp = datapath[0]
if dp == "":
	dp = "./"+dfDataSheetName

try:
	dataFullPath = dir + dp[2:]
except:
	pass

# Assign your output to the OUT variable.
OUT = dataFullPath
# ----------------------------------------
if_ = If(test=browser_manual, true=file_path, false=python_script)
code_block_2 = CodeBlock(path=if_) { path; }
code_block_3 = CodeBlock { shName="GRID.DAT"; strw=0; stCl=0; data; true; }  # unwired: data
fromPath = FileObject(path=code_block_2)  # "File.FromPath"
code_block_4 = CodeBlock { shName="BIMSTD"; strw=0; stCl=0; data; true; }  # unwired: data
open_excel = BoolSelector(true)
importExcel = Data.ImportExcel(file=fromPath, sheetName=code_block_3.shName, readAsStrings=code_block_4.out4, showExcel=open_excel)
deconstruct = List.Deconstruct(list=importExcel)
isNull = Object.IsNull(obj=deconstruct.rest)
code_block_5 = CodeBlock { empty = ""; }
if_2 = If(test=isNull, true=code_block_5, false=deconstruct.rest)
flatten = List.Flatten(list=if_2)

# group: need Clean Sheet ?
code_block_6 = CodeBlock(t1=flatten) { num2 = List.Count(t1); t2 = num2 > 0; }

# group: Clean Excel
code_block_7 = CodeBlock(len=code_block_6.num2) { empty; amount = len+1; }  # unwired: empty
overwrite_excel_data = BoolSelector(false)

# group (continued): need Clean Sheet ?
if_3 = If(test=code_block_6.t2, true=code_block_7.empty, false=flatten)

# group (continued): Clean Excel
ofRepeatedItem = List.OfRepeatedItem(item=if_3, amount=code_block_7.amount)
exportExcel = Data.ExportExcel(filePath=code_block_2, sheetName=code_block_3.shName, startRow=code_block_3.strw, startCol=code_block_3.stCl, data=ofRepeatedItem, overWrite=overwrite_excel_data)

# group: Is cleaned ?
count = List.Count(list=exportExcel)
code_block_8 = CodeBlock { 0; }
eq = count == code_block_8

importExcel_2 = Data.ImportExcel(file=fromPath, sheetName=code_block_4.shName, readAsStrings=code_block_4.out4, showExcel=open_excel)
transpose = List.Transpose(lists=importExcel_2)
code_block_9 = CodeBlock(col=transpose) { col[0]; }
isNull_2 = Object.IsNull(obj=code_block_9)
filterByBoolMask = List.FilterByBoolMask(list=importExcel_2, mask=isNull_2)
transpose_2 = List.Transpose(lists=filterByBoolMask.out)
code_block_10 = CodeBlock(col=transpose_2) { col[0]; }
allIndicesOf = List.AllIndicesOf(list=code_block_10, item=code_block_3.shName)
code_block_11 = CodeBlock(col=importExcel_2, i=allIndicesOf) { col[i]; }
isNull_3 = Object.IsNull(obj=code_block_11@L1)
filterByBoolMask_2 = List.FilterByBoolMask(list=code_block_11@L2, mask=isNull_3)
flatten_2 = List.Flatten(list=filterByBoolMask_2.out)
deconstruct_2 = List.Deconstruct(list=flatten_2)
python_script_tittle = Python(IN[0]=deconstruct_2.rest)
# ---------- python_script_tittle.python (17 lines) ----------
import clr
clr.AddReference('ProtoGeometry')
from Autodesk.DesignScript.Geometry import *
#The inputs to this node will be stored as a list in the IN variables.
dataEnteringNode = IN

elems = IN[0]
str = "Grid-"
try:
	for p in elems:			
		str += p.ToString()+" "

except Exception, e:
	OUT = e

#Assign your output to the OUT variable.
OUT = str
# ----------------------------------------
code_block_12 = CodeBlock { "OST_Levels"; "OST_Grids"; }
byName_2 = Category.ByName(name=code_block_12.out1)
all_elements_of_category_2 = ElementsOfCategory(Category=byName_2)
code_block_13 = CodeBlock { "Name"; }
getParameterValueByName_2 = Element.GetParameterValueByName(element=all_elements_of_category_2, parameterName=code_block_13)
curve = Grid.Curve(grid=all_elements_of_category_2)
startPoint = Curve.StartPoint(curve=curve)
X = Point.X(point=startPoint)
code_block_14 = CodeBlock { 1000; 1; }
div = X / code_block_14.out0
round = Math.Round(number=div, digits=code_block_14.out1)
Y = Point.Y(point=startPoint)
div_2 = Y / code_block_14.out0
round_2 = Math.Round(number=div_2, digits=code_block_14.out1)
python_script_2 = Python(IN[0]=round, IN[1]=round_2)
# ---------- python_script_2.python (20 lines) ----------
import clr
clr.AddReference('ProtoGeometry')
from Autodesk.DesignScript.Geometry import *
#The inputs to this node will be stored as a list in the IN variables.
dataEnteringNode = IN

xx = IN[0]
yy = IN[1]

res = []

for i in range(len(xx)):
	try:
		res.append(xx[i].ToString()+" "+yy[i].ToString())
	except:
		res.append("null")
		pass

#Assign your output to the OUT variable.
OUT = res
# ----------------------------------------
endPoint = Curve.EndPoint(curve=curve)
X_2 = Point.X(point=endPoint)
code_block_15 = CodeBlock { 1000; 1; }
div_3 = X_2 / code_block_15.out0
round_3 = Math.Round(number=div_3, digits=code_block_15.out1)
Y_2 = Point.Y(point=endPoint)
div_4 = Y_2 / code_block_15.out0
round_4 = Math.Round(number=div_4, digits=code_block_15.out1)
python_script_3 = Python(IN[0]=round_3, IN[1]=round_4)  # same code as python_script_2
byStartPointEndPoint = Line.ByStartPointEndPoint(startPoint=startPoint, endPoint=endPoint)
length = Curve.Length(curve=byStartPointEndPoint)
length_2 = Curve.Length(curve=curve)
is_line = length == length_2
is_arc = length != length_2
create = List.Create(item0=getParameterValueByName_2, item1=python_script_2, item2=python_script_3, item3=is_line, item4=is_arc)
transpose_3 = List.Transpose(lists=create)
python_script_4 = Python(IN[0]=transpose_3)
# ---------- python_script_4.python (22 lines) ----------
import clr
clr.AddReference('ProtoGeometry')
from Autodesk.DesignScript.Geometry import *
#The inputs to this node will be stored as a list in the IN variables.
dataEnteringNode = IN

elems = IN[0]
res=[]
try:
	for params in elems:
		str = "Grid-"
		try:
			for p in params:		
				str += p.ToString()+" "
			res.append(str)
		except:
			pass
except Exception, e:
	OUT = e

#Assign your output to the OUT variable.
OUT = res
# ----------------------------------------
flatten_3 = List.Flatten(list=python_script_4)
addItemToFront = List.AddItemToFront(item=flatten_3, list=flatten)
flatten_4 = List.Flatten(list=addItemToFront)
python_script_remove_duplicate = Python(IN[0]=flatten_4)
# ---------- python_script_remove_duplicate.python (21 lines) ----------
import clr
clr.AddReference('ProtoGeometry')
from Autodesk.DesignScript.Geometry import *
#The inputs to this node will be stored as a list in the IN variables.
dataEnteringNode = IN

elems = IN[0]
res=[]
res1 = []
try:
	res.Add(list( dict.fromkeys(elems) ))
except Exception, e:
	OUT = e
try:	
	for r in res[0]:
		if not r.isspace() and len(r)>0:
			res1.append(r)
except Exception, e:
	OUT = e
#Assign your output to the OUT variable.
OUT = res1
# ----------------------------------------
addItemToFront_2 = List.AddItemToFront(item=python_script_tittle, list=python_script_remove_duplicate)
flatten_5 = List.Flatten(list=addItemToFront_2)
if_4 = If(test=eq, true=flatten_5, false=flatten_5)
overwrite_excel_data_2 = BoolSelector(false)
exportExcel_2 = Data.ExportExcel(filePath=code_block_2, sheetName=code_block_3.shName, startRow=code_block_3.strw, startCol=code_block_3.stCl, data=if_4, overWrite=overwrite_excel_data_2)
watch = Watch(fromPath)
code_block_16 = CodeBlock { shName="GRID.INTERSECT.DAT"; strw=0; stCl=0; data; true; }  # unwired: data
importExcel_3 = Data.ImportExcel(file=fromPath, sheetName=code_block_16.shName, readAsStrings=code_block_4.out4, showExcel=open_excel)
deconstruct_3 = List.Deconstruct(list=importExcel_3)
isNull_4 = Object.IsNull(obj=deconstruct_3.rest)
code_block_17 = CodeBlock { empty = ""; }
if_5 = If(test=isNull_4, true=code_block_17, false=deconstruct_3.rest)
flatten_6 = List.Flatten(list=if_5)

# group: need Clean Sheet ?
code_block_18 = CodeBlock(t1=flatten_6) { num2 = List.Count(t1); t2 = num2 > 0; }

# group: Clean Excel
code_block_19 = CodeBlock(len=code_block_18.num2) { empty; amount = len+1; }  # unwired: empty
overwrite_excel_data_3 = BoolSelector(false)

# group (continued): need Clean Sheet ?
if_6 = If(test=code_block_18.t2, true=code_block_19.empty, false=flatten_6)

# group (continued): Clean Excel
ofRepeatedItem_2 = List.OfRepeatedItem(item=if_6, amount=code_block_19.amount)
exportExcel_3 = Data.ExportExcel(filePath=code_block_2, sheetName=code_block_16.shName, startRow=code_block_3.strw, startCol=code_block_3.stCl, data=ofRepeatedItem_2, overWrite=overwrite_excel_data_3)

# group: Is cleaned ?
count_2 = List.Count(list=exportExcel_3)
code_block_20 = CodeBlock { 0; }
eq_2 = count_2 == code_block_20

allIndicesOf_2 = List.AllIndicesOf(list=code_block_10, item=code_block_16.shName)
code_block_21 = CodeBlock(col=importExcel_2, i=allIndicesOf_2) { col[i]; }
isNull_5 = Object.IsNull(obj=code_block_21@L1)
filterByBoolMask_3 = List.FilterByBoolMask(list=code_block_21@L2, mask=isNull_5)
flatten_7 = List.Flatten(list=filterByBoolMask_3.out)
deconstruct_4 = List.Deconstruct(list=flatten_7)
python_script_tittle_2 = Python(IN[0]=deconstruct_4.rest)  # same code as python_script_tittle

# group: INtersect GRIDs
python_script_intersect_grid = Python(IN[0]=getParameterValueByName_2, IN[1]=curve)
# ---------- python_script_intersect_grid.python (51 lines) ----------
import clr
clr.AddReference('ProtoGeometry')
from Autodesk.DesignScript.Geometry import *
#The inputs to this node will be stored as a list in the IN variables.
dataEnteringNode = IN

names = IN[0]
curves = IN[1]

i = len(curves)

iGrs = []
res = []
res1=[]

while i > 1:
	iniCurves = curves[len(curves)-i:len(curves)]
	res1.append(iniCurves)
	c0 = iniCurves[0]
	restCurves = curves[len(curves)-i+1:len(curves)]
	
	str1 = names[len(curves)-i]
	
	for j in range(len(restCurves)):
		c1 = restCurves[j]
		try:
			flag = c0.DoesIntersect(c1)
			if flag:
				str2 = names[len(curves)-i+j+1]
				
				str = "GridIntersectPoint-"+str1 + " "+str2			
				pt = c0.Intersect(c1)
				res.append(pt)
				iG = []
				#iG.append(str)
				
				x = round(pt[0].X/1000,3).ToString()	
				y = round(pt[0].Y/1000,3).ToString()	
				xy = str + " " + x + " " + y
				
				iG.append(xy)
				#iGrs.append(pt)
				iGrs.append(iG)
		except:
			pass
		
	i = i - 1
	

#Assign your output to the OUT variable.
OUT = iGrs
# ----------------------------------------

addItemToFront_3 = List.AddItemToFront(item=python_script_intersect_grid, list=flatten_6)
flatten_8 = List.Flatten(list=addItemToFront_3)
python_script_remove_duplicate_2 = Python(IN[0]=flatten_8)  # same code as python_script_remove_duplicate
addItemToFront_4 = List.AddItemToFront(item=python_script_tittle_2, list=python_script_remove_duplicate_2)
flatten_9 = List.Flatten(list=addItemToFront_4)
if_7 = If(test=eq_2, true=flatten_9, false=flatten_9)
overwrite_excel_data_4 = BoolSelector(false)
exportExcel_4 = Data.ExportExcel(filePath=code_block_2, sheetName=code_block_16.shName, startRow=code_block_3.strw, startCol=code_block_3.stCl, data=if_7, overWrite=overwrite_excel_data_4)
python_script_setup_units = Python()  # unwired: IN[0]
# ---------- python_script_setup_units.python (60 lines) ----------
# Load the Python Standard and DesignScript Libraries
import sys
import clr
clr.AddReference('ProtoGeometry')
from Autodesk.DesignScript.Geometry import *

clr.AddReference('RevitAPI')
from Autodesk.Revit.DB import *
clr.AddReference('RevitAPIUI')
from Autodesk.Revit.UI import TaskDialog
clr.AddReference("RevitNodes")
import Revit
clr.ImportExtensions(Revit.Elements)
clr.AddReference("RevitServices")
import RevitServices
from RevitServices.Persistence import DocumentManager
from RevitServices.Transactions import TransactionManager
from System.Collections.Generic import *
clr.ImportExtensions(Revit.GeometryConversion)

##
doc = DocumentManager.Instance.CurrentDBDocument
uiapp = DocumentManager.Instance.CurrentUIApplication
app = uiapp.Application


# The inputs to this node will be stored as a list in the IN variables.
dataEnteringNode = IN

# Place your code below this line


t = Transaction(doc)
	
t.Start("Units setup")
try:
	#Area
	unit = Units(UnitSystem.Metric)

	fmOp = FormatOptions(DisplayUnitType.DUT_SQUARE_METERS,UnitSymbolType.UST_NONE,0.001)
	
	unit.SetFormatOptions(UnitType.UT_Area,fmOp)
	
	doc.SetUnits(unit)
	#Volume
	unit1 = Units(UnitSystem.Metric)

	fmOp1 = FormatOptions(DisplayUnitType.DUT_CUBIC_METERS,UnitSymbolType.UST_NONE,0.001)
	
	unit.SetFormatOptions(UnitType.UT_Volume,fmOp1)
	
	doc.SetUnits(unit)
	#doc.GetUnits().SetFormatOptions(UnitType.UT_Area,fmOp)
except Exception, e:
	pass
t.Commit()


# Assign your output to the OUT variable.
OUT = 0
# ----------------------------------------
