# Dynamo graph test.dyn (Dynamo 2.10.0.3455)

python_script = Python()  # IronPython2; frozen
# ---------- python_script.python (67 lines) ----------
# Load the Python Standard and DesignScript Libraries
import sys
import clr
#clr.AddReference('ProtoGeometry')
#from Autodesk.DesignScript.Geometry import *

clr.AddReference("RevitAPI")
from Autodesk.Revit.DB import *


clr.AddReference("RevitAPIUI")
from Autodesk.Revit.UI.Selection import *

clr.AddReference("RevitServices")
import RevitServices
from RevitServices.Persistence import DocumentManager
from RevitServices.Transactions import TransactionManager
 
doc = DocumentManager.Instance.CurrentDBDocument
uiapp = DocumentManager.Instance.CurrentUIApplication
app = uiapp.Application


# The inputs to this node will be stored as a list in the IN variables.
dataEnteringNode = IN
BREAK = "____"
ATTBREAK = " : "
def getProperties (params):
	storageTypes = []
	paramNames = []
	paramValues = []
	paramValuesToStrings = []
	oneline = ""
	for p in params:		
		try:
			cbTxt = "{0}{2}{1}"			
			n = p.Definition.Name
			v= ""
			if p.AsValueString():
				v = p.AsValueString()
			else:
				if p.StorageType == StorageType.String:
					if p.AsString():
						v = p.AsString()
			oneline += cbTxt.format(n,v,ATTBREAK)+BREAK
			storageTypes.append(p.StorageType)
			paramNames.append(p.Definition.Name)
			paramValues.append(p.AsValueString())
			paramValuesToStrings.append(p.AsString())
		except:
			pass
	return storageTypes,paramNames,paramValues,paramValuesToStrings#oneline

# Place your code below this line

#e = doc.GetElement(uiapp.ActiveUIDocument.Selection.PickObject(ObjectType.Element, "Chọn Wall").ElementId).UniqueId

#wall(builtin category) e6b44a4b-e6ba-49b1-b36b-5bf0da92857a-000009aa
#family e6b44a4b-e6ba-49b1-b36b-5bf0da92857a-000009ea
#family door e6b44a4b-e6ba-49b1-b36b-5bf0da92857a-000009b5
e = doc.GetElement("e6b44a4b-e6ba-49b1-b36b-5bf0da92857a-000009b5")

param = e.Parameters
typeparam = doc.GetElement(e.GetTypeId()).Parameters

# Assign your output to the OUT variable.
OUT = getProperties (typeparam)
# ----------------------------------------
code_block = CodeBlock()  # unwired: dir
# ---------- code_block.designscript (5 lines) ----------
excelpath = "C:\\Users\\USER\\Downloads\\Z2\\06 ONE PLACE\\ARC\\BIMData.xlsx";
dir;
txtPath = "C:\\Users\\USER\\Downloads\\Z2\\06 ONE PLACE\\ARC\\SOCats.txt";
txtPath1 = "C:\\Users\\USER\\Downloads\\Z2\\06 ONE PLACE\\ARC\\BIMSTD1.txt";
txtPath2 = "C:\\Users\\USER\\Downloads\\Z2\\06 ONE PLACE\\ARC\\QTOreq.txt";
# ----------------------------------------
python_script_read_txt = Python(IN[0]=code_block.txtPath)  # IronPython2; frozen
# ---------- python_script_read_txt.python (28 lines) ----------
# Load the Python Standard and DesignScript Libraries
import sys
import clr
clr.AddReference('ProtoGeometry')
from Autodesk.DesignScript.Geometry import *

import os

# The inputs to this node will be stored as a list in the IN variables.
dataEnteringNode = IN
path = IN[0]
# Place your code below this line

test1 = os.path.isdir(path)
test2 = os.path.exists(path)
test3 = os.path.isfile(path)

dat=[]

if not test1:
	if test2:
		if test3:
			with open(path,"r") as f:
				dat = f.read().decode('utf-8')


# Assign your output to the OUT variable.
OUT = dat
# ----------------------------------------
python_script_write_txt = Python(IN[0]=python_script_read_txt, IN[1]=code_block.txtPath1)  # IronPython2
# ---------- python_script_write_txt.python (68 lines) ----------
# Load the Python Standard and DesignScript Libraries
import sys
import clr
clr.AddReference('ProtoGeometry')
from Autodesk.DesignScript.Geometry import *

clr.AddReference('System.IO')
clr.AddReference('System.Drawing')
clr.AddReference('System.Reflection')
clr.AddReference('System.Threading')
clr.AddReference("System.Windows.Forms")

import System
import System.IO
import System.Drawing
import System.Reflection
import System.Windows.Forms

from System.Threading import ApartmentState, Thread, ThreadStart
from System.Windows.Forms import *

import os
# The inputs to this node will be stored as a list in the IN variables.
dataEnteringNode = IN
exDat = IN[0]
path = IN[1]
#list1Line = []
allText=""

TAB = "\t"
BREAKLINE = "\n"

test1 = os.path.isdir(path)
test2 = os.path.exists(path)
test3 = os.path.isfile(path)

# Place your code below this line

def writeTxtFromExcelDat(exDat,_TAB,_BREAKLINE): #from excel data list
	allText=""
	TAB = _TAB
	BREAKLINE = _BREAKLINE	
	for d in exDat:
		str = ""
		strF = "{0}{1}"		
		if d[0] and len(d)>0:		
			for c in d:
				if c:
					str += strF.format(c,TAB)
		if len(str)>0:
			str += BREAKLINE	
		#list1Line.append(str)
		allText += str	
	f = open(path,"w")
	f.write(allText.encode('utf8'))
	f.close
	return allText
def writeTxtFromTxtString(exDat,_TAB,_BREAKLINE): #from txt string	
	f = open(path,"w")
	f.write(exDat.encode('utf8'))
	f.close
	return exDat
###################
if not test1 and len(exDat) >0:
	allText = writeTxtFromTxtString(exDat,TAB,BREAKLINE)
#MessageBox.Show(allText)
# Assign your output to the OUT variable.
OUT = allText
# ----------------------------------------
code_block_2 = CodeBlock(res=python_script_write_txt) { res[0]; res[1]; res[2]; res[3]; }
watch = Watch(code_block_2.out0)  # graph output
watch_2 = Watch(code_block_2.out1)  # graph output
watch_3 = Watch(code_block_2.out2)  # graph output
watch_4 = Watch(code_block_2.out3)  # graph output
watch_5 = Watch(python_script_write_txt)  # graph output
code_block_3 = CodeBlock(res=watch_5) { res[0]; }
watch_6 = Watch(code_block_3)  # graph output
deconstruct = List.Deconstruct(list=watch_5)
python_script_read_txt_out = Python(IN[0]=code_block.txtPath)  # "Python Script-Read TxT-OUT Dictionary"; IronPython2
# ---------- python_script_read_txt_out.python (43 lines) ----------
# Load the Python Standard and DesignScript Libraries
import sys
import clr
clr.AddReference('ProtoGeometry')
from Autodesk.DesignScript.Geometry import *

import os

# The inputs to this node will be stored as a list in the IN variables.
dataEnteringNode = IN
path = IN[0]
# ini
TAB = "\t"

###
def createQTOreqDic (path):
	dat=[]
	dic = []
	with open(path,"r") as f:
		lines = f.readlines()
		for l in lines:
			if len(l)>0:
				d =[]
				for att in l.decode('utf-8').split(TAB):
					d.append(att)
				dat.append(l.decode('utf-8'))
	for d in dat[1:]:
		di = {}
		di[d.split(TAB)[0]] = d.split(TAB)[1]
		dic.append(di)
		#for att in d.split(TAB):
	
	return dic
# Place your code below this line

test1 = os.path.isdir(path)
test2 = os.path.exists(path)
test3 = os.path.isfile(path)

dat=createQTOreqDic (path)

# Assign your output to the OUT variable.
OUT = dat
# ----------------------------------------
python_script_read_txt_out_2 = Python(IN[0]=code_block.txtPath2)  # "Python Script-Read TxT-OUT Dictionary Array"; IronPython2
# ---------- python_script_read_txt_out_2.python (48 lines) ----------
# Load the Python Standard and DesignScript Libraries
import sys
import clr
clr.AddReference('ProtoGeometry')
from Autodesk.DesignScript.Geometry import *

import os

# The inputs to this node will be stored as a list in the IN variables.
dataEnteringNode = IN
path = IN[0]
# ini
TAB = "\t"

###
def createQTOreqDic (path):
	dat=[]
	dic = []
	with open(path,"r") as f:
		lines = f.readlines()
		for l in lines:
			if len(l)>0:
				d =[]
				for att in l.decode('utf-8').split(TAB):
					d.append(att)
				dat.append(l.decode('utf-8'))
	for d in dat[2:]:
		di = {}
		reqs = []
		for req in d.split(TAB)[1:]:			
			if req and not req == "\n":
				reqs.append(req)
			
		di[d.split(TAB)[0]] = reqs
		dic.append(di)
		#for att in d.split(TAB):
	
	return dic
# Place your code below this line

test1 = os.path.isdir(path)
test2 = os.path.exists(path)
test3 = os.path.isfile(path)

dat=createQTOreqDic (path)

# Assign your output to the OUT variable.
OUT = dat
# ----------------------------------------
