# Dynamo graph test2.dyn (Dynamo 2.10.0.3455)

python_script = Python()  # IronPython2; frozen
# ---------- python_script.python (59 lines) ----------
# Load the Python Standard and DesignScript Libraries
import sys
import clr
clr.AddReference('ProtoGeometry')
from Autodesk.DesignScript.Geometry import *

from shutil import copyfile
import tempfile
import os
from os import listdir
from os.path import isfile, join


# The inputs to this node will be stored as a list in the IN variables.
dataEnteringNode = IN

# Place your code below this line
dynExe = sys.path[1]
# Assign your output to the OUT variable.
tempDir = tempfile.gettempdir()

#open file
resStr = ""

tempFilePath = tempDir + "\\text1.txt"

checkFilePath = os.path.exists(tempFilePath)


# WRITE TEMP TXT
if not checkFilePath:		
	with open(tempFilePath,"w") as f:
		f.write("Hello World")	
		#resStr = f.read()
checkFilePath1 = os.path.exists(tempFilePath)
if checkFilePath1:
	with open(tempFilePath,"r") as ff:		
		resStr = ff.read()

"""
#REMOVE TEMP TXT
if not checkFilePath:		
	resStr = "File not existed"
else:
	os.remove(tempFilePath)
	resStr = "File REMOVED"
"""
#COPY FILE

filePath = "C:\\Users\\hnthanhhang\\Downloads\\text1.txt"

copyfile(tempFilePath, filePath)

filedir = "C:\\Users\\hnthanhhang\\Downloads"
onlyfiles = [f for f in listdir(filedir) if isfile(join(filedir, f))]

arr = os.listdir(filedir)

OUT = arr
# ----------------------------------------
python_script_2 = Python()  # IronPython2
# ---------- python_script_2.python (33 lines) ----------
# Load the Python Standard and DesignScript Libraries
import sys
import clr
clr.AddReference('ProtoGeometry')
from Autodesk.DesignScript.Geometry import *

from shutil import copyfile
import tempfile
import os
from os import listdir
from os.path import isfile, join


# The inputs to this node will be stored as a list in the IN variables.
dataEnteringNode = IN


filedir = "C:\\Users\\hnthanhhang\\Downloads"

def getAllfile(filedir):
	res = []
	arr = os.listdir(filedir)
	for a in arr:
		dir = filedir+"\\"+a
		isdir = os.path.isdir(dir)		
		if isdir:
			res.Add(getAllfile(dir))
		if a[-3:] == "pdf":
			res.Add(a)
		if len(a) == 0:
			pass
	return res
OUT = getAllfile(filedir)
# ----------------------------------------
watch = Watch(python_script_2)
