# Dynamo graph event.dyn (Dynamo 2.1.0.7500)

python_script = Python()  # unwired: IN[0]
# ---------- python_script.python (49 lines) ----------
# Load the Python Standard and DesignScript Libraries
import sys
import clr
clr.AddReference('ProtoGeometry')
from Autodesk.DesignScript.Geometry import *
clr.AddReference('RevitAPI')
from Autodesk.Revit.DB import *
from Autodesk.Revit.ApplicationServices import *
from Autodesk.Revit.DB.Events import *
clr.AddReference('RevitAPIUI')
from Autodesk.Revit.UI import *
clr.AddReference("RevitNodes")
import Revit
clr.ImportExtensions(Revit.Elements)
clr.AddReference("RevitServices")
import RevitServices
from RevitServices.Persistence import DocumentManager
from RevitServices.Transactions import TransactionManager
from System.Collections.Generic import *
clr.ImportExtensions(Revit.GeometryConversion)
from System import EventHandler, Uri



##


doc = DocumentManager.Instance.CurrentDBDocument
uiapp = DocumentManager.Instance.CurrentUIApplication
app = uiapp.Application
opt = Options()
categories = doc.Settings.Categories

# The inputs to this node will be stored as a list in the IN variables.
dataEnteringNode = IN

# Place your code below this line

class SimpleEventHandler(IExternalEventHandler):
	def _init__(self,dothis):
		self.dothis = dothis

def revitEventHandler(sender, args):
	pass

    
doc.ActiveView += EventHandler[DocumentChangedEventArgs](revitEventHandler)

OUT = doc.ActiveView
# ----------------------------------------
watch = Watch(python_script)
