# Dynamo graph 01-ThietLap-ProjectBasepoint_SurveyPoint.dyn (Dynamo 2.1.0.7500)

file_path = Filename("C:\Users\USER\Documents\_RnD_2021\RevitDynamo\BIMmodelDataSchema.xlsx")
file_from_path = FileObject(path=file_path)
code_block = CodeBlock { sheetName = "PRO_PTs"; readAsString = false; showExcel = true; }
importExcel = Data.ImportExcel(file=file_from_path, sheetName=code_block.sheetName, readAsStrings=code_block.readAsString, showExcel=code_block.showExcel)
deconstruct = List.Deconstruct(list=importExcel)
transpose = List.Transpose(lists=deconstruct.rest)
code_block_2 = CodeBlock(list=transpose) { list[3]; builtinCat=list[3]; }
isNull = Object.IsNull(obj=code_block_2.builtinCat)
filterByBoolMask = List.FilterByBoolMask(list=code_block_2.builtinCat, mask=isNull)
byName = Category.ByName(name=filterByBoolMask.out)
