# Dynamo graph 22-FAMILIES INSTANCE IN ROOM.dyn (Dynamo 0.9.1.4062)

select_rooms = DSModelElementsSelection()  # 21 picked in the model
filter = StringInput("Rooms")
python_script_filterer = Python(IN[0]=select_rooms, IN[1]=filter)
# ---------- python_script_filterer.python (17 lines) ----------
import clr
clr.AddReference('ProtoGeometry')
from Autodesk.DesignScript.Geometry import *
#The inputs to this node will be stored as a list in the IN variables.
dataEnteringNode = IN
elems = IN[0]
cateName = IN[1]

res = []

for e in elems:
	ee = UnwrapElement(e)
	if ee.Category.Name == cateName:
		res.append(e)

#Assign your output to the OUT variable.
OUT = res
# ----------------------------------------
solids = Element.Solids(python_script_filterer)
flatten = Flatten(solids)
explode = Geometry.Explode(flatten)
python_script_get_surface_vector = Python(IN[0]=explode)  # "Python Script-Get Surface vector Z -1"
# ---------- python_script_get_surface_vector.python (17 lines) ----------
import clr
clr.AddReference('ProtoGeometry')
from Autodesk.DesignScript.Geometry import *
#The inputs to this node will be stored as a list in the IN variables.
dataEnteringNode = IN

listSurfaces = IN[0]

res = []
for list in listSurfaces:
	for sf in list:
		if sf.NormalAtParameter(0.5,0.5).Z == -1:
			res.append(sf)
			

#Assign your output to the OUT variable.
OUT = res
# ----------------------------------------
perimeterCurves = Surface.PerimeterCurves(python_script_get_surface_vector)
byJoinedCurves = PolyCurve.ByJoinedCurves(perimeterCurves)
select_door_window = DSModelElementsSelection()  # 41 picked in the model
filter_2 = StringInput("Doors")
python_script_filterer_2 = Python(IN[0]=select_door_window, IN[1]=filter_2)  # same code as python_script_filterer
location = FamilyInstance.Location(python_script_filterer_2)
code_block = CodeBlock { 200; }
byCenterPointRadius = Sphere.ByCenterPointRadius(centerPoint=location, radius=code_block)
filter_3 = StringInput("Windows")
python_script_filterer_3 = Python(IN[0]=select_door_window, IN[1]=filter_3)  # same code as python_script_filterer
location_2 = FamilyInstance.Location(python_script_filterer_3)
byCenterPointRadius_2 = Sphere.ByCenterPointRadius(centerPoint=location_2, radius=code_block)
python_script = Python(IN[0]=byJoinedCurves, IN[1]=byCenterPointRadius, IN[2]=byCenterPointRadius_2, IN[3]=flatten)
# ---------- python_script.python (28 lines) ----------
import clr
clr.AddReference('ProtoGeometry')
from Autodesk.DesignScript.Geometry import *
#The inputs to this node will be stored as a list in the IN variables.
dataEnteringNode = IN

curves = IN[0]
sphDoors = IN[1]
sphWindows = IN[2]
solids = IN[3]

res = []

for i in range(len(curves)):
	c = curves[i]
	list = []
	list.append(solids[i])
	for d in sphDoors:
		if c.DoesIntersect(d):
			list.append(d)	
	for w in sphWindows:
		if c.DoesIntersect(w):
			list.append(w)	
	
	res.append(list)

#Assign your output to the OUT variable.
OUT = res
# ----------------------------------------
ZAxis = Vector.ZAxis()
door_windown_param = CodeBlock { "DW Width"; "DW Height"; "Sill Height"; }
getParameterValueByName = Element.GetParameterValueByName(element=python_script_filterer_2, parameterName=door_windown_param.out1)
getParameterValueByName_2 = Element.GetParameterValueByName(element=python_script_filterer_2, parameterName=door_windown_param.out2)
code_block_2 = CodeBlock(h=getParameterValueByName, sh=getParameterValueByName_2) { z = h/2 + sh; }
translate = Geometry.Translate(geometry=location, direction=ZAxis, distance=code_block_2)
getParameterValueByName_3 = Element.GetParameterValueByName(element=python_script_filterer_2, parameterName=door_windown_param.out0)
code_block_3 = CodeBlock { 500; }
byLengths = Cuboid.ByLengths(origin=translate, width=getParameterValueByName_3, length=code_block_3, height=getParameterValueByName)
facingOrientation = FamilyInstance.FacingOrientation(python_script_filterer_2)
XAxis = Vector.XAxis()
angleBetween = Vector.AngleBetween(facingOrientation, XAxis)
rotate = Geometry.Rotate(geometry=byLengths, origin=translate, axis=ZAxis, degrees=angleBetween)
getParameterValueByName_4 = Element.GetParameterValueByName(element=python_script_filterer_3, parameterName=door_windown_param.out2)
ZAxis_2 = Vector.ZAxis()
getParameterValueByName_5 = Element.GetParameterValueByName(element=python_script_filterer_3, parameterName=door_windown_param.out1)
code_block_4 = CodeBlock(h=getParameterValueByName_5) { z = h/2; }
translate_2 = Geometry.Translate(geometry=location_2, direction=ZAxis_2, distance=code_block_4)
getParameterValueByName_6 = Element.GetParameterValueByName(element=python_script_filterer_3, parameterName=door_windown_param.out0)
code_block_5 = CodeBlock { 500; }
byLengths_2 = Cuboid.ByLengths(origin=translate_2, width=getParameterValueByName_6, length=code_block_5, height=getParameterValueByName_5)
facingOrientation_2 = FamilyInstance.FacingOrientation(python_script_filterer_3)
XAxis_2 = Vector.XAxis()
angleBetween_2 = Vector.AngleBetween(facingOrientation_2, XAxis_2)
rotate_2 = Geometry.Rotate(geometry=byLengths_2, origin=translate_2, axis=ZAxis_2, degrees=angleBetween_2)
