# Dynamo graph 23-COLUMN FORMWORK-FACE THICKEN.dyn (Dynamo 0.9.1.4062)

select_model_elements = DSModelElementsSelection()  # 6 picked in the model
string = StringInput("Structural Columns")
python_script_filterer = Python(IN[0]=select_model_elements, IN[1]=string)
# ---------- python_script_filterer.python (17 lines) ----------
import clr
clr.AddReference('ProtoGeometry')
from Autodesk.DesignScript.Geometry import *
#The inputs to this node will be stored as a list in the IN variables.
dataEnteringNode = IN
elems = IN[0]
cateName = IN[1]

res = []

for e in elems:
	ee = UnwrapElement(e)
	if ee.Category.Name == cateName:
		res.append(e)

#Assign your output to the OUT variable.
OUT = res
# ----------------------------------------
solids = Element.Solids(python_script_filterer)
flatten = Flatten(solids)  # frozen
deconstruct = List.Deconstruct(list=flatten)
unionAll = Solid.UnionAll(deconstruct.first, deconstruct.rest)
python_script_union_all = Python(IN[0]=solids)
# ---------- python_script_union_all.python (16 lines) ----------
import clr
clr.AddReference('ProtoGeometry')
from Autodesk.DesignScript.Geometry import *
#The inputs to this node will be stored as a list in the IN variables.
dataEnteringNode = IN
listSol = IN[0]

newlist = []
for list in listSol:
	
	sol = list[0]
	union = sol.UnionAll(list)
	newlist.append(union)
		
#Assign your output to the OUT variable.
OUT = newlist
# ----------------------------------------
explode = Geometry.Explode(python_script_union_all)
code_block = CodeBlock { 0.5; }
normalAtParameter = Surface.NormalAtParameter(surface=explode, u=code_block, v=code_block)
Z = Vector.Z(normalAtParameter)
abs = Math.Abs(Z)
code_block_2 = CodeBlock { 1; }
eq = abs == code_block_2
filterByBoolMask = List.FilterByBoolMask(list=explode, mask=eq)
byJoinedSurfaces = PolySurface.ByJoinedSurfaces(filterByBoolMask.out)
code_block_3 = CodeBlock { 20; }
boolean = BoolSelector(false)
thicken = Surface.Thicken(surface=byJoinedSurfaces, thickness=code_block_3, both_sides=boolean)
file_path = Filename("R:\BimESC\03_KIEM SOAT KHOI LUONG_3D QUANTITY\DYNAMO\_wip\column fw face thicken")
exportToSAT = ExportWithUnits(thicken, file_path, exportedUnit=Millimeters)
python_script_get_surface_vector = Python(IN[0]=explode)  # "Python Script-Get Surface vector Z !=-1"; frozen
# ---------- python_script_get_surface_vector.python (17 lines) ----------
import clr
clr.AddReference('ProtoGeometry')
from Autodesk.DesignScript.Geometry import *
#The inputs to this node will be stored as a list in the IN variables.
dataEnteringNode = IN

listSurfaces = IN[0]

res = []
for sf in listSurfaces:
	d = sf.NormalAtParameter(0.5,0.5).Z
	if d != -1 or d != 1:
		res.append(sf)
			

#Assign your output to the OUT variable.
OUT = res
# ----------------------------------------
byJoinedSurfaces_2 = PolySurface.ByJoinedSurfaces(python_script_get_surface_vector)
