# Dynamo graph 23-FRAMING & SLAB FORMWORK-FACE THICKEN-merge solid.dyn (Dynamo 0.9.1.4062)

# note: FAIL !!! VỚI SỐ LƯỢNG LỚN
select_model_elements = DSModelElementsSelection()  # 29 picked in the model
string = StringInput("Structural Framing")
python_script_filterer = Python(IN[0]=select_model_elements, IN[1]=string)
# ---------- python_script_filterer.python (17 lines) ----------
import clr
clr.AddReference('ProtoGeometry')
from Autodesk.DesignScript.Geometry import *
#The inputs to this node will be stored as a list in the IN variables.
dataEnteringNode = IN
elems = IN[0]
cateName = IN[1]

res = []

for e in elems:
	ee = UnwrapElement(e)
	if ee.Category.Name == cateName:
		res.append(e)

#Assign your output to the OUT variable.
OUT = res
# ----------------------------------------
solids = Element.Solids(python_script_filterer)
flatten = Flatten(solids)
deconstruct = List.Deconstruct(list=flatten)
unionAll = Solid.UnionAll(deconstruct.first, deconstruct.rest)
explode = Geometry.Explode(unionAll)
code_block = CodeBlock { 0.5; }
normalAtParameter = Surface.NormalAtParameter(surface=explode, u=code_block, v=code_block)
Z = Vector.Z(normalAtParameter)
code_block_2 = CodeBlock { 1; }
eq = Z == code_block_2
filterByBoolMask = List.FilterByBoolMask(list=explode, mask=eq)
code_block_3 = CodeBlock { 0.5; }
pointAtParameter = Surface.PointAtParameter(surface=filterByBoolMask.out, u=code_block_3, v=code_block_3)
sphere_radius_for_check = CodeBlock { 200; }
byCenterPointRadius = Sphere.ByCenterPointRadius(centerPoint=pointAtParameter, radius=sphere_radius_for_check)
location = StructuralFraming.Location(python_script_filterer)
startPoint = Curve.StartPoint(location)
byCenterPointRadius_2 = Sphere.ByCenterPointRadius(centerPoint=startPoint, radius=sphere_radius_for_check)
endPoint = Curve.EndPoint(location)
byCenterPointRadius_3 = Sphere.ByCenterPointRadius(centerPoint=endPoint, radius=sphere_radius_for_check)
create = List.Create(byCenterPointRadius_2, byCenterPointRadius_3)
transpose = List.Transpose(create)
flatten_2 = Flatten(transpose)
python_script_self_intersect_loc = Python(IN[0]=transpose, IN[1]=location)  # "Python Script-self intersect Loc Curves"
# ---------- python_script_self_intersect_loc.python (25 lines) ----------
import clr
clr.AddReference('ProtoGeometry')
from Autodesk.DesignScript.Geometry import *
#The inputs to this node will be stored as a list in the IN variables.
dataEnteringNode = IN

listlistSphere = IN[0]
listCurve = IN[1]
res = []
for i in range(len(listlistSphere)):
	listres = []
	A = listlistSphere[i]
	newlist = listCurve[:]
	del newlist[i]
	
	#flattened_list = [y for x in newlist for y in x]
	for a in A:
		flag = False
		for c in newlist:
			if a.DoesIntersect(c):
				flag = True
		listres.append(flag)
	res.append(listres)
#Assign your output to the OUT variable.
OUT = res
# ----------------------------------------
flatten_3 = Flatten(python_script_self_intersect_loc)
filterByBoolMask_2 = List.FilterByBoolMask(list=flatten_2, mask=flatten_3)
python_script_find_surface_of = Python(IN[0]=byCenterPointRadius, IN[1]=filterByBoolMask_2.out)  # "Python Script-Find surface of arc frame"
# ---------- python_script_find_surface_of.python (17 lines) ----------
import clr
clr.AddReference('ProtoGeometry')
from Autodesk.DesignScript.Geometry import *
#The inputs to this node will be stored as a list in the IN variables.
dataEnteringNode = IN

listSfSphere = IN[0]
listSESphere = IN[1]
res = []
for sfsp in listSfSphere:
	flag = False
	for sp in listSESphere:
		if sfsp.DoesIntersect(sp):
			flag = True
	res.append(flag)
#Assign your output to the OUT variable.
OUT = res
# ----------------------------------------
filterByBoolMask_3 = List.FilterByBoolMask(list=filterByBoolMask.out, mask=python_script_find_surface_of)
byJoinedSurfaces = PolySurface.ByJoinedSurfaces(filterByBoolMask_3.out)
code_block_4 = CodeBlock { 20; }
boolean = BoolSelector(false)
thicken = Surface.Thicken(surface=byJoinedSurfaces, thickness=code_block_4, both_sides=boolean)
file_path = Filename("C:\Users\USER\Documents\MARUBENI COFFEE\BIM QTO\frame slab fw thicken")
exportToSAT = ExportWithUnits(thicken, file_path, exportedUnit=Millimeters)
string_2 = StringInput("Floors")
python_script_filterer_2 = Python(IN[0]=select_model_elements, IN[1]=string_2)  # same code as python_script_filterer
