# Dynamo graph 23-FRAMING FORMWORK-FACE THICKEN-one by one.dyn (Dynamo 0.9.1.4062)

select_model_elements = DSModelElementsSelection()  # 2 picked in the model
string = StringInput("Structural Framing")
python_script_filterer = Python(IN[0]=select_model_elements, IN[1]=string)
# ---------- python_script_filterer.python (17 lines) ----------
import clr
clr.AddReference('ProtoGeometry')
from Autodesk.DesignScript.Geometry import *
#The inputs to this node will be stored as a list in the IN variables.
dataEnteringNode = IN
elems = IN[0]
cateName = IN[1]

res = []

for e in elems:
	ee = UnwrapElement(e)
	if ee.Category.Name == cateName:
		res.append(e)

#Assign your output to the OUT variable.
OUT = res
# ----------------------------------------
solids = Element.Solids(python_script_filterer)
python_script_union_all = Python(IN[0]=solids)
# ---------- python_script_union_all.python (16 lines) ----------
import clr
clr.AddReference('ProtoGeometry')
from Autodesk.DesignScript.Geometry import *
#The inputs to this node will be stored as a list in the IN variables.
dataEnteringNode = IN
listSol = IN[0]

newlist = []
for list in listSol:
	
	sol = list[0]
	union = sol.UnionAll(list)
	newlist.append(union)
		
#Assign your output to the OUT variable.
OUT = newlist
# ----------------------------------------
explode = Geometry.Explode(python_script_union_all)
code_block = CodeBlock { 0.5; }
normalAtParameter = Surface.NormalAtParameter(surface=explode, u=code_block, v=code_block)
Z = Vector.Z(normalAtParameter)
code_block_2 = CodeBlock { 1; }
eq = Z == code_block_2
filterByBoolMask = List.FilterByBoolMask(list=explode, mask=eq)
normalAtParameter_2 = Surface.NormalAtParameter(surface=filterByBoolMask.out, u=code_block, v=code_block)
location = StructuralFraming.Location(python_script_filterer)
startPoint = Curve.StartPoint(location)
endPoint = Curve.EndPoint(location)
byTwoPoints = Vector.ByTwoPoints(start=startPoint, end=endPoint)
python_script_vector_is_parallel = Python(IN[0]=normalAtParameter_2, IN[1]=byTwoPoints)
# ---------- python_script_vector_is_parallel.python (19 lines) ----------
import clr
clr.AddReference('ProtoGeometry')
from Autodesk.DesignScript.Geometry import *
#The inputs to this node will be stored as a list in the IN variables.
dataEnteringNode = IN

listListVec = IN[0]
listVecCompare = IN[1]
res = []
for i in range(len(listListVec)):
	listres = []
	for v in listListVec[i]:
		if v.IsParallel(listVecCompare[i]):
			listres.append(True)
		else:
			listres.append(False)
	res.append(listres)
#Assign your output to the OUT variable.
OUT = res
# ----------------------------------------
filterByBoolMask_2 = List.FilterByBoolMask(list=filterByBoolMask.out, mask=python_script_vector_is_parallel)
code_block_3 = CodeBlock { 0.5; }
pointAtParameter = Surface.PointAtParameter(surface=filterByBoolMask_2.out, u=code_block_3, v=code_block_3)
code_block_4 = CodeBlock { 150; }
byCenterPointRadius = Sphere.ByCenterPointRadius(centerPoint=pointAtParameter, radius=code_block_4)
byCenterPointRadius_2 = Sphere.ByCenterPointRadius(centerPoint=startPoint, radius=code_block_4)
byCenterPointRadius_3 = Sphere.ByCenterPointRadius(centerPoint=endPoint, radius=code_block_4)
create = List.Create(byCenterPointRadius_2, byCenterPointRadius_3)
transpose = List.Transpose(create)
python_script_find_surface_of = Python(IN[0]=byCenterPointRadius, IN[1]=transpose)  # "Python Script-Find surface of arc frame"
# ---------- python_script_find_surface_of.python (22 lines) ----------
import clr
clr.AddReference('ProtoGeometry')
from Autodesk.DesignScript.Geometry import *
#The inputs to this node will be stored as a list in the IN variables.
dataEnteringNode = IN

listlistSfSphere = IN[0]
listSESphere = IN[1]
res = []
for i in range(len(listlistSfSphere)):
	A = listlistSfSphere[i]
	B = listSESphere[i]	
	listres = []
	for a in A:
		flag = False
		for b in B:
			if a.DoesIntersect(b):
				flag = True
		listres.append(flag)
	res.append(listres)
#Assign your output to the OUT variable.
OUT = res
# ----------------------------------------
filterByBoolMask_3 = List.FilterByBoolMask(list=filterByBoolMask_2.out, mask=python_script_find_surface_of)
byJoinedSurfaces = PolySurface.ByJoinedSurfaces(filterByBoolMask_3.out)
code_block_5 = CodeBlock { 20; }
boolean = BoolSelector(false)
thicken = Surface.Thicken(surface=byJoinedSurfaces, thickness=code_block_5, both_sides=boolean)
file_path = Filename("C:\Users\USER\Documents\MARUBENI COFFEE\BIM QTO\framing fw face thicken")
exportToSAT = ExportWithUnits(thicken, file_path, exportedUnit=Millimeters)
length = Curve.Length(location)
byStartPointEndPoint = Line.ByStartPointEndPoint(startPoint=startPoint, endPoint=endPoint)
eq_2 = length == byStartPointEndPoint
