# Dynamo graph 26-LINTEL by EXCEL data For DW 2.dyn (Dynamo 0.9.1.4062)

writeToFile = Excel.WriteToFile()
writeToFile_2 = Excel.WriteToFile()
code_block = CodeBlock { "lanh to"; }
byName = FamilyType.ByName(code_block)
file_path = Filename("R:\BimESC\03_KIEM SOAT KHOI LUONG_3D QUANTITY\2002 CO GIANG SOHO\2 WIP\REVIT RV1\DATA_DOOR\DATA_DOOR_2F.xlsx")
fromPath = FileObject(file_path)  # "File.FromPath"
code_block_2 = CodeBlock { "Doors"; "Windows"; }
code_block_3 = CodeBlock(param=code_block_2.out1) { param; }
boolean = BoolSelector(false)
readFromFile = Excel.ReadFromFile(file=fromPath, sheetName=code_block_3, readAsStrings=boolean)
deconstruct = List.Deconstruct(list=readFromFile)
transpose = List.Transpose(deconstruct.rest)
code_block_4 = CodeBlock(list=transpose) { list; name = list[0]; x = list[1]; y = list[2]; rot = list[4]; w=list[5]; h=list[6]; sh=list[7]; ww = list[9]; }
code_block_5 = CodeBlock { 0; }
byCoordinates = Point.ByCoordinates(x=code_block_4.x, y=code_block_4.y, z=code_block_5)
flatten = Flatten(byCoordinates)
levels = Levels("Level 1")
byPointAndLevel = FamilyInstance.ByPointAndLevel(familyType=byName, point=flatten, level=levels)
setRotation = FamilyInstance.SetRotation(familyInstance=byPointAndLevel, degree=code_block_4.rot)
code_block_6 = CodeBlock { "Width"; "Height"; "Length"; "Offset"; "Comments"; }
offset = CodeBlock { 200; }
code_block_7 = CodeBlock(w=code_block_4.w, o=offset) { l = w + 2*o; }
setParameterByName = Element.SetParameterByName(element=setRotation, parameterName=code_block_6.out2, value=code_block_7)
code_block_8 = CodeBlock(h=code_block_4.h, sh=code_block_4.sh) { h+sh; }
setParameterByName_2 = Element.SetParameterByName(element=setParameterByName, parameterName=code_block_6.out3, value=code_block_8)
code_block_9 = CodeBlock(p=code_block_3) { "Lintel " + p; }
setParameterByName_3 = Element.SetParameterByName(element=setParameterByName_2, parameterName=code_block_6.out4, value=code_block_9)
setParameterByName_4 = Element.SetParameterByName(element=setParameterByName_3, parameterName=code_block_6.out0, value=code_block_4.ww)
height_value = CodeBlock { 200; }
setParameterByName_5 = Element.SetParameterByName(element=setParameterByName_3, parameterName=code_block_6.out1, value=height_value)
