# Dynamo graph 34-UNDERGROUND STRUC FOR EXCAVATION embank-CATE BY CATE.dyn (Dynamo 0.9.1.4062)

select_model_elements = DSModelElementsSelection()  # 1049 picked in the model
category_name = StringInput("Floors")
code_block = CodeBlock(cat=category_name) { cat; }
revit_category_filterer_1 = Custom[Revit Category Filterer 1](select_model_elements, code_block)
code_block_2 = CodeBlock(elems=revit_category_filterer_1) { elems; }
solids = Element.Solids(code_block_2)
flatten = Flatten(solids)
isNull = Object.IsNull(flatten)
filterByBoolMask = List.FilterByBoolMask(list=flatten, mask=isNull)
flatten_2 = Flatten(filterByBoolMask.out)
deconstruct = List.Deconstruct(list=flatten_2)
unionAll = Solid.UnionAll(deconstruct.first, deconstruct.rest)
select_model_element_excluded = DSModelElementSelection()  # "Select Model Element-Excluded Below"; 1 picked in the model
solids_2 = Element.Solids(select_model_element_excluded)
flatten_3 = Flatten(solids_2)
difference = Solid.Difference(solid=unionAll, other=flatten_3)
select_model_element_excluded_2 = DSModelElementSelection()  # "Select Model Element-Excluded Top"; 1 picked in the model
solids_3 = Element.Solids(select_model_element_excluded_2)
flatten_4 = Flatten(solids_3)
difference_2 = Solid.Difference(solid=difference, other=flatten_4)
code_block_3 = CodeBlock(solids=difference_2) { solids; }
directory_path = Directory("C:\Users\USER\Desktop")
string_from_object = FromObject(directory_path)
string = StringInput("\")
file_name = StringInput("UG Struc for Embank")
code_block_4 = CodeBlock(sf=file_name, cat=code_block) { name = sf + "-"+cat; }
code_block_5 = CodeBlock(name=code_block_4) { name; }
volume = Solid.Volume(code_block_3)
number = DoubleInput(1000000000)
div = volume / number
sum = Math.Sum(div)
number_2 = DoubleInput(3)
round = Math.Round(number=sum, digits=number_2)
code_block_6 = CodeBlock(dir=string_from_object, plash=string, filename=code_block_5, Info=round) { filepath = dir+plash+filename+"-"+Info+" m3"+".sat"; }
exportToSAT = ExportWithUnits(code_block_3, code_block_6, exportedUnit=Millimeters)
create = List.Create(flatten_2)  # frozen
number_slider = DoubleSlider(255, range=0..255 step 1)
number_slider_2 = DoubleSlider(0, range=0..255 step 1)
number_slider_3 = DoubleSlider(103, range=0..255 step 1)
number_slider_4 = DoubleSlider(255, range=0..255 step 1)
color_elements = Custom[Color Elements](A=number_slider, R=number_slider_2, G=number_slider_3, B=number_slider_4)
category_name_2 = StringInput("Structural Foundations")
category_name_3 = StringInput("Walls")
category_name_4 = StringInput("Structural Columns")
category_name_5 = StringInput("Structural Framing")
python_script = Python(IN[0]=select_model_elements, IN[1]=category_name_2, IN[2]=category_name_3, IN[3]=category_name_4, IN[4]=category_name_5, IN[5]=category_name)  # frozen
# ---------- python_script.python (22 lines) ----------
import clr
clr.AddReference('ProtoGeometry')
from Autodesk.DesignScript.Geometry import *
#The inputs to this node will be stored as a list in the IN variables.
dataEnteringNode = IN
elems = IN[0]
cateName1 = IN[1]
cateName2 = IN[2]
cateName3 = IN[3]
cateName4 = IN[4]
cateName5 = IN[5]

res = []

for e in elems:
	ee = UnwrapElement(e)
	cat = ee.Category.Name
	if cat == cateName1 or cat == cateName2 or cat == cateName3 or cat == cateName4 or cat == cateName5:
		res.append(e)

#Assign your output to the OUT variable.
OUT = res
# ----------------------------------------
differenceAll = Solid.DifferenceAll(arg1=flatten_2, lacing=Longest)  # frozen
flatten_5 = Flatten(differenceAll)
create_2 = List.Create(code_block_3)
