# Dynamo graph 38- Get parameter value of door and windows.dyn (Dynamo 0.9.1.4062)

select_model_elements = DSModelElementsSelection()  # 415 picked in the model
code_block = CodeBlock { "Doors"; "Windows"; }
code_block_2 = CodeBlock(sheetName=code_block.out0) { sheetName; }
revit_category_filterer_1 = Custom[Revit Category Filterer 1](select_model_elements, code_block_2)
code_block_3 = CodeBlock(list=revit_category_filterer_1) { list; }
parameters = Element.Parameters(code_block_3)
watch = Watch(parameters)
code_block_4 = CodeBlock { "Width"; "Height"; "Level"; }
getParameterValueByName = Element.GetParameterValueByName(element=code_block_3, parameterName=code_block_4.out2)
code_block_5 = CodeBlock { "Type Id"; }
getParameterValueByName_2 = Element.GetParameterValueByName(parameterName=code_block_5)
geometry = Element.Geometry(code_block_3)
facingOrientation = FamilyInstance.FacingOrientation(code_block_3)
Y = Vector.Y(facingOrientation)
code_block_6 = CodeBlock { 0; }
# note: Alpha =  Huong Cua hop voi Phuong X cua du an
ge = Y >= code_block_6
XAxis = Vector.XAxis()
angleBetween = Vector.AngleBetween(facingOrientation, XAxis)
angleBetween_2 = Vector.AngleBetween(facingOrientation, XAxis)
code_block_7 = CodeBlock { -1; }
mul = angleBetween_2 * code_block_7
if_ = If(test=ge, true=angleBetween, false=mul)
# note: goc hop boi phuong X family voi phuong X du an
# = Alpha - 90 do
code_block_8 = CodeBlock { 90; }
sub = if_ - code_block_8  # frozen
file_path = Filename("R:\BimESC\03_KIEM SOAT KHOI LUONG_3D QUANTITY\2002 CO GIANG SOHO\2 WIP\REVIT RV1\DATA_DOOR\DATA_DOOR_3F.xlsx")
code_block_9 = CodeBlock { 0; 0; }
code_block_10 = CodeBlock { "Type"; "X"; "Y"; "Z"; "Rot"; "W"; "H"; "SH"; "Id"; "WW"; }
create = List.Create(code_block_10.out0, code_block_10.out1, code_block_10.out2, code_block_10.out3, code_block_10.out4, code_block_10.out5, code_block_10.out6, code_block_10.out7, code_block_10.out8, code_block_10.out9)
code_block_11 = CodeBlock { "Type"; "Sill Height"; "Host Id"; "Width"; "Height"; }
getParameterValueByName_3 = Element.GetParameterValueByName(element=code_block_3, parameterName=code_block_11.out2)
location = FamilyInstance.Location(code_block_3)
X = Point.X(location)
round = Math.Round(X)
Y_2 = Point.Y(location)
round_2 = Math.Round(Y_2)
Z = Point.Z(location)
round_3 = Math.Round(Z)
add = if_ + code_block_8
round_4 = Math.Round(add)
getParameterValueByName_4 = Element.GetParameterValueByName(element=code_block_3, parameterName=code_block_11.out0)
getParameterValueByName_5 = Element.GetParameterValueByName(element=getParameterValueByName_4, parameterName=code_block_4.out0)
getParameterValueByName_6 = Element.GetParameterValueByName(element=getParameterValueByName_4, parameterName=code_block_4.out1)
getParameterValueByName_7 = Element.GetParameterValueByName(element=code_block_3, parameterName=code_block_11.out1)
id = Element.Id(code_block_3)
getParameterValueByName_8 = Element.GetParameterValueByName(element=getParameterValueByName_3, parameterName=code_block_11.out0)
getParameterValueByName_9 = Element.GetParameterValueByName(element=getParameterValueByName_8, parameterName=code_block_11.out3)
create_2 = List.Create(getParameterValueByName_3, round, round_2, round_3, round_4, getParameterValueByName_5, getParameterValueByName_6, getParameterValueByName_7, id, getParameterValueByName_9)
transpose = List.Transpose(create_2)
addItemToFront = List.AddItemToFront(item=create, list=transpose)
boolean = BoolSelector(true)
writeToFile = Excel.WriteToFile(filePath=file_path, sheetName=code_block_2, startRow=code_block_9.out1, startCol=code_block_9.out0, data=addItemToFront, overWrite=boolean)
wall_host_width = CodeBlock { "Width"; }
