# Dynamo graph 39- WALL STIFFERNER.dyn (Dynamo 0.9.1.4062)

select_model_elements = DSModelElementsSelection()  # 15 picked in the model
filter = CodeBlock { "Walls"; }
revit_category_filterer_1 = Custom[Revit Category Filterer 1](select_model_elements, filter)
python_script_get_wall_solid = Python(IN[0]=revit_category_filterer_1)  # frozen
# ---------- python_script_get_wall_solid.python (42 lines) ----------
import clr
clr.AddReference('ProtoGeometry')
from Autodesk.DesignScript.Geometry import *
clr.AddReference('RevitAPI')
from Autodesk.Revit.DB import *
clr.AddReference('RevitAPIUI')
from Autodesk.Revit.UI import TaskDialog
clr.AddReference("RevitNodes")
import Revit
clr.ImportExtensions(Revit.Elements)
clr.AddReference("RevitServices")
import RevitServices
from RevitServices.Persistence import DocumentManager
from RevitServices.Transactions import TransactionManager
from System.Collections.Generic import *
clr.ImportExtensions(Revit.GeometryConversion)
 
doc = DocumentManager.Instance.CurrentDBDocument
uiapp = DocumentManager.Instance.CurrentUIApplication
app = uiapp.Application

#The inputs to this node will be stored as a list in the IN variables.
dataEnteringNode = IN
walls = UnwrapElement(IN[0])

def getCurves(geoElems):
	res = []		
	return 0

res = []

opt = Options()

for w in walls:	
	geoElem = w.get_Geometry(opt)
	
	for geoObj in geoElem:
		res.append(geoObj.ToString())


#Assign your output to the OUT variable.
OUT = res
# ----------------------------------------
python_script_get_wall_curve = Python(IN[0]=revit_category_filterer_1)
# ---------- python_script_get_wall_curve.python (39 lines) ----------
import clr
clr.AddReference('ProtoGeometry')
from Autodesk.DesignScript.Geometry import *
clr.AddReference('RevitAPI')
from Autodesk.Revit.DB import *
clr.AddReference('RevitAPIUI')
from Autodesk.Revit.UI import TaskDialog
clr.AddReference("RevitNodes")
import Revit
clr.ImportExtensions(Revit.Elements)
clr.AddReference("RevitServices")
import RevitServices
from RevitServices.Persistence import DocumentManager
from RevitServices.Transactions import TransactionManager
from System.Collections.Generic import *
clr.ImportExtensions(Revit.GeometryConversion)
 
 
 
doc = DocumentManager.Instance.CurrentDBDocument
uiapp = DocumentManager.Instance.CurrentUIApplication
app = uiapp.Application

#The inputs to this node will be stored as a list in the IN variables.
dataEnteringNode = IN
walls = UnwrapElement(IN[0])

res = []

opt = Options()

for w in walls:	
	loc = w.Location
	c = loc.Curve
	res.append(c.ToProtoType())


#Assign your output to the OUT variable.
OUT = res
# ----------------------------------------
python_script_get_wall_curve_2 = Python(IN[0]=python_script_get_wall_curve)
# ---------- python_script_get_wall_curve_2.python (29 lines) ----------
import clr
clr.AddReference('ProtoGeometry')
from Autodesk.DesignScript.Geometry import *

 
 

#The inputs to this node will be stored as a list in the IN variables.
dataEnteringNode = IN
curves = IN[0]

def getIntersectPoints(curves):
	res = []	
	still = True
	i = 1
	while i < len(curves):
		c0 = curves[i-1]		
		rest = curves[i:]		
		for c in rest:
			flag = c0.DoesIntersect(c)
			if flag:
				p = c0.Intersect(c)
				res.append(p)
		i+=1
	return res

res = getIntersectPoints(curves)
#Assign your output to the OUT variable.
OUT = res
# ----------------------------------------
flatten = Flatten(python_script_get_wall_curve_2)
