# Dynamo graph 40- FLOOR BY WALLS.dyn (Dynamo 0.9.1.4062)

select_model_elements = DSModelElementsSelection()  # 12 picked in the model
filter = CodeBlock { "Walls"; }
revit_category_filterer_1 = Custom[Revit Category Filterer 1](select_model_elements, filter)
python_script_get_wall_curve = Python(IN[0]=revit_category_filterer_1)
# ---------- python_script_get_wall_curve.python (39 lines) ----------
import clr
clr.AddReference('ProtoGeometry')
from Autodesk.DesignScript.Geometry import *
clr.AddReference('RevitAPI')
from Autodesk.Revit.DB import *
clr.AddReference('RevitAPIUI')
from Autodesk.Revit.UI import TaskDialog
clr.AddReference("RevitNodes")
import Revit
clr.ImportExtensions(Revit.Elements)
clr.AddReference("RevitServices")
import RevitServices
from RevitServices.Persistence import DocumentManager
from RevitServices.Transactions import TransactionManager
from System.Collections.Generic import *
clr.ImportExtensions(Revit.GeometryConversion)
 
 
 
doc = DocumentManager.Instance.CurrentDBDocument
uiapp = DocumentManager.Instance.CurrentUIApplication
app = uiapp.Application

#The inputs to this node will be stored as a list in the IN variables.
dataEnteringNode = IN
walls = UnwrapElement(IN[0])

res = []

opt = Options()

for w in walls:	
	loc = w.Location
	c = loc.Curve
	res.append(c.ToProtoType())


#Assign your output to the OUT variable.
OUT = res
# ----------------------------------------
python_script_curve_loop = Python(IN[0]=python_script_get_wall_curve)
# ---------- python_script_curve_loop.python (37 lines) ----------
import clr
clr.AddReference('ProtoGeometry')
from Autodesk.DesignScript.Geometry import *

 
 

#The inputs to this node will be stored as a list in the IN variables.
dataEnteringNode = IN
curves = IN[0]
radius = IN[1]

def revert(c):
	
	return 0


def getCurveLoop(curves,r):
	res = []	
	i = 1
	while i < len(curves):
		c0 = curves[i-1]
		circle1 = Circle.ByCenterPointRadius(c0.StartPoint,r)
		
		rest = curves[i:]		
		
		for c in rest:
			flag = circle1.DoesIntersect(c)
			if flag:
				res.append(c0)
				if 
		i+=1
	return res

res = getCurveLoop(curves,radius)
#Assign your output to the OUT variable.
OUT = res
# ----------------------------------------
code_block = CodeBlock { c = null; circle1 = Circle.ByCenterPointRadius(c, 50); }
code_block_2 = CodeBlock { c = null; curve1 = c.Reverse(); }
get_intersected_points_of_curves = Custom[Get Intersected points of curves](curves=python_script_get_wall_curve)
