# Dynamo graph 40-ZONING CONCRETE-for Part.dyn (Dynamo 0.9.1.4062)

# note: Chọn Đối tượng Kết cấu
select_model_elements = DSModelElementsSelection()  # 89 picked in the model
code_block = CodeBlock { "Areas"; "Parts"; }
code_block_2 = CodeBlock(cat=code_block.out1) { cat; }
revit_category_filterer_1 = Custom[Revit Category Filterer 1](elems=select_model_elements, catName=code_block_2)
code_block_3 = CodeBlock(elems=revit_category_filterer_1) { elems; }
solids = Element.Solids(code_block_3)
flatten = Flatten(solids)
isNull = Object.IsNull(flatten)
filterByBoolMask = List.FilterByBoolMask(list=code_block_3, mask=isNull)
# note: Chọn Zone (đối tương Areas)
select_model_elements_2 = DSModelElementsSelection()  # 28 picked in the model
code_block_4 = CodeBlock(cat=code_block.out0) { cat; }
revit_category_filterer_1_2 = Custom[Revit Category Filterer 1](elems=select_model_elements_2, catName=code_block_4)
code_block_5 = CodeBlock(elems=revit_category_filterer_1_2) { elems; }
python_script = Python(IN[0]=code_block_5)
# ---------- python_script.python (33 lines) ----------
import clr
clr.AddReference('ProtoGeometry')
from Autodesk.DesignScript.Geometry import *

clr.AddReference('RevitAPI')
from Autodesk.Revit.DB import *
clr.AddReference('RevitAPIUI')
from Autodesk.Revit.UI import TaskDialog
clr.AddReference("RevitNodes")
import Revit
clr.ImportExtensions(Revit.Elements)
clr.AddReference("RevitServices")
import RevitServices
from RevitServices.Persistence import DocumentManager
from RevitServices.Transactions import TransactionManager
from System.Collections.Generic import *
clr.ImportExtensions(Revit.GeometryConversion)

#The inputs to this node will be stored as a list in the IN variables.
dataEnteringNode = IN
areaElems = UnwrapElement(IN[0])

res = []
for a in areaElems:
	opt = SpatialElementBoundaryOptions()
	lines = a.GetBoundarySegments(opt)
	convertLines = []
	for l in lines[0]:
		convertLines.append(l.GetCurve().ToProtoType())	
	res.append(convertLines)

#Assign your output to the OUT variable.
OUT = res
# ----------------------------------------
byJoinedCurves = PolyCurve.ByJoinedCurves(python_script)
isNull_2 = Object.IsNull(byJoinedCurves)
filterByBoolMask_2 = List.FilterByBoolMask(list=python_script, mask=isNull_2)
code_block_6 = CodeBlock { 1; "ZoningPart"; }
code_block_7 = CodeBlock { "Category"; "Orgin Cat"; "ID"; "Zone"; }
create = List.Create(code_block_7.out0, code_block_7.out1, code_block_7.out2, code_block_7.out3)
boundingBox = Element.BoundingBox(code_block_3)
maxPoint = BoundingBox.MaxPoint(boundingBox)
minPoint = BoundingBox.MinPoint(boundingBox)
byStartPointEndPoint = Line.ByStartPointEndPoint(startPoint=maxPoint, endPoint=minPoint)
code_block_8 = CodeBlock { 0.5; }
pointAtParameter = Curve.PointAtParameter(curve=byStartPointEndPoint, param=code_block_8)
code_block_9 = CodeBlock { 200; }
byCenterPointRadius = Sphere.ByCenterPointRadius(centerPoint=pointAtParameter, radius=code_block_9)
filterByBoolMask_3 = List.FilterByBoolMask(list=byJoinedCurves, mask=isNull_2)
ZAxis = Vector.ZAxis()
translate_distance = CodeBlock { -1000; }
translate = Geometry.Translate(geometry=filterByBoolMask_3.out, direction=ZAxis, distance=translate_distance)
depth_start_end = CodeBlock { 4000; }
code_block_10 = CodeBlock(d=depth_start_end) { d; -d; }
translate_2 = Geometry.Translate(geometry=translate, direction=ZAxis, distance=code_block_10.out1)
translate_3 = Geometry.Translate(geometry=translate, direction=ZAxis, distance=code_block_10.d)
create_2 = List.Create(translate_2, translate_3)
transpose = List.Transpose(create_2)
byLoft = Solid.ByLoft(transpose)
isNull_3 = Object.IsNull(byLoft)
filterByBoolMask_4 = List.FilterByBoolMask(list=byLoft, mask=isNull_3)
param_name = CodeBlock { "Name"; }
getParameterValueByName = Element.GetParameterValueByName(element=code_block_5, parameterName=param_name)
filterByBoolMask_5 = List.FilterByBoolMask(list=getParameterValueByName, mask=isNull_2)
filterByBoolMask_6 = List.FilterByBoolMask(list=filterByBoolMask_5.out, mask=isNull_3)
python_script_2 = Python(IN[0]=byCenterPointRadius, IN[1]=filterByBoolMask_4.out, IN[2]=filterByBoolMask_6.out, IN[3]=code_block_3)
# ---------- python_script_2.python (39 lines) ----------
import clr
clr.AddReference('ProtoGeometry')
from Autodesk.DesignScript.Geometry import *
#The inputs to this node will be stored as a list in the IN variables.
dataEnteringNode = IN

solids = IN[0]
zones = IN[1]
names = IN[2]
elems = IN[3]


result = []

for j in range(len(solids)):
	list=[]
	p = solids[j]
	
	info = ""
	e = elems[j]
	
	list.append("Parts")	
	list.append(e.GetParameterValueByName("Original Category"))
	list.append(e.Id)
	for i in range(len(zones)):
		z = zones[i]		
		if p.DoesIntersect(z):
			try:
				bool = not p.Difference(z).Volume == 0
				if True:
					info += ", "+ names[i]
			except:
				info += ", "+ "Error"
				pass				
	list.append(info)
	#e.SetParameterByName(param,info)
	result.append(list)
#Assign your output to the OUT variable.
OUT = result
# ----------------------------------------
addItemToFront = List.AddItemToFront(item=create, list=python_script_2)
boolean = BoolSelector(true)
writeToFile = Excel.WriteToFile(sheetName=code_block_6.out1, startRow=code_block_6.out0, startCol=code_block_6.out0, data=addItemToFront, overWrite=boolean)  # frozen
filterByBoolMask_7 = List.FilterByBoolMask(list=flatten, mask=isNull)
create_3 = List.Create(byCenterPointRadius, filterByBoolMask_7.out)
flatten_2 = Flatten(create_3)
directory_path = Directory("C:\Users\USER\Documents\TTRP")
string = StringInput("\")
data_file_name = StringInput("Part data")
string_2 = StringInput(".csv")
code_block_11 = CodeBlock(dir=directory_path, br=string, name=data_file_name, e=string_2) { dir+br+name+e; }
writeToFile_2 = CSV.WriteToFile(code_block_11, addItemToFront)
