# Dynamo graph 43-Place Doors Windows to Walls.dyn (Dynamo 0.9.1.4062)

levels = Levels("Level 1")
select_model_elements = DSModelElementsSelection()  # 2 picked in the model
code_block = CodeBlock { "Walls"; }
revit_category_filterer_1 = Custom[Revit Category Filterer 1](elems=select_model_elements, catName=code_block)
string = StringInput("0406 x 0610mm")
byName = FamilyType.ByName(string)
get_wall_curves = Custom[Get Wall Curves](walls=revit_category_filterer_1)
code_block_2 = CodeBlock { 0.5; }
pointAtParameter = Curve.PointAtParameter(curve=get_wall_curves, param=code_block_2)
ZAxis = Vector.ZAxis()
code_block_3 = CodeBlock { 1000; }
translate = Geometry.Translate(geometry=pointAtParameter, direction=ZAxis, distance=code_block_3)
YAxis = Vector.YAxis()
translate_2 = Geometry.Translate(geometry=translate, direction=YAxis, distance=code_block_3)
code_block_4 = CodeBlock(walls=revit_category_filterer_1, types=byName, points=translate_2) { walls; types; points; }
python_script_place_dw = Python(IN[0]=code_block_4.walls, IN[1]=code_block_4.types, IN[2]=code_block_4.points)
# ---------- python_script_place_dw.python (45 lines) ----------
#Copyright(c) 2016, Dimitar Venkov
# @5devene, dimitar.ven@gmail.com

import clr

clr.AddReference("RevitServices")
import RevitServices
from RevitServices.Persistence import DocumentManager
from RevitServices.Transactions import TransactionManager
doc = DocumentManager.Instance.CurrentDBDocument

clr.AddReference("RevitAPI")
import Autodesk

clr.AddReference("RevitNodes")
import Revit
clr.ImportExtensions(Revit.Elements)
clr.ImportExtensions(Revit.GeometryConversion)

def tolist(obj1):
	if hasattr(obj1,"__iter__"): return obj1
	else: return [obj1]

host = UnwrapElement(tolist(IN[0]))
ftype = UnwrapElement(tolist(IN[1]))
fpts = UnwrapElement(tolist(IN[2]))

OUT = []
strt = Autodesk.Revit.DB.Structure.StructuralType.NonStructural
ftp_len = len(ftype) == 1
hst_len = len(host) == 1

TransactionManager.Instance.EnsureInTransaction(doc)
for i in xrange(len(fpts) ):
	p = fpts[i].ToXyz(True)
	j = 0 if ftp_len else i
	k = 0 if hst_len else i
	try:
		if not ftype[j].IsActive : ftype[j].Activate()
		level = doc.GetElement(host[k].LevelId)
		nf = doc.Create.NewFamilyInstance(p,ftype[j],host[k],level,strt)
		OUT.append(nf.ToDSType(False))
	except:
		OUT.append(None)
TransactionManager.Instance.TransactionTaskDone()
# ----------------------------------------
