# Dynamo graph 44-Value Param A to B.dyn (Dynamo 0.9.1.4062)

select_model_elements_parama = DSModelElementsSelection()  # "Select Model Elements-paramA --> paramB"; 28 picked in the model
paramA = StringInput("Zone")
paramB = StringInput("Name")
param = CodeBlock(paramA=paramA, paramB=paramB) { paramA; paramB; }
getParameterValueByName = Element.GetParameterValueByName(element=select_model_elements_parama, parameterName=param.paramA)
setParameterByName = Element.SetParameterByName(element=select_model_elements_parama, parameterName=param.paramB, value=getParameterValueByName)
