# Dynamo graph 45-DIVDE PARTS.dyn (Dynamo 0.9.1.4062)

select_model_elements_zone_line = DSModelElementsSelection()  # 3 picked in the model
category = CodeBlock { "Lines"; "Parts"; }
revit_category_filterer_1 = Custom[Revit Category Filterer 1](elems=select_model_elements_zone_line, catName=category.out0)
select_model_elements_parts = DSModelElementsSelection()  # 1 picked in the model
revit_category_filterer_1_2 = Custom[Revit Category Filterer 1](elems=select_model_elements_parts, catName=category.out1)
