# Dynamo graph 48-EXPORT DATA SCHEDULE by START WITH.dyn (Dynamo 0.9.1.4062)

element_types = ElementTypes("ViewSchedule")
all_elements_of_type = ElementsOfType(element_types)
name = Element.Name(all_elements_of_type)
start_with = CodeBlock { "QTO"; }
startsWith = String.StartsWith(str=name, searchFor=start_with)
filterByBoolMask = List.FilterByBoolMask(list=all_elements_of_type, mask=startsWith)
directory_path = Directory("C:\Users\USER\Documents\TTRP")
name_2 = Element.Name(filterByBoolMask.in)
EXT = StringInput(".xls")
file_path = CodeBlock(append=name_2, extension=EXT) { append + extension; }
python_script = Python(IN[0]=filterByBoolMask.in, IN[1]=directory_path, IN[2]=file_path)
# ---------- python_script.python (16 lines) ----------
import clr
clr.AddReference('ProtoGeometry')
from Autodesk.DesignScript.Geometry import *
clr.AddReference('RevitAPI')
from Autodesk.Revit.DB import *
#The inputs to this node will be stored as a list in the IN variables.
dataEnteringNode = IN
schedule = UnwrapElement(IN[0])
path = IN[1]
names = IN[2]
exp_opt = ViewScheduleExportOptions()
for i in range(len(schedule)):	
	schedule[i].Export(path, names[i], exp_opt)	

#Assign your output to the OUT variable.
OUT = "Nope"
# ----------------------------------------
