# Dynamo graph 51-DELETE VALUE to PARAM.dyn (Dynamo 0.9.1.4062)

# note: version 2 200414
select_model_elements = DSModelElementsSelection()  # 146 picked in the model
category = CodeBlock { "Structural Foundations"; "Structural Columns"; "Structural Framing"; "Floors"; "Walls"; "Stairs"; }
revit_category_filterer_1 = Custom[Revit Category Filterer 1](elems=select_model_elements, catName=category.out0)
tên_param = CodeBlock { "QTO Filter"; }
ký_tự_nối = CodeBlock { ", "; }
giá_trị = CodeBlock { "Sub"; "BaseCap"; "Plastic Sheet"; "Formwork"; "Earthwork"; "Leveling Level -350"; }
giá_trị_2 = CodeBlock(c=ký_tự_nối, v=giá_trị.out5) { c+v; v; true; }
code_block = CodeBlock(param=tên_param, value=giá_trị_2.out0) { param; value; }
getParameterValueByName = Element.GetParameterValueByName(element=revit_category_filterer_1, parameterName=code_block.param)
code_block_2 = CodeBlock(e=getParameterValueByName, v=code_block.value, elems=revit_category_filterer_1) { e+v; v; e; elems; }
contains = String.Contains(str=code_block_2.e, searchFor=giá_trị_2.v, ignoreCase=giá_trị_2.out2)
if_ = If(test=contains, true=code_block_2.v, false=code_block_2.out0)
setParameterByName = Element.SetParameterByName(element=code_block_2.elems, parameterName=code_block.param, value=if_)
revit_category_filterer_1_2 = Custom[Revit Category Filterer 1](elems=select_model_elements, catName=category.out1)
getParameterValueByName_2 = Element.GetParameterValueByName(element=revit_category_filterer_1_2, parameterName=code_block.param)
code_block_3 = CodeBlock(e=getParameterValueByName_2, v=code_block.value, elems=revit_category_filterer_1_2) { e+v; v; e; elems; }
contains_2 = String.Contains(str=code_block_3.e, searchFor=code_block_3.v, ignoreCase=giá_trị_2.out2)
if_2 = If(test=contains_2, true=code_block_3.e, false=code_block_3.out0)
setParameterByName_2 = Element.SetParameterByName(element=code_block_3.elems, parameterName=code_block.param, value=if_2)
revit_category_filterer_1_3 = Custom[Revit Category Filterer 1](elems=select_model_elements, catName=category.out2)
getParameterValueByName_3 = Element.GetParameterValueByName(element=revit_category_filterer_1_3, parameterName=code_block.param)
code_block_4 = CodeBlock(e=getParameterValueByName_3, v=code_block.value, elems=revit_category_filterer_1_3) { e+v; v; e; elems; }
contains_3 = String.Contains(str=code_block_4.e, searchFor=code_block_4.v, ignoreCase=giá_trị_2.out2)
if_3 = If(test=contains_3, true=code_block_2.v, false=code_block_4.out0)
setParameterByName_3 = Element.SetParameterByName(element=code_block_4.elems, parameterName=code_block.param, value=if_3)
revit_category_filterer_1_4 = Custom[Revit Category Filterer 1](elems=select_model_elements, catName=category.out3)
getParameterValueByName_4 = Element.GetParameterValueByName(element=revit_category_filterer_1_4, parameterName=code_block.param)
code_block_5 = CodeBlock(e=getParameterValueByName_4, v=code_block.value, elems=revit_category_filterer_1_4) { e+v; v; e; elems; }
contains_4 = String.Contains(str=code_block_5.e, searchFor=code_block_5.v, ignoreCase=giá_trị_2.out2)
if_4 = If(test=contains_4, true=code_block_2.v, false=code_block_5.out0)
setParameterByName_4 = Element.SetParameterByName(element=code_block_5.elems, parameterName=code_block.param, value=if_4)
revit_category_filterer_1_5 = Custom[Revit Category Filterer 1](elems=select_model_elements, catName=category.out4)
getParameterValueByName_5 = Element.GetParameterValueByName(element=revit_category_filterer_1_5, parameterName=code_block.param)
code_block_6 = CodeBlock(e=getParameterValueByName_5, v=code_block.value, elems=revit_category_filterer_1_5) { e+v; v; e; elems; }
contains_5 = String.Contains(str=code_block_6.e, searchFor=code_block_6.v, ignoreCase=giá_trị_2.out2)
if_5 = If(test=contains_5, true=code_block_2.v, false=code_block_6.out0)
setParameterByName_5 = Element.SetParameterByName(element=code_block_6.elems, parameterName=code_block.param, value=if_5)
revit_category_filterer_1_6 = Custom[Revit Category Filterer 1](elems=select_model_elements, catName=category.out5)
getParameterValueByName_6 = Element.GetParameterValueByName(element=revit_category_filterer_1_6, parameterName=code_block.param)
code_block_7 = CodeBlock(e=getParameterValueByName_6, v=code_block.value, elems=revit_category_filterer_1_6) { e+v; v; e; elems; }
contains_6 = String.Contains(str=code_block_7.e, searchFor=code_block_7.v, ignoreCase=giá_trị_2.out2)
if_6 = If(test=contains_6, true=code_block_2.v, false=code_block_7.out0)
setParameterByName_6 = Element.SetParameterByName(element=code_block_7.elems, parameterName=code_block.param, value=if_6)
