# Dynamo graph 53-CHECK SOIL VOLUME FILL (1).dyn (Dynamo 0.9.1.4062)

file_path_data_cd_san_nen = Filename("C:\Users\USER\Documents\ANH NAM\BINH DO SAN LAP.xls")
fromPath = FileObject(file_path_data_cd_san_nen)  # "File.FromPath"
tên_sheet = StringInput("Summary")
boolean = BoolSelector(false)
readFromFile = Excel.ReadFromFile(file=fromPath, sheetName=tên_sheet, readAsStrings=boolean)
watch = Watch(readFromFile)
deconstruct = List.Deconstruct(list=readFromFile)
transpose = List.Transpose(deconstruct.rest)
watch_2 = Watch(transpose)
boolean_2 = BoolSelector(true)
lọc_block_khối_lượng_sn = StringInput("HSNX_OneSVolume")
danh_sách_dữ_liệu = CodeBlock(list=transpose)
# ---------- danh_sách_dữ_liệu.designscript (9 lines) ----------
list;
blockname = list[1];
x = list[2];
y = list[3];
z = list[4];
filter = list[14];
eleTK = list[6];
eleHT = list[7];
rot = list[5];
# ----------------------------------------
length = String.Length(danh_sách_dữ_liệu.filter)
lọc_block_chênh_lệch_cao_độ = StringInput("CDSN")
code_block = CodeBlock(f=lọc_block_chênh_lệch_cao_độ) { f; }
length_2 = String.Length(code_block)
eq = length == length_2
code_block_2 = CodeBlock(mask=eq) { mask; }
filterByBoolMask = List.FilterByBoolMask(list=danh_sách_dữ_liệu.blockname, mask=code_block_2)
filterByBoolMask_2 = List.FilterByBoolMask(list=danh_sách_dữ_liệu.x, mask=code_block_2)
filterByBoolMask_3 = List.FilterByBoolMask(list=danh_sách_dữ_liệu.y, mask=code_block_2)
filterByBoolMask_4 = List.FilterByBoolMask(list=danh_sách_dữ_liệu.z, mask=code_block_2)
filterByBoolMask_5 = List.FilterByBoolMask(list=danh_sách_dữ_liệu.eleTK, mask=code_block_2)
filterByBoolMask_6 = List.FilterByBoolMask(list=danh_sách_dữ_liệu.eleHT, mask=code_block_2)
filterByBoolMask_7 = List.FilterByBoolMask(list=danh_sách_dữ_liệu.rot, mask=code_block_2)
danh_sách_đã_lọc = CodeBlock(blockname=filterByBoolMask.in, x=filterByBoolMask_2.in, y=filterByBoolMask_3.in, z=filterByBoolMask_4.in, eleTK=filterByBoolMask_5.in, eleHT=filterByBoolMask_6.in, rot=filterByBoolMask_7.in) { blockname; x; y; z; eleTK; eleHT; rot; }
toNumber = String.ToNumber(danh_sách_đã_lọc.x)
toNumber_2 = String.ToNumber(danh_sách_đã_lọc.y)
code_block_3 = CodeBlock(elev=danh_sách_đã_lọc.eleTK)
# ---------- code_block_3.designscript (2 lines) ----------
e = String.ToNumber(elev)
 * 1000;
# ----------------------------------------
chuyển_vị_z = DoubleInput(-12000)
add = code_block_3 + chuyển_vị_z
byCoordinates = Point.ByCoordinates(x=toNumber, y=toNumber_2, z=add)
chỉ_số_điểm_ngẫu_nhiên = CodeBlock { 200; }
toNumber_3 = String.ToNumber(danh_sách_đã_lọc.rot)
code_block_4 = CodeBlock(list=byCoordinates, i=chỉ_số_điểm_ngẫu_nhiên, list1=toNumber_3) { p = list[i]; rot = list1[i]; }
# note: Tìm vector 2 điểm liền kề trong 1 ô đất
XAxis = Vector.XAxis()
code_block_5 = CodeBlock { 5000; }
translate = Geometry.Translate(geometry=code_block_4.p, direction=XAxis, distance=code_block_5)
byStartPointEndPoint = Line.ByStartPointEndPoint(startPoint=code_block_4.p, endPoint=translate)
ZAxis = Vector.ZAxis()
code_block_6 = CodeBlock(a=code_block_4.rot) { a; }
rotate = Geometry.Rotate(geometry=byStartPointEndPoint, origin=code_block_4.p, axis=ZAxis, degrees=code_block_6)
hệ_số_chỉ_số_liền_kề = CodeBlock { 2; }
code_block_7 = CodeBlock(list=byCoordinates, i=chỉ_số_điểm_ngẫu_nhiên, j=hệ_số_chỉ_số_liền_kề, list1=toNumber_3) { p = list[i+j]; rot = list1[i+j]; }
XAxis_2 = Vector.XAxis()
translate_2 = Geometry.Translate(geometry=code_block_7.p, direction=XAxis_2, distance=code_block_5)
byStartPointEndPoint_2 = Line.ByStartPointEndPoint(startPoint=code_block_7.p, endPoint=translate_2)
ZAxis_2 = Vector.ZAxis()
code_block_8 = CodeBlock(a=code_block_7.rot) { a; }
rotate_2 = Geometry.Rotate(geometry=byStartPointEndPoint_2, origin=code_block_7.p, axis=ZAxis_2, degrees=code_block_8)
line_bystartpointendpoint_duong = Line.ByStartPointEndPoint(startPoint=code_block_10.p1, endPoint=code_block_10.p2)  # "Line.ByStartPointEndPoint-duong thang"
code_block_9 = CodeBlock { 0.5; }
normalAtParameter = Curve.NormalAtParameter(curve=line_bystartpointendpoint_duong, param=code_block_9)
length_3 = Curve.Length(line_bystartpointendpoint_duong)
translate_3 = Geometry.Translate(geometry=code_block_7.p, direction=normalAtParameter, distance=length_3)
code_block_10 = CodeBlock(p1=code_block_4.p, p2=code_block_7.p, p3=translate_3) { p1; p2; p3; }
byTwoPoints = Vector.ByTwoPoints(start=code_block_10.p1, end=code_block_10.p2)
normalized = Vector.Normalized(byTwoPoints)
file_path_data_ranh_dat = Filename("C:\Users\USER\Documents\ANH NAM\RANH DAT.xls")
fromPath_2 = FileObject(file_path_data_ranh_dat)  # "File.FromPath"
readFromFile_2 = Excel.ReadFromFile(file=fromPath_2, sheetName=tên_sheet, readAsStrings=boolean)
deconstruct_2 = List.Deconstruct(list=readFromFile_2)
transpose_2 = List.Transpose(deconstruct_2.rest)
watch_3 = Watch(transpose_2)
watch_4 = Watch(readFromFile_2)
string_tạm_lưu = StringInput("""for i in range(arrL):
 xL = x - i*d
 yL = y
 pL = Point.ByCoordinates(xL,yL).Rotate(p,Vector.ZAxis(), angle)
 res.append(pL)

for j in range(arrR):
 xR = x + j*d
 yR = y
 pR = Point.ByCoordinates(xR,yR).Rotate(p,Vector.ZAxis(), angle)
 res.append(pR)


for m in range(arrF):
 xF = x + m*d
 yF = y
 pF = Point.ByCoordinates(xF,yF).Rotate(p,Vector.ZAxis(), angle+90)
 res.append(pF)
for n in range(arrB):
 xB = x - n*d
 yB = y
 pB = Point.ByCoordinates(xB,yB).Rotate(p,Vector.ZAxis(), angle+90)
 res.append(pB) """)
line_bystartpointendpoint_duong_2 = Line.ByStartPointEndPoint(startPoint=code_block_10.p1, endPoint=code_block_10.p3)  # "Line.ByStartPointEndPoint-duong chéo"
code_block_11 = CodeBlock { 0.5; }
pointAtParameter = Curve.PointAtParameter(curve=line_bystartpointendpoint_duong_2, param=code_block_11)
code_block_12 = CodeBlock(startPoint=pointAtParameter, length=length_3) { startPoint; length; }
array_lưới_điểm = CodeBlock { left = 19; right = 9; up = 15; down = 16; }
# note: Tạo lưới
code_block_13 = CodeBlock(rotationAngle=code_block_8) { rotationAngle; }
# note: Tạo lưới đặt rectange ô đất San nền
python_script_tạo_lưới_điểm = Python(IN[0]=code_block_12.startPoint, IN[1]=code_block_12.length, IN[2]=array_lưới_điểm.left, IN[3]=array_lưới_điểm.right, IN[4]=array_lưới_điểm.up, IN[5]=array_lưới_điểm.down, IN[6]=code_block_13)
# ---------- python_script_tạo_lưới_điểm.python (36 lines) ----------
import clr
clr.AddReference('ProtoGeometry')
from Autodesk.DesignScript.Geometry import *
#The inputs to this node will be stored as a list in the IN variables.
dataEnteringNode = IN

p = IN[0]
d = IN[1]
arrL = IN[2]
arrR = IN[3]
arrF = IN[4]
arrB = IN[5]
angle = IN[6]

x = p.X
y = p.Y

nX = x - arrL*d
nY = y - arrB*d

nP = Point.ByCoordinates(nX, nY).Rotate(p,Vector.ZAxis(), angle)

res = []
res.append(nP)

arrX = arrL + arrR
arrY = arrF + arrB


for i in range(arrX):
	for j in range(arrY):
		p1 = Point.ByCoordinates(nP.X + i*d, nP.Y + j*d).Rotate(nP,Vector.ZAxis(), angle)
		res.append(p1)

#Assign your output to the OUT variable.
OUT = res
# ----------------------------------------
X = Point.X(python_script_tạo_lưới_điểm)
Y = Point.Y(python_script_tạo_lưới_điểm)
byOrigin = CoordinateSystem.ByOrigin(x=X, y=Y)
code_block_14 = CodeBlock(point=python_script_tạo_lưới_điểm, cs=byOrigin, length=code_block_12.length, rotationAngle=code_block_13) { point; cs; length; rotationAngle; }
byWidthLength = Rectangle.ByWidthLength(cs=code_block_14.cs, width=code_block_14.length, length=code_block_14.length)
ZAxis_3 = Vector.ZAxis()
rotate_3 = Geometry.Rotate(geometry=byWidthLength, origin=code_block_14.point, axis=ZAxis_3, degrees=code_block_14.rotationAngle)
danh_sách_dữ_liệu_2 = CodeBlock(list=transpose_2) { list; startX = list[2]; startY = list[3]; startZ = list[4]; endX = list[5]; endY = list[6]; endZ = list[7]; }
toNumber_4 = String.ToNumber(danh_sách_dữ_liệu_2.startX)
toNumber_5 = String.ToNumber(danh_sách_dữ_liệu_2.startY)
byCoordinates_2 = Point.ByCoordinates(x=toNumber_4, y=toNumber_5)
toNumber_6 = String.ToNumber(danh_sách_dữ_liệu_2.endX)
toNumber_7 = String.ToNumber(danh_sách_dữ_liệu_2.endY)
byCoordinates_3 = Point.ByCoordinates(x=toNumber_6, y=toNumber_7)
byStartPointEndPoint_3 = Line.ByStartPointEndPoint(startPoint=byCoordinates_2, endPoint=byCoordinates_3)
deconstruct_3 = List.Deconstruct(list=byStartPointEndPoint_3)
join = Curve.Join(curve=deconstruct_3.first, curves=deconstruct_3.rest)
ZAxis_4 = Vector.ZAxis()
ranh_dat_extrustion_start_end = CodeBlock { 15000; }
code_block_15 = CodeBlock(d=ranh_dat_extrustion_start_end) { d; -d; }
translate_4 = Geometry.Translate(geometry=join, direction=ZAxis_4, distance=code_block_15.d)
translate_5 = Geometry.Translate(geometry=join, direction=ZAxis_4, distance=code_block_15.out1)
create = List.Create(translate_4, translate_5)
byLoft = Solid.ByLoft(create)
code_block_16 = CodeBlock(solid=byLoft) { solid; }
doesIntersect = Geometry.DoesIntersect(geometry=rotate_3, other=code_block_16)
filterByBoolMask_8 = List.FilterByBoolMask(list=rotate_3, mask=doesIntersect)
# note: Tạo rectange ô đất San nền
code_block_17 = CodeBlock(rectanges=filterByBoolMask_8.in) { rectanges; }
cote_giả_định_đáy_khối_đất = CodeBlock { -20000; }
code_block_18 = CodeBlock(num=cote_giả_định_đáy_khối_đất) { num; }
code_block_19 = CodeBlock(g=code_block_17, num1=code_block_18) { g; vector1 = Vector.ZAxis(); geometry1 = g.Translate(vector1, num1); }
create_2 = List.Create(code_block_17, code_block_19.geometry1)  # frozen
transpose_3 = List.Transpose(create_2)
byLoft_2 = Solid.ByLoft(transpose_3)
explode = Geometry.Explode(code_block_17)
startPoint = Curve.StartPoint(explode)
X_2 = Point.X(startPoint)
Y_2 = Point.Y(startPoint)
byOrigin_2 = CoordinateSystem.ByOrigin(x=X_2, y=Y_2)  # frozen
bán_kính_kiểm_tra = CodeBlock { rC = 2000; rectLength = 2000; }
bán_kính_kiểm_tra_2 = CodeBlock(rC=bán_kính_kiểm_tra.rC, rectLength=bán_kính_kiểm_tra.rectLength) { rC; rectLength; }
byWidthLength_2 = Rectangle.ByWidthLength(cs=byOrigin_2, width=bán_kính_kiểm_tra_2.rectLength, length=bán_kính_kiểm_tra_2.rectLength)
ZAxis_5 = Vector.ZAxis()
code_block_20 = CodeBlock { 45; }
rotate_4 = Geometry.Rotate(geometry=byWidthLength_2, origin=startPoint, axis=ZAxis_5, degrees=code_block_20)
count = List.Count(rotate_4)
toNumber_8 = String.ToNumber(danh_sách_đã_lọc.x)
round = Math.Round(toNumber_8)
toNumber_9 = String.ToNumber(danh_sách_đã_lọc.y)
round_2 = Math.Round(toNumber_9)
code_block_21 = CodeBlock(elev=danh_sách_đã_lọc.eleHT)  # same code as code_block_3
add_2 = code_block_21 + chuyển_vị_z
byCoordinates_4 = Point.ByCoordinates(x=round, y=round_2, z=add_2)
code_block_22 = CodeBlock(designPoints=byCoordinates, fillPoints=byCoordinates_4) { designPoints; fillPoints; }
X_3 = Point.X(code_block_22.designPoints)
Y_3 = Point.Y(code_block_22.designPoints)
byOrigin_3 = CoordinateSystem.ByOrigin(x=X_3, y=Y_3)  # frozen
byWidthLength_3 = Rectangle.ByWidthLength(cs=byOrigin_3, width=bán_kính_kiểm_tra_2.rectLength, length=bán_kính_kiểm_tra_2.rectLength)
count_2 = List.Count(byWidthLength_3)
count_3 = List.Count(danh_sách_đã_lọc.eleTK)
doesIntersect_2 = Geometry.DoesIntersect(geometry=byLoft, other=code_block_22.designPoints)
filterByBoolMask_9 = List.FilterByBoolMask(list=code_block_22.designPoints, mask=doesIntersect_2)
# note: Lọc các Point trong Ranh đất
code_block_23 = CodeBlock(designPoints=filterByBoolMask_9.in) { designPoints; }
count_4 = List.Count(code_block_23)
doesIntersect_3 = Geometry.DoesIntersect(geometry=byLoft, other=code_block_22.fillPoints)
filterByBoolMask_10 = List.FilterByBoolMask(list=code_block_22.fillPoints, mask=doesIntersect_3)
code_block_24 = CodeBlock(fillPoints=filterByBoolMask_10.in) { fillPoints; }
count_5 = List.Count(code_block_24)
code_block_25 = CodeBlock(pointNeedTranslate=startPoint) { pointNeedTranslate; }
code_block_26 = CodeBlock(designPoints=code_block_22.designPoints, fillPoints=code_block_22.fillPoints) { designPoints; fillPoints; }
code_block_27 = CodeBlock(eleTK=danh_sách_đã_lọc.eleTK, eleHT=danh_sách_đã_lọc.eleHT) { eleTK; eleHT; }
toNumber_10 = String.ToNumber(code_block_27.eleTK)
toNumber_11 = String.ToNumber(code_block_27.eleHT)
quy_đổi_mm = CodeBlock(tk=toNumber_10, ht=toNumber_11) { tk * 1000; ht * 1000; }
code_block_28 = CodeBlock(point1=startPoint, point2=code_block_26.designPoints, data1=quy_đổi_mm.out0, datt2=quy_đổi_mm.out1) { point1; point2; data1; datt2; }
python_script_tìm_dữ_liệu_cd_san = Python(IN[0]=code_block_28.point1, IN[1]=code_block_28.point2, IN[2]=code_block_28.data1, IN[3]=code_block_28.datt2)  # "Python Script-tìm dữ liệu CD san nền thiết kế và hiện trạng"
# ---------- python_script_tìm_dữ_liệu_cd_san.python (55 lines) ----------
import clr
clr.AddReference('ProtoGeometry')
from Autodesk.DesignScript.Geometry import *


def findNearestData(p0,points,data):
	d = 100000
	idx = 0
	x0 = p0.X
	y0 = p0.Y
	
	if not len(points) == len(data):
		return "Counting not match"
	
	for i in range(len(points)):
		p = points[i]
		x = p.X
		y = p.Y		
		dd = calDistance(x0,y0,x,y)
		if dd < d:
			d = dd
			idx = i
	return data[idx]
		
		
def calDistance(x0,y0,x,y):
	dx = abs(x0-x)
	dy = abs(y0-y)		
	res = (dx**2 + dy**2)**(0.5)		
	return res

#The inputs to this node will be stored as a list in the IN variables.
dataEnteringNode = IN

GroupPoints_1 = IN[0]
points_2 = IN[1]
data_1 = IN[2]
data_2 = IN[3]

res1 = []
res2 = []

for points_1 in GroupPoints_1:
	r1=[]
	r2=[]
	for p1 in points_1:
		r1.append(findNearestData(p1,points_2,data_1))
		r2.append(findNearestData(p1,points_2,data_2))
	res1.append(r1)
	res2.append(r2)



#Assign your output to the OUT variable.
OUT = res1 ,res2
# ----------------------------------------
code_block_29 = CodeBlock(list=python_script_tìm_dữ_liệu_cd_san) { list[0]; list[1]; }
# note: CD HIen trang
python_script_translate_top = Python(IN[0]=code_block_25, IN[1]=code_block_29.out1)  # "Python Script-translate top Points"
# ---------- python_script_translate_top.python (23 lines) ----------
import clr
clr.AddReference('ProtoGeometry')
from Autodesk.DesignScript.Geometry import *
#The inputs to this node will be stored as a list in the IN variables.
dataEnteringNode = IN

listPoints = IN[0]
listDatas = IN[1]

res = []

for i in range(len(listPoints)):
	points = listPoints[i]
	datas = listDatas[i]
	r = []
	for j in range(len(points)):
		p = points[j]
		data = datas[j]
		np = p.Translate(Vector.ZAxis(),data)
		r.append(np)
	res.append(r)
#Assign your output to the OUT variable.
OUT = res
# ----------------------------------------
# note: CDSN Thiet ke
python_script_translate_top_2 = Python(IN[0]=code_block_25, IN[1]=code_block_29.out0)  # "Python Script-translate top Points"; same code as python_script_translate_top
# note: Top surface
byPerimeterPoints = Surface.ByPerimeterPoints(python_script_translate_top_2)
explode_2 = Geometry.Explode(code_block_19.geometry1)
startPoint_2 = Curve.StartPoint(explode_2)
byPerimeterPoints_2 = Surface.ByPerimeterPoints(startPoint_2)
code_block_30 = CodeBlock(bottomSurfaces=byPerimeterPoints_2) { bottomSurfaces; }
solid_by_merged_surfaces_1 = Custom[Solid By Merged Surfaces 1](topSurface=byPerimeterPoints, bottomSurface=code_block_30)  # frozen
