# Dynamo graph 53-CHECK SOIL VOLUME FILL.dyn (Dynamo 0.9.1.4062)

file_path_data_cd_san_nen = Filename("C:\Users\USER\Documents\ANH NAM\BINH DO SAN LAP.xls")
fromPath = FileObject(file_path_data_cd_san_nen)  # "File.FromPath"
tên_sheet = StringInput("Summary")
boolean = BoolSelector(false)
readFromFile = Excel.ReadFromFile(file=fromPath, sheetName=tên_sheet, readAsStrings=boolean)
watch = Watch(readFromFile)
deconstruct = List.Deconstruct(list=readFromFile)
transpose = List.Transpose(deconstruct.rest)
watch_2 = Watch(transpose)
boolean_2 = BoolSelector(true)
danh_sách_dữ_liệu = CodeBlock(list=transpose)
# ---------- danh_sách_dữ_liệu.designscript (9 lines) ----------
list;
blockname = list[1];
x = list[2];
y = list[3];
z = list[4];
filter = list[14];
eleTK = list[6];
eleHT = list[7];
rot = list[5];
# ----------------------------------------
length = String.Length(danh_sách_dữ_liệu.filter)
lọc_block_chênh_lệch_cao_độ = StringInput("CDSN")
code_block = CodeBlock(f=lọc_block_chênh_lệch_cao_độ) { f; }
length_2 = String.Length(code_block)
eq = length == length_2
code_block_2 = CodeBlock(mask=eq) { mask; }
filterByBoolMask = List.FilterByBoolMask(list=danh_sách_dữ_liệu.blockname, mask=code_block_2)
filterByBoolMask_2 = List.FilterByBoolMask(list=danh_sách_dữ_liệu.x, mask=code_block_2)
filterByBoolMask_3 = List.FilterByBoolMask(list=danh_sách_dữ_liệu.y, mask=code_block_2)
filterByBoolMask_4 = List.FilterByBoolMask(list=danh_sách_dữ_liệu.z, mask=code_block_2)
filterByBoolMask_5 = List.FilterByBoolMask(list=danh_sách_dữ_liệu.eleTK, mask=code_block_2)
filterByBoolMask_6 = List.FilterByBoolMask(list=danh_sách_dữ_liệu.eleHT, mask=code_block_2)
filterByBoolMask_7 = List.FilterByBoolMask(list=danh_sách_dữ_liệu.rot, mask=code_block_2)
danh_sách_đã_lọc = CodeBlock(blockname=filterByBoolMask.in, x=filterByBoolMask_2.in, y=filterByBoolMask_3.in, z=filterByBoolMask_4.in, eleTK=filterByBoolMask_5.in, eleHT=filterByBoolMask_6.in, rot=filterByBoolMask_7.in) { blockname; x; y; z; eleTK; eleHT; rot; }
toNumber = String.ToNumber(danh_sách_đã_lọc.x)
toNumber_2 = String.ToNumber(danh_sách_đã_lọc.y)
code_block_3 = CodeBlock(elev=danh_sách_đã_lọc.eleTK)
# ---------- code_block_3.designscript (2 lines) ----------
e = String.ToNumber(elev)
 * 1000;
# ----------------------------------------
chuyển_vị_z = DoubleInput(-12000)
add = code_block_3 + chuyển_vị_z
byCoordinates = Point.ByCoordinates(x=toNumber, y=toNumber_2, z=add)
byPoints = Topography.ByPoints(byCoordinates)  # frozen
lọc_block_khối_lượng_sn = StringInput("HSNX_OneSVolume")
toNumber_3 = String.ToNumber(danh_sách_đã_lọc.x)
round = Math.Round(toNumber_3)
toNumber_4 = String.ToNumber(danh_sách_đã_lọc.y)
round_2 = Math.Round(toNumber_4)
code_block_4 = CodeBlock(elev=danh_sách_đã_lọc.eleHT)  # same code as code_block_3
add_2 = code_block_4 + chuyển_vị_z
byCoordinates_2 = Point.ByCoordinates(x=round, y=round_2, z=add_2)
byPoints_2 = Topography.ByPoints(byCoordinates_2)  # frozen
chỉ_số_điểm_ngẫu_nhiên = CodeBlock { 200; }
toNumber_5 = String.ToNumber(danh_sách_đã_lọc.rot)
code_block_5 = CodeBlock(list=byCoordinates, i=chỉ_số_điểm_ngẫu_nhiên, list1=toNumber_5) { p = list[i]; rot = list1[i]; }
# note: Tìm vector 2 điểm liền kề trong 1 ô đất
XAxis = Vector.XAxis()
code_block_6 = CodeBlock { 5000; }
translate = Geometry.Translate(geometry=code_block_5.p, direction=XAxis, distance=code_block_6)
byStartPointEndPoint = Line.ByStartPointEndPoint(startPoint=code_block_5.p, endPoint=translate)
ZAxis = Vector.ZAxis()
code_block_7 = CodeBlock(a=code_block_5.rot) { a; }
rotate = Geometry.Rotate(geometry=byStartPointEndPoint, origin=code_block_5.p, axis=ZAxis, degrees=code_block_7)
hệ_số_chỉ_số_liền_kề = CodeBlock { 2; }
code_block_8 = CodeBlock(list=byCoordinates, i=chỉ_số_điểm_ngẫu_nhiên, j=hệ_số_chỉ_số_liền_kề, list1=toNumber_5) { p = list[i+j]; rot = list1[i+j]; }
XAxis_2 = Vector.XAxis()
translate_2 = Geometry.Translate(geometry=code_block_8.p, direction=XAxis_2, distance=code_block_6)
byStartPointEndPoint_2 = Line.ByStartPointEndPoint(startPoint=code_block_8.p, endPoint=translate_2)
ZAxis_2 = Vector.ZAxis()
code_block_9 = CodeBlock(a=code_block_8.rot) { a; }
rotate_2 = Geometry.Rotate(geometry=byStartPointEndPoint_2, origin=code_block_8.p, axis=ZAxis_2, degrees=code_block_9)
line_bystartpointendpoint_duong = Line.ByStartPointEndPoint(startPoint=code_block_11.p1, endPoint=code_block_11.p2)  # "Line.ByStartPointEndPoint-duong thang"
code_block_10 = CodeBlock { 0.5; }
normalAtParameter = Curve.NormalAtParameter(curve=line_bystartpointendpoint_duong, param=code_block_10)
length_3 = Curve.Length(line_bystartpointendpoint_duong)
translate_3 = Geometry.Translate(geometry=code_block_8.p, direction=normalAtParameter, distance=length_3)
code_block_11 = CodeBlock(p1=code_block_5.p, p2=code_block_8.p, p3=translate_3) { p1; p2; p3; }
byTwoPoints = Vector.ByTwoPoints(start=code_block_11.p1, end=code_block_11.p2)
normalized = Vector.Normalized(byTwoPoints)
file_path_data_ranh_dat = Filename("C:\Users\USER\Documents\ANH NAM\RANH DAT.xls")
fromPath_2 = FileObject(file_path_data_ranh_dat)  # "File.FromPath"
readFromFile_2 = Excel.ReadFromFile(file=fromPath_2, sheetName=tên_sheet, readAsStrings=boolean)
deconstruct_2 = List.Deconstruct(list=readFromFile_2)
transpose_2 = List.Transpose(deconstruct_2.rest)
watch_3 = Watch(transpose_2)
watch_4 = Watch(readFromFile_2)
code_block_12 = CodeBlock(designPoints=byCoordinates, fillPoints=byCoordinates_2) { designPoints; fillPoints; }
danh_sách_dữ_liệu_2 = CodeBlock(list=transpose_2) { list; startX = list[2]; startY = list[3]; startZ = list[4]; endX = list[5]; endY = list[6]; endZ = list[7]; }
toNumber_6 = String.ToNumber(danh_sách_dữ_liệu_2.startX)
toNumber_7 = String.ToNumber(danh_sách_dữ_liệu_2.startY)
byCoordinates_3 = Point.ByCoordinates(x=toNumber_6, y=toNumber_7)
toNumber_8 = String.ToNumber(danh_sách_dữ_liệu_2.endX)
toNumber_9 = String.ToNumber(danh_sách_dữ_liệu_2.endY)
byCoordinates_4 = Point.ByCoordinates(x=toNumber_8, y=toNumber_9)
byStartPointEndPoint_3 = Line.ByStartPointEndPoint(startPoint=byCoordinates_3, endPoint=byCoordinates_4)
deconstruct_3 = List.Deconstruct(list=byStartPointEndPoint_3)
join = Curve.Join(curve=deconstruct_3.first, curves=deconstruct_3.rest)
ZAxis_3 = Vector.ZAxis()
ranh_dat_extrustion_start_end = CodeBlock { 15000; }
code_block_13 = CodeBlock(d=ranh_dat_extrustion_start_end) { d; -d; }
translate_4 = Geometry.Translate(geometry=join, direction=ZAxis_3, distance=code_block_13.d)
translate_5 = Geometry.Translate(geometry=join, direction=ZAxis_3, distance=code_block_13.out1)
create = List.Create(translate_4, translate_5)
byLoft = Solid.ByLoft(create)
doesIntersect = Geometry.DoesIntersect(geometry=byLoft, other=code_block_12.designPoints)
filterByBoolMask_8 = List.FilterByBoolMask(list=code_block_12.designPoints, mask=doesIntersect)  # frozen
# note: Lọc các Point trong Ranh đất
code_block_14 = CodeBlock(designPoints=filterByBoolMask_8.in) { designPoints; }
doesIntersect_2 = Geometry.DoesIntersect(geometry=byLoft, other=code_block_12.fillPoints)
filterByBoolMask_9 = List.FilterByBoolMask(list=code_block_12.fillPoints, mask=doesIntersect_2)  # frozen
code_block_15 = CodeBlock(fillPoints=filterByBoolMask_9.in) { fillPoints; }
string_tạm_lưu = StringInput("""for i in range(arrL):
 xL = x - i*d
 yL = y
 pL = Point.ByCoordinates(xL,yL).Rotate(p,Vector.ZAxis(), angle)
 res.append(pL)

for j in range(arrR):
 xR = x + j*d
 yR = y
 pR = Point.ByCoordinates(xR,yR).Rotate(p,Vector.ZAxis(), angle)
 res.append(pR)


for m in range(arrF):
 xF = x + m*d
 yF = y
 pF = Point.ByCoordinates(xF,yF).Rotate(p,Vector.ZAxis(), angle+90)
 res.append(pF)
for n in range(arrB):
 xB = x - n*d
 yB = y
 pB = Point.ByCoordinates(xB,yB).Rotate(p,Vector.ZAxis(), angle+90)
 res.append(pB) """)
X = Point.X(code_block_12.designPoints)
Y = Point.Y(code_block_12.designPoints)
byOrigin = CoordinateSystem.ByOrigin(x=X, y=Y)
bán_kính_kiểm_tra = CodeBlock { rC = 2000; rectLength = 2000; }
bán_kính_kiểm_tra_2 = CodeBlock(rC=bán_kính_kiểm_tra.rC, rectLength=bán_kính_kiểm_tra.rectLength) { rC; rectLength; }
byWidthLength = Rectangle.ByWidthLength(cs=byOrigin, width=bán_kính_kiểm_tra_2.rectLength, length=bán_kính_kiểm_tra_2.rectLength)
line_bystartpointendpoint_duong_2 = Line.ByStartPointEndPoint(startPoint=code_block_11.p1, endPoint=code_block_11.p3)  # "Line.ByStartPointEndPoint-duong chéo"
code_block_16 = CodeBlock { 0.5; }
pointAtParameter = Curve.PointAtParameter(curve=line_bystartpointendpoint_duong_2, param=code_block_16)
code_block_17 = CodeBlock(startPoint=pointAtParameter, length=length_3) { startPoint; length; }
array_lưới_điểm = CodeBlock { left = 19; right = 9; up = 15; down = 16; }
# note: Tạo lưới
code_block_18 = CodeBlock(rotationAngle=code_block_9) { rotationAngle; }
python_script_tạo_lưới_điểm = Python(IN[0]=code_block_17.startPoint, IN[1]=code_block_17.length, IN[2]=array_lưới_điểm.left, IN[3]=array_lưới_điểm.right, IN[4]=array_lưới_điểm.up, IN[5]=array_lưới_điểm.down, IN[6]=code_block_18)
# ---------- python_script_tạo_lưới_điểm.python (36 lines) ----------
import clr
clr.AddReference('ProtoGeometry')
from Autodesk.DesignScript.Geometry import *
#The inputs to this node will be stored as a list in the IN variables.
dataEnteringNode = IN

p = IN[0]
d = IN[1]
arrL = IN[2]
arrR = IN[3]
arrF = IN[4]
arrB = IN[5]
angle = IN[6]

x = p.X
y = p.Y

nX = x - arrL*d
nY = y - arrB*d

nP = Point.ByCoordinates(nX, nY).Rotate(p,Vector.ZAxis(), angle)

res = []
res.append(nP)

arrX = arrL + arrR
arrY = arrF + arrB


for i in range(arrX):
	for j in range(arrY):
		p1 = Point.ByCoordinates(nP.X + i*d, nP.Y + j*d).Rotate(nP,Vector.ZAxis(), angle)
		res.append(p1)

#Assign your output to the OUT variable.
OUT = res
# ----------------------------------------
X_2 = Point.X(python_script_tạo_lưới_điểm)
Y_2 = Point.Y(python_script_tạo_lưới_điểm)
byOrigin_2 = CoordinateSystem.ByOrigin(x=X_2, y=Y_2)
code_block_19 = CodeBlock(point=python_script_tạo_lưới_điểm, cs=byOrigin_2, length=code_block_17.length, rotationAngle=code_block_18) { point; cs; length; rotationAngle; }
byWidthLength_2 = Rectangle.ByWidthLength(cs=code_block_19.cs, width=code_block_19.length, length=code_block_19.length)
ZAxis_4 = Vector.ZAxis()
rotate_3 = Geometry.Rotate(geometry=byWidthLength_2, origin=code_block_19.point, axis=ZAxis_4, degrees=code_block_19.rotationAngle)
code_block_20 = CodeBlock(solid=byLoft) { solid; }
doesIntersect_3 = Geometry.DoesIntersect(geometry=rotate_3, other=code_block_20)
filterByBoolMask_10 = List.FilterByBoolMask(list=rotate_3, mask=doesIntersect_3)
code_block_21 = CodeBlock(rectanges=filterByBoolMask_10.in) { rectanges; }
explode = Geometry.Explode(code_block_21)
startPoint = Curve.StartPoint(explode)
X_3 = Point.X(startPoint)
Y_3 = Point.Y(startPoint)
byOrigin_3 = CoordinateSystem.ByOrigin(x=X_3, y=Y_3)
byWidthLength_3 = Rectangle.ByWidthLength(cs=byOrigin_3, width=bán_kính_kiểm_tra_2.rectLength, length=bán_kính_kiểm_tra_2.rectLength)
ZAxis_5 = Vector.ZAxis()
code_block_22 = CodeBlock { 45; }
rotate_4 = Geometry.Rotate(geometry=byWidthLength_3, origin=startPoint, axis=ZAxis_5, degrees=code_block_22)
