# Dynamo custom node Color Elements.dyf (Dynamo 0.9.1.4062)
# category: Revit.Elements

elems = Input()
number_slider = DoubleSlider(255, range=0..255 step 1)
number_slider_2 = DoubleSlider(0, range=0..255 step 1)
number_slider_3 = DoubleSlider(103, range=0..255 step 1)
number_slider_4 = DoubleSlider(172, range=0..255 step 1)
byARGB = Color.ByARGB(a=number_slider, r=number_slider_2, g=number_slider_3, b=number_slider_4)
overrideColorInView = Element.OverrideColorInView(element=elems, color=byARGB)
elems_2 = Output(overrideColorInView)  # "elems"
