# Dynamo custom node Embankment.dyf (Dynamo 0.9.1.4062)
# category: Revit.Elements

revitElems = Input()
revit_elements_to_merged_solid = Custom[Revit Elements to Merged Solid](RevitElements=revitElems)
solid_bottom_surface = Custom[Solid Bottom Surface](solid=revit_elements_to_merged_solid)
code_block = CodeBlock { 0.5; }
pointAtParameter = Surface.PointAtParameter(surface=solid_bottom_surface, u=code_block, v=code_block)
Z = Point.Z(pointAtParameter)
level = Input()
elevation = Level.Elevation(level)
lt = Z < elevation
filterByBoolMask = List.FilterByBoolMask(list=solid_bottom_surface, mask=lt)
perimeterCurves = Surface.PerimeterCurves(filterByBoolMask.out)
byJoinedCurves = PolyCurve.ByJoinedCurves(perimeterCurves)
watch = Watch(byJoinedCurves)
volume = Solid.Volume(revit_elements_to_merged_solid)
code_block_2 = CodeBlock { 1000000000; }
div = volume / code_block_2
watch_2 = Watch(div)
watch_3 = Watch(filterByBoolMask.out)
filterByBoolMask_2 = List.FilterByBoolMask(list=pointAtParameter, mask=lt)
byGeometry = BoundingBox.ByGeometry(revit_elements_to_merged_solid)
toCuboid = BoundingBox.ToCuboid(byGeometry)
XY = Plane.XY()
ZAxis = Vector.ZAxis()
translate = Geometry.Translate(geometry=XY, direction=ZAxis, distance=elevation)
intersect = Geometry.Intersect(geometry=toCuboid, other=translate)
distanceTo = Geometry.DistanceTo(geometry=filterByBoolMask_2.out, other=intersect, lacing=Longest)
round = Math.Round(distanceTo)
watch_4 = Watch(round)
watch_5 = Watch(Z)
code_block_3 = CodeBlock { 0; -1; }
byCoordinates = Vector.ByCoordinates(x=code_block_3.out0, y=code_block_3.out0, z=code_block_3.out1)
extrudeAsSolid = Curve.ExtrudeAsSolid(curve=byJoinedCurves, direction=byCoordinates, distance=round)
dirPath = Input()
fileName = Input()
solid_volume_sum_meter_cubic = Custom[Solid Volume Sum Meter Cubic](solids=extrudeAsSolid)
export_sat_w_info = Custom[Export SAT w Info](geometries=extrudeAsSolid, DirPath=dirPath, fileName=fileName, info=solid_volume_sum_meter_cubic)
res = Output(export_sat_w_info)
