# Dynamo custom node Export SAT w Info.dyf (Dynamo 0.9.1.4062)
# category: Revit.Elements

geometries = Input()
DirPath = Input()
string = StringInput("\")
fileName = Input()
info = Input()
code_block = CodeBlock(dir=DirPath, plash=string, filename=fileName, Info=info) { filepath = dir+plash+filename+"-"+Info+" m2"+".sat"; }
exportToSAT = ExportWithUnits(geometries, code_block, exportedUnit=Millimeters)
Output = Output(exportToSAT)  # ""
