# Dynamo custom node Filter Revit Element by checking Parameter value.dyf (Dynamo 0.9.1.4062)
# category: Revit.Selection

RevitElements = Input()
flatten = Flatten(RevitElements)
ParamName = Input()
getParameterValueByName = Element.GetParameterValueByName(element=flatten, parameterName=ParamName)
CheckValue = Input()
contains = String.Contains(str=getParameterValueByName, searchFor=CheckValue)
filterByBoolMask = List.FilterByBoolMask(mask=contains)
FilteredElements = Output(filterByBoolMask.out)
