# Dynamo custom node Revit Category Filterer 1.dyf (Dynamo 0.9.1.4062)
# category: Revit.Selection

elems = Input()
count = Count(elems)
code_block = CodeBlock { 1; }
gt = count > code_block
catName = Input()
python_script_filterer = Python(IN[0]=elems, IN[1]=catName)
# ---------- python_script_filterer.python (17 lines) ----------
import clr
clr.AddReference('ProtoGeometry')
from Autodesk.DesignScript.Geometry import *
#The inputs to this node will be stored as a list in the IN variables.
dataEnteringNode = IN
elems = IN[0]
cateName = IN[1]

res = []

for e in elems:
	ee = UnwrapElement(e)
	if ee.Category.Name == cateName:
		res.append(e)

#Assign your output to the OUT variable.
OUT = res
# ----------------------------------------
python_script_filterer_2 = Python(IN[0]=elems, IN[1]=catName)
# ---------- python_script_filterer_2.python (14 lines) ----------
import clr
clr.AddReference('ProtoGeometry')
from Autodesk.DesignScript.Geometry import *
#The inputs to this node will be stored as a list in the IN variables.
dataEnteringNode = IN
elem = UnwrapElement(IN[0])
cateName = IN[1]

res = []
if elem.Category.Name == cateName:
	res.append(elem)

#Assign your output to the OUT variable.
OUT = elem
# ----------------------------------------
if_ = If(test=gt, true=python_script_filterer, false=python_script_filterer_2)
elems_2 = Output(if_)  # "elems"
