# Dynamo custom node Revit Elements to Merged Solid.dyf (Dynamo 0.9.1.4062)
# category: Revit.Selection

RevitElements = Input()
solids = Element.Solids(RevitElements)
flatten = Flatten(solids)
isNull = Object.IsNull(flatten)
filterByBoolMask = List.FilterByBoolMask(list=flatten, mask=isNull)
deconstruct = List.Deconstruct(list=filterByBoolMask.out)
unionAll = Solid.UnionAll(deconstruct.first, deconstruct.rest)
Solid = Output(unionAll)
