# Dynamo custom node Solid Top Surface.dyf (Dynamo 0.9.1.4062)
# category: Geometry.Solid

code_block = CodeBlock { 1; }
solid_to_sufaces_filtered_vector = Custom[Filter Surface by Vector Z](ZValue=code_block)  # "Solid to Sufaces filtered vector Z"
solid = Input()
explode = Geometry.Explode(solid)
flatten = Flatten(explode)
code_block_2 = CodeBlock { 0.5; }
normalAtParameter = Surface.NormalAtParameter(surface=flatten, u=code_block_2, v=code_block_2)
Z = Vector.Z(normalAtParameter)
eq = Z == code_block
filterByBoolMask = List.FilterByBoolMask(list=flatten, mask=eq)
Surface = Output(filterByBoolMask.in)
