# Dynamo custom node Thicken Faces difference Solid.dyf (Dynamo 0.9.1.4062)
# category: Geometry.Solid

surfaces = Input()
solid = Input()
thickness = Input()
python_script_solid_differ_solid = Python(IN[0]=surfaces, IN[1]=solid, IN[2]=thickness)
# ---------- python_script_solid_differ_solid.python (18 lines) ----------
import clr
clr.AddReference('ProtoGeometry')
from Autodesk.DesignScript.Geometry import *
#The inputs to this node will be stored as a list in the IN variables.
dataEnteringNode = IN
listFace = IN[0]
solid = IN[1]
thick = IN[2]
res = []

for f in listFace:
	s = f.Thicken(thick,False)
	if s.DoesIntersect(solid):
		res.append(s.Difference(solid))
	else:
		res.append(s)
#Assign your output to the OUT variable.
OUT = res
# ----------------------------------------
solid_2 = Output(python_script_solid_differ_solid)  # "solid"
volume = Solid.Volume(python_script_solid_differ_solid)
sum = Math.Sum(volume)
code_block = CodeBlock { 1000000000; 0.02; }
div = sum / code_block.out0
volume_2 = Output(div)  # "volume"
area = div / code_block.out1
area_2 = Output(area)  # "area"
