# Dynamo custom node Union List Solids.dyf (Dynamo 0.9.1.4062)
# category: Geometry.Solid

ListSolids = Input()
isNull = Object.IsNull(ListSolids)
filterByBoolMask = List.FilterByBoolMask(list=ListSolids, mask=isNull)
deconstruct = List.Deconstruct(list=filterByBoolMask.out)
unionAll = Solid.UnionAll(deconstruct.first, deconstruct.rest)
Solid = Output(unionAll)
