# Dynamo graph AdaptiveRailingByLines-0901-OK-171103.dyn (Dynamo 0.9.1.4062)

code_block = CodeBlock()
# ---------- code_block.designscript (1 lines) ----------
https://www.youtube.com/watch?v=YmYlwCjTU9A
# ----------------------------------------

# group: USE LINES
select_lines = DSModelElementsSelection()  # 1 picked in the model
curves = Element.Curves(select_lines)

flatten = Flatten(curves)
byJoinedCurves = PolyCurve.ByJoinedCurves(flatten)
curves_2 = PolyCurve.Curves(byJoinedCurves)
length = Curve.Length(curves_2)

# group: SPACING OF RAILINGS
code_block_2 = CodeBlock { 500; }

code_block_3 = CodeBlock(len=length, n=code_block_2) { len/n; }
divideByDistance = Curve.DivideByDistance(curves_2, code_block_3)
flatten_2 = Flatten(divideByDistance)
startPoint = Curve.StartPoint(flatten_2)
endPoint = Curve.EndPoint(flatten_2)
create = List.Create(startPoint, endPoint)
transpose = List.Transpose(create)
deconstruct = List.Deconstruct(list=transpose)
code_block_4 = CodeBlock { 2; }
chop = List.Chop(list=deconstruct.first, lengths=code_block_4)

# group: SELECT TYPE OF ADAPTIVE COMPONENT
family_types = FamilyTypes("ADT-RAILING FIRST:ADT-RAILING FIRST")
family_types_2 = FamilyTypes("ADT-RAILING:ADT-RAILING")

byPoints = AdaptiveComponent.ByPoints(points=chop, familyType=family_types)
byPoints_2 = AdaptiveComponent.ByPoints(points=deconstruct.rest, familyType=family_types_2)
flatten_3 = Flatten(transpose)

# group: USE CAD FILE
select_cad_file = DSModelElementsSelection()  # 1 picked in the model
geometry = Element.Geometry(select_cad_file)
curves_3 = PolyCurve.Curves(geometry)
