# Dynamo graph FW.dyn (Dynamo 0.9.1.4062)

select_model_elements = DSModelElementsSelection()  # 10 picked in the model
python_script = Python(IN[0]=select_model_elements)
# ---------- python_script.python (60 lines) ----------
import clr
clr.AddReference('ProtoGeometry')
from Autodesk.DesignScript.Geometry import *
clr.AddReference('RevitAPI')
from Autodesk.Revit.DB import *
clr.AddReference('RevitAPIUI')
from Autodesk.Revit.UI import TaskDialog
clr.AddReference("RevitNodes")
import Revit
clr.ImportExtensions(Revit.Elements)
# Import DocumentManager and TransactionManager
clr.AddReference("RevitServices")
import RevitServices
from RevitServices.Persistence import DocumentManager
from RevitServices.Transactions import TransactionManager

from System.Collections.Generic import *
# Import geometry conversion extension methods
clr.ImportExtensions(Revit.GeometryConversion)
import sys
import System

doc = DocumentManager.Instance.CurrentDBDocument
uiapp = DocumentManager.Instance.CurrentUIApplication
app = uiapp.Application
#####################################################################
#The inputs to this node will be stored as a list in the IN variables.
dataEnteringNode = IN
selectElems = UnwrapElement(IN[0])

#####################################################################
elemGeometries =[]
elemGeoSolids=[]
geoSolids = []
opt = Options()
#elemGeometryBoundingBoxes =[]
elemFaces=[]
#intersectElems = []
solids = []
#####################################################################
for elem in selectElems:
	geoElem = elem.get_Geometry(opt)
	elemGeometries.append(geoElem)
	for elem in geoElem:
		geoObj = [GeometryObject]
		geoObj = elem
		geoInst = [GeometryInstance]
		geoInst = geoObj
		solid = [Solid]
		solid = geoInst			
		elemGeoSolids.append(solid)
#for solid in elemGeoSolids:
#	if solid is Solid:
#		geoSolids.append(solid)
for i in range(1,len(elemGeoSolids)/3):
	geoSolids.append(elemGeoSolids[i])
	

#Assign your output to the OUT variable.
OUT = geoSolids
# ----------------------------------------
