# Dynamo graph DuplicateWithDetailingByAllPhasesAndPlacingToSheet-0901-180203-OK.dyn (Dynamo 0.9.1.4062)

# group: Inputting
chọn_thư_viện_khung_tên_chưa = FamilyTypes("A0 desire:A0 desire")  # "Chọn thư viện Khung tên (#chưa dùng)"
# note: Số Sheet bắt đầu = Tiền tố Sheet Number + số thứ tự Phase
tiền_tố_sheet_number = StringInput("X_GH-CONS SEQUENCE-")
chọn_các_viewport_trong_sheet = DSModelElementsSelection()  # 6 picked in the model
# note: 1. Tạo 1 sheet mới
# 2. Place view muốn Duplicate vào Sheet
# 3. Active vào trong Viewport = double click vô view
# 4. Inputting
# 5. Run
# note: Tên của View = Tên view ban đầu + Tiền tố View
tiền_tố_view = StringInput("3D- GH-F6_")

# group: Get all Phases
get_phases = Python()
# ---------- get_phases.python (45 lines) ----------
#import libraries and reference
import clr
clr.AddReference('ProtoGeometry')
from Autodesk.DesignScript.Geometry import *
clr.AddReference('RevitAPI')
from Autodesk.Revit.DB import *
clr.AddReference('RevitAPIUI')
from Autodesk.Revit.UI import TaskDialog
clr.AddReference("RevitNodes")
import Revit
clr.ImportExtensions(Revit.Elements)
# Import geometry conversion extension methods
clr.ImportExtensions(Revit.GeometryConversion)
# Import DocumentManager and TransactionManager
clr.AddReference("RevitServices")
import RevitServices
from RevitServices.Persistence import DocumentManager
from RevitServices.Transactions import TransactionManager
from System.Collections.Generic import *


doc = DocumentManager.Instance.CurrentDBDocument
uiapp = DocumentManager.Instance.CurrentUIApplication
app = uiapp.Application
#The inputs to this node will be stored as a list in the IN variables.
dataEnteringNode = IN

elems = list()
elemName = list()
elemDes = list()

for phase in doc.Phases:
	elems.append(phase)
	elemName.append(phase.Name)


# Start Transaction
TransactionManager.Instance.EnsureInTransaction(doc)

# End Transaction
TransactionManager.Instance.TransactionTaskDone()
doc.Regenerate()

#Assign your output to the OUT variable.
OUT = elems
# ----------------------------------------
code_block = CodeBlock { "Sequence Number"; "Name"; }
getParameterValueByName = Element.GetParameterValueByName(element=get_phases, parameterName=code_block.out0)
boolean = BoolSelector(true)
sortIndexByValue = SortIndexByValue(getParameterValueByName, boolean)
list_getitematindex_phases_in = List.GetItemAtIndex(list=get_phases, index=sortIndexByValue)  # "List.GetItemAtIndex = Phases in Revit"
getParameterValueByName_2 = Element.GetParameterValueByName(element=get_phases, parameterName=code_block.out1)
parameters = Element.Parameters(get_phases)

# group: Create New Sheets
code_block_2 = CodeBlock(phases=list_getitematindex_phases_in) { n = Count(phases); rank = (1..n..1); }
code_block_3 = CodeBlock(shsf=tiền_tố_sheet_number, n=code_block_2.rank, pf=getParameterValueByName_2)
# ---------- code_block_3.designscript (4 lines) ----------
//Sheet numbers
shsf+n;
//Sheet names or Phase string
pf;
# ----------------------------------------
create_sheets = Python(IN[0]=code_block_3.out0, IN[1]=code_block_3.pf)
# ---------- create_sheets.python (88 lines) ----------
#import libraries and reference
import clr

clr.AddReference('ProtoGeometry')
from Autodesk.DesignScript.Geometry import *

clr.AddReference('RevitAPI')
from Autodesk.Revit.DB import *
from Autodesk.Revit.DB import ElementId
from Autodesk.Revit.DB import ViewSheet
from Autodesk.Revit.DB import FamilySymbol
from Autodesk.Revit.DB import Element

clr.AddReference('RevitAPIUI')
from Autodesk.Revit.UI import TaskDialog

clr.AddReference("RevitNodes")
import Revit
clr.ImportExtensions(Revit.Elements)


# Import geometry conversion extension methods
clr.ImportExtensions(Revit.GeometryConversion)


# Import DocumentManager and TransactionManager

clr.AddReference("RevitServices")
import RevitServices
from RevitServices.Persistence import DocumentManager
from RevitServices.Transactions import TransactionManager
from System.Collections.Generic import *


doc = DocumentManager.Instance.CurrentDBDocument
uiapp = DocumentManager.Instance.CurrentUIApplication
app = uiapp.Application

#The inputs to this node will be stored as a list in the IN variables.
dataEnteringNode = IN
newSheetNumbers = IN[0]
newSheetNames = IN[1]

############################################################################################################
# lấy typeId của sheet
nTid = FilteredElementCollector(doc).OfCategory(BuiltInCategory.OST_TitleBlocks).WhereElementIsElementType().FirstElement().Id

# lấy tất cả current sheet
allCurrentSheets = FilteredElementCollector(doc).OfClass(ViewSheet).WhereElementIsNotElementType().ToElements()

newSheetNumbersAfterCheck = []

newSheets =[] # cac sheet duoc tao mới
nsSheetnumbers = [] # Number sheet moi
nsSheetNames = []# Name sheet moi
filCurrentSheets = []
finalSheets =[]
# Start Transaction
TransactionManager.Instance.EnsureInTransaction(doc)

try:
# Tìm các sheet có Number trùng với List Sheetnumber và xóa đi number đó trong list Sheetnumber và sheetname
	newSheetNumbersAfterCheck = newSheetNumbers[:] # sao chep list
	for a in range(len(allCurrentSheets)):
		for b in range(len(newSheetNumbers)):
			if allCurrentSheets[a].SheetNumber == newSheetNumbers[b]:
				newSheetNumbersAfterCheck.remove(newSheetNumbers[b])
				
	for i in range(len(newSheetNumbersAfterCheck)):
		newSheets.append(ViewSheet.Create(doc,nTid))
		newSheets[i].SheetNumber = newSheetNumbersAfterCheck[i]	
	
	allCurrentSheets2 = FilteredElementCollector(doc).OfClass(ViewSheet).WhereElementIsNotElementType().ToElements()
		
		
	for j in range(len(allCurrentSheets2)):
		for k in range(len(newSheetNames)):
			if allCurrentSheets2[j].SheetNumber == newSheetNumbers[k]:
				allCurrentSheets2[j].ViewName = newSheetNames[k]
				finalSheets.append(allCurrentSheets2[j])
	
except:
	pass
# End Transaction
TransactionManager.Instance.TransactionTaskDone()
doc.Regenerate()

OUT = finalSheets
# ----------------------------------------
watch = Watch(code_block_3.pf)
watch_2 = Watch(code_block_3.out0)
test_get_titleblock = Python()
# ---------- test_get_titleblock.python (47 lines) ----------
#import libraries and reference
import clr

clr.AddReference('ProtoGeometry')
from Autodesk.DesignScript.Geometry import *

clr.AddReference('RevitAPI')
from Autodesk.Revit.DB import *
from Autodesk.Revit.DB import ElementId
from Autodesk.Revit.DB import ViewSheet
from Autodesk.Revit.DB import FamilySymbol
from Autodesk.Revit.DB import Element

clr.AddReference('RevitAPIUI')
from Autodesk.Revit.UI import TaskDialog

clr.AddReference("RevitNodes")
import Revit
clr.ImportExtensions(Revit.Elements)


# Import geometry conversion extension methods
clr.ImportExtensions(Revit.GeometryConversion)


# Import DocumentManager and TransactionManager

clr.AddReference("RevitServices")
import RevitServices
from RevitServices.Persistence import DocumentManager
from RevitServices.Transactions import TransactionManager
from System.Collections.Generic import *


doc = DocumentManager.Instance.CurrentDBDocument
uiapp = DocumentManager.Instance.CurrentUIApplication
app = uiapp.Application

#The inputs to this node will be stored as a list in the IN variables.
dataEnteringNode = IN

# lấy typeId của sheet
allCurrentSheets = FilteredElementCollector(doc).OfClass(ViewSheet).WhereElementIsNotElementType().ToElements()



OUT = allCurrentSheets[4].SheetNumber
# ----------------------------------------

sorting_accending_new_sheets = Python(IN[0]=create_sheets, IN[1]=code_block_3.out0)
# ---------- sorting_accending_new_sheets.python (55 lines) ----------
#import libraries and reference
import clr

clr.AddReference('ProtoGeometry')
from Autodesk.DesignScript.Geometry import *

clr.AddReference('RevitAPI')
from Autodesk.Revit.DB import *
from Autodesk.Revit.DB import ElementId
from Autodesk.Revit.DB import ViewSheet
from Autodesk.Revit.DB import FamilySymbol
from Autodesk.Revit.DB import Element

clr.AddReference('RevitAPIUI')
from Autodesk.Revit.UI import TaskDialog

clr.AddReference("RevitNodes")
import Revit
clr.ImportExtensions(Revit.Elements)


# Import geometry conversion extension methods
clr.ImportExtensions(Revit.GeometryConversion)


# Import DocumentManager and TransactionManager

clr.AddReference("RevitServices")
import RevitServices
from RevitServices.Persistence import DocumentManager
from RevitServices.Transactions import TransactionManager
from System.Collections.Generic import *


doc = DocumentManager.Instance.CurrentDBDocument
uiapp = DocumentManager.Instance.CurrentUIApplication
app = uiapp.Application
#######################################################################################################
#The inputs to this node will be stored as a list in the IN variables.
dataEnteringNode = IN
sheets = UnwrapElement(IN[0])
inisheetnumbers = UnwrapElement(IN[1])

#######################################################################################################
sortedSheets = []
sortedSheetNums = []
i=0
for ininum in inisheetnumbers:
	for sheet in sheets:
		i+=1
		if sheet.SheetNumber == ininum:
			sortedSheets.append(sheet)
			sortedSheetNums.append(sheet.SheetNumber)

OUT = sortedSheets
# ----------------------------------------
viewports_to_views = Python(IN[0]=chọn_các_viewport_trong_sheet)
# ---------- viewports_to_views.python (58 lines) ----------
#import libraries and reference
import clr

clr.AddReference('ProtoGeometry')
from Autodesk.DesignScript.Geometry import *

clr.AddReference('RevitAPI')
from Autodesk.Revit.DB import *
from Autodesk.Revit.DB import ElementId
from Autodesk.Revit.DB import ViewSheet
from Autodesk.Revit.DB import Viewport

clr.AddReference('RevitAPIUI')
from Autodesk.Revit.UI import TaskDialog

clr.AddReference("RevitNodes")
import Revit
clr.ImportExtensions(Revit.Elements)


# Import geometry conversion extension methods
clr.ImportExtensions(Revit.GeometryConversion)


# Import DocumentManager and TransactionManager

clr.AddReference("RevitServices")
import RevitServices
from RevitServices.Persistence import DocumentManager
from RevitServices.Transactions import TransactionManager
from System.Collections.Generic import *


doc = DocumentManager.Instance.CurrentDBDocument
uiapp = DocumentManager.Instance.CurrentUIApplication
app = uiapp.Application

#The inputs to this node will be stored as a list in the IN variables.
dataEnteringNode = IN

inputs = UnwrapElement(IN[0])
viewports=[]

viewIds =[]
views=[]

viewportTypeId = FilteredElementCollector(doc).OfCategory(BuiltInCategory.OST_Viewports).WhereElementIsNotElementType().FirstElement().GetTypeId()

for input in inputs:
	if input.GetTypeId() == viewportTypeId:
		viewports.append(input)
		
for viewport in viewports:
	viewIds.append(viewport.ViewId)
	views.append(doc.GetElement(viewport.ViewId))	

OUT = views
#sheetResult, viewId
# ----------------------------------------
count = Count(viewports_to_views)
ofRepeatedItem = List.OfRepeatedItem(item=sorting_accending_new_sheets, amount=count)
get_sheet_containing_view = Python(IN[0]=viewports_to_views)  # "Get Sheet containing view & Position of views inside"
# ---------- get_sheet_containing_view.python (72 lines) ----------
#import libraries and reference
import clr

clr.AddReference('ProtoGeometry')
from Autodesk.DesignScript.Geometry import *

clr.AddReference('RevitAPI')
from Autodesk.Revit.DB import *
from Autodesk.Revit.DB import ElementId
from Autodesk.Revit.DB import ViewSheet
from Autodesk.Revit.DB import Viewport

clr.AddReference('RevitAPIUI')
from Autodesk.Revit.UI import TaskDialog

clr.AddReference("RevitNodes")
import Revit
clr.ImportExtensions(Revit.Elements)


# Import geometry conversion extension methods
clr.ImportExtensions(Revit.GeometryConversion)


# Import DocumentManager and TransactionManager

clr.AddReference("RevitServices")
import RevitServices
from RevitServices.Persistence import DocumentManager
from RevitServices.Transactions import TransactionManager
from System.Collections.Generic import *


doc = DocumentManager.Instance.CurrentDBDocument
uiapp = DocumentManager.Instance.CurrentUIApplication
app = uiapp.Application

#The inputs to this node will be stored as a list in the IN variables.
dataEnteringNode = IN
views = UnwrapElement(IN[0])

# View Id
viewIds=[]
for a in range(0,len(views)):
	viewIds.append(views[a].Id)

# get all obljuect
sheets = FilteredElementCollector(doc).OfClass(ViewSheet) 

sheetResults = []

for sheet in sheets:
	placedViewIds = sheet.GetAllPlacedViews()	#Id cua view duoc place trong sheet
	for viewid in viewIds:
		for placedViewId in placedViewIds:
			if viewid == placedViewId:
				sheetResults.append(sheet)

positions=[]

viewportIds = sheetResults[0].GetAllViewports() # lấy tat ca viewport trong sheet ket qua dầu tiên [0]
for viewId in viewIds:
	for viewportId in viewportIds:
		viewport = doc.GetElement(viewportId)
		if viewId == viewport.ViewId:
			boundingbox = viewport.get_BoundingBox(sheetResults[0])
			positions.append((boundingbox.Max + boundingbox.Min)/2)	
		


OUT = positions
#sheetResult, viewId
# ----------------------------------------
count_2 = Count(list_getitematindex_phases_in)

# group: Duplicate View and set Parameter
code_block_4 = CodeBlock(sf=tiền_tố_view, mf=code_block_2.rank, pf=getParameterValueByName_2)
# ---------- code_block_4.designscript (2 lines) ----------
//sheet name;
sf+"_"+mf+"_"+pf;
# ----------------------------------------
duplicate_views_w_detailing = Python(IN[0]=viewports_to_views, IN[1]=list_getitematindex_phases_in, IN[2]=code_block_4)  # "Duplicate Views w Detailing follow phases"
# ---------- duplicate_views_w_detailing.python (66 lines) ----------
import clr
clr.AddReference('ProtoGeometry')
from Autodesk.DesignScript.Geometry import *
clr.AddReference('RevitAPI')
from Autodesk.Revit.DB import *
clr.AddReference('RevitAPIUI')
from Autodesk.Revit.UI import TaskDialog
clr.AddReference("RevitNodes")
import Revit
clr.ImportExtensions(Revit.Elements)
clr.AddReference("RevitServices")
import RevitServices
from RevitServices.Persistence import DocumentManager
from RevitServices.Transactions import TransactionManager
from System.Collections.Generic import *
#The inputs to this node will be stored as a list in the IN variables.
dataEnteringNode = IN

doc = DocumentManager.Instance.CurrentDBDocument
uiapp = DocumentManager.Instance.CurrentUIApplication
app = uiapp.Application

###################################################
views = UnwrapElement(IN[0])
phases = UnwrapElement(IN[1])
newViewNames = IN[2]
###################################################

newViews = []
newViewsChunks = []
newviewIds=[]
oldviewnames=[] #tên ban đầu của các view input
viewDupOption = ViewDuplicateOption.WithDetailing#Option để duplicate w detailing
countPhases = len(phases)#đếm số lượng phases

#******************************************************
def chunks(l, n):
    """Yield successive n-sized chunks from l."""
    for i in range(0, len(l), n):
        yield  l[i:i + n]
#******************************************************
#############################################################
# Start Transaction
TransactionManager.Instance.EnsureInTransaction(doc)

try:
	for view in views:
		oldviewnames.append(view.ViewName)# lấy tên ban đầu của các view input
		for count in range(countPhases):
			newviewIds.append(view.Duplicate(viewDupOption))
			
	for id in newviewIds:			
		newViews.append(view.Document.GetElement(id))
	
	newviews2 = chunks(newViews,countPhases)#split list Newview theo số lượng phase	


except:
	pass

# End Transaction
TransactionManager.Instance.TransactionTaskDone()
doc.Regenerate()
#############################################################
#Assign your output to the OUT variable.
OUT = newviews2,oldviewnames
# ----------------------------------------
code_block_5 = CodeBlock(output=duplicate_views_w_detailing) { output[0]; output[1]; }
flatten = Flatten(code_block_5.out0)
ofRepeatedItem_2 = List.OfRepeatedItem(item=code_block_5.out1, amount=count_2)
transpose = List.Transpose(ofRepeatedItem_2)
flatten_2 = Flatten(transpose)
ofRepeatedItem_3 = List.OfRepeatedItem(item=code_block_4, amount=count)
flatten_3 = Flatten(ofRepeatedItem_3)
code_block_6 = CodeBlock(ssf=flatten_2, name=flatten_3) { ssf+"_"+name; }
flatten_4 = Flatten(code_block_6)
ids_of_phases = Python(IN[0]=list_getitematindex_phases_in)
# ---------- ids_of_phases.python (34 lines) ----------
import clr
clr.AddReference('ProtoGeometry')
from Autodesk.DesignScript.Geometry import *
clr.AddReference('RevitAPI')
from Autodesk.Revit.DB import *
clr.AddReference('RevitAPIUI')
from Autodesk.Revit.UI import TaskDialog
clr.AddReference("RevitNodes")
import Revit
clr.ImportExtensions(Revit.Elements)
clr.AddReference("RevitServices")
import RevitServices
from RevitServices.Persistence import DocumentManager
from RevitServices.Transactions import TransactionManager
from System.Collections.Generic import *
#The inputs to this node will be stored as a list in the IN variables.
dataEnteringNode = IN

doc = DocumentManager.Instance.CurrentDBDocument
uiapp = DocumentManager.Instance.CurrentUIApplication
app = uiapp.Application

###################################################
phases = UnwrapElement(IN[0])

#############################################################
phaseIds=[]

for phase in phases:
	phaseIds.append(phase.Id)

#############################################################
#Assign your output to the OUT variable.
OUT = phaseIds
# ----------------------------------------
ofRepeatedItem_4 = List.OfRepeatedItem(item=ids_of_phases, amount=count)
flatten_5 = Flatten(ofRepeatedItem_4)
change_names_and_phases = Python(IN[0]=flatten, IN[1]=flatten_4, IN[2]=flatten_5, IN[3]=count_2)
# ---------- change_names_and_phases.python (58 lines) ----------
import clr
clr.AddReference('ProtoGeometry')
from Autodesk.DesignScript.Geometry import *
clr.AddReference('RevitAPI')
from Autodesk.Revit.DB import *
clr.AddReference('RevitAPIUI')
from Autodesk.Revit.UI import TaskDialog
clr.AddReference("RevitNodes")
import Revit
clr.ImportExtensions(Revit.Elements)
clr.AddReference("RevitServices")
import RevitServices
from RevitServices.Persistence import DocumentManager
from RevitServices.Transactions import TransactionManager
from System.Collections.Generic import *
#The inputs to this node will be stored as a list in the IN variables.
dataEnteringNode = IN

doc = DocumentManager.Instance.CurrentDBDocument
uiapp = DocumentManager.Instance.CurrentUIApplication
app = uiapp.Application

###################################################
views = UnwrapElement(IN[0])
names = UnwrapElement(IN[1])
phases = UnwrapElement(IN[2])#Id của phase
phasescount = UnwrapElement(IN[3])
#############################################################
viewphases=[]
newviews=[]
#############################################################
#************************************************************************
def chunks(l, n):
    """Yield successive n-sized chunks from l."""
    for i in range(0, len(l), n):
        yield  l[i:i + n]
#************************************************************************


# Start Transaction
TransactionManager.Instance.EnsureInTransaction(doc)
try:
	for i in range(len(views)):
		view = views[i]
		view.ViewName = names[i]
		viewphases.append(view.LookupParameter("Phase"))
	for j in range(len(viewphases)):
		viewphases[j].Set(phases[j])
		
	#newviews = chunks(views,phasescount)
except:
	pass
# End Transaction
TransactionManager.Instance.TransactionTaskDone()
doc.Regenerate()
#############################################################
#Assign your output to the OUT variable.
OUT = views
# ----------------------------------------

# group: Placing Views to Sheet
transpose_2 = List.Transpose(ofRepeatedItem)
flatten_6 = Flatten(transpose_2)
transpose_3 = List.Transpose(code_block_5.out0)
flatten_7 = Flatten(transpose_3)
ofRepeatedItem_5 = List.OfRepeatedItem(item=get_sheet_containing_view, amount=count_2)
flatten_8 = Flatten(ofRepeatedItem_5)
create = List.Create(flatten_6, flatten_7, flatten_8)
transpose_4 = List.Transpose(create)
place_viewports_to_sheet = Python(IN[0]=transpose_4)
# ---------- place_viewports_to_sheet.python (80 lines) ----------
#import libraries and reference
import clr

clr.AddReference('ProtoGeometry')
from Autodesk.DesignScript.Geometry import *

clr.AddReference('RevitAPI')
from Autodesk.Revit.DB import *
from Autodesk.Revit.DB import ElementId
from Autodesk.Revit.DB import ViewSheet

clr.AddReference('RevitAPIUI')
from Autodesk.Revit.UI import TaskDialog

clr.AddReference("RevitNodes")
import Revit
clr.ImportExtensions(Revit.Elements)


# Import geometry conversion extension methods
clr.ImportExtensions(Revit.GeometryConversion)


# Import DocumentManager and TransactionManager

clr.AddReference("RevitServices")
import RevitServices
from RevitServices.Persistence import DocumentManager
from RevitServices.Transactions import TransactionManager
from System.Collections.Generic import *


doc = DocumentManager.Instance.CurrentDBDocument
uiapp = DocumentManager.Instance.CurrentUIApplication
app = uiapp.Application
########################################################################################
#The inputs to this node will be stored as a list in the IN variables.
dataEnteringNode = IN
lists = UnwrapElement(IN[0])
#sheets = UnwrapElement(IN[0])
#views = UnwrapElement(IN[1])
#positions = UnwrapElement(IN[2])
########################################################################################
newViewports=[]
#sheetIds = []
#viewIds = []

#for sheet in sheets:
#	sheetIds.append(sheet.Id)
#for view in views:
#	viewIds.append(view.Id)
#n = len(sheets)

# Start Transaction
TransactionManager.Instance.EnsureInTransaction(doc)
try:
	# Xóa viewport trong sheet neu co
#	for vs in newSheets:
#		vps = vs.GetAllViewports()		
#		for vp in vps:
#			vpe = doc.GetElement(vp)
#			vs.DeleteViewport(vpe)		
	
#	for i in range(len(sheets)):
#		for j in range(len(views[i])):
#			viewport = Viewport.Create(doc,sheets[i].Id,views[i][j].Id,positions[i][j])
#			newViewports.append(vp)

	for list in lists:
		viewport = Viewport.Create(doc,list[0].Id,list[1].Id,list[2])
		newViewports.append(viewport)
except:
	pass

# End Transaction
TransactionManager.Instance.TransactionTaskDone()
doc.Regenerate()

#Assign your output to the OUT variable.
OUT = newViewports
# ----------------------------------------

# note: Tất cả các View phải cùng nằm trên 1 sheet
current = Document.Current()  # frozen
activeView = Document.ActiveView(current)
