# Dynamo graph EXPORT VIEW SCHEDULES 190320 OK.dyn (Dynamo 0.9.1.4062)

element_types = ElementTypes("ViewSchedule")
all_elements_of_type = ElementsOfType(element_types)
name = Element.Name(all_elements_of_type)
code_block = CodeBlock { "OF"; }
startsWith = String.StartsWith(str=name, searchFor=code_block)
filterByBoolMask = List.FilterByBoolMask(list=all_elements_of_type, mask=startsWith)
directory_path = Directory("C:\Users\pduy0\OneDrive\Desktop\EX SCHEDULE")
name_2 = Element.Name(filterByBoolMask.in)
EXT = StringInput(".txt")
file_path = CodeBlock(append=name_2, extension=EXT) { append + extension; }
python_script = Python(IN[0]=filterByBoolMask.in, IN[1]=directory_path, IN[2]=file_path)
# ---------- python_script.python (16 lines) ----------
import clr
clr.AddReference('ProtoGeometry')
from Autodesk.DesignScript.Geometry import *
clr.AddReference('RevitAPI')
from Autodesk.Revit.DB import *
#The inputs to this node will be stored as a list in the IN variables.
dataEnteringNode = IN
schedule = UnwrapElement(IN[0])
path = IN[1]
names = IN[2]
exp_opt = ViewScheduleExportOptions()
for i in range(len(schedule)):	
	schedule[i].Export(path, names[i], exp_opt)	

#Assign your output to the OUT variable.
OUT = "Nope"
# ----------------------------------------
code_block_2 = CodeBlock { "WH"; }
startsWith_2 = String.StartsWith(str=name, searchFor=code_block_2)
filterByBoolMask_2 = List.FilterByBoolMask(list=all_elements_of_type, mask=startsWith_2)
name_3 = Element.Name(filterByBoolMask_2.in)
file_path_2 = CodeBlock(append=name_3, extension=EXT) { append + extension; }
python_script_2 = Python(IN[0]=filterByBoolMask_2.in, IN[1]=directory_path, IN[2]=file_path_2)  # same code as python_script
