# Dynamo graph ExternalWork-FrameSystem-0901-180314-2.dyn (Dynamo 0.9.1.4062)

reverse_start_end = BoolSelector(true)
select_a_line = DSModelElementSelection()  # 1 picked in the model
code_block = CodeBlock(line=select_a_line) { line; }
geometry = Element.Geometry(code_block)
startPoint = Curve.StartPoint(geometry)
endPoint = Curve.EndPoint(geometry)
byTwoPoints = Vector.ByTwoPoints(start=startPoint, end=endPoint)
endspace_of_frame_sys = DoubleSlider(0, range=-3660..3660 step 1)
endSpace = CodeBlock(es=endspace_of_frame_sys) { es; }
translate = Geometry.Translate(geometry=startPoint, direction=byTwoPoints, distance=endSpace)
reverse = Vector.Reverse(byTwoPoints)
startspace_of_frame_sys = DoubleSlider(-1525, range=-3660..3660 step 1)
startSpace = CodeBlock(ss=startspace_of_frame_sys) { ss; }
translate_2 = Geometry.Translate(geometry=endPoint, direction=reverse, distance=startSpace)
code_block_2 = CodeBlock(startPoint=translate, endPoint=translate_2) { startPoint; endPoint; }
byStartPointEndPoint = Line.ByStartPointEndPoint(startPoint=code_block_2.startPoint, endPoint=code_block_2.endPoint)
byStartPointEndPoint_2 = Line.ByStartPointEndPoint(startPoint=code_block_2.endPoint, endPoint=code_block_2.startPoint)

# group: origin curve
if_ = If(test=reverse_start_end, true=byStartPointEndPoint, false=byStartPointEndPoint_2)

flip = BoolSelector(true)
offset_from_boundary = CodeBlock { 300; }
spanLengthSpecial = CodeBlock { 1225; }
bracketDepth = CodeBlock()
# ---------- bracketDepth.designscript (2 lines) ----------
2000;
 //fixed
# ----------------------------------------
code_block_3 = CodeBlock(offset=offset_from_boundary, frameWidth=spanLengthSpecial, bracketDepth=bracketDepth) { offset; -offset; frameWidth; -frameWidth; bracketDepth; -bracketDepth; }
if_2 = If(test=flip, true=code_block_3.out1, false=code_block_3.offset)

# group: 1st offset curve = Inside Frame Leg Line
offset = Curve.Offset(curve=if_, distance=if_2)

spanLengthCommon = CodeBlock { 1830; }
decrease_module_1830 = IntegerSlider(0, range=0..5 step 1)
decreasing_module = CodeBlock(dm=decrease_module_1830) { dm; }

# group: Analyse LENGTH
length = Curve.Length(offset)
code_block_4 = CodeBlock(length=length, d=decreasing_module, spanLength=spanLengthCommon)
# ---------- code_block_4.designscript (2 lines) ----------
trueLength = length -
Math.Abs(d)*spanLength;
# ----------------------------------------
mod = code_block_4 % spanLengthCommon
sub = code_block_4 - mod
div = sub / spanLengthCommon
ofRepeatedItem = List.OfRepeatedItem(item=spanLengthCommon, amount=div)
flatten = Flatten(ofRepeatedItem)

# note: Point from 1st offset Curve
point_by_divided_distance = Python(IN[0]=offset, IN[1]=flatten)
# ---------- point_by_divided_distance.python (16 lines) ----------
import clr
clr.AddReference('ProtoGeometry')
from Autodesk.DesignScript.Geometry import *
#The inputs to this node will be stored as a list in the IN variables.
dataEnteringNode = IN
curve = IN[0]
listDist = IN[1]

pointsAtDistance = []

for c in curve:
	for i in range(len(listDist)+1):
		point = c.PointAtDistance(i*listDist[0])
		pointsAtDistance.append(point)
#Assign your output to the OUT variable.
OUT = pointsAtDistance
# ----------------------------------------
line_categories = CodeBlock()
# ---------- line_categories.designscript (12 lines) ----------
"Line_ES_Cross Brace_1225";
"Line_ES_Cross Brace_1830";
"Line_ES_Frame_1225";
"Line_ES_Bracket I_2000";
"Line_ES_Z Beam 1830";
"Line_ES_Z Beam 2440";
"Line_ES_Z Beam 3050";
"Line_ES_Z Beam 3660";
"Line_ES_Z Beam 4270";
"Line_ES_Riser Catching Net";
"Line_ES_Plank 3000";
"Line_ES_Plank 4000";
# ----------------------------------------
get_line_category_by_id = Python(IN[0]=line_categories.out1)
# ---------- get_line_category_by_id.python (36 lines) ----------
import clr
clr.AddReference('ProtoGeometry')
from Autodesk.DesignScript.Geometry import *
clr.AddReference('RevitAPI')
from Autodesk.Revit.DB import *
from Autodesk.Revit.DB import ElementId
clr.AddReference('RevitAPIUI')
from Autodesk.Revit.UI import TaskDialog
clr.AddReference("RevitNodes")
import Revit
clr.ImportExtensions(Revit.Elements)
clr.ImportExtensions(Revit.GeometryConversion)
clr.AddReference("RevitServices")
import RevitServices
from RevitServices.Persistence import DocumentManager
from RevitServices.Transactions import TransactionManager
from System.Collections.Generic import *

doc = DocumentManager.Instance.CurrentDBDocument
uiapp = DocumentManager.Instance.CurrentUIApplication
app = uiapp.Application

dataEnteringNode = IN
catName = IN[0]

graphStyles = FilteredElementCollector(doc).OfClass(GraphicsStyle)
graphId = []

for style in graphStyles:
	name = style.Name
	if name == catName:
		graphId.append(style.Id)
id = graphId[0]

#Assign your output to the OUT variable.
OUT = doc.GetElement(id)
# ----------------------------------------
code_block_5 = CodeBlock(value=get_line_category_by_id) { "Line Style"; value; }
if_3 = If(test=flip, true=code_block_3.out3, false=code_block_3.frameWidth)

# group: 2nd offset curve =1st offset curve = Outside Frame Leg Line
offset_2 = Curve.Offset(curve=offset, distance=if_3)

point_by_divided_distance_2 = Python(IN[0]=offset_2, IN[1]=flatten)  # same code as point_by_divided_distance

# group: Create lines
firstItem = List.FirstItem(point_by_divided_distance)
lastItem = List.LastItem(point_by_divided_distance)
byStartPointEndPoint_3 = Line.ByStartPointEndPoint(startPoint=firstItem, endPoint=lastItem)
byCurve = ModelCurve.ByCurve(byStartPointEndPoint_3)  # frozen
setParameterByName = Element.SetParameterByName(element=byCurve, parameterName=code_block_5.out0, value=code_block_5.value)
firstItem_2 = List.FirstItem(point_by_divided_distance_2)
lastItem_2 = List.LastItem(point_by_divided_distance_2)
byStartPointEndPoint_4 = Line.ByStartPointEndPoint(startPoint=firstItem_2, endPoint=lastItem_2)
byCurve_2 = ModelCurve.ByCurve(byStartPointEndPoint_4)  # frozen
setParameterByName_2 = Element.SetParameterByName(element=byCurve_2, parameterName=code_block_5.out0, value=code_block_5.value)

lastItem_3 = List.LastItem(point_by_divided_distance)
endPoint_2 = Curve.EndPoint(offset)
byStartPointEndPoint_5 = Line.ByStartPointEndPoint(startPoint=lastItem_3, endPoint=endPoint_2)
the_rest_length_of_curve = CodeBlock(spanLength1=spanLengthCommon, spanLength2=spanLengthSpecial, length=length, n=div)
# ---------- the_rest_length_of_curve.designscript (6 lines) ----------
spanLength1;
spanLength2;
restLength = Math.Round(length -
n*spanLength1);
modulo = restLength % spanLength2;
divNumber = Math.Round((restLength-modulo)/spanLength2);
# ----------------------------------------
ofRepeatedItem_2 = List.OfRepeatedItem(item=the_rest_length_of_curve.spanLength2, amount=the_rest_length_of_curve.divNumber)
flatten_2 = Flatten(ofRepeatedItem_2)
point_by_divided_distance_3 = Python(IN[0]=byStartPointEndPoint_5, IN[1]=flatten_2)  # same code as point_by_divided_distance
get_line_category_by_id_2 = Python(IN[0]=line_categories.out0)  # same code as get_line_category_by_id
code_block_6 = CodeBlock(value=get_line_category_by_id_2) { "Line Style"; value; }
lastItem_4 = List.LastItem(point_by_divided_distance_2)
endPoint_3 = Curve.EndPoint(offset_2)
byStartPointEndPoint_6 = Line.ByStartPointEndPoint(startPoint=lastItem_4, endPoint=endPoint_3)
point_by_divided_distance_4 = Python(IN[0]=byStartPointEndPoint_6, IN[1]=flatten_2)  # same code as point_by_divided_distance

# group: Create Line
firstItem_3 = List.FirstItem(point_by_divided_distance_3)
lastItem_5 = List.LastItem(point_by_divided_distance_3)
byStartPointEndPoint_7 = Line.ByStartPointEndPoint(startPoint=firstItem_3, endPoint=lastItem_5)
byCurve_3 = ModelCurve.ByCurve(byStartPointEndPoint_7)  # frozen
setParameterByName_3 = Element.SetParameterByName(element=byCurve_3, parameterName=code_block_6.out0, value=code_block_6.value)
firstItem_4 = List.FirstItem(point_by_divided_distance_4)
lastItem_6 = List.LastItem(point_by_divided_distance_4)
byStartPointEndPoint_8 = Line.ByStartPointEndPoint(startPoint=firstItem_4, endPoint=lastItem_6)
byCurve_4 = ModelCurve.ByCurve(byStartPointEndPoint_8)  # frozen
setParameterByName_4 = Element.SetParameterByName(element=byCurve_4, parameterName=code_block_6.out0, value=code_block_6.value)

# note: Point from Origin Curve
# = bracket boundary points
point_by_divided_distance_5 = Python(IN[0]=if_, IN[1]=flatten)  # same code as point_by_divided_distance
if_4 = If(test=flip, true=code_block_3.out5, false=code_block_3.bracketDepth)

# group: 3rd offset curve = End of Bracket 2000
offset_3 = Curve.Offset(curve=if_, distance=if_4)

# note: Point from 2nd offset Curve
# note: Point from 3rd offset Curve
# = bracket boundary points
point_by_divided_distance_6 = Python(IN[0]=offset_3, IN[1]=flatten)  # same code as point_by_divided_distance

# group: List of Points of Bracket
create = List.Create(point_by_divided_distance_5, point_by_divided_distance_6)
list_transpose_list_of_bracket = List.Transpose(create)  # "List.Transpose.List of Bracket Points"

create_line_by_startendpoint = Python(IN[0]=list_transpose_list_of_bracket)
# ---------- create_line_by_startendpoint.python (15 lines) ----------
import clr
clr.AddReference('ProtoGeometry')
from Autodesk.DesignScript.Geometry import *
#The inputs to this node will be stored as a list in the IN variables.
dataEnteringNode = IN
points = IN[0]

lines = []

for p in points:
	line = Line.ByStartPointEndPoint(p[0],p[1])
	lines.append(line)

#Assign your output to the OUT variable.
OUT = lines
# ----------------------------------------
byCurve_5 = ModelCurve.ByCurve(create_line_by_startendpoint)
get_line_category_by_id_3 = Python(IN[0]=line_categories.out3)  # same code as get_line_category_by_id
code_block_7 = CodeBlock(value=get_line_category_by_id_3) { "Line Style"; value; }
setParameterByName_5 = Element.SetParameterByName(element=byCurve_5, parameterName=code_block_7.out0, value=code_block_7.value)

# group: List of Points of Moduled 1830
create_2 = List.Create(point_by_divided_distance, point_by_divided_distance_2)
list_transpose_list_of_frame = List.Transpose(create_2)  # "List.Transpose.List of Frame Points"
list_of_brace_points = Python(IN[0]=point_by_divided_distance)
# ---------- list_of_brace_points.python (21 lines) ----------
import clr
clr.AddReference('ProtoGeometry')
from Autodesk.DesignScript.Geometry import *
#The inputs to this node will be stored as a list in the IN variables.
dataEnteringNode = IN
points = IN[0]


bracePoints = []

for i in range(len(points)-1):
	newpoint1 = points[i]
	newpoint2 = points[i+1]
	newPointCouple = []
	newPointCouple.append(newpoint1)
	newPointCouple.append(newpoint2)
	
	bracePoints.append(newPointCouple)
	
#Assign your output to the OUT variable.
OUT = bracePoints
# ----------------------------------------
list_of_brace_points_2 = Python(IN[0]=point_by_divided_distance_2)  # same code as list_of_brace_points

create_line_by_startendpoint_2 = Python(IN[0]=list_transpose_list_of_frame)  # same code as create_line_by_startendpoint
byCurve_6 = ModelCurve.ByCurve(create_line_by_startendpoint_2)
get_line_category_by_id_4 = Python(IN[0]=line_categories.out2)  # same code as get_line_category_by_id
code_block_8 = CodeBlock(value=get_line_category_by_id_4) { "Line Style"; value; }
setParameterByName_6 = Element.SetParameterByName(element=byCurve_6, parameterName=code_block_8.out0, value=code_block_8.value)
create_line_by_startendpoint_3 = Python(IN[0]=list_of_brace_points)  # same code as create_line_by_startendpoint
byCurve_7 = ModelCurve.ByCurve(create_line_by_startendpoint_3)
setParameterByName_7 = Element.SetParameterByName(element=byCurve_7, parameterName=code_block_5.out0, value=code_block_5.value)
create_line_by_startendpoint_4 = Python(IN[0]=list_of_brace_points_2)  # same code as create_line_by_startendpoint
byCurve_8 = ModelCurve.ByCurve(create_line_by_startendpoint_4)
setParameterByName_8 = Element.SetParameterByName(element=byCurve_8, parameterName=code_block_5.out0, value=code_block_5.value)

# group: List of Points of Moduled 1225
create_3 = List.Create(point_by_divided_distance_3, point_by_divided_distance_4)
transpose = List.Transpose(create_3)
list_deconstruct_list_of_frame = List.Deconstruct(list=transpose)  # "List.Deconstruct-List of Frame Points"
list_of_brace_points_3 = Python(IN[0]=point_by_divided_distance_3)  # same code as list_of_brace_points
list_of_brace_points_4 = Python(IN[0]=point_by_divided_distance_4)  # same code as list_of_brace_points

create_line_by_startendpoint_5 = Python(IN[0]=list_deconstruct_list_of_frame.rest)  # same code as create_line_by_startendpoint
byCurve_9 = ModelCurve.ByCurve(create_line_by_startendpoint_5)
setParameterByName_9 = Element.SetParameterByName(element=byCurve_9, parameterName=code_block_6.out0, value=code_block_8.value)
create_line_by_startendpoint_6 = Python(IN[0]=list_of_brace_points_3)  # same code as create_line_by_startendpoint
byCurve_10 = ModelCurve.ByCurve(create_line_by_startendpoint_6)
setParameterByName_10 = Element.SetParameterByName(element=byCurve_10, parameterName=code_block_6.out0, value=code_block_6.value)
create_line_by_startendpoint_7 = Python(IN[0]=list_of_brace_points_4)  # same code as create_line_by_startendpoint
byCurve_11 = ModelCurve.ByCurve(create_line_by_startendpoint_7)
setParameterByName_11 = Element.SetParameterByName(element=byCurve_11, parameterName=code_block_6.out0, value=code_block_6.value)
create_4 = List.Create(setParameterByName_5, setParameterByName_6, setParameterByName_7, setParameterByName_8, setParameterByName_9, setParameterByName_10, setParameterByName_11)
flatten_3 = Flatten(create_4)
python_script = Python(IN[0]=flatten_3)
# ---------- python_script.python (15 lines) ----------
import clr
clr.AddReference('ProtoGeometry')
from Autodesk.DesignScript.Geometry import *
#The inputs to this node will be stored as a list in the IN variables.
dataEnteringNode = IN

curves = IN[0]

curveLineStyles = []
for c in curves:
	curveLineStyles.append(c.GetParameterValueByName("Line Style"))
	

#Assign your output to the OUT variable.
OUT = curveLineStyles
# ----------------------------------------
get_line_category_by_id_5 = Python(IN[0]=line_categories.out4)  # same code as get_line_category_by_id
code_block_9 = CodeBlock(value=get_line_category_by_id_5) { "Line Style"; value; }
get_line_category_by_id_6 = Python(IN[0]=line_categories.out5)  # same code as get_line_category_by_id
code_block_10 = CodeBlock(value=get_line_category_by_id_6) { "Line Style"; value; }
get_line_category_by_id_7 = Python(IN[0]=line_categories.out6)  # same code as get_line_category_by_id
code_block_11 = CodeBlock(value=get_line_category_by_id_7) { "Line Style"; value; }
get_line_category_by_id_8 = Python(IN[0]=line_categories.out7)  # same code as get_line_category_by_id
code_block_12 = CodeBlock(value=get_line_category_by_id_8) { "Line Style"; value; }
get_line_category_by_id_9 = Python(IN[0]=line_categories.out8)  # same code as get_line_category_by_id
code_block_13 = CodeBlock(value=get_line_category_by_id_9) { "Line Style"; value; }
firstItem_5 = List.FirstItem(point_by_divided_distance_2)
isEmpty = List.IsEmpty(point_by_divided_distance_4)
if_5 = If(test=isEmpty, true=point_by_divided_distance_2, false=point_by_divided_distance_4)
lastItem_7 = List.LastItem(if_5)
byStartPointEndPoint_9 = Line.ByStartPointEndPoint(startPoint=firstItem_5, endPoint=lastItem_7)
startPoint_2 = Curve.StartPoint(byStartPointEndPoint_9)
endPoint_4 = Curve.EndPoint(byStartPointEndPoint_9)
byTwoPoints_2 = Vector.ByTwoPoints(start=startPoint_2, end=endPoint_4)
catching_riser_length = DoubleSlider(6000, range=-6000..6000 step 1)
start_offset_catching_riser = DoubleSlider(250, range=-1830..1830 step 1)
end_offset_catching_riser = DoubleSlider(250, range=-1830..1830 step 1)
max_span_of_catching_riser = CodeBlock { 6000; }
code_block_14 = CodeBlock(crLength=catching_riser_length, startOffset=start_offset_catching_riser, endOffset=end_offset_catching_riser, maxSpan=max_span_of_catching_riser) { crLength; -crLength; startOffset; endOffset; maxSpan; }
translate_3 = Geometry.Translate(geometry=startPoint_2, direction=byTwoPoints_2, distance=code_block_14.startOffset)
reverse_2 = Vector.Reverse(byTwoPoints_2)
translate_4 = Geometry.Translate(geometry=lastItem_7, direction=reverse_2, distance=code_block_14.endOffset)

# group: 4th offset curve = Start of Catching Riser
byStartPointEndPoint_10 = Line.ByStartPointEndPoint(startPoint=translate_3, endPoint=translate_4)

create_5 = List.Create(byStartPointEndPoint_10)
if_6 = If(test=flip, true=code_block_14.out1, false=code_block_14.crLength)

# group: 5th offset curve = End of Catching Riser
offset_4 = Curve.Offset(curve=byStartPointEndPoint_10, distance=if_6)

length_2 = Curve.Length(offset_4)
div_2 = length_2 / code_block_14.maxSpan
round = Math.Round(div_2)
div_3 = length_2 / round
ofRepeatedItem_3 = List.OfRepeatedItem(item=div_3, amount=round)
point_by_divided_distance_7 = Python(IN[0]=create_5, IN[1]=ofRepeatedItem_3)  # same code as point_by_divided_distance
create_6 = List.Create(offset_4)
point_by_divided_distance_8 = Python(IN[0]=create_6, IN[1]=ofRepeatedItem_3)  # same code as point_by_divided_distance

# group: List of Points of Catching Riser
create_7 = List.Create(point_by_divided_distance_7, point_by_divided_distance_8)
transpose_2 = List.Transpose(create_7)

create_line_by_startendpoint_8 = Python(IN[0]=transpose_2)  # same code as create_line_by_startendpoint
byCurve_12 = ModelCurve.ByCurve(create_line_by_startendpoint_8)
get_line_category_by_id_10 = Python(IN[0]=line_categories.out9)  # same code as get_line_category_by_id
code_block_15 = CodeBlock(value=get_line_category_by_id_10) { "Line Style"; value; }
setParameterByName_12 = Element.SetParameterByName(element=byCurve_12, parameterName=code_block_5.out0, value=code_block_15.value)
get_line_category_by_id_11 = Python(IN[0]=line_categories.out10)  # same code as get_line_category_by_id
code_block_16 = CodeBlock(value=get_line_category_by_id_11) { "Line Style"; value; }

# group: List of Points of Catching Riser
create_8 = List.Create()
transpose_3 = List.Transpose(create_8)

create_line_by_startendpoint_9 = Python(IN[0]=transpose_3)  # same code as create_line_by_startendpoint
byCurve_13 = ModelCurve.ByCurve(create_line_by_startendpoint_9)
get_line_category_by_id_12 = Python(IN[0]=line_categories.out11)  # same code as get_line_category_by_id
code_block_17 = CodeBlock(value=get_line_category_by_id_12) { "Line Style"; value; }
setParameterByName_13 = Element.SetParameterByName(element=byCurve_13, parameterName=code_block_5.out0, value=code_block_17.value)
code_block_18 = CodeBlock { a; b; }
outa_module_true_plank_3000 = BoolSelector(false)  # "Outa module: True = Plank 3000 / False = Plank 2000"
firstItem_6 = List.FirstItem(point_by_divided_distance_2)
isEmpty_2 = List.IsEmpty(point_by_divided_distance_4)
if_7 = If(test=isEmpty_2, true=point_by_divided_distance_6, false=point_by_divided_distance_4)
lastItem_8 = List.LastItem(if_7)
byStartPointEndPoint_11 = Line.ByStartPointEndPoint(startPoint=firstItem_6, endPoint=lastItem_8)
firstItem_7 = List.FirstItem(point_by_divided_distance)
isEmpty_3 = List.IsEmpty(point_by_divided_distance_3)
if_8 = If(test=isEmpty_3, true=point_by_divided_distance, false=point_by_divided_distance_3)
lastItem_9 = List.LastItem(if_8)
byStartPointEndPoint_12 = Line.ByStartPointEndPoint(startPoint=firstItem_7, endPoint=lastItem_9)
length_3 = Curve.Length(byStartPointEndPoint_12)
plank_module_length = CodeBlock { 4000; 3000; 2000; }
decrease_module_plank_4000 = IntegerSlider(0, range=0..5 step 1)
true_length = CodeBlock(length=length_3, pLLength=plank_module_length.out0, n=decrease_module_plank_4000) { length; pLLength; truelength=length-n*pLLength; }
mod_2 = true_length.truelength % true_length.pLLength
sub_2 = true_length.truelength - mod_2
# note: Number of Plank 4000
div_4 = sub_2 / true_length.pLLength
rest_length = CodeBlock(length=true_length.length, n=div_4, plLength=true_length.pLLength)
# ---------- rest_length.designscript (6 lines) ----------
length;
resultlength =
n * plLength;
restlength=
length-
resultlength;
# ----------------------------------------
mod_3 = rest_length.restlength % plank_module_length.out1
sub_3 = rest_length.restlength - mod_3
# note: Number of Plank 3000
div_5 = sub_3 / plank_module_length.out1
byStartPointEndPoint_13 = Line.ByStartPointEndPoint(startPoint=firstItem_7, endPoint=firstItem_6)
create_9 = List.Create(byStartPointEndPoint_13)
point_by_divided_distance_w = Python(IN[0]=create_9)  # "Point by divided distance w startspace"
# ---------- point_by_divided_distance_w.python (19 lines) ----------
import clr
clr.AddReference('ProtoGeometry')
from Autodesk.DesignScript.Geometry import *
#The inputs to this node will be stored as a list in the IN variables.
dataEnteringNode = IN
curve = IN[0]

listDist = int(4)

startSpace = (1225-4*275)/2 +275/2 # plank depth = 275

pointsAtDistance = []

for c in curve:
	for i in range(0,listDist):
		point = c.PointAtDistance(startSpace + i*275)
		pointsAtDistance.append(point)
#Assign your output to the OUT variable.
OUT = pointsAtDistance
# ----------------------------------------
byStartPointEndPoint_14 = Line.ByStartPointEndPoint(startPoint=lastItem_9, endPoint=lastItem_8)
create_10 = List.Create(byStartPointEndPoint_14)
point_by_divided_distance_w_2 = Python(IN[0]=create_10)  # "Point by divided distance w startspace"; same code as point_by_divided_distance_w
create_11 = List.Create(point_by_divided_distance_w, point_by_divided_distance_w_2)
transpose_4 = List.Transpose(create_11)
# note: Full curve for Plank
create_line_by_startendpoint_10 = Python(IN[0]=transpose_4)  # same code as create_line_by_startendpoint
