# Dynamo graph PlaceScaffoldFrameSystem.dyn (Dynamo 0.9.1.4062)

line = CodeBlock()
# ---------- line.designscript (12 lines) ----------
"Line_ES_Cross Brace_1225";
"Line_ES_Cross Brace_1830";
"Line_ES_Frame_1225";
"Line_ES_Bracket I_2000";
"Line_ES_Z Beam 1830";
"Line_ES_Z Beam 2440";
"Line_ES_Z Beam 3050";
"Line_ES_Z Beam 3660";
"Line_ES_Z Beam 4270";
"Line_ES_Riser Catching Net";
"Line_ES_Plank 3000";
"Line_ES_Plank 4000";
# ----------------------------------------
select_all_lines = DSModelElementsSelection()  # 87 picked in the model
python_script = Python(IN[0]=line.out2, IN[1]=select_all_lines)
# ---------- python_script.python (46 lines) ----------
import clr
clr.AddReference('ProtoGeometry')
from Autodesk.DesignScript.Geometry import *
clr.AddReference('RevitAPI')
from Autodesk.Revit.DB import *
from Autodesk.Revit.DB import ElementId
clr.AddReference('RevitAPIUI')
from Autodesk.Revit.UI import TaskDialog
clr.AddReference("RevitNodes")
import Revit
clr.ImportExtensions(Revit.Elements)
clr.ImportExtensions(Revit.GeometryConversion)
clr.AddReference("RevitServices")
import RevitServices
from RevitServices.Persistence import DocumentManager
from RevitServices.Transactions import TransactionManager
from System.Collections.Generic import *

doc = DocumentManager.Instance.CurrentDBDocument
uiapp = DocumentManager.Instance.CurrentUIApplication
app = uiapp.Application

dataEnteringNode = IN
catName = IN[0]
#selectElems = IN[1]
selectElems = UnwrapElement(IN[1])

graphStyles = FilteredElementCollector(doc).OfClass(GraphicsStyle)
graphId = []
result = []

for style in graphStyles:
	name = style.Name
	if name == catName:
		graphId.append(style.Id)
id = graphId[0]

elemID = doc.GetElement(id)

for elem in selectElems:	 
	if elem.LineStyle.Id == elemID.Id:
	#if elem.GetParameterValueByName("Line Style").Id == elemID:
		result.append(elem)

#Assign your output to the OUT variable.
OUT = result
# ----------------------------------------
geometry = Element.Geometry(python_script)
flatten = Flatten(geometry)
startPoint = Curve.StartPoint(flatten)
endPoint = Curve.EndPoint(flatten)
create = List.Create(startPoint, endPoint)
transpose = List.Transpose(create)
family = CodeBlock()
# ---------- family.designscript (12 lines) ----------
"Adap_2P_Tấm Giằng Chéo 1700";
"Adap_2P_Tấm Giằng Chéo 2200";
"Adap_2P_Tấm Ngang 1700";
"Adap_2P_Bracket I";
"Line_ES_Z Beam 1830";
"Line_ES_Z Beam 2440";
"Line_ES_Z Beam 3050";
"Line_ES_Z Beam 3660";
"Line_ES_Z Beam 4270";
"Adap_2P_Catching Riser";
"Plank 3000";
"Plank 4000";
# ----------------------------------------
byName = FamilyType.ByName(family.out2)
byPoints = AdaptiveComponent.ByPoints(points=transpose, familyType=byName)
chiều_cao_tổng = CodeBlock { 10000; }
chiều_cao_chân = CodeBlock { 300; }
code_block = CodeBlock(adaptivecomponent1=byPoints, num2=chiều_cao_tổng, num1=chiều_cao_chân)
# ---------- code_block.designscript (4 lines) ----------
str1 = "Chieu_Cao_Chan";
str2 = "Chieu_Cao_Tong";
element2 = adaptivecomponent1.SetParameterByName(str2, num2);
element1 = adaptivecomponent1.SetParameterByName(str1, num1);
# ----------------------------------------
python_script_2 = Python(IN[0]=line.out1, IN[1]=select_all_lines)  # same code as python_script
geometry_2 = Element.Geometry(python_script_2)
flatten_2 = Flatten(geometry_2)
startPoint_2 = Curve.StartPoint(flatten_2)
endPoint_2 = Curve.EndPoint(flatten_2)
create_2 = List.Create(startPoint_2, endPoint_2)
transpose_2 = List.Transpose(create_2)
byName_2 = FamilyType.ByName(family.out1)
byPoints_2 = AdaptiveComponent.ByPoints(points=transpose_2, familyType=byName_2)
code_block_2 = CodeBlock(adaptivecomponent1=byPoints_2, num2=chiều_cao_tổng, num1=chiều_cao_chân)  # same code as code_block
python_script_3 = Python(IN[0]=line.out0, IN[1]=select_all_lines)  # same code as python_script
geometry_3 = Element.Geometry(python_script_3)
flatten_3 = Flatten(geometry_3)
startPoint_3 = Curve.StartPoint(flatten_3)
endPoint_3 = Curve.EndPoint(flatten_3)
create_3 = List.Create(startPoint_3, endPoint_3)
transpose_3 = List.Transpose(create_3)
byName_3 = FamilyType.ByName(family.out0)
byPoints_3 = AdaptiveComponent.ByPoints(points=transpose_3, familyType=byName_3)
code_block_3 = CodeBlock(adaptivecomponent1=byPoints_3, num2=chiều_cao_tổng, num1=chiều_cao_chân)  # same code as code_block
python_script_4 = Python(IN[0]=line.out3, IN[1]=select_all_lines)  # same code as python_script
geometry_4 = Element.Geometry(python_script_4)
flatten_4 = Flatten(geometry_4)
startPoint_4 = Curve.StartPoint(flatten_4)
endPoint_4 = Curve.EndPoint(flatten_4)
create_4 = List.Create(startPoint_4, endPoint_4)
transpose_4 = List.Transpose(create_4)
byName_4 = FamilyType.ByName(family.out3)
byPoints_4 = AdaptiveComponent.ByPoints(points=transpose_4, familyType=byName_4)
code_block_4 = CodeBlock(adaptivecomponent1=byPoints_4, num2=chiều_cao_tổng, num1=chiều_cao_chân)  # frozen; same code as code_block
python_script_5 = Python(IN[0]=line.out11, IN[1]=select_all_lines)  # same code as python_script
geometry_5 = Element.Geometry(python_script_5)
flatten_5 = Flatten(geometry_5)
startPoint_5 = Curve.StartPoint(flatten_5)
endPoint_5 = Curve.EndPoint(flatten_5)
create_5 = List.Create(startPoint_5, endPoint_5)
transpose_5 = List.Transpose(create_5)
byName_5 = FamilyType.ByName(family.out11)
byPoints_5 = AdaptiveComponent.ByPoints(points=transpose_5, familyType=byName_5)
code_block_5 = CodeBlock(adaptivecomponent1=byPoints_5, num2=chiều_cao_tổng, num1=chiều_cao_chân)  # same code as code_block
python_script_6 = Python(IN[0]=line.out9, IN[1]=select_all_lines)  # same code as python_script
geometry_6 = Element.Geometry(python_script_6)
flatten_6 = Flatten(geometry_6)
startPoint_6 = Curve.StartPoint(flatten_6)
endPoint_6 = Curve.EndPoint(flatten_6)
create_6 = List.Create(startPoint_6, endPoint_6)
transpose_6 = List.Transpose(create_6)
byName_6 = FamilyType.ByName(family.out9)
byPoints_6 = AdaptiveComponent.ByPoints(points=transpose_6, familyType=byName_6)
code_block_6 = CodeBlock(adaptivecomponent1=byPoints_6, num2=chiều_cao_tổng, num1=chiều_cao_chân)  # same code as code_block
