# Dynamo graph Formwork by Faces 0901 180412-OK.dyn (Dynamo 0.9.1.4062)

select_faces = SelectFaces()  # 14 picked in the model
flatten = Flatten(select_faces)
isNull = Object.IsNull(flatten)
boolean = BoolSelector(false)
allIndicesOf = List.AllIndicesOf(list=isNull, item=boolean)
getItemAtIndex = List.GetItemAtIndex(list=flatten, index=allIndicesOf)
code_block = CodeBlock { 0; }
normalAtParameter = Surface.NormalAtParameter(surface=getItemAtIndex, u=code_block, v=code_block)
Z = Vector.Z(normalAtParameter)
code_block_2 = CodeBlock { 1; true; }
ne = Z != code_block_2.out0
allIndicesOf_2 = List.AllIndicesOf(list=ne, item=code_block_2.out1)
getItemAtIndex_2 = List.GetItemAtIndex(list=getItemAtIndex, index=allIndicesOf_2)
perimeterCurves = Surface.PerimeterCurves(getItemAtIndex_2)
startPoint = Curve.StartPoint(perimeterCurves)
python_script = Python(IN[0]=startPoint)
# ---------- python_script.python (35 lines) ----------
import clr
clr.AddReference('ProtoGeometry')
from Autodesk.DesignScript.Geometry import *
clr.AddReference('RevitAPI')
from Autodesk.Revit.DB import *
clr.AddReference('RevitAPIUI')
from Autodesk.Revit.UI import TaskDialog
clr.AddReference("RevitNodes")
import Revit
clr.ImportExtensions(Revit.Elements)
clr.AddReference("RevitServices")
import RevitServices
from RevitServices.Persistence import DocumentManager
from RevitServices.Transactions import TransactionManager
from System.Collections.Generic import *
clr.ImportExtensions(Revit.GeometryConversion)

doc = DocumentManager.Instance.CurrentDBDocument
uiapp = DocumentManager.Instance.CurrentUIApplication
app = uiapp.Application

import sys
import System
#The inputs to this node will be stored as a list in the IN variables.
dataEnteringNode = IN
listPoints = IN[0]

result = []

for list in listPoints:
	pCount = len(list)
	result.append(pCount)

#Assign your output to the OUT variable.
OUT = result
# ----------------------------------------
code_block_3 = CodeBlock { 19; }
gt = python_script > code_block_3
boolean_2 = BoolSelector(false)
allIndicesOf_3 = List.AllIndicesOf(list=gt, item=boolean_2)
getItemAtIndex_3 = List.GetItemAtIndex(list=getItemAtIndex_2, index=allIndicesOf_3)
area = Surface.Area(getItemAtIndex_3)
boolean_3 = BoolSelector(true)
allIndicesOf_4 = List.AllIndicesOf(list=gt, item=boolean_3)
getItemAtIndex_4 = List.GetItemAtIndex(list=getItemAtIndex_2, index=allIndicesOf_4)
getItemAtIndex_5 = List.GetItemAtIndex(list=startPoint, index=allIndicesOf_4)
getItemAtIndex_6 = List.GetItemAtIndex(list=select_faces, index=allIndicesOf)
perimeterCurves_2 = Surface.PerimeterCurves(getItemAtIndex_6)
startPoint_2 = Curve.StartPoint(perimeterCurves_2)
getItemAtIndex_7 = List.GetItemAtIndex(list=startPoint_2, index=allIndicesOf_3)
code_block_4 = CodeBlock(lists=getItemAtIndex_7) { lists; }
getItemAtIndex_8 = List.GetItemAtIndex(list=startPoint, index=allIndicesOf_3)
count = Count(getItemAtIndex_8, lacing=Longest)
code_block_5 = CodeBlock(n=count) { n; a="ADT-FW "; b=" points"; c=a+n+b; }
byName = FamilyType.ByName(code_block_5.c)
byPoints = AdaptiveComponent.ByPoints(points=code_block_4, familyType=byName)
