# Dynamo graph Formwork-Wedgelock-180421.dyn (Dynamo 0.9.1.4062)

giằng_ngang_1200 = CodeBlock { "Line_WedgeLock_Brace_1200"; "Adt-Wedgelock-Sys of Hoz Brace 1200-2 points"; }
select_all_lines = DSModelElementsSelection()  # 13 picked in the model
select_single_face = DSFaceSelection()  # 1 picked in the model
perimeterCurves = Surface.PerimeterCurves(select_single_face)
startPoint = Curve.StartPoint(perimeterCurves)
byBestFitThroughPoints = Plane.ByBestFitThroughPoints(startPoint)
code_block = CodeBlock(geo=byBestFitThroughPoints) { geo; }
ZAxis = Vector.ZAxis()
ZAxis_2 = Vector.ZAxis()
chiều_cao_chân = CodeBlock { 300; }

# group: GIẰNG NGANG 1200
python_script = Python(IN[0]=giằng_ngang_1200.out0, IN[1]=select_all_lines)
# ---------- python_script.python (46 lines) ----------
import clr
clr.AddReference('ProtoGeometry')
from Autodesk.DesignScript.Geometry import *
clr.AddReference('RevitAPI')
from Autodesk.Revit.DB import *
from Autodesk.Revit.DB import ElementId
clr.AddReference('RevitAPIUI')
from Autodesk.Revit.UI import TaskDialog
clr.AddReference("RevitNodes")
import Revit
clr.ImportExtensions(Revit.Elements)
clr.ImportExtensions(Revit.GeometryConversion)
clr.AddReference("RevitServices")
import RevitServices
from RevitServices.Persistence import DocumentManager
from RevitServices.Transactions import TransactionManager
from System.Collections.Generic import *

doc = DocumentManager.Instance.CurrentDBDocument
uiapp = DocumentManager.Instance.CurrentUIApplication
app = uiapp.Application

dataEnteringNode = IN
catName = IN[0]
#selectElems = IN[1]
selectElems = UnwrapElement(IN[1])

graphStyles = FilteredElementCollector(doc).OfClass(GraphicsStyle)
graphId = []
result = []

for style in graphStyles:
	name = style.Name
	if name == catName:
		graphId.append(style.Id)
id = graphId[0]

elemID = doc.GetElement(id)

for elem in selectElems:	 
	if elem.LineStyle.Id == elemID.Id:
	#if elem.GetParameterValueByName("Line Style").Id == elemID:
		result.append(elem)

#Assign your output to the OUT variable.
OUT = result
# ----------------------------------------
geometry = Element.Geometry(python_script)
flatten = Flatten(geometry)
startPoint_2 = Curve.StartPoint(flatten)
endPoint = Curve.EndPoint(flatten)
create = List.Create(startPoint_2, endPoint)
transpose = List.Transpose(create)
byName = FamilyType.ByName(giằng_ngang_1200.out1)
byPoints = AdaptiveComponent.ByPoints(points=transpose, familyType=byName)

code_block_2 = CodeBlock(p=startPoint_2) { p; }
flatten_2 = Flatten(code_block_2)
project = Point.Project(flatten_2, code_block, ZAxis, lacing=Longest)
flatten_3 = Flatten(project)
byStartPointEndPoint = Line.ByStartPointEndPoint(startPoint=flatten_2, endPoint=flatten_3)
length = Curve.Length(byStartPointEndPoint)
round = Math.Round(length)
code_block_3 = CodeBlock(p=endPoint) { p; }
flatten_4 = Flatten(code_block_3)
project_2 = Point.Project(flatten_4, code_block, ZAxis_2, lacing=Longest)
flatten_5 = Flatten(project_2)
byStartPointEndPoint_2 = Line.ByStartPointEndPoint(startPoint=flatten_4, endPoint=flatten_5)
length_2 = Curve.Length(byStartPointEndPoint_2)
round_2 = Math.Round(length_2)
create_2 = List.Create(round, round_2)
transpose_2 = List.Transpose(create_2)
python_script_2 = Python(IN[0]=transpose_2)
# ---------- python_script_2.python (15 lines) ----------
import clr
clr.AddReference('ProtoGeometry')
from Autodesk.DesignScript.Geometry import *
#The inputs to this node will be stored as a list in the IN variables.
dataEnteringNode = IN
list = IN[0]
res=[]
for l in list:
	if l[0]<l[1]:
		res.append(l[0])
	else:
		res.append(l[1])

#Assign your output to the OUT variable.
OUT = res
# ----------------------------------------

# group (continued): GIẰNG NGANG 1200
code_block_4 = CodeBlock(adaptivecomponent1=byPoints, num2=python_script_2, num1=chiều_cao_chân)
# ---------- code_block_4.designscript (4 lines) ----------
str1 = "Chieu_Cao_Chan";
str2 = "Chieu_Cao_Tong";
element2 = adaptivecomponent1.SetParameterByName(str2, num2);
element1 = adaptivecomponent1.SetParameterByName(str1, num1);
# ----------------------------------------

giằng_ngang_900 = CodeBlock { "Line_WedgeLock_Brace_900"; "Adt-Wedgelock-Sys of Hoz Brace 900-2 points"; }

# group: GIẰNG NGANG 900
python_script_3 = Python(IN[0]=giằng_ngang_900.out0, IN[1]=select_all_lines)  # same code as python_script
geometry_2 = Element.Geometry(python_script_3)
flatten_6 = Flatten(geometry_2)
startPoint_3 = Curve.StartPoint(flatten_6)
endPoint_2 = Curve.EndPoint(flatten_6)
create_3 = List.Create(startPoint_3, endPoint_2)
transpose_3 = List.Transpose(create_3)
byName_2 = FamilyType.ByName(giằng_ngang_900.out1)
byPoints_2 = AdaptiveComponent.ByPoints(points=transpose_3, familyType=byName_2)

code_block_5 = CodeBlock(p=startPoint_3) { p; }
flatten_7 = Flatten(code_block_5)
ZAxis_3 = Vector.ZAxis()
project_3 = Point.Project(flatten_7, code_block, ZAxis_3, lacing=Longest)
flatten_8 = Flatten(project_3)
byStartPointEndPoint_3 = Line.ByStartPointEndPoint(startPoint=flatten_7, endPoint=flatten_8)
length_3 = Curve.Length(byStartPointEndPoint_3)
round_3 = Math.Round(length_3)
code_block_6 = CodeBlock(p=endPoint_2) { p; }
flatten_9 = Flatten(code_block_6)
ZAxis_4 = Vector.ZAxis()
project_4 = Point.Project(flatten_9, code_block, ZAxis_4, lacing=Longest)
flatten_10 = Flatten(project_4)
byStartPointEndPoint_4 = Line.ByStartPointEndPoint(startPoint=flatten_9, endPoint=flatten_10)
length_4 = Curve.Length(byStartPointEndPoint_4)
round_4 = Math.Round(length_4)
create_4 = List.Create(round_3, round_4)
transpose_4 = List.Transpose(create_4)
python_script_4 = Python(IN[0]=transpose_4)  # same code as python_script_2

# group (continued): GIẰNG NGANG 900
code_block_7 = CodeBlock(adaptivecomponent1=byPoints_2, num2=python_script_4, num1=chiều_cao_chân)  # same code as code_block_4

giằng_ngang_600 = CodeBlock { "Line_WedgeLock_Brace_600"; "Adt-Wedgelock-Sys of Hoz Brace 600-2 points"; }

# group: GIẰNG NGANG 600
python_script_5 = Python(IN[0]=giằng_ngang_600.out0, IN[1]=select_all_lines)  # same code as python_script
geometry_3 = Element.Geometry(python_script_5)
flatten_11 = Flatten(geometry_3)
startPoint_4 = Curve.StartPoint(flatten_11)
endPoint_3 = Curve.EndPoint(flatten_11)
create_5 = List.Create(startPoint_4, endPoint_3)
transpose_5 = List.Transpose(create_5)
byName_3 = FamilyType.ByName(giằng_ngang_600.out1)
byPoints_3 = AdaptiveComponent.ByPoints(points=transpose_5, familyType=byName_3)

code_block_8 = CodeBlock(p=startPoint_4) { p; }
flatten_12 = Flatten(code_block_8)
ZAxis_5 = Vector.ZAxis()
project_5 = Point.Project(flatten_12, code_block, ZAxis_5, lacing=Longest)
flatten_13 = Flatten(project_5)
byStartPointEndPoint_5 = Line.ByStartPointEndPoint(startPoint=flatten_12, endPoint=flatten_13)
length_5 = Curve.Length(byStartPointEndPoint_5)
round_5 = Math.Round(length_5)
code_block_9 = CodeBlock(p=endPoint_3) { p; }
flatten_14 = Flatten(code_block_9)
ZAxis_6 = Vector.ZAxis()
project_6 = Point.Project(flatten_14, code_block, ZAxis_6, lacing=Longest)
flatten_15 = Flatten(project_6)
byStartPointEndPoint_6 = Line.ByStartPointEndPoint(startPoint=flatten_14, endPoint=flatten_15)
length_6 = Curve.Length(byStartPointEndPoint_6)
round_6 = Math.Round(length_6)
create_6 = List.Create(round_5, round_6)
transpose_6 = List.Transpose(create_6)
python_script_6 = Python(IN[0]=transpose_6)  # same code as python_script_2

# group (continued): GIẰNG NGANG 600
code_block_10 = CodeBlock(adaptivecomponent1=byPoints_3, num2=python_script_6, num1=chiều_cao_chân)  # same code as code_block_4

giằng_chéo_1200x1000 = CodeBlock { "Line_WedgeLock_Diagonal Brace_1200x1000"; "Adt-Wedgelock-Sys of Diagonal Brace 1200x1000-2 points"; }
python_script_7 = Python(IN[0]=giằng_chéo_1200x1000.out0, IN[1]=select_all_lines)  # same code as python_script
geometry_4 = Element.Geometry(python_script_7)
flatten_16 = Flatten(geometry_4)
startPoint_5 = Curve.StartPoint(flatten_16)
endPoint_4 = Curve.EndPoint(flatten_16)
create_7 = List.Create(startPoint_5, endPoint_4)
transpose_7 = List.Transpose(create_7)
byName_4 = FamilyType.ByName(giằng_chéo_1200x1000.out1)
byPoints_4 = AdaptiveComponent.ByPoints(points=transpose_7, familyType=byName_4)
code_block_11 = CodeBlock(p=startPoint_5) { p; }
flatten_17 = Flatten(code_block_11)
ZAxis_7 = Vector.ZAxis()
project_7 = Point.Project(flatten_17, code_block, ZAxis_7, lacing=Longest)
flatten_18 = Flatten(project_7)
byStartPointEndPoint_7 = Line.ByStartPointEndPoint(startPoint=flatten_17, endPoint=flatten_18)
length_7 = Curve.Length(byStartPointEndPoint_7)
round_7 = Math.Round(length_7)
code_block_12 = CodeBlock(p=endPoint_4) { p; }
flatten_19 = Flatten(code_block_12)
ZAxis_8 = Vector.ZAxis()
project_8 = Point.Project(flatten_19, code_block, ZAxis_8, lacing=Longest)
flatten_20 = Flatten(project_8)
byStartPointEndPoint_8 = Line.ByStartPointEndPoint(startPoint=flatten_19, endPoint=flatten_20)
length_8 = Curve.Length(byStartPointEndPoint_8)
round_8 = Math.Round(length_8)
create_8 = List.Create(round_7, round_8)
transpose_8 = List.Transpose(create_8)
python_script_8 = Python(IN[0]=transpose_8)  # same code as python_script_2
code_block_13 = CodeBlock(adaptivecomponent1=byPoints_4, num2=python_script_8, num1=chiều_cao_chân)  # same code as code_block_4
create_9 = List.Create(geometry, geometry_2, geometry_3)
flatten_21 = Flatten(create_9)
python_script_9 = Python(IN[0]=flatten_21)
# ---------- python_script_9.python (46 lines) ----------
import clr
clr.AddReference('ProtoGeometry')
from Autodesk.DesignScript.Geometry import *
#The inputs to this node will be stored as a list in the IN variables.
dataEnteringNode = IN

crs = IN[0]

crs1 = crs[:]

c0=crs1[0]
v = Vector.ByTwoPoints(c0.StartPoint,c0.EndPoint)
crs1.remove(c0)

res1 = crs1[:]
res2 = []
res2.append(c0)

for c in crs1:
	vc = Vector.ByTwoPoints(c.StartPoint,c.EndPoint)
	if v.IsParallel(vc):
		res2.append(c)
		res1.remove(c)

result =[]
res3 = []
res4 = []
res5 = []
for i in range(1,len(res1)):
	res3.append(res1[0].DoesIntersect(res1[i]))

for i in range(1,len(res2)):
	res4.append(res2[0].DoesIntersect(res2[i]))


if sum(res4) > sum(res3):
	res5=res1
else:
	res5=res2

for c in res5:
	result.append(c.StartPoint)
	result.append(c.EndPoint)

#Assign your output to the OUT variable.
OUT = result
# ----------------------------------------
code_block_14 = CodeBlock(p=python_script_9) { p; }  # frozen
flatten_22 = Flatten(code_block_14)
ZAxis_9 = Vector.ZAxis()
project_9 = Point.Project(flatten_22, code_block, ZAxis_9, lacing=Longest)
flatten_23 = Flatten(project_9)
byStartPointEndPoint_9 = Line.ByStartPointEndPoint(startPoint=flatten_22, endPoint=flatten_23)
length_9 = Curve.Length(byStartPointEndPoint_9)
round_9 = Math.Round(length_9)
code_block_15 = CodeBlock { 7000; }
le = round_9 <= code_block_15
boolean = BoolSelector(true)
allIndicesOf = List.AllIndicesOf(list=le, item=boolean)
getItemAtIndex = List.GetItemAtIndex(list=code_block_14, index=allIndicesOf)
flatten_24 = Flatten(getItemAtIndex)
cây_chống = CodeBlock { "Adt-Wedgelock-Sys of Post w Head U less than 7000-1 points"; }  # frozen
byName_5 = FamilyType.ByName(cây_chống)
byPoints_5 = AdaptiveComponent.ByPoints(points=flatten_24, familyType=byName_5)
getItemAtIndex_2 = List.GetItemAtIndex(list=round_9, index=allIndicesOf)
flatten_25 = Flatten(getItemAtIndex_2)
code_block_16 = CodeBlock(adaptivecomponent1=byPoints_5, num2=flatten_25, num1=chiều_cao_chân)  # same code as code_block_4
select_multi_faces = SelectFaces()
code_block_17 = CodeBlock(faces=select_multi_faces) { faces; }
byJoinedSurfaces = PolySurface.ByJoinedSurfaces(code_block_17)
flatten_26 = Flatten(byJoinedSurfaces)
deconstruct = List.Deconstruct(list=flatten_26)
join = Surface.Join(deconstruct.first, deconstruct.rest)
flatten_27 = Flatten(code_block_17)  # frozen
perimeterCurves_2 = Surface.PerimeterCurves(flatten_27)
startPoint_6 = Curve.StartPoint(perimeterCurves_2)
select_joine_geometry_to_project = DSModelElementSelection()
solids = Element.Solids(select_joine_geometry_to_project)
geometry_5 = Element.Geometry(select_joine_geometry_to_project)
le_2 = round_9 <= code_block_15
boolean_2 = BoolSelector(false)
allIndicesOf_2 = List.AllIndicesOf(list=le_2, item=boolean_2)
getItemAtIndex_3 = List.GetItemAtIndex(list=code_block_14, index=allIndicesOf_2)
flatten_28 = Flatten(getItemAtIndex_3)
cây_chống_2 = CodeBlock { "Adt-Wedgelock-Sys of Post w Head U-1 points"; }  # frozen
byName_6 = FamilyType.ByName(cây_chống_2)
byPoints_6 = AdaptiveComponent.ByPoints(points=flatten_28, familyType=byName_6)
getItemAtIndex_4 = List.GetItemAtIndex(list=round_9, index=allIndicesOf_2)
flatten_29 = Flatten(getItemAtIndex_4)
code_block_18 = CodeBlock(adaptivecomponent1=byPoints_6, num2=flatten_29, num1=chiều_cao_chân)  # same code as code_block_4
create_10 = List.Create(startPoint_2, startPoint_3, startPoint_4)  # frozen
flatten_30 = Flatten(create_10)
python_script_10 = Python(IN[0]=flatten_30)
# ---------- python_script_10.python (23 lines) ----------
import clr
clr.AddReference('ProtoGeometry')
from Autodesk.DesignScript.Geometry import *
#The inputs to this node will be stored as a list in the IN variables.
dataEnteringNode = IN

pts = IN[0]

pts1 = pts[:]
pts2=[]
#pts2.append(pts1[0])
#pts1.remove(pts1[0])
for p1 in pts1:
	pts3 = pts1[:]
	pts3.remove(p1)
	for p3 in pts3:
		if p1.DoesIntersect(p3):
			pts1.remove(p3)
			


#Assign your output to the OUT variable.
OUT = pts1
# ----------------------------------------
create_11 = List.Create(startPoint_2, endPoint, startPoint_3, endPoint_2, startPoint_4, endPoint_3)  # frozen
flatten_31 = Flatten(create_11)
python_script_11 = Python(IN[0]=flatten_31)  # same code as python_script_10
code_block_19 = CodeBlock(p=python_script_9) { p; }
cây_chống_3 = CodeBlock { "Adt-Wedgelock-Sys of Post w Head U non Moduled-1 points"; }
byName_7 = FamilyType.ByName(cây_chống_3)
byPoints_7 = AdaptiveComponent.ByPoints(points=code_block_19, familyType=byName_7)
ZAxis_10 = Vector.ZAxis()
project_10 = Point.Project(code_block_19, code_block, ZAxis_10, lacing=Longest)
flatten_32 = Flatten(project_10)
byStartPointEndPoint_10 = Line.ByStartPointEndPoint(startPoint=code_block_19, endPoint=flatten_32)
length_10 = Curve.Length(byStartPointEndPoint_10)
round_10 = Math.Round(length_10)
code_block_20 = CodeBlock(adaptivecomponent1=byPoints_7, num2=round_10, num1=chiều_cao_chân)  # same code as code_block_4
