# Dynamo graph MappingAndSetMarkParameter-OK.dyn (Dynamo 0.9.1.4062)

categories = Categories("StructuralColumns")
start = Revit.Transaction.Transaction.Start(categories)
all_elements_of_category = ElementsOfCategory(start)
code_block = CodeBlock { "Base Level"; "Mark"; }
getParameterValueByName = Element.GetParameterValueByName(element=all_elements_of_category, parameterName=code_block.out0)
levels = Levels("1F")
allIndicesOf = List.AllIndicesOf(list=getParameterValueByName, item=levels)
getItemAtIndex = List.GetItemAtIndex(list=all_elements_of_category, index=allIndicesOf)
getParameterValueByName_2 = Element.GetParameterValueByName(element=all_elements_of_category, parameterName=code_block.out1)
levels_2 = Levels("ToF")
allIndicesOf_2 = List.AllIndicesOf(list=getParameterValueByName, item=levels_2)
getItemAtIndex_2 = List.GetItemAtIndex(list=getParameterValueByName_2, index=allIndicesOf_2)
setParameterByName = Element.SetParameterByName(element=getItemAtIndex, parameterName=code_block.out1, value=getItemAtIndex_2)
end = Revit.Transaction.Transaction.End(setParameterByName)
elevation = Level.Elevation(getParameterValueByName)
boolean = BoolSelector(true)
sortIndexByValue = SortIndexByValue(elevation, boolean)
categories_2 = Categories("Levels")
all_elements_of_category_2 = ElementsOfCategory(categories_2)
count = Count(all_elements_of_category_2)
getItemAtIndex_3 = List.GetItemAtIndex(list=all_elements_of_category, index=allIndicesOf_2)
getItemAtIndex_4 = List.GetItemAtIndex(list=getParameterValueByName_2, index=allIndicesOf)
string = StringInput("""
Mapping và set parameter của các Instance A cho các Instance B

***Hiệu quả khi các Instance B được copy / paste từ các Instance A """)
