# Dynamo graph GetDuplicatePoints.dyn (Dynamo 0.9.1.4062)

select_model_elements = DSModelElementsSelection()  # 7 picked in the model
geometry = Element.Geometry(select_model_elements)
flatten = Flatten(geometry)
endPoint = Curve.EndPoint(flatten)
code_block = CodeBlock { 0.01; }
pruneDuplicates = Point.PruneDuplicates(points=endPoint, tolerance=code_block)
setDifference = SetDifference(endPoint, pruneDuplicates)
allIndicesOf = List.AllIndicesOf(list=endPoint, item=setDifference)
flatten_2 = Flatten(allIndicesOf)
startPoint = Curve.StartPoint(flatten)
code_block_2 = CodeBlock { 0.01; }
pruneDuplicates_2 = Point.PruneDuplicates(points=startPoint, tolerance=code_block_2)
setDifference_2 = SetDifference(startPoint, pruneDuplicates_2)
allIndicesOf_2 = List.AllIndicesOf(list=startPoint, item=setDifference_2)
flatten_3 = Flatten(allIndicesOf_2)
uniqueItems = List.UniqueItems(startPoint)
allIndicesOf_3 = List.AllIndicesOf(list=startPoint, item=uniqueItems)
count = Count()
map = List.Map(list=allIndicesOf_3, f_x=count)
code_block_3 = CodeBlock { 1; }
gt = map > code_block_3
filterByBoolMask = List.FilterByBoolMask(list=allIndicesOf_3, mask=gt)
flatten_4 = Flatten(filterByBoolMask.in)
watch = Watch(filterByBoolMask.in)
uniqueItems_2 = List.UniqueItems(endPoint)
allIndicesOf_4 = List.AllIndicesOf(list=endPoint, item=uniqueItems_2)
count_2 = Count()
map_2 = List.Map(list=allIndicesOf_4, f_x=count_2)
code_block_4 = CodeBlock { 1; }
gt_2 = map_2 > code_block_4
filterByBoolMask_2 = List.FilterByBoolMask(list=allIndicesOf_4, mask=gt_2)
flatten_5 = Flatten(filterByBoolMask_2.in)
watch_2 = Watch(filterByBoolMask_2.in)
allIndicesOf_5 = List.AllIndicesOf(list=endPoint, item=pruneDuplicates)
