# Dynamo graph Element.GetParameterValueByName.dyn (Dynamo 0.8.2.2392)

element_types = ElementTypes("Wall")
all_elements_of_type = ElementsOfType(element_types)
watch = Watch(all_elements_of_type)
code_block = CodeBlock { "Brick, Common"; }
getParameterValueByName = Element.GetParameterValueByName(element=watch, parameterName=code_block)
