# Dynamo graph SetParameterFollowExcelFile.dyn (Dynamo 0.9.1.4062)

pathFile = StringInput("R:\BimESC\09-R&D\DYNAMO\01-WIP\QR Code")
c = StringInput("\")
parameterFileName = StringInput("Eq_shareParams")
extension = StringInput(".txt")
code_block = CodeBlock(p=pathFile, c=c, n=parameterFileName, e=extension) { p+c+n+e; }
string = StringInput("# COFICO Shared parameters")
writeText = File.WriteText(code_block, string)  # frozen
category = CodeBlock { "Site"; "Generic Models"; }
create = List.Create(category.out0, category.out1)
parameter_group = StringInput("SiteEquipment")
fileName = StringInput("EquipmentList")
extension_2 = StringInput(".xlsx")
code_block_2 = CodeBlock(p=pathFile, c=c, n=fileName, e=extension_2) { p+c+n+e; }
fromPath = FileObject(code_block_2)  # "File.FromPath"
sheetName = StringInput("EqList")
boolean = BoolSelector(true)
readFromFile = Excel.ReadFromFile(file=fromPath, sheetName=sheetName, readAsStrings=boolean)
code_block_3 = CodeBlock(params=readFromFile) { params[0]; }
parameter_type = CodeBlock { "Text"; "Integer"; "Number"; "Length"; "Area"; "Volumn"; "Angle"; "URL"; "Material"; "YesNo"; "Image"; }
chosen_parameter_type = CodeBlock(paraType=parameter_type.out0) { paraType; }
set_parameters = Python(IN[0]=code_block, IN[1]=parameter_group, IN[2]=code_block_3, IN[3]=chosen_parameter_type)
# ---------- set_parameters.python (89 lines) ----------
import clr
clr.AddReference('ProtoGeometry')
from Autodesk.DesignScript.Geometry import *

clr.AddReference('RevitAPI')
from Autodesk.Revit.DB import *

clr.AddReference("RevitServices")
import RevitServices
from RevitServices.Persistence import DocumentManager
from RevitServices.Transactions import TransactionManager
from System.Collections.Generic import *

clr.AddReference("DSCoreNodes")
from DSCore.IO import *

import sys
import System


doc = DocumentManager.Instance.CurrentDBDocument
uiapp = DocumentManager.Instance.CurrentUIApplication
app = uiapp.Application
##########################################################################################
#The inputs to this node will be stored as a list in the IN variables.
dataEnteringNode = IN
sharedParamsFileName = IN[0]
groupName = IN[1]
paramNames = IN[2]
paramType = IN[3]



##########################################################################################
test = []
param = []

defGroup = []
defParam = []

dfparamTypes = [ParameterType.Text,ParameterType.Integer,ParameterType.Number,ParameterType.Length,ParameterType.Area,ParameterType.Volume,ParameterType.Angle,ParameterType.URL,ParameterType.Material,ParameterType.YesNo]

paramTypeRs = []

for i in range(len(dfparamTypes)):
	if dfparamTypes[i].ToString() == paramType:
		paramTypeRs = dfparamTypes[i]

#defElems = FilteredElementCollector(doc).OfClass(Definitions).ToElements()
##########################################################################################
# Start Transaction
TransactionManager.Instance.EnsureInTransaction(doc)
try:
	#Tạo file Para và sd cho dự án	
	if System.IO.File.Exists(sharedParamsFileName): # nếu file txt param có tồn tại thì setup cho dự án sử dụng
		app.SharedParametersFilename = sharedParamsFileName	
		param = app.OpenSharedParameterFile()
	else:
		File.WriteText(sharedParamsFileName,"# COFICO Shared parameters")
		app.SharedParametersFilename = sharedParamsFileName
		param = app.OpenSharedParameterFile()
	
	#Tạo group Parameter
	if param.Groups.get_Item(groupName) is None: #nếu chưa tồn tại group thì tạo group
		defGroup = param.Groups.Create(groupName)

	else:#nếu đã tồn tại group thì không tạo
		defGroup = param.Groups.get_Item(groupName)
		
	#Tao Parameter def
	for name in paramNames:
		if defGroup.Definitions.get_Item(name) == None:
			extDefCreationOption = ExternalDefinitionCreationOptions(name,paramTypeRs)
			defpa = defGroup.Definitions.Create(extDefCreationOption)
			defParam.append(defpa)
		else:
			defpa = defGroup.Definitions.get_Item(name)
			defParam.append(defpa)

	
except:
	pass

# End Transaction
TransactionManager.Instance.TransactionTaskDone()
doc.Regenerate()

#Assign your output to the OUT variable.
OUT = defParam
# ----------------------------------------
binding_parameters_to_revit = Python(IN[0]=set_parameters)  # "Binding Parameters to Revit Elements"
# ---------- binding_parameters_to_revit.python (42 lines) ----------
import clr
clr.AddReference('ProtoGeometry')
from Autodesk.DesignScript.Geometry import *

clr.AddReference('RevitAPI')
from Autodesk.Revit.DB import *

clr.AddReference("RevitServices")
import RevitServices
from RevitServices.Persistence import DocumentManager
from RevitServices.Transactions import TransactionManager
from System.Collections.Generic import *

clr.AddReference("DSCoreNodes")
from DSCore.IO import *

import sys
import System


doc = DocumentManager.Instance.CurrentDBDocument
uiapp = DocumentManager.Instance.CurrentUIApplication
app = uiapp.Application
##########################################################################################
#The inputs to this node will be stored as a list in the IN variables.
dataEnteringNode = IN
defParams = IN[0]

#binding = Autodesk.Revit.DB.Binding
#builtinparamGroup = BuiltInParameterGroup.PG_CONSTRUCTION

cats = [doc.Settings.Categories.get_Item(BuiltInCategory.OST_Site),doc.Settings.Categories.get_Item(BuiltInCategory.OST_GenericModel)]

CatIds = []
allCurrentElems = FilteredElementCollector(doc).WhereElementIsNotElementType().ToElements()


test = []


#Assign your output to the OUT variable.
OUT = allCurrentElems
# ----------------------------------------
