# Dynamo graph PlacingNamedGrid3D-0901-171228-OK.dyn (Dynamo 0.9.1.4062)

categories = Categories("Grids")
all_elements_of_category = ElementsOfCategory(categories)
curve = Grid.Curve(all_elements_of_category)
ZAxis = Vector.ZAxis()
please_choose_level_of = Levels("TERRACE STOREY")  # "Please choose Level of Components"
elevation = Level.Elevation(please_choose_level_of)
translate = Geometry.Translate(geometry=curve, direction=ZAxis, distance=elevation)
startPoint = Curve.StartPoint(translate)
endPoint = Curve.EndPoint(translate)
create = List.Create(startPoint, endPoint)
transpose = List.Transpose(create)
family_types = FamilyTypes("Adt-Grid 3D:Adt-Grid 3D")
byPoints = AdaptiveComponent.ByPoints(points=transpose, familyType=family_types)
code_block = CodeBlock { "GridName"; }
code_block_2 = CodeBlock { "Name"; }
getParameterValueByName = Element.GetParameterValueByName(element=all_elements_of_category, parameterName=code_block_2)
setParameterByName = Element.SetParameterByName(element=byPoints, parameterName=code_block, value=getParameterValueByName)
getParameterValueByName_2 = Element.GetParameterValueByName(element=byPoints, parameterName=code_block)
