# Dynamo graph ExcelDataToQRCode-0901-180207-OK.dyn (Dynamo 0.9.1.4062)

string_connecter = StringInput("__")
excel_file_path = StringInput("R:\BimESC\09-R&D\DYNAMO\01-WIP\QR Code\")
excel_file_path_2 = StringInput("EquipmentList.xlsx")
code_block = CodeBlock(path=excel_file_path, name=excel_file_path_2) { path + name; }
fromPath = FileObject(code_block)  # "File.FromPath"
sheet_name = StringInput("EqList")
boolean = BoolSelector(false)
readFromFile = Excel.ReadFromFile(file=fromPath, sheetName=sheet_name, readAsStrings=boolean)
transpose = List.Transpose(readFromFile)
code_block_2 = CodeBlock(string_connecter, transpose)
# ---------- code_block_2.designscript (12 lines) ----------
c;
combineString = [Imperative]
{
rank = 0..(Count(list[0])-1);
a={};
for (i in rank)
{

a[i] = list[0][i]+c+list[1][i]+c+list[2][i];
}
return = a;
};
# ----------------------------------------
directory = StringInput("R:\BimESC\09-R&D\DYNAMO\01-WIP\QR Code\QRImages\")
extention = StringInput(".png")
# note: Names
generate_qr_codes = Python(IN[0]=code_block_2.out1, IN[1]=directory, IN[2]=extention)
# ---------- generate_qr_codes.python (35 lines) ----------
import clr
clr.AddReference('ProtoGeometry')
from Autodesk.DesignScript.Geometry import *
clr.AddReference('QRCoder')
from QRCoder import *
clr.AddReference('DSCoreNodes')
import DSCore
from DSCore.IO import *


#The inputs to this node will be stored as a list in the IN variables.
dataEnteringNode = IN
names = IN[0]
path= IN[1]
extention = IN[2]

pathNames=[]
QR_codes = []
generator = QRCodeGenerator()

for i in range(len(names)):
	#tạo pathName
	pathName = path+names[i]+extention
	pathNames.append(pathNames)
	#tạo QR code theo name
	codedata = generator.CreateQrCode(names[i], QRCodeGenerator.ECCLevel.Q)
	code = QRCode(codedata)
	
	QR_code = code.GetGraphic(20)
	QR_codes.append(QR_code)
	
	DSCore.IO.Image.WriteToFile(pathName,QR_code)

#Assign your output to the OUT variable.
OUT = "Ok"
# ----------------------------------------
readFromFile_2 = Image.ReadFromFile()
dimensions = Image.Dimensions()
fromPixels = Image.FromPixels()
fromPixels_2 = Image.FromPixels()
pixels = Image.Pixels()
copy_multi_files = Python()  # frozen
# ---------- copy_multi_files.python (26 lines) ----------
import clr
clr.AddReference('ProtoGeometry')
from Autodesk.DesignScript.Geometry import *
clr.AddReference('DSCoreNodes')
import DSCore
from DSCore.IO import File
from DSCore.IO.File import *

import sys
import System

#The inputs to this node will be stored as a list in the IN variable.
dataEnteringNode = IN
path = IN[0]
count = IN[1]
directory = IN[2]
name = IN[3]
extention = IN[4]

for i in range(count):
	desPathName = directory+name[i]+extention
	fileInfo = FromPath(path.ToString())
	
	copyElem = Copy(fileInfo,desPathName,True)
        
OUT = "Ok"
# ----------------------------------------
# note: Path
# note: Extension
QRCode = Custom[QRCode]()  # Creates a simple QR code based on strings. Accepts single items or lists
file_path = Filename("R:\BimESC\09-R&D\DYNAMO\01-WIP\QR Code\EquipmentList.xlsx")
sheet_name_2 = StringInput("QRCodes")
code_block_3 = CodeBlock { startRow=0; StartCol=0; }
code_block_4 = CodeBlock(strings=code_block_2.out1) { strings; qrCodes = strings[1..(Count(strings)-1)]; }
boolean_2 = BoolSelector(false)
writeToFile = Excel.WriteToFile(filePath=code_block, sheetName=sheet_name_2, startRow=code_block_3.startRow, startCol=code_block_3.StartCol, data=code_block_4.qrCodes, overWrite=boolean_2)
sheet_name_3 = StringInput("QRImages")
writeToFile_2 = Excel.WriteToFile(filePath=code_block, sheetName=sheet_name_3, startRow=code_block_3.startRow, startCol=code_block_3.StartCol, overWrite=boolean_2)  # frozen
