# Dynamo graph Formwork-Wedgelock 0901 180424-OK.dyn (Dynamo 0.9.1.4062)

giằng_ngang_1200_1500 = CodeBlock { "Line_WedgeLock_Brace_1200"; "Adt-Wedgelock-Sys of Hoz Brace 1200 @1500-2 points"; }
select_all_lines = DSModelElementsSelection()  # 2086 picked in the model
code_block = CodeBlock { 0.5; 10; }
n1_geometry_2_1_face_for_plane_3 = IntegerSlider(2, range=1..3 step 1)  # "1 = Geometry;2 = 1 face for Plane;3 = Joined Faces for Plane"
select_joine_geometry_to_project = DSModelElementSelection()
geometry = Element.Geometry(select_joine_geometry_to_project)
# note: 1
select_one_face_to_plane = DSFaceSelection()  # 1 picked in the model
perimeterCurves = Surface.PerimeterCurves(select_one_face_to_plane)
startPoint = Curve.StartPoint(perimeterCurves)
flatten = Flatten(startPoint)
byBestFitThroughPoints = Plane.ByBestFitThroughPoints(flatten)
# note: 2
# note: 3
select_covering_joinable_multi = SelectFaces()  # "Select Covering Joinable Multi Faces"; 15 picked in the model
code_block_2 = CodeBlock(faces=select_covering_joinable_multi) { faces; }
byJoinedSurfaces = PolySurface.ByJoinedSurfaces(code_block_2)
flatten_2 = Flatten(byJoinedSurfaces)
deconstruct = List.Deconstruct(list=flatten_2)
join = Surface.Join(deconstruct.first, deconstruct.rest)
python_script = Python(IN[0]=n1_geometry_2_1_face_for_plane_3, IN[1]=geometry, IN[2]=byBestFitThroughPoints, IN[3]=join)
# ---------- python_script.python (22 lines) ----------
import clr
clr.AddReference('ProtoGeometry')
from Autodesk.DesignScript.Geometry import *
#The inputs to this node will be stored as a list in the IN variables.
dataEnteringNode = IN

cond = IN[0]
res1 = IN[1]
res2 = IN[2]
res3 = IN[3]

result = []
if cond == 1:
	result = res1
if cond == 2:
	result = res2
if cond == 3:
	result = res3


#Assign your output to the OUT variable.
OUT = result
# ----------------------------------------
code_block_3 = CodeBlock(geo=python_script) { geo; }
ZAxis = Vector.ZAxis()
ZAxis_2 = Vector.ZAxis()
chiều_cao_chân = CodeBlock { 300; }

# group: GIẰNG NGANG 1200
python_script_2 = Python(IN[0]=giằng_ngang_1200_1500.out0, IN[1]=select_all_lines)
# ---------- python_script_2.python (46 lines) ----------
import clr
clr.AddReference('ProtoGeometry')
from Autodesk.DesignScript.Geometry import *
clr.AddReference('RevitAPI')
from Autodesk.Revit.DB import *
from Autodesk.Revit.DB import ElementId
clr.AddReference('RevitAPIUI')
from Autodesk.Revit.UI import TaskDialog
clr.AddReference("RevitNodes")
import Revit
clr.ImportExtensions(Revit.Elements)
clr.ImportExtensions(Revit.GeometryConversion)
clr.AddReference("RevitServices")
import RevitServices
from RevitServices.Persistence import DocumentManager
from RevitServices.Transactions import TransactionManager
from System.Collections.Generic import *

doc = DocumentManager.Instance.CurrentDBDocument
uiapp = DocumentManager.Instance.CurrentUIApplication
app = uiapp.Application

dataEnteringNode = IN
catName = IN[0]
#selectElems = IN[1]
selectElems = UnwrapElement(IN[1])

graphStyles = FilteredElementCollector(doc).OfClass(GraphicsStyle)
graphId = []
result = []

for style in graphStyles:
	name = style.Name
	if name == catName:
		graphId.append(style.Id)
id = graphId[0]

elemID = doc.GetElement(id)

for elem in selectElems:	 
	if elem.LineStyle.Id == elemID.Id:
	#if elem.GetParameterValueByName("Line Style").Id == elemID:
		result.append(elem)

#Assign your output to the OUT variable.
OUT = result
# ----------------------------------------
geometry_2 = Element.Geometry(python_script_2)
flatten_3 = Flatten(geometry_2)
byName = FamilyType.ByName(giằng_ngang_1200_1500.out1)

pointAtParameter = Curve.PointAtParameter(curve=flatten_3, param=code_block.out0)
byCenterPointRadius = Sphere.ByCenterPointRadius(centerPoint=pointAtParameter, radius=code_block.out1)
boundingBox = Element.BoundingBox(byCenterPointRadius)
toCuboid = BoundingBox.ToCuboid(boundingBox)
python_script_3 = Python(IN[0]=toCuboid, IN[1]=flatten_3)
# ---------- python_script_3.python (26 lines) ----------
import clr
clr.AddReference('ProtoGeometry')
from Autodesk.DesignScript.Geometry import *
#The inputs to this node will be stored as a list in the IN variables.
dataEnteringNode = IN

elems = IN[0]
list = IN[1]

res = []
rest = elems[:]
res2 = []

for i in range(len(elems)):	
	rest.remove(elems[i])
	res.append(elems[i])
	res2.append(list[i])
	for er in rest:
		if er.DoesIntersect(elems[i]):
			res.remove(elems[i])
			res2.remove(list[i])
			
		
			
#Assign your output to the OUT variable.
OUT = res2
# ----------------------------------------

# group (continued): GIẰNG NGANG 1200
startPoint_2 = Curve.StartPoint(python_script_3)
endPoint = Curve.EndPoint(python_script_3)
create = List.Create(startPoint_2, endPoint)
transpose = List.Transpose(create)
byPoints = AdaptiveComponent.ByPoints(points=transpose, familyType=byName)

code_block_4 = CodeBlock(p=startPoint_2) { p; }
flatten_4 = Flatten(code_block_4)
project = Point.Project(flatten_4, code_block_3, ZAxis, lacing=Longest)
flatten_5 = Flatten(project)
byStartPointEndPoint = Line.ByStartPointEndPoint(startPoint=flatten_4, endPoint=flatten_5)
length = Curve.Length(byStartPointEndPoint)
round = Math.Round(length)
code_block_5 = CodeBlock(p=endPoint) { p; }
flatten_6 = Flatten(code_block_5)
project_2 = Point.Project(flatten_6, code_block_3, ZAxis_2, lacing=Longest)
flatten_7 = Flatten(project_2)
byStartPointEndPoint_2 = Line.ByStartPointEndPoint(startPoint=flatten_6, endPoint=flatten_7)
length_2 = Curve.Length(byStartPointEndPoint_2)
round_2 = Math.Round(length_2)
create_2 = List.Create(round, round_2)
transpose_2 = List.Transpose(create_2)
python_script_4 = Python(IN[0]=transpose_2)
# ---------- python_script_4.python (15 lines) ----------
import clr
clr.AddReference('ProtoGeometry')
from Autodesk.DesignScript.Geometry import *
#The inputs to this node will be stored as a list in the IN variables.
dataEnteringNode = IN
list = IN[0]
res=[]
for l in list:
	if l[0]<l[1]:
		res.append(l[0])
	else:
		res.append(l[1])

#Assign your output to the OUT variable.
OUT = res
# ----------------------------------------

# group (continued): GIẰNG NGANG 1200
code_block_6 = CodeBlock(adaptivecomponent1=byPoints, num2=python_script_4, num1=chiều_cao_chân)
# ---------- code_block_6.designscript (4 lines) ----------
str1 = "Chieu_Cao_Chan";
str2 = "Chieu_Cao_Tong";
element2 = adaptivecomponent1.SetParameterByName(str2, num2);
element1 = adaptivecomponent1.SetParameterByName(str1, num1);
# ----------------------------------------

giằng_ngang_900_1500 = CodeBlock { "Line_WedgeLock_Brace_900"; "Adt-Wedgelock-Sys of Hoz Brace 900 @1500-2 points"; }

# group: GIẰNG NGANG 900
python_script_5 = Python(IN[0]=giằng_ngang_900_1500.out0, IN[1]=select_all_lines)  # same code as python_script_2
geometry_3 = Element.Geometry(python_script_5)
flatten_8 = Flatten(geometry_3)
byName_2 = FamilyType.ByName(giằng_ngang_900_1500.out1)

code_block_7 = CodeBlock { 0.5; 10; }
pointAtParameter_2 = Curve.PointAtParameter(curve=flatten_8, param=code_block_7.out0)
byCenterPointRadius_2 = Sphere.ByCenterPointRadius(centerPoint=pointAtParameter_2, radius=code_block_7.out1)
boundingBox_2 = Element.BoundingBox(byCenterPointRadius_2)
toCuboid_2 = BoundingBox.ToCuboid(boundingBox_2)
python_script_6 = Python(IN[0]=toCuboid_2, IN[1]=flatten_8)  # same code as python_script_3

# group (continued): GIẰNG NGANG 900
startPoint_3 = Curve.StartPoint(python_script_6)
endPoint_2 = Curve.EndPoint(python_script_6)
create_3 = List.Create(startPoint_3, endPoint_2)
transpose_3 = List.Transpose(create_3)
byPoints_2 = AdaptiveComponent.ByPoints(points=transpose_3, familyType=byName_2)

code_block_8 = CodeBlock(p=startPoint_3) { p; }
flatten_9 = Flatten(code_block_8)
ZAxis_3 = Vector.ZAxis()
project_3 = Point.Project(flatten_9, code_block_3, ZAxis_3, lacing=Longest)
flatten_10 = Flatten(project_3)
byStartPointEndPoint_3 = Line.ByStartPointEndPoint(startPoint=flatten_9, endPoint=flatten_10)
length_3 = Curve.Length(byStartPointEndPoint_3)
round_3 = Math.Round(length_3)
code_block_9 = CodeBlock(p=endPoint_2) { p; }
flatten_11 = Flatten(code_block_9)
ZAxis_4 = Vector.ZAxis()
project_4 = Point.Project(flatten_11, code_block_3, ZAxis_4, lacing=Longest)
flatten_12 = Flatten(project_4)
byStartPointEndPoint_4 = Line.ByStartPointEndPoint(startPoint=flatten_11, endPoint=flatten_12)
length_4 = Curve.Length(byStartPointEndPoint_4)
round_4 = Math.Round(length_4)
create_4 = List.Create(round_3, round_4)
transpose_4 = List.Transpose(create_4)
python_script_7 = Python(IN[0]=transpose_4)  # same code as python_script_4

# group (continued): GIẰNG NGANG 900
code_block_10 = CodeBlock(adaptivecomponent1=byPoints_2, num2=python_script_7, num1=chiều_cao_chân)  # same code as code_block_6

giằng_ngang_600_1500 = CodeBlock { "Line_WedgeLock_Brace_600"; "Adt-Wedgelock-Sys of Hoz Brace 600 @1500-2 points"; }

# group: GIẰNG NGANG 600
python_script_8 = Python(IN[0]=giằng_ngang_600_1500.out0, IN[1]=select_all_lines)  # same code as python_script_2
geometry_4 = Element.Geometry(python_script_8)
flatten_13 = Flatten(geometry_4)
byName_3 = FamilyType.ByName(giằng_ngang_600_1500.out1)

code_block_11 = CodeBlock { 0.5; 10; }
pointAtParameter_3 = Curve.PointAtParameter(curve=flatten_13, param=code_block_11.out0)
byCenterPointRadius_3 = Sphere.ByCenterPointRadius(centerPoint=pointAtParameter_3, radius=code_block_11.out1)
boundingBox_3 = Element.BoundingBox(byCenterPointRadius_3)
toCuboid_3 = BoundingBox.ToCuboid(boundingBox_3)
python_script_9 = Python(IN[0]=toCuboid_3, IN[1]=flatten_13)  # same code as python_script_3

# group (continued): GIẰNG NGANG 600
startPoint_4 = Curve.StartPoint(python_script_9)
endPoint_3 = Curve.EndPoint(python_script_9)
create_5 = List.Create(startPoint_4, endPoint_3)
transpose_5 = List.Transpose(create_5)
byPoints_3 = AdaptiveComponent.ByPoints(points=transpose_5, familyType=byName_3)

code_block_12 = CodeBlock(p=startPoint_4) { p; }
flatten_14 = Flatten(code_block_12)
ZAxis_5 = Vector.ZAxis()
project_5 = Point.Project(flatten_14, code_block_3, ZAxis_5, lacing=Longest)
flatten_15 = Flatten(project_5)
byStartPointEndPoint_5 = Line.ByStartPointEndPoint(startPoint=flatten_14, endPoint=flatten_15)
length_5 = Curve.Length(byStartPointEndPoint_5)
round_5 = Math.Round(length_5)
code_block_13 = CodeBlock(p=endPoint_3) { p; }
flatten_16 = Flatten(code_block_13)
ZAxis_6 = Vector.ZAxis()
project_6 = Point.Project(flatten_16, code_block_3, ZAxis_6, lacing=Longest)
flatten_17 = Flatten(project_6)
byStartPointEndPoint_6 = Line.ByStartPointEndPoint(startPoint=flatten_16, endPoint=flatten_17)
length_6 = Curve.Length(byStartPointEndPoint_6)
round_6 = Math.Round(length_6)
create_6 = List.Create(round_5, round_6)
transpose_6 = List.Transpose(create_6)
python_script_10 = Python(IN[0]=transpose_6)  # same code as python_script_4

# group (continued): GIẰNG NGANG 600
code_block_14 = CodeBlock(adaptivecomponent1=byPoints_3, num2=python_script_10, num1=chiều_cao_chân)  # same code as code_block_6

giằng_chéo_1200x1500 = CodeBlock { "Line_WedgeLock_Diagonal Brace_1200x1500"; "Adt-Wedgelock-Sys of Diagonal Brace 1200x1500-2 points"; }
python_script_11 = Python(IN[0]=giằng_chéo_1200x1500.out0, IN[1]=select_all_lines)  # same code as python_script_2
geometry_5 = Element.Geometry(python_script_11)
flatten_18 = Flatten(geometry_5)
code_block_15 = CodeBlock { 0.5; 10; }
pointAtParameter_4 = Curve.PointAtParameter(curve=flatten_18, param=code_block_15.out0)
byCenterPointRadius_4 = Sphere.ByCenterPointRadius(centerPoint=pointAtParameter_4, radius=code_block_15.out1)
boundingBox_4 = Element.BoundingBox(byCenterPointRadius_4)
toCuboid_4 = BoundingBox.ToCuboid(boundingBox_4)
python_script_12 = Python(IN[0]=toCuboid_4, IN[1]=flatten_18)  # same code as python_script_3
startPoint_5 = Curve.StartPoint(python_script_12)
endPoint_4 = Curve.EndPoint(python_script_12)
create_7 = List.Create(startPoint_5, endPoint_4)
transpose_7 = List.Transpose(create_7)
byName_4 = FamilyType.ByName(giằng_chéo_1200x1500.out1)
byPoints_4 = AdaptiveComponent.ByPoints(points=transpose_7, familyType=byName_4)
code_block_16 = CodeBlock(p=startPoint_5) { p; }
flatten_19 = Flatten(code_block_16)
ZAxis_7 = Vector.ZAxis()
project_7 = Point.Project(flatten_19, code_block_3, ZAxis_7, lacing=Longest)
flatten_20 = Flatten(project_7)
byStartPointEndPoint_7 = Line.ByStartPointEndPoint(startPoint=flatten_19, endPoint=flatten_20)
length_7 = Curve.Length(byStartPointEndPoint_7)
round_7 = Math.Round(length_7)
code_block_17 = CodeBlock(p=endPoint_4) { p; }
flatten_21 = Flatten(code_block_17)
ZAxis_8 = Vector.ZAxis()
project_8 = Point.Project(flatten_21, code_block_3, ZAxis_8, lacing=Longest)
flatten_22 = Flatten(project_8)
byStartPointEndPoint_8 = Line.ByStartPointEndPoint(startPoint=flatten_21, endPoint=flatten_22)
length_8 = Curve.Length(byStartPointEndPoint_8)
round_8 = Math.Round(length_8)
create_8 = List.Create(round_7, round_8)
transpose_8 = List.Transpose(create_8)
python_script_13 = Python(IN[0]=transpose_8)  # same code as python_script_4
code_block_18 = CodeBlock(adaptivecomponent1=byPoints_4, num2=python_script_13, num1=chiều_cao_chân)  # same code as code_block_6
create_9 = List.Create(python_script_3, python_script_6, python_script_9)
flatten_23 = Flatten(create_9)
python_script_14 = Python(IN[0]=flatten_23)
# ---------- python_script_14.python (46 lines) ----------
import clr
clr.AddReference('ProtoGeometry')
from Autodesk.DesignScript.Geometry import *
#The inputs to this node will be stored as a list in the IN variables.
dataEnteringNode = IN

crs = IN[0]

crs1 = crs[:]

c0=crs1[0]
v = Vector.ByTwoPoints(c0.StartPoint,c0.EndPoint)
crs1.remove(c0)

res1 = crs1[:]
res2 = []
res2.append(c0)

for c in crs1:
	vc = Vector.ByTwoPoints(c.StartPoint,c.EndPoint)
	if v.IsParallel(vc):
		res2.append(c)
		res1.remove(c)

result =[]
res3 = []
res4 = []
res5 = []
for i in range(1,len(res1)):
	res3.append(res1[0].DoesIntersect(res1[i]))

for i in range(1,len(res2)):
	res4.append(res2[0].DoesIntersect(res2[i]))


if sum(res4) > sum(res3):
	res5=res1
else:
	res5=res2

for c in res5:
	result.append(c.StartPoint)
	result.append(c.EndPoint)

#Assign your output to the OUT variable.
OUT = result
# ----------------------------------------
code_block_19 = CodeBlock { 10; }
byCenterPointRadius_5 = Sphere.ByCenterPointRadius(centerPoint=python_script_14, radius=code_block_19)
boundingBox_5 = Element.BoundingBox(byCenterPointRadius_5)
toCuboid_5 = BoundingBox.ToCuboid(boundingBox_5)
python_script_15 = Python(IN[0]=toCuboid_5)
# ---------- python_script_15.python (20 lines) ----------
import clr
clr.AddReference('ProtoGeometry')
from Autodesk.DesignScript.Geometry import *
#The inputs to this node will be stored as a list in the IN variables.
dataEnteringNode = IN

elems = IN[0]
res = []
rest = elems[:]

for e in elems:	
	rest.remove(e)
	res.append(e)
	for er in rest:
		if er.DoesIntersect(e):
			res.remove(e)
		
			
#Assign your output to the OUT variable.
OUT = res
# ----------------------------------------
centroid = Solid.Centroid(python_script_15)
code_block_20 = CodeBlock(p=centroid) { p; }
cây_chống = CodeBlock { "Adt-Wedgelock-Sys of Post w Head U non Moduled-1 points"; }
byName_5 = FamilyType.ByName(cây_chống)
byPoints_5 = AdaptiveComponent.ByPoints(points=code_block_20, familyType=byName_5)
ZAxis_9 = Vector.ZAxis()
project_9 = Point.Project(code_block_20, code_block_3, ZAxis_9, lacing=Longest)
flatten_24 = Flatten(project_9)
byStartPointEndPoint_9 = Line.ByStartPointEndPoint(startPoint=code_block_20, endPoint=flatten_24)
length_9 = Curve.Length(byStartPointEndPoint_9)
round_9 = Math.Round(length_9)
code_block_21 = CodeBlock(adaptivecomponent1=byPoints_5, num2=round_9, num1=chiều_cao_chân)  # same code as code_block_6
python_script_16 = Python(IN[0]=flatten_23)  # frozen
# ---------- python_script_16.python (64 lines) ----------
import clr
clr.AddReference('ProtoGeometry')
from Autodesk.DesignScript.Geometry import *
#The inputs to this node will be stored as a list in the IN variables.
dataEnteringNode = IN

crs = IN[0]

crs1 = crs[:]

c0=crs1[0]
v = Vector.ByTwoPoints(c0.StartPoint,c0.EndPoint)
crs1.remove(c0)

res1 = crs1[:]
res2 = []
res2.append(c0)

for c in crs1:
	vc = Vector.ByTwoPoints(c.StartPoint,c.EndPoint)
	if v.IsParallel(vc):
		res2.append(c)
		res1.remove(c)

result =[]
res3 = []
res4 = []
res5 = []

for i in range(1,len(res1)):
	res3.append(res1[0].DoesIntersect(res1[i]))

for i in range(1,len(res2)):
	res4.append(res2[0].DoesIntersect(res2[i]))


if sum(res4) > sum(res3):
	res5=res1
else:
	res5=res2

c0 = res5[0]
res6 = res5[:]
res6.remove(c0)

pp=[]
pp.append(c0.PointAtParameter(0))
pp.append(c0.PointAtParameter(1))

for c in res6:
	for p in pp:
		if p.DoesIntersect(c):
			intP = p.Intersect(c)			
			result.append(intP)
			if intP.DoesIntersect(c.PointAtParameter(0)):
				result.append(c.PointAtParameter(1))
			else:
				result.append(c.PointAtParameter(0))
			res6.remove(c)
	


#Assign your output to the OUT variable.
OUT = result
# ----------------------------------------
reverse = Vector.Reverse()
startPoint_6 = Curve.StartPoint(flatten_23)  # frozen
endPoint_5 = Curve.EndPoint(flatten_23)  # frozen
byTwoPoints = Vector.ByTwoPoints(start=startPoint_6, end=endPoint_5)
normalized = Vector.Normalized(byTwoPoints)
asPoint = Vector.AsPoint(byTwoPoints)
create_10 = List.Create()
python_script_17 = Python(IN[0]=flatten_23)  # frozen
# ---------- python_script_17.python (62 lines) ----------
import clr
clr.AddReference('ProtoGeometry')
from Autodesk.DesignScript.Geometry import *

clr.AddReference('DSCoreNodes')
from DSCore.List import *
#The inputs to this node will be stored as a list in the IN variables.
dataEnteringNode = IN

crs = IN[0]

crs1 = crs[:]

c0=crs1[0]
v = Vector.ByTwoPoints(c0.StartPoint,c0.EndPoint)
crs1.remove(c0)

res1 = crs1[:]
res2 = []
res2.append(c0)

for c in crs1:
	vc = Vector.ByTwoPoints(c.StartPoint,c.EndPoint)
	if v.IsParallel(vc):
		res2.append(c)
		res1.remove(c)

result =[]
res3 = []
res4 = []
res5 = []
for i in range(1,len(res1)):
	res3.append(res1[0].DoesIntersect(res1[i]))

for i in range(1,len(res2)):
	res4.append(res2[0].DoesIntersect(res2[i]))


if sum(res4) > sum(res3):
	res5=res1
else:
	res5=res2

for c in res5:
	result.append(c.StartPoint)
	result.append(c.EndPoint)
	
ptst=[]
for c in res5:
	ptst.append(c.StartPoint)
	
pt0x = []	
for c in res5:
	pt0x.append(c.StartPoint.X)
sortPt0x = Sort(pt0x)

sortPtSt = SortByKey(ptst,sortPt0x)
#sortRes5 = SortByKey(res5,sortPtSt[0])


#Assign your output to the OUT variable.
OUT = res5
# ----------------------------------------
startPoint_7 = Curve.StartPoint(python_script_17)
X = Point.X(startPoint_7)
sortByKey = List.SortByKey(list=python_script_17, keys=X)
python_script_18 = Python(IN[0]=sortByKey.sorted_list)
# ---------- python_script_18.python (16 lines) ----------
import clr
clr.AddReference('ProtoGeometry')
from Autodesk.DesignScript.Geometry import *

clr.AddReference('DSCoreNodes')
from DSCore.List import *
#The inputs to this node will be stored as a list in the IN variables.
dataEnteringNode = IN
crs = IN[0]





#Assign your output to the OUT variable.
OUT = 0
# ----------------------------------------
