# Dynamo graph SetMarkParameter-OK.dyn (Dynamo 0.9.1.4062)

categories = Categories("StructuralColumns")
all_elements_of_category = ElementsOfCategory(categories)
true_x_axis_false_y_axis = BoolSelector(true)
boolean = BoolSelector(true)
eq = true_x_axis_false_y_axis == boolean
select_model_elements = DSModelElementsSelection()  # 4 picked in the model
start = Revit.Transaction.Transaction.Start(select_model_elements)
code_block = CodeBlock(e=start) { e; }
solids = Element.Solids(code_block)
flatten = Flatten(solids)
centroid = Solid.Centroid(flatten)
X = Point.X(centroid)
boolean_2 = BoolSelector(true)
sortIndexByValue = SortIndexByValue(X, boolean_2)
getItemAtIndex = List.GetItemAtIndex(list=code_block, index=sortIndexByValue)
Y = Point.Y(centroid)
boolean_3 = BoolSelector(false)
sortIndexByValue_2 = SortIndexByValue(Y, boolean_3)
getItemAtIndex_2 = List.GetItemAtIndex(list=code_block, index=sortIndexByValue_2)
if_ = If(test=eq, true=getItemAtIndex, false=getItemAtIndex_2)
code_block_2 = CodeBlock { "Mark"; }
integer_slider = IntegerSlider(50, range=0..100 step 1)
count = Count(code_block)
tiền_tố = StringInput("C")
hậu_tố = StringInput("")
code_block_3 = CodeBlock(c1=tiền_tố, c3=hậu_tố) { c1; c3; }
code_block_4 = CodeBlock(x=integer_slider, n=count, c1=code_block_3.c1, c3=hậu_tố) { a=x..n+x..1; c=c1+a+c3; }
setParameterByName = Element.SetParameterByName(element=if_, parameterName=code_block_2, value=code_block_4.c)
end = Revit.Transaction.Transaction.End(setParameterByName)
