# Dynamo graph SetParameter-OK.dyn (Dynamo 0.9.1.4062)

select_model_elements = DSModelElementsSelection()  # 2 picked in the model
code_block = CodeBlock(e=select_model_elements) { e; }  # frozen
code_block_2 = CodeBlock { "Mark"; }
integer_slider = IntegerSlider(4, range=0..100 step 1)
tiền_tố = StringInput("M")
hậu_tố = StringInput("")
code_block_3 = CodeBlock(s=integer_slider, t1=code_block, m1=tiền_tố, n=integer_slider, m2=hậu_tố) { s..Count(t1)+s..1; m = m1+n+m2; }
setParameterByName = Element.SetParameterByName(element=code_block, parameterName=code_block_2, value=code_block_3.m)
categories = Categories("StructuralFoundation")
all_elements_of_category = ElementsOfCategory(categories)
start = Revit.Transaction.Transaction.Start(all_elements_of_category)
code_block_4 = CodeBlock(e=start) { e; }
code_block_5 = CodeBlock { "Mark"; }
getParameterValueByName = Element.GetParameterValueByName(element=code_block_4, parameterName=code_block_5)
code_block_6 = CodeBlock()
# ---------- code_block_6.designscript (13 lines) ----------
list1={{"M1",1500,1500,300,600},
{"M1A",1500,1500,300,600},
{"M1C",1800,1800,300,600},
{"M2",2000,2000,300,600},
{"M2A",2000,2000,300,600},
{"M2B",2000,2000,300,600},
{"M3",2500,2500,300,600},
{"M3B",2500,2500,300,600},
{"M4",3500,3500,300,600},
{"M4A",3000,3000,300,600},
{"M5",2000,4200,300,600},
{"M5A",2000,4200,300,600},
{"M6",2000,4000,300,600}};
# ----------------------------------------
transpose = List.Transpose(code_block_6)
code_block_7 = CodeBlock { 0; 1; 2; 3; 4; }
code_block_8 = CodeBlock(t1=transpose, num1=code_block_7.out0, num2=code_block_7.out1, num3=code_block_7.out2, num4=code_block_7.out3, num5=code_block_7.out4)
# ---------- code_block_8.designscript (5 lines) ----------
List.GetItemAtIndex(t1, num1);
List.GetItemAtIndex(t1, num2);
List.GetItemAtIndex(t1, num3);
List.GetItemAtIndex(t1, num4);
List.GetItemAtIndex(t1, num5);
# ----------------------------------------
allIndicesOf = List.AllIndicesOf(list=getParameterValueByName, item=code_block_8.out0)
getItemAtIndex = List.GetItemAtIndex(list=code_block_4, index=allIndicesOf)
code_block_9 = CodeBlock(getItemAtIndex)
# ---------- code_block_9.designscript (11 lines) ----------
list1;
listTakeEvery = [Imperative]
{
 listA = {};
 r = 0..Count(list1)-1..1;
 for (i in r)
 {
  listA[i] =List.FirstItem(list1[i]);
 };
 return = listA;
};
# ----------------------------------------
type = FamilyInstance.Type(code_block_9.out1)
code_block_10 = CodeBlock { "Width"; "Length"; "a"; "Foundation Thickness"; }
setParameterByName_2 = Element.SetParameterByName(element=type, parameterName=code_block_10.out0, value=code_block_8.out1)
setParameterByName_3 = Element.SetParameterByName(element=type, parameterName=code_block_10.out1, value=code_block_8.out2)
setParameterByName_4 = Element.SetParameterByName(element=type, parameterName=code_block_10.out2, value=code_block_8.out3)
setParameterByName_5 = Element.SetParameterByName(element=type, parameterName=code_block_10.out3, value=code_block_8.out4)
create = List.Create(setParameterByName_2, setParameterByName_3, setParameterByName_4, setParameterByName_5)
end = Revit.Transaction.Transaction.End(create)
select_model_element = DSModelElementSelection()  # 1 picked in the model
type_2 = FamilyInstance.Type(select_model_element)
family = FamilyType.Family(type_2)
code_block_11 = CodeBlock(a=code_block_8.out0, b=code_block_8.out1, c=code_block_8.out2, d=code_block_8.out3, e=code_block_8.out4) { a+"-"+b+"x"+c+"("+d+"-"+e+")"; }
python_script = Python(IN[0]=family, IN[1]=code_block_11)
# ---------- python_script.python (35 lines) ----------
import clr
clr.AddReference('RevitAPI')
from Autodesk.Revit.DB import *

clr.AddReference("RevitNodes")
import Revit
clr.ImportExtensions(Revit.Elements)

clr.AddReference("RevitServices")
import RevitServices
from RevitServices.Persistence import DocumentManager
from RevitServices.Transactions import TransactionManager

doc = DocumentManager.Instance.CurrentDBDocument
family = UnwrapElement(IN[0])
newNames = IN[1]

nameInList = list()
failedNameList = []
initialSymbolNames = [n.get_Parameter(BuiltInParameter.SYMBOL_NAME_PARAM).AsString() for n in list(family.Symbols)]

TransactionManager.Instance.EnsureInTransaction(doc)
for name in newNames:
	try:
		if name in initialSymbolNames:
			nameInList.append(name)
		else:
			newsym = list(family.Symbols)[0].Duplicate(name)
			nameInList.append(name)
	except BaseException as E:
		failedNameList.append(E[0])
TransactionManager.Instance.TransactionTaskDone()

OUT = [initialSymbolNames, nameInList, failedNameList]
#OUT = nameInList
# ----------------------------------------
python_script_2 = Python(IN[0]=family, IN[1]=code_block_11)
# ---------- python_script_2.python (24 lines) ----------
import clr
clr.AddReference('RevitAPI')
from Autodesk.Revit.DB import *

clr.AddReference("RevitNodes")
import Revit
clr.ImportExtensions(Revit.Elements)

clr.AddReference("RevitServices")
import RevitServices
from RevitServices.Persistence import DocumentManager
from RevitServices.Transactions import TransactionManager

doc = DocumentManager.Instance.CurrentDBDocument
family = UnwrapElement(IN[0])
newNames = IN[1]

nameInList = list()
failedNameList = []
famSymIDs = family.GetFamilySymbolIds()

aa = FamilySymbolFilter.PassesFilter(doc,ElementId(famSymIDs[2]))
	
OUT = aa
# ----------------------------------------
name = Family.Name()
types = Family.Types()
