# Dynamo graph DuplicateWithDetailingByAllPhasesAndPlacingToSheet-0901-180111-OK.dyn (Dynamo 0.9.1.4062)

# group: Get all Phases
get_phases = Python()
# ---------- get_phases.python (45 lines) ----------
#import libraries and reference
import clr
clr.AddReference('ProtoGeometry')
from Autodesk.DesignScript.Geometry import *
clr.AddReference('RevitAPI')
from Autodesk.Revit.DB import *
clr.AddReference('RevitAPIUI')
from Autodesk.Revit.UI import TaskDialog
clr.AddReference("RevitNodes")
import Revit
clr.ImportExtensions(Revit.Elements)
# Import geometry conversion extension methods
clr.ImportExtensions(Revit.GeometryConversion)
# Import DocumentManager and TransactionManager
clr.AddReference("RevitServices")
import RevitServices
from RevitServices.Persistence import DocumentManager
from RevitServices.Transactions import TransactionManager
from System.Collections.Generic import *


doc = DocumentManager.Instance.CurrentDBDocument
uiapp = DocumentManager.Instance.CurrentUIApplication
app = uiapp.Application
#The inputs to this node will be stored as a list in the IN variables.
dataEnteringNode = IN

elems = list()
elemName = list()
elemDes = list()

for phase in doc.Phases:
	elems.append(phase)
	elemName.append(phase.Name)


# Start Transaction
TransactionManager.Instance.EnsureInTransaction(doc)

# End Transaction
TransactionManager.Instance.TransactionTaskDone()
doc.Regenerate()

#Assign your output to the OUT variable.
OUT = elems
# ----------------------------------------
parameters = Element.Parameters(get_phases)
code_block = CodeBlock { "Sequence Number"; "Name"; }
getParameterValueByName = Element.GetParameterValueByName(element=get_phases, parameterName=code_block.out0)
boolean = BoolSelector(true)
sortIndexByValue = SortIndexByValue(getParameterValueByName, boolean)
getItemAtIndex = List.GetItemAtIndex(list=get_phases, index=sortIndexByValue)
getParameterValueByName_2 = Element.GetParameterValueByName(element=get_phases, parameterName=code_block.out1)

current = Document.Current()
activeView = Document.ActiveView(current)
count = Count(getItemAtIndex)

# group: Inputting
# note: 1. Tạo 1 sheet mới
# 2. Place view muốn Duplicate vào Sheet
# 3. Active vào trong Viewport = double click vô view
# 4. Inputting
# 5. Run
tiền_tố_cho_view_name = StringInput("3D_")
tiền_tố_cho_sheet_number = StringInput("S_")

code_block_2 = CodeBlock(n=count) { 1..n..1; }

# group: Duplicate View and set Parameter
duplicate_views_w_detailing = Python(IN[0]=activeView, IN[1]=count)
# ---------- duplicate_views_w_detailing.python (45 lines) ----------
import clr
clr.AddReference('ProtoGeometry')
from Autodesk.DesignScript.Geometry import *
clr.AddReference('RevitAPI')
from Autodesk.Revit.DB import *
clr.AddReference('RevitAPIUI')
from Autodesk.Revit.UI import TaskDialog
clr.AddReference("RevitNodes")
import Revit
clr.ImportExtensions(Revit.Elements)
clr.AddReference("RevitServices")
import RevitServices
from RevitServices.Persistence import DocumentManager
from RevitServices.Transactions import TransactionManager
from System.Collections.Generic import *
#The inputs to this node will be stored as a list in the IN variables.
dataEnteringNode = IN

doc = DocumentManager.Instance.CurrentDBDocument
uiapp = DocumentManager.Instance.CurrentUIApplication
app = uiapp.Application


cView = UnwrapElement(IN[0])
aV = IN[1]
newViews = []
nvId=[]
dOp = ViewDuplicateOption.WithDetailing

# Start Transaction
TransactionManager.Instance.EnsureInTransaction(doc)

for i in range(0,aV):
	idV=cView.Duplicate(dOp)
	nvId.append(idV)
	
for j in range(0,len(nvId)):
	nV = cView.Document.GetElement(nvId[j])
	newViews.append(nV)

# End Transaction
TransactionManager.Instance.TransactionTaskDone()
doc.Regenerate()
#Assign your output to the OUT variable.
OUT = newViews
# ----------------------------------------
code_block_3 = CodeBlock { "View Name"; "Phase"; }
code_block_4 = CodeBlock(sf=tiền_tố_cho_view_name, mf=code_block_2, pf=getParameterValueByName_2) { sf+"_"+mf+"_"+pf; pf; }
setParameterByName = Element.SetParameterByName(element=duplicate_views_w_detailing, parameterName=code_block_3.out0, value=code_block_4.out0)
setParameterByName_2 = Element.SetParameterByName(element=setParameterByName, parameterName=code_block_3.out1, value=getItemAtIndex)

get_sheet_containing_view = Python(IN[0]=activeView)
# ---------- get_sheet_containing_view.python (63 lines) ----------
#import libraries and reference
import clr

clr.AddReference('ProtoGeometry')
from Autodesk.DesignScript.Geometry import *

clr.AddReference('RevitAPI')
from Autodesk.Revit.DB import *
from Autodesk.Revit.DB import ElementId

clr.AddReference('RevitAPIUI')
from Autodesk.Revit.UI import TaskDialog

clr.AddReference("RevitNodes")
import Revit
clr.ImportExtensions(Revit.Elements)


# Import geometry conversion extension methods
clr.ImportExtensions(Revit.GeometryConversion)


# Import DocumentManager and TransactionManager

clr.AddReference("RevitServices")
import RevitServices
from RevitServices.Persistence import DocumentManager
from RevitServices.Transactions import TransactionManager
from System.Collections.Generic import *


doc = DocumentManager.Instance.CurrentDBDocument
uiapp = DocumentManager.Instance.CurrentUIApplication
app = uiapp.Application

#The inputs to this node will be stored as a list in the IN variables.
dataEnteringNode = IN
view = UnwrapElement(IN[0])

# View Id
viewId = view.Id

# get all sheet
sheets = FilteredElementCollector(doc).OfClass(ViewSheet)

vpIds = list() # object List
sheetResult = [] # object Null
for sheet in sheets:
	vpId = sheet.GetAllPlacedViews()
	
	vpIds.append(vpId)
	
	for i in vpIds:
		for ii in i:
			if viewId == ii:
				sheetResult = sheet
			break
				

# Viewports ID on sheet


OUT = sheetResult, viewId
# ----------------------------------------
code_block_5 = CodeBlock(a=get_sheet_containing_view) { a[0]; }
chọn_thư_viện_khung_tên = FamilyTypes("A3 PRESENT:A3 PRESENT")

# group: Create New Sheets
code_block_6 = CodeBlock(shsf=tiền_tố_cho_sheet_number, n=code_block_2, pf=getParameterValueByName_2) { shsf+n; pf; }
byNameNumberTitleBlockAndView = Sheet.ByNameNumberTitleBlockAndView(sheetName=code_block_6.pf, sheetNumber=code_block_6.out0, titleBlockFamilyType=chọn_thư_viện_khung_tên, view=activeView)

# group: Placing Views to Sheet
get_the_start_view_location = Python(IN[0]=code_block_5, IN[1]=byNameNumberTitleBlockAndView, IN[2]=duplicate_views_w_detailing)
# ---------- get_the_start_view_location.python (91 lines) ----------
#import libraries and reference
import clr

clr.AddReference('ProtoGeometry')
from Autodesk.DesignScript.Geometry import *

clr.AddReference('RevitAPI')
from Autodesk.Revit.DB import *
from Autodesk.Revit.DB import ElementId

clr.AddReference('RevitAPIUI')
from Autodesk.Revit.UI import TaskDialog

clr.AddReference("RevitNodes")
import Revit
clr.ImportExtensions(Revit.Elements)


# Import geometry conversion extension methods
clr.ImportExtensions(Revit.GeometryConversion)


# Import DocumentManager and TransactionManager

clr.AddReference("RevitServices")
import RevitServices
from RevitServices.Persistence import DocumentManager
from RevitServices.Transactions import TransactionManager
from System.Collections.Generic import *


doc = DocumentManager.Instance.CurrentDBDocument
uiapp = DocumentManager.Instance.CurrentUIApplication
app = uiapp.Application

#The inputs to this node will be stored as a list in the IN variables.
dataEnteringNode = IN
sheet = UnwrapElement(IN[0])

newSheets = UnwrapElement(IN[1])
newViews = UnwrapElement(IN[2])


# Xac đinh vi tri Viewport
viewportIds = list()
viewportIds = sheet.GetAllViewports()
vpId = sheet.GetAllPlacedViews()
elZero = doc.GetElement(viewportIds[0])
bdb = elZero.get_BoundingBox(sheet)

xyzPos = (bdb.Max + bdb.Min)/2;
xPos = xyzPos.X
yPos = xyzPos.Y
zPos = xyzPos.Z

#Id NewSheet và Newview
nsIds = list()
nvIds = list()

for ns in newSheets:
	nsIds.append(ns.Id)
for nv in newViews:
	nvIds.append(nv.Id)

newViewports = list()

# Start Transaction
TransactionManager.Instance.EnsureInTransaction(doc)
try:
	# Xóa viewport trong sheet neu co
	for vs in newSheets:
		vps = vs.GetAllViewports()		
		for vp in vps:
			vpe = doc.GetElement(vp)
			vs.DeleteViewport(vpe)		
	
	for i in range(0,len(nsIds)):
		vp = Viewport.Create(doc,nsIds[i],nvIds[i],xyzPos)
		newViewports.append(vp)
except:
	pass

# End Transaction
TransactionManager.Instance.TransactionTaskDone()
doc.Regenerate()

#Assign your output to the OUT variable.

#OUT = xPos,yPos,zPos

OUT = "OK",newViewports
# ----------------------------------------
