# Dynamo graph ReLocateViewport by Saved Position info 0901 180510-OK.dyn (Dynamo 0.9.1.4062)

# note: --> Run -->
file_path = Filename("R:\BimESC\01_PROJECTS\HAR-HOI AN PEARL\05-Wip\02-Model\DYN\xyz.csv")
# note: 1
# note: Guide:
# ## Only use for VIEWPORT, posible to Multi task
# ## Process
# 1 --> Run  --> 2 --> Run
select_viewport_to_get_location = DSModelElementSelection()  # "Select viewport to get Location on sheet"; 1 picked in the model
python_script = Python(IN[0]=select_viewport_to_get_location)
# ---------- python_script.python (35 lines) ----------
import clr
clr.AddReference('ProtoGeometry')
from Autodesk.DesignScript.Geometry import *
clr.AddReference('RevitAPI')
from Autodesk.Revit.DB import *
from Autodesk.Revit.DB import ElementId
from Autodesk.Revit.DB import ViewSheet
from Autodesk.Revit.DB import Viewport
clr.AddReference('RevitAPIUI')
from Autodesk.Revit.UI import TaskDialog
clr.AddReference("RevitNodes")
import Revit
clr.ImportExtensions(Revit.Elements)
clr.ImportExtensions(Revit.GeometryConversion)

clr.AddReference("RevitServices")
import RevitServices
from RevitServices.Persistence import DocumentManager
from RevitServices.Transactions import TransactionManager
from System.Collections.Generic import *

doc = DocumentManager.Instance.CurrentDBDocument
uiapp = DocumentManager.Instance.CurrentUIApplication
app = uiapp.Application
#The inputs to this node will be stored as a list in the IN variables.
dataEnteringNode = IN
viewport = UnwrapElement(IN[0])

sheet = doc.GetElement(viewport.SheetId)

bdbox = viewport.get_BoundingBox(sheet)

positions= (bdbox.Max + bdbox.Min)/2
#Assign your output to the OUT variable.
OUT = positions.X,positions.Y,positions.Z
# ----------------------------------------
writeToFile = CSV.WriteToFile(file_path, python_script)
fromPath = FileObject(file_path)  # "File.FromPath"
readFromFile = CSV.ReadFromFile(fromPath)
flatten = Flatten(readFromFile)
# note: 2
# note: Run
# note: --> Run
select_viewport_to_move = DSModelElementSelection()  # 1 picked in the model
start = Revit.Transaction.Transaction.Start(select_viewport_to_move)
python_script_2 = Python(IN[0]=flatten, IN[1]=start)
# ---------- python_script_2.python (59 lines) ----------
import clr
clr.AddReference('ProtoGeometry')
from Autodesk.DesignScript.Geometry import *
clr.AddReference('RevitAPI')
from Autodesk.Revit.DB import *
from Autodesk.Revit.Creation import *
clr.AddReference('RevitAPIUI')
from Autodesk.Revit.UI import TaskDialog
clr.AddReference("RevitNodes")
import Revit
clr.ImportExtensions(Revit.Elements)
clr.ImportExtensions(Revit.GeometryConversion)

clr.AddReference("RevitServices")
import RevitServices
from RevitServices.Persistence import DocumentManager
from RevitServices.Transactions import TransactionManager
from System.Collections.Generic import *

doc = DocumentManager.Instance.CurrentDBDocument
uiapp = DocumentManager.Instance.CurrentUIApplication
app = uiapp.Application
#The inputs to this node will be stored as a list in the IN variables.
dataEnteringNode = IN
pos = IN[0]
viewport = UnwrapElement(IN[1])


x1 = pos[0]
y1 = pos[1]
z1 = pos[2]

sheet = doc.GetElement(viewport.SheetId)
bdbox = viewport.get_BoundingBox(sheet)
positions= (bdbox.Max + bdbox.Min)/2
x2 = positions.X
y2 = positions.Y
z2 = positions.Z


#vpid = viewport.Id
#xyz = app.Create.NewXYZ(x1,y1,z1)
loc = viewport.Location
xyz = app.Create.NewXYZ(x1-x2,y1-y2,z1)

# Start Transaction
TransactionManager.Instance.EnsureInTransaction(doc)
try:
	#MoveElement(doc, vpid, xyz)
	newloc = loc.Move(xyz)
except:
	pass
 
# End Transaction
TransactionManager.Instance.TransactionTaskDone()
doc.Regenerate()

#Assign your output to the OUT variable.
OUT = newloc
# ----------------------------------------
end = Revit.Transaction.Transaction.End(python_script_2)
