# Dynamo graph Viewport_ChangeTypeToNewTypeThenDelete-0901-180320-ok.dyn (Dynamo 0.9.1.4062)

delete_type_yes_true = BoolSelector(true)
change_to = DSModelElementSelection()
be_changed = DSModelElementSelection()  # 1 picked in the model
python_script = Python(IN[0]=change_to, IN[1]=be_changed)
# ---------- python_script.python (82 lines) ----------
import clr
clr.AddReference('ProtoGeometry')
from Autodesk.DesignScript.Geometry import *
clr.AddReference('RevitAPI')
from Autodesk.Revit.DB import *
clr.AddReference('RevitAPIUI')
from Autodesk.Revit.UI import TaskDialog
clr.AddReference("RevitNodes")
import Revit
clr.ImportExtensions(Revit.Elements)
clr.AddReference("RevitServices")
import RevitServices
from RevitServices.Persistence import DocumentManager
from RevitServices.Transactions import TransactionManager
from System.Collections.Generic import *
clr.ImportExtensions(Revit.GeometryConversion)

doc = DocumentManager.Instance.CurrentDBDocument
uiapp = DocumentManager.Instance.CurrentUIApplication
app = uiapp.Application

import sys
import System

#The inputs to this node will be stored as a list in the IN variables.
dataEnteringNode = IN
sampeVp = UnwrapElement(IN[0])
bechangedVp = UnwrapElement(IN[1])

allCurrentSheets = FilteredElementCollector(doc).OfClass(ViewSheet).WhereElementIsNotElementType().ToElements()


allvpids = []
viewports=[]
typeIds = []
elemTypeS=[]
typenames = []

validtypes= []

resultviewports = []

sampleVPid = sampeVp.GetTypeId()
bechangedVPid = bechangedVp.GetTypeId()

listBechangedVPid = []
listBechangedVPid.append(bechangedVPid)

beDelVPId = listBechangedVPid[:]
 
for sheet in allCurrentSheets:
	vpIds = sheet.GetAllViewports()
	allvpids.append(vpIds)
for vpids in allvpids:
	for id in vpids:
		viewport = doc.GetElement(id)
		viewports.append(viewport)
		
for vp in viewports:
	typeId = vp.GetTypeId()
	typeIds.append(typeId)
for id in typeIds:
	elem = doc.GetElement(id)
	elemTypeS.append(elem)
	
#define a transaction variable and describe the transactio
# Start Transaction
TransactionManager.Instance.EnsureInTransaction(doc)
try:
	for vp in viewports:
		if vp.GetTypeId() == bechangedVPid:
			resultviewports.append(vp)
			vp.ChangeTypeId(sampleVPid)
except:
	pass
# End Transaction
TransactionManager.Instance.TransactionTaskDone()
doc.Regenerate()

result = "Number of Changed Viewport Types: "+len(resultviewports).ToString()
#Assign your output to the OUT variable.
OUT = result, beDelVPId
# ----------------------------------------
python_script_2 = Python(IN[0]=delete_type_yes_true, IN[1]=python_script)
# ---------- python_script_2.python (44 lines) ----------
import clr
clr.AddReference('ProtoGeometry')
from Autodesk.DesignScript.Geometry import *
clr.AddReference('RevitAPI')
from Autodesk.Revit.DB import *
clr.AddReference('RevitAPIUI')
from Autodesk.Revit.UI import TaskDialog
clr.AddReference("RevitNodes")
import Revit
clr.ImportExtensions(Revit.Elements)
clr.AddReference("RevitServices")
import RevitServices
from RevitServices.Persistence import DocumentManager
from RevitServices.Transactions import TransactionManager
from System.Collections.Generic import *
clr.ImportExtensions(Revit.GeometryConversion)

doc = DocumentManager.Instance.CurrentDBDocument
uiapp = DocumentManager.Instance.CurrentUIApplication
app = uiapp.Application

import sys
import System

#The inputs to this node will be stored as a list in the IN variables.
dataEnteringNode = IN
boolDel = IN[0]
bechangedVPid = IN[1]
	
#define a transaction variable and describe the transactio
# Start Transaction
TransactionManager.Instance.EnsureInTransaction(doc)
try:
	if boolDel:
		doc.Delete(bechangedVPid[1][0])
except:
	pass
# End Transaction
TransactionManager.Instance.TransactionTaskDone()
doc.Regenerate()

result = "ok"
#Assign your output to the OUT variable.
OUT = result
# ----------------------------------------
watch = Watch(python_script)
get_all_view_class = Python()
# ---------- get_all_view_class.python (32 lines) ----------
import clr
clr.AddReference('ProtoGeometry')
from Autodesk.DesignScript.Geometry import *
clr.AddReference('RevitAPI')
from Autodesk.Revit.DB import *
clr.AddReference('RevitAPIUI')
from Autodesk.Revit.UI import TaskDialog
clr.AddReference("RevitNodes")
import Revit
clr.ImportExtensions(Revit.Elements)
clr.AddReference("RevitServices")
import RevitServices
from RevitServices.Persistence import DocumentManager
from RevitServices.Transactions import TransactionManager
from System.Collections.Generic import *
clr.ImportExtensions(Revit.GeometryConversion)

doc = DocumentManager.Instance.CurrentDBDocument
uiapp = DocumentManager.Instance.CurrentUIApplication
app = uiapp.Application

import sys
import System

#The inputs to this node will be stored as a list in the IN variables.
dataEnteringNode = IN

result = FilteredElementCollector(doc).OfClass(View)


#Assign your output to the OUT variable.
OUT = result
# ----------------------------------------
get_type_id = Python(IN[0]=get_all_view_class)
# ---------- get_type_id.python (36 lines) ----------
import clr
clr.AddReference('ProtoGeometry')
from Autodesk.DesignScript.Geometry import *
clr.AddReference('RevitAPI')
from Autodesk.Revit.DB import *
clr.AddReference('RevitAPIUI')
from Autodesk.Revit.UI import TaskDialog
clr.AddReference("RevitNodes")
import Revit
clr.ImportExtensions(Revit.Elements)
clr.AddReference("RevitServices")
import RevitServices
from RevitServices.Persistence import DocumentManager
from RevitServices.Transactions import TransactionManager
from System.Collections.Generic import *
clr.ImportExtensions(Revit.GeometryConversion)

doc = DocumentManager.Instance.CurrentDBDocument
uiapp = DocumentManager.Instance.CurrentUIApplication
app = uiapp.Application

import sys
import System

#The inputs to this node will be stored as a list in the IN variables.
dataEnteringNode = IN

viewelems = UnwrapElement(IN[0])

result=[]
for elem in viewelems:
	result.append(doc.GetElement(elem.GetTypeId()))


#Assign your output to the OUT variable.
OUT = result
# ----------------------------------------
create = List.Create(be_changed)  # frozen
get_type_id_2 = Python(IN[0]=create)
# ---------- get_type_id_2.python (36 lines) ----------
import clr
clr.AddReference('ProtoGeometry')
from Autodesk.DesignScript.Geometry import *
clr.AddReference('RevitAPI')
from Autodesk.Revit.DB import *
clr.AddReference('RevitAPIUI')
from Autodesk.Revit.UI import TaskDialog
clr.AddReference("RevitNodes")
import Revit
clr.ImportExtensions(Revit.Elements)
clr.AddReference("RevitServices")
import RevitServices
from RevitServices.Persistence import DocumentManager
from RevitServices.Transactions import TransactionManager
from System.Collections.Generic import *
clr.ImportExtensions(Revit.GeometryConversion)

doc = DocumentManager.Instance.CurrentDBDocument
uiapp = DocumentManager.Instance.CurrentUIApplication
app = uiapp.Application

import sys
import System

#The inputs to this node will be stored as a list in the IN variables.
dataEnteringNode = IN

viewelems = UnwrapElement(IN[0])

result=[]
elemTypes = []
for elem in viewelems:
	result.append(doc.GetElement(elem.GetTypeId()).CanBeDeleted)

#Assign your output to the OUT variable.
OUT = result
# ----------------------------------------
