# Dynamo graph Viewport_ChangeType_to1Type-0901-180320-OK.dyn (Dynamo 0.9.1.4062)

select_sample_viewport_with_type = DSModelElementSelection()  # 1 picked in the model
python_script = Python(IN[0]=select_sample_viewport_with_type)
# ---------- python_script.python (72 lines) ----------
import clr
clr.AddReference('ProtoGeometry')
from Autodesk.DesignScript.Geometry import *
clr.AddReference('RevitAPI')
from Autodesk.Revit.DB import *
clr.AddReference('RevitAPIUI')
from Autodesk.Revit.UI import TaskDialog
clr.AddReference("RevitNodes")
import Revit
clr.ImportExtensions(Revit.Elements)
clr.AddReference("RevitServices")
import RevitServices
from RevitServices.Persistence import DocumentManager
from RevitServices.Transactions import TransactionManager
from System.Collections.Generic import *
clr.ImportExtensions(Revit.GeometryConversion)

doc = DocumentManager.Instance.CurrentDBDocument
uiapp = DocumentManager.Instance.CurrentUIApplication
app = uiapp.Application

import sys
import System

#The inputs to this node will be stored as a list in the IN variables.
dataEnteringNode = IN
sampeVp = UnwrapElement(IN[0])

allCurrentSheets = FilteredElementCollector(doc).OfClass(ViewSheet).WhereElementIsNotElementType().ToElements()


allvpids = []
viewports=[]
typeIds = []
elemTypeS=[]
typenames = []

validtypes= []

sampleVPid = sampeVp.GetTypeId()

for sheet in allCurrentSheets:
	vpIds = sheet.GetAllViewports()
	allvpids.append(vpIds)
for vpids in allvpids:
	for id in vpids:
		viewport = doc.GetElement(id)
		viewports.append(viewport)
		
for vp in viewports:
	typeId = vp.GetTypeId()
	typeIds.append(typeId)
for id in typeIds:
	elem = doc.GetElement(id)
	elemTypeS.append(elem)
	
#define a transaction variable and describe the transactio
# Start Transaction
TransactionManager.Instance.EnsureInTransaction(doc)
try:
	for vp in viewports:
		if not vp.GetTypeId() == sampleVPid:
			vp.ChangeTypeId(sampleVPid)
except:
	pass
# End Transaction
TransactionManager.Instance.TransactionTaskDone()
doc.Regenerate()

result = "OK"
#Assign your output to the OUT variable.
OUT = viewports
# ----------------------------------------
