# Dynamo graph Hide Revision By Name.dyn (Dynamo 0.9.1.4062)

revision = StringInput("Seq. 1 - Revision 1")
filter_needed_rev_clouds = Python(IN[0]=revision)
# ---------- filter_needed_rev_clouds.python (61 lines) ----------
import clr
clr.AddReference('ProtoGeometry')
from Autodesk.DesignScript.Geometry import *
clr.AddReference('RevitAPI')
from Autodesk.Revit.DB import *
clr.AddReference('RevitAPIUI')
from Autodesk.Revit.UI import TaskDialog
clr.AddReference("RevitNodes")
import Revit
clr.ImportExtensions(Revit.Elements)
clr.AddReference("RevitServices")
import RevitServices
from RevitServices.Persistence import DocumentManager
from RevitServices.Transactions import TransactionManager
from System.Collections.Generic import *
clr.ImportExtensions(Revit.GeometryConversion)
 
doc = DocumentManager.Instance.CurrentDBDocument
uiapp = DocumentManager.Instance.CurrentUIApplication
app = uiapp.Application
 
import sys
import System

#The inputs to this node will be stored as a list in the IN variables.
dataEnteringNode = IN

hidName = IN[0]

revClouds = FilteredElementCollector(doc).OfClass(RevisionCloud).WhereElementIsNotElementType()

res = []

revnames=[]
for c in revClouds:
	rn = doc.GetElement(c.RevisionId).Name
	revnames.append(rn)
	if rn == hidName:
		res.append(c)

ownvs=[]	
for r in res:
	ownvs.append(doc.GetElement(r.OwnerViewId))


# Start Transaction
TransactionManager.Instance.EnsureInTransaction(doc)
try:
	for i in range(len(res)):
		ownvs[i].HideElementTemporary(res[i].Id)

except:
    pass
 
# End Transaction
TransactionManager.Instance.TransactionTaskDone()
doc.Regenerate()


#Assign your output to the OUT variable.
OUT = res,ownvs
# ----------------------------------------
watch = Watch(filter_needed_rev_clouds)
