# Dynamo graph PLACE PILE FROM CAD DATA XYZ - 190315.dyn (Dynamo 0.9.1.4062)

file_path = Filename("R:\BimESC\01_PROJECTS\BIG1903_BIG C QUANG NGAI (MAIN BUILDING)\05-Wip\01-Cad\DATA PILE P2.xls")
fromPath = FileObject(file_path)  # "File.FromPath"
code_block = CodeBlock { "Summary"; }
boolean = BoolSelector(false)
readFromFile = Excel.ReadFromFile(file=fromPath, sheetName=code_block, readAsStrings=boolean)
transpose = List.Transpose(readFromFile)
code_block_2 = CodeBlock(list=transpose) { listX = list[2]; listY = list[3]; }
deconstruct = List.Deconstruct(list=code_block_2.listX)
toNumber = String.ToNumber(deconstruct.rest)
x_translate = DoubleInput(5054308.355)
add = toNumber + x_translate
deconstruct_2 = List.Deconstruct(list=code_block_2.listY)
toNumber_2 = String.ToNumber(deconstruct_2.rest)
y_translate = DoubleInput(-285718.482)
add_2 = toNumber_2 + y_translate
code_block_3 = CodeBlock(listX=add, listY=add_2) { listX; listY; }
code_block_4 = CodeBlock { 0; }
byCoordinates = Point.ByCoordinates(x=code_block_3.listX, y=code_block_3.listY, z=code_block_4)
code_block_5 = CodeBlock(test=byCoordinates) { test[1]; }
family_name = StringInput("D300-18m")
byName = FamilyType.ByName(family_name)
levels = Levels("0.FDL")
byPointAndLevel = FamilyInstance.ByPointAndLevel(familyType=byName, point=byCoordinates, level=levels)
offset_from_level = DoubleInput(0)
