# Dynamo graph EXTRACT CONCRETE STRUC DATA 901.dyn (Dynamo 0.9.1.4062)

select_model_elements = DSModelElementsSelection()  # 5 picked in the model
thu_tu_uu_tien = CodeBlock { p1; p2; p3; p4; }
categories = Categories("StructuralFoundation")  # frozen
categories_2 = Categories("StructuralColumns")  # frozen
categories_3 = Categories("StructuralFraming")  # frozen
categories_4 = Categories("Floors")  # frozen
thu_tu_uu_tien_2 = CodeBlock(p1=categories, p2=categories_2, p3=categories_3, p4=categories_4) { p1; p2; p3; p4; }
string = StringInput("OST_StructuralColumns")
byName = Category.ByName(string)
all_elements_of_category = ElementsOfCategory(byName)
string_2 = StringInput("OST_StructuralFraming")
byName_2 = Category.ByName(string_2)
all_elements_of_category_2 = ElementsOfCategory(byName_2)
string_3 = StringInput("OST_Floors")
byName_3 = Category.ByName(string_3)
all_elements_of_category_3 = ElementsOfCategory(byName_3)
select_model_element = DSModelElementSelection()  # 1 picked in the model
parameters = Element.Parameters(select_model_element)
watch = Watch(parameters)
location = FamilyInstance.Location(select_model_element)
watch_2 = Watch(location)
facingOrientation = FamilyInstance.FacingOrientation(select_model_element)
watch_3 = Watch(facingOrientation)
location_2 = StructuralFraming.Location(select_model_element)
curves = Element.Curves(select_model_element)
string_4 = StringInput("OST_StructuralFoundation")
byName_4 = Category.ByName(string_4)
all_elements_of_category_4 = ElementsOfCategory(byName_4)
column_location = Python(IN[0]=all_elements_of_category_4)
# ---------- column_location.python (23 lines) ----------
import clr
clr.AddReference('ProtoGeometry')
from Autodesk.DesignScript.Geometry import *
clr.AddReference('RevitAPI')
from Autodesk.Revit.DB import *
#The inputs to this node will be stored as a list in the IN variables.
dataEnteringNode = IN

cols = UnwrapElement(IN[0])
results = []
#if listcount = 1

#if listcount > 1
for i in range(len(cols)):
	loc = cols[i].Location.Point
	xyz = []
	xyz.append(loc.X*304.8)
	xyz.append(loc.Y*304.8)
	xyz.append(loc.Z*304.8)
	results.append(xyz)

#Assign your output to the OUT variable.
OUT = results
# ----------------------------------------
