# Dynamo graph Graph Curve For FACADE.dyn (Dynamo 0.9.1.4062)

select_model_element = DSModelElementSelection()  # 1 picked in the model
code_block = CodeBlock()
# ---------- code_block.designscript (15 lines) ----------
{"x101",
"x102",
"x103",
"x104",
"x105",
"x201",
"x202",
"x203",
"x204",
"x205",
"x301",
"x302",
"x303",
"x304",
"x305"};
# ----------------------------------------
vertex_offset = CodeBlock { v1=50000; v2=v1; v3=40000; v4=v1; v5=v3; }
tower_length = CodeBlock { twl = 26000; }
code_block_2 = CodeBlock(num1=vertex_offset.v1, num2=tower_length)
# ---------- code_block_2.designscript (6 lines) ----------
v = num1;
twl = num2;
x1 = ((v - twl) / 2) + twl;
x2 = ((x1 - twl) / 2) + twl;
x3 = ((x2 - twl) / 2) + twl;
t1 = {x1, x2, x3};
# ----------------------------------------
code_block_3 = CodeBlock(num1=vertex_offset.v2, num2=tower_length)  # same code as code_block_2
code_block_4 = CodeBlock(num1=vertex_offset.v3, num2=tower_length)  # same code as code_block_2
code_block_5 = CodeBlock(num1=vertex_offset.v4, num2=tower_length)  # same code as code_block_2
code_block_6 = CodeBlock(num1=vertex_offset.v5, num2=tower_length)  # same code as code_block_2
create = List.Create(code_block_2.t1, code_block_3.t1, code_block_4.t1, code_block_5.t1, code_block_6.t1)
transpose = List.Transpose(create)
flatten = Flatten(transpose)
setParameterByName = Element.SetParameterByName(element=select_model_element, parameterName=code_block, value=flatten)  # frozen
code_block_7 = CodeBlock()
# ---------- code_block_7.designscript (3 lines) ----------
{"y1",
"y2",
"y3"};
# ----------------------------------------
ratio = CodeBlock { a = 30000000; }
height = CodeBlock { htwt = 80000; hpd = 20000; }
code_block_8 = CodeBlock(a=ratio, x=code_block_2.x1, twl=tower_length, hpd=height.hpd) { y = a*(1/(x-twl))+hpd; }
code_block_9 = CodeBlock(a=ratio, x=code_block_2.x2, twl=tower_length, hpd=height.hpd) { y = a*(1/(x-twl))+hpd; }
code_block_10 = CodeBlock(a=ratio, x=code_block_2.x3, twl=tower_length, hpd=height.hpd) { y = a*(1/(x-twl))+hpd; }
create_2 = List.Create(code_block_8, code_block_9, code_block_10)
setParameterByName_2 = Element.SetParameterByName(element=select_model_element, parameterName=code_block_7, value=create_2)  # frozen
watch = Watch(code_block_8)
watch_2 = Watch(code_block_9)
watch_3 = Watch(code_block_10)
python_script = Python(IN[0]=select_model_element, IN[1]=code_block, IN[2]=flatten)
# ---------- python_script.python (30 lines) ----------
import clr
clr.AddReference('ProtoGeometry')
from Autodesk.DesignScript.Geometry import *
clr.AddReference('RevitNodes')
from Revit.Elements import *
clr.AddReference('RevitServices')
from RevitServices.Persistence import DocumentManager
from RevitServices.Transactions import TransactionManager
#The inputs to this node will be stored as a list in the IN variables.
dataEnteringNode = IN

elem = IN[0]
list1 = IN[1]#Param names
list2 = IN[2]#Values

doc = DocumentManager.Instance.CurrentDBDocument
uiapp = DocumentManager.Instance.CurrentUIApplication
app = uiapp.Application

TransactionManager.Instance.EnsureInTransaction(doc)

for i in range(len(list1)):
	elem.SetParameterByName(list1[i],list2[i])
	
	
TransactionManager.Instance.TransactionTaskDone()
doc.Regenerate()

#Assign your output to the OUT variable.
OUT = 0
# ----------------------------------------
python_script_2 = Python(IN[0]=select_model_element, IN[1]=code_block_7, IN[2]=create_2)  # same code as python_script
