# Dynamo graph ISOLATED FOUNDATION EXCAVATION.dyn (Dynamo 0.9.1.4062)

string = StringInput("OST_StructuralFoundation")
byName = Category.ByName(string)
all_elements_of_category = ElementsOfCategory(byName)
facingOrientation = FamilyInstance.FacingOrientation(all_elements_of_category)
XAxis = Vector.XAxis()
angleBetween = Vector.AngleBetween(facingOrientation, XAxis)

# group: Radian to Degree
number = DoubleInput(57.296)
mul = angleBetween * number

watch = Watch(mul)
excavate_hole_family_type_name = StringInput("Excavate Hole-Taluy")
byName_2 = FamilyType.ByName(excavate_hole_family_type_name)
location = FamilyInstance.Location(all_elements_of_category)
X = Point.X(location)
Y = Point.Y(location)
level_of_nature_ground_soil = Levels("Exc LV")  # "Level of Nature Ground Soil Surface"
elevation = Level.Elevation(level_of_nature_ground_soil)

# group: foundation parameter value
code_block = CodeBlock { "Elevation at Top"; "Elevation at Bottom"; "Width"; "Length"; }
getParameterValueByName = Element.GetParameterValueByName(element=all_elements_of_category, parameterName=code_block.out0)
getParameterValueByName_2 = Element.GetParameterValueByName(element=all_elements_of_category, parameterName=code_block.out1)
sub = elevation - getParameterValueByName_2
getParameterValueByName_3 = Element.GetParameterValueByName(element=all_elements_of_category, parameterName=code_block.out2)
getParameterValueByName_4 = Element.GetParameterValueByName(element=all_elements_of_category, parameterName=code_block.out3)
id = Element.Id(all_elements_of_category)

byCoordinates = Point.ByCoordinates(x=X, y=Y, z=elevation)
byPoint = FamilyInstance.ByPoint(familyType=byName_2, point=byCoordinates)
code_block_2 = CodeBlock(elems=byPoint) { elems; }
code_block_3 = CodeBlock { "Height"; "Width"; "Length"; }
setParameterByName = Element.SetParameterByName(element=code_block_2, parameterName=code_block_3.out0, value=sub)
setParameterByName_2 = Element.SetParameterByName(element=setParameterByName, parameterName=code_block_3.out1, value=getParameterValueByName_3)
setParameterByName_3 = Element.SetParameterByName(element=setParameterByName_2, parameterName=code_block_3.out2, value=getParameterValueByName_4)
python_script = Python(IN[0]=all_elements_of_category)
# ---------- python_script.python (19 lines) ----------
import clr
clr.AddReference('ProtoGeometry')
from Autodesk.DesignScript.Geometry import *
clr.AddReference('RevitAPI')
from Autodesk.Revit.DB import *
#The inputs to this node will be stored as a list in the IN variables.
dataEnteringNode = IN

elems = UnwrapElement(IN[0])
results = []
#if listcount = 1

#if listcount > 1
for i in range(len(elems)):
	rot = round(elems[i].Location.Rotation * 57.2957795,0)
	results.append(rot)

#Assign your output to the OUT variable.
OUT = results
# ----------------------------------------
code_block_4 = CodeBlock(a=python_script) { 0-a; }
setRotation = FamilyInstance.SetRotation(familyInstance=code_block_2, degree=code_block_4)
code_block_5 = CodeBlock(list=setParameterByName) { list[0]; }
parameters = Element.Parameters(code_block_5)
watch_2 = Watch(parameters)
code_block_6 = CodeBlock(list=all_elements_of_category) { list[0]; }
parameters_2 = Element.Parameters(code_block_6)
watch_3 = Watch(parameters_2)
file_path = Filename("C:\Users\USER\Documents\MARUBENI COFFEE\BIM QTO\Dynamo Data-Foundation.xlsx")
fromPath = FileObject(file_path)  # "File.FromPath"
sheet_name = StringInput("Excavation")
code_block_7 = CodeBlock()
# ---------- code_block_7.designscript (2 lines) ----------
3;
//start row #
# ----------------------------------------
code_block_8 = CodeBlock()
# ---------- code_block_8.designscript (24 lines) ----------
0;
//ids;
1;
//hostIds1;
2;
//trackingHostIds1;
3;
//gfElevations;
4;
//taluyAngles;
5;
//volumePrims;
6;
//volumeJoined;
7;
//impBFPrimi;
8;
//impBFMerged;
9;
//impTF;
10;
//impMerged;
11;
//volumeBF;
# ----------------------------------------
overwrite = BoolSelector(false)

# group: Excavation Hole Param value
code_block_9 = CodeBlock()
# ---------- code_block_9.designscript (10 lines) ----------
"HostID1";
"TrackingHostID1";
"ExcavationTaluyAngleToX";
"VolumeExcavatedSoilPrimitive";
"VolumeExcavatedSoilMerged";
"VolumeBackfillSoil";
"AreaBOFImpactmentPrimitive";
"AreaBOFImpactmentMerged";
"AreaTOESImpactmentPrimitive";
"AreaTOESImpactmentMerged";
# ----------------------------------------
code_block_10 = CodeBlock { "Offset"; }

setParameterByName_4 = Element.SetParameterByName(element=code_block_2, parameterName=code_block_9.out0, value=id)
setParameterByName_5 = Element.SetParameterByName(element=setParameterByName_4, parameterName=code_block_9.out1, value=id)
solids = Element.Solids(setParameterByName_5)
python_script_unionall = Python(IN[0]=solids)
# ---------- python_script_unionall.python (16 lines) ----------
import clr
clr.AddReference('ProtoGeometry')
from Autodesk.DesignScript.Geometry import *
#The inputs to this node will be stored as a list in the IN variables.
dataEnteringNode = IN
listSol = IN[0]

newlist = []
for list in listSol:
	
	sol = list[0]
	union = sol.UnionAll(list)
	newlist.append(union)
		
#Assign your output to the OUT variable.
OUT = newlist
# ----------------------------------------
volume = Solid.Volume(python_script_unionall)
code_block_11 = CodeBlock { 1000000000; }
div = volume / code_block_11
element_setparameterbyname = Element.SetParameterByName(element=setParameterByName_5, parameterName=code_block_9.out3, value=div)  # "Element.SetParameterByName-v3ExcSoilPrimi"
solids_2 = Element.Solids(all_elements_of_category)
python_script_unionall_2 = Python(IN[0]=solids_2)  # same code as python_script_unionall
difference = Solid.Difference(solid=python_script_unionall, other=python_script_unionall_2)
volume_2 = Solid.Volume(difference)
div_2 = volume_2 / code_block_11
element_setparameterbyname_2 = Element.SetParameterByName(element=element_setparameterbyname, parameterName=code_block_9.out5, value=div_2)  # "Element.SetParameterByName-v3BackfillPrimi"
code_block_12 = CodeBlock(elemFinishModified=element_setparameterbyname_2) { elemFinishModified; }

# group (continued): Excavation Hole Param value
code_block_13 = CodeBlock(elems=code_block_12) { elems; }
id_2 = Element.Id(code_block_13)
code_block_14 = CodeBlock(elem=code_block_13, paramName=code_block_9.out0) { value = elem.GetParameterValueByName(paramName); }
code_block_15 = CodeBlock(elem=code_block_13, paramName=code_block_9.out1) { value = elem.GetParameterValueByName(paramName); }
code_block_16 = CodeBlock(elem=code_block_13, paramName=code_block_9.out2) { value = elem.GetParameterValueByName(paramName); }

code_block_17 = CodeBlock(elem=code_block_13, paramName=code_block_10) { value = elem.GetParameterValueByName(paramName); }
code_block_18 = CodeBlock(elem=code_block_13, paramName=code_block_9.out3) { value = elem.GetParameterValueByName(paramName); }
code_block_19 = CodeBlock(elem=code_block_13, paramName=code_block_9.out4) { value = elem.GetParameterValueByName(paramName); }
code_block_20 = CodeBlock(elem=code_block_13, paramName=code_block_9.out6) { value = elem.GetParameterValueByName(paramName); }
code_block_21 = CodeBlock(elem=code_block_13, paramName=code_block_9.out7) { value = elem.GetParameterValueByName(paramName); }
code_block_22 = CodeBlock(elem=code_block_13, paramName=code_block_9.out8) { value = elem.GetParameterValueByName(paramName); }
code_block_23 = CodeBlock(elem=code_block_13, paramName=code_block_9.out9) { value = elem.GetParameterValueByName(paramName); }
code_block_24 = CodeBlock(elem=code_block_13, paramName=code_block_9.out5) { value = elem.GetParameterValueByName(paramName); }
data = CodeBlock(ids=id_2, hostIds1=code_block_14, trackingHostIds1=code_block_15, gfElevations=code_block_17, taluyAngles=code_block_16, volumePrims=code_block_18, volumemerged=code_block_19, impBFprimi=code_block_20, impBFmerged=code_block_21, impTFprimi=code_block_22, impTFmerged=code_block_23, volumeBF=code_block_24)
# ---------- data.designscript (12 lines) ----------
ids;
hostIds1;
trackingHostIds1;
gfElevations;
taluyAngles;
volumePrims;
volumemerged;
impBFprimi;
impBFmerged;
impTFprimi;
impTFmerged;
volumeBF;
# ----------------------------------------
code_block_25 = CodeBlock(sheetname=sheet_name, row=code_block_7, col=code_block_8.out0, override=overwrite, file=file_path, data=data.ids) { sheetname; row; col; override; t6 = Excel.WriteToFile(file, sheetname, row, col, data, override); }
code_block_26 = CodeBlock()
# ---------- code_block_26.designscript (4 lines) ----------
3;
//start row #
0;
//start column #
# ----------------------------------------
boolean = BoolSelector(false)
writeToFile = Excel.WriteToFile(filePath=fromPath, sheetName=code_block_25.row, startRow=code_block_26.out0, startCol=code_block_26.out1, overWrite=boolean)  # frozen
getParameterValueByName_5 = Element.GetParameterValueByName(element=code_block_12, parameterName=code_block_9.out2)
watch_4 = Watch(data.ids)
code_block_27 = CodeBlock(sheetname=sheet_name, row=code_block_7, col=code_block_8.out1, override=overwrite, file=file_path, data=data.hostIds1) { sheetname; row; col; override; t6 = Excel.WriteToFile(file, sheetname, row, col, data, override); }
code_block_28 = CodeBlock(sheetname=sheet_name, row=code_block_7, col=code_block_8.out3, override=overwrite, file=file_path, data=data.gfElevations) { sheetname; row; col; override; t6 = Excel.WriteToFile(file, sheetname, row, col, data, override); }
code_block_29 = CodeBlock(sheetname=sheet_name, row=code_block_7, col=code_block_8.out2, override=overwrite, file=file_path, data=data.trackingHostIds1) { sheetname; row; col; override; t6 = Excel.WriteToFile(file, sheetname, row, col, data, override); }
code_block_30 = CodeBlock(sheetname=sheet_name, row=code_block_7, col=code_block_8.out7, override=overwrite, file=file_path, data=data.impBFprimi) { sheetname; row; col; override; t6 = Excel.WriteToFile(file, sheetname, row, col, data, override); }
code_block_31 = CodeBlock(sheetname=sheet_name, row=code_block_7, col=code_block_8.out6, override=overwrite, file=file_path, data=data.volumemerged) { sheetname; row; col; override; t6 = Excel.WriteToFile(file, sheetname, row, col, data, override); }
code_block_32 = CodeBlock(sheetname=sheet_name, row=code_block_7, col=code_block_8.out5, override=overwrite, file=file_path, data=data.volumePrims) { sheetname; row; col; override; t6 = Excel.WriteToFile(file, sheetname, row, col, data, override); }
code_block_33 = CodeBlock(sheetname=sheet_name, row=code_block_7, col=code_block_8.out4, override=overwrite, file=file_path, data=data.taluyAngles) { sheetname; row; col; override; t6 = Excel.WriteToFile(file, sheetname, row, col, data, override); }
code_block_34 = CodeBlock(sheetname=sheet_name, row=code_block_7, col=code_block_8.out9, override=overwrite, file=file_path, data=data.impTFprimi) { sheetname; row; col; override; t6 = Excel.WriteToFile(file, sheetname, row, col, data, override); }
code_block_35 = CodeBlock(sheetname=sheet_name, row=code_block_7, col=code_block_8.out8, override=overwrite, file=file_path, data=data.impBFmerged) { sheetname; row; col; override; t6 = Excel.WriteToFile(file, sheetname, row, col, data, override); }
code_block_36 = CodeBlock(sheetname=sheet_name, row=code_block_7, col=code_block_8.out11, override=overwrite, file=file_path, data=data.volumeBF) { sheetname; row; col; override; t6 = Excel.WriteToFile(file, sheetname, row, col, data, override); }
code_block_37 = CodeBlock(sheetname=sheet_name, row=code_block_7, col=code_block_8.out10, override=overwrite, file=file_path, data=data.impTFmerged) { sheetname; row; col; override; t6 = Excel.WriteToFile(file, sheetname, row, col, data, override); }
