# Dynamo graph Parameter Control (Read Write).dyn (Dynamo 0.9.1.4062)

select_model_elements = DSModelElementsSelection()  # 5 picked in the model
parameters = Element.Parameters(select_model_elements)
watch = Watch(parameters)
code_block = CodeBlock(l=parameters) { l[0][8]; }
watch_2 = Watch(code_block)
file_path = Filename("R:\BimESC\01_PROJECTS\VUNGTAU19\05-Wip\Mass Surface Parameter.xlsx")
string = StringInput("Sheet1")
code_block_2 = CodeBlock { 0; 1; 7; }
string_from_object = FromObject(parameters)
string_2 = StringInput(" : ")
lastIndexOf = String.LastIndexOf(string_from_object, string_2)
code_block_3 = CodeBlock(a=lastIndexOf, s=string_from_object) { 0; l = a; m = a+3; n = String.Length(s)-(a+3); }
param_names = String.Substring(str=string_from_object, startIndex=code_block_3.out0, length=code_block_3.l)
boolean = BoolSelector(true)
writeToFile = Excel.WriteToFile(filePath=file_path, sheetName=string, startRow=code_block_2.out0, startCol=code_block_2.out0, data=param_names, overWrite=boolean)
param_values = String.Substring(str=string_from_object, startIndex=code_block_3.m, length=code_block_3.n)
string_from_object_2 = FromObject(file_path)
create = List.Create(param_names, param_values)
transpose = List.Transpose(create)
python_script = Python(IN[0]=param_names, IN[1]=param_values, IN[2]=string_from_object_2, IN[3]=transpose)  # frozen
# ---------- python_script.python (42 lines) ----------
import array as arr
import clr
clr.AddReference('ProtoGeometry')
from Autodesk.DesignScript.Geometry import *
clr.AddReference('DSOffice')
from DSOffice.Excel import *
#from DSOffice.WorkSheet import *
#The inputs to this node will be stored as a list in the IN variables.
dataEnteringNode = IN
list1 = IN[0]
list2 = IN[1]

filepath = IN[2]
list3 = IN[3]

s = 'None';
res = []

listW = []

for i in range(len(list1)):
	lww = []
	for j in range(len(list1[i])):
		if list1[i][j] == "Mark":			
			res.append(list2[i][j])
			
		lw = []
		lw.append(list1[i][j])
		lw.append(list2[i][j])
		
		lww.append(lw)
	listW.append(lww)
	

for k in range(len(res)):
	w = WriteToFile(filepath,res[k],0,0,list3[k],True)
#	for m in range(len(listW[k])):
#		w = WriteToFile(filepath,res[k],0,0,arr.array(listW[k][m]),True)

	
#Assign your output to the OUT variable.
OUT = listW,res
# ----------------------------------------
string_3 = StringInput("Sheet4")
python_script_2 = Python(IN[0]=param_names, IN[1]=param_values)
# ---------- python_script_2.python (16 lines) ----------
import clr
clr.AddReference('ProtoGeometry')
from Autodesk.DesignScript.Geometry import *
#The inputs to this node will be stored as a list in the IN variables.
dataEnteringNode = IN
list1 = IN[0]
list2 = IN[1]

res = []

for i in range(len(list1)):
	for j in range(len(list1[i])):
		if list1[i][j] == "Mark":
			res.append(list2[i][j])
#Assign your output to the OUT variable.
OUT = res
# ----------------------------------------
create_2 = List.Create(python_script_2)
writeToFile_2 = Excel.WriteToFile(filePath=file_path, sheetName=string_3, startRow=code_block_2.out2, startCol=code_block_2.out1, data=create_2)
string_4 = StringInput("Sheet1a")
writeToFile_3 = Excel.WriteToFile(filePath=file_path, sheetName=string_4, startRow=code_block_2.out0, startCol=code_block_2.out0, data=param_values, overWrite=boolean)
