# Dynamo graph Wall by Mass Floor.dyn (Dynamo 0.9.1.4062)

wall_height = DoubleInput(3000)
wall_type = StringInput("VT19-W2-1-250mm-Aluminium-Glass")
byName = WallType.ByName(wall_type)
byCurveAndHeight = Wall.ByCurveAndHeight(height=wall_height, wallType=byName)
byCurveAndLevels = Wall.ByCurveAndLevels(arg3=byName)
select_model_elements = DSModelElementsSelection()
code_block = CodeBlock(a=select_model_elements) { a[0]; }
parameters = Element.Parameters(code_block)
param_name = StringInput("Level")
getParameterValueByName = Element.GetParameterValueByName(element=code_block, parameterName=param_name)
parameters_2 = Element.Parameters(getParameterValueByName)
