# Dynamo graph 180802 Create Filter from Selected Element.dyn (Dynamo 0.9.1.4062)

select_model_elements = DSModelElementsSelection()  # 1 picked in the model
select_model_element = DSModelElementSelection()  # 1 picked in the model
python_script = Python(IN[0]=select_model_element)
# ---------- python_script.python (55 lines) ----------
import clr
clr.AddReference('ProtoGeometry')
from Autodesk.DesignScript.Geometry import *
clr.AddReference('RevitAPI')
from Autodesk.Revit.DB import *
clr.AddReference('RevitAPIUI')
from Autodesk.Revit.UI import TaskDialog
clr.AddReference("RevitNodes")
import Revit
clr.ImportExtensions(Revit.Elements)
clr.AddReference("RevitServices")
import RevitServices
from RevitServices.Persistence import DocumentManager
from RevitServices.Transactions import TransactionManager
from System.Collections.Generic import *
clr.ImportExtensions(Revit.GeometryConversion)
 
doc = DocumentManager.Instance.CurrentDBDocument
uiapp = DocumentManager.Instance.CurrentUIApplication
app = uiapp.Application
 
import sys
import System
import Autodesk.Revit.DB.JoinGeometryUtils as JGU # de Join 

import Autodesk.Revit.DB.SelectionFilterElement as SFE

#The inputs to this node will be stored as a list in the IN variables.
dataEnteringNode = IN

elem = UnwrapElement(IN[0])

catName = elem.Category.Name.ToString()
typeName = elem.Name.ToString()
filterName = catName + "-" + typeName

btCat = BuiltInCategory.OST_+catName

filteredElems = FilteredElementCollector(doc).OfCategory(btCat).WhereElementIsNotElementType().ToElements()


# Start Transaction
TransactionManager.Instance.EnsureInTransaction(doc)
try:
	#process here
	filterElement = SFE.Create(doc,filterName)
except:
    pass
 
# End Transaction
TransactionManager.Instance.TransactionTaskDone()
doc.Regenerate()

#Assign your output to the OUT variable.
OUT = filteredElems
# ----------------------------------------
