# Dynamo graph 180807 Element Intersect Filter.dyn (Dynamo 0.9.1.4062)

select_model_elements = DSModelElementsSelection()  # 2 picked in the model
python_script = Python(IN[0]=select_model_elements)
# ---------- python_script.python (38 lines) ----------
import clr
clr.AddReference('ProtoGeometry')
from Autodesk.DesignScript.Geometry import *
clr.AddReference('RevitAPI')
from Autodesk.Revit.DB import *
clr.AddReference('RevitAPIUI')
from Autodesk.Revit.UI import TaskDialog
clr.AddReference("RevitNodes")
import Revit
clr.ImportExtensions(Revit.Elements)
clr.AddReference("RevitServices")
import RevitServices
from RevitServices.Persistence import DocumentManager
from RevitServices.Transactions import TransactionManager
from System.Collections.Generic import *
clr.ImportExtensions(Revit.GeometryConversion)
 
doc = DocumentManager.Instance.CurrentDBDocument
uiapp = DocumentManager.Instance.CurrentUIApplication
app = uiapp.Application
 
import sys
import System
import Autodesk.Revit.DB.JoinGeometryUtils as JGU # de Join 


#The inputs to this node will be stored as a list in the IN variables.
dataEnteringNode = IN
e = UnwrapElement(IN[0])

res = []

EIEF = ElementIntersectsElementFilter(e[0])
ee = FilteredElementCollector(doc).WherePasses(EIEF).ToElements()
res.append(ee)
	
#Assign your output to the OUT variable.
OUT = res
# ----------------------------------------
