# Dynamo graph WALL JOIN -JOIN TYPE-MITTER-2.0.dyn (Dynamo 0.8.2.2392)

select_model_elements = DSModelElementsSelection()  # 4 picked in the model
number = DoubleInput(0)
number_2 = DoubleInput(1)
number_3 = DoubleInput(1)
number_range = NumberRange(number, number_2, number_3, lacing=CrossProduct)
python_script = Python(IN[0]=select_model_elements, IN[1]=number_range)
# ---------- python_script.python (26 lines) ----------
import clr

clr.AddReference("RevitServices")
import RevitServices
from RevitServices.Persistence import DocumentManager
from RevitServices.Transactions import TransactionManager
doc = DocumentManager.Instance.CurrentDBDocument

clr.AddReference("RevitAPI")
from Autodesk.Revit.DB import JoinType

for wall1 in UnwrapElement(IN[0]):
	TransactionManager.Instance.EnsureInTransaction(doc)

	wallc=wall1.Location
	
	for corner in IN[1]:
		join1=wallc.set_JoinType(corner,JoinType.Miter)
	
		
TransactionManager.Instance.TransactionTaskDone()
	
if wallc.get_JoinType(corner) == JoinType.Miter:
	OUT = True
else:
	OUT = False
# ----------------------------------------
watch = Watch(python_script)
