# Dynamo graph WALL JOIN -JOIN TYPE.dyn (Dynamo 0.8.2.2392)

select_model_elements = DSModelElementsSelection()
python_script = Python(IN[0]=select_model_elements)
# ---------- python_script.python (18 lines) ----------
import clr

clr.AddReference("RevitServices")
import RevitServices
from RevitServices.Persistence import DocumentManager
from RevitServices.Transactions import TransactionManager
doc = DocumentManager.Instance.CurrentDBDocument

clr.AddReference("RevitAPI")
from Autodesk.Revit.DB import LocationCurve

for wall1 in UnwrapElement(IN[0])

	TransactionManager.Instance.EnsureInTransaction(doc)

	OUT = LocationCurve.JoinType(wall1,JoinType.Mitter)
	
TransactionManager.Instance.TransactionTaskDone()
# ----------------------------------------
number = DoubleInput(0)
number_2 = DoubleInput(1)
number_3 = DoubleInput(1)
number_range = NumberRange(number, number_2, number_3, lacing=CrossProduct)
