# Dynamo graph WALL JOIN.dyn (Dynamo 0.8.2.2392)

select_model_elements = DSModelElementsSelection()  # 2 picked in the model
number = DoubleInput(0)
number_2 = DoubleInput(1)
number_3 = DoubleInput(1)
number_range = NumberRange(number, number_2, number_3, lacing=CrossProduct)
python_script = Python(IN[0]=select_model_elements, IN[1]=number_range)
# ---------- python_script.python (19 lines) ----------
import clr

clr.AddReference("RevitServices")
import RevitServices
from RevitServices.Persistence import DocumentManager
from RevitServices.Transactions import TransactionManager
doc = DocumentManager.Instance.CurrentDBDocument

clr.AddReference("RevitAPI")
from Autodesk.Revit.DB import WallUtils

wall1 = UnwrapElement(IN[0])

TransactionManager.Instance.EnsureInTransaction(doc)
for corner in IN[1]:
	for wall1 in UnwrapElement(IN[0]):
		OUT = WallUtils.DisallowWallJoinAtEnd(wall1,corner)
	
TransactionManager.Instance.TransactionTaskDone()
# ----------------------------------------
