# Dynamo graph _Geometry 1.dyn (Dynamo 0.9.1.4062)

code_block = CodeBlock { 0; 5000; }
byCoordinates = Point.ByCoordinates(x=code_block.out0, y=code_block.out0)
byOrigin = CoordinateSystem.ByOrigin(x=code_block.out0, y=code_block.out0)
byWidthLength = Rectangle.ByWidthLength(cs=byOrigin, width=code_block.out1, length=code_block.out1)
explode = Geometry.Explode(byWidthLength)
startPoint = Curve.StartPoint(explode)
byPerimeterPoints = Surface.ByPerimeterPoints(startPoint)
ZAxis = Vector.ZAxis()
translate = Geometry.Translate(geometry=byWidthLength, direction=ZAxis, distance=code_block.out1)
explode_2 = Geometry.Explode(translate)
startPoint_2 = Curve.StartPoint(explode_2)
code_block_2 = CodeBlock(points=startPoint_2) { points; }
code_block_3 = CodeBlock(p=startPoint_2) { i1 = 1; i3 = 3; p1 = p[i1]; p3 = p[i3]; }
code_block_4 = CodeBlock { -500; -2000; }
translate_2 = Geometry.Translate(geometry=code_block_3.p1, direction=ZAxis, distance=code_block_4.out0)
replaceItemAtIndex = List.ReplaceItemAtIndex(list=code_block_2, index=code_block_3.i1, item=translate_2)
translate_3 = Geometry.Translate(geometry=code_block_3.p3, direction=ZAxis, distance=code_block_4.out1)
replaceItemAtIndex_2 = List.ReplaceItemAtIndex(list=replaceItemAtIndex, index=code_block_3.i3, item=translate_3)
code_block_5 = CodeBlock(newStartPoints=replaceItemAtIndex_2) { newStartPoints; }
byPerimeterPoints_2 = Surface.ByPerimeterPoints(code_block_5)
code_block_6 = CodeBlock(topSurface=byPerimeterPoints, bottomSurface=byPerimeterPoints_2) { topSurface; bottomSurface; }
explode_3 = Geometry.Explode(code_block_6.topSurface)
perimeterCurves = Surface.PerimeterCurves(explode_3)
flatten = Flatten(perimeterCurves)
explode_4 = Geometry.Explode(code_block_6.bottomSurface)
perimeterCurves_2 = Surface.PerimeterCurves(explode_4)
flatten_2 = Flatten(perimeterCurves_2)
create = List.Create(flatten, flatten_2)
transpose = List.Transpose(create)
byLoft = Surface.ByLoft(transpose)
create_2 = List.Create(code_block_6.topSurface, code_block_6.bottomSurface, byLoft)
flatten_3 = Flatten(create_2)
byJoinedSurfaces = Solid.ByJoinedSurfaces(flatten_3)
volume = Solid.Volume(byJoinedSurfaces)
