# Dynamo graph _Import Module Numpy Vectormath.dyn (Dynamo 0.9.1.4062)

python_script = Python()
# ---------- python_script.python (16 lines) ----------
import clr
clr.AddReference('ProtoGeometry')
from Autodesk.DesignScript.Geometry import *


import sys
sys.path.append(r'C:\Users\USER\AppData\Local\Programs\Python\Python38-32\Lib\site-packages')

import numpy as np
import vectormath as vmath

#The inputs to this node will be stored as a list in the IN variables.
dataEnteringNode = IN

#Assign your output to the OUT variable.
OUT = 0
# ----------------------------------------
